# Grasshopper definition Feasibility Analysis Calculator 0.3.3.gh (Grasshopper 1.0.7)
# plug-ins: Human, LunchBox

# Notes to Improve per Angie 23 0413:
# 
# 1. Mix used setbacks vs Residential setbakcs.
# 
# 2. Work with limits first, zoning limits create the criteria we should work on.
# 
# 3. Residnetial and Commerical have different FAR calculations. Residential is by buildable area while commerical is by site area.
lot_corner_point = Point(Point(0, 0, 0))

# ---- group: Get Building Outline
building_outline = Curve(<curve referenced from the Rhino model>)

# ---- group: Reads Curve Geometry
property_boundary = Curve(<curve referenced from the Rhino model>)

# ----
false_gh_property_input_true_curve_prope = BooleanToggle(True)  # "False = GH Property Input | True = Curve Property Input"
false_by_setbacks_true_by_sketch = BooleanToggle(True)
write_to_excel = BooleanToggle(False)
clear_excel_table = BooleanToggle(False)
parking_coefficient = DigitScroller(Scroller_Digits=12, Scroller_Prefix="Parking Coefficient", Scroller_Radix=11, Scroller_Value=0.5)
parking_gross_area = DigitScroller(Scroller_Digits=12, Scroller_Prefix="Parking Gross Area", Scroller_Radix=11, Scroller_Value=600)
lot_width = Slider(110, range=0..1000)
lot_length = Slider(60, range=0..1000)
front_stbk = Slider(2, range=0..20)

# ---- group: Note: Review also with Fire
# Note: Per LA review Fire well.
side_stbk = Slider(5, range=0..20)

# ----
rear_stbk = Slider(17, range=0..20)
far = DigitScroller(Scroller_Digits=12, Scroller_Prefix="FAR", Scroller_Radix=11, Scroller_Value=3)
story_height = DigitScroller(Scroller_Digits=12, Scroller_Prefix="Story Height", Scroller_Radix=11, Scroller_Value=10)
unit_density = DigitScroller(Scroller_Digits=12, Scroller_Prefix="Unit Density", Scroller_Radix=11, Scroller_Value=800)
max_height = DigitScroller(Scroller_Digits=12, Scroller_Prefix="Max Height", Scroller_Radix=11, Scroller_Value=75)
parking_levels = DigitScroller(Scroller_Digits=12, Scroller_Prefix="Parking Levels", Scroller_Radix=11, Scroller_Value=2)
select_front_property_line = Slider(3, range=0..3)
dedicated_parking_area = Curve(property_boundary)

input_front_setback = Number(front_stbk)
input_side_setback = Number(side_stbk)
input_rear_setback = Number(rear_stbk)

# ---- group: Creates Rectangle
dom = ConstructDomain(DomainStart=0, DomainEnd=lot_width)
dom_2 = ConstructDomain(DomainStart=0, DomainEnd=lot_length)
rectangle = Rectangle(Plane=lot_corner_point, XSize=dom, YSize=dom_2, Radius=0)  # -> Rectangle, Length

# ----
filter = StreamFilter(Gate=false_gh_property_input_true_curve_prope, Stream0=rectangle.Rectangle, Stream1=property_boundary)
filter_2 = StreamFilter(Gate=false_gh_property_input_true_curve_prope, Stream0=rectangle.Rectangle, Stream1=dedicated_parking_area)
property_boundary_2 = Curve(filter)

# ---- group: Calculate Lot Area
area = Area(Geometry=property_boundary_2)  # -> Area, Centroid

# ----
lot_area = Panel(area.Area)

# ---- group: Get Property Lines
debrep = DeconstructBrep(Brep=property_boundary_2)  # -> Faces, Edges, Vertices
item = ListItem(List=debrep.Edges, Index=select_front_property_line, Wrap=True)  # -> Item, Item1, Item2, Item3

# ----
side_02 = Curve(item.Item3)
front = Curve(item.Item)
side_01 = Curve(item.Item1)
rear = Curve(item.Item2)

# ---- group: Calculates Buildable Area
input_side_setback_2 = Number(input_side_setback)
input_front_setback_2 = Number(input_front_setback)
input_rear_setback_2 = Number(input_rear_setback)

# ---- group: Calculates Buildable Area / Get Yards
getyard = GetYard(property_boundary=property_boundary_2, C=rear, D=input_rear_setback_2)
getyard_2 = GetYard(property_boundary=property_boundary_2, C=front, D=input_front_setback_2)
getyard_3 = GetYard(property_boundary=property_boundary_2, C=side_01, D=input_side_setback_2)
getyard_4 = GetYard(property_boundary=property_boundary_2, C=side_02, D=input_side_setback_2)

# ---- group: Calculates Buildable Area / Get Buildable Area
yard = Curve(getyard_4)
yard_2 = Curve(getyard_2)
yard_3 = Curve(getyard_3)
yard_4 = Curve(getyard)
llx = LineLine(Line1=yard_2, Line2=yard_3)  # -> ParamA, ParamB, PointA, PointB
llx_2 = LineLine(Line1=yard_2, Line2=yard)  # -> ParamA, ParamB, PointA, PointB
llx_3 = LineLine(Line1=yard_3, Line2=yard_4)  # -> ParamA, ParamB, PointA, PointB
llx_4 = LineLine(Line1=yard, Line2=yard_4)  # -> ParamA, ParamB, PointA, PointB
srf4pt = _4PointSurface(CornerA=llx.PointA, CornerB=llx_2.PointA, CornerC=llx_4.PointA, CornerD=llx_3.PointA)

# ----
buildable_area = Surface(srf4pt)
filter_3 = StreamFilter(Gate=false_by_setbacks_true_by_sketch, Stream0=buildable_area, Stream1=building_outline)
area_2 = Area(Geometry=buildable_area)  # -> Area, Centroid
# Residential = Buildable Area
# Commercial = Site Area
buildable_area_area_within_setbacks = Panel(area_2.Area)

# ---- group: Buildable Area for Calculation
area_3 = Area(Geometry=filter_3)  # -> Area, Centroid

# ---- group: Stories
no_of_stories = Expression(
    FAR=far,
    Buildable_Area=buildable_area_area_within_setbacks,
    Lot_Area=lot_area,
    Buildable_Footprint=area_3.Area,
    Expression="Floor(Round((FAR*Buildable_Area))/Buildable_Footprint)")

# ----
stories = Integer(no_of_stories)
expression = Expression(No_Stories=stories, Story_Height=story_height, Expression="No_Stories * Story_Height")
python = GhPythonScript(assumed_height=expression, allowable_height=max_height, stories=stories, typ_floor_height=story_height)  # -> height, stories, typ_floor_height
# ---------- python: Python ----------
__author__ = "ilouh"
__version__ = "2023.02.21"

import rhinoscriptsyntax as rs
import Grasshopper as gh
import Rhino.Geometry as rg
import ghpythonlib.components as comps
import math

if assumed_height < allowable_height:
    
    height = assumed_height
    stories = stories

else:
    
    height = allowable_height
    stories = math.floor(height/typ_floor_height)

typ_floor_height = round(height/stories,2)
# ---------- end python ----------

building_height = Number(python.height)
output_no_of_underground_parking_levels = Number(parking_levels)
input_story = Number(python.typ_floor_height)

panel = Panel("""Keys
Values""")
Z = UnitZ(Factor=building_height)
extr = Extrude(Base=filter_3, Direction=Z)
Z_2 = UnitZ(Factor=-0.25)
building_envelope = Brep(extr)
contour = Contour(Shape=building_envelope, Point=Point(0, 0, 0), Direction=Vector(0, 0, 1), Distance=input_story)
path = FilePath("G:\My Drive\Scripting Repository\Exchange Data\Feasibility_Analysis_Workbook.xlsx")
cap = CapHoles(Brep=building_envelope)
material = CreateMaterial(
    Diffuse=ColourSwatch(SwatchColor=RGB(59, 192, 91)),
    Specular=ColourSwatch(SwatchColor=RGB(162, 238, 91)),
    Emission=ColourSwatch(SwatchColor=RGB(179, 84, 91)),
    Transparency=0,
    Shine=0)
setbacks = Curve([yard_2, yard_3, yard, yard_4])

# ---- group: Output - Building Massing
massing_envelope = Brep(cap)

# ---- group: Output - Floors as Curves
floors = Curve(contour)

# ----
preview = CustomPreview(Geometry=cap, Material=ColourSwatch(SwatchColor=RGB(93, 189, 192)))
previewlw = CustomPreviewLineweights(
    Geometry=setbacks,
    Shader={diffuse=RGB(255, 105, 180), emission=RGB(76, 32, 54), shine=0.5, specular=RGB(255, 255, 255), transparency=0},
    Absolute=False)
output = DataOutput(
    DataInput=setbacks,
    Destination="G:\My Drive\Scripting Repository\Exchange Data\Setbacks.ghdata",
    RelativePath="G:\My Drive\Scripting Repository\Exchange Data\Setbacks.ghdata|..\..\Exchange Data\Setbacks.ghdata")
output_2 = DataOutput(
    DataInput=massing_envelope,
    Destination="G:\My Drive\Scripting Repository\Exchange Data\Mass.ghdata",
    RelativePath="G:\My Drive\Scripting Repository\Exchange Data\Mass.ghdata|..\..\Exchange Data\Mass.ghdata")

# ---- group: Extrudes Parking Lot
output_no_of_underground_parking_levels_2 = Number(output_no_of_underground_parking_levels)
input_story_2 = Number(input_story)
parking_boundary = Curve(filter_2)

# ----
area_4 = Area(Geometry=parking_boundary)  # -> Area, Centroid
dedicated_parking_area_2 = Panel(area_4.Area)
python_2 = GhPythonScript(
    Lot_Area=lot_area,
    Buildable_Area=buildable_area_area_within_setbacks,
    FAR=far,
    Stories=python.stories,
    Building_Height=python.height,
    Unit_Density=unit_density,
    Dedicated_Parking_Area=dedicated_parking_area_2,
    Underground_Parking_Levels=parking_levels,
    Parking_Coefficient=parking_coefficient,
    Parking_Stall_Gross_Area=parking_gross_area,
    Building_footprint_area=area_3.Area)  # -> keys, values
# ---------- python_2: Python ----------
__author__ = "ilouh"
__version__ = "2023.02.20"

import rhinoscriptsyntax as rs
import math
import Rhino as rc


Number_Of_Units = round((Lot_Area / Unit_Density),2)
Avg_Unit_Size = round((round((Buildable_Area * Stories),2) / Number_Of_Units),2)
Number_Of_Parking_Stalls = Number_Of_Units * Parking_Coefficient
Parking_Gross_Area = Number_Of_Parking_Stalls * Parking_Stall_Gross_Area
Parking_Levels = math.ceil(Parking_Gross_Area / Dedicated_Parking_Area)
Building_footprint_area = round(Building_footprint_area,2)

dic = {

    "BI_Lot_Area": Lot_Area,
    "BI_Buildable_Area": round(Buildable_Area,2),
    "BI_Maximum_Building_Area": round((Buildable_Area * FAR),2),
    "BI_Gross_Floor_Area": round((Building_footprint_area * Stories),2),
    "BI_Number_Of_Stories": Stories,
    "BI_Building_Height": Building_Height,
    "BI_Lot_Coverage": round((Buildable_Area / Lot_Area),2),
    "UI_Number_Of_Units": Number_Of_Units,
    "UI_Average_Unit_Size": Avg_Unit_Size,
    "UI_Net_Rentable_SF": round((Number_Of_Units * Avg_Unit_Size),2),
    "PI_Total_Number_of_Parking_Stalls": Number_Of_Parking_Stalls,
    "PI_Parking_Ratio": Parking_Coefficient,
    "PI_Parking_Gross_Area": Parking_Gross_Area,
    "PI_Parking_Levels": Parking_Levels

    }
    
keys = dic.keys()
values = dic.values()

sorted_keys = sorted(keys, key = str.lower)
sorted_keys = sorted(zip(keys, values), key=lambda x: x[0])

values = [] 
keys = [] 

for item in sorted_keys:
    keys.append(item[0])
    values.append(item[1])
    
print(sorted_keys)
# ---------- end python_2 ----------
concat = Concatenate(FragmentA=python_2.keys, FragmentB=": ", FragmentC=python_2.values)  # -> reverse(Result)

pt = Point(<point referenced from the Rhino model>)
lng = ListLength(List=concat)
number_slider = Slider(10, range=0..100)
series = Series(Start=0, Step=number_slider, Count=lng)
Z_3 = UnitZ(Factor=series)
move = Move(Geometry=pt, Motion=Z_3)  # -> Geometry, Transform

series_2 = Series(Start=input_story_2, Step=input_story_2, Count=output_no_of_underground_parking_levels_2)

flatten = FlattenTree(Tree=python_2.keys, Path="{0}")
flatten_2 = FlattenTree(Tree=python_2.values, Path="{1}")
merge = Merge(Data1=flatten, Data2=flatten_2)

# ---- group: Extrudes Parking Lot (continued)
Z_4 = UnitZ(Factor=series_2)
extr_2 = Extrude(Base=parking_boundary, Direction=expr("-x", Z_4))

# ----
boundary = BoundarySurfaces(Edges=parking_boundary)
screentext = ScreenOrientedText(Text=concat, Font="Ariel", Justification=7, Location=move.Geometry, SizeFactor=number_slider, Depth=0, Absolute=False)
move_2 = Move(Geometry=extr_2, Motion=Z_2)  # -> Geometry, Transform

# ---- group: Output - Panel Data
panel_2 = Panel(concat)

# ----
cap_2 = CapHoles(Brep=move_2.Geometry)
excelwrite = ExcelWrite(
    WriteExcelData=write_to_excel,
    WorkbookPath=path,
    WorksheetName="Sheet1",
    ColumnHeadings=panel,
    Data=merge,
    ClearSheet=clear_excel_table)

# ---- group: Output - Parking Slabs
parking_levels_2 = Brep(cap_2)

# ----
preview_2 = CustomPreview(Geometry=cap_2, Material=ColourSwatch(SwatchColor=RGB(74, 177, 226)))
preview_3 = CustomPreview(Geometry=boundary, Material=material)
output_3 = DataOutput(
    DataInput=parking_levels_2,
    Destination="G:\My Drive\Scripting Repository\Exchange Data\UndergroundParking.ghdata",
    RelativePath="G:\My Drive\Scripting Repository\Exchange Data\UndergroundParking.ghdata|..\..\Exchange Data\UndergroundParking.ghdata")
output_4 = DataOutput(
    DataInput=boundary,
    Destination="G:\My Drive\Scripting Repository\Exchange Data\OpenSpace_Lot.ghdata",
    RelativePath="G:\My Drive\Scripting Repository\Exchange Data\OpenSpace_Lot.ghdata|..\..\Exchange Data\OpenSpace_Lot.ghdata")

# ==== cluster GetYard
property_boundary = ClusterInput()
D = ClusterInput()
C = ClusterInput()

# ---- group: Offset Yard - Ensure inwards
property_boundary_2 = Curve(property_boundary)
neg = Negative(Value=D)
area = Area(Geometry=property_boundary_2)  # -> Area, Centroid
offset = OffsetCurve(Curve=C, Distance=[neg, D], Corners=1)  # -> flatten(Curve)
crv_cp = CurveClosestPoint(Point=area.Centroid, Curve=offset)  # -> Point, Parameter, Distance
sort = SortList(Keys=crv_cp.Distance, ValuesA=offset)  # -> Keys, ValuesA
item = ListItem(List=sort.ValuesA, Index=0, Wrap=True)

# ----
i = ClusterOutput(item)
