# Grasshopper definition Feasibility Analysis Calculator 0.4.0.gh (Grasshopper 1.0.7)
# plug-ins: Human, LunchBox

# Notes to Improve per Angie 23 0413:
# 
# 1. Mix used setbacks vs Residential setbakcs. Done
# 
# 2. Work with limits first, zoning limits create the criteria we should work on.
# 
# 3. Residnetial and Commerical have different FAR calculations. Residential is by buildable area while commerical is by site area. Done
lot_corner_point = Point(Point(0, 0, 0))

# ---- group: Get Building Outline
building_outline = Curve(<curve referenced from the Rhino model>)

# ---- group: Reads Curve Geometry
property_boundary = Curve(<curve referenced from the Rhino model>)

# ----
false_gh_property_input_true_curve_prope = BooleanToggle(False)  # "False = GH Property Input | True = Curve Property Input"
false_by_setbacks_true_by_sketch = BooleanToggle(False)
write_to_excel = BooleanToggle(False)
clear_excel_table = BooleanToggle(False)
is_project_mixed_used = BooleanToggle(True)
lot_length = Slider(150, range=0..1000)
lot_width = Slider(50, range=0..1000)
# Residential = Buildable Area
# Commercial = Site Area
select_front_property_line = Slider(3, range=0..3)

# ---- group: Residential Setbacks
front_stbk = Slider(20, range=0..20)
# Note: Per LA review Fire well.
side_stbk = Slider(12, range=0..20)
rear_stbk = Slider(20, range=0..20)
input_front_setback = Number(front_stbk)
input_side_setback = Number(side_stbk)
input_rear_setback = Number(rear_stbk)

# ----
side_stbk_2 = Slider(8, range=0..20)

# ---- group: Commercial Setbacks
front_stbk_2 = Slider(4, range=0..20)
side_stbk_3 = Slider(5, range=0..20)
rear_stbk_2 = Slider(15, range=0..20)
input_c_front_setback = Number(front_stbk_2)
input_c_side_setback = Number(side_stbk_3)
input_c_rear_setback = Number(rear_stbk_2)

# ----
commercial_story_height = DigitScroller(Scroller_Digits=12, Scroller_Prefix="Commercial Story Height", Scroller_Radix=11, Scroller_Value=10)
no_of_commercial_stories = DigitScroller(Scroller_Digits=12, Scroller_Prefix="No of Commercial Stories", Scroller_Radix=11, Scroller_Value=2)
far = DigitScroller(Scroller_Digits=12, Scroller_Prefix="FAR", Scroller_Radix=11, Scroller_Value=4)
max_height = DigitScroller(Scroller_Digits=12, Scroller_Prefix="Max Height", Scroller_Radix=11, Scroller_Value=115)
max_stories = DigitScroller(Scroller_Digits=12, Scroller_Prefix="Max Stories", Scroller_Radix=11, Scroller_Value=3)
story_height = DigitScroller(Scroller_Digits=12, Scroller_Prefix="Story Height", Scroller_Radix=11, Scroller_Value=10)
unit_density = DigitScroller(Scroller_Digits=12, Scroller_Prefix="Unit Density", Scroller_Radix=11, Scroller_Value=400)
parking_levels = DigitScroller(Scroller_Digits=12, Scroller_Prefix="Parking Levels", Scroller_Radix=11, Scroller_Value=2)
parking_coefficient = DigitScroller(Scroller_Digits=12, Scroller_Prefix="Parking Coefficient", Scroller_Radix=11, Scroller_Value=0.5)
parking_gross_area = DigitScroller(Scroller_Digits=12, Scroller_Prefix="Parking Gross Area", Scroller_Radix=11, Scroller_Value=600)
side_stbk_4 = Slider(15, range=0..20)
dedicated_parking_area = Curve(property_boundary)
boundary = BoundarySurfaces(Edges=building_outline)
input_c_side_setback_2 = Number(side_stbk_4)
input_side_setback_2 = Number(side_stbk_2)
merge = Merge(Data1=input_front_setback, Data2=input_side_setback, Data3=input_rear_setback, Data4=input_side_setback_2)
merge_2 = Merge(Data1=input_c_front_setback, Data2=input_c_side_setback, Data3=input_c_rear_setback, Data4=input_c_side_setback_2)

# ---- group: Creates Rectangle
dom = ConstructDomain(DomainStart=0, DomainEnd=lot_length)
dom_2 = ConstructDomain(DomainStart=0, DomainEnd=lot_width)
rectangle = Rectangle(Plane=lot_corner_point, XSize=dom, YSize=dom_2, Radius=0)  # -> Rectangle, Length

# ----
filter = StreamFilter(Gate=false_gh_property_input_true_curve_prope, Stream0=rectangle.Rectangle, Stream1=property_boundary)
filter_2 = StreamFilter(Gate=false_gh_property_input_true_curve_prope, Stream0=rectangle.Rectangle, Stream1=dedicated_parking_area)
property_boundary_2 = Curve(filter)

# ---- group: Calculate Lot Area
area = Area(Geometry=property_boundary_2)  # -> Area, Centroid

# ----
lot_area = Panel(area.Area)
property_boundary_3 = Curve(property_boundary_2)
panel = Panel("""Keys
Values""")
path = FilePath("G:\My Drive\Scripting Repository\Exchange Data\Feasibility_Analysis_Workbook.xlsx")
setbacks = Curve()
previewlw = CustomPreviewLineweights(
    Geometry=setbacks,
    Shader={diffuse=RGB(255, 105, 180), emission=RGB(76, 32, 54), shine=0.5, specular=RGB(255, 255, 255), transparency=0},
    Absolute=False)
output = DataOutput(
    DataInput=setbacks,
    Destination="G:\My Drive\Scripting Repository\Exchange Data\Setbacks.ghdata",
    RelativePath="G:\My Drive\Scripting Repository\Exchange Data\Setbacks.ghdata|..\..\Exchange Data\Setbacks.ghdata")
output_no_of_underground_parking_levels = Number(parking_levels)
parking_boundary = Curve(filter_2)
material = CreateMaterial(
    Diffuse=ColourSwatch(SwatchColor=RGB(59, 192, 91)),
    Specular=ColourSwatch(SwatchColor=RGB(162, 238, 91)),
    Emission=ColourSwatch(SwatchColor=RGB(179, 84, 91)),
    Transparency=0,
    Shine=0)

# ---- group: Setbacks - Commercial Program
setbacks_comm = Number(merge_2)
shift = ShiftList(List=setbacks_comm, Shift=select_front_property_line, Wrap=True)
buildable_area = Buildable_area(C=property_boundary_3, d=shift)
commercial_area_footprint = Surface(buildable_area)
input_story = Number(commercial_story_height)
Z = UnitZ(Factor=input_story)

# ----
filter_3 = StreamFilter(Gate=false_by_setbacks_true_by_sketch, Stream0=commercial_area_footprint, Stream1=boundary)

# ---- group: Setbacks - Residential Program
setbacks_resi = Number(merge)
shift_2 = ShiftList(List=setbacks_resi, Shift=select_front_property_line, Wrap=True)
buildable_area_2 = Buildable_area(C=property_boundary_3, d=shift_2)
residential_area_footprint = Surface(buildable_area_2)
input_story_2 = Number(story_height)
Z_2 = UnitZ(Factor=input_story_2)

# ----
buildable_area_residential = Surface(residential_area_footprint)
area_2 = Area(Geometry=buildable_area_residential)  # -> Area, Centroid
buildable_area_area_within_setbacks = Panel(area_2.Area)
python = GhPythonScript(
    by_crv=false_by_setbacks_true_by_sketch,
    mixed_use=is_project_mixed_used,
    property_boundary=property_boundary_2,
    buildable_area=area_2.Area,
    FAR=far,
    floor_height=story_height,
    building_outline=boundary,
    allowable_height=max_height,
    unit_density=unit_density,
    parking_coefficient=parking_coefficient,
    parking_stall_gross_Area=parking_gross_area,
    parking_footprint=filter_2)  # -> keys, values, allowable_area, stories, height, typ_floor_height
# ---------- python: Python ----------
__author__ = "ilouh"
__version__ = "2023.02.21"

import rhinoscriptsyntax as rs
import Grasshopper as gh
import Rhino.Geometry as rg
import ghpythonlib.components as comps
import math

lot_area = comps.Area(property_boundary)
lot_area = lot_area['area']

buildable_footprint = comps.Area(building_outline)
buildable_footprint = buildable_footprint['area']

dedicated_parking_area = comps.Area(parking_footprint)
dedicated_parking_area = dedicated_parking_area['area']

# Calculate allowable area per use, mixed use by lot area, residential by buildable area
########################################################################################
if mixed_use is True:

    allowable_area = FAR * lot_area

else:

    allowable_area = FAR * buildable_area

#to calculate the height of the building based on curve input or setback input
########################################################################################
if by_crv is True:

    footprint = buildable_footprint

else: 

    footprint = buildable_area

print(footprint)

stories = math.floor(allowable_area / footprint)
assumed_height = stories * floor_height

#checks building height against allowable height
########################################################################################
if assumed_height < allowable_height:
    
    height = assumed_height
    stories = stories

else:
    
    height = allowable_height
    stories = math.floor(height/floor_height)

#Dictionary Creation
########################################################################################
Number_Of_Units = round((lot_area / unit_density),2)
Avg_Unit_Size = round((round((footprint * stories),2) / Number_Of_Units),2)
Number_Of_Parking_Stalls = Number_Of_Units * parking_coefficient
Parking_Gross_Area = Number_Of_Parking_Stalls * parking_stall_gross_Area
Parking_Levels = math.ceil(Parking_Gross_Area / dedicated_parking_area)
Building_footprint_area = round(footprint,2)
typ_floor_height = round(height/stories,2)

dic = {

    "BI_Lot_Area": lot_area,
    "BI_Buildable_Area": round(buildable_area,2),
    "BI_Maximum_Building_Area": round(allowable_area,2),
    "BI_Gross_Floor_Area": round((footprint * stories),2),
    "BI_Number_Of_Stories": stories,
    "BI_Building_Height": height,
    "BI_Lot_Coverage": round((footprint / lot_area),2),
    "UI_Number_Of_Units": Number_Of_Units,
    "UI_Average_Unit_Size": Avg_Unit_Size,
    "UI_Net_Rentable_SF": round((Number_Of_Units * Avg_Unit_Size),2),
    "PI_Total_Number_of_Parking_Stalls": Number_Of_Parking_Stalls,
    "PI_Parking_Ratio": parking_coefficient,
    "PI_Parking_Gross_Area": Parking_Gross_Area,
    "PI_Parking_Levels": Parking_Levels

    }

keys = dic.keys()
values = dic.values()

sorted_keys = sorted(keys, key = str.lower)
sorted_keys = sorted(zip(keys, values), key=lambda x: x[0])

values = [] 
keys = [] 

for item in sorted_keys:
    keys.append(item[0])
    values.append(item[1])
# ---------- end python ----------
python_2 = GhPythonScript(
    mixed_use=is_project_mixed_used,
    stories=python.stories,
    z_vector_commerical=commercial_story_height,
    z_vector_residential=story_height,
    no_commercial_floors=no_of_commercial_stories)  # -> z_values_comm, z_values_resi
# ---------- python_2: Python ----------
__author__ = "ilouh"
__version__ = "2023.02.21"

import rhinoscriptsyntax as rs
import Grasshopper as gh
import Rhino.Geometry as rg
import ghpythonlib.components as comps
import math

#inputs

floors = range(int(stories))
print(floors)

z_vector_commerical = 10
z_vector_residential = 10

if mixed_use is True:
    index_to_split_list = int(no_commercial_floors)-1

    #split the list into two lists based on the index
    commercial_floors, residential_floors = floors[:index_to_split_list], floors[index_to_split_list:]
    print(residential_floors)
    
    #create a range between z_vector_commerical z_vector_commercial*index_to_split_list
    
    z_vector_commerical_list = range(0, z_vector_commerical*index_to_split_list+1, z_vector_commerical)
    z_vector_residential_list = range(z_vector_residential*int(no_commercial_floors), z_vector_residential*(int(no_commercial_floors) -1)+ z_vector_residential*(len(floors)-index_to_split_list), z_vector_residential)
    
    z_values_comm = z_vector_commerical_list
    z_values_resi = z_vector_residential_list
    
else: 

    z_values_comm = []
    z_values_resi = range(0, z_vector_residential*len(floors), z_vector_residential)
# ---------- end python_2 ----------

# ---- group: Setbacks - Commercial Program (continued)
z_values_comm = Integer(python_2.z_values_comm)
Z_3 = UnitZ(Factor=z_values_comm)
move = Move(Geometry=filter_3, Motion=Z_3)  # -> Geometry, Transform
extr = Extrude(Base=move.Geometry, Direction=Z)

# ----
filter_4 = StreamFilter(Gate=false_by_setbacks_true_by_sketch, Stream0=residential_area_footprint, Stream1=boundary)

# ---- group: Setbacks - Residential Program (continued)
z_values_resi = Integer(python_2.z_values_resi)
Z_4 = UnitZ(Factor=z_values_resi)
move_2 = Move(Geometry=filter_4, Motion=Z_4)  # -> Geometry, Transform
extr_2 = Extrude(Base=move_2.Geometry, Direction=Z_2)

# ----
item = ListItem(List=move_2.Geometry, Index=0, Wrap=True)
item_2 = ListItem(List=move.Geometry, Index=0, Wrap=True)
bbox = BoundingBox(Content=extr, Plane=PlaneXY(0, 0, 0), UnionBox=True)  # -> Box, Box_2
bbox_2 = BoundingBox(Content=extr_2, Plane=PlaneXY(0, 0, 0), UnionBox=True)  # -> Box, Box_2
concat = Concatenate(FragmentA=python.keys, FragmentB=": ", FragmentC=python.values)  # -> reverse(Result)
python_3 = GhPythonScript(srf=item_2, bbox=bbox.Box)  # -> envelope
# ---------- python_3: Python ----------
__author__ = "ilouh"
__version__ = "2023.02.21"

import rhinoscriptsyntax as rs
import Grasshopper as gh
import Rhino.Geometry as rg
import ghpythonlib.components as comps
import math


bbox_dims = comps.DeconstructBox(bbox)
start_value = bbox_dims['z'][0]
z_value = bbox_dims['z'][1]

point_a = comps.ConstructPoint(0,0,start_value)
point_b = comps.ConstructPoint(0,0,z_value)

z_vector = comps.Vector2Pt(point_a,point_b,False)

envelope = comps.Extrude(srf,z_vector['vector'])
# ---------- end python_3 ----------
python_4 = GhPythonScript(srf=item, bbox=bbox_2.Box)  # -> envelope
# ---------- python_4: Python ----------
__author__ = "ilouh"
__version__ = "2023.02.21"

import rhinoscriptsyntax as rs
import Grasshopper as gh
import Rhino.Geometry as rg
import ghpythonlib.components as comps
import math



bbox_dims = comps.DeconstructBox(bbox)


start_value = bbox_dims['z'][0]
z_value = bbox_dims['z'][1]

point_a = comps.ConstructPoint(0,0,start_value)
point_b = comps.ConstructPoint(0,0,z_value)

z_vector = comps.Vector2Pt(point_a,point_b,False)

envelope = comps.Extrude(srf,z_vector['vector'])
# ---------- end python_4 ----------

pt = Point(<point referenced from the Rhino model>)
lng = ListLength(List=concat)
number_slider = Slider(10, range=0..100)
series = Series(Start=0, Step=number_slider, Count=lng)
Z_5 = UnitZ(Factor=series)
move_3 = Move(Geometry=pt, Motion=Z_5)  # -> Geometry, Transform

envelope_comm = Brep(python_3)
preview = CustomPreview(Geometry=extr, Material=ColourSwatch(SwatchColor=RGB(93, 189, 192)))
envelope_resi = Brep(python_4)
preview_2 = CustomPreview(Geometry=extr_2, Material=ColourSwatch(SwatchColor=RGB(74, 183, 67)))

flatten = FlattenTree(Tree=python.keys, Path="{0}")
flatten_2 = FlattenTree(Tree=python.values, Path="{1}")
merge_3 = Merge(Data1=flatten, Data2=flatten_2)

output_2 = DataOutput(
    DataInput=envelope_resi,
    Destination="G:\My Drive\Scripting Repository\Exchange Data\Envelope_resi.ghdata",
    RelativePath="G:\My Drive\Scripting Repository\Exchange Data\Envelope_resi.ghdata|..\..\Exchange Data\Envelope_resi.ghdata")
output_3 = DataOutput(
    DataInput=envelope_comm,
    Destination="G:\My Drive\Scripting Repository\Exchange Data\Envelope_comm.ghdata",
    RelativePath="G:\My Drive\Scripting Repository\Exchange Data\Envelope_comm.ghdata|..\..\Exchange Data\Envelope_comm.ghdata")
screentext = ScreenOrientedText(Text=concat, Font="Ariel", Justification=7, Location=move_3.Geometry, SizeFactor=number_slider, Depth=0, Absolute=False)

# ---- group: Output - Panel Data
panel_2 = Panel(concat)

# ----
excelwrite = ExcelWrite(
    WriteExcelData=write_to_excel,
    WorkbookPath=path,
    WorksheetName="Sheet1",
    ColumnHeadings=panel,
    Data=merge_3,
    ClearSheet=clear_excel_table)
input_story_3 = Number(python.typ_floor_height)
parking = Parking(
    B=parking_boundary,
    S=input_story_3,
    N=input_story_3,
    C=output_no_of_underground_parking_levels,
    E=parking_boundary,
    G=parking_boundary)  # -> B_2, S_2, A
dedicated_parking_area_2 = Panel(parking.A)

# ---- group: Output - Parking Slabs
parking_levels_2 = Brep(parking.B_2)

# ----
output_4 = DataOutput(
    DataInput=parking_levels_2,
    Destination="G:\My Drive\Scripting Repository\Exchange Data\UndergroundParking.ghdata",
    RelativePath="G:\My Drive\Scripting Repository\Exchange Data\UndergroundParking.ghdata|..\..\Exchange Data\UndergroundParking.ghdata")
preview_3 = CustomPreview(Geometry=parking.B_2, Material=ColourSwatch(SwatchColor=RGB(74, 177, 226)))
preview_4 = CustomPreview(Geometry=parking.S_2, Material=material)
output_5 = DataOutput(
    DataInput=parking.S_2,
    Destination="G:\My Drive\Scripting Repository\Exchange Data\OpenSpace_Lot.ghdata",
    RelativePath="G:\My Drive\Scripting Repository\Exchange Data\OpenSpace_Lot.ghdata|..\..\Exchange Data\OpenSpace_Lot.ghdata")

# ==== cluster Buildable_area
d = ClusterInput()
C = ClusterInput()
explode = Explode(Curve=C, Recursive=True)  # -> Segments, Vertices
d_2 = Number(d)
neg = Negative(Value=d_2)
hframe = HorizontalFrame(Curve=reparameterize(explode.Segments), Parameter=0.5)  # -> graft(Frame)
merge = Merge(Data1=graft(d_2), Data2=graft(neg))  # -> simplify(Result)
offset = OffsetCurve(Curve=graft(explode.Segments), Distance=merge, Plane=hframe, Corners=1)  # -> simplify(Curve)
split = SplitTree(Data=offset, Masks=flatten("{?;1}"))  # -> flatten(Positive), Negative
split_2 = SplitTree(Data=offset, Masks=flatten("{?;0}"))  # -> flatten(Positive), Negative

crv = Curve(split_2.Positive)
shift = ShiftList(List=crv, Shift=1, Wrap=True)
shift_2 = ShiftList(List=crv, Shift=0, Wrap=True)
llx = LineLine(Line1=shift_2, Line2=shift)  # -> ParamA, ParamB, PointA, PointB
pline = PolyLine(Vertices=llx.PointA, Closed=True)

crv_2 = Curve(split.Positive)
shift_3 = ShiftList(List=crv_2, Shift=1, Wrap=True)
shift_4 = ShiftList(List=crv_2, Shift=0, Wrap=True)
llx_2 = LineLine(Line1=shift_4, Line2=shift_3)  # -> ParamA, ParamB, PointA, PointB
pline_2 = PolyLine(Vertices=llx_2.PointA, Closed=True)

boundary = BoundarySurfaces(Edges=pline)
boundary_2 = BoundarySurfaces(Edges=pline_2)
merge_2 = Merge(Data1=boundary_2, Data2=boundary)
python = GhPythonScript(srfs=merge_2)  # -> buildable_area_footprint; inputs srfs: list
# ---------- python: Python ----------
__author__ = "ilouh"
__version__ = "2023.02.21"

import rhinoscriptsyntax as rs
import Grasshopper as gh
import Rhino.Geometry as rg
import ghpythonlib.components as comps
import math

buildable_area_footprint= []
areas = [] 

for srf in srfs:
    
    area = comps.Area(srf)
    areas.append(area['area'])
    
zip_list = zip(areas,srfs)
sorted_list = sorted(zip_list, key=lambda x: x[0])

buildable_area_footprint = sorted_list[0][1]
# ---------- end python ----------
buildable_area_footprint = ClusterOutput(python)

# ==== cluster Parking
G = ClusterInput()
S = ClusterInput()
N = ClusterInput()
C = ClusterInput()
B = ClusterInput()
E = ClusterInput()

area = Area(Geometry=G)  # -> Area, Centroid
series = Series(Start=S, Step=N, Count=C)
Z = UnitZ(Factor=series)
extr = Extrude(Base=B, Direction=expr("-x", Z))
boundary = BoundarySurfaces(Edges=E)
Z_2 = UnitZ(Factor=-0.25)
move = Move(Geometry=extr, Motion=Z_2)  # -> Geometry, Transform
cap = CapHoles(Brep=move.Geometry)

A = ClusterOutput(area.Area)
S_2 = ClusterOutput(boundary)
B_2 = ClusterOutput(cap)
