# Grasshopper definition Massing Design Calculator 0.2.0.gh (Grasshopper 1.0.7)
# plug-ins: Human

input = DataInput(
    Destination="G:\My Drive\Scripting Repository\Exchange Data\Mass.ghdata",
    RelativePath="G:\My Drive\Scripting Repository\Exchange Data\Mass.ghdata|..\..\Exchange Data\Mass.ghdata",
    UpdateDelay=50000)
_1st_stack_floor_height = DigitScroller(Scroller_Digits=12, Scroller_Prefix="1st Stack Floor Height", Scroller_Radix=11, Scroller_Value=10)
no_of_floors = DigitScroller(Scroller_Digits=12, Scroller_Prefix="No. Of Floors", Scroller_Radix=11, Scroller_Value=2)
_2nd_stack_floor_height = DigitScroller(Scroller_Digits=12, Scroller_Prefix="2nd Stack Floor Height", Scroller_Radix=11, Scroller_Value=10)
no_of_floors_2 = DigitScroller(Scroller_Digits=12, Scroller_Prefix="No. Of Floors", Scroller_Radix=11, Scroller_Value=0)
typical_floor_height = DigitScroller(Scroller_Digits=12, Scroller_Prefix="Typical Floor Height", Scroller_Radix=11, Scroller_Value=10)

# ---- group: Import Mass as PolySurface
massing = Brep(graft(input))

# ---- group: Calculates Building Height
bbox = BoundingBox(Content=flatten(massing), Plane=PlaneXY(0, 0, 0), UnionBox=True)  # -> Box, Box_2
box_corners = BoxCorners(Box=bbox.Box)  # -> CornerA, CornerB, CornerC, CornerD, CornerE, CornerF, CornerG, CornerH
dist = Distance(PointA=box_corners.CornerA, PointB=box_corners.CornerE)

# ---- group: This Python Component Create the Contour Lines
python = GhPythonScript(
    First_Stack_Floor_Height=_1st_stack_floor_height,
    First_Stack_No_Floors=no_of_floors,
    Second_Stack_Floor_Height=_2nd_stack_floor_height,
    Second_Stack_No_Floors=no_of_floors_2,
    Typical_Floor_Height=typical_floor_height,
    Overall_Building_Height=dist)  # -> Distances
# ---------- python: Python ----------
__author__ = "Iliya Muzychuk"
__version__ = "2023.02.03"

import rhinoscriptsyntax as rs
import Grasshopper as gh
import Rhino.Geometry as rg
import ghpythonlib.components as comps
import math

#Variable Declaration

First_Stack_Floor_Height = First_Stack_Floor_Height
First_Stack_No_Floors = First_Stack_No_Floors
Second_Stack_Floor_Height = Second_Stack_Floor_Height
Second_Stack_No_Floors = Second_Stack_No_Floors
Typical_Floor_Height = Typical_Floor_Height
Overall_Building_Height = Overall_Building_Height


#Creates a list of distances for contouring. 

Distances = [0]

#Creates the list of first stack floors 

for i in range(0, int(First_Stack_No_Floors)):
    
    temp_height = (i + 1) * First_Stack_Floor_Height
    Distances.append(temp_height)

#Appends the list the second stack floors 
for i in range(0, int(Second_Stack_No_Floors)):
    
    temp_height = Distances[-1] + Second_Stack_Floor_Height
    Distances.append(temp_height)

remaining_floors = math.floor((round(Overall_Building_Height) - Distances[-1])/Typical_Floor_Height)

for i in range(0, int(remaining_floors)):
    
    temp_height = Distances[-1] + Typical_Floor_Height
    Distances.append(temp_height)
    
print(remaining_floors)
print(Distances)
# ---------- end python ----------

# ----
xy = XYPlane(Origin=Point(0, 0, 0))

# ---- group: Isolate Faces of Mass
debrep = DeconstructBrep(Brep=massing)  # -> Faces, Edges, Vertices
evalsrf = EvaluateSurface(Surface=reparameterize(debrep.Faces), Point="{0.5,0.5,0}")  # -> Point, Normal, UDirection, VDirection, Frame
distributefaces = GhPythonScript(v=evalsrf.Normal, faces=debrep.Faces)  # -> floors, facadeWalls, roof; inputs v: list, faces: list
# ---------- distributefaces: Python ----------
__author__ = "ilouh"
__version__ = "2023.01.08"

import rhinoscriptsyntax as rs
import ghpythonlib.components as comps
import Rhino.Geometry as geom

#elements = comps.DeconstructBrep(mass)
#faces = elements['faces']

#find the normal of each face


roof = []
floors = []
solidWalls = []
facadeWalls = [] 

for i in range(0,len(v)):
    
    
    values = comps.DeconstructVector(v[i])
    print(values)
    
    x_value = values['x_component']
    y_value = values['y_component']
    z_value = values['z_component']
    
    

    if z_value >= 0.7:
        
        print(i)
        roof.append(faces[i])
    
    if z_value == -1:
        
        floors.append(faces[i])
   
    if abs(z_value) != 1:
    
        facadeWalls.append(faces[i])
# ---------- end distributefaces ----------

# ----
contour = ContourEx(Shape=massing, Plane=xy, Offsets=python)
clean = CleanTree(RemoveNulls=True, RemoveInvalid=True, RemoveEmpty=False, Tree=contour)
trim = TrimTree(Tree=contour, Depth=1)

# ---- group: Sort Floor Plates
area = Area(Geometry=flatten(trim))  # -> Area, Centroid
pdecon = Deconstruct(Point=area.Centroid)  # -> XComponent, YComponent, ZComponent
sort = SortList(Keys=pdecon.ZComponent, ValuesA=flatten(trim))  # -> Keys, ValuesA

# ----
srf = Surface(flatten(distributefaces.roof))
srf_2 = Surface(graft(distributefaces.facadeWalls))
trim_2 = TrimTree(Tree=srf_2, Depth=1)
no_of_commercial_floors = DigitScroller(Scroller_Digits=12, Scroller_Prefix="No. Of Commercial Floors", Scroller_Radix=11, Scroller_Value=2)
python_2 = GhPythonScript(floor_plates=sort.ValuesA, n_commercial=no_of_commercial_floors)  # -> residential, commercial; inputs floor_plates: list of Curve
# ---------- python_2: Python ----------
__author__ = "ilouh"
__version__ = "2023.02.21"

import rhinoscriptsyntax as rs
import Grasshopper as gh
import Rhino.Geometry as rg
import ghpythonlib.components as comps
import math

residential = floor_plates[int(n_commercial):]
residential.pop(-1)
commercial = floor_plates[:int(n_commercial)-1]
# ---------- end python_2 ----------
walls = Surface(simplify(trim_2))
commercial = Curve(python_2.commercial)
residential = Curve(python_2.residential)
merge = Merge(Data1=residential, Data2=commercial)

neg = Negative(Value=Slider(0.5, range=0..1))
Z = UnitZ(Factor=neg)
extr = Extrude(Base=merge, Direction=Z)
cap = CapHoles(Brep=extr)

floors = Brep(simplify(cap))

extr_2 = Extrude(Base=srf, Direction=Z)
cap_2 = CapHoles(Brep=extr_2)

# ---- group: Calculates Gross Building Area
python_3 = GhPythonScript(Floor_Plate_Curves=trim, floorList=python)  # -> keys, values, TotalBuildingArea; inputs Floor_Plate_Curves: list of Curve, floorList: list of Int32
# ---------- python_3: Python ----------
__author__ = "Iliya Muzychuk"
__version__ = "2023.02.03"

import rhinoscriptsyntax as rs
import Grasshopper as gh
import Rhino.Geometry as rg
import ghpythonlib.components as comps

FloorNames = []
FloorAreas = []

#Funcition to find the key of a dictionary by value 

def findKey(value_to_find,dic):
    for key, value in dic.items():
        if abs(value - value_to_find) < 2:
            return key
dic = {}
#Create a name and claculates the area of each floor
for i in range(0,len(floorList)):
    dic_name = 'Floor {}'.format(i)
    dic[dic_name] = floorList[i]

print(dic)

Floor_Plate_Curves.pop(-1)

for  floor in Floor_Plate_Curves: 
    
    
    Floor_Area = comps.Area(floor)
    FloorAreas.append(round(Floor_Area['area'],2))
    
    z_value = int(Floor_Area['centroid'][2])
    
    Floor_Name = findKey(z_value,dic)
    
    print(z_value)

    FloorNames.append(Floor_Name)

keys = FloorNames
values = FloorAreas

TotalBuildingArea = sum(values)
# ---------- end python_3 ----------

# ----
flatten = FlattenTree(Tree=python_3.TotalBuildingArea, Path="{0}")
graft = GraftTree(Tree=flatten, IncludeEmptyLists=True, IncludeNullItems=True)

# ---- group: Calculates Wall Area Ratio
python_4 = GhPythonScript(walls=walls, totalBuildingArea=graft)  # -> keys, values; inputs walls: list
# ---------- python_4: Python ----------
__author__ = "Iliya Muzychuk"
__version__ = "2023.02.03"

import rhinoscriptsyntax as rs
import Grasshopper as gh
import Rhino.Geometry as rg
import ghpythonlib.components as comps

#A function to convert a float to percentage

def float_to_percentage(number):
    return '{:.2%}'.format(number)
    
wall_areas = []

for wall in walls:
    
    area = rs.Area(wall)
    wall_areas.append(area)

total_wall_area = round(sum(wall_areas),2)
wall_area_ratio = total_wall_area / totalBuildingArea

#Dictionary constructions allows future json file control 

dic = {

    'Total Facade Area' : total_wall_area,
    'Wall area/Floor area Ratio' : float_to_percentage(wall_area_ratio)

}

keys = dic.keys()
values = dic.values()
# ---------- end python_4 ----------

# ----
multiplication = Multiplication(A=_1st_stack_floor_height, B=no_of_commercial_floors)
Z_2 = UnitZ(Factor=multiplication)
concat = Concatenate(FragmentA=python_4.keys, FragmentB=": ", FragmentC=python_4.values)
extr_3 = Extrude(Base=commercial, Direction=Z_2)
preview = CustomPreview(Geometry=extr_3, Material=ColourSwatch(SwatchColor=RGBA(199, 58, 175, 145)))
panel = Panel(concat)
output = DataOutput(
    DataInput=flatten(residential),
    Destination="G:\My Drive\Scripting Repository\Exchange Data\FloorBreps.ghdata",
    RelativePath="G:\My Drive\Scripting Repository\Exchange Data\FloorBreps.ghdata|..\..\Exchange Data\FloorBreps.ghdata")
output_2 = DataOutput(
    DataInput=flatten(extr_3),
    Destination="G:\My Drive\Scripting Repository\Exchange Data\CommercialFloors.ghdata",
    RelativePath="G:\My Drive\Scripting Repository\Exchange Data\CommercialFloors.ghdata|..\..\Exchange Data\CommercialFloors.ghdata")
panel_2 = Panel(python_3.values)
output_floors = Brep(floors)
output_roof = Brep(cap_2)
concat_2 = Concatenate(FragmentA="Total Building Area", FragmentB=": ", FragmentC=python_3.TotalBuildingArea)
preview_2 = CustomPreview(Geometry=walls, Material=ColourSwatch(SwatchColor=RGBA(191, 191, 191, 86)))
preview_3 = CustomPreview(Geometry=output_roof, Material=ColourSwatch(SwatchColor=RGB(125, 125, 125)))
preview_4 = CustomPreview(Geometry=output_floors, Material=ColourSwatch(SwatchColor=RGB(164, 212, 126)))
output_3 = DataOutput(
    DataInput=output_roof,
    Destination="G:\My Drive\Scripting Repository\Exchange Data\RoofBreps.ghdata",
    RelativePath="G:\My Drive\Scripting Repository\Exchange Data\RoofBreps.ghdata|..\..\Exchange Data\RoofBreps.ghdata")
output_4 = DataOutput(
    DataInput=output_floors,
    Destination="G:\My Drive\Scripting Repository\Exchange Data\FloorBreps.ghdata",
    RelativePath="G:\My Drive\Scripting Repository\Exchange Data\FloorBreps.ghdata|..\..\Exchange Data\FloorBreps.ghdata")

bbox_2 = BoundingBox(Content=flatten(massing), Plane=PlaneXY(0, 0, 0), UnionBox=True)  # -> Box, Box_2
volume = Volume(Geometry=bbox_2.Box)  # -> Volume, Centroid
scale = Scale(Geometry=bbox_2.Box, Center=volume.Centroid, Factor=1.25)  # -> Geometry, Transform
box_corners_2 = BoxCorners(Box=scale.Geometry)  # -> CornerA, CornerB, CornerC, CornerD, CornerE, CornerF, CornerG, CornerH
pdecon_2 = Deconstruct(Point=box_corners_2.CornerA)  # -> XComponent, YComponent, ZComponent

# ---- group: This panel can be exported to a CSV
concat_3 = Concatenate(FragmentA=python_3.keys, FragmentB=": ", FragmentC=python_3.values)

# ----
ins = InsertItems(List=concat_3, Item=concat_2, Indices=0, Wrap=True)

# ---- group: This panel can be exported to a CSV (continued)
panel_3 = Panel(ins)

# ----
lng = ListLength(List=simplify(flatten(panel_3)))
series = Series(Start=0, Step=typical_floor_height, Count=lng)
pt = ConstructPoint(XCoordinate=pdecon_2.XComponent, YCoordinate=pdecon_2.YComponent, ZCoordinate=series)
screentext = ScreenOrientedText(Text=flatten(panel_3), Font="Ariel", Justification=7, Location=pt, SizeFactor=10, Depth=0, Absolute=False)
