# Grasshopper definition Massing Design Calculator 0.3.0.gh (Grasshopper 1.0.7)
# plug-ins: Human, jSwan

_1st_stack_floor_height = DigitScroller(Scroller_Digits=12, Scroller_Prefix="1st Stack Floor Height", Scroller_Radix=11, Scroller_Value=6.4)
no_of_floors = DigitScroller(Scroller_Digits=12, Scroller_Prefix="No. Of Floors", Scroller_Radix=11, Scroller_Value=1)
_2nd_stack_floor_height = DigitScroller(Scroller_Digits=12, Scroller_Prefix="2nd Stack Floor Height", Scroller_Radix=11, Scroller_Value=5.4)
no_of_floors_2 = DigitScroller(Scroller_Digits=12, Scroller_Prefix="No. Of Floors", Scroller_Radix=11, Scroller_Value=1)
typical_floor_height = DigitScroller(Scroller_Digits=12, Scroller_Prefix="Typical Floor Height", Scroller_Radix=11, Scroller_Value=3)

# ---- group: Import Mass as PolySurface
massing = Brep(graft(<brep referenced from the Rhino model>))

# ---- group: Calculates Building Height
bbox = BoundingBox(Content=flatten(massing), Plane=PlaneXY(0, 0, 0), UnionBox=True)  # -> Box, Box_2
box_corners = BoxCorners(Box=bbox.Box)  # -> CornerA, CornerB, CornerC, CornerD, CornerE, CornerF, CornerG, CornerH
dist = Distance(PointA=box_corners.CornerA, PointB=box_corners.CornerE)

# ---- group: This Python Component Create the Contour Lines
python = GhPythonScript(
    First_Stack_Floor_Height=_1st_stack_floor_height,
    First_Stack_No_Floors=no_of_floors,
    Second_Stack_Floor_Height=_2nd_stack_floor_height,
    Second_Stack_No_Floors=no_of_floors_2,
    Typical_Floor_Height=typical_floor_height,
    Overall_Building_Height=dist)  # -> Distances, intersection_Planes
# ---------- python: Python ----------
__author__ = "Iliya Muzychuk"
__version__ = "2023.02.03"

import rhinoscriptsyntax as rs
import Grasshopper as gh
import Rhino.Geometry as rg
import ghpythonlib.components as comps
import math

#Variable Declaration

First_Stack_Floor_Height = First_Stack_Floor_Height
First_Stack_No_Floors = First_Stack_No_Floors
Second_Stack_Floor_Height = Second_Stack_Floor_Height
Second_Stack_No_Floors = Second_Stack_No_Floors
Typical_Floor_Height = Typical_Floor_Height
Overall_Building_Height = Overall_Building_Height


#Creates a list of distances for contouring. 

Distances = [0]

#Creates the list of first stack floors 

for i in range(0, int(First_Stack_No_Floors)):
    
    temp_height = (i + 1) * First_Stack_Floor_Height
    print(temp_height)
    Distances.append(temp_height)

#Appends the list the second stack floors 
for i in range(0, int(Second_Stack_No_Floors)):
    
    temp_height = Distances[-1] + Second_Stack_Floor_Height
    Distances.append(temp_height)

remaining_floors = math.floor((round(Overall_Building_Height) - Distances[-1])/Typical_Floor_Height)

for i in range(0, int(remaining_floors)):
    
    temp_height = Distances[-1] + Typical_Floor_Height
    Distances.append(temp_height)
    
#print(remaining_floors)
#print(Distances)

intersection_Planes = []

intersection_Planes = []
for z in Distances: 
    
    point = comps.ConstructPoint(0,0,z)
    print(point)
    plane = comps.XYPlane(point)
    intersection_Planes.append(plane)
# ---------- end python ----------

# ---- group: Isolate Faces of Mass
debrep = DeconstructBrep(Brep=massing)  # -> Faces, Edges, Vertices
evalsrf = EvaluateSurface(Surface=reparameterize(debrep.Faces), Point="{0.5,0.5,0}")  # -> Point, Normal, UDirection, VDirection, Frame
distributefaces = GhPythonScript(v=evalsrf.Normal, faces=debrep.Faces)  # -> floors, facadeWalls, roof; inputs v: list, faces: list
# ---------- distributefaces: Python ----------
__author__ = "ilouh"
__version__ = "2023.01.08"

import rhinoscriptsyntax as rs
import ghpythonlib.components as comps
import Rhino.Geometry as geom

#elements = comps.DeconstructBrep(mass)
#faces = elements['faces']

#find the normal of each face


roof = []
floors = []
solidWalls = []
facadeWalls = [] 

for i in range(0,len(v)):
    
    
    values = comps.DeconstructVector(v[i])
    print(values)
    
    x_value = values['x_component']
    y_value = values['y_component']
    z_value = values['z_component']
    
    

    if z_value >= 0.4:
        
        print(i)
        roof.append(faces[i])
    
    if z_value == -1:
        
        floors.append(faces[i])
   
    if abs(z_value) != 1:
    
        facadeWalls.append(faces[i])
# ---------- end distributefaces ----------

# ----
xy = XYPlane(Origin=python.intersection_Planes)
mesh = MeshBrep(
    Brep=massing,
    Settings={GridMaxCount=0, GridMinCount=16, JaggedSeams=False, MaxEdgeLength=0, MinEdgeLength=0.0001, MinTolerance=0, Refine=True, RefineAngle=0, RelativeTolerance=0.65, SimplePlanes=True, Tolerance=0})
sec = MeshPlane(Mesh=mesh, Plane=xy)

srf = Surface(flatten(distributefaces.roof))
srf_2 = Surface(graft(distributefaces.facadeWalls))
trim = TrimTree(Tree=srf_2, Depth=1)

# ---- group: Requires Additional Work
no_of_commercial_floors = DigitScroller(Scroller_Digits=12, Scroller_Prefix="No. Of Commercial Floors", Scroller_Radix=11, Scroller_Value=0)
python_2 = GhPythonScript(n_commercial=no_of_commercial_floors)  # -> residential, commercial; inputs floor_plates: list of Curve
# ---------- python_2: Python ----------
__author__ = "ilouh"
__version__ = "2023.02.21"

import rhinoscriptsyntax as rs
import Grasshopper as gh
import Rhino.Geometry as rg
import ghpythonlib.components as comps
import math

residential = floor_plates[int(n_commercial):]
residential.pop(-1)
commercial = floor_plates[:int(n_commercial)-1]
# ---------- end python_2 ----------
commercial = Curve(python_2.commercial)
residential = Curve(python_2.residential)

# ----
trim_2 = TrimTree(Tree=sec, Depth=1)

floor_thickness = Slider(0.5, range=0..1)
neg = Negative(Value=floor_thickness)
Z = UnitZ(Factor=neg)
extr = Extrude(Base=trim_2, Direction=Z)
cap = CapHoles(Brep=extr)

extr_2 = Extrude(Base=srf, Direction=Z)
cap_2 = CapHoles(Brep=extr_2)

walls = Surface(simplify(trim))
floors = Brep(simplify(cap))

# ---- group: Calculates Gross Building Area
python_3 = GhPythonScript(Floor_Plate_Curves=trim_2, floorList=python.Distances, bool=Toggle(True))  # -> keys, values, TotalBuildingArea; inputs Floor_Plate_Curves: list of Curve, floorList: list of Int32
# ---------- python_3: Python ----------
__author__ = "Iliya Muzychuk"
__version__ = "2023.02.03"

import rhinoscriptsyntax as rs
import Grasshopper as gh
import Rhino.Geometry as rg
import ghpythonlib.components as comps

FloorNames = []
FloorAreas = []

#Funcition to find the key of a dictionary by value 

def findKey(value_to_find,dic):
    for key, value in dic.items():
        if abs(value - value_to_find) < 2:
            return key
dic = {}
#Create a name and claculates the area of each floor
for i in range(0,len(floorList)):
    dic_name = 'Floor {}'.format(i)
    dic[dic_name] = floorList[i]

print(dic)

if bool == True: 

    Floor_Plate_Curves.pop(-1)

else:
    
    pass

for  floor in Floor_Plate_Curves: 
    
    
    Floor_Area = comps.Area(floor)
    FloorAreas.append(round(Floor_Area['area'],2))

    
    z_value = int(Floor_Area['centroid'][2])
    
    Floor_Name = findKey(z_value,dic)
    
    print(Floor_Name)

    FloorNames.append(Floor_Name)

keys = FloorNames
values = FloorAreas

TotalBuildingArea = sum(values)
# ---------- end python_3 ----------

# ----
flatten = FlattenTree(Tree=python_3.TotalBuildingArea, Path="{0}")
graft = GraftTree(Tree=flatten, IncludeEmptyLists=True, IncludeNullItems=True)

# ---- group: Calculates Wall Area Ratio
python_4 = GhPythonScript(walls=walls, totalBuildingArea=graft)  # -> keys, values; inputs walls: list
# ---------- python_4: Python ----------
__author__ = "Iliya Muzychuk"
__version__ = "2023.02.03"

import rhinoscriptsyntax as rs
import Grasshopper as gh
import Rhino.Geometry as rg
import ghpythonlib.components as comps

#A function to convert a float to percentage

def float_to_percentage(number):
    return '{:.2%}'.format(number)
    
wall_areas = []

for wall in walls:
    
    area = rs.Area(wall)
    wall_areas.append(area)

total_wall_area = round(sum(wall_areas),2)
wall_area_ratio = total_wall_area / totalBuildingArea

#Dictionary constructions allows future json file control 

dic = {

    'Total Facade Area' : total_wall_area,
    'Wall area/Floor area Ratio' : float_to_percentage(wall_area_ratio)

}

keys = dic.keys()
values = dic.values()
# ---------- end python_4 ----------

# ----
concat = Concatenate(FragmentA=python_4.keys, FragmentB=": ", FragmentC=python_4.values)

# ---- group: Working
rejsonkv = SerializeKeysAndValues(Key=python_3.keys, Value=python_3.values)
panel = Panel(rejsonkv)

# ----
concat_2 = Concatenate(FragmentA=python_3.keys, FragmentB=": ", FragmentC=python_3.values)
concat_3 = Concatenate(FragmentA="Total Building Area", FragmentB=": ", FragmentC=python_3.TotalBuildingArea)
ins = InsertItems(List=concat_2, Item=concat_3, Indices=0, Wrap=True)
panel_2 = Panel(ins)

output_floors = Brep(floors)

# ---- group: Output - Walls
walls_2 = Surface(simplify(trim))

# ----
output_roof = Brep(cap_2)
preview = CustomPreview(Geometry=walls, Material=ColourSwatch(SwatchColor=RGBA(191, 191, 191, 126)))
preview_2 = CustomPreview(Geometry=output_roof, Material=ColourSwatch(SwatchColor=RGB(125, 125, 125)))
preview_3 = CustomPreview(Geometry=output_floors, Material=ColourSwatch(SwatchColor=RGB(164, 212, 126)))
panel_3 = Panel(concat)

lng = ListLength(List=simplify(panel_2))
series = Series(Start=0, Step=typical_floor_height, Count=lng)

lng_2 = ListLength(List=simplify(panel_3))
series_2 = Series(Start=0, Step=typical_floor_height, Count=lng_2)

bbox_2 = BoundingBox(Content=massing, Plane=PlaneXY(0, 0, 0), UnionBox=True)  # -> Box, Box_2
volume = Volume(Geometry=bbox_2.Box)  # -> Volume, Centroid

scale_nu = ScaleNU(Geometry=bbox_2.Box, Plane=volume.Centroid, ScaleX="1.25", ScaleY="1.25", ScaleZ=1)  # -> Geometry, Transform

box_corners_2 = BoxCorners(Box=scale_nu.Geometry)  # -> CornerA, CornerB, CornerC, CornerD, CornerE, CornerF, CornerG, CornerH

Z_2 = UnitZ(Factor=series)
move = Move(Geometry=box_corners_2.CornerA, Motion=Z_2)  # -> Geometry, Transform

pt = Point(box_corners_2.CornerG)

Z_3 = UnitZ(Factor=series_2)
move_2 = Move(Geometry=pt, Motion=Z_3)  # -> Geometry, Transform

screentext = ScreenOrientedText(Text=panel_2, Font="Ariel", Justification=7, Location=move.Geometry, SizeFactor=10, Depth=0, Absolute=False)
screentext_2 = ScreenOrientedText(Text=panel_3, Font="Ariel", Justification=7, Location=move_2.Geometry, SizeFactor=10, Depth=0, Absolute=False)
