# Grasshopper definition Massing Design Calculator 0.4.3.gh (Grasshopper 1.0.7)
# plug-ins: Human

toggle = BooleanToggle(True)
pipeline = GeometryPipeline(
    GroupByLayer=False,
    GroupByType=False,
    IncludeHidden=True,
    IncludeLocked=True,
    LayerFilter="02_MASSING*02_OPTION 1 SOLID",
    NameFilter="*",
    SublayerFiltering=True,
    TypeFilter=1073741848)
pipeline_2 = GeometryPipeline(
    GroupByLayer=False,
    GroupByType=False,
    IncludeHidden=True,
    IncludeLocked=True,
    LayerFilter="02_MASSING*02_OPTION 2 SOLID",
    NameFilter="*",
    SublayerFiltering=True,
    TypeFilter=1073741848)
input = DataInput(
    Destination="G:\My Drive\Scripting Repository\Exchange Data\Envelope_resi.ghdata",
    RelativePath="G:\My Drive\Scripting Repository\Exchange Data\Envelope_resi.ghdata|..\..\Exchange Data\Envelope_resi.ghdata",
    UpdateDelay=50000)
input_2 = DataInput(
    Destination="G:\My Drive\Scripting Repository\Exchange Data\Envelope_comm.ghdata",
    RelativePath="G:\My Drive\Scripting Repository\Exchange Data\Envelope_comm.ghdata|..\..\Exchange Data\Envelope_comm.ghdata",
    UpdateDelay=50000)
filter = StreamFilter(Gate=toggle, Stream0=input_2, Stream1=pipeline_2)
filter_2 = StreamFilter(Gate=toggle, Stream0=input, Stream1=pipeline)
input_3 = DataInput(
    Destination="G:\My Drive\Scripting Repository\Exchange Data\UndergroundParking.ghdata",
    RelativePath="G:\My Drive\Scripting Repository\Exchange Data\UndergroundParking.ghdata|..\..\Exchange Data\UndergroundParking.ghdata",
    UpdateDelay=50000)  # disabled
input_4 = DataInput(
    Destination="G:\My Drive\Scripting Repository\Exchange Data\OpenSpace_Lot.ghdata",
    RelativePath="G:\My Drive\Scripting Repository\Exchange Data\OpenSpace_Lot.ghdata|..\..\Exchange Data\OpenSpace_Lot.ghdata",
    UpdateDelay=50000)  # disabled

# ---- group: Import Mass as PolySurface
massing = Brep(graft(filter_2))

# ----
_1st_stack_floor_height = DigitScroller(Scroller_Digits=12, Scroller_Prefix="1st Stack Floor Height", Scroller_Radix=11, Scroller_Value=10)
no_of_floors = DigitScroller(Scroller_Digits=12, Scroller_Prefix="No. Of Floors", Scroller_Radix=11, Scroller_Value=1)
_2nd_stack_floor_height = DigitScroller(Scroller_Digits=12, Scroller_Prefix="2nd Stack Floor Height", Scroller_Radix=11, Scroller_Value=0)
no_of_floors_2 = DigitScroller(Scroller_Digits=12, Scroller_Prefix="No. Of Floors", Scroller_Radix=11, Scroller_Value=0)
typical_floor_height = DigitScroller(Scroller_Digits=12, Scroller_Prefix="Typical Floor Height", Scroller_Radix=11, Scroller_Value=10)
omit_last_floor_slab = BooleanToggle(True)

# ---- group: Import Mass as PolySurface
massing_2 = Brep(graft(filter))

# ----
_1st_stack_floor_height_2 = DigitScroller(Scroller_Digits=12, Scroller_Prefix="1st Stack Floor Height", Scroller_Radix=11, Scroller_Value=14)
no_of_floors_3 = DigitScroller(Scroller_Digits=12, Scroller_Prefix="No. Of Floors", Scroller_Radix=11, Scroller_Value=1)
_2nd_stack_floor_height_2 = DigitScroller(Scroller_Digits=12, Scroller_Prefix="2nd Stack Floor Height", Scroller_Radix=11, Scroller_Value=0)
no_of_floors_4 = DigitScroller(Scroller_Digits=12, Scroller_Prefix="No. Of Floors", Scroller_Radix=11, Scroller_Value=0)
typical_floor_height_2 = DigitScroller(Scroller_Digits=12, Scroller_Prefix="Typical Floor Height", Scroller_Radix=11, Scroller_Value=10)
omit_last_floor_slab_2 = BooleanToggle(False)
swatch = ColourSwatch(SwatchColor=RGB(192, 192, 192))  # disabled
swatch_2 = ColourSwatch(SwatchColor=RGB(19, 232, 119))  # disabled
preview = CustomPreview(Geometry=input_3, Material=swatch)  # disabled
preview_2 = CustomPreview(Geometry=input_4, Material=swatch_2)  # disabled
cluster = Cluster(
    massing=massing,
    _1st_stack_floor_height=_1st_stack_floor_height,
    no_of_floors=no_of_floors,
    _2nd_stack_floor_height=_2nd_stack_floor_height,
    no_of_floors_2=no_of_floors_2,
    typical_floor_height=typical_floor_height,
    bool=omit_last_floor_slab)  # -> walls_2, facade_attributes_2, points_facade_attributes, roof, floors_2, floors_as_curves_2, building_data_2, points_attributes
cluster_2 = Cluster(
    massing=massing_2,
    _1st_stack_floor_height=_1st_stack_floor_height_2,
    no_of_floors=no_of_floors_3,
    _2nd_stack_floor_height=_2nd_stack_floor_height_2,
    no_of_floors_2=no_of_floors_4,
    typical_floor_height=typical_floor_height_2,
    bool=omit_last_floor_slab_2)  # -> walls_2, facade_attributes_2, points_facade_attributes, roof, floors_2, floors_as_curves_2, building_data_2, points_attributes
output_floors = Brep(cluster.floors_2)

# ---- group: Output - Walls
walls = Surface(simplify(cluster.walls_2))

# ----
output_roof = Brep(cluster.roof)
output_floors_2 = Brep(cluster_2.floors_2)

# ---- group: Output - Walls
walls_2 = Surface(simplify(cluster_2.walls_2))

# ---- group: Output - Floors As Curve
crv = Curve(cluster.floors_as_curves_2)

# ----
output_roof_2 = Brep(cluster_2.roof)

# ---- group: Output - Floors As Curve
crv_2 = Curve(cluster_2.floors_as_curves_2)

# ----
preview_3 = CustomPreview(Geometry=cluster.walls_2, Material=ColourSwatch(SwatchColor=RGBA(191, 191, 191, 126)))
preview_4 = CustomPreview(Geometry=output_roof, Material=ColourSwatch(SwatchColor=RGB(125, 125, 125)))
preview_5 = CustomPreview(Geometry=output_floors, Material=ColourSwatch(SwatchColor=RGB(164, 212, 126)))
preview_6 = CustomPreview(Geometry=cluster_2.walls_2, Material=ColourSwatch(SwatchColor=RGBA(191, 191, 191, 126)))
preview_7 = CustomPreview(Geometry=output_roof_2, Material=ColourSwatch(SwatchColor=RGB(125, 125, 125)))
preview_8 = CustomPreview(Geometry=output_floors_2, Material=ColourSwatch(SwatchColor=RGB(164, 212, 126)))
screentext = ScreenOrientedText(
    Text=cluster.facade_attributes_2,
    Font="Ariel",
    Justification=7,
    Location=cluster.points_facade_attributes,
    SizeFactor=10,
    Depth=0,
    Absolute=False)
screentext_2 = ScreenOrientedText(
    Text=cluster.building_data_2,
    Font="Ariel",
    Justification=7,
    Location=cluster.points_attributes,
    SizeFactor=10,
    Depth=0,
    Absolute=False)
screentext_3 = ScreenOrientedText(
    Text=cluster_2.facade_attributes_2,
    Font="Ariel",
    Justification=7,
    Location=cluster_2.points_facade_attributes,
    SizeFactor=10,
    Depth=0,
    Absolute=False)
screentext_4 = ScreenOrientedText(
    Text=cluster_2.building_data_2,
    Font="Ariel",
    Justification=7,
    Location=cluster_2.points_attributes,
    SizeFactor=10,
    Depth=0,
    Absolute=False)
output = DataOutput(
    DataInput=walls,
    Destination="G:\My Drive\Scripting Repository\Exchange Data\FacadeWalls_resi.ghdata",
    RelativePath="G:\My Drive\Scripting Repository\Exchange Data\FacadeWalls_resi.ghdata|..\..\Exchange Data\FacadeWalls_resi.ghdata")
output_2 = DataOutput(
    DataInput=output_roof,
    Destination="G:\My Drive\Scripting Repository\Exchange Data\Roof_resi.ghdata",
    RelativePath="G:\My Drive\Scripting Repository\Exchange Data\Roof_resi.ghdata|..\..\Exchange Data\Roof_resi.ghdata")
output_3 = DataOutput(
    DataInput=output_floors,
    Destination="G:\My Drive\Scripting Repository\Exchange Data\Floors_resi.ghdata",
    RelativePath="G:\My Drive\Scripting Repository\Exchange Data\Floors_resi.ghdata|..\..\Exchange Data\Floors_resi.ghdata")
output_4 = DataOutput(
    DataInput=walls_2,
    Destination="G:\My Drive\Scripting Repository\Exchange Data\FacadeWalls_comm.ghdata",
    RelativePath="G:\My Drive\Scripting Repository\Exchange Data\FacadeWalls_comm.ghdata|..\..\Exchange Data\FacadeWalls_comm.ghdata")
output_5 = DataOutput(
    DataInput=output_roof_2,
    Destination="G:\My Drive\Scripting Repository\Exchange Data\Roof_comm.ghdata",
    RelativePath="G:\My Drive\Scripting Repository\Exchange Data\Roof_comm.ghdata|..\..\Exchange Data\Roof_comm.ghdata")
output_6 = DataOutput(
    DataInput=output_floors_2,
    Destination="G:\My Drive\Scripting Repository\Exchange Data\Floors_comm.ghdata",
    RelativePath="G:\My Drive\Scripting Repository\Exchange Data\Floors_comm.ghdata|..\..\Exchange Data\Floors_comm.ghdata")

# ==== cluster Cluster
_1st_stack_floor_height = ClusterInput()
no_of_floors = ClusterInput()
no_of_floors_2 = ClusterInput()
typical_floor_height = ClusterInput()
_2nd_stack_floor_height = ClusterInput()
massing = ClusterInput()
massing_2 = Brep(graft(massing))
_1st_stack_floor_height_2 = Integer(_1st_stack_floor_height)
no_of_floors_3 = Integer(no_of_floors_2)
no_of_floors_4 = Integer(no_of_floors)
_2nd_stack_floor_height_2 = Integer(_2nd_stack_floor_height)
typical_floor_height_2 = Integer(typical_floor_height)

# ---- group: Calculates Building Height
bbox = BoundingBox(Content=massing_2, Plane=PlaneXY(0, 0, 0), UnionBox=True)  # -> Box, Box_2
box_corners = BoxCorners(Box=bbox.Box)  # -> CornerA, CornerB, CornerC, CornerD, CornerE, CornerF, CornerG, CornerH
dist = Distance(PointA=box_corners.CornerA, PointB=box_corners.CornerE)

# ----
pdecon = Deconstruct(Point=box_corners.CornerA)  # -> XComponent, YComponent, ZComponent

# ---- group: This Python Component Create the Contour Lines
python = GhPythonScript(
    First_Stack_Floor_Height=_1st_stack_floor_height_2,
    First_Stack_No_Floors=no_of_floors_4,
    Second_Stack_Floor_Height=_2nd_stack_floor_height_2,
    Second_Stack_No_Floors=no_of_floors_3,
    Typical_Floor_Height=typical_floor_height_2,
    Overall_Building_Height=dist,
    start_value_z=pdecon.ZComponent)  # -> Distances, intersection_Planes
# ---------- python: Python ----------
__author__ = "Iliya Muzychuk"
__version__ = "2023.02.03"

import rhinoscriptsyntax as rs
import Grasshopper as gh
import Rhino.Geometry as rg
import ghpythonlib.components as comps
import math

#Variable Declaration

First_Stack_Floor_Height = First_Stack_Floor_Height
First_Stack_No_Floors = First_Stack_No_Floors
Second_Stack_Floor_Height = Second_Stack_Floor_Height
Second_Stack_No_Floors = Second_Stack_No_Floors
Typical_Floor_Height = Typical_Floor_Height
Overall_Building_Height = Overall_Building_Height


#Creates a list of distances for contouring. 

Distances = [0]

#Creates the list of first stack floors 

for i in range(0, int(First_Stack_No_Floors)):
    
    temp_height = (i + 1) * First_Stack_Floor_Height
    print(temp_height)
    Distances.append(temp_height)

#Appends the list the second stack floors 
for i in range(0, int(Second_Stack_No_Floors)):
    
    temp_height = Distances[-1] + Second_Stack_Floor_Height
    Distances.append(temp_height)

remaining_floors = math.floor((round(Overall_Building_Height) - Distances[-1])/Typical_Floor_Height)

for i in range(0, int(remaining_floors)):
    
    temp_height = Distances[-1] + Typical_Floor_Height
    Distances.append(temp_height)
    
#print(remaining_floors)
#print(Distances)

intersection_Planes = []

intersection_Planes = []

for i in range(0,len(Distances)): 
    
    Distances[i] = Distances[i] + start_value_z
    
for z in Distances: 
    
    point = comps.ConstructPoint(0,0,z)
    print(point)
    plane = comps.XYPlane(point)
    intersection_Planes.append(plane)
# ---------- end python ----------

# ----
xy = XYPlane(Origin=python.intersection_Planes)
mesh = MeshBrep(
    Brep=massing_2,
    Settings={GridMaxCount=0, GridMinCount=16, JaggedSeams=False, MaxEdgeLength=0, MinEdgeLength=0.0001, MinTolerance=0, Refine=True, RefineAngle=0, RelativeTolerance=0.65, SimplePlanes=True, Tolerance=0})
sec = MeshPlane(Mesh=mesh, Plane=xy)  # -> simplify(Curves)

# ---- group: Isolate Faces of Mass
debrep = DeconstructBrep(Brep=massing_2)  # -> Faces, Edges, Vertices
evalsrf = EvaluateSurface(Surface=reparameterize(debrep.Faces), Point="{0.5,0.5,0}")  # -> Point, Normal, UDirection, VDirection, Frame
distributefaces = GhPythonScript(v=evalsrf.Normal, faces=debrep.Faces)  # -> floors, facadeWalls, roof; inputs v: list, faces: list
# ---------- distributefaces: Python ----------
__author__ = "ilouh"
__version__ = "2023.01.08"

import rhinoscriptsyntax as rs
import ghpythonlib.components as comps
import Rhino.Geometry as geom

#elements = comps.DeconstructBrep(mass)
#faces = elements['faces']

#find the normal of each face


roof = []
floors = []
solidWalls = []
facadeWalls = [] 

for i in range(0,len(v)):
    
    
    values = comps.DeconstructVector(v[i])
    print(values)
    
    x_value = values['x_component']
    y_value = values['y_component']
    z_value = values['z_component']
    
    

    if z_value >= 0.4:
        
        print(i)
        roof.append(faces[i])
    
    if z_value == -1:
        
        floors.append(faces[i])
   
    if abs(z_value) != 1:
    
        facadeWalls.append(faces[i])
# ---------- end distributefaces ----------

# ----
floors_as_curves = Curve(sec)
flatten = FlattenTree(Tree=massing_2, Path="{0}")
python_2 = GhPythonScript(x=flatten)  # -> a; inputs x: list
# ---------- python_2: Python ----------
__author__ = "ilouh"
__version__ = "2023.02.21"

import rhinoscriptsyntax as rs
import Grasshopper as gh
import Rhino.Geometry as rg
import ghpythonlib.components as comps
import math

if len(x) > 1:
    a = True
else:
    a = False
# ---------- end python_2 ----------
trim = TrimTree(Tree=floors_as_curves, Depth=1)
flatten_2 = FlattenTree(Tree=floors_as_curves, Path="{0}")
filter = StreamFilter(Gate=python_2, Stream0=flatten_2, Stream1=trim)
srf = Surface(flatten(distributefaces.roof))
srf_2 = Surface(graft(distributefaces.facadeWalls))
trim_2 = TrimTree(Tree=srf_2, Depth=1)
omit_last_floor_slab = BooleanToggle(True)
bool = ClusterInput()
walls = Surface(simplify(trim_2))
python_3 = GhPythonScript(x=filter, bool=bool)  # -> floors_as_curves; inputs x: list
# ---------- python_3: Python ----------
__author__ = "ilouh"
__version__ = "2023.02.21"

import rhinoscriptsyntax as rs
import Grasshopper as gh
import Rhino.Geometry as rg
import ghpythonlib.components as comps
import math

if bool is True:
    
    floors_as_curves = x[0:-1]
else:
    floors_as_curves = x
# ---------- end python_3 ----------

floor_thickness = Slider(0.5, range=0..1)
neg = Negative(Value=floor_thickness)
Z = UnitZ(Factor=neg)
extr = Extrude(Base=python_3, Direction=Z)
cap = CapHoles(Brep=extr)

extr_2 = Extrude(Base=srf, Direction=Z)
cap_2 = CapHoles(Brep=extr_2)

roof = ClusterOutput(cap_2)
walls_2 = ClusterOutput(walls)
floors = Brep(simplify(cap))

# ---- group: Calculates Gross Building Area
python_4 = GhPythonScript(Floor_Plate_Curves=filter, floorList=python.Distances, bool=bool)  # -> keys, values, TotalBuildingArea; inputs Floor_Plate_Curves: list of Curve, floorList: list of Int32
# ---------- python_4: Python ----------
__author__ = "Iliya Muzychuk"
__version__ = "2023.02.03"

import rhinoscriptsyntax as rs
import Grasshopper as gh
import Rhino.Geometry as rg
import ghpythonlib.components as comps

FloorNames = []
FloorAreas = []

#Funcition to find the key of a dictionary by value 

def findKey(value_to_find,dic):
    for key, value in dic.items():
        if abs(value - value_to_find) < 2:
            return key
dic = {}
#Create a name and claculates the area of each floor
for i in range(0,len(floorList)):
    floor_number = 1 + i
    dic_name = 'Floor {}'.format(floor_number)
    dic[dic_name] = floorList[i]

print(dic)

if bool == True: 

    Floor_Plate_Curves.pop(-1)

else:
    
    pass

for  floor in Floor_Plate_Curves: 
    
    
    Floor_Area = comps.Area(floor)
    FloorAreas.append(round(Floor_Area['area'],2))

    
    z_value = int(Floor_Area['centroid'][2])
    print(z_value)
    Floor_Name = findKey(z_value,dic)
    
    print(Floor_Name)

    FloorNames.append(Floor_Name)

keys = FloorNames
values = FloorAreas

TotalBuildingArea = sum(values)
# ---------- end python_4 ----------

# ----
flatten_3 = FlattenTree(Tree=python_4.TotalBuildingArea, Path="{0}")
graft = GraftTree(Tree=flatten_3, IncludeEmptyLists=True, IncludeNullItems=True)

# ---- group: Calculates Wall Area Ratio
python_5 = GhPythonScript(walls=walls, totalBuildingArea=graft)  # -> keys, values; inputs walls: list
# ---------- python_5: Python ----------
__author__ = "Iliya Muzychuk"
__version__ = "2023.02.03"

import rhinoscriptsyntax as rs
import Grasshopper as gh
import Rhino.Geometry as rg
import ghpythonlib.components as comps

#A function to convert a float to percentage

def float_to_percentage(number):
    return '{:.2%}'.format(number)
    
wall_areas = []

for wall in walls:
    
    area = rs.Area(wall)
    wall_areas.append(area)

total_wall_area = round(sum(wall_areas),2)
wall_area_ratio = total_wall_area / totalBuildingArea

#Dictionary constructions allows future json file control 

dic = {

    'Total Facade Area' : total_wall_area,
    'Wall area/Floor area Ratio' : float_to_percentage(wall_area_ratio)

}

keys = dic.keys()
values = dic.values()
# ---------- end python_5 ----------

# ----
concat = Concatenate(FragmentA=python_5.keys, FragmentB=": ", FragmentC=python_5.values)
floors_2 = ClusterOutput(floors)
floors_as_curves_2 = ClusterOutput(python_3)
panel = Panel(python_4.keys)
facade_attributes = Data(concat)
facade_attributes_2 = ClusterOutput(facade_attributes)

concat_2 = Concatenate(FragmentA=python_4.keys, FragmentB=": ", FragmentC=python_4.values)
concat_3 = Concatenate(FragmentA="Total Building Area", FragmentB=": ", FragmentC=python_4.TotalBuildingArea)
ins = InsertItems(List=concat_2, Item=concat_3, Indices=0, Wrap=True)

lng = ListLength(List=simplify(facade_attributes))
series = Series(Start=0, Step=typical_floor_height_2, Count=lng)

building_data = Data(ins)
building_data_2 = ClusterOutput(building_data)

lng_2 = ListLength(List=simplify(ins))
series_2 = Series(Start=0, TextSpacing=typical_floor_height_2, Count=lng_2)

Z_2 = UnitZ(Factor=series)

bbox_2 = BoundingBox(Content=massing_2, Plane=PlaneXY(0, 0, 0), UnionBox=True)  # -> Box, Box_2
volume = Volume(Geometry=bbox_2.Box)  # -> Volume, Centroid

scale_nu = ScaleNU(Geometry=bbox_2.Box, Plane=volume.Centroid, ScaleX="1.25", ScaleY="1.25", ScaleZ=1)  # -> Geometry, Transform

box_corners_2 = BoxCorners(Box=scale_nu.Geometry)  # -> CornerA, CornerB, CornerC, CornerD, CornerE, CornerF, CornerG, CornerH

Z_3 = UnitZ(Factor=series_2)
move = Move(Geometry=box_corners_2.CornerA, Motion=Z_3)  # -> Points_Attributes, Transform

pt = Point(box_corners_2.CornerG)

move_2 = Move(Geometry=pt, Motion=Z_2)  # -> Points_Facade_Attributes, Transform

points_facade_attributes = ClusterOutput(move_2.Points_Facade_Attributes)
points_attributes = ClusterOutput(move.Points_Attributes)
