# Grasshopper definition Massing Design Calculator 0.6.2.gh (Grasshopper 1.0.7)

# ---- group: Extremly Low Income
eli = Brep(graft([<brep referenced from the Rhino model> x2]))

# ----
typical_floor_height = DigitScroller(Scroller_Digits=12, Scroller_Prefix="Typical Floor Height", Scroller_Radix=11, Scroller_Value=10)
omit_last_floor_slab = BooleanToggle(False)
cluster = Cluster(massing=eli, typical_floor_height=typical_floor_height, bool=omit_last_floor_slab)  # -> facade_attributes_2, points_facade_attributes, walls_2, roof, floors_2, floor_plate_curves, areas, length_tree
brep = Brep(cluster.floors_2)
brep_2 = Brep(cluster.walls_2)
brep_3 = Brep(cluster.roof)

# ==== cluster Cluster
massing = ClusterInput()
typical_floor_height = ClusterInput()
typical_floor_height_2 = Integer(typical_floor_height)
massing_2 = Brep(massing)

# ---- group: Calculates Building Height
bbox = BoundingBox(Content=massing_2, Plane=PlaneXY(0, 0, 0), UnionBox=True)  # -> Box, Box_2
box_corners = BoxCorners(Box=bbox.Box)  # -> CornerA, CornerB, CornerC, CornerD, CornerE, CornerF, CornerG, CornerH

# ----
Z = UnitZ(Factor=1)
contour = Contour(Shape=massing_2, Point=box_corners.CornerA, Direction=Z, Distance=typical_floor_height_2)  # -> simplify(Contours)
tstat = TreeStatistics(Tree=contour)  # -> Paths, Length, Count
trim = TrimTree(Tree=contour, Depth=1)
panel = Panel(trim)
floors_as_curves = Curve(simplify(contour))

# ---- group: Isolate Faces of Mass
debrep = DeconstructBrep(Brep=massing_2)  # -> Faces, Edges, Vertices
evalsrf = EvaluateSurface(Surface=reparameterize(debrep.Faces), Point="{0.5,0.5,0}")  # -> Point, Normal, UDirection, VDirection, Frame
distributefaces = GhPythonScript(v=evalsrf.Normal, faces=debrep.Faces)  # -> floors, facadeWalls, roof; inputs v: list, faces: list
# ---------- distributefaces: Python ----------
__author__ = "ilouh"
__version__ = "2023.01.08"

import rhinoscriptsyntax as rs
import ghpythonlib.components as comps
import Rhino.Geometry as geom

#elements = comps.DeconstructBrep(mass)
#faces = elements['faces']

#find the normal of each face


roof = []
floors = []
solidWalls = []
facadeWalls = [] 

for i in range(0,len(v)):
    
    
    values = comps.DeconstructVector(v[i])
    print(values)
    
    x_value = values['x_component']
    y_value = values['y_component']
    z_value = values['z_component']
    
    

    if z_value >= 0.4:
        
        print(i)
        roof.append(faces[i])
    
    if z_value == -1:
        
        floors.append(faces[i])
   
    if abs(z_value) != 1:
    
        facadeWalls.append(faces[i])
# ---------- end distributefaces ----------

# ----
srf = Surface(graft(distributefaces.facadeWalls))
srf_2 = Surface(flatten(distributefaces.roof))
srf_3 = Surface(distributefaces.floors)
flatten = FlattenTree(Tree=srf_3, Path="{0}")
trim_2 = TrimTree(Tree=srf, Depth=1)
area = Area(Geometry=flatten)  # -> Area, Centroid
bool = ClusterInput()
ma = MassAddition(Input=area.Area)  # -> Result, PartialResults
walls = Surface(simplify(trim_2))

# ---- group: Pass if Tree or List
python = GhPythonScript(x=floors_as_curves, tree=floors_as_curves)  # -> simplify(flatten(a)); inputs x: list, tree: tree
# ---------- python: Python ----------
__author__ = "ilouh"
__version__ = "2023.02.21"

import rhinoscriptsyntax as rs
import Grasshopper as gh
import Rhino.Geometry as rg
import ghpythonlib.components as comps
from ghpythonlib import treehelpers as th
import math

def remove_brackets(input_str):
    # Remove the brackets
    content = input_str.strip('{}')
    # Split the string by commas and convert to integers
    numbers = [int(num) for num in content.split(';')]

    return numbers
    
test_li = th.tree_to_list(tree)
test_value = len(test_li)

tree_stats = comps.TreeStatistics(tree)
tree_paths = tree_stats['paths']
tree_paths = tree_paths[0]
tree_path_structure = remove_brackets(str(tree_paths))
tree_path_structure_length = len(tree_path_structure)
print(tree_path_structure_length)


if tree_path_structure_length > 1:
    a = True
else:
    a = False
# ---------- end python ----------
trim_3 = TrimTree(Tree=floors_as_curves, Depth=1)
flatten_2 = FlattenTree(Tree=floors_as_curves, Path="{0}")

# ----
item = ListItem(List=python, Index=0, Wrap=True)

# ---- group: Pass if Tree or List (continued)
filter = StreamFilter(Gate=item, Stream0=flatten_2, Stream1=trim_3)

# ----
cls = Closed(Curve=filter)  # -> Closed, Periodic
panel_2 = Panel(cls.Closed)
cull = CullPattern(List=filter, CullPattern=cls.Closed)

# ---- group: Calculates Gross Building Area
python_2 = GhPythonScript(Floor_Plate_Curves=cull, bool=bool)  # -> keys, simplify(values), TotalBuildingArea, Floor_Plate_Curves; inputs Floor_Plate_Curves: list of Curve, floorList: list of Int32
# ---------- python_2: Python ----------
__author__ = "Iliya Muzychuk"
__version__ = "2023.02.03"

import rhinoscriptsyntax as rs
import Grasshopper as gh
import Rhino.Geometry as rg
import ghpythonlib.components as comps

FloorNames = []
FloorAreas = []

#Funcition to find the key of a dictionary by value 

def findKey(value_to_find,dic):
    for key, value in dic.items():
        if abs(value - value_to_find) < 2:
            return key
dic = {}
#Create a name and claculates the area of each floor
for i in range(0,len(floorList)):
    floor_number = 1 + i
    dic_name = 'Floor {}'.format(floor_number)
    dic[dic_name] = floorList[i]

print(dic)

if bool == True: 

    Floor_Plate_Curves.pop(-1)

else:
    
    pass

for  floor in Floor_Plate_Curves: 
    
    
    Floor_Area = comps.Area(floor)
    FloorAreas.append(round(Floor_Area['area'],2))

    
    z_value = int(Floor_Area['centroid'][2])
    print(z_value)
    Floor_Name = findKey(z_value,dic)
    
    print(Floor_Name)

    FloorNames.append(Floor_Name)

keys = FloorNames
values = FloorAreas

TotalBuildingArea = sum(values)
# ---------- end python_2 ----------

# ---- group: creates the extrusion distance
floor_thickness = Slider(0.5, range=0..1)
neg = Negative(Value=floor_thickness)
Z_2 = UnitZ(Factor=neg)
extr = Extrude(Base=python_2.Floor_Plate_Curves, Direction=Z_2)
cap = CapHoles(Brep=extr)

# ----
panel_3 = Panel(python_2.TotalBuildingArea)

extr_2 = Extrude(Base=srf_2, Direction=Z_2)
cap_2 = CapHoles(Brep=extr_2)

floors = Brep(simplify(cap))
flatten_3 = FlattenTree(Tree=python_2.values, Path="{0}")
tstat_2 = TreeStatistics(Tree=python_2.values)  # -> Length_tree, Length, Count

# ---- group: Outputs
floor_plate_curves = ClusterOutput(python_2.Floor_Plate_Curves)
floors_2 = ClusterOutput(floors)
walls_2 = ClusterOutput(walls)
roof = ClusterOutput(cap_2)

# ----
areas = ClusterOutput(flatten_3)
length_tree = ClusterOutput(tstat_2.Length_tree)
flatten_4 = FlattenTree(Tree=python_2.TotalBuildingArea, Path="{0}")
graft = GraftTree(Tree=flatten_4, IncludeEmptyLists=True, IncludeNullItems=True)

# ---- group: Calculates Wall Area Ratio
python_3 = GhPythonScript(walls=walls, totalBuildingArea=graft)  # -> keys, values, result; inputs walls: list
# ---------- python_3: Python ----------
__author__ = "Iliya Muzychuk"
__version__ = "2023.02.03"

import rhinoscriptsyntax as rs
import Grasshopper as gh
import Rhino.Geometry as rg
import ghpythonlib.components as comps

#A function to convert a float to percentage

def float_to_percentage(number):
    return '{:.2%}'.format(number)
    
wall_areas = []

for wall in walls:
    
    area = rs.Area(wall)
    wall_areas.append(area)

total_wall_area = round(sum(wall_areas),2)
wall_area_ratio = total_wall_area / totalBuildingArea

#Dictionary constructions allows future json file control 

dic = {

    'Total Facade Area' : total_wall_area,
    'Wall area/Floor area Ratio' : float_to_percentage(wall_area_ratio)

}

keys = dic.keys()
values = dic.values() 

result = []

for key, value in dic.items():
    
    string = str(key) + ": " + str(value)
    result.append(string)
# ---------- end python_3 ----------

# ----
facade_attributes = Data(python_3.result)

lng = ListLength(List=simplify(facade_attributes))
series = Series(Start=0, Step=typical_floor_height_2, Count=lng)

Z_3 = UnitZ(Factor=series)
move = Move(Motion=Z_3)  # -> Points_Facade_Attributes, Transform

points_facade_attributes = ClusterOutput(move.Points_Facade_Attributes)
facade_attributes_2 = ClusterOutput(facade_attributes)
