# Grasshopper definition Massing Individual Site Calculator 0.2.0.gh (Grasshopper 1.0.7)
# plug-ins: Human, LunchBox

massing = Brep(graft([<brep referenced from the Rhino model> x3]))
_1st_stack_floor_height = DigitScroller(Scroller_Digits=12, Scroller_Prefix="1st Stack Floor Height", Scroller_Radix=11, Scroller_Value=6.4)
no_of_floors = DigitScroller(Scroller_Digits=12, Scroller_Prefix="No. Of Floors", Scroller_Radix=11, Scroller_Value=1)
_2nd_stack_floor_height = DigitScroller(Scroller_Digits=12, Scroller_Prefix="2nd Stack Floor Height", Scroller_Radix=11, Scroller_Value=5.4)
no_of_floors_2 = DigitScroller(Scroller_Digits=12, Scroller_Prefix="No. Of Floors", Scroller_Radix=11, Scroller_Value=1)
typical_floor_height = DigitScroller(Scroller_Digits=12, Scroller_Prefix="Typical Floor Height", Scroller_Radix=11, Scroller_Value=3)
total_allowed_area = DigitScroller(Scroller_Digits=12, Scroller_Prefix="Total Allowed Area", Scroller_Radix=11, Scroller_Value=56675)
max_height = DigitScroller(Scroller_Digits=12, Scroller_Prefix="Max Height", Scroller_Radix=11, Scroller_Value=147)
allowed_greeen_space = DigitScroller(Scroller_Digits=12, Scroller_Prefix="Allowed Greeen Space", Scroller_Radix=11, Scroller_Value=-0.5)

# ---- group: Calculates Building Height
bbox = BoundingBox(Content=flatten(massing), Plane=PlaneXY(0, 0, 0), UnionBox=True)  # -> Box, Box_2
volume = Volume(Geometry=bbox.Box)  # -> Volume, Centroid
scale_nu = ScaleNU(Geometry=bbox.Box, Plane=volume.Centroid, ScaleX="1.25", ScaleY="1.25", ScaleZ=1)  # -> Geometry, Transform
box_corners = BoxCorners(Box=scale_nu.Geometry)  # -> CornerA, CornerB, CornerC, CornerD, CornerE, CornerF, CornerG, CornerH
dist = Distance(PointA=box_corners.CornerA, PointB=box_corners.CornerE)

# ----
scale_nu_2 = ScaleNU(Geometry=bbox.Box, Plane=volume.Centroid, ScaleX="1.25", ScaleY="1.25", ScaleZ="1.25")  # -> Geometry, Transform

# ---- group: Isolate Faces of Mass
debrep = DeconstructBrep(Brep=massing)  # -> Faces, Edges, Vertices
evalsrf = EvaluateSurface(Surface=reparameterize(debrep.Faces), Point="{0.5,0.5,0}")  # -> Point, Normal, UDirection, VDirection, Frame
distributefaces = GhPythonScript(v=evalsrf.Normal, faces=debrep.Faces)  # -> floors, facadeWalls, roof; inputs v: list, faces: list
# ---------- distributefaces: Python ----------
__author__ = "ilouh"
__version__ = "2023.01.08"

import rhinoscriptsyntax as rs
import ghpythonlib.components as comps
import Rhino.Geometry as geom

#elements = comps.DeconstructBrep(mass)
#faces = elements['faces']

#find the normal of each face


roof = []
floors = []
solidWalls = []
facadeWalls = [] 

for i in range(0,len(v)):
    
    
    values = comps.DeconstructVector(v[i])
    print(values)
    
    x_value = values['x_component']
    y_value = values['y_component']
    z_value = values['z_component']
    
    

    if z_value >= 0.7:
        
        print(i)
        roof.append(faces[i])
    
    if z_value == -1:
        
        floors.append(faces[i])
   
    if abs(z_value) != 1:
    
        facadeWalls.append(faces[i])
# ---------- end distributefaces ----------

# ---- group: This Python Component Create the Contour Lines
python = GhPythonScript(
    First_Stack_Floor_Height=_1st_stack_floor_height,
    First_Stack_No_Floors=no_of_floors,
    Second_Stack_Floor_Height=_2nd_stack_floor_height,
    Second_Stack_No_Floors=no_of_floors_2,
    Typical_Floor_Height=typical_floor_height,
    Overall_Building_Height=dist)  # -> Distances, intersection_Planes, No_Floors
# ---------- python: Python ----------
__author__ = "Iliya Muzychuk"
__version__ = "2023.02.03"

import rhinoscriptsyntax as rs
import Grasshopper as gh
import Rhino.Geometry as rg
import ghpythonlib.components as comps
import math

#Variable Declaration

First_Stack_Floor_Height = First_Stack_Floor_Height
First_Stack_No_Floors = First_Stack_No_Floors
Second_Stack_Floor_Height = Second_Stack_Floor_Height
Second_Stack_No_Floors = Second_Stack_No_Floors
Typical_Floor_Height = Typical_Floor_Height
Overall_Building_Height = Overall_Building_Height


#Creates a list of distances for contouring. 

Distances = [0]

#Creates the list of first stack floors 

for i in range(0, int(First_Stack_No_Floors)):
    
    temp_height = (i + 1) * First_Stack_Floor_Height
    print(temp_height)
    Distances.append(temp_height)

#Appends the list the second stack floors 
for i in range(0, int(Second_Stack_No_Floors)):
    
    temp_height = Distances[-1] + Second_Stack_Floor_Height
    Distances.append(temp_height)

remaining_floors = math.floor((round(Overall_Building_Height) - Distances[-1])/Typical_Floor_Height)

for i in range(0, int(remaining_floors)):
    
    temp_height = Distances[-1] + Typical_Floor_Height
    Distances.append(temp_height)
    
#print(remaining_floors)
#print(Distances)

intersection_Planes = []

intersection_Planes = []
for z in Distances: 
    
    point = comps.ConstructPoint(0,0,z)
    print(point)
    plane = comps.XYPlane(point)
    intersection_Planes.append(plane)

No_Floors = len(intersection_Planes)
# ---------- end python ----------

# ----
srf = Surface(reparameterize(graft(distributefaces.facadeWalls)))
srf_2 = Surface(flatten(distributefaces.roof))

xy = XYPlane(Origin=python.intersection_Planes)
mesh = MeshBrep(
    Brep=scale_nu_2.Geometry,
    Settings={GridMaxCount=0, GridMinCount=16, JaggedSeams=False, MaxEdgeLength=0, MinEdgeLength=0.0001, MinTolerance=0, Refine=True, RefineAngle=0, RelativeTolerance=0.65, SimplePlanes=True, Tolerance=0})
sec = MeshPlane(Mesh=mesh, Plane=xy)  # -> flatten(Curves)

boundary = BoundarySurfaces(Edges=sec)
bbx = BrepBrep(BrepA=massing, BrepB=boundary)  # -> simplify(Curves), Points

gridbraced2d = BracedGrid2DStructure(Surface=srf, UDivisions=10, VDivisions=10)  # -> PrimaryLines, BraceLines, StructureNodes

disc = Discontinuity(Curve=sec, Level=1)  # -> Points, Parameters
item = ListItem(List=disc.Points, Index=2, Wrap=True)  # -> flatten(Item)

area = Area(Geometry=flatten(bbx.Curves))  # -> Area, Centroid
ma = MassAddition(Input=area.Area)  # -> Result, PartialResults

area_2 = Area(Geometry=bbx.Curves)  # -> Area, Centroid
pdecon = Deconstruct(Point=area_2.Centroid)  # -> XComponent, YComponent, ZComponent
prune = PruneTree(Tree=bbx.Curves, Minimum=1, Maximum=0)
prune_2 = PruneTree(Tree=pdecon.ZComponent, Minimum=1, Maximum=0)
python_2 = GhPythonScript(z=prune_2, first_floor_height=_1st_stack_floor_height, second_floor_height=_2nd_stack_floor_height)  # -> out, a
# ---------- python_2: Python ----------
__author__ = "ilouh"
__version__ = "2023.02.21"

import rhinoscriptsyntax as rs
import Grasshopper as gh
import Rhino.Geometry as rg
import ghpythonlib.components as comps
import math

z = round(z,1)

try:

    if z == 0:
        a = 6.4
        
    if z ==round(first_floor_height,1):
        a = 5.4
        
    if z >= (round(first_floor_height,1) + round(second_floor_height,1)):
        a = 3
except RuntimeError:
    pass
# ---------- end python_2 ----------
Z = UnitZ(Factor=python_2.a)
extr = Extrude(Base=prune, Direction=Z)

building_area = Number(ma.Result)
no_of_floors_3 = Number(python.No_Floors)
building_height = Number(dist)

ln = Line(StartPoint=box_corners.CornerA, EndPoint=box_corners.CornerE)
python_3 = GhPythonScript(x=no_of_floors_3, line=ln, allowed_height=max_height)  # -> str; inputs line: Curve
# ---------- python_3: Python ----------
__author__ = "ilouh"
__version__ = "2023.02.21"

import rhinoscriptsyntax as rs
import Grasshopper as gh
import Rhino.Geometry as rg
import ghpythonlib.components as comps
import math


dim = comps.Length(line)

if dim < allowed_height:
    no_floors = x 
    str = 'Height {}m ({} floors)'.format(dim,int(no_floors))

else:
    str = 'You are above the allowed height'
# ---------- end python_3 ----------

python_4 = GhPythonScript(building_area=building_area, allowed_area=total_allowed_area)  # -> Compliance, total_building_area; inputs allowed_area: Int32
# ---------- python_4: Python ----------
__author__ = "ilouh"
__version__ = "2023.02.21"

import rhinoscriptsyntax as rs
import Grasshopper as gh
import Rhino.Geometry as rg
import ghpythonlib.components as comps
import math


if building_area > allowed_area: 
    
    Within_conformance = False

else:
    
    Within_conformance = True

Compliance = 'Is the building within compliance: {}'.format(Within_conformance)

building_area = round(building_area,2)
building_area = "{:,}".format(building_area)
total_building_area = 'Total Massing Area: {} m2'.format(building_area)
# ---------- end python_4 ----------
Z_2 = UnitZ(Factor=Slider(3, range=0..10))
pt = Point(box_corners.CornerG)
move = Move(Geometry=pt, Motion=Z_2)  # -> Geometry, Transform
merge = Merge(Data1=python_4.Compliance, Data2=python_4.total_building_area)

python_5 = GhPythonScript(levels=sec)  # -> level_names; inputs levels: list
# ---------- python_5: Python ----------
__author__ = "ilouh"
__version__ = "2023.02.21"

import rhinoscriptsyntax as rs
import Grasshopper as gh
import Rhino.Geometry as rg
import ghpythonlib.components as comps
import math

level_names = []

for i in range(0,len(levels)): 
    
    name = 'level {}'.format(i)
    level_names.append(name)
# ---------- end python_5 ----------
cap = CapHoles(Brep=extr)
screentext = ScreenOrientedText(Text=merge, Justification=7, Location=[move.Geometry, pt], SizeFactor=10, Depth=0, Absolute=False)
previewlw = CustomPreviewLineweights(Geometry=sec, Shader=ColourSwatch(SwatchColor=RGB(192, 192, 192)), Absolute=False)
tag = TextTag(Location=item, Text=python_5)
linedim = LineDimension(Line=ln, Text=python_3, Size=2)
material = CreateMaterial(
    Diffuse=ColourSwatch(SwatchColor=RGB(148, 199, 32)),
    Specular=RGB(255, 255, 255),
    Emission=RGB(0, 0, 0),
    Transparency=0,
    Shine=0)
preview = CustomPreview(Geometry=cap, Material=material)
