# Grasshopper definition Massing Studies By Layers 0.1.0.gh (Grasshopper 1.0.7)

no_of_floors = DigitScroller(Scroller_Digits=12, Scroller_Prefix="No. Of Floors", Scroller_Radix=11, Scroller_Value=0)
no_of_floors_2 = DigitScroller(Scroller_Digits=12, Scroller_Prefix="No. Of Floors", Scroller_Radix=11, Scroller_Value=4)
_2nd_stack_floor_height = DigitScroller(Scroller_Digits=12, Scroller_Prefix="2nd Stack Floor Height", Scroller_Radix=11, Scroller_Value=0)
typical_floor_height = DigitScroller(Scroller_Digits=12, Scroller_Prefix="Typical Floor Height", Scroller_Radix=11, Scroller_Value=3.5)
_1st_stack_floor_height = DigitScroller(Scroller_Digits=12, Scroller_Prefix="1st Stack Floor Height", Scroller_Radix=11, Scroller_Value=4)
omit_last_floor_slab = BooleanToggle(True)

net_coefficient = Slider(80, range=0..100)

geo = Geometry([<brep referenced from the Rhino model> x3])

# ----
# Python script to read associate layers and paths of referenced geometry.
# Cluster includes python scripts to create general building elements
# Python Script to create data and pro forma calculations
# Cluster includes python scripts to create general building elements
# Python Script to create a series of points to display various data
python = GhPythonScript(id=geo)  # -> out, graft(fullPath), parent; inputs id: Guid
# ---------- python: Python ----------
import Rhino
import scriptcontext as sc

sc.doc = Rhino.RhinoDoc.ActiveDoc

obj = sc.doc.Objects.Find(id)
layerIndex = obj.Attributes.LayerIndex
layer = sc.doc.Layers.FindId(sc.doc.Layers[layerIndex].Id)


fullPath = layer.FullPath
parent = fullPath.split("::")[0]

sc.doc = ghdoc
# ---------- end python ----------
massing = Brep(simplify(graft(geo)))
bbox = BoundingBox(Content=massing, Plane=PlaneXY(0, 0, 0))  # -> Box, Box_2
massing_calcs = MassingCalcs(
    massing=massing,
    first_stack_floor_height=_1st_stack_floor_height,
    first_stack_no_floors=no_of_floors_2,
    second_stack_floor_height=_2nd_stack_floor_height,
    second_stack_no_floors=no_of_floors,
    typical_floor_height=typical_floor_height,
    bool=omit_last_floor_slab)  # -> massing_3, massing_height, simplify(graft(roof)), walls, simplify(floors_surfaces), floors_as_plates
distributefaces = GhPythonScript(Massing=simplify(bbox.Box))  # -> floor, walls, roof; inputs Massing: list
# ---------- distributefaces: Python ----------
__author__ = "ilouh"
__version__ = "2023.01.08"

import rhinoscriptsyntax as rs
import ghpythonlib.components as comps
import Rhino.Geometry as geom


roof = []
floor = []
walls = [] 

#find the normal of each face

faces = comps.DeconstructBrep(Massing)['faces']
evaluation_point = comps.ConstructPoint(x_coordinate = 0.5, y_coordinate = 0.5, z_coordinate = 0)

for face in faces: 
    
    vector = comps.EvaluateSurface(face,evaluation_point)['normal']
    
    
    vector_a = comps.VectorXYZ(x_component = vector[0], y_component = vector[1], z_component = vector[2])['vector']
    vector_b = comps.UnitZ(1)

    cross_product = comps.CrossProduct(vector_a,vector_b,True)['vector']
    dot_product = round(comps.DotProduct(vector_a,vector_b,True),4)
    
    print(dot_product)
    
    if abs(dot_product) == 0: 
        walls.append(face)
    
    if dot_product > 0: 
        roof.append(face)
    
    if dot_product == -1: 
        floor.append(face)
# ---------- end distributefaces ----------
srf = Surface(distributefaces.roof)
area = Area(Geometry=srf)  # -> Area, Centroid
brep = Brep(massing_calcs.floors_as_plates)
pt = Point(area.Centroid)
datalocations = GhPythonScript(Point=pt, d=Slider(15, range=0..100), n=Slider(7, range=0..100), step=Slider(8, range=0..100))  # -> data_points; inputs Point: Point3d, n: Int32, step: Int32
# ---------- datalocations: Python ----------
__author__ = "Iliya Muzychuk"
__version__ = "2023.02.03"

import rhinoscriptsyntax as rs
import Grasshopper as gh
import Rhino.Geometry as rg
import ghpythonlib.components as comps

def function(Point,d,n,step):
    
    move_vol_center = comps.Move(Point,comps.UnitZ(d))['geometry']

    #create range for translations
    translated_pts = [] 
    
    for i in range(1,n*step,step):
        print(i)
        translated_pts.append(comps.Move(move_vol_center,comps.UnitZ(i))['geometry'])
    
    return translated_pts
        

    pass

if __name__ == "__main__":
    # Add the main part of your script here
    data_points = function(Point,d,n,step)
# ---------- end datalocations ----------

crv = Curve(massing_calcs.floors_surfaces)
cls = Closed(Curve=crv)  # -> Closed, Periodic
cull = CullPattern(List=crv, CullPattern=cls.Closed)

pro_forma = GhPythonScript(
    floor_curves=simplify(cull),
    program_name=python.fullPath,
    unit_density=Slider(85, range=0..1000),
    net_coef=net_coefficient,
    massing_height=massing_calcs.massing_height,
    typical_story=typical_floor_height)  # -> values, simplify(dic_keys), simplify(dic_values), total_net_area, units; inputs floor_curves: list of Curve, areas: list
# ---------- pro_forma: Python ----------
__author__ = "ilouh"
__version__ = "2023.02.21"

import rhinoscriptsyntax as rs
import Grasshopper as gh
import Rhino.Geometry as rg
import ghpythonlib.components as comps
import math

#sum a list of numbers
def sum(numbers):
    total = 0
    for n in numbers:
        total += n
    return total

def convertString(input_string):
    # Split the string by '/' and take the last part
    parts = input_string.split('::')
    result = parts[-1]
    result = result.lstrip('0123456789_*')
    result = result.lower()
    result = result.capitalize()
    
    return result

#Functions
def format_to_dollar_price(value):
    if isinstance(value, (int, float)):
        formatted_value = "${:,.2f}".format(value)
    elif isinstance(value, str):
        # Remove any non-numeric characters
        value = ''.join(filter(str.isdigit, value))
        if value:
            formatted_value = "${:,.2f}".format(float(value)/100)
        else:
            formatted_value = "$0.00"
    else:
        raise TypeError("Unsupported value type. Only int, float, and str are supported.")
    
    return formatted_value

def float_to_percentage(number):
    percentage = number * 100
    formatted_percentage = "{:.2f}%".format(percentage)
    return formatted_percentage

def format_to_sf_area(value):
    if isinstance(value, (int, float)):
        formatted_value = "{:,.2f} SF".format(value)
    else:
        raise TypeError("Unsupported value type. Only int and float are supported.")
    
    return formatted_value

def totalArea(floor_curves):
    
    areas = []
    
    for floor in floor_curves:
        
        area = comps.Area(floor)['area']
        areas.append(area)
    
    return areas
#_______________________________________________________________________________________
# Calculations


total_area = sum(totalArea(floor_curves))

if total_area > 0: 

    total_net_area = total_area * (net_coef /100)
    units = math.floor(total_net_area/unit_density)
    average_unit_size = total_net_area / units  # Average size of each unit in square feet
    
    # Create a dictionary to store the calculated values
    data_dict = {
        'program_name' : convertString(program_name),
        'total_gross_area': round(total_area,2),
        'total_net_area': round(total_net_area,2),
        'total_Potential_units': round(units,2),
        'average_unit_size': round(average_unit_size,2),
        'massing_height' : massing_height,
        'no_stories' : math.floor(massing_height/typical_story)
        
    }
    
    # Create a list of keys to iterate through
    keys_list = [
        'program_name',
        'total_gross_area',
        'total_net_area',
        'total_Potential_units',
        'average_unit_size',
        'massing_height',
        'no_stories',
        
    
    ]
    

    # Iterate through the keys_list and retrieve corresponding values from the data_dict
    values = []
    for item in keys_list:
        values.append(item + ': ' + str(data_dict[item]))
    
    # Print the values
    print(data_dict['program_name'])
    
    dic_keys = keys_list
    dic_values = []
    
    for key in keys_list: 
        
        dic_values.append(data_dict[key])


    else: 
        pass
# ---------- end pro_forma ----------

path = FilePath("C:\Users\Brooks Scarpa\Google Drive Streaming\Shared drives\BSA Current Projects\23013.0 KAFD 6&7 Masterplan Visioning\23013.0_20_Digital Workspace\01 Rhino\data.json")
panel = Panel(path)
path_mapper = PathMapper(pro_forma.dic_values, source="{A}", target="{0;path_index}")
path_mapper_2 = PathMapper(pro_forma.dic_keys, source="{A}", target="{0;path_index}")
storeasjson = GhPythonScript(tree_keys=path_mapper_2, tree_values=path_mapper, file_path=panel)  # -> dic; inputs tree_keys: tree, tree_values: tree
# ---------- storeasjson: Python ----------
__author__ = "Iliya Muzychuk"
__version__ = "2023.02.03"

import rhinoscriptsyntax as rs
import Grasshopper as gh
import Rhino.Geometry as rg
import ghpythonlib.components as comps
import ghpythonlib.treehelpers as th
import json 

def convertString(input_string):
    # Split the string by '/' and take the last part
    parts = input_string.split('::')
    result = parts[-1]
    result = result.lstrip('0123456789_*')
    result = result.lower()
    result = result.capitalize()
    
    return result

# Remove any leading digits, underscores, and asterisks

def treeToJson(tree_keys,tree_values,file_path):
    
    converted_tree_keys = th.tree_to_list(tree_keys)
    converted_tree_values = th.tree_to_list(tree_values)
    
    dic_list = [] 
    data = {}
    
    for keys,values in zip(converted_tree_keys,converted_tree_values):
        
        temp_dic = dict(zip(keys,values))
        name = convertString(values[0])
        temp_dic['program_name'] = name
        dic_list.append(temp_dic)
    
    for i in range(0,len(dic_list)): 
        
        name = 'Building 0{}'.format(i)
        data[name] = dic_list[i]
        
    #with open(file_path, 'w') as json_file:
    #    json.dump(data, json_file)
       
    return data

if __name__ == "__main__":
    # Add the main part of your script here
    dic = treeToJson(tree_keys,tree_values,file_path)
# ---------- end storeasjson ----------

item = ListItem(List=pro_forma.dic_values, Index=1, Wrap=True)  # -> flatten(Item)
ma = MassAddition(Input=item)  # -> Result, PartialResults
python_2 = GhPythonScript(area=ma.Result)  # -> out
# ---------- python_2: Python ----------
__author__ = "ilouh"
__version__ = "2023.02.21"

import rhinoscriptsyntax as rs
import Grasshopper as gh
import Rhino.Geometry as rg
import ghpythonlib.components as comps
import math

def format_area(value):
    if isinstance(value, (int, float)):
        formatted_value = "{:,.2f}".format(value)
    else:
        raise TypeError("Unsupported value type. Only int and float are supported.")
    
    return formatted_value
    
out = 'Total Site Area {} SQM'.format(format_area(round(area)))
# ---------- end python_2 ----------

concat = Concatenate(FragmentA=pro_forma.dic_keys, FragmentB=": ", FragmentC=pro_forma.dic_values)
tag = TextTag(Location=datalocations, Text=reverse(concat), Colour=ColourSwatch(SwatchColor=RGB(0, 0, 0)))
gsm = Panel(python_2)
keys = Panel(pro_forma.dic_keys)
values = Panel(pro_forma.dic_values)

# ==== cluster MassingCalcs
first_stack_floor_height = ClusterInput()
first_stack_no_floors = ClusterInput()
second_stack_no_floors = ClusterInput()
typical_floor_height = ClusterInput()
second_stack_floor_height = ClusterInput()
massing = ClusterInput()
massing_2 = Brep(graft(massing))

# ---- group: This Python Component Create the Contour Lines
python = GhPythonScript(
    massing=massing_2,
    First_Stack_Floor_Height=first_stack_floor_height,
    First_Stack_No_Floors=first_stack_no_floors,
    Second_Stack_Floor_Height=second_stack_floor_height,
    Second_Stack_No_Floors=second_stack_no_floors,
    Typical_Floor_Height=typical_floor_height)  # -> simplify(Distances), floor_as_curves; inputs massing: GeometryBase
# ---------- python: Python ----------
__author__ = "Iliya Muzychuk"
__version__ = "2023.02.03"

import rhinoscriptsyntax as rs
import Grasshopper as gh
import Rhino.Geometry as rg
import ghpythonlib.components as comps
import math

def bboxHeight(massing):
    
    box_corners_list = comps.BoxCorners(comps.BoundingBox(massing,comps.XYPlane(comps.ConstructPoint(0,0,0)))[0])
    boxHeight = comps.Distance(box_corners_list[0],box_corners_list[4])
    
    return boxHeight,box_corners_list[0]
#Variable Declaration

First_Stack_Floor_Height = First_Stack_Floor_Height
First_Stack_No_Floors = First_Stack_No_Floors
Second_Stack_Floor_Height = Second_Stack_Floor_Height
Second_Stack_No_Floors = Second_Stack_No_Floors
Typical_Floor_Height = Typical_Floor_Height
Overall_Building_Height = bboxHeight(massing)[0]
start_value_z = bboxHeight(massing)[1]

#Creates a list of distances for contouring. 

Distances = [0]

#Creates the list of first stack floors 

for i in range(0, int(First_Stack_No_Floors)):
    
    temp_height = (i + 1) * First_Stack_Floor_Height
    print(temp_height)
    Distances.append(temp_height)

#Appends the list the second stack floors 
for i in range(0, int(Second_Stack_No_Floors)):
    
    temp_height = Distances[-1] + Second_Stack_Floor_Height
    Distances.append(temp_height)

remaining_floors = math.floor((round(Overall_Building_Height) - Distances[-1])/Typical_Floor_Height)

for i in range(0, int(remaining_floors)):
    
    temp_height = Distances[-1] + Typical_Floor_Height
    Distances.append(temp_height)
    
#print(remaining_floors)
#print(Distances)

intersection_Planes = []

intersection_Planes = []

for i in range(0,len(Distances)): 
    
    Distances[i] = Distances[i] + start_value_z[2]
    
for z in Distances: 
    
    point = comps.ConstructPoint(0,0,z)
    print(point)
    plane = comps.XYPlane(point)
    intersection_Planes.append(plane)
 

floor_as_curves = comps.MeshXPlane(massing,intersection_Planes)
# ---------- end python ----------

# ----
distributefaces = GhPythonScript(Massing=simplify(massing_2))  # -> floor, walls, roof, massing_height; inputs Massing: list
# ---------- distributefaces: Python ----------
__author__ = "ilouh"
__version__ = "2023.01.08"

import rhinoscriptsyntax as rs
import ghpythonlib.components as comps
import Rhino.Geometry as geom

def getSrfElevation(surface):
    
    centerPoint = comps.EvaluateSurface(surface,comps.ConstructPoint(0.5,0.5,0))['point']
    elevation = centerPoint[2]
    
    return elevation

roof = []
floor = []
walls = [] 

roof_elevations = []
floor_elevations = []

#find the normal of each face

faces = comps.DeconstructBrep(Massing)['faces']
evaluation_point = comps.ConstructPoint(x_coordinate = 0.5, y_coordinate = 0.5, z_coordinate = 0)

for face in faces: 
    
    vector = comps.EvaluateSurface(face,evaluation_point)['normal']
    
    
    vector_a = comps.VectorXYZ(x_component = vector[0], y_component = vector[1], z_component = vector[2])['vector']
    vector_b = comps.UnitZ(1)

    cross_product = comps.CrossProduct(vector_a,vector_b,True)['vector']
    dot_product = round(comps.DotProduct(vector_a,vector_b,True),4)
    
    print(dot_product)
    
    if abs(dot_product) == 0: 
        walls.append(face)
    
    if dot_product > 0: 
        roof.append(face)
        roof_elevations.append(getSrfElevation(face))
        
        
    if dot_product == -1: 
        floor.append(face)
        floor_elevations.append(getSrfElevation(face))

#sort surface elevations

lowest_floor_elevation = floor_elevations.sort()
lowest_roof_elevation = roof_elevations.sort()

#select lowest floor and heights roof elevations

lowest_floor_elevation = floor_elevations[0]
lowest_roof_elevation = roof_elevations[-1]

#calculates massing height

massing_height = round(lowest_roof_elevation - lowest_floor_elevation,2)
# ---------- end distributefaces ----------

floor_thickness = Slider(0.5, range=0..1)
neg = Negative(Value=floor_thickness)
Z = UnitZ(Factor=neg)

srf = Surface(flatten(distributefaces.roof))
panel = Panel(python.floor_as_curves)
bool = ClusterInput()
python_2 = GhPythonScript(floor_as_curves=python.floor_as_curves, bool=bool, thickenss="0.5")  # -> simplify(floors_as_curves), floors_as_plates; inputs floor_as_curves: list of Curve
# ---------- python_2: Python ----------
__author__ = "ilouh"
__version__ = "2023.02.21"

import rhinoscriptsyntax as rs
import Grasshopper as gh
import Rhino.Geometry as rg
import ghpythonlib.components as comps
import math

def extrudeCurve(curves,thickenss):
    
    floor_plates = []
    
    for curve in curves:
        extrusion = comps.Extrude(curve,comps.UnitZ(-thickenss))
        extrusion = comps.CapHoles(extrusion)
        floor_plates.append(extrusion)
        
        print(floor_plates)
    
    return floor_plates

if bool is True:
    
    floors_as_curves = floor_as_curves[0:-1]
    floors_as_plates = extrudeCurve(floors_as_curves,thickenss)
    
else:
    floors_as_curves = floor_as_curves
    floors_as_plates = extrudeCurve(floors_as_curves,thickenss)
# ---------- end python_2 ----------

extr = Extrude(Base=srf, Direction=Z)
cap = CapHoles(Brep=extr)

python_3 = GhPythonScript(floor_as_curves=python_2.floors_as_curves)  # -> floor_surfaces; inputs floor_as_curves: list of Curve
# ---------- python_3: Python ----------
__author__ = "Iliya Muzychuk"
__version__ = "2023.02.03"

import rhinoscriptsyntax as rs
import Grasshopper as gh
import Rhino.Geometry as rg
import ghpythonlib.components as comps

floors = floor_as_curves
z_values = []

for floor in floors:
    
    z_value = comps.Area(floor)['centroid'][2]
    z_values.append(z_value)

zipped_data = list(zip(floors,z_values))

print(zipped_data)
sorted_data = sorted(zipped_data, key=lambda x: x[1])

#create a dictionary to store grouped data
grouped_data = {}

#iterate through the values and curves

for curve,value in sorted_data:
    if value not in grouped_data:
        grouped_data[value] = [] #create a new list for the value
    grouped_data[value].append(curve)


# convert the dictionary to a list of sublists
grouped_curves_by_floor = list(grouped_data.values())

floor_surfaces = []

for sublist in grouped_curves_by_floor:

    srf = comps.BoundarySurfaces(sublist)
    floor_surfaces.append(srf)
# ---------- end python_3 ----------
python_4 = GhPythonScript(floors_surfaces=python_3, bool=bool, thickenss="0.5")  # -> simplify(floors_surfaces), floors_as_plates; inputs floors_surfaces: list of Surface
# ---------- python_4: Python ----------
__author__ = "ilouh"
__version__ = "2023.02.21"

import rhinoscriptsyntax as rs
import Grasshopper as gh
import Rhino.Geometry as rg
import ghpythonlib.components as comps
import math

def extrudeSurface(surfaces,thickenss):
    
    floor_plates = []
    
    for surface in surfaces:
        extrusion = comps.Extrude(surface,comps.UnitZ(-thickenss))
        floor_plates.append(extrusion)
        
    
    return floor_plates

if bool is True:
    
    floors_surfaces = floors_surfaces[0:-1]
    print(floors_surfaces)
    #floors_as_plates = extrudeSurface(floors_surfaces,thickenss)
    
else:
    floors_surfaces = floors_surfaces
    #floors_as_plates = extrudeSurface(floors_surfaces,thickenss)
# ---------- end python_4 ----------
srf_2 = Surface(python_4.floors_surfaces)  # disabled
Z_2 = UnitZ(Factor=1)
floors_as_plates = ClusterOutput(python_4.floors_as_plates)
massing_3 = ClusterOutput(massing_2)
massing_height = ClusterOutput(distributefaces.massing_height)
roof = ClusterOutput(cap)
walls = ClusterOutput(distributefaces.walls)
floors_surfaces = ClusterOutput(python_4.floors_surfaces)
extr_2 = Extrude(Base=python_3, Direction=Z_2)
