# Grasshopper definition Massing_Explorations 0.1.0.gh (Grasshopper 1.0.7)
# plug-ins: Human

# ---- group: Input - Upper Tower Curves
towers = Curve([<curve referenced from the Rhino model> x4])

# ---- group: Input - Base Curve
base = Curve(<curve referenced from the Rhino model>)

# ----
curve_offset = Slider(10, range=0..100)
extrusion_distance = Slider(30, range=0..100)

# ---- group: Input - Curve
crv = Curve(graft([<curve referenced from the Rhino model> x6]))

# ---- group: Input - Facade Outline
crv_2 = Curve([<curve referenced from the Rhino model> x2])

# ----
area = Area(Geometry=base)  # -> Area, Centroid
xy = XYPlane(Origin=area.Centroid)
boundary = BoundarySurfaces(Edges=crv_2)  # -> reparameterize(Surfaces)
project = Project(Geometry=towers, Plane=xy)  # -> Geometry, Transform

bbox = BoundingBox(Content=crv, Plane=PlaneXY(0, 0, 0))  # -> Box, Box_2
debrep = DeconstructBrep(Brep=bbox.Box)  # -> Faces, Edges, Vertices

boundary_2 = BoundarySurfaces(Edges=project.Geometry)  # -> reparameterize(Surfaces)
evalsrf = EvaluateSurface(Surface=boundary, Point="{0.5,0.5,0.5}")  # -> Point, Normal, UDirection, VDirection, Frame
evalsrf_2 = EvaluateSurface(Surface=boundary_2, Point="{0.5,0.5,0.5}")  # -> Point, Normal, UDirection, VDirection, Frame
boundary_3 = BoundarySurfaces(Edges=debrep.Faces)  # -> reparameterize(Surfaces)
popgeo = PopulateGeometry(Geometry=boundary, Count=Slider(15, range=0..20), Seed=Slider(10, range=0..20))
evalsrf_3 = EvaluateSurface(Surface=boundary_3, Point="{0.5,0.5,0.5}")  # -> Point, Normal, UDirection, VDirection, Frame
Z = UnitZ(Factor=Slider(5, range=0..10))
Z_2 = UnitZ(Factor=Slider(10, range=0..10))
scale_nu = ScaleNU(
    Geometry=project.Geometry,
    Plane=evalsrf_2.Frame,
    ScaleX=Slider(1.6, range=1..2),
    ScaleY=Slider(1.8, range=1..2),
    ScaleZ=1)  # -> Geometry, Transform
move = Move(Geometry=project.Geometry, Motion=Z)  # -> Geometry, Transform
move_2 = Move(Geometry=project.Geometry, Motion=Z_2)  # -> Geometry, Transform

crv_cp = CurveClosestPoint(Point=popgeo, Curve=graft(crv_2))  # -> Point, Parameter, Distance
larger = LargerThan(FirstNumber=crv_cp.Distance, SecondNumber=Slider(7, range=0..10))  # -> LargerThan, OrEqualTo
cull = CullPattern(List=popgeo, CullPattern=larger.LargerThan)

offset = OffsetCurve(Curve=crv, Distance=curve_offset, Plane=evalsrf_3.Frame, Corners=Slider(1, range=0..4))
merge = Merge(Data1=graft(scale_nu.Geometry), Data2=graft(move.Geometry), Data3=graft(move_2.Geometry), Data4=graft(towers))
end = EndPoints(Curve=crv)  # -> Start, End
end_2 = EndPoints(Curve=offset)  # -> Start, End
loft = Loft(Curves=merge, Options={Adjust=True, Closed=False, LoftEnds=0, LoftSimp=0, LoftType=1, Rebuild=10, Refit=0.01})  # -> flatten(Loft)
boundary_4 = BoundarySurfaces(Edges=[base, scale_nu.Geometry])
panel = Panel(merge)
ln = Line(StartPoint=end.Start, EndPoint=end_2.Start)  # -> simplify(Line)
ln_2 = Line(StartPoint=end.End, EndPoint=end_2.End)  # -> simplify(Line)
crv_3 = Curve(simplify(offset))
pl_origin = PlaneOrigin(Base=graft(evalsrf.Frame), Origin=cull)

dom = ConstructDomain(DomainStart=Slider(27, range=0..100), DomainEnd=Slider(12, range=0..100))
lng = ListLength(List=pl_origin)
random = Random(Range=dom, Number=lng, Seed=Slider(5, range=0..10), Integers=True)

dom_2 = ConstructDomain(DomainStart=Slider(17, range=0..100), DomainEnd=Slider(25, range=0..100))
lng_2 = ListLength(List=pl_origin)
random_2 = Random(Range=dom_2, Number=lng_2, Seed=Slider(5, range=0..10), Integers=True)

crv_4 = Curve(crv)
join = BrepJoin(Breps=[loft, boundary_4])  # -> Breps, Closed
flatten = FlattenTree(Tree=ln, Path="{0}")
flatten_2 = FlattenTree(Tree=ln_2, Path="{0}")
flatten_3 = FlattenTree(Tree=crv_3, Path="{0}")
flatten_4 = FlattenTree(Tree=crv_4, Path="{0}")
number_slider = Slider(3, range=0..10)

num = Number(random)
neg = Negative(Value=num)
dom_3 = ConstructDomain(DomainStart=neg, DomainEnd=num)

num_2 = Number(random_2)
neg_2 = Negative(Value=num_2)
dom_4 = ConstructDomain(DomainStart=neg_2, DomainEnd=num_2)

graft = GraftTree(Tree=flatten, IncludeEmptyLists=True, IncludeNullItems=True)
graft_2 = GraftTree(Tree=flatten_2, IncludeEmptyLists=True, IncludeNullItems=True)
graft_3 = GraftTree(Tree=flatten_3, IncludeEmptyLists=True, IncludeNullItems=True)
graft_4 = GraftTree(Tree=flatten_4, IncludeEmptyLists=True, IncludeNullItems=True)
merge_2 = Merge(Data1=simplify(graft), Data2=simplify(graft_2), Data3=simplify(graft_3), Data4=simplify(graft_4))
amp = Amplitude(Vector=evalsrf_3.Normal, Amplitude=extrusion_distance)

# ---- group: Output - Brep
final_form = Brep(join.Breps)

# ----
join_2 = JoinCurves(Curves=merge_2, Preserve=False)
previewmat = CustomPreviewMaterials(Geometry=join.Breps, DiffuseColor=ColourSwatch(SwatchColor=RGB(55, 177, 255)))
extr = Extrude(Base=join_2, Direction=amp)

# ---- group: Spilt the surfaces and selects the biggest surface
rectangle = Rectangle(Plane=pl_origin, XSize=dom_3, YSize=dom_4, Radius=0)  # -> simplify(Rectangle), Length
graft_5 = GraftTree(Tree=crv_2, IncludeEmptyLists=True, IncludeNullItems=True)  # -> simplify(Tree)
boundary_5 = BoundarySurfaces(Edges=graft_5)
boundary_6 = BoundarySurfaces(Edges=rectangle.Rectangle)
srfsplit = SurfaceSplit(Surface=boundary_5, Curves=boundary_6)  # -> simplify(Fragments)
area_2 = Area(Geometry=srfsplit)  # -> Area, Centroid
sort = SortList(Keys=area_2.Area, ValuesA=srfsplit)  # -> Keys, reverse(ValuesA)
item = ListItem(List=sort.ValuesA, Index=0, Wrap=True)

# ----
cap = CapHoles(Brep=extr)
previewmat_2 = CustomPreviewMaterials(Geometry=cap, DiffuseColor=ColourSwatch(SwatchColor=RGB(88, 195, 116)))
crv_5 = Curve([<curve referenced from the Rhino model> x4])
boundary_7 = BoundarySurfaces(Edges=crv_5)

# ---- group: Ouput - Porous Surface
srf = Surface(item)

# ---- group: Input Surfaces
srf_2 = Surface(srf)

# ----
evalsrf_4 = EvaluateSurface(Surface=srf_2, Point="{0.5,0.5,0.5}")  # -> Point, Normal, UDirection, VDirection, Frame
amp_2 = Amplitude(Vector=evalsrf_4.Normal, Amplitude=Slider(14, range=0..50))
extr_2 = Extrude(Base=srf_2, Direction=amp_2)
previewmat_3 = CustomPreviewMaterials(Geometry=extr_2, DiffuseColor=ColourSwatch(SwatchColor=RGB(88, 195, 116)))
