# Grasshopper definition Massing_Random Extrusion of Rectangular.gh (Grasshopper 1.0.7)

crv = Curve([<curve referenced from the Rhino model> x7])

number_slider = Slider(10, range=0..50)
number_slider_2 = Slider(23, range=0..50)
number_slider_3 = Slider(4, range=0..50)
typical_story_height = Slider(10, range=0..50)

pt = Point([<point referenced from the Rhino model> x14])
lng = ListLength(List=crv)
panel = Panel(pt)
lng_2 = ListLength(List=pt)
dom = ConstructDomain(DomainStart=number_slider_3, DomainEnd=number_slider)
random = Random(Range=dom, Number=lng, Seed=number_slider_2, Integers=True)
expression = Expression(x=random, y=typical_story_height, Expression="x*y")

dom_2 = ConstructDomain(DomainStart=Slider(10, range=0..50), DomainEnd=Slider(20, range=0..50))
random_2 = Random(Range=dom_2, Number=lng_2, Seed=Slider(1, range=0..5), Integers=True)
neg = Negative(Value=random_2)
dom_3 = ConstructDomain(DomainStart=random_2, DomainEnd=neg)

Z = UnitZ(Factor=expression)

dom_4 = ConstructDomain(DomainStart=Slider(10, range=0..50), DomainEnd=Slider(20, range=0..50))
random_3 = Random(Range=dom_4, Number=lng_2, Seed=Slider(2, range=0..5), Integers=True)
neg_2 = Negative(Value=random_3)
dom_5 = ConstructDomain(DomainStart=random_3, DomainEnd=neg_2)

panel_2 = Panel(expression)
extr = Extrude(Base=crv, Direction=Z)
cap = CapHoles(Brep=extr)
panel_3 = Panel(dom_3)
# Create a rectangular shape - Random sizes
rectangle = Rectangle(Plane=pt, XSize=dom_3, YSize=dom_5, Radius=0)  # -> Rectangle, Length
dom_6 = ConstructDomain(DomainStart=number_slider_3, DomainEnd=number_slider)
panel_4 = Panel("Extrude Shape")
random_4 = Random(Range=dom_6, Number=lng_2, Seed=number_slider_2, Integers=True)
expression_2 = Expression(x=random_4, y=typical_story_height, Expression="x*y")
Z_2 = UnitZ(Factor=expression_2)
panel_5 = Panel(expression_2)
extr_2 = Extrude(Base=rectangle.Rectangle, Direction=Z_2)
panel_6 = Panel("Capping")
cap_2 = CapHoles(Brep=extr_2)
