# Grasshopper definition Massing_TypologyMapping 0.1.0.gh (Grasshopper 1.0.7)

# ---- group: Database
box = Brep(<brep referenced from the Rhino model>)
l_shape = Brep(<brep referenced from the Rhino model>)
courtyard = Brep(<brep referenced from the Rhino model>)
doughnut = Brep(<brep referenced from the Rhino model>)
merge = Merge(Data1=box, Data2=l_shape, Data3=courtyard, Data4=doughnut)

# ---- group: Import Building Envelope
building_envelope = Brep()

# ---- group: Input - Story Height
input_story = Number()

# ----
list = ValueList({"Box Shaped Building": "Box Building", "L Shaped Building": "L Building", "Courtyard Shaped Building": "Courtyard Building", "Doughnut Shape Building": "Doughnut Building"}, selected="Courtyard Shaped Building")
xy = XYPlane(Origin=Point(0, 0, 0))
building_typology = GhPythonScript(li=merge, building_type=list, envelope=building_envelope, xyplane=xy)  # -> typology, sourcebb, targetbb; inputs li: list of Brep, envelope: Brep
# ---------- building_typology: Python ----------
__author__ = "iliyamuzychuk"

import rhinoscriptsyntax as rs
import Grasshopper as gh
import Rhino.Geometry as rg
import ghpythonlib.components as comps

def listToTree(nestedList):
    
    """ Convert a nested python iterable to a datatree """
    
    dt = gh.DataTree[object]()
    for i,l in enumerate(nestedList):
        dt.AddRange(l,gh.Kernel.Data.GH_Path(i))
        
    return dt
    

dic = { 

    'Box Building' : li[0],
    'L Building' : li[1],
    'Courtyard Building' : li[2],
    'Doughnut Building' : li[3]
    
}


typology = dic[building_type]

print(typology)

sourcebb = comps.BoundingBox(typology,xyplane)
sourcebb = sourcebb['box']
print(sourcebb)
targetbb = comps.BoundingBox(envelope,xyplane)
targetbb = targetbb['box']
# ---------- end building_typology ----------
boxmap = BoxMapping(Geometry=building_typology.typology, Source=building_typology.sourcebb, Target=building_typology.targetbb)  # -> Geometry, Transform
contour = Contour(Shape=boxmap.Geometry, Point=Point(0, 0, 0), Direction=Vector(0, 0, 1), Distance=input_story)
boundary = BoundarySurfaces(Edges=contour)
floor_plates = Surface(boundary)
Z = UnitZ(Factor=input_story)
swatch = ColourSwatch(SwatchColor=RGB(198, 183, 255))
extr = Extrude(Base=floor_plates, Direction=Z)
material = CreateMaterial(Diffuse=swatch, Specular=swatch, Emission=swatch, Transparency=Slider(0.1, range=0..1), Shine=0)
preview = CustomPreview(Geometry=extr, Material=material)
