# Grasshopper definition Residential Concept Design Calculator 0.2.0.gh (Grasshopper 1.0.7)
# plug-ins: Human

_1st_stack_floor_height = DigitScroller(Scroller_Digits=12, Scroller_Prefix="1st Stack Floor Height", Scroller_Radix=11, Scroller_Value=15)
no_of_floors = DigitScroller(Scroller_Digits=12, Scroller_Prefix="No. Of Floors", Scroller_Radix=11, Scroller_Value=2)
_2nd_stack_floor_height = DigitScroller(Scroller_Digits=12, Scroller_Prefix="2nd Stack Floor Height", Scroller_Radix=11, Scroller_Value=12)
no_of_floors_2 = DigitScroller(Scroller_Digits=12, Scroller_Prefix="No. Of Floors", Scroller_Radix=11, Scroller_Value=0)
typical_floor_height = DigitScroller(Scroller_Digits=12, Scroller_Prefix="Typical Floor Height", Scroller_Radix=11, Scroller_Value=10)

# ---- group: Import Mass as PolySurface
massing = Brep(graft([<brep referenced from the Rhino model> x4]))

# ---- group: Calculates Building Height
bbox = BoundingBox(Content=flatten(massing), Plane=PlaneXY(0, 0, 0), UnionBox=True)  # -> Box, Box_2
box_corners = BoxCorners(Box=bbox.Box)  # -> CornerA, CornerB, CornerC, CornerD, CornerE, CornerF, CornerG, CornerH
dist = Distance(PointA=box_corners.CornerA, PointB=box_corners.CornerE)

# ---- group: This Python Component Create the Contour Lines
python = GhPythonScript(
    First_Stack_Floor_Height=_1st_stack_floor_height,
    First_Stack_No_Floors=no_of_floors,
    Second_Stack_Floor_Height=_2nd_stack_floor_height,
    Second_Stack_No_Floors=no_of_floors_2,
    Typical_Floor_Height=typical_floor_height,
    Overall_Building_Height=dist)  # -> Distances
# ---------- python: Python ----------
__author__ = "Iliya Muzychuk"
__version__ = "2023.02.03"

import rhinoscriptsyntax as rs
import Grasshopper as gh
import Rhino.Geometry as rg
import ghpythonlib.components as comps
import math

#Variable Declaration

First_Stack_Floor_Height = First_Stack_Floor_Height
First_Stack_No_Floors = First_Stack_No_Floors
Second_Stack_Floor_Height = Second_Stack_Floor_Height
Second_Stack_No_Floors = Second_Stack_No_Floors
Typical_Floor_Height = Typical_Floor_Height
Overall_Building_Height = Overall_Building_Height


#Creates a list of distances for contouring. 

Distances = [0]

#Creates the list of first stack floors 

for i in range(0, int(First_Stack_No_Floors)):
    
    temp_height = (i + 1) * First_Stack_Floor_Height
    Distances.append(temp_height)

#Appends the list the second stack floors 
for i in range(0, int(Second_Stack_No_Floors)):
    
    temp_height = Distances[-1] + Second_Stack_Floor_Height
    Distances.append(temp_height)

remaining_floors = math.floor((round(Overall_Building_Height) - Distances[-1])/Typical_Floor_Height)

for i in range(0, int(remaining_floors)):
    
    temp_height = Distances[-1] + Typical_Floor_Height
    Distances.append(temp_height)
    
print(remaining_floors)
print(Distances)
# ---------- end python ----------

# ----
xy = XYPlane(Origin=Point(0, 0, 0))

# ---- group: Isolate Faces of Mass
debrep = DeconstructBrep(Brep=massing)  # -> Faces, Edges, Vertices
evalsrf = EvaluateSurface(Surface=reparameterize(debrep.Faces), Point="{0.5,0.5,0}")  # -> Point, Normal, UDirection, VDirection, Frame
distributefaces = GhPythonScript(v=evalsrf.Normal, faces=debrep.Faces)  # -> floors, facadeWalls, roof; inputs v: list, faces: list
# ---------- distributefaces: Python ----------
__author__ = "ilouh"
__version__ = "2023.01.08"

import rhinoscriptsyntax as rs
import ghpythonlib.components as comps
import Rhino.Geometry as geom

#elements = comps.DeconstructBrep(mass)
#faces = elements['faces']

#find the normal of each face


roof = []
floors = []
solidWalls = []
facadeWalls = [] 

for i in range(0,len(v)):
    
    
    values = comps.DeconstructVector(v[i])
    print(values)
    
    x_value = values['x_component']
    y_value = values['y_component']
    z_value = values['z_component']
    
    

    if z_value >= 0.7:
        
        print(i)
        roof.append(faces[i])
    
    if z_value == -1:
        
        floors.append(faces[i])
   
    if abs(z_value) != 1:
    
        facadeWalls.append(faces[i])
# ---------- end distributefaces ----------

# ----
contour = ContourEx(Shape=massing, Plane=xy, Offsets=python)
trim = TrimTree(Tree=contour, Depth=1)

# ---- group: Sort Floor Plates
area = Area(Geometry=trim)  # -> Area, Centroid
pdecon = Deconstruct(Point=area.Centroid)  # -> XComponent, YComponent, ZComponent
sort = SortList(Keys=pdecon.ZComponent, ValuesA=trim)  # -> Keys, ValuesA

# ----
srf = Surface(flatten(distributefaces.roof))
srf_2 = Surface(graft(distributefaces.facadeWalls))
trim_2 = TrimTree(Tree=srf_2, Depth=1)
walls = Surface(simplify(trim_2))

# ---- group: Calculates Gross Building Area
python_2 = GhPythonScript(Floor_Plate_Curves=trim, floorList=python)  # -> keys, values, TotalBuildingArea; inputs Floor_Plate_Curves: list of Curve, floorList: list of Int32
# ---------- python_2: Python ----------
__author__ = "Iliya Muzychuk"
__version__ = "2023.02.03"

import rhinoscriptsyntax as rs
import Grasshopper as gh
import Rhino.Geometry as rg
import ghpythonlib.components as comps

FloorNames = []
FloorAreas = []

#Funcition to find the key of a dictionary by value 

def findKey(value_to_find,dic):
    for key, value in dic.items():
        if abs(value - value_to_find) < 2:
            return key
dic = {}
#Create a name and claculates the area of each floor
for i in range(0,len(floorList)):
    dic_name = 'Floor {}'.format(i)
    dic[dic_name] = floorList[i]

print(dic)

Floor_Plate_Curves.pop(-1)

for  floor in Floor_Plate_Curves: 
    
    
    Floor_Area = comps.Area(floor)
    FloorAreas.append(round(Floor_Area['area'],2))
    
    z_value = int(Floor_Area['centroid'][2])
    
    Floor_Name = findKey(z_value,dic)
    
    print(z_value)

    FloorNames.append(Floor_Name)

keys = FloorNames
values = FloorAreas

TotalBuildingArea = sum(values)
# ---------- end python_2 ----------

# ----
flatten = FlattenTree(Tree=python_2.TotalBuildingArea, Path="{0}")
graft = GraftTree(Tree=flatten, IncludeEmptyLists=True, IncludeNullItems=True)

# ---- group: Calculates Wall Area Ratio
python_3 = GhPythonScript(walls=walls, totalBuildingArea=graft)  # -> keys, values; inputs walls: list
# ---------- python_3: Python ----------
__author__ = "Iliya Muzychuk"
__version__ = "2023.02.03"

import rhinoscriptsyntax as rs
import Grasshopper as gh
import Rhino.Geometry as rg
import ghpythonlib.components as comps

#A function to convert a float to percentage

def float_to_percentage(number):
    return '{:.2%}'.format(number)
    
wall_areas = []

for wall in walls:
    
    area = rs.Area(wall)
    wall_areas.append(area)

total_wall_area = round(sum(wall_areas),2)
wall_area_ratio = total_wall_area / totalBuildingArea

#Dictionary constructions allows future json file control 

dic = {

    'Total Facade Area' : total_wall_area,
    'Wall area/Floor area Ratio' : float_to_percentage(wall_area_ratio)

}

keys = dic.keys()
values = dic.values()
# ---------- end python_3 ----------

# ----
panel = Panel(python_2.keys)
concat = Concatenate(FragmentA=python_3.keys, FragmentB=": ", FragmentC=python_3.values)
panel_2 = Panel(concat)
swatch = ColourSwatch(SwatchColor=RGBA(191, 191, 191, 86))  # disabled
swatch_2 = ColourSwatch(SwatchColor=RGB(125, 125, 125))  # disabled
swatch_3 = ColourSwatch(SwatchColor=RGB(164, 212, 126))  # disabled
concat_2 = Concatenate(FragmentA="Total Building Area", FragmentB=": ", FragmentC=python_2.TotalBuildingArea)
preview = CustomPreview(Geometry=walls, Material=swatch)  # disabled

bbox_2 = BoundingBox(Content=massing, Plane=PlaneXY(0, 0, 0), UnionBox=False)  # -> Box, Box_2
volume = Volume(Geometry=bbox_2.Box)  # -> Volume, Centroid
scale = Scale(Geometry=bbox_2.Box, Center=volume.Centroid, Factor=1.25)  # -> Geometry, Transform
box_corners_2 = BoxCorners(Box=scale.Geometry)  # -> CornerA, CornerB, CornerC, CornerD, CornerE, CornerF, CornerG, CornerH

pt = Point(box_corners_2.CornerA)
no_of_commercial_floors = DigitScroller(Scroller_Digits=12, Scroller_Prefix="No. Of Commercial Floors", Scroller_Radix=11, Scroller_Value=2)
python_4 = GhPythonScript(floor_plates=sort.ValuesA, n_commercial=no_of_commercial_floors)  # -> residential, commercial; inputs floor_plates: list of Curve
# ---------- python_4: Python ----------
__author__ = "ilouh"
__version__ = "2023.02.21"

import rhinoscriptsyntax as rs
import Grasshopper as gh
import Rhino.Geometry as rg
import ghpythonlib.components as comps
import math

residential = floor_plates[int(n_commercial):]
residential.pop(-1)
commercial = floor_plates[:int(n_commercial)]
# ---------- end python_4 ----------
residential = Curve(python_4.residential)
commercial = Curve(python_4.commercial)
merge = Merge(Data1=residential, Data2=commercial)

neg = Negative(Value=Slider(0.5, range=0..1))
Z = UnitZ(Factor=neg)
extr = Extrude(Base=merge, Direction=Z)
cap = CapHoles(Brep=extr)

extr_2 = Extrude(Base=srf, Direction=Z)
cap_2 = CapHoles(Brep=extr_2)

floors = Brep(simplify(cap))
output_floors = Brep(floors)  # disabled
output_roof = Brep(cap_2)  # disabled
preview_2 = CustomPreview(Geometry=output_roof, Material=swatch_2)  # disabled
preview_3 = CustomPreview(Geometry=output_floors, Material=swatch_3)  # disabled
path_curve = Curve(reparameterize(graft(residential)))
true_by_unit_length_false_by_unit_area = BooleanToggle(False)
true_inboard_false_outboard = BooleanToggle(False)
unit_area = DigitScroller(Scroller_Digits=12, Scroller_Prefix="Unit Area", Scroller_Radix=9, Scroller_Value=600)
unit_width = DigitScroller(Scroller_Digits=12, Scroller_Prefix="Unit Width", Scroller_Radix=9, Scroller_Value=25)
unit_length = DigitScroller(Scroller_Digits=12, Scroller_Prefix="Unit Length", Scroller_Radix=9, Scroller_Value=30)
unit_height = DigitScroller(Scroller_Digits=12, Scroller_Prefix="Unit Height", Scroller_Radix=9, Scroller_Value=9.25)

python_5 = GhPythonScript(bool=true_inboard_false_outboard)  # -> coef
# ---------- python_5: Python ----------
__author__ = "ilouh"
__version__ = "2023.02.21"

import rhinoscriptsyntax as rs
import Grasshopper as gh
import Rhino.Geometry as rg
import ghpythonlib.components as comps
import math

if bool == True: 
    
    coef = 1

else:
    
    coef = -1
# ---------- end python_5 ----------
expression = Expression(Unit_Length=unit_length, coef=python_5, Expression="coef * Unit_Length")
expression_2 = Expression(Unit_Area=unit_area, Unit_Width=unit_width, coef=python_5, Expression="coef * Ceiling(Unit_Area/Unit_Width)")

explode = Explode(Curve=path_curve, Recursive=True)  # -> simplify(Segments), Vertices

# ---- group: Creates a script to subdivide a curve into units
python_6 = GhPythonScript(crv=explode.Segments, facade_length=unit_width)  # -> simplify(points); inputs crv: Curve
# ---------- python_6: Python ----------
__author__ = "ilouh"
__version__ = "2022.12.10"

import rhinoscriptsyntax as rs
import ghpythonlib.components as comps

def subdivide_curve(curve, num_subdivisions):

    # Use the DivideCurve function to perform the subdivision
    points = rs.DivideCurve(curve, num_subdivisions)
    
    curve_segments = []
    shatter_parameters = []
    
    for i in range(len(points) - 1):
        
        #curve_segments.append(rs.AddLine(points[i], points[i + 1]))
        
        t = rs.CurveClosestPoint(curve, points[i])
        shatter_parameters.append(t)
        
    curve_segments = comps.Shatter(curve,shatter_parameters)

    return curve_segments


length = rs.CurveLength(crv)

num = round(length / facade_length,0)
a = subdivide_curve(crv,num)
points = rs.DivideCurve(crv, num)
# ---------- end python_6 ----------

# ----
filter = StreamFilter(Gate=true_by_unit_length_false_by_unit_area, Stream0=expression_2, Stream1=expression)
Z_2 = UnitZ(Factor=expr("x-2", unit_height))

# ---- group: This panel can be exported to a CSV
concat_3 = Concatenate(FragmentA=python_2.keys, FragmentB=": ", FragmentC=python_2.values)

# ----
ins = InsertItems(List=concat_3, Item=concat_2, Indices=0, Wrap=True)

# ---- group: This panel can be exported to a CSV (continued)
panel_3 = Panel(ins)

# ----
lng = ListLength(List=simplify(panel_3))
series = Series(Start=Slider(38, range=0..100), Step=typical_floor_height, Count=lng)  # -> simplify(Series)
Z_3 = UnitZ(Factor=series)
move = Move(Geometry=pt, Motion=Z_3)  # -> Geometry, Transform

screentext = ScreenOrientedText(
    Text=simplify(panel_3),
    Font="Ariel",
    Justification=7,
    Location=simplify(move.Geometry),
    SizeFactor=10,
    Depth=0,
    Absolute=False)

# ---- group: Offset the curves and joins the points for the demising lines
offset = OffsetCurve(Curve=path_curve, Distance=filter, Corners=Slider(1, range=0..4))
crv_cp = CurveClosestPoint(Point=python_6, Curve=reparameterize(graft(explode.Segments)))  # -> Point, Parameter, Distance

# ----
explode_2 = Explode(Curve=offset, Recursive=True)  # -> simplify(Segments), Vertices

# ---- group: Offset the curves and joins the points for the demising lines (continued)
crv_cp_2 = CurveClosestPoint(Point=python_6, Curve=simplify(graft(explode_2.Segments)))  # -> Point, Parameter, Distance
ln = Line(StartPoint=crv_cp.Point, EndPoint=crv_cp_2.Point)

# ---- group: Checks Vector Degree
end = EndPoints(Curve=ln)  # -> Start, End
crv_cp_3 = CurveClosestPoint(Point=end.Start, Curve=graft(explode.Segments))  # -> Point, Parameter, Distance
vec2pt = Vector2Pt(PointA=end.Start, PointB=end.End, Unitize=False)  # -> Vector, Length
eval = EvaluateCurve(Curve=graft(explode.Segments), Parameter=crv_cp_3.Parameter)  # -> Point, Tangent, Angle
dprod = DotProduct(VectorA=eval.Tangent, VectorB=vec2pt.Vector, Unitize=False)

# ----
panel_4 = Panel(dprod)

# ---- group: Removes non perpendicular lines
similar = Similarity(FirstNumber=panel_4, SecondNumber=Slider(0, range=0..100), Threshold="5")  # -> Similarity, AbsoluteDifference
cull = CullPattern(List=ln, CullPattern=similar.Similarity)  # -> simplify(List)

# ----
end_2 = EndPoints(Curve=cull)  # -> Start, End
trim_3 = TrimTree(Tree=end_2.Start, Depth=1)
pt_2 = Point(trim_3)
crv = Curve(reparameterize(path_curve))
crv_cp_4 = CurveClosestPoint(Point=pt_2, Curve=crv)  # -> Point, Parameter, Distance
shatter = Shatter(Curve=crv, Parameters=crv_cp_4.Parameter)

offset_2 = OffsetCurve(Curve=crv, Distance=filter, Corners=Slider(1, range=0..4))

crv_cp_5 = CurveClosestPoint(Point=pt_2, Curve=offset_2)  # -> Point, Parameter, Distance
shatter_2 = Shatter(Curve=offset_2, Parameters=crv_cp_5.Parameter)

merge_2 = Merge(Data1=simplify(graft(shatter)), Data2=simplify(graft(shatter_2)))
loft = Loft(Curves=merge_2, Options={Adjust=False, Closed=False, LoftEnds=0, LoftSimp=0, LoftType=0, Rebuild=10, Refit=0.01})  # -> simplify(flatten(Loft))

midpt = CurveMiddle(Curve=merge_2)
python_7 = GhPythonScript(surfaces=loft)  # -> Typical_Units, Corner_Units, dic, areas, center_points; inputs surfaces: list of Brep
# ---------- python_7: Python ----------
__author__ = "ilouh"
__version__ = "2023.02.21"

import rhinoscriptsyntax as rs
import Grasshopper as gh
import Rhino.Geometry as rg
import ghpythonlib.components as comps
import math

Typical_Units = [] 
Corner_Units = []
areas = []
center_points = []

areas_Corner_units = []
areas_Typical_units = []

dic = {}

i = 0 

for surface in surfaces:
    
    
    temp = comps.DeconstructBrep(surface)
    points = temp['vertices']
    
    
    unit_area = comps.Area(surface)
    
    unit_center = unit_area['centroid']
    
    
    unit_area = round(unit_area['area'],2)
    unit_number = 'Unit Number {}'.format(i)
    
    
    if len(points) > 4: 
        
        unit_name = 'Corner Unit',
        unit_type = 'Two Bedroom',
        Corner_Units.append(surface)

        
    else:
        
        unit_name = 'Typical Unit',
        unit_type = 'One Bedroom',
        Typical_Units.append(surface)

    


    dic_temp = {

        'Unit Name':  unit_name,
        'Unit Area': unit_area,
        'Unit Number' : unit_number,
        'Unit Type' : unit_type


    }
    
    dic[unit_number] = dic_temp
    str = '{}'.format(unit_type)
    areas.append(str)
    center_points.append(unit_center)
    
    i= i+1
# ---------- end python_7 ----------
points = PointList(Points=midpt, Size=Slider(5, range=0..10))

# ---- group: Builds a tree to run extrusion once
flatten_2 = FlattenTree(Tree=python_7.Typical_Units, Path="{0}")
flatten_3 = FlattenTree(Tree=python_7.Corner_Units, Path="{1}")
merge_3 = Merge(Data1=flatten_2, Data2=flatten_3)

# ----
Z_4 = UnitZ(Factor=unit_height)
extr_3 = Extrude(Base=merge_3, Direction=Z_4)  # -> simplify(Extrusion)

bang = ExplodeTree(Data=extr_3)  # -> Branch0, Branch1
wires = BrepWireframe(Brep=extr_3, Density=-1)
python_8 = GhPythonScript(x=python_7.areas)  # -> flatten(out)
# ---------- python_8: Python ----------
__author__ = "ilouh"
__version__ = "2023.02.21"

import rhinoscriptsyntax as rs
import Grasshopper as gh
import Rhino.Geometry as rg
import ghpythonlib.components as comps
import math

def remove_chars(string):
    """
    Remove characters ( ) ' , from a string.

    Args:
        string (str): The input string.

    Returns:
        str: The input string with ( ) ' , characters removed.
    """
    chars_to_remove = ["(", ")", "'", ","]
    for char in chars_to_remove:
        string = string.replace(char, "")
    return string

out = remove_chars(x)
print(out)
# ---------- end python_8 ----------
brep = Brep(flatten(bang.Branch0))
brep_2 = Brep(flatten(bang.Branch1))
move_2 = Move(Geometry=python_7.center_points, Motion=Z_2)  # -> Geometry, Transform
preview_4 = CustomPreview(Geometry=brep, Material=ColourSwatch(SwatchColor=RGBA(190, 219, 184, 145)))
preview_5 = CustomPreview(Geometry=brep_2, Material=ColourSwatch(SwatchColor=RGBA(70, 79, 73, 158)))
tag = TextTag(Location=move_2.Geometry, Text=python_8)
