# Grasshopper definition Scupltural Perforated Trees 0.1.0.gh (Grasshopper 1.0.7)

# ---- group: Plug in Curve from Rhino
crv = Curve(<curve referenced from the Rhino model>)

# ----
md_slider = MDSlider(
    SliderMode=0,
    slider_value=Point(0.5167835515, 0.322865742, 0.5),
    x_domain=Domain(0, 1),
    y_domain=Domain(0, 1),
    z_domain=Domain(0, 1))
height = Slider(58, range=0..100)
control_trunk = Slider(3, range=0..10)
loft_scale = Slider(0.35, range=0..1)
boundary = BoundarySurfaces(Edges=crv)
evalsrf = EvaluateSurface(Surface=reparameterize(boundary), Point=md_slider)  # -> Point, Normal, UDirection, VDirection, Frame

# ---- group: Mound Creating Script / Plug in Curve from Rhino
crv_2 = Curve(<curve referenced from the Rhino model>)  # disabled

# ---- group: Mound Creating Script
bottom_pit_scale = Slider(0.55, range=0..1)  # disabled
path_offset = Slider(2, range=0..100)  # disabled
max_mound_height = Slider(6, range=0..10)  # disabled
mound_scale = Slider(0.58, range=0..1)  # disabled
deviation_scale = Slider(0.77, range=0..1)  # disabled
pit_scale = Slider(0.67, range=0..1)  # disabled
mound_depth = Slider(-3, range=-10..10)  # disabled
number_slider = Slider(-2, range=-10..10)  # disabled
neg = Negative(Value=path_offset)  # disabled
offset = OffsetCurve(Curve=crv_2, Distance=[path_offset, neg], Plane=PlaneXY(0, 0, 0), Corners=1)  # -> flatten(Curve); disabled
area = Area(Geometry=offset)  # -> Area, Centroid; disabled
sort = SortList(Keys=area.Area, ValuesA=offset)  # -> Keys, ValuesA; disabled
Z = UnitZ(Factor=max_mound_height)  # disabled
item = ListItem(List=sort.ValuesA, Index=0, Wrap=True)  # disabled
move = Move(Geometry=item, Motion=expr("x/2", Z))  # -> Geometry, Transform; disabled
move_2 = Move(Geometry=item, Motion=Z)  # -> Geometry, Transform; disabled
area_2 = Area(Geometry=move_2.Geometry)  # -> Area, Centroid; disabled
scale = Scale(Geometry=move.Geometry, Center=area_2.Centroid, Factor=deviation_scale)  # -> Geometry, Transform; disabled
scale_2 = Scale(Geometry=move_2.Geometry, Center=area_2.Centroid, Factor=mound_scale)  # -> Geometry, Transform; disabled
neg_2 = Negative(Value=mound_depth)  # disabled
Z_2 = UnitZ(Factor=neg_2)  # disabled
move_3 = Move(Geometry=scale_2.Geometry, Motion=Z_2)  # -> Geometry, Transform; disabled
crv_3 = Curve(scale.Geometry)  # disabled
crv_4 = Curve(scale_2.Geometry)  # disabled
crv_5 = Curve(item)  # disabled
scale_3 = Scale(Geometry=move_3.Geometry, Center=area_2.Centroid, Factor=pit_scale)  # -> Geometry, Transform; disabled
crv_6 = Curve(scale_3.Geometry)  # disabled
crv_7 = Curve(scale_3.Geometry)  # disabled
area_3 = Area(Geometry=crv_7)  # -> Area, Centroid; disabled
Z_3 = UnitZ(Factor=number_slider)  # disabled
scale_4 = Scale(Geometry=crv_7, Center=area_3.Centroid, Factor=bottom_pit_scale)  # -> Geometry, Transform; disabled
neg_3 = Negative(Value=Z_3)  # disabled
move_4 = Move(Geometry=scale_4.Geometry, Motion=neg_3)  # -> Geometry, Transform; disabled
crv_8 = Curve(move_4.Geometry)  # disabled
merge = Merge(Data1=crv_5, Data2=crv_3, Data3=crv_4, Data4=crv_6, Data5=crv_8)  # disabled
boundary_2 = BoundarySurfaces(Edges=crv_8)  # disabled
loft = Loft(Curves=merge, Options={Adjust=False, Closed=False, LoftEnds=0, LoftSimp=0, LoftType=2, Rebuild=10, Refit=0.01})  # disabled
merge_2 = Merge(Data1=loft, Data2=boundary_2)  # disabled
swatch = ColourSwatch(SwatchColor=RGB(50, 227, 82))  # disabled
preview = CustomPreview(Geometry=merge_2, Material=swatch)  # disabled

# ----
Z_4 = UnitZ(Factor=height)
move_5 = Move(Geometry=crv, Motion=Z_4)  # -> Geometry, Transform
area_4 = Area(Geometry=move_5.Geometry)  # -> Area, Centroid

dist = Distance(PointA=evalsrf.Point, PointB=area_4.Centroid)
Z_5 = UnitZ(Factor=dist)
move_6 = Move(Geometry=crv, Motion=Z_5)  # -> Geometry, Transform

ln = Line(StartPoint=evalsrf.Point, EndPoint=area_4.Centroid)
curvepoint = PointOnCurve(ln, parameter=0.75)
curvepoint_2 = PointOnCurve(ln, parameter=0.5)

start_point = Point(evalsrf.Point)
cir = Circle(Plane=start_point, Radius=control_trunk)
cir_2 = Circle(Plane=curvepoint_2, Radius=control_trunk)

dist_2 = Distance(PointA=area_4.Centroid, PointB=curvepoint)
Z_6 = UnitZ(Factor=dist_2)
neg_4 = Negative(Value=Z_6)
move_7 = Move(Geometry=move_6.Geometry, Motion=neg_4)  # -> Geometry, Transform
scale_5 = Scale(Geometry=move_7.Geometry, Center=curvepoint, Factor=loft_scale)  # -> Geometry, Transform

crv_9 = Curve(cir)
crv_10 = Curve(cir_2)
crv_11 = Curve(scale_5.Geometry)
crv_12 = Curve(move_6.Geometry)
merge_3 = Merge(
    Data1=simplify(graft(crv_9)),
    Data2=simplify(graft(crv_10)),
    Data3=simplify(graft(crv_11)),
    Data4=simplify(graft(crv_12)))
reb = RebuildCurve(Curve=merge_3, Degree=3, Count=Slider(6, range=0..10), Tangents=False)

# ---- group: Bake this object
loft_2 = Loft(Curves=reb, Options={Adjust=True, Closed=False, LoftEnds=0, LoftSimp=1, LoftType=5, Rebuild=10, Refit=0.01})

# ----
crv_13 = Curve(<curve referenced from the Rhino model>)
offset_2 = OffsetCurve(Curve=crv_13, Distance=Slider(-4, range=-10..10), Corners=1)
boundary_3 = BoundarySurfaces(Edges=offset_2)
popgeo = PopulateGeometry(Geometry=boundary_3, Count=Slider(56, range=0..100), Seed=Slider(8, range=0..25))
srf = Surface(loft_2)
Z_7 = UnitZ(Factor=1)
project = ProjectPoint(Point=popgeo, Direction=Z_7, Geometry=srf)  # -> Point, Index
srf_cp = SurfaceClosestPoint(Point=project.Point, Surface=srf)  # -> Point, UVPoint, Distance
dom = ConstructDomain(DomainStart=Slider(0.8, range=0..10), DomainEnd=Slider(2.2, range=0..10))
evalsrf_2 = EvaluateSurface(Surface=srf, Point=srf_cp.UVPoint)  # -> Point, Normal, UDirection, VDirection, Frame
lng = ListLength(List=evalsrf_2.Frame)
random = Random(Range=dom, Number=lng, Seed=2)
cir_3 = Circle(Plane=evalsrf_2.Frame, Radius=random)
ccx = CurveCurve(CurveA=graft(cir_3), CurveB=cir_3)  # -> simplify(Points), ParamsA, ParamsB
python = GhPythonScript(x=ccx.Points)  # -> out, flatten(a); inputs x: list
# ---------- python: Python ----------
__author__ = "Iliya Muzychuk"
__version__ = "2023.02.03"

import rhinoscriptsyntax as rs
import Grasshopper as gh
import Rhino.Geometry as rg
import ghpythonlib.components as comps


if len(x) > 1: 
    
    a = False 
else: 
    a = True
# ---------- end python ----------
cull = CullPattern(List=cir_3, CullPattern=python.a)
srfsplit = SurfaceSplit(Surface=srf, Curves=cull)
area_5 = Area(Geometry=srfsplit)  # -> Area, Centroid
sort_2 = SortList(Keys=area_5.Area, ValuesA=srfsplit)  # -> Keys, reverse(ValuesA)
item_2 = ListItem(List=sort_2.ValuesA, Index=0, Wrap=True)
preview_2 = CustomPreview(Geometry=item_2, Material=ColourSwatch(SwatchColor=RGB(9, 230, 50)))
