# Grasshopper definition BuildingElements_Column.gh (Grasshopper 1.0.8)

pipeline = GeometryPipeline(
    GroupByLayer=False,
    GroupByType=False,
    IncludeHidden=True,
    IncludeLocked=True,
    LayerFilter="Architectural*Columns",
    NameFilter="*",
    SublayerFiltering=True,
    TypeFilter=1)
pt = Point(pipeline)
expression = Expression(x=Slider(9, range=0..10), Expression="x*12")
create_lumber_column = Python3Script(center_point=pt, width=Slider(4, range=0..10), depth=Slider(4, range=0..10), height=expression)  # -> a
# ---------- create_lumber_column: Python ----------
import rhinoscriptsyntax as rs
import Rhino.Geometry as rg
import scriptcontext as sc
import Rhino

# Convert any given length to inches based on document units
def to_inches(length):
    units = Rhino.RhinoDoc.ActiveDoc.ModelUnitSystem
    # Conversion factors from Rhino units to inches
    unit_factors = {
        Rhino.UnitSystem.Millimeters: 1/0.0393701,
        Rhino.UnitSystem.Centimeters: 1/0.393701,
        Rhino.UnitSystem.Meters: 1/39.3701,
        Rhino.UnitSystem.Feet: 1/12.0,
        Rhino.UnitSystem.Inches: 1/1.0
    }
    factor = unit_factors.get(units, 1.0)
    return length * factor


def create_column(center_point, width, depth, height):
    # Coerce the input to a Point3d if necessary
    if isinstance(center_point, tuple) or isinstance(center_point, list):
        center_point = rg.Point3d(*center_point)
    elif not isinstance(center_point, rg.Point3d):
        center_point = rs.coerce3dpoint(center_point)
    
    if not isinstance(center_point, rg.Point3d):
        raise ValueError("Input is not a valid point.")

    # Convert dimensions to inches
    width = to_inches(width)
    depth = to_inches(depth)
    height = to_inches(height)
    
    # Create a plane at the center point
    base_plane = rg.Plane(center_point, rg.Vector3d.ZAxis)
    
    # Calculate the corner points for the rectangle
    half_width = width / 2.0
    half_depth = depth / 2.0
    
    # Define rectangle corners relative to the center
    pt1 = rg.Point3d(center_point.X - half_width, center_point.Y - half_depth, center_point.Z)
    pt2 = rg.Point3d(center_point.X + half_width, center_point.Y - half_depth, center_point.Z)
    pt3 = rg.Point3d(center_point.X + half_width, center_point.Y + half_depth, center_point.Z)
    pt4 = rg.Point3d(center_point.X - half_width, center_point.Y + half_depth, center_point.Z)
    
    # Create the rectangle
    rectangle = rg.Polyline([pt1, pt2, pt3, pt4, pt1])
    rectangle_curve = rectangle.ToNurbsCurve()
    
    # Extrude the rectangle to create the column
    vector = rg.Vector3d(0, 0, height)
    
    # Use Extrusion instead of Brep.CreateFromExtrusion
    extrusion = rg.Extrusion.Create(rectangle_curve, height, True)

    # Add the column to the document and refresh
    if extrusion:
        sc.doc.Objects.AddExtrusion(extrusion)
        sc.doc.Views.Redraw()
        return extrusion
    else:
        raise ValueError("Failed to create column.")


a = create_column(center_point, width, depth, height)
# ---------- end create_lumber_column ----------
cap = CapHoles(Brep=create_lumber_column)
