# Grasshopper definition BuildingElements_Roof Trusses.gh (Grasshopper 1.0.8)
# plug-ins: LunchBox

lower_curve = Curve(graft(<curve referenced from the Rhino model>))
upper_curve = Curve(graft(<curve referenced from the Rhino model>))
number_slider = Slider(2, range=0..20)
number_slider_2 = Slider(2, range=0..20)
explode = Explode(Curve=upper_curve, Recursive=True)  # -> Segments, Vertices
explode_2 = Explode(Curve=lower_curve, Recursive=True)  # -> Segments, Vertices
item = ListItem(List=explode.Segments, Index=0, Wrap=True)  # -> Item, Item1
item_2 = ListItem(List=explode_2.Segments, Index=0, Wrap=True)  # -> Item, Item1
flip = FlipCurve(Curve=item.Item1)  # -> Curve, Flag
flip_2 = FlipCurve(Curve=item_2.Item1)  # -> Curve, Flag

truss = _2DTruss(CurveA=item.Item, CurveB=item_2.Item, Divisions=number_slider, TrussToggle=number_slider_2)  # -> PrimaryLines, BraceLines, VerticalLines, StructureNodes
truss_2 = _2DTruss(CurveA=flip.Curve, CurveB=flip_2.Curve, Divisions=number_slider, TrussToggle=number_slider_2)  # -> PrimaryLines, BraceLines, VerticalLines, StructureNodes
chords = Curve(truss.PrimaryLines)
brace = Curve(truss.BraceLines)
vertical = Curve(truss.VerticalLines)
chords_2 = Curve(truss_2.PrimaryLines)
brace_2 = Curve(truss_2.BraceLines)
vertical_2 = Curve(truss_2.VerticalLines)
join = JoinCurves(Curves=brace, Preserve=False)
join_2 = JoinCurves(Curves=[chords, chords_2], Preserve=False)
join_3 = JoinCurves(Curves=vertical, Preserve=False)
join_4 = JoinCurves(Curves=chords_2, Preserve=False)
join_5 = JoinCurves(Curves=vertical_2, Preserve=False)
join_6 = JoinCurves(Curves=brace_2, Preserve=False)

number_slider_3 = Slider(2, range=0..10)
number_slider_4 = Slider(4, range=0..10)
number_slider_5 = Slider(2, range=0..10)
number_slider_6 = Slider(2, range=0..10)
number_slider_7 = Slider(2, range=0..10)
number_slider_8 = Slider(2, range=0..10)
toggle = BooleanToggle(False)
toggle_2 = BooleanToggle(True)
toggle_3 = BooleanToggle(False)
toggle_4 = BooleanToggle(True)
toggle_5 = BooleanToggle(False)
toggle_6 = BooleanToggle(True)
py3 = Python3Script(C=join_2, W=number_slider_3, H=number_slider_4, Bank=toggle, Cap=toggle_2)  # -> Section, B
# ---------- py3: Python ----------
import math
import Rhino
import rhinoscriptsyntax as rs
import scriptcontext as sc

# ---------------- Inputs & defaults ----------------
if W is None: W = 3.5
if H is None: H = 1.5
if Angle is None: Angle = 0.0
if Bank is None: Bank = False
if Cap is None: Cap = True
if R is None: R = 0.0
# fallback sampling step along rail (used only if sweep fails)
# choose a reasonable default ~ 1x the larger profile dim
if 'Step' not in globals() or Step is None or Step <= 0:
    Step = max(W, H)

B = None
Section = None

# ---------------- Coerce rail curve ----------------
if C is None:
    raise ValueError("Input curve (C) is missing.")
rail = C if isinstance(C, Rhino.Geometry.Curve) else rs.coercecurve(C)
if rail is None or not rail.IsValid:
    raise ValueError("Could not convert input to a valid rail curve.")

tol = sc.doc.ModelAbsoluteTolerance
ang_tol = sc.doc.ModelAngleToleranceRadians

# ---------------- Build base section at start ----------------
def rect_section_on_plane(plane, w, h, fillet_r):
    xint = Rhino.Geometry.Interval(-w*0.5, w*0.5)
    yint = Rhino.Geometry.Interval(-h*0.5, h*0.5)
    rect = Rhino.Geometry.Rectangle3d(plane, xint, yint)
    crv = rect.ToNurbsCurve()
    if fillet_r and fillet_r > tol:
        fil = Rhino.Geometry.Curve.CreateFilletCornersCurve(crv, fillet_r, tol, ang_tol)
        if fil and fil.IsClosed: 
            crv = fil
    return crv

# frame at start
t0 = rail.Domain.T0
ok, base_plane = rail.PerpendicularFrameAt(t0)
if not ok:
    ok, base_plane = rail.FrameAt(t0)
    if not ok:
        raise ValueError("Failed to get a frame at the rail start.")

# rotate profile about tangent if requested
if Angle and abs(Angle) > 1e-9:
    base_plane.Rotate(math.radians(Angle), base_plane.ZAxis)

section0 = rect_section_on_plane(base_plane, W, H, R)
Section = section0

# ---------------- Try 1: robust Rhino sweep ----------------
try:
    breps = Rhino.Geometry.Brep.CreateFromSweep(rail, section0, False, tol)
    if breps and len(breps) > 0:
        brep = breps[0]
        if Cap:
            capped = brep.CapPlanarHoles(tol)
            if capped: brep = capped
        B = brep
except Exception:
    breps = None

# If the sweep succeeded, we're done
if B:
    pass
else:
    # ---------------- Fallback: frame samples + loft ----------------
    # Build oriented copies of the rectangle along the rail
    crvs = []

    rail_len = rail.GetLength()
    # ensure at least a handful of sections (min 4)
    n = max(4, int(max(2, rail_len / max(Step, tol*10))) + 1)

    params = []
    # Use DivideByCount to spread evenly
    if not rail.DivideByCount(n, True, params):
        # fallback: uniform by length
        params = []
        rail.DivideByLength(max(Step, tol*10), True, params)
        if not params:
            params = [rail.Domain.T0, rail.Domain.T1]

    Z = Rhino.Geometry.Vector3d.ZAxis
    X = Rhino.Geometry.Vector3d.XAxis

    for t in params:
        pt = rail.PointAt(t)
        tan = rail.TangentAt(t)
        if not tan or not tan.Unitize(): 
            continue

        if Bank:
            # bank with curve (perpendicular frame / frenet-ish)
            ok, pl = rail.PerpendicularFrameAt(t)
            if not ok:
                ok, pl = rail.FrameAt(t)
                if not ok:
                    # build from tangent + world up fallback
                    xaxis = Rhino.Geometry.Vector3d.CrossProduct(Z, tan)
                    if not xaxis.Unitize():
                        xaxis = Rhino.Geometry.Vector3d.CrossProduct(X, tan); xaxis.Unitize()
                    yaxis = Rhino.Geometry.Vector3d.CrossProduct(tan, xaxis); yaxis.Unitize()
                    pl = Rhino.Geometry.Plane(pt, xaxis, yaxis)
        else:
            # upright roadlike: world Z as "up"
            # Z × tan = x-axis (unless near-parallel, then use world X)
            xaxis = Rhino.Geometry.Vector3d.CrossProduct(Z, tan)
            if not xaxis.Unitize():
                xaxis = Rhino.Geometry.Vector3d.CrossProduct(X, tan); xaxis.Unitize()
            yaxis = Rhino.Geometry.Vector3d.CrossProduct(tan, xaxis); yaxis.Unitize()
            pl = Rhino.Geometry.Plane(pt, xaxis, yaxis)

        # rotate profile around tangent by Angle
        if Angle and abs(Angle) > 1e-9:
            pl.Rotate(math.radians(Angle), pl.ZAxis, pl.Origin)

        crv = rect_section_on_plane(pl, W, H, R)
        crvs.append(crv)

    if len(crvs) < 2:
        raise Exception("Not enough section samples for loft fallback.")

    lofts = Rhino.Geometry.Brep.CreateFromLoft(crvs, Rhino.Geometry.Point3d.Unset, Rhino.Geometry.Point3d.Unset,
                                               Rhino.Geometry.LoftType.Tight, False)
    if not lofts:
        raise Exception("Loft fallback failed.")
    brep = lofts[0]

    # Join edges if multiple
    joined = Rhino.Geometry.Brep.JoinBreps([brep], tol)
    brep = joined[0] if joined and len(joined) else brep

    if Cap:
        capped = brep.CapPlanarHoles(tol)
        if capped: 
            brep = capped

    B = brep

# Done; B (solid if cap worked), Section for preview
# ---------- end py3 ----------
py3_2 = Python3Script(C=join_3, W=number_slider_5, H=number_slider_6, Bank=toggle_3, Cap=toggle_4)  # -> Section, B; same code as py3
py3_3 = Python3Script(C=join, W=number_slider_7, H=number_slider_8, Bank=toggle_5, Cap=toggle_6)  # -> Section, B; same code as py3
py3_4 = Python3Script(C=join_4, W=number_slider_3, H=number_slider_4, Bank=toggle, Cap=toggle_2)  # -> Section, B; disabled; same code as py3
py3_5 = Python3Script(C=join_6, W=number_slider_5, H=number_slider_6, Bank=toggle_3, Cap=toggle_4)  # -> Section, B; same code as py3
py3_6 = Python3Script(C=join_5, W=number_slider_7, H=number_slider_8, Bank=toggle_5, Cap=toggle_6)  # -> Section, B; same code as py3

brep = Brep(py3.B)
brep_2 = Brep(py3_2.B)
brep_3 = Brep(py3_3.B)
brep_4 = Brep(py3_4.B)  # disabled
brep_5 = Brep(py3_5.B)
brep_6 = Brep(py3_6.B)
