# Grasshopper definition BuildingElements_StructuralFramingByCurve.gh (Grasshopper 1.0.8)
# plug-ins: CORE.Toolbox.Grasshopper

curve = Curve(graft([<curve referenced from the Rhino model> x11]))
rectangle = Rectangle(Plane=PlaneXY(0, 0, 0), XSize=Domain(-1, 1), YSize=Domain(-2, 2), Radius=0)  # -> Rectangle, Length
create_lumber_beam = Python3Script(curve=curve, width=Slider(10, range=0..20), height=Slider(2, range=0..10))  # -> a
# ---------- create_lumber_beam: Python ----------
import rhinoscriptsyntax as rs
import Rhino
import scriptcontext as sc
import ghpythonlib.components as ghcomp

# Convert any given length to inches based on document units
def to_inches(length):
    units = sc.doc.ModelUnitSystem
    # Conversion factors from Rhino units to inches
    unit_factors = {
        Rhino.UnitSystem.Millimeters: 1/0.0393701,
        Rhino.UnitSystem.Centimeters: 1/0.393701,
        Rhino.UnitSystem.Meters: 1/39.3701,
        Rhino.UnitSystem.Feet: 1/12.0,
        Rhino.UnitSystem.Inches: 1.0
    }
    factor = unit_factors.get(units, 1.0)
    return length * factor


def create_dimensional_lumber(curve, width, height):
    if not rs.IsCurve(curve):
        raise ValueError("Input is not a valid curve.")

    # Convert width and height to inches
    width = to_inches(width)
    height = to_inches(height)

    # Get the start plane perpendicular to the curve's tangent
    start_point = rs.CurveStartPoint(curve)
    tangent = rs.CurveTangent(curve, 0)
    plane = Rhino.Geometry.Plane(start_point, tangent)

    # Offset the plane to center the profile
    plane.Origin -= plane.XAxis * (width / 2.0)
    plane.Origin -= plane.YAxis * (height / 2.0)

    # Create the profile rectangle on the plane
    rectangle = Rhino.Geometry.Rectangle3d(plane, width, height)

    if not rectangle:
        raise ValueError("Failed to create profile rectangle.")

    # Convert the rectangle to a NurbsCurve
    section_curve = rectangle.ToNurbsCurve()

    # Coerce the rail curve
    rail_curve = rs.coercecurve(curve)

    # Sweep the rectangle along the curve
    sweep = Rhino.Geometry.SweepOneRail()
    sweep.AngleToleranceRadians = Rhino.RhinoDoc.ActiveDoc.ModelAngleToleranceRadians
    sweep.ClosedSweep = False

    breps = sweep.PerformSweep(rail_curve, section_curve)

    if breps:
        for brep in breps:
            sc.doc.Objects.AddBrep(brep)
        sc.doc.Views.Redraw()
        return breps
    else:
        raise ValueError("Sweep operation failed.")


a = create_dimensional_lumber(curve, width, height)
# ---------- end create_lumber_beam ----------
cap = CapHoles(Brep=create_lumber_beam)
profile_selector = ProfileSelector(System=0, ShapeType=0)
panel = Panel(profile_selector)
list_item = ListItem(List=profile_selector, Index=Slider(266, range=0..500), Wrap=True)
curve_2 = Curve(<curve referenced from the Rhino model>)
sweep_profile = SweepProfile(
    OutputMesh=False,
    BeamRail=curve_2,
    SectionNameOrCurve=list_item,
    Justification=-1,
    Rotation=0,
    JustificationIndex=4,
    SectionNameIndex=191,
    ShapeTypeIndex=0,
    UnitTypeIndex=0)  # -> BrepsOrMeshes, SectionProfiles
brep = Brep(sweep_profile.BrepsOrMeshes)
