# Grasshopper definition BuildingElements_StructuralFramingBySurface 0.2.5.gh (Grasshopper 1.0.8)

# ---- group: Input Surface
srf = Surface(reparameterize(graft([<surface referenced from the Rhino model> x7])))

# ----
direction = BooleanToggle(False)
spacing = Slider(1.5, range=0..100)
height = Slider(0.875, range=-20..20)
width = Slider(0.2, range=-10..10)
md_slider = MDSlider(SliderMode=0, slider_value=Point(0.5, 0.5, 0.5), x_domain=Domain(0, 1), y_domain=Domain(0, 1), z_domain=Domain(0, 1))
evalsrf = EvaluateSurface(Surface=reparameterize(srf), Point=md_slider)  # -> Point, Normal, UDirection, VDirection, Frame
createframinglines = GhPythonScript(srf=srf, direction=direction, distance=spacing)  # -> framing_lines; inputs srf: Surface
# ---------- createframinglines: Python ----------
__author__ = "ilouh"
__version__ = "2023.02.21"

import rhinoscriptsyntax as rs
import Grasshopper as gh
import Rhino.Geometry as rg
import ghpythonlib.components as comps
import math


untrim_sruface = comps.Untrim(srf)



def framing (crvs,distance):
    
    crv_01 = crvs[0]
    crv_02 = comps.FlipCurve(crvs[1])['curve']
    
    spacing = comps.Length(crv_01)/distance
    
    points_01 = comps.DivideCurve(crv_01,spacing,False)['points']
    points_02 = comps.DivideCurve(crv_02,spacing,False)['points']

    zipped_points = list(zip(points_01,points_02))
    
    framing_members = []
    
    for pair in zipped_points:
        
        line = comps.Line(pair[0],pair[1])
        framing_members.append(line)
        
    
    return framing_members


edges = comps.DeconstructBrep(untrim_sruface)['edges']
edge_lengths = comps.Length(edges)

sorted_list = list(zip(edges,edge_lengths))
sorted_list = sorted(sorted_list, key = lambda x: x[1])

crvs, lengths = zip(*sorted_list)

shortest_crvs = [crvs[0],crvs[1]]
longest_crvs = [crvs[2],crvs[3]]


if direction:
    
    framing_lines = framing(shortest_crvs,distance)

else: 
    
    framing_lines = framing(longest_crvs,distance)
# ---------- end createframinglines ----------
Z = UnitZ(Factor=1)

scx = SurfaceCurve(Surface=srf, Curve=createframinglines)  # -> Curves, Points, UVPoints, Normals, Parameters, Tangents

amp = Amplitude(Vector=Z, Amplitude=height)

extr = Extrude(Base=scx.Curves, Direction=amp)
offset = OffsetSurface(Surface=extr, Distance=expr("-x/2", width), Retrim=True)
offset_2 = OffsetSurface(Surface=extr, Distance=expr("x/2", width), Retrim=True)
merge = Merge(Data1=offset_2, Data2=offset)  # -> simplify(Result)

loft = Loft(Curves=merge, Options={Adjust=False, Closed=False, LoftEnds=0, LoftSimp=0, LoftType=0, Rebuild=10, Refit=0.01})
cap = CapHoles(Brep=loft)
