# Grasshopper definition BuildingElements_WindowsFromCurves.gh (Grasshopper 1.0.8)
# plug-ins: CORE.Toolbox.Grasshopper

surface = Surface([<surface referenced from the Rhino model> x8])
deconstruct_brep = DeconstructBrep(Brep=surface)  # -> Faces, Edges, Vertices
join_curves = JoinCurves(Curves=deconstruct_brep.Edges, Preserve=False)
framewidth = Slider(2, range=0..6)
framedepth = Slider(3, range=0..100)
boundary_curve = Curve(reparameterize(graft(join_curves)))
units = ConvertUnits(Value=framewidth, Source=3, Target=3, Exponent=1)  # -> Result, Factor
units_2 = ConvertUnits(Value=framedepth, Source=3, Target=3, Exponent=1)  # -> Result, Factor
surfaceboundary = GhPythonScript(curve=boundary_curve, distance=units.Result, frameDepth=units_2.Result)  # -> windowFrame, windowGlazing; inputs curve: Curve
# ---------- surfaceboundary: Python ----------
__author__ = "ilouh"
__version__ = "2023.02.21"

import rhinoscriptsyntax as rs
import Grasshopper as gh
import Rhino.Geometry as rg
import ghpythonlib.components as comps
import math


def createFrame(crv,distance,frameDepth):
    
    offset_1 = comps.OffsetCurve(crv,distance,corners = 1)
    offset_2 = comps.OffsetCurve(crv,-distance,corners = 1)
    
    if comps.Length(offset_1) > comps.Length(offset_2): 
        srf = comps.BoundarySurfaces([crv,offset_2])
        point = comps.ConstructPoint(0.5,0.5,0)
        normal = comps.EvaluateSurface(srf,point)['normal']
        brep = comps.Extrude(srf,comps.Amplitude(normal,frameDepth))
        brep = comps.Move(brep,comps.Amplitude(normal,-frameDepth/2))['geometry']
        return brep,comps.BoundarySurfaces(offset_2)

    
    else:
        srf =  comps.BoundarySurfaces([crv,offset_1])
        point = comps.ConstructPoint(0.5,0.5,0)
        normal = comps.EvaluateSurface(srf,point)['normal']
        brep = comps.Extrude(srf,comps.Amplitude(normal,frameDepth))
        brep = comps.Move(brep,comps.Amplitude(normal,-frameDepth/2))['geometry']
        return brep,comps.BoundarySurfaces(offset_1)



windowFrame = createFrame(curve,distance,frameDepth)[0]
windowGlazing = createFrame(curve,distance,frameDepth)[1]
# ---------- end surfaceboundary ----------
glazing = Surface(reparameterize(surfaceboundary.windowGlazing))
dim = Dimensions(Surface=glazing)  # -> UDimension, VDimension
expression = Expression(v=dim.VDimension, x=Slider(12, range=0..40), Expression="round(v/x)")
expression_2 = Expression(u=dim.UDimension, x=Slider(12, range=0..40), Expression="round(u/x)")
frame = Brep(surfaceboundary.windowFrame)
mountins = Mountins(S=reparameterize(graft(glazing)), x=expression, x_2=expression_2)  # -> U, V
preview = CustomPreview(Geometry=frame, Material=ColourSwatch(SwatchColor=RGB(70, 19, 17)))
preview_2 = CustomPreview(Geometry=glazing, Material=ColourSwatch(SwatchColor=RGBA(255, 0, 255, 59)))
crv = Curve(mountins.U)
crv_2 = Curve(mountins.V)
merge = Merge(Data1=crv, Data2=crv_2)  # -> flatten(Result)
number_slider = Slider(6, range=0..10)  # disabled
units_3 = ConvertUnits(Value=number_slider, Source=3, Target=4, Exponent=1)  # -> Result, Factor; disabled
pipe = Pipe(Curve=merge, Radius=units_3.Result, Caps=0)  # disabled
merge_2 = Merge(Data1=simplify(frame), Data2=simplify(pipe))  # disabled
cap = CapHoles(Brep=pipe)  # disabled
group = Group(Objects=merge_2)  # disabled

# ==== cluster Mountins
x = ClusterInput()
x_2 = ClusterInput()
py3 = Python3Script(x=x)  # -> out
# ---------- py3: Python ----------
def create_range(step_size):
    if step_size <= 0:
        return "Step size must be greater than 0."
    else:
        range_list = []
        current_value = 0
        while current_value <= 1:
            range_list.append(round(current_value, 5))
            current_value += step_size
        return range_list[1:-1]


step_size = 1/x
out = create_range(step_size)
# ---------- end py3 ----------
py3_2 = Python3Script(x=x_2)  # -> out; same code as py3
concat = Concatenate(FragmentA="{0.0,", FragmentB=py3, FragmentC=",0.0}")
concat_2 = Concatenate(FragmentA=py3_2, FragmentB=",0.0,", FragmentC=",0.0}")
S = ClusterInput()
iso = IsoCurve(Surface=reparameterize(S), UVPoint=concat)  # -> UIsocurve, VIsocurve
iso_2 = IsoCurve(Surface=reparameterize(S), UVPoint=concat_2)  # -> UIsocurve, VIsocurve
U = ClusterOutput(iso.UIsocurve)
V = ClusterOutput(iso_2.VIsocurve)
