# Grasshopper definition Facade_Box Morphing Panels 0.2.5.gh (Grasshopper 1.0.8)
# plug-ins: LunchBox

# ---- group: Facade Option
list = ValueList({"One": 0, "Two": 1, "Three": 2, "Four": 3}, selected="One")

# ----
# Input Facade Panel Option
option_a = Brep(<brep referenced from the Rhino model>)
option_b = Brep([<brep referenced from the Rhino model> x5])  # disabled
option_c = Brep([<brep referenced from the Rhino model> x6])  # disabled
option_d = Brep([<brep referenced from the Rhino model> x5])  # disabled

# ---- group: Orientation Option
list_2 = ValueList({"One": 0, "Two": 1, "Three": 2}, selected="Three")

# ---- group: Stacking
list_3 = ValueList({"Running Bond": 0, "Stacking Bond": 1}, selected="Running Bond")

# ----
checkboard_mirroring = BooleanToggle(False)
flip_surface_inboard_outboard = BooleanToggle(False)
facade_panel_u_size = Slider(0.66, range=0..50)
facade_panel_v_size = Slider(0.66, range=0..50)
facade_depth = Slider(0.66, range=0..10)

# ---- group: Input Surface
# When surfaces are mirrored, the distribution of panels wouldn't work as smoothly
srf = Surface(reparameterize(graft([<surface referenced from the Rhino model> x3])))

# ----
pattern_type = Integer(list_3)
checkboard_mirroring_2 = Boolean(checkboard_mirroring)
panel_u_size = Number(facade_panel_u_size)
panel_v_size = Number(facade_panel_v_size)
facade_depth_2 = Number(facade_depth)
flip_surface_inboard_outboard_2 = Boolean(flip_surface_inboard_outboard)
flatten = FlattenTree(Tree=srf, Path="{0}")  # -> graft(Tree)

toggle = BooleanToggle(True)  # disabled
toggle_2 = BooleanToggle(False)  # disabled
toggle_3 = BooleanToggle(False)  # disabled
srf_2 = Surface(reparameterize(flatten))  # disabled
python = PythonScript(s=srf_2, swapUV=toggle, reverseU=toggle_2, reverseV=toggle_3)  # -> out, anchor, uVec, vVec, revSrf; inputs s: Surface, swapUV: Int32, reverseU: Int32, reverseV: Int32; disabled
# ---------- python: Python ----------
import Rhino

if reverseU:
    uS,uE = s.Domain(0)
    inter0 = Rhino.Geometry.Interval(-uE, -uS)
    s.SetDomain(0,inter0)
    s = s.Reverse(0)

if reverseV:
    vS,vE = s.Domain(1)
    inter1 = Rhino.Geometry.Interval(-vE, -vS)
    s.SetDomain(1,inter1)
    s = s.Reverse(1)

if swapUV:
    s = s.Transpose()

anchor = s.PointAt(0,0)
uend = s.PointAt(0.5,0)
vend = s.PointAt(0,0.5)
uVec = uend - anchor
vVec = vend - anchor

revSrf = s
# ---------- end python ----------

# ---- group: Preview to show normals of currents surfaces
md_slider = MDSlider(SliderMode=0, slider_value=Point(0.5, 0.5, 0.5), x_domain=Domain(0, 1), y_domain=Domain(0, 1), z_domain=Domain(0, 1))
evalsrf = EvaluateSurface(Surface=reparameterize(srf), Point=md_slider)  # -> Point, Normal, UDirection, VDirection, simplify(Frame)
vdis = VectorDisplay(Anchor=evalsrf.Point, Vector=evalsrf.Normal)

# ----
facade_option = Integer(list)
orientation_option = Integer(list_2)
input_surface = Surface(flatten)

xy = XYPlane(Origin=Point(0, 0, 0))
xz = XZPlane(Origin=Point(0, 0, 0))
yz = YZPlane(Origin=Point(0, 0, 0))
filter = StreamFilter(Gate=facade_option, Stream0=option_a, Stream1=option_b, Stream2=option_c, Stream3=option_d)
filter_2 = StreamFilter(Gate=orientation_option, Stream0=xy, Stream1=xz, Stream2=yz)
group = Group(Objects=filter)
bbox = BoundingBox(Content=group, Plane=filter_2)  # -> Box, Box_2
volume = Volume(Geometry=bbox.Box)  # -> Volume, Centroid
xz_2 = XZPlane(Origin=volume.Centroid)
yz_2 = YZPlane(Origin=volume.Centroid)
xy_2 = XYPlane(Origin=volume.Centroid)
mirror = Mirror(Geometry=bbox.Box, Plane=xz_2)  # -> Geometry, Transform

# ---- group: Surface subdivision
dim = Dimensions(Surface=input_surface)  # -> UDimension, VDimension
expression = Expression(x=dim.UDimension, y=panel_u_size, Expression="round(x/y)")
expression_2 = Expression(x=dim.VDimension, y=panel_v_size, Expression="round(x/y)")

divide = DivideDomain²(Domain=input_surface, UCount=expression, VCount=expression_2)
quadstag = StaggeredQuadPanels(Surface=simplify(input_surface), UDivisions=expression, VDivisions=expression_2)
subsrf = Isotrim(Surface=input_surface, Domain=divide)
filter_3 = StreamFilter(Gate=pattern_type, Stream0=quadstag, Stream1=subsrf)
partition = PartitionList(List=filter_3, Size=expression_2)

# ---- group: Box Mapping
debrep = DeconstructBrep(Brep=partition)  # -> Faces, Edges, Vertices
item = ListItem(List=debrep.Vertices, Index=0, Wrap=True)  # -> Item, Item1, Item2, Item3
md_slider_2 = MDSlider(SliderMode=0, slider_value=Point(0.5, 0.5, 0.5), x_domain=Domain(0, 1), y_domain=Domain(0, 1), z_domain=Domain(0, 1))
srf4pt = _4PointSurface(CornerA=item.Item, CornerB=item.Item1, CornerC=item.Item2, CornerD=item.Item3)  # -> reparameterize(simplify(Surface))
evalsrf_2 = EvaluateSurface(Surface=reparameterize(srf4pt), Point=md_slider_2)  # -> Point, Normal, UDirection, VDirection, simplify(Frame)
neg = Negative(Value=evalsrf_2.Normal)
filter_4 = StreamFilter(Gate=flip_surface_inboard_outboard_2, Stream0=evalsrf_2.Normal, Stream1=neg)
amp = Amplitude(Vector=filter_4, Amplitude=facade_depth_2)
extr = Extrude(Base=srf4pt, Direction=amp)  # -> simplify(Extrusion)
pl = ConstructPlane(Origin=evalsrf_2.Point, XAxis=evalsrf_2.Normal, YAxis=evalsrf_2.UDirection)
bbox_2 = BoundingBox(Content=extr, Plane=pl)  # -> simplify(Box), Box_2
trim = TrimTree(Tree=bbox_2.Box, Depth=1)
gate = StreamGate(Stream=trim, Gate=checkboard_mirroring_2)  # -> Target0, Target1

# ---- group: Box mapping choice between tree & list (single surface)
boxmap = BoxMapping(Geometry=group, Source=bbox.Box, Target=gate.Target1)  # -> Geometry, Transform
brep_t1 = SplitTree(Data=gate.Target0, Masks=flatten("{?;(0,2,....)}"))  # -> Positive, Negative
plane_t1 = SplitTree(Data=gate.Target0, Masks=flatten("{?;(1,3,....)}"))  # -> Positive, Negative
cull = CullPattern(List=brep_t1.Positive, CullPattern=[False, True])
cull_2 = CullPattern(List=brep_t1.Positive, CullPattern=[True, False])
cull_3 = CullPattern(List=plane_t1.Positive, CullPattern=[False, True])
cull_4 = CullPattern(List=plane_t1.Positive, CullPattern=[True, False])
merge = Merge(Data1=cull, Data2=cull_4)
merge_2 = Merge(Data1=cull_2, Data2=cull_3)
boxmap_2 = BoxMapping(Geometry=group, Source=bbox.Box, Target=merge)  # -> Geometry, Transform
boxmap_3 = BoxMapping(Geometry=group, Source=mirror.Geometry, Target=merge_2)  # -> Geometry, Transform

# ----
filter_5 = StreamFilter(Gate=checkboard_mirroring_2, Stream0=[boxmap_3.Geometry, boxmap_2.Geometry], Stream1=boxmap.Geometry)

preview = CustomPreview(Geometry=filter_5, Material=ColourSwatch(SwatchColor=RGB(113, 140, 255)))

output_group = Group(Objects=filter_5)
