# Grasshopper definition Facade_Glass & Mullions 0.1.0.gh (Grasshopper 1.0.8)

base_surface = Geometry(graft([<surface referenced from the Rhino model> x4, <extrusion referenced from the Rhino model>, <surface referenced from the Rhino model>, <extrusion referenced from the Rhino model>, <surface referenced from the Rhino model>]))
debrep = DeconstructBrep(Brep=base_surface)  # -> Faces, Edges, Vertices
divide = DivideDomain²(Domain=base_surface, UCount=Slider(3, range=0..10), VCount=Slider(3, range=0..10))
join = JoinCurves(Curves=debrep.Edges, Preserve=False)
createframinglines = GhPythonScript(srf=base_surface, direction=Toggle(False), distance=Slider(4, range=0..4))  # -> framing_lines, sillCurve, headCurve; inputs srf: Surface
# ---------- createframinglines: Python ----------
__author__ = "ilouh"
__version__ = "2025.05.15"

import rhinoscriptsyntax as rs
import Grasshopper as gh
import Rhino.Geometry as rg
import ghpythonlib.components as comps
import math


# Untrim the surface for full edge detection
untrim_surface = comps.Untrim(srf)


def framing(crvs, distance):
    crv_01, crv_02 = crvs

    # Flip curve if necessary to match direction
    if not rs.IsCurve(crv_01) or not rs.IsCurve(crv_02):
        raise ValueError("Input curves are not valid.")

    spacing = rs.CurveLength(crv_01) / distance
    if spacing < 2:
        spacing = 2  # Minimum spacing

    points_01 = rs.DivideCurve(crv_01, int(spacing))
    points_02 = rs.DivideCurve(crv_02, int(spacing))

    # Ensure the lists match in length
    if len(points_01) > len(points_02):
        points_01 = points_01[:len(points_02)]
    elif len(points_02) > len(points_01):
        points_02 = points_02[:len(points_01)]

    # Reverse the points of the upper edge to ensure alignment
    points_02.reverse()

    framing_members = [rs.AddLine(p1, p2) for p1, p2 in zip(points_01, points_02)]

    return framing_members, crv_01, crv_02


# Extract the edges of the surface
edges = comps.DeconstructBrep(untrim_surface)['edges']

# Sort by direction to detect vertical vs. horizontal
vertical_edges = []
horizontal_edges = []

for edge in edges:
    start, end = rs.CurveStartPoint(edge), rs.CurveEndPoint(edge)
    vector = rs.VectorCreate(end, start)
    if abs(vector.Z) > abs(vector.X) and abs(vector.Z) > abs(vector.Y):
        vertical_edges.append(edge)
    else:
        horizontal_edges.append(edge)

# Sort edges by length
vertical_edges = sorted(vertical_edges, key=lambda e: rs.CurveLength(e))
horizontal_edges = sorted(horizontal_edges, key=lambda e: rs.CurveLength(e))

if direction:
    framing_lines = framing(vertical_edges, distance)[0]
    sillCurve, headCurve = horizontal_edges[-1], horizontal_edges[0]
else:
    framing_lines = framing(horizontal_edges, distance)[0]
    sillCurve, headCurve = horizontal_edges[-1], horizontal_edges[0]

# Output the result
a = framing_lines
# ---------- end createframinglines ----------
surfaceboundary = GhPythonScript(curve=join, distance=Slider(0.1, range=0..0.1), frameDepth=Slider(0.3, range=0..1))  # -> windowFrame, windowGlazing; inputs curve: Curve
# ---------- surfaceboundary: Python ----------
__author__ = "ilouh"
__version__ = "2023.02.21"

import rhinoscriptsyntax as rs
import Grasshopper as gh
import Rhino.Geometry as rg
import ghpythonlib.components as comps
import math


def createFrame(crv,distance,frameDepth):
    
    offset_1 = comps.OffsetCurve(crv,distance,corners = 1)
    offset_2 = comps.OffsetCurve(crv,-distance,corners = 1)
    
    if comps.Length(offset_1) > comps.Length(offset_2): 
        srf = comps.BoundarySurfaces([crv,offset_2])
        point = comps.ConstructPoint(0.5,0.5,0)
        normal = comps.EvaluateSurface(srf,point)['normal']
        brep = comps.Extrude(srf,comps.Amplitude(normal,frameDepth))
        brep = comps.Move(brep,comps.Amplitude(normal,-frameDepth/2))['geometry']
        return brep,comps.BoundarySurfaces(offset_2)

    
    else:
        srf =  comps.BoundarySurfaces([crv,offset_1])
        point = comps.ConstructPoint(0.5,0.5,0)
        normal = comps.EvaluateSurface(srf,point)['normal']
        brep = comps.Extrude(srf,comps.Amplitude(normal,frameDepth))
        brep = comps.Move(brep,comps.Amplitude(normal,-frameDepth/2))['geometry']
        return brep,comps.BoundarySurfaces(offset_1)



windowFrame = createFrame(curve,distance,frameDepth)[0]
windowGlazing = createFrame(curve,distance,frameDepth)[1]
# ---------- end surfaceboundary ----------
crv = Curve(createframinglines.headCurve)
crv_2 = Curve(createframinglines.sillCurve)
crv_3 = Curve(createframinglines.framing_lines)
brep = Brep(surfaceboundary.windowFrame)
brep_2 = Brep(surfaceboundary.windowGlazing)
