# Grasshopper definition Facade_Standing Seam.gh (Grasshopper 1.0.8)

pipeline = GeometryPipeline(
    GroupByLayer=False,
    GroupByType=False,
    IncludeHidden=True,
    IncludeLocked=True,
    LayerFilter="03_ARCH*03_STANDING_SEAM",
    NameFilter="*",
    SublayerFiltering=True,
    TypeFilter=1073741848)
get_geometry = GetGeometry(AnnotationTypeFilter=3966, AtLeast=1, AtMost=1, DeleteInput=False, Filter=1074081855, TreeAccess=False)

# ---- group: Input Surface
srf = Surface(graft(get_geometry))

# ----
facade_panel_v_size = Slider(12, range=0..50)
# REGULATED SPACING
facade_depth = Slider(2, range=0..10)
list = ValueList({"Running Bond": 0, "Stacking Bond": 1}, selected="Stacking Bond")

flatten = FlattenTree(Tree=srf, Path="{0}")  # -> graft(Tree)

srf_2 = Surface(reparameterize(flatten))
python = PythonScript(s=srf_2, swapUV=Toggle(False), reverseU=Toggle(False), reverseV=Toggle(True))  # -> out, anchor, uVec, vVec, revSrf; inputs s: Surface, swapUV: Int32, reverseU: Int32, reverseV: Int32
# ---------- python: Python ----------
import Rhino

if reverseU:
    uS,uE = s.Domain(0)
    inter0 = Rhino.Geometry.Interval(-uE, -uS)
    s.SetDomain(0,inter0)
    s = s.Reverse(0)

if reverseV:
    vS,vE = s.Domain(1)
    inter1 = Rhino.Geometry.Interval(-vE, -vS)
    s.SetDomain(1,inter1)
    s = s.Reverse(1)

if swapUV:
    s = s.Transpose()

anchor = s.PointAt(0,0)
uend = s.PointAt(0.5,0)
vend = s.PointAt(0,0.5)
uVec = uend - anchor
vVec = vend - anchor

revSrf = s
# ---------- end python ----------

create_standing_seam = CreateStandingSeam(input_surface=python.revSrf, panel_v_size=facade_panel_v_size, facade_depth=facade_depth)
seams = Brep(create_standing_seam)
context_bake = ContextBake(Content=seams)

# ==== cluster CreateStandingSeam
input_surface = ClusterInput()
panel_v_size = ClusterInput()
facade_depth = ClusterInput()
input_surface_2 = Surface(input_surface)
panel_v_size_2 = Number(panel_v_size)
facade_depth_2 = Number(facade_depth)

dim = Dimensions(Surface=input_surface_2)  # -> UDimension, VDimension
expression = Expression(x=dim.VDimension, y=panel_v_size_2, Expression="round(x/y)")
divide = DivideDomain²(Domain=input_surface_2, UCount=1, VCount=expression)

md_slider = MDSlider(SliderMode=0, slider_value=Point(0.5, 0.5, 0.5), x_domain=Domain(0, 1), y_domain=Domain(0, 1), z_domain=Domain(0, 1))
subsrf = Isotrim(Surface=input_surface_2, Domain=divide)
evalsrf = EvaluateSurface(Surface=reparameterize(subsrf), Point=md_slider)  # -> Point, Normal, UDirection, VDirection, Frame

iso = IsoCurve(Surface=reparameterize(subsrf), UVPoint=md_slider)  # -> simplify(graft(UIsocurve)), simplify(graft(VIsocurve))
len = Length(Curve=iso.VIsocurve)
len_2 = Length(Curve=iso.UIsocurve)
merge = Merge(Data1=iso.UIsocurve, Data2=iso.VIsocurve)
merge_2 = Merge(Data1=len_2, Data2=len)

sort = SortList(Keys=merge_2, ValuesA=merge)  # -> Keys, reverse(ValuesA)
item = ListItem(List=sort.ValuesA, Index=0, Wrap=True)
amp = Amplitude(Vector=evalsrf.Normal, Amplitude=facade_depth_2)  # -> graft(Vector)
extr = Extrude(Base=item, Direction=amp)  # -> simplify(Extrusion)

number_slider = Slider(0.125, range=0..1)
neg = Negative(Value=number_slider)
offset = OffsetSurface(Surface=extr, Distance=number_slider, Retrim=True)
offset_2 = OffsetSurface(Surface=extr, Distance=neg, Retrim=True)
merge_3 = Merge(Data1=offset, Data2=offset_2)

loft = Loft(Curves=merge_3, Options={Adjust=False, Closed=False, LoftEnds=0, LoftSimp=0, LoftType=0, Rebuild=10, Refit=0.01})
cap = CapHoles(Brep=loft)
B = ClusterOutput(cap)
