# Grasshopper definition Massing Design Calculator 0.7.3.gh (Grasshopper 1.0.7)
# plug-ins: CORE.Toolbox.Grasshopper

land_value = DigitScroller(Scroller_Digits=12, Scroller_Prefix="Land Value", Scroller_Radix=11, Scroller_Value=1300000)
hard_vs_soft_coef = DigitScroller(Scroller_Digits=12, Scroller_Prefix="Hard vs Soft Coef", Scroller_Radix=11, Scroller_Value=70)
net_coefficient = DigitScroller(Scroller_Digits=12, Scroller_Prefix="Net Coefficient", Scroller_Radix=11, Scroller_Value=82)
cap_rate = DigitScroller(Scroller_Digits=12, Scroller_Prefix="Cap Rate", Scroller_Radix=11, Scroller_Value=5)

program_name = Panel("Market Rate")
input_mass = Brep(graft(<brep referenced from the Rhino model>))
omit_last_floor_slab = BooleanToggle(True)
percentage_studios = DigitScroller(Scroller_Digits=12, Scroller_Prefix="Percentage Studios", Scroller_Radix=11, Scroller_Value=25)
target_area_studios = DigitScroller(Scroller_Digits=12, Scroller_Prefix="Target Area - Studios", Scroller_Radix=11, Scroller_Value=500)
typical_floor_height = DigitScroller(Scroller_Digits=12, Scroller_Prefix="Typical Floor Height", Scroller_Radix=11, Scroller_Value=11)
residentail_y_n = BooleanToggle(True)

unit_density = DigitScroller(Scroller_Digits=12, Scroller_Prefix="Unit Density", Scroller_Radix=11, Scroller_Value=850)
construction_cost_per_sf = DigitScroller(Scroller_Digits=12, Scroller_Prefix="Construction Cost Per SF", Scroller_Radix=11, Scroller_Value=375)
rent_per_sf = DigitScroller(Scroller_Digits=12, Scroller_Prefix="Rent Per SF", Scroller_Radix=10, Scroller_Value=6.82)
percentage_of_two_bedrooms = DigitScroller(Scroller_Digits=12, Scroller_Prefix="Percentage of Two Bedrooms", Scroller_Radix=11, Scroller_Value=25)
target_area_two_bedroom = DigitScroller(Scroller_Digits=12, Scroller_Prefix="Target Area - Two Bedroom", Scroller_Radix=11, Scroller_Value=900)
target_area_three_bedroom = DigitScroller(Scroller_Digits=12, Scroller_Prefix="Target Area - Three Bedroom", Scroller_Radix=11, Scroller_Value=1100)
sale_price_per_sf = DigitScroller(Scroller_Digits=12, Scroller_Prefix="Sale Price Per SF", Scroller_Radix=11, Scroller_Value=1260)
percentage_of_one_bedrooms = DigitScroller(Scroller_Digits=12, Scroller_Prefix="Percentage of One Bedrooms", Scroller_Radix=11, Scroller_Value=48)
target_area_one_bedroom = DigitScroller(Scroller_Digits=12, Scroller_Prefix="Target Area - One Bedroom", Scroller_Radix=11, Scroller_Value=650)
pro_forma_calculator = ProFormaCalculator(
    program_name=program_name,
    massing=input_mass,
    unit_density=unit_density,
    cpsf=construction_cost_per_sf,
    typical_floor_height=typical_floor_height,
    ppsf=sale_price_per_sf,
    rpsf=rent_per_sf,
    cap_rate=cap_rate,
    bool=omit_last_floor_slab,
    net_coef=net_coefficient,
    land_value=land_value,
    hard_soft_coef=hard_vs_soft_coef,
    residential=residentail_y_n,
    percentage_studios=percentage_studios,
    percentage_one_bedrooms=percentage_of_one_bedrooms,
    percentage_two_bedrooms=percentage_of_two_bedrooms,
    desired_area_studios=target_area_studios,
    desired_area_one_bedroom=target_area_one_bedroom,
    desired_area_two_bedroom=target_area_two_bedroom,
    desired_area_three_bedroom=target_area_three_bedroom)  # -> walls, roof, floors, floors_as_curves, values, dic_keys, dic_values, resi_info, resi_key_list, resi_values

list_values = Data(pro_forma_calculator.dic_values)
list_keys = Data(pro_forma_calculator.dic_keys)
crv = Curve(pro_forma_calculator.floors_as_curves)
brep = Brep(pro_forma_calculator.floors)
flip = FlipMatrix(Data=pro_forma_calculator.resi_values)

# ---- group: Write to Excel
path = FilePath("G:\My Drive\MTA - Venice Bus Yard\04 Excel Files\MTA - Data & Proforma.xlsx")
xl_out = WriteToExcelClassic(WorkbookFilepath=path, WorksheetName="Pro-Forma", Data=flip, LocationAddress="E21", Stream=Toggle(True))

# ==== cluster ProFormaCalculator
massing = ClusterInput()
typical_floor_height = ClusterInput()
bool = ClusterInput()
percentage_studios = ClusterInput()
percentage_one_bedrooms = ClusterInput()
percentage_two_bedrooms = ClusterInput()
desired_area_studios = ClusterInput()
desired_area_one_bedroom = ClusterInput()
desired_area_two_bedroom = ClusterInput()
desired_area_three_bedroom = ClusterInput()
program_name = ClusterInput()
unit_density = ClusterInput()
cpsf = ClusterInput()
ppsf = ClusterInput()
rpsf = ClusterInput()
cap_rate = ClusterInput()
net_coef = ClusterInput()
land_value = ClusterInput()
hard_soft_coef = ClusterInput()
residential = ClusterInput()

cluster = Cluster(massing=massing, typical_floor_height=typical_floor_height, bool=bool)  # -> facade_attributes_2, points_facade_attributes, walls_2, roof, floors_2, floors_as_curves_2, areas, length_tree
pro_forma = GhPythonScript(
    program_name=program_name,
    areas=cluster.areas,
    unit_density=unit_density,
    cpsf=cpsf,
    ppsf=ppsf,
    rpsf=rpsf,
    cap_rate=cap_rate,
    net_coef=net_coef,
    land_value=land_value,
    hard_soft_coef=hard_soft_coef)  # -> values, dic_keys, dic_values, total_net_area, units; inputs areas: list
# ---------- pro_forma: Python ----------
__author__ = "ilouh"
__version__ = "2023.02.21"

import rhinoscriptsyntax as rs
import Grasshopper as gh
import Rhino.Geometry as rg
import ghpythonlib.components as comps
import math

#sum a list of numbers
def sum(numbers):
    total = 0
    for n in numbers:
        total += n
    return total


#Functions
def format_to_dollar_price(value):
    if isinstance(value, (int, float)):
        formatted_value = "${:,.2f}".format(value)
    elif isinstance(value, str):
        # Remove any non-numeric characters
        value = ''.join(filter(str.isdigit, value))
        if value:
            formatted_value = "${:,.2f}".format(float(value)/100)
        else:
            formatted_value = "$0.00"
    else:
        raise TypeError("Unsupported value type. Only int, float, and str are supported.")
    
    return formatted_value

def float_to_percentage(number):
    percentage = number * 100
    formatted_percentage = "{:.2f}%".format(percentage)
    return formatted_percentage

def format_to_sf_area(value):
    if isinstance(value, (int, float)):
        formatted_value = "{:,.2f} SF".format(value)
    else:
        raise TypeError("Unsupported value type. Only int and float are supported.")
    
    return formatted_value

#_______________________________________________________________________________________
# Calculations


total_area = sum(areas)
total_net_area = total_area * (net_coef /100)
units = math.floor(total_net_area/unit_density)
average_unit_size = total_net_area / units  # Average size of each unit in square feet
average_rent = float(rpsf) * total_net_area / units  # Average monthly rent per unit
unit_sale_value = average_unit_size * ppsf  # Sale value of each unit

project_valuation = (average_rent * units * (net_coef / 100) * 12) / (cap_rate / 100)  # Valuation of the project based on net operating income
construction_costs = total_area * cpsf  # Total construction costs for the project
soft_costs = construction_costs * ((100 - hard_soft_coef) / 100)  # Soft costs for the project
total_project_costs = land_value + construction_costs + soft_costs  # Total costs for the project

net_income = total_net_area * rpsf * (net_coef/100) * 12 

# Create a dictionary to store the calculated values
data_dict = {
    'program_name' : program_name,
    'total_gross_area': format_to_sf_area(total_area),
    'total_net_area': format_to_sf_area(total_net_area),
    'total_Potential_units': units,
    'average_unit_size': format_to_sf_area(average_unit_size),
    'average_unit_rent': format_to_dollar_price(average_rent),
    'average_unit_sale_value': format_to_dollar_price(unit_sale_value),
    'construction_cost': format_to_dollar_price(total_area * cpsf),
    'soft_costs': format_to_dollar_price(soft_costs),
    'total_cost': format_to_dollar_price(total_project_costs),
    'sale_value': format_to_dollar_price(total_area * ppsf),
    'gross_income' : format_to_dollar_price(total_area * rpsf * 12) ,
    'net_income' : format_to_dollar_price(net_income),
    'costruction_costs_per_sf': format_to_dollar_price(cpsf),
    'sale_price_per_sf': format_to_dollar_price(ppsf),
    'rent_price_per_sf': format_to_dollar_price(rpsf)
    
}


# Create a list of keys to iterate through
keys_list = [
    'program_name',
    'total_gross_area',
    'total_net_area',
    'total_Potential_units',
    'average_unit_size',
    'average_unit_rent',
    'average_unit_sale_value',
    'construction_cost',
    'soft_costs',
    'total_cost',
    'sale_value',
    'gross_income',
    'net_income',
    'costruction_costs_per_sf',
    'sale_price_per_sf',
    'rent_price_per_sf'
    
]

# Iterate through the keys_list and retrieve corresponding values from the data_dict
values = []
for item in keys_list:
    values.append(item + ': ' + str(data_dict[item]))

# Print the values
print(values)

dic_keys = keys_list
dic_values = []

for key in keys_list: 
    
    dic_values.append(data_dict[key])
# ---------- end pro_forma ----------
unit_breakdown = GhPythonScript(
    residential=residential,
    total_achievable_units=pro_forma.units,
    total_program_area=pro_forma.total_net_area,
    percentage_studios=percentage_studios,
    percentage_one_bedrooms=percentage_one_bedrooms,
    percentage_two_bedrooms=percentage_two_bedrooms,
    desired_area_studios=desired_area_studios,
    desired_area_one_bedroom=desired_area_one_bedroom,
    desired_area_two_bedroom=desired_area_two_bedroom,
    desired_area_three_bedroom=desired_area_three_bedroom)  # -> resi_info, resi_key_list, resi_values
# ---------- unit_breakdown: Python ----------
__author__ = "ilouh"
__version__ = "2023.02.21"

import rhinoscriptsyntax as rs
import Grasshopper as gh
import Rhino.Geometry as rg
import ghpythonlib.components as comps
import math


#Declaration of variables
total_program_area = total_program_area
total_achievable_units = total_achievable_units

#residential = True
total_area = total_program_area

#percentage_studios = 35
#percentage_one_bedrooms = 25
#percentage_two_bedrooms = 35 

#desired_area_studios = 300
#desired_area_one_bedroom = 400
#desired_area_two_bedroom = 600
#desired_area_three_bedroom = 800

def format_to_sf_area(value):
    if isinstance(value, (int, float)):
        formatted_value = "{:,.2f} SF".format(value)
    else:
        raise TypeError("Unsupported value type. Only int and float are supported.")
    
    return formatted_value
    

def unit_program(total_area,
                 program_percentage,
                 proposed_unit_area,
                 total_achievable_units):

    total_program_area_for_unit_type = (total_achievable_units * (program_percentage/100))*proposed_unit_area
    total_units_of_type = total_achievable_units * (program_percentage/100)
    unit_of_type_average_area = round(total_program_area_for_unit_type / total_units_of_type,2)

    total_program_area = total_units_of_type * unit_of_type_average_area

    return total_units_of_type, unit_of_type_average_area,total_program_area

def unit_calcs(total_area,
               percentage_studios,
               percentage_one_bedrooms,
               percentage_two_bedrooms,
               desired_area_studios,
               desired_area_one_bedroom,
               desired_area_two_bedroom,
               desired_area_three_bedroom):

    percentage_three_bedrooms = 100 - (percentage_studios + percentage_one_bedrooms + percentage_two_bedrooms)
    
    studios = unit_program(total_area,percentage_studios,desired_area_studios,total_achievable_units)
    one_bedroom = unit_program(total_area,percentage_one_bedrooms,desired_area_one_bedroom,total_achievable_units)
    two_bedroom = unit_program(total_area,percentage_two_bedrooms,desired_area_two_bedroom,total_achievable_units)
    three_bedroom = unit_program(total_area,percentage_three_bedrooms,desired_area_three_bedroom,total_achievable_units)

    
    dic = {
        "unit_breakdown" : "----",
        "U.no_studios": studios[0],
        "U.avg_studio_area" : format_to_sf_area(studios[1]),
        "U.no_one_bedroom": one_bedroom[0],
        "U.avg_one_bedroom_area": format_to_sf_area(one_bedroom[1]),
        "U.no_two_bedroom": two_bedroom[0],
        "U.avg_two_bedroom_area": format_to_sf_area(two_bedroom[1]),
        "U.no_three_bedroom": three_bedroom[0],
        "U.avg_three_bedroom_area": format_to_sf_area(three_bedroom[1]),
        "U.total_net_area": format_to_sf_area(studios[2] + one_bedroom[2] + two_bedroom[2] + three_bedroom[2]),
        "U.total_units": studios[0] + one_bedroom[0] + two_bedroom[0] + three_bedroom[0]

    }

    return dic

if residential is True: 

    dic = unit_calcs(total_area,percentage_studios,percentage_one_bedrooms,percentage_two_bedrooms,desired_area_studios,desired_area_one_bedroom,desired_area_two_bedroom,desired_area_three_bedroom)
    
    resi_key_list = [
        
        "unit_breakdown",
        "U.no_studios",
        "U.avg_studio_area",
        "U.no_one_bedroom",
        "U.avg_one_bedroom_area",
        "U.no_two_bedroom",
        "U.avg_two_bedroom_area",
        "U.no_three_bedroom",
        "U.avg_three_bedroom_area",
        "U.total_units",
        "U.total_net_area"
    
    ]
    
    resi_info  = []
    for item in resi_key_list:
        resi_info.append(item + ': ' + str(dic[item]))
        
    resi_values  = []
    
    for key in resi_key_list:
        resi_values.append(dic[key])
# ---------- end unit_breakdown ----------
python = GhPythonScript(li=pro_forma.dic_values)  # -> flatten(values_as_floats); inputs li: list
# ---------- python: Python ----------
__author__ = "Iliya Muzychuk"
__version__ = "2023.02.03"

import rhinoscriptsyntax as rs
import Grasshopper as gh
import Rhino.Geometry as rg
import ghpythonlib.components as comps

import re

def extract_numbers(string):
    numbers = re.findall(r'\d+(?:,\d+)*(?:\.\d+)?', string)
    return [float(num.replace(',', '')) for num in numbers]

values_as_floats = []

for item in li: 
    
    extracted_number = extract_numbers(str(item))
    print(len(extracted_number))
    
    
    #check if extracted_number is a number or not
    if len(extracted_number) > 0:
        
        values_as_floats.append(extracted_number[0])
        
    else:
        empty_string = str(item)
        values_as_floats.append(empty_string)


print(values_as_floats)
# ---------- end python ----------
python_2 = GhPythonScript(li=unit_breakdown.resi_values)  # -> flatten(values_as_floats); inputs li: list; same code as python

panel = Panel(cluster.areas)
walls = ClusterOutput(cluster.walls_2)
roof = ClusterOutput(cluster.roof)
floors_as_curves = ClusterOutput(cluster.floors_as_curves_2)
floors = ClusterOutput(cluster.floors_2)
panel_2 = Panel(unit_breakdown.resi_values)
python_3 = GhPythonScript(
    pro_forma_keys=pro_forma.dic_keys,
    pro_forma_values=pro_forma.dic_values,
    unit_breakdown_keys=unit_breakdown.resi_key_list,
    unit_breakdown_values=unit_breakdown.resi_values)  # -> dic, keys, values; inputs pro_forma_keys: list, pro_forma_values: list, unit_breakdown_keys: list, unit_breakdown_values: list
# ---------- python_3: Python ----------
__author__ = "Iliya Muzychuk"
__version__ = "2023.02.03"

import rhinoscriptsyntax as rs
import Grasshopper as gh
import Rhino.Geometry as rg
import ghpythonlib.components as comps
import re 
import json

def extract_numbers(string):
    numbers = re.findall(r'\d+(?:,\d+)*(?:\.\d+)?', string)
    return [float(num.replace(',', '')) for num in numbers]
    
keys = pro_forma_keys+unit_breakdown_keys
values = pro_forma_values + unit_breakdown_values


dic = {}

for i in range(0,len(keys)):
    
    value = extract_numbers(str(values[i]))
    
    if len(value) > 0:
        
        dic[keys[i]] = round(value[0],2)
        
    else:
        dic[keys[i]] = str(values[i])
        

print dic
# ---------- end python_3 ----------
resi_key_list = ClusterOutput(unit_breakdown.resi_key_list)
resi_values = ClusterOutput(unit_breakdown.resi_values)
dic_values = ClusterOutput(pro_forma.dic_values)
dic_keys = ClusterOutput(pro_forma.dic_keys)
resi_info = ClusterOutput(unit_breakdown.resi_info)
values = ClusterOutput(pro_forma.values)

# ==== cluster Cluster
massing = ClusterInput()
typical_floor_height = ClusterInput()
typical_floor_height_2 = Integer(typical_floor_height)
massing_2 = Brep(massing)

# ---- group: Calculates Building Height
bbox = BoundingBox(Content=massing_2, Plane=PlaneXY(0, 0, 0), UnionBox=True)  # -> Box, Box_2
box_corners = BoxCorners(Box=bbox.Box)  # -> CornerA, CornerB, CornerC, CornerD, CornerE, CornerF, CornerG, CornerH

# ----
Z = UnitZ(Factor=1)
contour = Contour(Shape=massing_2, Point=box_corners.CornerA, Direction=Z, Distance=typical_floor_height_2)  # -> simplify(Contours)
tstat = TreeStatistics(Tree=contour)  # -> Paths, Length, Count
trim = TrimTree(Tree=contour, Depth=1)
panel = Panel(trim)
floors_as_curves = Curve(simplify(contour))

# ---- group: Isolate Faces of Mass
debrep = DeconstructBrep(Brep=massing_2)  # -> Faces, Edges, Vertices
evalsrf = EvaluateSurface(Surface=reparameterize(debrep.Faces), Point="{0.5,0.5,0}")  # -> Point, simplify(Normal), UDirection, VDirection, Frame
distributefaces = GhPythonScript(v=simplify(evalsrf.Normal), faces=simplify(debrep.Faces))  # -> floors, facadeWalls, roof; inputs v: list, faces: list
# ---------- distributefaces: Python ----------
__author__ = "ilouh"
__version__ = "2023.01.08"

import rhinoscriptsyntax as rs
import ghpythonlib.components as comps
import Rhino.Geometry as geom

#elements = comps.DeconstructBrep(mass)
#faces = elements['faces']

#find the normal of each face


roof = []
floors = []
solidWalls = []
facadeWalls = [] 

for i in range(0,len(v)):
    
    vector = v[i]
    values = comps.DeconstructVector(vector)
    
    print(vector)
    
    if values['x_component'] is not None:
        
        x_value = values['x_component']
        y_value = values['y_component']
        z_value = values['z_component']
        
    else:
        
        x_value = vector[0]
        y_value = vector[1]
        z_value = vector[2]
    
    print(x_value)
    
    if x_value is not None:
        
        if z_value >= 0.4:
            
            print(i)
            roof.append(faces[i])
        
        if z_value == -1:
            
            floors.append(faces[i])
       
        if abs(z_value) != 1:
        
            facadeWalls.append(faces[i])
# ---------- end distributefaces ----------

# ----
panel_2 = Panel(evalsrf.Normal)
srf = Surface(graft(distributefaces.facadeWalls))
srf_2 = Surface(flatten(distributefaces.roof))
srf_3 = Surface(distributefaces.floors)
flatten = FlattenTree(Tree=srf_3, Path="{0}")
trim_2 = TrimTree(Tree=srf, Depth=1)
bool = ClusterInput()
area = Area(Geometry=flatten)  # -> Area, Centroid
python = GhPythonScript()  # -> Out, A
ma = MassAddition(Input=area.Area)  # -> Result, PartialResults
walls = Surface(simplify(trim_2))

# ---- group: Pass if Tree or List
python_2 = GhPythonScript(x=floors_as_curves, tree=floors_as_curves)  # -> simplify(flatten(a)); inputs x: list, tree: tree
# ---------- python_2: Python ----------
__author__ = "ilouh"
__version__ = "2023.02.21"

import rhinoscriptsyntax as rs
import Grasshopper as gh
import Rhino.Geometry as rg
import ghpythonlib.components as comps
from ghpythonlib import treehelpers as th
import math

def remove_brackets(input_str):
    # Remove the brackets
    content = input_str.strip('{}')
    # Split the string by commas and convert to integers
    numbers = [int(num) for num in content.split(';')]

    return numbers
    
test_li = th.tree_to_list(tree)
test_value = len(test_li)

tree_stats = comps.TreeStatistics(tree)
tree_paths = tree_stats['paths']
tree_paths = tree_paths[0]
tree_path_structure = remove_brackets(str(tree_paths))
tree_path_structure_length = len(tree_path_structure)
print(tree_path_structure_length)


if tree_path_structure_length > 1:
    a = True
else:
    a = False
# ---------- end python_2 ----------
trim_3 = TrimTree(Tree=floors_as_curves, Depth=1)
flatten_2 = FlattenTree(Tree=floors_as_curves, Path="{0}")

# ----
item = ListItem(List=python_2, Index=0, Wrap=True)

# ---- group: Pass if Tree or List (continued)
filter = StreamFilter(Gate=item, Stream0=flatten_2, Stream1=trim_3)

# ----
cls = Closed(Curve=filter)  # -> Closed, Periodic
panel_3 = Panel(cls.Closed)
cull = CullPattern(List=filter, CullPattern=cls.Closed)
area_2 = Area(Geometry=cull)  # -> Area, Centroid

# ---- group: Calculates Gross Building Area
python_3 = GhPythonScript(Floor_Plate_Curves=cull, bool=bool, areas=area_2.Area)  # -> keys, simplify(values), TotalBuildingArea, Floor_Plate_Curves; inputs Floor_Plate_Curves: list of Curve, floorList: list of Int32, areas: list
# ---------- python_3: Python ----------
__author__ = "Iliya Muzychuk"
__version__ = "2023.02.03"

import rhinoscriptsyntax as rs
import Grasshopper as gh
import Rhino.Geometry as rg
import ghpythonlib.components as comps

FloorNames = []
FloorAreas = []

#Funcition to find the key of a dictionary by value 

def findKey(value_to_find,dic):
    for key, value in dic.items():
        if abs(value - value_to_find) < 2:
            return key
dic = {}
#Create a name and claculates the area of each floor
for i in range(0,len(floorList)):
    floor_number = 1 + i
    dic_name = 'Floor {}'.format(floor_number)
    dic[dic_name] = floorList[i]



if bool == True: 

    Floor_Plate_Curves.pop(-1)


else:
    
    pass

for  i in range(0,len(Floor_Plate_Curves)): 
    
    floor = Floor_Plate_Curves[i]
    print(floor)
    #Floor_Area = comps.Area(floor)
    Floor_Area = areas[i]
    print(Floor_Area)
    if Floor_Area is not None:
        
        FloorAreas.append(round(Floor_Area,2))


keys = FloorNames
values = FloorAreas

TotalBuildingArea = sum(values)
# ---------- end python_3 ----------

# ---- group: creates the extrusion distance
floor_thickness = Slider(0.5, range=0..1)
neg = Negative(Value=floor_thickness)
Z_2 = UnitZ(Factor=neg)
extr = Extrude(Base=python_3.Floor_Plate_Curves, Direction=Z_2)
cap = CapHoles(Brep=extr)

# ----
panel_4 = Panel(python_3.TotalBuildingArea)

extr_2 = Extrude(Base=srf_2, Direction=Z_2)
cap_2 = CapHoles(Brep=extr_2)

panel_5 = Panel(python_3.Floor_Plate_Curves)
floors = Brep(simplify(cap))
flatten_3 = FlattenTree(Tree=python_3.values, Path="{0}")
tstat_2 = TreeStatistics(Tree=python_3.values)  # -> Length_tree, Length, Count

# ---- group: Outputs
floors_as_curves_2 = ClusterOutput(python_3.Floor_Plate_Curves)
floors_2 = ClusterOutput(floors)
walls_2 = ClusterOutput(walls)
roof = ClusterOutput(cap_2)

# ----
areas = ClusterOutput(flatten_3)
length_tree = ClusterOutput(tstat_2.Length_tree)
flatten_4 = FlattenTree(Tree=python_3.TotalBuildingArea, Path="{0}")
graft = GraftTree(Tree=flatten_4, IncludeEmptyLists=True, IncludeNullItems=True)

# ---- group: Calculates Wall Area Ratio
python_4 = GhPythonScript(walls=walls, totalBuildingArea=graft)  # -> keys, values, result; inputs walls: list
# ---------- python_4: Python ----------
__author__ = "Iliya Muzychuk"
__version__ = "2023.02.03"

import rhinoscriptsyntax as rs
import Grasshopper as gh
import Rhino.Geometry as rg
import ghpythonlib.components as comps

#A function to convert a float to percentage

def float_to_percentage(number):
    return '{:.2%}'.format(number)
    
wall_areas = []

for wall in walls:
    
    area = rs.Area(wall)
    
    wall_areas.append(area)

if len(wall_areas) > 0:
    
    total_wall_area = round(sum(wall_areas),2)
    wall_area_ratio = total_wall_area / totalBuildingArea
    
    #Dictionary constructions allows future json file control 
    
    dic = {
    
        'Total Facade Area' : total_wall_area,
        'Wall area/Floor area Ratio' : float_to_percentage(wall_area_ratio)
    
    }
    
    keys = dic.keys()
    values = dic.values() 
    
    result = []
    
    for key, value in dic.items():
        
        string = str(key) + ": " + str(value)
        result.append(string)
# ---------- end python_4 ----------

# ----
facade_attributes = Data(python_4.result)

lng = ListLength(List=simplify(facade_attributes))
series = Series(Start=0, Step=typical_floor_height_2, Count=lng)

Z_3 = UnitZ(Factor=series)
move = Move(Motion=Z_3)  # -> Points_Facade_Attributes, Transform

points_facade_attributes = ClusterOutput(move.Points_Facade_Attributes)
facade_attributes_2 = ClusterOutput(facade_attributes)
