# Grasshopper definition Massing Design Calculator 0.8.0.gh (Grasshopper 1.0.7)
# plug-ins: Human, eleFront, TT Toolbox

panel = Panel("""02_MASSING*02_RETAIL / ENTERTAINMENT
02_MASSING*02_ENTERTAINMENT
02_MASSING*02_OFFICE
02_MASSING*02_RESIDENTIAL-HIGH RISE
02_MASSING*02_RESIDENTIAL-SERVICED APARTMENTS
02_MASSING*02_HOSPITALITY
02_MASSING*02_COMMUNITY
02_MASSING*02_PUBLIC REALM AREA""")
reflay = ReferenceByLayer(LayerName=panel, lightweight=False, DisableAutoUpdate=False, OnlyVisible=True)

# ---- group: Import Mass as PolySurface
massing = Brep(simplify(graft(reflay)))

# ---- group: Use this script for by objects
_1st_stack_floor_height = DigitScroller(Scroller_Digits=12, Scroller_Prefix="1st Stack Floor Height", Scroller_Radix=11, Scroller_Value=4)  # disabled
no_of_floors = DigitScroller(Scroller_Digits=12, Scroller_Prefix="No. Of Floors", Scroller_Radix=11, Scroller_Value=4)  # disabled
_2nd_stack_floor_height = DigitScroller(Scroller_Digits=12, Scroller_Prefix="2nd Stack Floor Height", Scroller_Radix=11, Scroller_Value=0)  # disabled
no_of_floors_2 = DigitScroller(Scroller_Digits=12, Scroller_Prefix="No. Of Floors", Scroller_Radix=11, Scroller_Value=0)  # disabled
typical_floor_height = DigitScroller(Scroller_Digits=12, Scroller_Prefix="Typical Floor Height", Scroller_Radix=11, Scroller_Value=3.5)  # disabled
omit_last_floor_slab = BooleanToggle(True)  # disabled

# ----
_1st_stack_floor_height_2 = DigitScroller(Scroller_Digits=12, Scroller_Prefix="1st Stack Floor Height", Scroller_Radix=11, Scroller_Value=4)
no_of_floors_3 = DigitScroller(Scroller_Digits=12, Scroller_Prefix="No. Of Floors", Scroller_Radix=11, Scroller_Value=4)
_2nd_stack_floor_height_2 = DigitScroller(Scroller_Digits=12, Scroller_Prefix="2nd Stack Floor Height", Scroller_Radix=11, Scroller_Value=0)
no_of_floors_4 = DigitScroller(Scroller_Digits=12, Scroller_Prefix="No. Of Floors", Scroller_Radix=11, Scroller_Value=0)
typical_floor_height_2 = DigitScroller(Scroller_Digits=12, Scroller_Prefix="Typical Floor Height", Scroller_Radix=11, Scroller_Value=3.5)
omit_last_floor_slab_2 = BooleanToggle(True)

# ---- group: Converts to Layer names
graft = GraftTree(Tree=panel, IncludeEmptyLists=True, IncludeNullItems=True)  # -> simplify(Tree)
lng = ListLength(List=reflay)
dup = DuplicateData(Data=graft, Number=lng, Order=True)  # -> simplify(graft(Data))
clean = CleanTree(RemoveNulls=True, RemoveInvalid=True, RemoveEmpty=True, Tree=dup)

# ----
cluster = Cluster(
    massing=massing,
    _1st_stack_floor_height=_1st_stack_floor_height_2,
    no_of_floors=no_of_floors_3,
    _2nd_stack_floor_height=_2nd_stack_floor_height_2,
    no_of_floors_2=no_of_floors_4,
    typical_floor_height=typical_floor_height_2,
    bool=omit_last_floor_slab_2)  # -> walls_2, simplify(graft(roof)), massing_3, floors_2, simplify(floors_as_curves_2)
tstat = TreeStatistics(Tree=cluster.floors_as_curves_2)  # -> Paths, Length, Count
floors = Brep()  # disabled
panel_2 = Panel(cluster.floors_as_curves_2)

net_coefficient = Slider(80, range=0..100)
pro_forma = GhPythonScript(
    floor_curves=simplify(cluster.floors_as_curves_2),
    program_name=clean,
    unit_density=Slider(50, range=0..1000),
    net_coef=net_coefficient)  # -> values, keys, simplify(dic_keys), simplify(dic_values), total_net_area, units; inputs floor_curves: list of Curve, areas: list
# ---------- pro_forma: Python ----------
__author__ = "ilouh"
__version__ = "2023.02.21"

import rhinoscriptsyntax as rs
import Grasshopper as gh
import Rhino.Geometry as rg
import ghpythonlib.components as comps
import math

def convertKeys(input_string):
    # Capitalize each word and replace underscores with spaces
    modified_string = input_string.replace("_", " ").title()
    
    return modified_string
    
def convertString(input_string):
    # Split the string by '/' and take the last part
    parts = input_string.split('*')
    result = parts[-1]
    result = result.lstrip('0123456789_*')
    result = result.lower()
    result = result.capitalize()
    
    return result
#sum a list of numbers
def sum(numbers):
    total = 0
    for n in numbers:
        total += n
    return total
#Functions
def format_to_dollar_price(value):
    if isinstance(value, (int, float)):
        formatted_value = "${:,.2f}".format(value)
    elif isinstance(value, str):
        # Remove any non-numeric characters
        value = ''.join(filter(str.isdigit, value))
        if value:
            formatted_value = "${:,.2f}".format(float(value)/100)
        else:
            formatted_value = "$0.00"
    else:
        raise TypeError("Unsupported value type. Only int, float, and str are supported.")
    
    return formatted_value
#float to percetage
def float_to_percentage(number):
    percentage = number * 100
    formatted_percentage = "{:.2f}%".format(percentage)
    return formatted_percentage
#format to sf area
def format_to_sf_area(value):
    if isinstance(value, (int, float)):
        formatted_value = "{:,.2f} SF".format(value)
    else:
        raise TypeError("Unsupported value type. Only int and float are supported.")
    
    return formatted_value
#total area function
def totalArea(floor_curves):
    
    areas = []
    
    for floor in floor_curves:
        
        area = comps.Area(floor)['area']
        areas.append(area)
    
    return areas
#_______________________________________________________________________________________
# Calculations

if len(floor_curves) != 0: 

    total_area = sum(totalArea(floor_curves))
    total_net_area = total_area * (net_coef /100)
    units = math.floor(total_net_area/unit_density)
    average_unit_size = total_net_area / units  # Average size of each unit in square feet
    
    # Create a dictionary to store the calculated values
    data_dict = {
        'program_name' : convertString(program_name),
        'total_gross_area': round(total_area,2),
        'total_net_area': round(total_net_area,2),
        'total_Potential_units': round(units,2),
        'average_unit_size': round(average_unit_size,2),
        
    }
    # Create a list of keys to iterate through
    keys_list = [
        'program_name',
        'total_gross_area',
        'total_net_area',
        'total_Potential_units',
        'average_unit_size',
    
    ]
    
    # Iterate through the keys_list and retrieve corresponding values from the data_dict
    
    values = []
    
    for item in keys_list:
        values.append(item + ': ' + str(data_dict[item]))
    
    dic_keys = keys_list
    dic_values = []
    
    for key in keys_list: 
        dic_values.append(data_dict[key])
    
    keys = [] 
    
    for item in keys_list: 
        keys.append(convertKeys(item))
# ---------- end pro_forma ----------

brep = Brep(cluster.massing_3)
datalocations = GhPythonScript(brep=brep, d=Slider(80, range=0..100), n=Slider(5, range=0..100), step=Slider(12, range=0..100))  # -> data_points; inputs brep: Brep, n: Int32, step: Int32
# ---------- datalocations: Python ----------
__author__ = "Iliya Muzychuk"
__version__ = "2023.02.03"

import rhinoscriptsyntax as rs
import Grasshopper as gh
import Rhino.Geometry as rg
import ghpythonlib.components as comps

def function(input,d,n,step):
    
    vol_center = comps.Volume(input)['centroid']
    move_vol_center = comps.Move(vol_center,comps.UnitZ(d))['geometry']

    #create range for translations
    translated_pts = [] 
    
    for i in range(1,n*step,step):
        print(i)
        translated_pts.append(comps.Move(move_vol_center,comps.UnitZ(i))['geometry'])
    
    return translated_pts
        

    pass

if __name__ == "__main__":
    # Add the main part of your script here
    data_points = function(brep,d,n,step)
# ---------- end datalocations ----------

swatch = ColourSwatch(SwatchColor=RGB(128, 128, 128))  # disabled
swatch_2 = ColourSwatch(SwatchColor=RGB(171, 156, 162))  # disabled
swatch_3 = ColourSwatch(SwatchColor=RGBA(183, 173, 255, 72))  # disabled
preview = CustomPreview(Material=swatch_3)  # disabled
preview_2 = CustomPreview(Material=swatch_2)  # disabled
preview_3 = CustomPreview(Material=swatch)  # disabled

screentext = ScreenOrientedText(Text=reverse(pro_forma.values), Justification=7, Location=datalocations, SizeFactor=10, Depth=0, Absolute=False)
split = SplitTree(Data=pro_forma.keys, Masks=flatten("{0;0;0}"))  # -> Positive, Negative
writexl = WriteToExcel(
    Run=Toggle(True),
    ExcelWorksheet="1",
    ColumnNames=split.Positive,
    WriteOptions="None",
    ColumnnsOrRows=True,
    DataToWriteIntoColumns=pro_forma.dic_values)

# ---- group: Use this script for by objects
geo = Geometry([<brep referenced from the Rhino model> x15])  # disabled
python = GhPythonScript(id=geo)  # -> out, graft(fullPath), parent; inputs id: Guid; disabled
# ---------- python: Python ----------
import Rhino
import scriptcontext as sc

sc.doc = Rhino.RhinoDoc.ActiveDoc

obj = sc.doc.Objects.Find(id)
layerIndex = obj.Attributes.LayerIndex
layer = sc.doc.Layers.FindId(sc.doc.Layers[layerIndex].Id)


fullPath = layer.FullPath
parent = fullPath.split("::")[0]

sc.doc = ghdoc
# ---------- end python ----------
path = FilePath("C:\Users\Brooks Scarpa\Google Drive Streaming\Shared drives\BSA Current Projects\23013.0 KAFD 6&7 Masterplan Visioning\23013.0_20_Digital Workspace\01 Rhino\data.json")  # disabled
panel_3 = Panel(path)  # disabled

# ---- group: Use this script for by objects / Import Mass as PolySurface
massing_2 = Brep(simplify(graft(geo)))  # disabled

# ---- group: Use this script for by objects (continued)
cluster_2 = Cluster(
    massing=massing_2,
    _1st_stack_floor_height=_1st_stack_floor_height,
    no_of_floors=no_of_floors,
    _2nd_stack_floor_height=_2nd_stack_floor_height,
    no_of_floors_2=no_of_floors_2,
    typical_floor_height=typical_floor_height,
    bool=omit_last_floor_slab)  # -> walls_2, simplify(graft(roof)), massing_3, floors_2, simplify(floors_as_curves_2); disabled

net_coefficient_2 = Slider(80, range=0..100)  # disabled
number_slider = Slider(650, range=0..1000)  # disabled
pro_forma_2 = GhPythonScript(
    floor_curves=simplify(cluster_2.floors_as_curves_2),
    program_name=python.fullPath,
    unit_density=number_slider,
    net_coef=net_coefficient_2)  # -> values, simplify(dic_keys), simplify(dic_values), total_net_area, units; inputs floor_curves: list of Curve, areas: list; disabled
# ---------- pro_forma_2: Python ----------
__author__ = "ilouh"
__version__ = "2023.02.21"

import rhinoscriptsyntax as rs
import Grasshopper as gh
import Rhino.Geometry as rg
import ghpythonlib.components as comps
import math

#sum a list of numbers
def sum(numbers):
    total = 0
    for n in numbers:
        total += n
    return total


#Functions
def format_to_dollar_price(value):
    if isinstance(value, (int, float)):
        formatted_value = "${:,.2f}".format(value)
    elif isinstance(value, str):
        # Remove any non-numeric characters
        value = ''.join(filter(str.isdigit, value))
        if value:
            formatted_value = "${:,.2f}".format(float(value)/100)
        else:
            formatted_value = "$0.00"
    else:
        raise TypeError("Unsupported value type. Only int, float, and str are supported.")
    
    return formatted_value

def float_to_percentage(number):
    percentage = number * 100
    formatted_percentage = "{:.2f}%".format(percentage)
    return formatted_percentage

def format_to_sf_area(value):
    if isinstance(value, (int, float)):
        formatted_value = "{:,.2f} SF".format(value)
    else:
        raise TypeError("Unsupported value type. Only int and float are supported.")
    
    return formatted_value

def totalArea(floor_curves):
    
    areas = []
    
    for floor in floor_curves:
        
        area = comps.Area(floor)['area']
        areas.append(area)
    
    return areas
#_______________________________________________________________________________________
# Calculations


total_area = sum(totalArea(floor_curves))
total_net_area = total_area * (net_coef /100)
units = math.floor(total_net_area/unit_density)
average_unit_size = total_net_area / units  # Average size of each unit in square feet

# Create a dictionary to store the calculated values
data_dict = {
    'program_name' : program_name,
    'total_gross_area': round(total_area,2),
    'total_net_area': round(total_net_area,2),
    'total_Potential_units': round(units,2),
    'average_unit_size': round(average_unit_size,2),
    
}
# Create a list of keys to iterate through
keys_list = [
    'program_name',
    'total_gross_area',
    'total_net_area',
    'total_Potential_units',
    'average_unit_size',

]

# Iterate through the keys_list and retrieve corresponding values from the data_dict
values = []
for item in keys_list:
    values.append(item + ': ' + str(data_dict[item]))

# Print the values
print(values)

dic_keys = keys_list
dic_values = []

for key in keys_list: 
    
    dic_values.append(data_dict[key])
# ---------- end pro_forma_2 ----------

brep_2 = Brep(cluster_2.massing_3)  # disabled
number_slider_2 = Slider(80, range=0..100)  # disabled
number_slider_3 = Slider(5, range=0..100)  # disabled
number_slider_4 = Slider(12, range=0..100)  # disabled
datalocations_2 = GhPythonScript(brep=brep_2, d=number_slider_2, n=number_slider_3, step=number_slider_4)  # -> data_points; inputs brep: Brep, n: Int32, step: Int32; disabled; same code as datalocations

path_mapper = PathMapper(pro_forma_2.dic_values, source="{A}", target="{0;path_index}")  # disabled
path_mapper_2 = PathMapper(pro_forma_2.dic_keys, source="{A}", target="{0;path_index}")  # disabled
screentext_2 = ScreenOrientedText(Text=reverse(pro_forma_2.values), Justification=7, Location=datalocations_2, SizeFactor=10, Depth=0, Absolute=False)  # disabled
python_2 = GhPythonScript(tree_keys=path_mapper_2, tree_values=path_mapper, file_path=panel_3)  # inputs tree_keys: tree, tree_values: tree; disabled
# ---------- python_2: Python ----------
__author__ = "Iliya Muzychuk"
__version__ = "2023.02.03"

import rhinoscriptsyntax as rs
import Grasshopper as gh
import Rhino.Geometry as rg
import ghpythonlib.components as comps
import ghpythonlib.treehelpers as th
import json 

def convertString(input_string):
    # Split the string by '/' and take the last part
    parts = input_string.split('::')
    result = parts[-1]
    result = result.lstrip('0123456789_*')
    result = result.lower()
    result = result.capitalize()
    
    return result

# Remove any leading digits, underscores, and asterisks

def treeToJson(tree_keys,tree_values,file_path):
    
    converted_tree_keys = th.tree_to_list(tree_keys)
    converted_tree_values = th.tree_to_list(tree_values)
    
    dic_list = [] 
    data = {}
    
    for keys,values in zip(converted_tree_keys,converted_tree_values):
        
        temp_dic = dict(zip(keys,values))
        name = convertString(values[0])
        temp_dic['program_name'] = name
        dic_list.append(temp_dic)
    
    for i in range(0,len(dic_list)): 
        
        name = 'Building 0{}'.format(i)
        data[name] = dic_list[i]
        
    with open(file_path, 'w') as json_file:
        json.dump(data, json_file)
       
    return data

if __name__ == "__main__":
    # Add the main part of your script here
    dic = treeToJson(tree_keys,tree_values,file_path)
# ---------- end python_2 ----------

# ==== cluster Cluster
_1st_stack_floor_height = ClusterInput()
no_of_floors = ClusterInput()
no_of_floors_2 = ClusterInput()
typical_floor_height = ClusterInput()
_2nd_stack_floor_height = ClusterInput()
massing = ClusterInput()
massing_2 = Brep(graft(massing))
_1st_stack_floor_height_2 = Integer(_1st_stack_floor_height)
no_of_floors_3 = Integer(no_of_floors_2)
no_of_floors_4 = Integer(no_of_floors)
_2nd_stack_floor_height_2 = Integer(_2nd_stack_floor_height)
typical_floor_height_2 = Integer(typical_floor_height)
massing_3 = ClusterOutput(massing_2)

# ---- group: Calculates Building Height
bbox = BoundingBox(Content=massing_2, Plane=PlaneXY(0, 0, 0), UnionBox=True)  # -> Box, Box_2
box_corners = BoxCorners(Box=bbox.Box)  # -> CornerA, CornerB, CornerC, CornerD, CornerE, CornerF, CornerG, CornerH
dist = Distance(PointA=box_corners.CornerA, PointB=box_corners.CornerE)

# ----
pdecon = Deconstruct(Point=box_corners.CornerA)  # -> XComponent, YComponent, ZComponent

# ---- group: This Python Component Create the Contour Lines
python = GhPythonScript(
    First_Stack_Floor_Height=_1st_stack_floor_height_2,
    First_Stack_No_Floors=no_of_floors_4,
    Second_Stack_Floor_Height=_2nd_stack_floor_height_2,
    Second_Stack_No_Floors=no_of_floors_3,
    Typical_Floor_Height=typical_floor_height_2,
    Overall_Building_Height=dist,
    start_value_z=pdecon.ZComponent)  # -> simplify(Distances), simplify(intersection_Planes)
# ---------- python: Python ----------
__author__ = "Iliya Muzychuk"
__version__ = "2023.02.03"

import rhinoscriptsyntax as rs
import Grasshopper as gh
import Rhino.Geometry as rg
import ghpythonlib.components as comps
import math

#Variable Declaration

First_Stack_Floor_Height = First_Stack_Floor_Height
First_Stack_No_Floors = First_Stack_No_Floors
Second_Stack_Floor_Height = Second_Stack_Floor_Height
Second_Stack_No_Floors = Second_Stack_No_Floors
Typical_Floor_Height = Typical_Floor_Height
Overall_Building_Height = Overall_Building_Height


#Creates a list of distances for contouring. 

Distances = [0]

#Creates the list of first stack floors 

for i in range(0, int(First_Stack_No_Floors)):
    
    temp_height = (i + 1) * First_Stack_Floor_Height
    print(temp_height)
    Distances.append(temp_height)

#Appends the list the second stack floors 
for i in range(0, int(Second_Stack_No_Floors)):
    
    temp_height = Distances[-1] + Second_Stack_Floor_Height
    Distances.append(temp_height)

remaining_floors = math.floor((round(Overall_Building_Height) - Distances[-1])/Typical_Floor_Height)

for i in range(0, int(remaining_floors)):
    
    temp_height = Distances[-1] + Typical_Floor_Height
    Distances.append(temp_height)
    
#print(remaining_floors)
#print(Distances)

intersection_Planes = []

intersection_Planes = []

for i in range(0,len(Distances)): 
    
    Distances[i] = Distances[i] + start_value_z
    
for z in Distances: 
    
    point = comps.ConstructPoint(0,0,z)
    print(point)
    plane = comps.XYPlane(point)
    intersection_Planes.append(plane)
# ---------- end python ----------

# ----
xy = XYPlane(Origin=python.intersection_Planes)
mesh = MeshBrep(
    Brep=massing_2,
    Settings={GridMaxCount=0, GridMinCount=16, JaggedSeams=False, MaxEdgeLength=0, MinEdgeLength=0.0001, MinTolerance=0, Refine=True, RefineAngle=0, RelativeTolerance=0.65, SimplePlanes=True, Tolerance=0})
sec = MeshPlane(Mesh=mesh, Plane=xy)  # -> simplify(Curves)

# ---- group: Isolate Faces of Mass
debrep = DeconstructBrep(Brep=massing_2)  # -> Faces, Edges, Vertices
evalsrf = EvaluateSurface(Surface=reparameterize(debrep.Faces), Point="{0.5,0.5,0}")  # -> Point, Normal, UDirection, VDirection, Frame
distributefaces = GhPythonScript(v=evalsrf.Normal, faces=debrep.Faces)  # -> floors, facadeWalls, roof; inputs v: list, faces: list
# ---------- distributefaces: Python ----------
__author__ = "ilouh"
__version__ = "2023.01.08"

import rhinoscriptsyntax as rs
import ghpythonlib.components as comps
import Rhino.Geometry as geom

#elements = comps.DeconstructBrep(mass)
#faces = elements['faces']

#find the normal of each face


roof = []
floors = []
solidWalls = []
facadeWalls = [] 

for i in range(0,len(v)):
    
    
    values = comps.DeconstructVector(v[i])
    print(values)
    
    x_value = values['x_component']
    y_value = values['y_component']
    z_value = values['z_component']
    
    

    if z_value >= 0.4:
        
        print(i)
        roof.append(faces[i])
    
    if z_value == -1:
        
        floors.append(faces[i])
   
    if abs(z_value) != 1:
    
        facadeWalls.append(faces[i])
# ---------- end distributefaces ----------

# ----
floors_as_curves = Curve(sec)
flatten = FlattenTree(Tree=massing_2, Path="{0}")
python_2 = GhPythonScript(x=flatten)  # -> a; inputs x: list
# ---------- python_2: Python ----------
__author__ = "ilouh"
__version__ = "2023.02.21"

import rhinoscriptsyntax as rs
import Grasshopper as gh
import Rhino.Geometry as rg
import ghpythonlib.components as comps
import math

if len(x) > 1:
    a = True
else:
    a = False
# ---------- end python_2 ----------
trim = TrimTree(Tree=floors_as_curves, Depth=1)
flatten_2 = FlattenTree(Tree=floors_as_curves, Path="{0}")
filter = StreamFilter(Gate=python_2, Stream0=flatten_2, Stream1=trim)
srf = Surface(flatten(distributefaces.roof))
srf_2 = Surface(graft(distributefaces.facadeWalls))
trim_2 = TrimTree(Tree=srf_2, Depth=1)
bool = ClusterInput()
walls = Surface(simplify(trim_2))
python_3 = GhPythonScript(x=filter, bool=bool)  # -> simplify(floors_as_curves); inputs x: list
# ---------- python_3: Python ----------
__author__ = "ilouh"
__version__ = "2023.02.21"

import rhinoscriptsyntax as rs
import Grasshopper as gh
import Rhino.Geometry as rg
import ghpythonlib.components as comps
import math

if bool is True:
    
    floors_as_curves = x[0:-1]
else:
    floors_as_curves = x
# ---------- end python_3 ----------

floor_thickness = Slider(0.5, range=0..1)
neg = Negative(Value=floor_thickness)
Z = UnitZ(Factor=neg)
extr = Extrude(Base=python_3, Direction=Z)
cap = CapHoles(Brep=extr)

extr_2 = Extrude(Base=srf, Direction=Z)
cap_2 = CapHoles(Brep=extr_2)

roof = ClusterOutput(cap_2)
walls_2 = ClusterOutput(walls)
floors = Brep(simplify(cap))
floors_2 = ClusterOutput(floors)
floors_as_curves_2 = ClusterOutput(python_3)
