# Grasshopper definition Massing Object - Floors Walls & Roof 0.1.0.gh (Grasshopper 1.0.8)

# ---- group: Import Mass as PolySurface
massing = Brep(simplify(graft(<brep referenced from the Rhino model>)))

# ----
omit_last_floor_slab = BooleanToggle(True)
_1st_stack_floor_height = DigitScroller(Scroller_Digits=12, Scroller_Prefix="1st Stack Floor Height", Scroller_Radix=11, Scroller_Value=12)
no_of_floors = DigitScroller(Scroller_Digits=12, Scroller_Prefix="No. Of Floors", Scroller_Radix=11, Scroller_Value=1)
_2nd_stack_floor_height = DigitScroller(Scroller_Digits=12, Scroller_Prefix="2nd Stack Floor Height", Scroller_Radix=11, Scroller_Value=0)
no_of_floors_2 = DigitScroller(Scroller_Digits=12, Scroller_Prefix="No. Of Floors", Scroller_Radix=11, Scroller_Value=0)
typical_floor_height = DigitScroller(Scroller_Digits=12, Scroller_Prefix="Typical Floor Height", Scroller_Radix=11, Scroller_Value=10)

cluster = Cluster(
    massing=massing,
    _1st_stack_floor_height=_1st_stack_floor_height,
    no_of_floors=no_of_floors,
    _2nd_stack_floor_height=_2nd_stack_floor_height,
    no_of_floors_2=no_of_floors_2,
    typical_floor_height=typical_floor_height,
    bool=omit_last_floor_slab)  # -> walls_2, simplify(graft(roof)), massing_3, floors_2, simplify(floors_as_curves_2)
brep = Brep(cluster.roof)
brep_2 = Brep(cluster.floors_2)
brep_3 = Brep(cluster.walls_2)

# ==== cluster Cluster
_1st_stack_floor_height = ClusterInput()
no_of_floors = ClusterInput()
no_of_floors_2 = ClusterInput()
typical_floor_height = ClusterInput()
_2nd_stack_floor_height = ClusterInput()
massing = ClusterInput()
massing_2 = Brep(graft(massing))
_1st_stack_floor_height_2 = Integer(_1st_stack_floor_height)
no_of_floors_3 = Integer(no_of_floors_2)
no_of_floors_4 = Integer(no_of_floors)
_2nd_stack_floor_height_2 = Integer(_2nd_stack_floor_height)
typical_floor_height_2 = Integer(typical_floor_height)
massing_3 = ClusterOutput(massing_2)

# ---- group: Calculates Building Height
bbox = BoundingBox(Content=massing_2, Plane=PlaneXY(0, 0, 0), UnionBox=True)  # -> Box, Box_2
box_corners = BoxCorners(Box=bbox.Box)  # -> CornerA, CornerB, CornerC, CornerD, CornerE, CornerF, CornerG, CornerH
dist = Distance(PointA=box_corners.CornerA, PointB=box_corners.CornerE)

# ----
pdecon = Deconstruct(Point=box_corners.CornerA)  # -> XComponent, YComponent, ZComponent

# ---- group: This Python Component Create the Contour Lines
python = GhPythonScript(
    First_Stack_Floor_Height=_1st_stack_floor_height_2,
    First_Stack_No_Floors=no_of_floors_4,
    Second_Stack_Floor_Height=_2nd_stack_floor_height_2,
    Second_Stack_No_Floors=no_of_floors_3,
    Typical_Floor_Height=typical_floor_height_2,
    Overall_Building_Height=dist,
    start_value_z=pdecon.ZComponent)  # -> simplify(Distances), simplify(intersection_Planes)
# ---------- python: Python ----------
__author__ = "Iliya Muzychuk"
__version__ = "2023.02.03"

import rhinoscriptsyntax as rs
import Grasshopper as gh
import Rhino.Geometry as rg
import ghpythonlib.components as comps
import math

#Variable Declaration

First_Stack_Floor_Height = First_Stack_Floor_Height
First_Stack_No_Floors = First_Stack_No_Floors
Second_Stack_Floor_Height = Second_Stack_Floor_Height
Second_Stack_No_Floors = Second_Stack_No_Floors
Typical_Floor_Height = Typical_Floor_Height
Overall_Building_Height = Overall_Building_Height


#Creates a list of distances for contouring. 

Distances = [0]

#Creates the list of first stack floors 

for i in range(0, int(First_Stack_No_Floors)):
    
    temp_height = (i + 1) * First_Stack_Floor_Height
    print(temp_height)
    Distances.append(temp_height)

#Appends the list the second stack floors 
for i in range(0, int(Second_Stack_No_Floors)):
    
    temp_height = Distances[-1] + Second_Stack_Floor_Height
    Distances.append(temp_height)

remaining_floors = math.floor((round(Overall_Building_Height) - Distances[-1])/Typical_Floor_Height)

for i in range(0, int(remaining_floors)):
    
    temp_height = Distances[-1] + Typical_Floor_Height
    Distances.append(temp_height)
    
#print(remaining_floors)
#print(Distances)

intersection_Planes = []

intersection_Planes = []

for i in range(0,len(Distances)): 
    
    Distances[i] = Distances[i] + start_value_z
    
for z in Distances: 
    
    point = comps.ConstructPoint(0,0,z)
    print(point)
    plane = comps.XYPlane(point)
    intersection_Planes.append(plane)
# ---------- end python ----------

# ----
xy = XYPlane(Origin=python.intersection_Planes)
mesh = MeshBrep(
    Brep=massing_2,
    Settings={GridMaxCount=0, GridMinCount=16, JaggedSeams=False, MaxEdgeLength=0, MinEdgeLength=0.0001, MinTolerance=0, Refine=True, RefineAngle=0, RelativeTolerance=0.65, SimplePlanes=True, Tolerance=0})
sec = MeshPlane(Mesh=mesh, Plane=xy)  # -> simplify(Curves)

# ---- group: Isolate Faces of Mass
debrep = DeconstructBrep(Brep=massing_2)  # -> Faces, Edges, Vertices
evalsrf = EvaluateSurface(Surface=reparameterize(debrep.Faces), Point="{0.5,0.5,0}")  # -> Point, Normal, UDirection, VDirection, Frame
distributefaces = GhPythonScript(v=evalsrf.Normal, faces=debrep.Faces)  # -> floors, facadeWalls, roof; inputs v: list, faces: list
# ---------- distributefaces: Python ----------
__author__ = "ilouh"
__version__ = "2023.01.08"

import rhinoscriptsyntax as rs
import ghpythonlib.components as comps
import Rhino.Geometry as geom

#elements = comps.DeconstructBrep(mass)
#faces = elements['faces']

#find the normal of each face


roof = []
floors = []
solidWalls = []
facadeWalls = [] 

for i in range(0,len(v)):
    
    
    values = comps.DeconstructVector(v[i])
    print(values)
    
    x_value = values['x_component']
    y_value = values['y_component']
    z_value = values['z_component']
    
    

    if z_value >= 0.4:
        
        print(i)
        roof.append(faces[i])
    
    if z_value == -1:
        
        floors.append(faces[i])
   
    if abs(z_value) != 1:
    
        facadeWalls.append(faces[i])
# ---------- end distributefaces ----------

# ----
floors_as_curves = Curve(sec)
flatten = FlattenTree(Tree=massing_2, Path="{0}")
python_2 = GhPythonScript(x=flatten)  # -> a; inputs x: list
# ---------- python_2: Python ----------
__author__ = "ilouh"
__version__ = "2023.02.21"

import rhinoscriptsyntax as rs
import Grasshopper as gh
import Rhino.Geometry as rg
import ghpythonlib.components as comps
import math

if len(x) > 1:
    a = True
else:
    a = False
# ---------- end python_2 ----------
trim = TrimTree(Tree=floors_as_curves, Depth=1)
flatten_2 = FlattenTree(Tree=floors_as_curves, Path="{0}")
filter = StreamFilter(Gate=python_2, Stream0=flatten_2, Stream1=trim)
srf = Surface(flatten(distributefaces.roof))
srf_2 = Surface(graft(distributefaces.facadeWalls))
trim_2 = TrimTree(Tree=srf_2, Depth=1)
bool = ClusterInput()
walls = Surface(simplify(trim_2))
python_3 = GhPythonScript(x=filter, bool=bool)  # -> simplify(floors_as_curves); inputs x: list
# ---------- python_3: Python ----------
__author__ = "ilouh"
__version__ = "2023.02.21"

import rhinoscriptsyntax as rs
import Grasshopper as gh
import Rhino.Geometry as rg
import ghpythonlib.components as comps
import math

if bool is True:
    
    floors_as_curves = x[0:-1]
else:
    floors_as_curves = x
# ---------- end python_3 ----------

floor_thickness = Slider(0.5, range=0..1)
neg = Negative(Value=floor_thickness)
Z = UnitZ(Factor=neg)
extr = Extrude(Base=python_3, Direction=Z)
cap = CapHoles(Brep=extr)

extr_2 = Extrude(Base=srf, Direction=Z)
cap_2 = CapHoles(Brep=extr_2)

roof = ClusterOutput(cap_2)
walls_2 = ClusterOutput(walls)
floors = Brep(simplify(cap))
floors_2 = ClusterOutput(floors)
floors_as_curves_2 = ClusterOutput(python_3)
