# Grasshopper definition Massing Studies By Object & Attributes 0.1.0.gh (Grasshopper 1.0.7)
# plug-ins: eleFront

_1st_stack_floor_height = DigitScroller(Scroller_Digits=12, Scroller_Prefix="1st Stack Floor Height", Scroller_Radix=11, Scroller_Value=6)
_2nd_stack_floor_height = DigitScroller(Scroller_Digits=12, Scroller_Prefix="2nd Stack Floor Height", Scroller_Radix=11, Scroller_Value=14)
no_of_floors = DigitScroller(Scroller_Digits=12, Scroller_Prefix="No. Of Floors", Scroller_Radix=11, Scroller_Value=0)
no_of_floors_2 = DigitScroller(Scroller_Digits=12, Scroller_Prefix="No. Of Floors", Scroller_Radix=11, Scroller_Value=1)
typical_floor_height = DigitScroller(Scroller_Digits=12, Scroller_Prefix="Typical Floor Height", Scroller_Radix=11, Scroller_Value=4)
omit_last_floor_slab = BooleanToggle(False)

geometry = Geometry(graft(<brep referenced from the Rhino model>))
python = GhPythonScript(
    massing=geometry,
    First_Stack_Floor_Height=_1st_stack_floor_height,
    First_Stack_No_Floors=no_of_floors_2,
    Second_Stack_Floor_Height=_2nd_stack_floor_height,
    Second_Stack_No_Floors=no_of_floors,
    Typical_Floor_Height=typical_floor_height)  # -> simplify(Distances); inputs massing: GeometryBase
# ---------- python: Python ----------
__author__ = "Iliya Muzychuk"
__version__ = "2023.02.03"

import rhinoscriptsyntax as rs
import Grasshopper as gh
import Rhino.Geometry as rg
import ghpythonlib.components as comps
import math

def bboxHeight(massing):
    
    box_corners_list = comps.BoxCorners(comps.BoundingBox(massing,comps.XYPlane(comps.ConstructPoint(0,0,0)))[0])
    boxHeight = comps.Distance(box_corners_list[0],box_corners_list[4])
    
    return boxHeight,box_corners_list[0]
#Variable Declaration

First_Stack_Floor_Height = First_Stack_Floor_Height
First_Stack_No_Floors = First_Stack_No_Floors
Second_Stack_Floor_Height = Second_Stack_Floor_Height
Second_Stack_No_Floors = Second_Stack_No_Floors
Typical_Floor_Height = Typical_Floor_Height
Overall_Building_Height = bboxHeight(massing)[0]
start_value_z = bboxHeight(massing)[1]

#Creates a list of distances for contouring. 

Distances = [0]

#Creates the list of first stack floors 

for i in range(0, int(First_Stack_No_Floors)):
    
    temp_height = (i + 1) * First_Stack_Floor_Height
    print(temp_height)
    Distances.append(temp_height)

#Appends the list the second stack floors 
for i in range(0, int(Second_Stack_No_Floors)):
    
    temp_height = Distances[-1] + Second_Stack_Floor_Height
    Distances.append(temp_height)

remaining_floors = math.floor((round(Overall_Building_Height) - Distances[-1])/Typical_Floor_Height)

for i in range(0, int(remaining_floors)):
    
    temp_height = Distances[-1] + Typical_Floor_Height
    Distances.append(temp_height)
    
#print(remaining_floors)
#print(Distances)


for i in range(0,len(Distances)-1): 
    
    Distances[i] = Distances[i+1] - Distances[i]

Distances.pop()
# ---------- end python ----------
geometry_2 = Geometry([<brep referenced from the Rhino model> x23, <subd referenced from the Rhino model> x3, <brep referenced from the Rhino model>, <extrusion referenced from the Rhino model>, <brep referenced from the Rhino model> x11, <extrusion referenced from the Rhino model>, <brep referenced from the Rhino model>, <extrusion referenced from the Rhino model> x4, <brep referenced from the Rhino model>, <extrusion referenced from the Rhino model>, <brep referenced from the Rhino model>, <extrusion referenced from the Rhino model> x4, <brep referenced from the Rhino model> x19, <extrusion referenced from the Rhino model>, <brep referenced from the Rhino model>])
detach_attributes = DetachAttributes(Geometry=geometry_2)  # -> Geometry, Attributes
contour_ex = ContourEx(Shape=geometry, Plane=PlaneXY(0, 0, 0), Distances=python)
elefront_attributes = EleFrontAttributes(Attributes=detach_attributes.Attributes)  # -> Attributes, Keys, Values, Name, Layer, ColourSource, DisplayColour, MaterialSource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
# Python script to read associate layers and paths of referenced geometry.
ghpython_script = GhPythonScript(id=geometry)  # -> out, simplify(graft(fullPath)), parent; inputs id: Guid
# ---------- ghpython_script: Python ----------
import Rhino
import scriptcontext as sc

sc.doc = Rhino.RhinoDoc.ActiveDoc

obj = sc.doc.Objects.Find(id)
layerIndex = obj.Attributes.LayerIndex
layer = sc.doc.Layers.FindId(sc.doc.Layers[layerIndex].Id)


fullPath = layer.FullPath
parent = fullPath.split("::")[0]

sc.doc = ghdoc
# ---------- end ghpython_script ----------
massing = Brep(simplify(graft(geometry)))

text_distance = TextDistance(TextA=elefront_attributes.Keys, TextB="00_plot_number", Case=True)
equality = Equality(FirstNumber=text_distance, SecondNumber=0)  # -> Equality, Inequality
cull_pattern = CullPattern(List=elefront_attributes.Values, CullPattern=equality.Equality)

text_distance_2 = TextDistance(TextA=elefront_attributes.Keys, TextB="01_building_number", Case=True)
equality_2 = Equality(FirstNumber=text_distance_2, SecondNumber=0)  # -> Equality, Inequality
cull_pattern_2 = CullPattern(List=elefront_attributes.Values, CullPattern=equality_2.Equality)

join_curves = JoinCurves(Curves=simplify(contour_ex), Preserve=False)

# ----
# Cluster includes python scripts to create general building elements
massing_calcs = MassingCalcs(
    massing=massing,
    first_stack_floor_height=_1st_stack_floor_height,
    first_stack_no_floors=no_of_floors_2,
    second_stack_floor_height=_2nd_stack_floor_height,
    second_stack_no_floors=no_of_floors,
    typical_floor_height=typical_floor_height,
    bool=omit_last_floor_slab)  # -> massing_height, massing_3, number_of_floors, roof, walls, floors_as_curves, floors_as_surfaces
curve = Curve(massing_calcs.floors_as_curves)
brep = Brep(massing_calcs.floors_as_surfaces)
area = Area(Geometry=brep)  # -> Area, Centroid
mass_addition = MassAddition(Input=area.Area)  # -> Result, PartialResults

massing_calcs_2 = MassingCalcs2(
    massing=massing,
    first_stack_floor_height=_1st_stack_floor_height,
    first_stack_no_floors=no_of_floors_2,
    second_stack_floor_height=_2nd_stack_floor_height,
    second_stack_no_floors=no_of_floors,
    typical_floor_height=typical_floor_height,
    bool=omit_last_floor_slab)  # -> massing_height, massing_3, number_of_floors, roof, walls, floors_as_curves, floors_as_surfaces
brep_2 = Brep(massing_calcs_2.floors_as_surfaces)
area_2 = Area(Geometry=brep_2)  # -> Area, Centroid
mass_addition_2 = MassAddition(Input=area_2.Area)  # -> Result, PartialResults

# ----
# Python Script to create data and pro forma calculations
geometry_3 = Geometry(geometry)
detach_attributes_2 = DetachAttributes(Geometry=geometry_3)  # -> Geometry, Attributes
pro_forma = GhPythonScript(
    floor_surfaces=simplify(brep),
    program_name=simplify(ghpython_script.fullPath),
    areas=simplify(area.Area),
    massing_height=massing_calcs.massing_height,
    typical_story=typical_floor_height,
    number_of_floors=massing_calcs.number_of_floors,
    plot_number=cull_pattern,
    building_number=cull_pattern_2)  # -> values, simplify(dic_keys), simplify(dic_values), total_net_area, units; inputs floor_surfaces: list of Surface, areas: list
# ---------- pro_forma: Python ----------
__author__ = "ilouh"
__version__ = "2023.02.21"

import rhinoscriptsyntax as rs
import Grasshopper as gh
import Rhino.Geometry as rg
import ghpythonlib.components as comps
import math

#sum a list of numbers
def sum(numbers):
    total = 0
    for n in numbers:
        total += n
    return total

def convertString(input_string):
    # Split the string by '/' and take the last part
    parts = input_string.split('::')
    result = parts[-1]
    result = result.lstrip('0123456789_*')
    result = result.lower()
    result = result.capitalize()
    
    return result

def float_to_percentage(number):
    percentage = number * 100
    formatted_percentage = "{:.2f}%".format(percentage)
    return formatted_percentage

def format_to_sf_area(value):
    if isinstance(value, (int, float)):
        formatted_value = "{:,.2f} SF".format(value)
    else:
        raise TypeError("Unsupported value type. Only int and float are supported.")
    
    return formatted_value

def totalArea(floor_curves):
    
    areas = []
    
    for floor in floor_curves:
        
        area = comps.Area(floor)['area']
        areas.append(area)
    
    return areas
#_______________________________________________________________________________________
# Calculations

areas = list(filter(lambda item: item is not None, areas))
   
total_area = sum(areas) 



# Create a dictionary to store the calculated values
data_dict = {
    '00_plot_number': plot_number,
    '01_building_number': building_number,
    '02_program_name' : convertString(program_name),
    '03_total_gross_area': round(total_area,2),
    '04_massing_height' : massing_height,
    '05_no_stories' : number_of_floors
    
}

# Create a list of keys to iterate through
keys_list = [

    '00_plot_number',
    '01_building_number',
    '02_program_name',
    '03_total_gross_area',
    '04_massing_height',
    '05_no_stories',

]


# Iterate through the keys_list and retrieve corresponding values from the data_dict
values = []
for item in keys_list:
    values.append(item + ': ' + str(data_dict[item]))

# Print the values    
dic_keys = keys_list
dic_values = []

for key in keys_list: 
    
    dic_values.append(data_dict[key])


else: 
    pass
# ---------- end pro_forma ----------
elefront_attributes_2 = EleFrontAttributes(Attributes=detach_attributes_2.Attributes)  # -> Attributes, Keys, Values, Name, Layer, ColourSource, DisplayColour, MaterialSource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
elefront_attributes_3 = EleFrontAttributes(Keys=pro_forma.dic_keys, Values=pro_forma.dic_values, Layer=elefront_attributes_2.Layer)  # -> Attributes, Keys, Values, Name, Layer, ColourSource, DisplayColour, MaterialSource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
modify_rhino_object_attributes = ModifyRhinoObjectAttributes(ReferencedObject=geometry_3, Attributes=elefront_attributes_3.Attributes, Activate=False)

# ==== cluster MassingCalcs
first_stack_floor_height = ClusterInput()
first_stack_no_floors = ClusterInput()
second_stack_no_floors = ClusterInput()
typical_floor_height = ClusterInput()
second_stack_floor_height = ClusterInput()
massing = ClusterInput()
massing_2 = Brep(graft(massing))

# ---- group: This Python Component Create the Contour Lines
python = GhPythonScript(
    massing=massing_2,
    First_Stack_Floor_Height=first_stack_floor_height,
    First_Stack_No_Floors=first_stack_no_floors,
    Second_Stack_Floor_Height=second_stack_floor_height,
    Second_Stack_No_Floors=second_stack_no_floors,
    Typical_Floor_Height=typical_floor_height)  # -> simplify(Distances), floor_as_curves; inputs massing: GeometryBase
# ---------- python: Python ----------
__author__ = "Iliya Muzychuk"
__version__ = "2023.02.03"

import rhinoscriptsyntax as rs
import Grasshopper as gh
import Rhino.Geometry as rg
import ghpythonlib.components as comps
import math

def bboxHeight(massing):
    
    box_corners_list = comps.BoxCorners(comps.BoundingBox(massing,comps.XYPlane(comps.ConstructPoint(0,0,0)))[0])
    boxHeight = comps.Distance(box_corners_list[0],box_corners_list[4])
    
    return boxHeight,box_corners_list[0]
#Variable Declaration

First_Stack_Floor_Height = First_Stack_Floor_Height
First_Stack_No_Floors = First_Stack_No_Floors
Second_Stack_Floor_Height = Second_Stack_Floor_Height
Second_Stack_No_Floors = Second_Stack_No_Floors
Typical_Floor_Height = Typical_Floor_Height
Overall_Building_Height = bboxHeight(massing)[0]
start_value_z = bboxHeight(massing)[1]

#Creates a list of distances for contouring. 

Distances = [0]

#Creates the list of first stack floors 

for i in range(0, int(First_Stack_No_Floors)):
    
    temp_height = (i + 1) * First_Stack_Floor_Height
    print(temp_height)
    Distances.append(temp_height)

#Appends the list the second stack floors 
for i in range(0, int(Second_Stack_No_Floors)):
    
    temp_height = Distances[-1] + Second_Stack_Floor_Height
    Distances.append(temp_height)

remaining_floors = math.floor((round(Overall_Building_Height) - Distances[-1])/Typical_Floor_Height)

for i in range(0, int(remaining_floors)):
    
    temp_height = Distances[-1] + Typical_Floor_Height
    Distances.append(temp_height)
    
#print(remaining_floors)
#print(Distances)

intersection_Planes = []

intersection_Planes = []

for i in range(0,len(Distances)): 
    
    Distances[i] = Distances[i] + start_value_z[2]
    
for z in Distances: 
    
    point = comps.ConstructPoint(0,0,abs(z))
    plane = comps.XYPlane(point)
    intersection_Planes.append(plane)
 

floor_as_curves = comps.MeshXPlane(massing,intersection_Planes)
# ---------- end python ----------

# ----
bbox = BoundingBox(Content=massing_2, Plane=PlaneXY(0, 0, 0))  # -> Box, Box_2
debrep = DeconstructBrep(Brep=massing_2)  # -> Faces, Edges, Vertices
python_2 = GhPythonScript(
    massing=bbox.Box,
    First_Stack_Floor_Height=first_stack_floor_height,
    First_Stack_No_Floors=first_stack_no_floors,
    Second_Stack_Floor_Height=second_stack_floor_height,
    Second_Stack_No_Floors=second_stack_no_floors,
    Typical_Floor_Height=typical_floor_height)  # -> simplify(Distances), floor_as_curves; inputs massing: GeometryBase; same code as python
area = Area(Geometry=debrep.Faces)  # -> Area, Centroid
abs = Absolute(Value=python.Distances)
distributefaces = GhPythonScript(Massing=simplify(massing_2))  # -> floor, walls, roof, massing_height; inputs Massing: list
# ---------- distributefaces: Python ----------
__author__ = "ilouh"
__version__ = "2023.01.08"

import rhinoscriptsyntax as rs
import ghpythonlib.components as comps
import Rhino.Geometry as geom

def getSrfElevation(surface):
    
    centerPoint = comps.EvaluateSurface(surface,comps.ConstructPoint(0.5,0.5,0))['point']
    elevation = centerPoint[2]
    
    return elevation

roof = []
floor = []
walls = [] 

roof_elevations = []
floor_elevations = []

#find the normal of each face

faces = comps.DeconstructBrep(Massing)['faces']
evaluation_point = comps.ConstructPoint(x_coordinate = 0.5, y_coordinate = 0.5, z_coordinate = 0)

for face in faces: 
    
    vector = comps.EvaluateSurface(face,evaluation_point)['normal']
    
    
    vector_a = comps.VectorXYZ(x_component = vector[0], y_component = vector[1], z_component = vector[2])['vector']
    vector_b = comps.UnitZ(1)

    cross_product = comps.CrossProduct(vector_a,vector_b,True)['vector']
    dot_product = round(comps.DotProduct(vector_a,vector_b,True),4)
    
    print(dot_product)
    
    if abs(dot_product) == 0: 
        walls.append(face)
    
    if dot_product > 0: 
        roof.append(face)
        roof_elevations.append(getSrfElevation(face))
        
        
    if dot_product == -1: 
        floor.append(face)
        floor_elevations.append(getSrfElevation(face))

#sort surface elevations

lowest_floor_elevation = floor_elevations.sort()
lowest_roof_elevation = roof_elevations.sort()

#select lowest floor and heights roof elevations

lowest_floor_elevation = floor_elevations[0]
lowest_roof_elevation = roof_elevations[-1]

#calculates massing height

massing_height = round(lowest_roof_elevation - lowest_floor_elevation,2)
# ---------- end distributefaces ----------
script = Script()  # -> out, a
# ---------- script: Python ----------
floor_as_surfaces = [] 

for floor_boundary in floor_as_curves:
    
    print(floor_boundary)
    if comps.Closed(floor_boundary)['closed']:
        floor_plate = comps.BoundarySurfaces(floor_boundary)
        
    else:
        
        start_pt = comps.EndPoints(floor_boundary)['start']
        end_pt = comps.EndPoints(floor_boundary)['end']
        
        line = comps.Line(start_pt,end_pt)
        
        closed_floor_boundary = comps.JoinCurves([floor_boundary,line],True)
        floor_plate = comps.BoundarySurfaces(closed_floor_boundary)
# ---------- end script ----------
pdecon = Deconstruct(Point=area.Centroid)  # -> XComponent, YComponent, ZComponent

floor_thickness = Slider(0.5, range=0..1)
neg = Negative(Value=floor_thickness)
Z = UnitZ(Factor=neg)

sort = SortList(Keys=pdecon.ZComponent)  # -> Keys, ValuesA
list_length = ListLength(List=python_2.floor_as_curves)
srf = Surface(flatten(distributefaces.roof))
item = ListItem(List=sort.Keys, Index=0, Wrap=True)  # -> Item1, Item
subtraction = Subtraction(A=item.Item1, B=item.Item)  # -> simplify(Result)
bool = ClusterInput()

extr = Extrude(Base=srf, Direction=Z)
cap = CapHoles(Brep=extr)

python_3 = GhPythonScript(floor_as_curves=python.floor_as_curves, bool=bool, thickenss="0.5")  # -> simplify(floors_as_curves), floors_as_plates; inputs floor_as_curves: list of Curve
# ---------- python_3: Python ----------
__author__ = "ilouh"
__version__ = "2023.02.21"

import rhinoscriptsyntax as rs
import Grasshopper as gh
import Rhino.Geometry as rg
import ghpythonlib.components as comps
import math

def extrudeCurve(curves,thickenss):
    
    floor_plates = []
    
    for curve in curves:
        surface = comps.BoundarySurfaces(curve)
        floor_plates.append(surface)
        
        print(floor_plates)
    
    return floor_plates

if bool is True:
    
    floors_as_curves = floor_as_curves[0:-1]
    floors_as_plates = extrudeCurve(floors_as_curves,thickenss)
    
else:
    floors_as_curves = floor_as_curves
    floors_as_plates = extrudeCurve(floors_as_curves,thickenss)
# ---------- end python_3 ----------
cluster = Cluster(C=python.floor_as_curves, G=bool)  # -> floors_as_curves, floors_as_plates
massing_3 = ClusterOutput(massing_2)
roof = ClusterOutput(cap)
walls = ClusterOutput(distributefaces.walls)
floors_as_curves = ClusterOutput(python_3.floors_as_curves)
floors_as_surfaces = ClusterOutput(cluster.floors_as_plates)
massing_height = ClusterOutput(subtraction)
number_of_floors = ClusterOutput(list_length)

# ==== cluster MassingCalcs2
first_stack_floor_height = ClusterInput()
first_stack_no_floors = ClusterInput()
second_stack_no_floors = ClusterInput()
typical_floor_height = ClusterInput()
second_stack_floor_height = ClusterInput()
massing = ClusterInput()
massing_2 = Brep(graft(massing))

# ---- group: This Python Component Create the Contour Lines
python = GhPythonScript(
    massing=massing_2,
    First_Stack_Floor_Height=first_stack_floor_height,
    First_Stack_No_Floors=first_stack_no_floors,
    Second_Stack_Floor_Height=second_stack_floor_height,
    Second_Stack_No_Floors=second_stack_no_floors,
    Typical_Floor_Height=typical_floor_height)  # -> simplify(Distances), floor_as_curves; inputs massing: GeometryBase; same code as python

# ----
bbox = BoundingBox(Content=massing_2, Plane=PlaneXY(0, 0, 0))  # -> Box, Box_2
debrep = DeconstructBrep(Brep=massing_2)  # -> Faces, Edges, Vertices
python_2 = GhPythonScript(
    massing=bbox.Box,
    First_Stack_Floor_Height=first_stack_floor_height,
    First_Stack_No_Floors=first_stack_no_floors,
    Second_Stack_Floor_Height=second_stack_floor_height,
    Second_Stack_No_Floors=second_stack_no_floors,
    Typical_Floor_Height=typical_floor_height)  # -> simplify(Distances), floor_as_curves; inputs massing: GeometryBase; same code as python
area = Area(Geometry=debrep.Faces)  # -> Area, Centroid
abs = Absolute(Value=python.Distances)
distributefaces = GhPythonScript(Massing=simplify(massing_2))  # -> floor, walls, roof, massing_height; inputs Massing: list; same code as distributefaces
script = Script()  # -> out, a; same code as script
pdecon = Deconstruct(Point=area.Centroid)  # -> XComponent, YComponent, ZComponent

floor_thickness = Slider(0.5, range=0..1)
neg = Negative(Value=floor_thickness)
Z = UnitZ(Factor=neg)

sort = SortList(Keys=pdecon.ZComponent)  # -> Keys, ValuesA
list_length = ListLength(List=python_2.floor_as_curves)
srf = Surface(flatten(distributefaces.roof))
item = ListItem(List=sort.Keys, Index=0, Wrap=True)  # -> Item1, Item
subtraction = Subtraction(A=item.Item1, B=item.Item)  # -> simplify(Result)
bool = ClusterInput()

extr = Extrude(Base=srf, Direction=Z)
cap = CapHoles(Brep=extr)

python_3 = GhPythonScript(floor_as_curves=python.floor_as_curves, bool=bool, thickenss="0.5")  # -> simplify(floors_as_curves), floors_as_plates; inputs floor_as_curves: list of Curve
# ---------- python_3: Python ----------
__author__ = "ilouh"
__version__ = "2023.02.21"

import rhinoscriptsyntax as rs
import Grasshopper as gh
import Rhino.Geometry as rg
import ghpythonlib.components as comps
import math

def extrudeCurve(curves,thickenss):
    
    floor_plates = []
    
    for curve in curves:
        extrusion = comps.Extrude(curve,comps.UnitZ(-thickenss))
        extrusion = comps.CapHoles(extrusion)
        floor_plates.append(extrusion)
        
        print(floor_plates)
    
    return floor_plates

if bool is True:
    
    floors_as_curves = floor_as_curves[0:-1]
    #floors_as_plates = extrudeCurve(floors_as_curves,thickenss)
    
else:
    floors_as_curves = floor_as_curves
    #floors_as_plates = extrudeCurve(floors_as_curves,thickenss)
# ---------- end python_3 ----------
cluster = Cluster(C=python.floor_as_curves, G=bool)  # -> floors_as_curves, floors_as_plates
massing_3 = ClusterOutput(massing_2)
roof = ClusterOutput(cap)
walls = ClusterOutput(distributefaces.walls)
floors_as_curves = ClusterOutput(cluster.floors_as_curves)
floors_as_surfaces = ClusterOutput(cluster.floors_as_plates)
massing_height = ClusterOutput(subtraction)
number_of_floors = ClusterOutput(list_length)

# ==== cluster Cluster
C = ClusterInput()
G = ClusterInput()
join = JoinCurves(Curves=C, Preserve=False)
simplify = SimplifyCurve(Curve=join)  # -> Curve, Simplified
cls = Closed(Curve=simplify.Curve)  # -> Closed, Periodic
clscrv = CloseCurve(Curve=simplify.Curve, CloseType=0, Bulge=0.5, Tolerance=0)  # -> Closed, R; disabled
dispatch = Dispatch(List=simplify.Curve, DispatchPattern=cls.Closed)  # -> ListA, ListB
planar = Planar(Curve=dispatch.ListA)  # -> Planar, Plane, Deviation
dispatch_2 = Dispatch(List=dispatch.ListA, DispatchPattern=planar.Planar)  # -> ListA, ListB
data = Data(dispatch_2.ListA)
area = Area(Geometry=data)  # -> Area, Centroid
pdecon = Deconstruct(Point=area.Centroid)  # -> XComponent, YComponent, ZComponent
sort = SortList(Keys=pdecon.ZComponent, ValuesA=data)  # -> Keys, ValuesA
item = ListItem(List=reverse(sort.Keys), Index=0, Wrap=True)
equals = Equality(FirstNumber=sort.Keys, SecondNumber=item)  # -> Equality, Inequality
dispatch_3 = Dispatch(List=sort.ValuesA, DispatchPattern=equals.Inequality)  # -> ListA, ListB
data_2 = Data(dispatch_3.ListA)
filter = StreamFilter(Gate=G, Stream0=dispatch_2.ListA, Stream1=data_2)
data_3 = Data(filter)
area_2 = Area(Geometry=data_3)  # -> Area, Centroid
pdecon_2 = Deconstruct(Point=area_2.Centroid)  # -> XComponent, YComponent, ZComponent
sort_2 = SortList(Keys=pdecon_2.ZComponent, ValuesA=data_3)  # -> Keys, ValuesA
sort_val = SortDuplicateValues(ValueList=sort_2.Keys)  # -> UniqueValues, Indices
shfdep = ShiftToDepth(Tree=sort_val.Indices, Depth="1", shiftFromStart=False)
item_2 = ListItem(List=sort_2.ValuesA, Index=shfdep, Wrap=True)  # -> simplify(Item)
boundary = BoundarySurfaces(Edges=item_2)
floors_as_plates = ClusterOutput(boundary)
floors_as_curves = ClusterOutput(item_2)
