# Grasshopper definition Massing Town Homes 0.1.1.gh (Grasshopper 1.0.7)
# plug-ins: eleFront

curve = Curve(reparameterize(graft(<curve referenced from the Rhino model>)))
pitched_roof = GhPythonScript(Footprint=curve, height=Slider(10, range=0..10), building_height=Slider(30, range=0..100))  # -> pitched_roof_profiles, walls; inputs Footprint: Curve
# ---------- pitched_roof: Python ----------
__author__ = "ilouh"
__version__ = "2023.02.21"

import rhinoscriptsyntax as rs
import Grasshopper as gh
import Rhino.Geometry as rg
import ghpythonlib.components as comps
import math

#creates a function to find shortest lines in a curve footprint

def find_shortest_lines(closed_footprint):
    
    lines = comps.Explode(closed_footprint,False)['segments']
    
    len = [] 
    for line in lines:
        
        len.append(comps.Length(line))

    zipped_list = zip(len,lines)
    zipped_list.sort()

    shortest_lines = [zipped_list[0][1],zipped_list[1][1]]
    shortest_lines[1] = comps.FlipCurve(shortest_lines[1])['curve']
    return shortest_lines

def create_gabled_pitch(line,height):
    
    start_point = comps.EndPoints(line)['start']
    end_point = comps.EndPoints(line)['end']
    

    mid_point = comps.CurveMiddle(line)
    
    pitch_point = comps.Move(mid_point,comps.UnitZ(height))['geometry']
    
    pitch_profile = comps.PolyLine([start_point,pitch_point,end_point],True)
    
    return pitch_profile
    
shortest_lines = find_shortest_lines(Footprint)

def create_walls(footprint,height):
    
    walls = comps.Extrude(footprint,comps.UnitZ(height))
    walls = comps.CapHoles(walls)
    
    
    return walls


if __name__ == '__main__':
    
    walls = create_walls(Footprint,(building_height - height))
    
    pitched_roof_profiles = []
    
    for line in shortest_lines:
        gable_profile = create_gabled_pitch(line,height)
        gable_profile = comps.Move(gable_profile,comps.UnitZ((building_height - height)))['geometry']
        pitched_roof_profiles.append(gable_profile)
# ---------- end pitched_roof ----------

# ---- group: WIP
make2d = GhPythonScript(geometry=pitched_roof.walls, view="V001")  # -> visible_curves; inputs geometry: GeometryBase
# ---------- make2d: Python ----------
__author__ = "ilouh"
__version__ = "2023.02.21"

import rhinoscriptsyntax as rs
import Grasshopper as gh
import Rhino.Geometry as rg
import ghpythonlib.components as comps
import math

geometry = geometry
#clipping_plane = clipping_plane
view = view

visible_curves = comps.Make2D(geometry,view,tangent_seams = True, tangent_edges = False)['visible_curves']
print(visible_curves)
# ---------- end make2d ----------
curve_2 = Curve(make2d)

# ----
curve_3 = Curve(pitched_roof.pitched_roof_profiles)
loft = Loft(Curves=curve_3, Options={Adjust=False, Closed=False, LoftEnds=0, LoftSimp=0, LoftType=0, Rebuild=10, Refit=0.01})
cap_holes = CapHoles(Brep=loft)
massing = Brep(graft(pitched_roof.walls))
merge = Merge(Data1=cap_holes, Data2=massing)
distributefaces = GhPythonScript(Massing=simplify(massing))  # -> floor, walls, roof; inputs Massing: list
# ---------- distributefaces: Python ----------
__author__ = "ilouh"
__version__ = "2023.01.08"

import rhinoscriptsyntax as rs
import ghpythonlib.components as comps
import Rhino.Geometry as geom


roof = []
floor = []
walls = [] 

#find the normal of each face

faces = comps.DeconstructBrep(Massing)['faces']
evaluation_point = comps.ConstructPoint(x_coordinate = 0.5, y_coordinate = 0.5, z_coordinate = 0)

for face in faces: 
    
    vector = comps.EvaluateSurface(face,evaluation_point)['normal']
    
    
    vector_a = comps.VectorXYZ(x_component = vector[0], y_component = vector[1], z_component = vector[2])['vector']
    vector_b = comps.UnitZ(1)

    cross_product = comps.CrossProduct(vector_a,vector_b,True)['vector']
    dot_product = round(comps.DotProduct(vector_a,vector_b,True),4)
    
    print(dot_product)
    
    if abs(dot_product) == 0: 
        walls.append(face)
    
    if dot_product > 0: 
        roof.append(face)
    
    if dot_product == -1: 
        floor.append(face)
# ---------- end distributefaces ----------
brep = Brep(merge)
surface = Surface(distributefaces.floor)
surface_2 = Surface(distributefaces.walls)
surface_3 = Surface(distributefaces.roof)
surface_4 = Surface(reparameterize(surface_2))
surface_5 = Surface()
pattern_hatch = PatternHatch(Boundaries=surface_4, Pattern=1, Scale=Slider(12, range=0..20), Angle=degrees(90))
pattern_hatch_2 = PatternHatch(Boundaries=surface_5, Pattern=1, Scale=4, Angle=degrees(90))
get_horizontal_isocurve = GhPythonScript(surface=surface_4, sill=Slider(1, range=0..10))  # -> out; inputs surface: Surface
# ---------- get_horizontal_isocurve: Python ----------
__author__ = "ilouh"
__version__ = "2023.02.21"

import rhinoscriptsyntax as rs
import Grasshopper as gh
import Rhino.Geometry as rg
import ghpythonlib.components as comps
import math

#declare 
srf = surface

#get surface isocurves
pt_01 = comps.ConstructPoint(0.0,0.0,0)
pt_02 = comps.ConstructPoint(0.0,1.0,0)
pt_03 = comps.ConstructPoint(1.0,0.0,0)
pt_04 = comps.ConstructPoint(1.0,1.0,0)

points_test = [pt_01,pt_02,pt_03,pt_04] 

def horizontal_isocurve(srf,pt):
    
    curves = comps.IsoCurve(srf,pt)
    
    for curve in curves: 
        
        end_points = comps.EndPoints(curve)
        vector = comps.Vector2Pt(end_points['start'],end_points['end'],True)
        
        vector = vector['vector']
        
        values = comps.DeconstructVector(vector)
        z_value = values['z_component']
        
        if abs(round(z_value,0)) == 0: 
            
            horionztal_curve = curve
            
    return horionztal_curve

def mid_z(curve):
    
    middle = comps.EvaluateCurve(curve,0.5)
    middle = middle['point']
    
    z_value = comps.Deconstruct(middle)
    z_value = z_value['z_component']
    
    return z_value

horizontal_curves = [] 
z_values = []

for point in points_test: 
    
    crv = horizontal_isocurve(srf,point)
    mid = mid_z(crv)
    
    horizontal_curves.append(crv)
    z_values.append(mid)

    

temp_list = zip(z_values,horizontal_curves)
temp_list.sort()

print(temp_list[0][1])

horizontal_sill_curve = temp_list[0][1]

vector = comps.UnitZ(sill)
window_curve = comps.Move(horizontal_sill_curve,vector)
print(window_curve)
out = window_curve['geometry']
# ---------- end get_horizontal_isocurve ----------
curve_4 = Curve(get_horizontal_isocurve)
number_slider = Slider(8, range=0..10)
number_slider_2 = Slider(2, range=0..10)
window_from_sill_point = GhPythonScript(sill_curve=curve_4, height=number_slider, width=number_slider_2, num_windows=Slider(4, range=0..10))  # -> windows, window_planes; inputs sill_curve: Curve
# ---------- window_from_sill_point: Python ----------
__author__ = "ilouh"
__version__ = "2023.02.21"

import rhinoscriptsyntax as rs
import Grasshopper as gh
import Rhino.Geometry as rg
import ghpythonlib.components as comps
import math

sill_curve = sill_curve
sill_points = comps.DivideCurve(sill_curve,num_windows,kinks = False)['points']
sill_tangents = comps.DivideCurve(sill_curve,num_windows,kinks = False)['tangents']

evaluate_curve_planes = comps.CurveFrame(sill_curve,sill_tangents)
window_planes = evaluate_curve_planes[1:-1]

window_height = height
window_width = width

#declare 
windows = []

for i in range(1,len(sill_points)-1):
    
    sill_point = sill_points[i]
    sill_frame = evaluate_curve_planes[i]
    
    plane_vectors = comps.DeconstructPlane(sill_frame)
    
    x_axis = plane_vectors['x-axis']
    y_axis = plane_vectors['y-axis']

    
    
    pt_01 = comps.Move(sill_point,comps.Amplitude(x_axis,width/2))['geometry']
    pt_02 = comps.Move(sill_point,comps.Amplitude(x_axis,-width/2))['geometry']
    
    pt_03 = comps.Move(pt_01,comps.UnitZ(height))['geometry']
    pt_04 = comps.Move(pt_02,comps.UnitZ(height))['geometry']

    
    
    pt_list = [pt_01,pt_02,pt_04,pt_03]
    
    for pt in pt_list:
        print(pt)
        
    window_outline = comps.PolyLine(pt_list,True)

    windows.append(window_outline)
# ---------- end window_from_sill_point ----------
curve_5 = Curve(window_from_sill_point.windows)
evaluate_surface = EvaluateSurface(Surface=reparameterize(curve_5), Point="{0.5,0.0,0}")  # -> Point, Normal, UDirection, VDirection, Frame
expression = Expression(height=number_slider, Expression="height / 8")
expression_2 = Expression(width=number_slider_2, Expression="width / 3")
insert_block = InsertBlock(BlockName="Casement Window", Plane=evaluate_surface.Frame)
scale_nu = ScaleNU(Geometry=insert_block, Plane=evaluate_surface.Frame, ScaleX=expression_2, ScaleY=expression, ScaleZ=1)  # -> Geometry, Transform
