# Grasshopper definition Random City 0.1.0.gh (Grasshopper 1.0.8)

srf = Surface([<surface referenced from the Rhino model> x42])
area = Area(Geometry=srf)  # -> Area, Centroid
lng = ListLength(List=srf)
scale = Scale(Geometry=srf, Center=area.Centroid, Factor=Slider(0.84, range=0..1))  # -> Geometry, Transform
series = Series(Start=0, Step=1, Count=lng)
dom = ConstructDomain(DomainStart=Slider(2, range=0..10), DomainEnd=Slider(12, range=0..100))
random = Random(Range=dom, Number=1, Seed=series, Integers=True)
expression = Expression(x=random, Expression="x*10")
Z = UnitZ(Factor=expression)
extr = Extrude(Base=graft(scale.Geometry), Direction=Z)
merge = Merge(Data1=simplify(graft(srf)), Data2=simplify(extr))
group = Group(Geometry=merge)
