# Grasshopper definition Program_Parking 0.1.1.gh (Grasshopper 1.0.7)
# plug-ins: ParkingSolver, EleFront

typical_stall_length = Slider(18, range=0..100)  # disabled
typical_stall_width = Slider(9, range=0..10)  # disabled
desired_aisle_width = Slider(28, range=0..100)  # disabled
visualize_layout = BooleanToggle(True)  # disabled
access_aisle_width = Slider(28, range=0..100)  # disabled
axial_width = Slider(28, range=0..100)  # disabled
side_out = Slider(0, range=0..9)  # disabled
reference_edge = Slider(0, range=0..9)  # disabled
skirt = Slider(0.5, range=0..1)  # disabled
number_slider = Slider(2, range=0..9)  # disabled
axial_width_2 = Slider(28, range=0..100)  # disabled
island_radius = Slider(1, range=0..100)  # disabled
edges_cull = Slider(0, range=0..9)  # disabled
pedestrain_access_point = Point(Point(404.4373665, 266, 0))  # disabled
pedestrain_access_width = Slider(10, range=0..100)  # disabled
panel = Panel("5")  # disabled
panel_2 = Panel("10")  # disabled
point = Point(<point referenced from the Rhino model>)  # disabled

plot_parking_area_curve = Curve(<curve referenced from the Rhino model>)  # disabled
main_access_point = Point(point)  # disabled

normal_spot = NormalSpot(
    Angle=90,
    Stack=False,
    Length=typical_stall_length,
    Width=typical_stall_width,
    RoadWidth=desired_aisle_width,
    CountText5baba97a_1282_4edf_b8b2_e9454d95afd9=0,
    lastIndex5baba97a_1282_4edf_b8b2_e9454d95afd9=0)  # disabled
normal_spot_2 = NormalSpot(
    Length=typical_stall_length,
    Width=typical_stall_width,
    RoadWidth=desired_aisle_width,
    CountText1d2e8e4c_0566_4b95_9df8_6846a18eef92=0,
    lastIndex1d2e8e4c_0566_4b95_9df8_6846a18eef92=0)  # disabled
roads_settings = RoadsSettings(
    SideOut=side_out,
    EdgesCull=edges_cull,
    ReferenceEdge=reference_edge,
    Skirt=skirt,
    AccessWidth=access_aisle_width,
    AxialWidth=axial_width_2,
    PerimetralSettings=number_slider,
    SnapAccess=1,
    IslandRadius=island_radius)  # disabled
pedestrain_settings = PedestrainSettings(Access=pedestrain_access_point, AccessWidth=pedestrain_access_width, CircWidth=0.8, Style=0)  # disabled
normal_spot_3 = NormalSpot(Amount=panel, CountText1886b621_c52e_48d7_9a89_db1ba3845917=0, lastIndex1886b621_c52e_48d7_9a89_db1ba3845917=0)  # disabled
normal_spot_4 = NormalSpot(Amount=panel_2, CountTextb6dade71_039c_4edd_b0f5_1dcc0756d057=0, lastIndexb6dade71_039c_4edd_b0f5_1dcc0756d057=0)  # disabled
axial_road = Curve(<curve referenced from the Rhino model>)  # disabled
special_spots = SpecialSpots(Handicap=normal_spot_3, Elderly=normal_spot_4)  # disabled
parking_solver = ParkingSolver(
    Plot=plot_parking_area_curve,
    Access=main_access_point,
    AxialRoad=axial_road,
    OutterSpot=normal_spot,
    InnerSpot=normal_spot_2,
    SpecialSpots=special_spots,
    RoadsSettings=roads_settings,
    PedestrianSettings=pedestrain_settings,
    Visualize=visualize_layout,
    Form=False)  # -> RoadsNetwork, Spots, Islands, SpotInstances, RoadInstances; disabled
roads_info = RoadsInfo(Roads=parking_solver.RoadInstances)  # -> Curve, Width, Type, Stripes, Lanes, Zebras, Sidewalks; disabled
spots_info = SpotsInfo(Spots=parking_solver.SpotInstances)  # -> Type, Curve, Origin, Centroid, Width, Length, Strips, Sign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; disabled

curve = Curve(spots_info.Curve)  # disabled
curve_2 = Curve(spots_info.Strips)  # disabled
surface = Surface(parking_solver.Islands)  # disabled

brep_wireframe = BrepWireframe(Brep=surface, Density=-1)  # disabled
join_curves = JoinCurves(Curves=brep_wireframe, Preserve=False)  # disabled
define_hatch = DefineHatch(Curve=join_curves, Pattern="Solid", Rotation=0, Scale=1)  # disabled
