# Grasshopper definition Program_Units 0.6.2.gh (Grasshopper 1.0.8)
# plug-ins: PlanFinderGH

pipeline = GeometryPipeline(
    GroupByLayer=False,
    GroupByType=False,
    IncludeHidden=True,
    IncludeLocked=True,
    LayerFilter="03_ARCH",
    NameFilter="*",
    SublayerFiltering=True,
    TypeFilter=4)
corridor_depth = Slider(6, range=5..10)
unit_area = DigitScroller(Scroller_Digits=12, Scroller_Prefix="Unit Area", Scroller_Radix=9, Scroller_Value=5000)
unit_width = DigitScroller(Scroller_Digits=12, Scroller_Prefix="Unit Width", Scroller_Radix=9, Scroller_Value=50)
unit_length = DigitScroller(Scroller_Digits=12, Scroller_Prefix="Unit Length", Scroller_Radix=9, Scroller_Value=50)
unit_height = DigitScroller(Scroller_Digits=12, Scroller_Prefix="Unit Height", Scroller_Radix=9, Scroller_Value=9)
true_by_unit_length_false_by_unit_area = BooleanToggle(True)
true_inboard_false_outboard = BooleanToggle(True)
true_single_loaded_false_double_loaded = BooleanToggle(True)
path_curve = Curve(reparameterize(simplify(graft(<curve referenced from the Rhino model>))))
crv = Curve(graft(path_curve))

# ---- group: creates the curve offsets for units
python = GhPythonScript(
    guide_crv=crv,
    unit_depth=Slider(8, range=0..100),
    building_depth=Slider(1, range=0..100),
    corridor_depth=corridor_depth,
    unit_area=unit_area,
    unit_width=unit_width,
    unit_length=unit_length,
    bool_calc=true_by_unit_length_false_by_unit_area,
    bool_dir=true_inboard_false_outboard)  # -> outer_curves, inner_curves, corridor_curve; inputs guide_crv: Curve
# ---------- python: Python ----------
__author__ = "ilouh"
__version__ = "2023.02.21"

import rhinoscriptsyntax as rs
import Grasshopper as gh
import Rhino.Geometry as rg
import ghpythonlib.components as comps
import math


#Set the directionality of the curves 
#set up if the unit depth is calculated by reuiqred area or by preset depth

if bool_dir is True:
    coef = 1
else:
    coef = -1
    

if bool_calc is False:
    unit_depth = coef * math.ceil(unit_area/unit_width)
else:
    unit_depth = coef * unit_length

#__________________________________________________

offest_lengths = [

    0,
    unit_depth,
    unit_depth+corridor_depth,
    2*unit_depth + corridor_depth

]

curves = comps.OffsetCurve(guide_crv,offest_lengths, corners = 1)

#due to directionality the order of the list changes, therefore the if 
#condition

if bool_dir is False:
    
    outer_curves = [curves[0],curves[2]]
    outer_curves[1] = comps.FlipCurve(outer_curves[1])
    outer_curves[1] = outer_curves[1]['curve']
    
    inner_curves = [curves[1],curves[3]]
    inner_curves[1] = comps.FlipCurve(inner_curves[1])
    inner_curves[1] = inner_curves[1]['curve']
    
    corridor_curve = [curves[1],curves[2]]

else:
    
    outer_curves = [curves[2],curves[3]]
    outer_curves[1] = comps.FlipCurve(outer_curves[1])
    outer_curves[1] = outer_curves[1]['curve']
    
    inner_curves = [curves[0],curves[1]]
    inner_curves[1] = comps.FlipCurve(inner_curves[1])
    inner_curves[1] = inner_curves[1]['curve']
    
    corridor_curve = [[curves[1],curves[2]]]
# ---------- end python ----------

# ----
corridor_curve = Curve(python.corridor_curve)
item = ListItem(List=corridor_curve, Index=0, Wrap=True)  # -> Item, Item1
tweencrv = TweenCurve(CurveA=item.Item, CurveB=item.Item1, Factor=0.5, BlendType=0)  # -> simplify(graft(Tween))

crv_2 = Curve(simplify(python.inner_curves))
crv_3 = Curve(simplify(python.outer_curves))
filter = StreamFilter(Gate=true_single_loaded_false_double_loaded, Stream0=crv_2)
cluster = Cluster(curves=crv_3, unit_width=unit_width, curves_2=filter, unit_width_2=unit_width)  # -> F, F_2

merge = Merge(Data1=cluster.F, Data2=cluster.F_2)
python_2 = GhPythonScript(surfaces=merge)  # -> simplify(Typical_Units), Corner_Units, dic, areas, center_points, amount_of_units; inputs surfaces: list of Brep
# ---------- python_2: Python ----------
__author__ = "ilouh"
__version__ = "2023.02.21"

import rhinoscriptsyntax as rs
import Grasshopper as gh
import Rhino.Geometry as rg
import ghpythonlib.components as comps
import math

def UnitBoundary(srf):
    
    boundary = rs.DuplicateSurfaceBorder(srf)

    return boundary
    
Typical_Units = [] 
Corner_Units = []
areas = []
center_points = []

areas_Corner_units = []
areas_Typical_units = []

dic = {}

i = 0 

for surface in surfaces:
    
    
    temp = comps.DeconstructBrep(surface)
    points = temp['vertices']
    
    
    unit_area = comps.Area(surface)
    
    unit_center = unit_area['centroid']
    
    
    unit_area = round(unit_area['area'],2)
    unit_number = 'Unit Number {}'.format(i)
    
    
    if len(points) > 4: 
        
        unit_name = 'Corner Unit',
        unit_type = '2 BDRM',
        Corner_Units.append(surface)

        
    else:
        
        unit_name = 'Typical Unit',
        unit_type = '1 BDRM',
        Typical_Units.append(surface)


    dic_temp = {

        'Unit Name':  unit_name,
        'Unit Area': unit_area,
        'Unit Number' : unit_number,
        'Unit Type' : unit_type

    }
    
    dic[unit_number] = dic_temp
    str = '{} \n {} sf'.format(unit_type,unit_area)
    areas.append(str)
    center_points.append(unit_center)
    
    i= i+1

print(Typical_Units)

amount_of_units = len(surfaces)
# ---------- end python_2 ----------
fsettings = FitSettings(WidthInterior=100, WidthExterior=200, DownScaling=0.8, UpScaling=1.2, ThresholdScore=0, AmountOptions=3, UnitSystem=4)
panel = Panel(python_2.amount_of_units)
flatten = FlattenTree(Tree=panel, Path="{0}")

python_3 = GhPythonScript(unit_count=flatten, stories=Slider(5, range=0..10))  # -> unit_per_floor, total_units; inputs unit_count: list of Int32
# ---------- python_3: Python ----------
__author__ = "ilouh"
__version__ = "2023.02.21"

import rhinoscriptsyntax as rs
import Grasshopper as gh
import Rhino.Geometry as rg
import ghpythonlib.components as comps
import math

unit_count = sum(unit_count)
unit_per_floor = 'Unit Per Floor: {}'.format(unit_count)
total_units = 'Total Units: {}'.format(int(unit_count)*int(stories))
# ---------- end python_3 ----------

python_4 = GhPythonScript(units=simplify(python_2.Typical_Units))  # -> out
# ---------- python_4: Python ----------
__author__ = "ilouh"
__version__ = "2023.02.21"

import rhinoscriptsyntax as rs
import Grasshopper as gh
import Rhino.Geometry as rg
import ghpythonlib.components as comps
import math

def UnitArea(srf):
    
    unit_area = comps.Area(srf)
    unit_center = unit_area['centroid']
    unit_area = unit_area['area']
    

    unit_area = round(unit_area)
    unit_area_str = str(unit_area) + ' SF'
    print(unit_area_str)
    return unit_area,unit_area_str,unit_center


def UnitBoundary(srf):
    
    boundary = rs.DuplicateSurfaceBorder(srf)
    
    return boundary

Bndy_curves = [] 

print(units)

if units != None: 

    boundary = UnitBoundary(units)
    out = boundary
# ---------- end python_4 ----------
python_5 = GhPythonScript(units=simplify(python_2.Corner_Units))  # -> out; same code as python_4
corner_units = Curve(simplify(python_5))
typical_units = Curve(python_4)

typical_units_2 = Curve(reparameterize(python_4))
clean = CleanTree(RemoveNulls=True, RemoveInvalid=True, RemoveEmpty=False, Tree=typical_units_2)
python_6 = GhPythonScript(unit_outlines=clean, corridor_curve=tweencrv)  # -> entrance_points, facade_points, corner_points; inputs unit_outlines: list of Curve, corridor_curve: Curve
# ---------- python_6: Python ----------
__author__ = "ilouh"
__version__ = "2023.02.21"

import rhinoscriptsyntax as rs
import Grasshopper as gh
import Rhino.Geometry as rg
import ghpythonlib.components as comps
import math

entrance_points = []
corner_points = [] 
facade_points = [] 

for outline in unit_outlines:
    
    walls = comps.Explode(outline,True)
    walls = walls['segments']
    
    mid_points = comps.CurveMiddle(walls)

    
    sorted_points = comps.CurveClosestPoint(mid_points,corridor_curve)
    
    distances = sorted_points['distance']
    points = sorted_points['point']
    
    combined = zip(distances, mid_points)
    sorted_combined = sorted(combined, key=lambda x: x[0])
    sorted_distances, sorted_points = zip(*sorted_combined)

    entrance_points.append(sorted_points[0])
    facade_points.append(sorted_points[-1])
    corner_points.append(sorted_points[1])
    #print(sorted_distances)

#door_entrances = [] 

#for entrance,outline in zip(entrance_points,unit_outlines):
    
#    entrance_unit = comps.CurveClosestPoint(entrance,outline)
#    entrance_unit = entrance_unit['point']
#    
#    door_entrances.append(entrance_unit)
# ---------- end python_6 ----------
pt = Point(python_6.entrance_points)
pt_2 = Point(python_6.facade_points)
pt_3 = Point(python_6.corner_points)
ln = Line(StartPoint=pt, EndPoint=pt_2)
lnpt = LinePt(Line=ln, Point=pt_3)  # -> graft(Plane)

panel_2 = Panel("""Iliya Muzychuk
Brooks + Scarpa Architects
iliya@brooksscarpa.com""")
item_2 = ListItem(List=panel_2, Index=0, Wrap=True)  # -> Item, Item1, Item2
activate_license = Activate(FullName=item_2.Item, Company=item_2.Item1, EmailAddress=item_2.Item2)
crv_4 = Curve(reparameterize(clean))
fit = PlanFit(
    Boundary=simplify(graft(crv_4)),
    EntranceS=simplify(graft(pt)),
    Beds=-1,
    Baths=1,
    Country=15,
    FitSettings=fsettings,
    InHousePlans=False)
item_3 = ListItem(List=fit, Index=Slider(0, range=0..10), Wrap=True)
deplan = DeconstructPlan(Plan=item_3)  # -> InteriorWalls, ExteriorWalls, DoorCurves, Glass, WindowFrames, Furniture, Score, Rooms

panel_3 = Panel(crv_4)
number_slider = Slider(10, range=0..100)
Z = UnitZ(Factor=unit_height)
Z_2 = UnitZ(Factor=unit_height)

pt_4 = Point(<point referenced from the Rhino model>)
pt_5 = Point(<point referenced from the Rhino model>)
tag = TextTag3D(Location=pt_4, Text=python_3.unit_per_floor, Size=number_slider, Justification=4)
tag_2 = TextTag3D(Location=pt_5, Text=python_3.total_units, Size=number_slider, Justification=4)

extr = Extrude(Base=corner_units, Direction=Z)
extr_2 = Extrude(Base=typical_units, Direction=Z_2)
tag_3 = TextTag3D(Location=python_2.center_points, Text=python_2.areas, Size=Slider(2, range=0..100), Justification=5)
cap = CapHoles(Brep=extr)
cap_2 = CapHoles(Brep=extr_2)
preview = CustomPreview(Geometry=cap_2, Material=ColourSwatch(SwatchColor=RGBA(113, 193, 75, 84)))
preview_2 = CustomPreview(Geometry=cap, Material=ColourSwatch(SwatchColor=RGBA(39, 109, 159, 88)))

# ==== cluster Cluster
curves = ClusterInput()
curves_2 = ClusterInput()
unit_width = ClusterInput()
unit_width_2 = ClusterInput()

item = ListItem(Curves=curves, Index=0, Wrap=True)  # -> Item, Item1

# ---- group: curve subdivision per units dim
python = GhPythonScript(outer_curve=simplify(item.Item), unit_width=unit_width, inner_curve=simplify(item.Item1))  # -> simplify(outter_points), simplify(inner_points)
# ---------- python: Python ----------
__author__ = "ilouh"
__version__ = "2022.12.10"

import rhinoscriptsyntax as rs
import Grasshopper as gh
import Rhino.Geometry as rg
import ghpythonlib.components as comps
import math

def subdivide_curve(curve,unit_width):

    # Use the DivideCurve function to perform the subdivision
    points = comps.DivideDistance(curve,unit_width)
    points = comps.DivideCurve(curve,len(points['points']),kinks = True)
    
    return points['points']



#goal is to subdivide the curve into points appx per the width of a unit
outter_points = subdivide_curve(outer_curve,unit_width)

#find closest points
inner_points = comps.CurveClosestPoint(outter_points,inner_curve)
inner_points = inner_points['point']
# ---------- end python ----------

# ---- group: Get the X vector at each point
crv_cp = CurveClosestPoint(Point=python.outter_points, Curve=item.Item)  # -> Point, Parameter, Distance
hframe = HorizontalFrame(Curve=item.Item, Parameter=crv_cp.Parameter)
deplane = DeconstructPlane(Plane=hframe)  # -> Origin, XAxis, YAxis, ZAxis

# ---- group: creates a surface to be divided to units
python_2 = GhPythonScript(outer_curve=item.Item, inner_curve=item.Item1)  # -> srf; inputs outer_curve: Curve, inner_curve: Curve
# ---------- python_2: Python ----------
__author__ = "ilouh"
__version__ = "2023.02.21"

import rhinoscriptsyntax as rs
import Grasshopper as gh
import Rhino.Geometry as rg
import ghpythonlib.components as comps
import math


inner_curve = comps.FlipCurve(inner_curve,outer_curve)
inner_curve = inner_curve['curve']


if comps.Closed(outer_curve) is True: 
    srf = comps.BoundarySurfaces([outer_curve,inner_curve])

else:
    
    pts_outer = comps.EndPoints(outer_curve)
    pts_inner = comps.EndPoints(inner_curve)
    
    pts_outer_start = pts_outer['start']
    pts_outer_end = pts_outer['end']
    
    pts_inner_start = pts_inner['start']
    pts_inner_end = pts_inner['end']
    
    
    start_line = comps.Line(pts_outer_start,pts_inner_start)
    end_line = comps.Line(pts_outer_end,pts_inner_end)

    
    print(start_line)
    
    srf = comps.BoundarySurfaces([
        outer_curve,
        start_line,
        end_line,
        inner_curve])


    
    #srf = comps.BoundarySurfaces([outer_curve,inner_curve])

    #loft_option = comps.LoftOptions(True,True,0,0,0)
    #srf = comps.Loft([outer_curve,inner_curve],loft_option)
# ---------- end python_2 ----------

# ----
item_2 = ListItem(Curves=curves_2, Index=0, Wrap=True)  # -> Item, Item1

# ---- group: curve subdivision per units dim
python_3 = GhPythonScript(outer_curve=simplify(item_2.Item), unit_width=unit_width_2, inner_curve=simplify(item_2.Item1))  # -> simplify(outter_points), simplify(inner_points); same code as python

# ---- group: Get the X vector at each point
crv_cp_2 = CurveClosestPoint(Point=python_3.outter_points, Curve=item_2.Item)  # -> Point, Parameter, Distance
hframe_2 = HorizontalFrame(Curve=item_2.Item, Parameter=crv_cp_2.Parameter)
deplane_2 = DeconstructPlane(Plane=hframe_2)  # -> Origin, XAxis, YAxis, ZAxis

# ----
flip = FlipCurve(Curve=item_2.Item1)  # -> Curve, Flag

# ---- group: creates a surface to be divided to units
python_4 = GhPythonScript(outer_curve=item_2.Item, inner_curve=item_2.Item1)  # -> srf; inputs outer_curve: Curve, inner_curve: Curve; same code as python_2

# ----
pt = Point(python.outter_points)
pt_2 = Point(python.inner_points)

# ---- group: creates perpendicular dem walls
python_5 = GhPythonScript(outter_points=pt, inner_points=pt_2, vector1=deplane.XAxis)  # -> angled_walls, simplify(straight_walls); inputs outter_points: list of Point3d, inner_points: list of Point3d, vector1: list of Vector3d
# ---------- python_5: Python ----------
"""Provides a scripting component.
    Inputs:
        outter_points: A list of points for the outer wall endpoints
        inner_points: A list of points for the inner wall endpoints
        vector1: A list of vectors to compare against
    Output:
        straight_walls: List of lines considered 'straight'
        angled_walls: List of lines considered 'angled'
        P: Some points recorded if needed
"""

__author__ = "ilouh"
__version__ = "2023.02.21"

import rhinoscriptsyntax as rs
import Grasshopper as gh
import Rhino.Geometry as rg
import math

P = []
straight_walls = []
angled_walls = []

# Small angle tolerance in degrees
tol_deg = 1.0

for i in range(len(outter_points)):

    pt_start = outter_points[i]
    pt_end   = inner_points[i]

    # Create a RhinoCommon Line from start to end points
    crv = rg.Line(pt_start, pt_end)

    # Convert the two points into a Vector3d
    v2 = rg.Vector3d(pt_end - pt_start)

    # Make sure vector1[i] is a Rhino.Geometry.Vector3d (if not, cast it):
    v1 = rg.Vector3d(vector1[i])

    # Compute the angle in radians using RhinoCommon
    angle_radians = rg.Vector3d.VectorAngle(v1, v2)
    angle_degrees = math.degrees(angle_radians)

    # Check for near 0° or near 90° => "straight"
    if (abs(angle_degrees - 0) < tol_deg) or (abs(angle_degrees - 90) < tol_deg):
        straight_walls.append(crv)
        P.append(pt_start)
        print("Angle: {:.2f} => Straight wall".format(angle_degrees))
    else:
        angled_walls.append(crv)
        print("Angle: {:.2f} => Angled wall".format(angle_degrees))
# ---------- end python_5 ----------

# ----
crv = Curve(reparameterize(python_5.straight_walls))
srfsplit = SurfaceSplit(Surface=python_2, Curves=crv)

F = ClusterOutput(srfsplit)

pt_3 = Point(python_3.outter_points)
pt_4 = Point(python_3.inner_points)

# ---- group: creates perpendicular dem walls
python_6 = GhPythonScript(outter_points=pt_3, inner_points=pt_4, vector1=deplane_2.XAxis)  # -> angled_walls, simplify(straight_walls); inputs outter_points: list of Point3d, inner_points: list of Point3d, vector1: list of Vector3d
# ---------- python_6: Python ----------
__author__ = "ilouh"
__version__ = "2023.02.21"

import rhinoscriptsyntax as rs
import Grasshopper as gh
import Rhino.Geometry as rg
import ghpythonlib.components as comps
import math



# Function to convert radians to degrees
def deg2rad(rad):
    return 180 / rad



P = []  # List to store points
straight_walls = [] 
angled_walls = []

# Loop through the points
for i in range(len("""Provides a scripting component.
    Inputs:
        outter_points: A list of points for the outer wall endpoints
        inner_points: A list of points for the inner wall endpoints
        vector1: A list of vectors to compare against
    Output:
        straight_walls: List of lines considered 'straight'
        angled_walls: List of lines considered 'angled'
        P: Some points recorded if needed
"""

__author__ = "ilouh"
__version__ = "2023.02.21"

import rhinoscriptsyntax as rs
import Grasshopper as gh
import Rhino.Geometry as rg
import math

P = []
straight_walls = []
angled_walls = []

# Small angle tolerance in degrees
tol_deg = 1.0

for i in range(len(outter_points)):

    pt_start = outter_points[i]
    pt_end   = inner_points[i]

    # Create a RhinoCommon Line from start to end points
    crv = rg.Line(pt_start, pt_end)

    # Convert the two points into a Vector3d
    v2 = rg.Vector3d(pt_end - pt_start)

    # Make sure vector1[i] is a Rhino.Geometry.Vector3d (if not, cast it):
    v1 = rg.Vector3d(vector1[i])

    # Compute the angle in radians using RhinoCommon
    angle_radians = rg.Vector3d.VectorAngle(v1, v2)
    angle_degrees = math.degrees(angle_radians)

    # Check for near 0° or near 90° => "straight"
    if (abs(angle_degrees - 0) < tol_deg) or (abs(angle_degrees - 90) < tol_deg):
        straight_walls.append(crv)
        P.append(pt_start)
        print("Angle: {:.2f} => Straight wall".format(angle_degrees))
    else:
        angled_walls.append(crv)
        print("Angle: {:.2f} => Angled wall".format(angle_degrees))
# ---------- end python_6 ----------

# ----
crv_2 = Curve(reparameterize(python_6.straight_walls))
srfsplit_2 = SurfaceSplit(Surface=python_4, Curves=crv_2)

F_2 = ClusterOutput(srfsplit_2)
