# Grasshopper definition Facade_Dancing Boxes 0.1.0.gh (Grasshopper 1.0.7)
# plug-ins: eleFront

srf = Surface(<surface referenced from the Rhino model>)
divide = DivideDomain²(Domain=srf, UCount=Slider(30, range=0..100), VCount=Slider(9, range=0..100))

subsrf = Isotrim(Surface=srf, Domain=divide)  # -> flatten(Surface)
wires = BrepWireframe(Brep=subsrf, Density=-1)

join = JoinCurves(Curves=wires, Preserve=False)  # -> flatten(Curves)
offsets = OffsetOnSrf(Curve=join, Distance=1, Surface=subsrf)  # -> simplify(Curve)
disc = Discontinuity(Curve=offsets, Level=1)  # -> Points, Parameters
pline = PolyLine(Vertices=disc.Points, Closed=True)

md_slider = MDSlider(SliderMode=0, slider_value=Point(0.5, 0.5, 0.5), x_domain=Domain(0, 1), y_domain=Domain(0, 1), z_domain=Domain(0, 1))
evalsrf = EvaluateSurface(Surface=reparameterize(subsrf), Point=md_slider)  # -> Point, Normal, UDirection, VDirection, Frame

srf_cp = SurfaceClosestPoint(Point=graft(evalsrf.Point), Surface=reparameterize(srf))  # -> flatten(Point), flatten(UVPoint), Distance
bnd = Bounds(Numbers=srf_cp.UVPoint)
remap = RemapNumbers(Value=flatten(srf_cp.UVPoint), Source=flatten(bnd), Target=Domain(0.1, 1))  # -> Mapped, Clipped

image = ImageSampler(srf_cp.UVPoint, Filter="Colour", Interpolate=False, Umax=1, Umin=0, Vmax=1, Vmin=0, Wrap=0)
graph = GraphMapper(remap.Mapped, x0=0, x1=1, y0=0, y1=1, Gx=0.352501899, Gy=0.6298098564, container_name="Power", power=0.4434042815)
panel = Panel(image)
python = GhPythonScript(x=image, mul=Slider(1, range=0..10))  # -> simplify(x)
# ---------- python: Python ----------
__author__ = "Brooks Scarpa"
__version__ = "2020.06.22"

import rhinoscriptsyntax as rs
import math
import ghpythonlib as gh

print(x)

if str(x) != 'Transparent':

    

    x = [x[0],x[1],x[2]]
    x = gh.components.Average(x)
    
    x = gh.components.RemapNumbers(x,[0,255],[1,2])
    print(x)
    #x = math.floor(x[1])
    x = x[1]
    x = x*mul

else: 
    
    x = 1
# ---------- end python ----------

amp = Amplitude(Vector=flatten(evalsrf.Normal), Amplitude=python)
multiplication = Multiplication(A=amp, B=Slider(7, range=0..10))

panel_2 = Panel(python)
extr = Extrude(Base=flatten(pline), Direction=multiplication)
cap = CapHoles(Brep=extr)  # -> graft(Brep)
pl = ConstructPlane(Origin=evalsrf.Point, XAxis=evalsrf.UDirection, YAxis=evalsrf.VDirection)  # -> graft(Plane)
bbox = BoundingBox(Content=cap, Plane=pl)  # -> simplify(Box), Box_2
insert = InsertBlock(BlockName="Balcony", Plane=PlaneXY(0, 0, 0))
brep = Brep(<brep referenced from the Rhino model>)
bbox_2 = BoundingBox(Content=brep, Plane=PlaneXY(0, 0, 0))  # -> Box, Box_2
boxmap = BoxMapping(Geometry=brep, Source=bbox_2.Box, Target=bbox.Box)  # -> Geometry, Transform
preview = CustomPreview(Geometry=boxmap.Geometry, Material=ColourSwatch(SwatchColor=RGB(109, 134, 64)))
