# Grasshopper definition Facade_Box Morphing Panels 0.2.0.gh (Grasshopper 1.0.7)

input = DataInput(
    Destination="G:\My Drive\MTA - Venice Bus Yard\03 Data Exchange Files\floors_ELI.ghdata",
    RelativePath="G:\My Drive\MTA - Venice Bus Yard\03 Data Exchange Files\floors_ELI.ghdata|..\03 Data Exchange Files\floors_ELI.ghdata",
    UpdateDelay=50000)
merge = Merge(Data1=simplify(input))
preview = CustomPreview(Geometry=merge, Material=ColourSwatch(SwatchColor=RGB(192, 192, 192)))
preview_2 = CustomPreview(Material=ColourSwatch(SwatchColor=RGB(19, 232, 119)))
input_2 = DataInput(
    Destination="G:\My Drive\MTA - Venice Bus Yard\03 Data Exchange Files\walls_ELI.ghdata",
    RelativePath="G:\My Drive\MTA - Venice Bus Yard\03 Data Exchange Files\walls_ELI.ghdata|..\03 Data Exchange Files\walls_ELI.ghdata",
    UpdateDelay=50000)
input_3 = DataInput(
    Destination="G:\My Drive\MTA - Venice Bus Yard\03 Data Exchange Files\walls_retail.ghdata",
    RelativePath="G:\My Drive\MTA - Venice Bus Yard\03 Data Exchange Files\walls_retail.ghdata|..\03 Data Exchange Files\walls_retail.ghdata",
    UpdateDelay=50000)  # disabled
mullion_spacing = Slider(4, range=0..60)  # disabled
mullion_depth = Slider(6, range=0..36)  # disabled
# REGULATED SPACING
mullion_width = Slider(2, range=0..36)  # disabled
base_surface = Geometry(graft([<brep referenced from the Rhino model> x7]))  # disabled

# ---- group: Input Surface
srf = Surface(graft(input_2))

# ----
expression = Expression(x=mullion_depth, Expression="(X/12)/2")  # disabled
expression_2 = Expression(x=mullion_width, Expression="(X/12)/2")  # disabled
flatten = FlattenTree(Tree=srf, Path="{0}")  # -> graft(Tree)
curtainwall = CurtainWall(base_surface=base_surface, mullion_spacing=mullion_spacing, mullion_depth=expression, mullion_width=expression_2)  # -> base_surface_3, B; disabled
evalsrf = EvaluateSurface(Surface=reparameterize(flatten), Point="{0.5,0.5,0}")  # -> Point, Normal, UDirection, VDirection, Frame

srf_2 = Surface(reparameterize(flatten))
python = PythonScript(s=srf_2, swapUV=Toggle(False), reverseU=Toggle(False), reverseV=Toggle(True))  # -> out, anchor, uVec, vVec, revSrf; inputs s: Surface, swapUV: Int32, reverseU: Int32, reverseV: Int32
# ---------- python: Python ----------
import Rhino

if reverseU:
    uS,uE = s.Domain(0)
    inter0 = Rhino.Geometry.Interval(-uE, -uS)
    s.SetDomain(0,inter0)
    s = s.Reverse(0)

if reverseV:
    vS,vE = s.Domain(1)
    inter1 = Rhino.Geometry.Interval(-vE, -vS)
    s.SetDomain(1,inter1)
    s = s.Reverse(1)

if swapUV:
    s = s.Transpose()

anchor = s.PointAt(0,0)
uend = s.PointAt(0.5,0)
vend = s.PointAt(0,0.5)
uVec = uend - anchor
vVec = vend - anchor

revSrf = s
# ---------- end python ----------

swatch = ColourSwatch(SwatchColor=RGBA(68, 86, 255, 72))  # disabled

# ---- group: Output - Mullions
mullions = Brep(curtainwall.B)  # disabled

# ----
srf_3 = Surface(curtainwall.base_surface_3)  # disabled
preview_3 = CustomPreview(Geometry=srf_3, Material=swatch)  # disabled

# ---- group: Facade Option
list = ValueList({"One": 0, "Two": 1, "Three": 2, "Four": 3}, selected="One")

# ---- group: Orientation Option
list_2 = ValueList({"One": 0, "Two": 1, "Three": 2}, selected="One")

# ----
list_3 = ValueList({"Running Bond": 0, "Stacking Bond": 1}, selected="Running Bond")
checkboard_mirroring = BooleanToggle(False)
flip_surface_inboard_outboard = BooleanToggle(True)
facade_panel_u_size = Slider(10, range=0..50)
facade_panel_v_size = Slider(12, range=0..50)
facade_depth = Slider(2, range=0..10)

box_morphing_facade = BoxMorphingFacade(
    facade_option=list,
    orientation_option=list_2,
    checkboard_mirroring=checkboard_mirroring,
    flip_surface_inboard_outboard=flip_surface_inboard_outboard,
    pattern_type=list_3,
    input_surface=python.revSrf,
    panel_u_size=facade_panel_u_size,
    panel_v_size=facade_panel_v_size,
    facade_depth=facade_depth)
output_group = Group(Objects=box_morphing_facade)
preview_4 = CustomPreview(Geometry=box_morphing_facade, Material=ColourSwatch(SwatchColor=RGB(255, 255, 255)))

# ==== cluster BoxMorphingFacade
flip_surface_inboard_outboard = ClusterInput()
checkboard_mirroring = ClusterInput()
orientation_option = ClusterInput()
facade_option = ClusterInput()
pattern_type = ClusterInput()
input_surface = ClusterInput()
panel_u_size = ClusterInput()
panel_v_size = ClusterInput()
facade_depth = ClusterInput()
flip_surface_inboard_outboard_2 = Boolean(flip_surface_inboard_outboard)
checkboard_mirroring_2 = Boolean(checkboard_mirroring)
orientation_option_2 = Integer(orientation_option)
facade_option_2 = Integer(facade_option)
pattern_type_2 = Integer(pattern_type)
input_surface_2 = Surface(input_surface)
panel_u_size_2 = Number(panel_u_size)
panel_v_size_2 = Number(panel_v_size)
facade_depth_2 = Number(facade_depth)
xy = XYPlane(Origin=Point(0, 0, 0))
xz = XZPlane(Origin=Point(0, 0, 0))
yz = YZPlane(Origin=Point(0, 0, 0))
option_a = Brep(<brep referenced from the Rhino model>)
option_b = Brep([<brep referenced from the Rhino model> x5])
option_c = Brep([<brep referenced from the Rhino model> x6])
option_d = Brep([<brep referenced from the Rhino model> x5])

dim = Dimensions(Surface=input_surface_2)  # -> UDimension, VDimension
expression = Expression(x=dim.UDimension, y=panel_u_size_2, Expression="round(x/y)")
expression_2 = Expression(x=dim.VDimension, y=panel_v_size_2, Expression="round(x/y)")

filter = StreamFilter(Gate=facade_option_2, Stream0=option_a, Stream1=option_b, Stream2=option_c, Stream3=option_d)
filter_2 = StreamFilter(Gate=orientation_option_2, Stream0=xy, Stream1=xz, Stream2=yz)
group = Group(Objects=filter)

divide = DivideDomain²(Domain=input_surface_2, UCount=expression, VCount=expression_2)
quadstag = StaggeredQuadPanels(Surface=input_surface_2, UDivisions=expression, VDivisions=expression_2)
subsrf = Isotrim(Surface=input_surface_2, Domain=divide)

bbox = BoundingBox(Content=group, Plane=filter_2)  # -> Box, Box_2

volume = Volume(Geometry=bbox.Box)  # -> Volume, Centroid
xz_2 = XZPlane(Origin=volume.Centroid)
mirror = Mirror(Geometry=bbox.Box, Plane=xz_2)  # -> Geometry, Transform

yz_2 = YZPlane(Origin=volume.Centroid)
xy_2 = XYPlane(Origin=volume.Centroid)

filter_3 = StreamFilter(Gate=pattern_type_2, Stream0=quadstag, Stream1=subsrf)
partition = PartitionList(List=filter_3, Size=expression_2)

md_slider = MDSlider(SliderMode=0, slider_value=Point(0.5, 0.5, 0.5), x_domain=Domain(0, 1), y_domain=Domain(0, 1), z_domain=Domain(0, 1))

debrep = DeconstructBrep(Brep=partition)  # -> Faces, Edges, Vertices
item = ListItem(List=debrep.Vertices, Index=0, Wrap=True)  # -> Item, Item1, Item2, Item3
srf4pt = _4PointSurface(CornerA=item.Item, CornerB=item.Item1, CornerC=item.Item2, CornerD=item.Item3)  # -> simplify(Surface)
evalsrf = EvaluateSurface(Surface=reparameterize(srf4pt), Point=md_slider)  # -> Point, Normal, UDirection, VDirection, simplify(Frame)

pln = Plane(evalsrf.Frame)
neg = Negative(Value=evalsrf.Normal)
filter_4 = StreamFilter(Gate=flip_surface_inboard_outboard_2, Stream0=evalsrf.Normal, Stream1=neg)
amp = Amplitude(Vector=filter_4, Amplitude=facade_depth_2)

extr = Extrude(Base=srf4pt, Direction=amp)  # -> simplify(Extrusion)

pl = ConstructPlane(Origin=evalsrf.Point, XAxis=evalsrf.Normal, YAxis=evalsrf.UDirection)
bbox_2 = BoundingBox(Content=extr, Plane=pl)  # -> simplify(Box), Box_2
trim = TrimTree(Tree=bbox_2.Box, Depth=1)

gate = StreamGate(Stream=trim, Gate=checkboard_mirroring_2)  # -> Target0, Target1

brep_t1 = SplitTree(Data=gate.Target0, Masks=flatten("{?;(0,2,....)}"))  # -> Positive, Negative

plane_t1 = SplitTree(Data=gate.Target0, Masks=flatten("{?;(1,3,....)}"))  # -> Positive, Negative

# ----
# Check Board Pattern
panel = Panel(gate.Target0)

cull = CullPattern(List=brep_t1.Positive, CullPattern=[False, True])
cull_2 = CullPattern(List=brep_t1.Positive, CullPattern=[True, False])
cull_3 = CullPattern(List=plane_t1.Positive, CullPattern=[False, True])
cull_4 = CullPattern(List=plane_t1.Positive, CullPattern=[True, False])

merge = Merge(Data1=cull, Data2=cull_4)
merge_2 = Merge(Data1=cull_2, Data2=cull_3)

boxmap = BoxMapping(Geometry=group, Source=bbox.Box, Target=merge)  # -> Geometry, Transform
boxmap_2 = BoxMapping(Geometry=group, Source=mirror.Geometry, Target=merge_2)  # -> Geometry, Transform
boxmap_3 = BoxMapping(Geometry=group, Source=bbox.Box, Target=gate.Target1)  # -> Geometry, Transform
filter_5 = StreamFilter(Gate=checkboard_mirroring_2, Stream0=[boxmap_2.Geometry, boxmap.Geometry], Stream1=boxmap_3.Geometry)
s_0 = ClusterOutput(filter_5)

# ==== cluster CurtainWall
mullion_width = ClusterInput()
base_surface = ClusterInput()
mullion_spacing = ClusterInput()
mullion_depth = ClusterInput()
mullion_width_2 = Number(mullion_width)
base_surface_2 = Geometry(graft(base_surface))
mullion_spacing_2 = Number(mullion_spacing)
mullion_depth_2 = Number(mullion_depth)
base_surface_3 = ClusterOutput(base_surface_2)

edges = BrepEdges(Brep=base_surface_2)  # -> Naked, Interior, NonManifold
curvepoint = PointOnCurve(edges.Naked, parameter=0.5)
pdecon = Deconstruct(Point=curvepoint)  # -> XComponent, YComponent, ZComponent
sort = SortList(Keys=pdecon.ZComponent, ValuesA=edges.Naked)  # -> Keys, ValuesA
item = ListItem(List=reverse(sort.ValuesA), Index=0, Wrap=True)  # -> Item, Item1, Item2, Item3

flip = FlipCurve(Curve=item.Item3)  # -> Curve, Flag
crv = Curve(item.Item)
crv_2 = Curve(item.Item3)

divlength = DivideLength(Curve=item.Item, Length=mullion_spacing_2)  # -> Points, Tangents, Parameters
lng = ListLength(List=divlength.Points)  # -> simplify(Length)

divide = DivideCurve(Curve=reparameterize(simplify(crv)), Count=lng, Kinks=False)  # -> Points, Tangents, Parameters
divide_2 = DivideCurve(Curve=reparameterize(simplify(crv_2)), Count=lng, Kinks=False)  # -> Points, Tangents, Parameters

dom = ConstructDomain(DomainStart=mullion_width_2, DomainEnd=expr("-x", mullion_width_2))
dom_2 = ConstructDomain(DomainStart=mullion_depth_2, DomainEnd=expr("-x", mullion_depth_2))

ln = Line(StartPoint=divide.Points, EndPoint=divide_2.Points)
mullions = Curve(ln)

# ---- group: Creates the Mullions
curvepoint_2 = PointOnCurve(mullions, parameter=0)
srf = Surface(reparameterize(base_surface_2))
srf_cp = SurfaceClosestPoint(Point=curvepoint_2, Surface=srf)  # -> Point, UVPoint, Distance
evalsrf = EvaluateSurface(Surface=reparameterize(srf), Point=srf_cp.UVPoint)  # -> Point, Normal, UDirection, VDirection, Frame
pl = ConstructPlane(Origin=evalsrf.Point, XAxis=evalsrf.Normal, YAxis=evalsrf.UDirection)
rectangle = Rectangle(Plane=pl, XSize=dom_2, YSize=dom, Radius=0)  # -> simplify(graft(Rectangle)), Length
swp1 = Sweep1(Rail=simplify(graft(mullions)), Sections=rectangle.Rectangle, Miter=1)

# ----
cap = CapHoles(Brep=swp1)
B = ClusterOutput(cap)
