# Grasshopper definition Facade_CircularPattern.gh (Grasshopper 1.0.7)
# plug-ins: ShapeDiverForGrasshopper, LunchBox

srf = Surface(graft([<surface referenced from the Rhino model> x175]))  # disabled
dim = Dimensions(Surface=srf)  # -> UDimension, VDimension; disabled
number_slider = Slider(1, range=0..1)  # disabled
expression = Expression(x=dim.VDimension, Expression="round(x/20,0)")  # disabled
divide = DivideDomain²(Domain=srf, UCount=number_slider, VCount=expression)  # disabled
subsrf = Isotrim(Surface=srf, Domain=divide)  # -> reparameterize(Surface); disabled

# ---- group: Get sill & head curves
edges = BrepEdges(Brep=subsrf)  # -> Naked, Interior, NonManifold; disabled
midpt = CurveMiddle(Curve=edges.Naked)  # disabled
pdecon = Deconstruct(Point=midpt)  # -> XComponent, YComponent, ZComponent; disabled
sort = SortList(Keys=pdecon.ZComponent, ValuesA=edges.Naked)  # -> Keys, ValuesA; disabled
item = ListItem(List=sort.ValuesA, Index=0, Wrap=True)  # -> Item1, Item; disabled
flip = FlipCurve(Curve=item.Item, Guide=item.Item1)  # -> Curve, Flag; disabled

# ----
crv = Curve(item.Item1)  # disabled
crv_2 = Curve(flip.Curve)  # disabled

Z = UnitZ(Factor=expr("x/12", -1))  # disabled
Z_2 = UnitZ(Factor=expr("x/12", 1))  # disabled
move = Move(Geometry=crv, Motion=Z)  # -> Geometry, Transform; disabled
move_2 = Move(Geometry=crv_2, Motion=Z_2)  # -> Geometry, Transform; disabled
merge = Merge(Data1=move.Geometry, Data2=move_2.Geometry)  # disabled
loft = Loft(Curves=merge, Options={Adjust=False, Closed=False, LoftEnds=0, LoftSimp=0, LoftType=0, Rebuild=10, Refit=0.01})  # disabled

sddp = ShapeDiverDocumentPayload({AbsoluteTolerance=0, AngleTolerance=0, DistanceDisplayPrecision=0, GltfVersion="Gltf2", InputGroups="{}", OutputGroups="{}", RelativeTolerance=0, UnitSystem=0, VersionCreated="1.13.1.0", VersionSaved="1.13.1.0"})
srf_2 = Surface(graft([<surface referenced from the Rhino model> x2]))

srf_3 = Surface([<surface referenced from the Rhino model> x6])
md_slider = MDSlider(SliderMode=0, slider_value=Point(0.5, 0.5, 0.5), x_domain=Domain(0, 1), y_domain=Domain(0, 1), z_domain=Domain(0, 1))
quadstag = StaggeredQuadPanels(Surface=srf_3, UDivisions=Slider(20, range=0..100), VDivisions=Slider(15, range=0..100))
dim_2 = Dimensions(Surface=quadstag)  # -> UDimension, VDimension
evalsrf = EvaluateSurface(Surface=reparameterize(quadstag), Point=md_slider)  # -> Point, Normal, UDirection, VDirection, Frame
panel = Panel(dim_2.UDimension)
amp = Amplitude(Vector=evalsrf.Normal, Amplitude=Slider(3, range=0..10))
extr = Extrude(Base=quadstag, Direction=amp)
number_slider_2 = Slider(0.9, range=0..1)
volume = Volume(Geometry=extr)  # -> Volume, Centroid
scale_nu = ScaleNU(Geometry=extr, Plane=volume.Centroid, ScaleX=number_slider_2, ScaleY=number_slider_2, ScaleZ=1)  # -> Geometry, Transform
preview = CustomPreview(
    Geometry=scale_nu.Geometry,
    Material={diffuse=RGB(221, 160, 221), emission=RGB(66, 48, 66), shine=0.5, specular=RGB(255, 255, 255), transparency=0})

# ---- group: Get sill & head curves
edges_2 = BrepEdges(Brep=srf_2)  # -> Naked, Interior, NonManifold
midpt_2 = CurveMiddle(Curve=edges_2.Naked)
pdecon_2 = Deconstruct(Point=midpt_2)  # -> XComponent, YComponent, ZComponent
sort_2 = SortList(Keys=pdecon_2.ZComponent, ValuesA=edges_2.Naked)  # -> Keys, ValuesA
item_2 = ListItem(List=sort_2.ValuesA, Index=0, Wrap=True)  # -> Item1, Item
flip_2 = FlipCurve(Curve=item_2.Item, Guide=item_2.Item1)  # -> Curve, Flag

# ----
radius = Slider(1, range=0..10)
length = Slider(5, range=0..10)

# ---- group: Optional
dim_3 = Dimensions(Surface=srf_3)  # -> UDimension, VDimension
expression_2 = Expression(u=dim_3.UDimension, Expression="round(u/6,0)")
expression_3 = Expression(v=dim_3.UDimension, Expression="round(v/8,0)")

# ---- group: calculates the extrusion vector
item_3 = ListItem(List=sort_2.Keys, Index=0, Wrap=True)  # -> Item1, Item
subtraction = Subtraction(A=item_3.Item1, B=item_3.Item)
Z_3 = UnitZ(Factor=expr("x*-1", subtraction))

# ----
crv_3 = Curve(item_2.Item1)
crv_4 = Curve(flip_2.Curve)
python = GhPythonScript(my_curve=crv_3, num_points=Slider(16, range=0..100), radius=radius, length=length)  # -> points_on_curve, circles; inputs my_curve: Curve
# ---------- python: Python ----------
__author__ = "Iliya Muzychuk"
__version__ = "2023.02.03"

import rhinoscriptsyntax as rs
import Grasshopper as gh
import Rhino.Geometry as rg
import ghpythonlib.components as comps


def create_points_on_curve(curve, num_points,length):
    points = rs.DivideCurveLength(curve,length,create_points=True,return_points = True)
 
    return points

# Assuming you have a curve stored in a variable called "my_curve"


points_on_curve = create_points_on_curve(my_curve, num_points,length)


points_on_curve = points_on_curve[1:-1]

circles = []

for point in points_on_curve:
    circle = rs.AddCircle(point, radius)
    circles.append(circle)
# ---------- end python ----------

# ---- group: creates a region
offset = OffsetCurve(Curve=crv_3, Distance=Slider(2, range=0..10), Corners=1)
crv_5 = Curve(item_2.Item1)
end = EndPoints(Curve=offset)  # -> Start, End
end_2 = EndPoints(Curve=crv_5)  # -> Start, End
ln = Line(StartPoint=end.Start, EndPoint=end_2.Start)
ln_2 = Line(StartPoint=end.End, EndPoint=end_2.End)
crv_6 = Curve(offset)
crv_7 = Curve(crv_5)
merge_2 = Merge(Data1=simplify(crv_6), Data2=simplify(ln), Data3=simplify(crv_7), Data4=simplify(ln_2))
join = JoinCurves(Curves=merge_2, Preserve=False)

# ----
pt = Point(python.points_on_curve)
crv_8 = Curve(python.circles)
rdiff = RegionDifference(CurvesA=join, CurvesB=crv_8)
extr_2 = Extrude(Base=rdiff, Direction=Z_3)
cap = CapHoles(Brep=extr_2)
preview_2 = CustomPreview(
    Geometry=cap,
    Material={diffuse=RGB(221, 160, 221), emission=RGB(66, 48, 66), shine=0.5, specular=RGB(255, 255, 255), transparency=0})
