# Grasshopper definition Facade_Colorful Panels & Mullions 0.1.0.gh (Grasshopper 1.0.8)

# ---- group: Base Surface
# REGULATED SPACING
base_surface = Geometry(graft([<surface referenced from the Rhino model> x7]))

# ---- group: Distance Between Verticals
number_of_verticals = Slider(4, range=0..60)

# ---- group: Vertical Width
mullion_depth = Slider(6, range=0..36)

# ---- group: Vertical Depth
mullion_width = Slider(2, range=0..36)

# ----
percentage_of_reduction = Slider(0, range=0..1)
random_seed = Slider(4, range=0..10)
expression = Expression(x=mullion_depth, Expression="(X/12)/2")
expression_2 = Expression(x=mullion_width, Expression="(X/12)/2")

edges = BrepEdges(Brep=base_surface)  # -> Naked, Interior, NonManifold
curvepoint = PointOnCurve(edges.Naked, parameter=0.5)
pdecon = Deconstruct(Point=curvepoint)  # -> XComponent, YComponent, ZComponent
sort = SortList(Keys=pdecon.ZComponent, ValuesA=edges.Naked)  # -> Keys, ValuesA
item = ListItem(List=reverse(sort.ValuesA), Index=0, Wrap=True)  # -> Item, Item1, Item2, Item3

flip = FlipCurve(Curve=item.Item3)  # -> Curve, Flag
crv = Curve(item.Item)
crv_2 = Curve(item.Item3)

divlength = DivideLength(Curve=item.Item, Length=number_of_verticals)  # -> Points, Tangents, Parameters
lng = ListLength(List=divlength.Points)  # -> simplify(Length)

divide = DivideCurve(Curve=reparameterize(simplify(crv)), Count=lng, Kinks=False)  # -> Points, Tangents, Parameters
divide_2 = DivideCurve(Curve=reparameterize(simplify(crv_2)), Count=lng, Kinks=False)  # -> Points, Tangents, Parameters

ln = Line(StartPoint=divide.Points, EndPoint=divide_2.Points)  # -> simplify(Line)
tstat = TreeStatistics(Tree=ln)  # -> Paths, Length, Count
lng_2 = ListLength(List=ln)
series = Series(Start=random_seed, Step=1, Count=tstat.Count)  # -> graft(Series)
expression_3 = Expression(x=lng_2, y=percentage_of_reduction, Expression="x*y")
jitter = Jitter(List=ln, Jitter=1, Seed=series)  # -> Values, Indices

reduce = RandomReduce(List=jitter.Values, Reduction=expression_3, Seed=Slider(6, range=0..10))  # -> simplify(List)
mullions = Curve(reduce)
Z = UnitZ(Factor=expr("-x", expression_2))
Z_2 = UnitZ(Factor=expression_2)

dom = ConstructDomain(DomainStart=expression_2, DomainEnd=expr("-x", expression_2))
dom_2 = ConstructDomain(DomainStart=expression, DomainEnd=expr("-x", expression))

# ---- group: Creates the Mullions
curvepoint_2 = PointOnCurve(mullions, parameter=0)
srf = Surface(reparameterize(base_surface))
srf_cp = SurfaceClosestPoint(Point=curvepoint_2, Surface=srf)  # -> Point, UVPoint, Distance
evalsrf = EvaluateSurface(Surface=reparameterize(srf), Point=srf_cp.UVPoint)  # -> Point, Normal, UDirection, VDirection, Frame
pl = ConstructPlane(Origin=evalsrf.Point, XAxis=evalsrf.Normal, YAxis=evalsrf.UDirection)
rectangle = Rectangle(Plane=pl, XSize=dom_2, YSize=dom, Radius=0)  # -> simplify(graft(Rectangle)), Length
swp1 = Sweep1(Rail=graft(mullions), Sections=rectangle.Rectangle, Miter=1)

# ----
getsrflowerupperedges = GetSrfLowerUpperEdges(B=srf)  # -> i, item_3
create_mullion = CreateMullion(mullions=getsrflowerupperedges.i, A_2=expression, srf=base_surface, B_2=expression, A=expression_2, B=expression_2)
create_mullion_2 = CreateMullion(mullions=getsrflowerupperedges.item_3, A_2=expression, srf=base_surface, B_2=expression, A=expression_2, B=expression_2)
move = Move(Geometry=create_mullion, Motion=Z_2)  # -> Geometry, Transform
move_2 = Move(Geometry=create_mullion_2, Motion=Z)  # -> Geometry, Transform

# ---- group: Surface Splitting
srfsplit = SurfaceSplit(Surface=base_surface, Curves=reduce)  # -> simplify(Fragments)
jitter_2 = Jitter(List=srfsplit, Jitter=1, Seed=series)  # -> Values, Indices
jitter_3 = Jitter(List=jitter_2.Values, Jitter=1, Seed=series)  # -> Values, Indices
dispatch = Dispatch(List=jitter_3.Values, DispatchPattern=[True, False])  # -> ListA, ListB
dispatch_2 = Dispatch(List=dispatch.ListB, DispatchPattern=[True, False])  # -> ListA, ListB

# ----
panel = Panel(pl)
cap = CapHoles(Brep=[move_2.Geometry, move.Geometry])
cap_2 = CapHoles(Brep=swp1)
srf_2 = Surface(dispatch.ListA)
srf_3 = Surface(dispatch_2.ListA)
srf_4 = Surface(dispatch_2.ListB)

# ---- group: Output - Mullions
mullions_2 = Brep([cap_2, cap])

# ----
preview = CustomPreview(Geometry=srf_2, Material=ColourSwatch(SwatchColor=RGB(68, 86, 255)))
preview_2 = CustomPreview(Geometry=srf_3, Material=ColourSwatch(SwatchColor=RGB(95, 241, 156)))
preview_3 = CustomPreview(Geometry=srf_4, Material=ColourSwatch(SwatchColor=RGB(146, 56, 156)))

# ==== cluster GetSrfLowerUpperEdges
B = ClusterInput()
edges = BrepEdges(Brep=B)  # -> Naked, Interior, NonManifold
crv = Curve(edges.Naked)
midpt = CurveMiddle(Curve=crv)
pdecon = Deconstruct(Point=midpt)  # -> XComponent, YComponent, ZComponent
sort = SortList(Keys=pdecon.ZComponent, ValuesA=crv)  # -> Keys, ValuesA
item = ListItem(List=sort.ValuesA, Index=0, Wrap=True)  # -> Item, Item1, Item2, Item3
i = ClusterOutput(item.Item)
item_3 = ClusterOutput(item.Item3)

# ==== cluster CreateMullion
mullions = ClusterInput()
mullions_2 = Curve(mullions)
A = ClusterInput()
B = ClusterInput()
A_2 = ClusterInput()
B_2 = ClusterInput()

dom = ConstructDomain(DomainStart=A, DomainEnd=expr("-x", B))
dom_2 = ConstructDomain(DomainStart=A_2, DomainEnd=expr("-x", B_2))

srf = ClusterInput()

# ---- group: Creates the Mullions
curvepoint = PointOnCurve(mullions_2, parameter=0)
srf_2 = Surface(reparameterize(srf))
srf_cp = SurfaceClosestPoint(Point=curvepoint, Surface=srf_2)  # -> Point, UVPoint, Distance
evalsrf = EvaluateSurface(Surface=reparameterize(srf_2), Point=srf_cp.UVPoint)  # -> Point, Normal, UDirection, VDirection, Frame
pl = ConstructPlane(Origin=evalsrf.Point, XAxis=evalsrf.Normal, YAxis=evalsrf.VDirection)
rectangle = Rectangle(Plane=pl, XSize=dom_2, YSize=dom, Radius=0)  # -> simplify(graft(Rectangle)), Length
swp1 = Sweep1(Rail=graft(mullions_2), Sections=rectangle.Rectangle, Miter=1)

# ----
S = ClusterOutput(swp1)
