# Grasshopper definition Facade_Colorful Panels & Mullions 0.2.0.gh (Grasshopper 1.0.7)
# plug-ins: RhinoCodePluginGH

height = Slider(7.4, range=0..1000)
subdivisionnumber = Slider(2, range=0..1000)

number_of_verticals = Slider(2, range=0..60)
mullion_depth = Slider(1, range=0..36)
mullion_width = Slider(4, range=0..36)
random_seed = Slider(3, range=0..10)
percentage_of_reduction = Slider(0.4, range=0..1)

# ----
# REGULATED SPACING
sill_curve = Curve(<curve referenced from the Rhino model>)
Z = UnitZ(Factor=height)
expression = Expression(x=mullion_depth, Expression="(X/10)/2")
expression_2 = Expression(x=mullion_width, Expression="(X/10)/2")
range = Range(Domain=Domain(0, 1), Steps=subdivisionnumber)
move = Move(Geometry=sill_curve, Motion=Z)  # -> Geometry, Transform
S = Script(t=range)  # -> out, a; inputs t: list of Double
# ---------- S: Python ----------
t = list(t)
t.pop(0)
t.pop(-1)

a = t
# ---------- end S ----------
crv = Curve(sill_curve)
crv_2 = Curve(move.Geometry)
tweencrv = TweenCurve(CurveA=crv, CurveB=crv_2, Factor=S.a, BlendType=0)
entwine = Entwine(Branch00=crv, Branch01=tweencrv, Branch02=crv_2, FlattenInputs=True)  # -> flatten(Result)
python = GhPythonScript(curves=entwine)  # -> panel_list; inputs curves: list of Curve
# ---------- python: Python ----------
__author__ = "Iliya Muzychuk"
__version__ = "2023.02.03"

import rhinoscriptsyntax as rs
import Grasshopper as gh
import Rhino.Geometry as rg
import ghpythonlib.components as comps
import ghpythonlib.treehelpers as th 

panel_list = []

for i in range(0,len(curves)-1):
    
    sill = curves[i]
    head = curves[i+1]
    
    temp = [sill,head]

    panel_list.append(temp)

panel_list = th.list_to_tree(panel_list)
# ---------- end python ----------
pframe = PerpFrame(Curve=reparameterize(entwine), Parameter=0)

dom = ConstructDomain(DomainStart=expression_2, DomainEnd=expr("-x", expression_2))
dom_2 = ConstructDomain(DomainStart=expression, DomainEnd=expr("-x", expression))

item = ListItem(List=python, Index=0, Wrap=True)  # -> Item, Item1
divlength = DivideLength(Curve=item.Item, Length=number_of_verticals)  # -> Points, Tangents, Parameters
lng = ListLength(List=divlength.Points)  # -> simplify(Length)

rectangle = Rectangle(Plane=pframe, XSize=dom_2, YSize=dom, Radius=0)  # -> simplify(graft(Rectangle)), Length
swp1 = Sweep1(Rail=graft(entwine), Sections=rectangle.Rectangle, Miter=1)

divide = DivideCurve(Curve=reparameterize(simplify(item.Item)), Count=lng, Kinks=False)  # -> Points, Tangents, Parameters
divide_2 = DivideCurve(Curve=reparameterize(simplify(item.Item1)), Count=lng, Kinks=False)  # -> Points, Tangents, Parameters

hframe = HorizontalFrame(Curve=reparameterize(item.Item), Parameter=divide.Parameters)
ln = Line(StartPoint=divide.Points, EndPoint=divide_2.Points)  # -> simplify(Line)
mullions = Curve(ln)

dom_3 = ConstructDomain(DomainStart=expression_2, DomainEnd=expr("-x", expression_2))
dom_4 = ConstructDomain(DomainStart=expression, DomainEnd=expr("-x", expression))

rectangle_2 = Rectangle(Plane=hframe, XSize=dom_4, YSize=dom_3, Radius=0)  # -> simplify(graft(Rectangle)), Length
swp1_2 = Sweep1(Rail=graft(mullions), Sections=rectangle_2.Rectangle, Miter=1)

cap = CapHoles(Brep=swp1_2)

# ---- group: Output - Mullions
mullions_2 = Brep(flatten(cap))

# ----
tstat = TreeStatistics(Tree=mullions_2)  # -> Paths, Length, Count
lng_2 = ListLength(List=mullions_2)
series = Series(Start=random_seed, Step=1, Count=tstat.Count)  # -> graft(Series)
expression_3 = Expression(x=lng_2, y=percentage_of_reduction, Expression="x*y")
jitter = Jitter(List=mullions_2, Jitter=1, Seed=series)  # -> Values, Indices

reduce = RandomReduce(List=flatten(jitter.Values), Reduction=flatten(expression_3), Seed=Slider(7, range=0..10))  # -> simplify(List)
merge = Merge(Data1=flatten(reduce), Data2=flatten(swp1))
cap_2 = CapHoles(Brep=merge)
