# Grasshopper definition Facade_Glass & Mullions 0.1.0.gh (Grasshopper 1.0.8)

base_surface = Geometry(graft(<surface referenced from the Rhino model>))
debrep = DeconstructBrep(Brep=base_surface)  # -> Faces, Edges, Vertices
divide = DivideDomain²(Domain=base_surface, UCount=Slider(3, range=0..10), VCount=Slider(3, range=0..10))
join = JoinCurves(Curves=debrep.Edges, Preserve=False)
createframinglines = GhPythonScript(srf=base_surface, direction=Toggle(False), distance=Slider(4, range=0..4))  # -> framing_lines, sillCurve, headCurve; inputs srf: Surface
# ---------- createframinglines: Python ----------
__author__ = "ilouh"
__version__ = "2023.02.21"

import rhinoscriptsyntax as rs
import Grasshopper as gh
import Rhino.Geometry as rg
import ghpythonlib.components as comps
import math


untrim_sruface = comps.Untrim(srf)



def framing (crvs,distance):
    
    crv_01 = crvs[0]
    crv_02 = comps.FlipCurve(crvs[1])['curve']
    
    spacing = comps.Length(crv_01)/distance
    
    points_01 = comps.DivideCurve(crv_01,spacing,False)['points']
    points_02 = comps.DivideCurve(crv_02,spacing,False)['points']

    zipped_points = list(zip(points_01,points_02))
    
    framing_members = []
    
    for pair in zipped_points:
        
        line = comps.Line(pair[0],pair[1])
        framing_members.append(line)
        
    
    return framing_members,crv_01,crv_02


edges = comps.DeconstructBrep(untrim_sruface)['edges']
edge_lengths = comps.Length(edges)

sorted_list = list(zip(edges,edge_lengths))
sorted_list = sorted(sorted_list, key = lambda x: x[1])

crvs, lengths = zip(*sorted_list)

shortest_crvs = [crvs[0],crvs[1]]
longest_crvs = [crvs[2],crvs[3]]


if direction:
    
    framing_lines = framing(shortest_crvs,distance)[0]
    sillCurve = longest_crvs[1]
    headCurve = longest_crvs[0]


else: 
    
    framing_lines = framing(longest_crvs,distance)[0]
    sillCurve = longest_crvs[1]
    headCurve = longest_crvs[0]
# ---------- end createframinglines ----------
surfaceboundary = GhPythonScript(curve=join, distance=Slider(0.1, range=0..0.1), frameDepth=Slider(0.3, range=0..1))  # -> windowFrame, windowGlazing; inputs curve: Curve
# ---------- surfaceboundary: Python ----------
__author__ = "ilouh"
__version__ = "2023.02.21"

import rhinoscriptsyntax as rs
import Grasshopper as gh
import Rhino.Geometry as rg
import ghpythonlib.components as comps
import math


def createFrame(crv,distance,frameDepth):
    
    offset_1 = comps.OffsetCurve(crv,distance,corners = 1)
    offset_2 = comps.OffsetCurve(crv,-distance,corners = 1)
    
    if comps.Length(offset_1) > comps.Length(offset_2): 
        srf = comps.BoundarySurfaces([crv,offset_2])
        point = comps.ConstructPoint(0.5,0.5,0)
        normal = comps.EvaluateSurface(srf,point)['normal']
        brep = comps.Extrude(srf,comps.Amplitude(normal,frameDepth))
        brep = comps.Move(brep,comps.Amplitude(normal,-frameDepth/2))['geometry']
        return brep,comps.BoundarySurfaces(offset_2)

    
    else:
        srf =  comps.BoundarySurfaces([crv,offset_1])
        point = comps.ConstructPoint(0.5,0.5,0)
        normal = comps.EvaluateSurface(srf,point)['normal']
        brep = comps.Extrude(srf,comps.Amplitude(normal,frameDepth))
        brep = comps.Move(brep,comps.Amplitude(normal,-frameDepth/2))['geometry']
        return brep,comps.BoundarySurfaces(offset_1)



windowFrame = createFrame(curve,distance,frameDepth)[0]
windowGlazing = createFrame(curve,distance,frameDepth)[1]
# ---------- end surfaceboundary ----------
crv = Curve(createframinglines.framing_lines)
crv_2 = Curve(createframinglines.headCurve)
crv_3 = Curve(createframinglines.sillCurve)
brep = Brep(surfaceboundary.windowFrame)
brep_2 = Brep(surfaceboundary.windowGlazing)
