# Grasshopper definition Facade_NonUniformSurfacePanelingByCurves.gh (Grasshopper 1.0.7)

number_slider = Slider(0, range=0..10)
crv = Curve([<curve referenced from the Rhino model> x10])
number_slider_2 = Slider(6, range=0..10)
item = ListItem(List=crv, Index=0, Wrap=True)
midpt = CurveMiddle(Curve=crv)
pdecon = Deconstruct(Point=midpt)  # -> XComponent, YComponent, ZComponent
sort = SortList(Keys=pdecon.ZComponent, ValuesA=crv)  # -> Keys, ValuesA
split = SplitList(List=sort.ValuesA, Index=Slider(1, range=0..100))  # -> ListA, ListB
panel = Panel(split.ListA)
panel_2 = Panel(split.ListB)
divlength = DivideLength(Curve=split.ListA, Length=Slider(8, range=0..100))  # -> Points, Tangents, Parameters
lng = ListLength(List=divlength.Points)
Z = UnitZ(Factor=1)
divide = DivideCurve(Curve=split.ListA, Count=lng, Kinks=False)  # -> Points, Tangents, Parameters
project = ProjectPoint(Point=divide.Points, Direction=Z, Geometry=graft(split.ListB))  # -> Point, Index
crv_2 = Curve(reparameterize(sort.ValuesA))
python = GhPythonScript(sill_curve_points=divide.Points, curve_points=project.Point, curves=crv_2)  # -> simplify(out_tree), t_param_out; inputs sill_curve_points: list of Point3d, curve_points: tree of Point3d, curves: list of Curve
# ---------- python: Python ----------
__author__ = "Brooks Scarpa"
__version__ = "2023.07.21"

import rhinoscriptsyntax as rs
from ghpythonlib import components as comps 
from ghpythonlib import treehelpers as th 

sill_curve_points = sill_curve_points
curve_points_list = th.tree_to_list(curve_points)
curve_points_list = curve_points_list[0][0]

curve_points_list.insert(0,sill_curve_points) 

th_out = [] 
for points in curve_points_list: 
    th_out.append(points)

out_tree = th.list_to_tree(th_out)


curve_points = th_out 

t_list = [] 

for i in range(0,len(curves)):
    
    crv = curves[i]
    points = curve_points[i]
    temp_list = [] 
    for point in points: 
        
        temp = comps.CurveClosestPoint(point,crv)
        print(temp)
        t = temp['parameter']
        temp_list.append(t)
    t_list.append(temp_list)

t_param_out = th.list_to_tree(t_list)
# ---------- end python ----------
panel_3 = Panel(python.t_param_out)
shatter = Shatter(Curve=graft(crv_2), Parameters=python.t_param_out)  # -> simplify(Segments)
crv_3 = Curve(split.ListA)
flip = FlipMatrix(Data=shatter)
toggle = BooleanToggle(False)
pframe = PerpFrame(Curve=reparameterize(crv_3), Parameter=0.5)
shift = ShiftList(List=flip, Shift=1, Wrap=toggle)
shift_2 = ShiftList(List=flip, Shift=-1, Wrap=toggle)
deplane = DeconstructPlane(Plane=pframe)  # -> Origin, XAxis, YAxis, ZAxis
merge = Merge(Data1=graft(shift), Data2=graft(shift_2))
pl = ConstructPlane(Origin=deplane.Origin, XAxis=deplane.YAxis, YAxis=deplane.ZAxis)
loft = Loft(Curves=merge, Options={Adjust=False, Closed=False, LoftEnds=0, LoftSimp=0, LoftType=0, Rebuild=10, Refit=0.01})
flatten = FlattenTree(Tree=loft, Path="{0}")
md_slider = MDSlider(SliderMode=0, slider_value=Point(0.5, 0.5, 0.5), x_domain=Domain(0, 1), y_domain=Domain(0, 1), z_domain=Domain(0, 1))
debrep = DeconstructBrep(Brep=flatten)  # -> Faces, Edges, Vertices
number_slider_3 = Slider(3, range=0..10)
evalsrf = EvaluateSurface(Surface=reparameterize(flatten), Point=md_slider)  # -> Point, Normal, UDirection, VDirection, Frame
pl_origin = PlaneOrigin(Base=pl, Origin=evalsrf.Point)
item_2 = ListItem(List=debrep.Vertices, Index=0, Wrap=True)  # -> Item, Item1, Item2
dist = Distance(PointA=item_2.Item, PointB=item_2.Item2)  # -> expr("x/5", Distance)
dom = ConstructDomain(DomainStart=dist, DomainEnd=expr("-x", dist))
dom_2 = ConstructDomain(DomainStart=number_slider_3, DomainEnd=expr("-x", number_slider_3))
rectangle = Rectangle(Plane=graft(pl_origin), XSize=dom, YSize=dom_2, Radius=0)  # -> Rectangle, Length
boundary = BoundarySurfaces(Edges=rectangle.Rectangle)
brep = Brep(boundary)
number_slider_4 = Slider(6, range=0..10)
splitmul = SplitBrepMultiple(Brep=brep, Cutters=brep)
lng_2 = ListLength(List=boundary)
