# Grasshopper definition Facade_Panelization By Image Sampler 0.1.1.gh (Grasshopper 1.0.8)
# plug-ins: LunchBox

panel_surface_or_polysurface = Brep(<brep referenced from the Rhino model>)
bake_true_false = BooleanToggle(True)
flip_sill_curve_if_needed = BooleanToggle(False)
horizontal_spacing = Slider(0.8, range=0..10)
vertical_spacing = Slider(0.5, range=0..10)
input_surface = Surface(reparameterize(graft(<surface referenced from the Rhino model>)))
rotation_coefficient = Slider(2, range=1..10)

# ---- group: Get Surface Edges
getsrflowerupperedges = GetSrfLowerUpperEdges(B=input_surface)  # -> i, item_3
loweredge = Curve(getsrflowerupperedges.i)
upperedge = Curve(getsrflowerupperedges.item_3)

# ----
len = Length(Curve=loweredge)
expression = Expression(x=len, y=horizontal_spacing, Expression="Floor(Round(x/y))")
Z = UnitZ(Factor=1)
divide = DivideCurve(Curve=loweredge, Count=expression, Kinks=False)  # -> Points, Tangents, Parameters
project = ProjectPoint(Point=divide.Points, Direction=Z, Geometry=upperedge)  # -> Point, Index

flip = FlipCurve(Curve=upperedge)  # -> Curve, Flag
filter = StreamFilter(Gate=flip_sill_curve_if_needed, Stream0=upperedge, Stream1=flip.Curve)
divide_2 = DivideCurve(Curve=filter, Count=expression, Kinks=False)  # -> Points, Tangents, Parameters

ln = Line(StartPoint=divide.Points, EndPoint=divide_2.Points)

axis_lines = Curve(ln)

# ---- group: mul
python = GhPythonScript(x=axis_lines)  # -> li_points, curves; inputs x: list of Curve
# ---------- python: Python ----------
__author__ = "Brooks Scarpa"
__version__ = "2020.06.22"

import rhinoscriptsyntax as rs
import ghpythonlib as gh

curves = x 
t = 0.5

li_points = []

for curve in curves:
    midpoints = gh.components.EvaluateCurve(curve,t)
    midpoints = midpoints[0]
    crv_midpoint = midpoints[1]
    
    li_points.append(crv_midpoint)
# ---------- end python ----------
loft = Loft(Curves=axis_lines, Options={Adjust=False, Closed=False, LoftEnds=0, LoftSimp=0, LoftType=0, Rebuild=10, Refit=0.01})
sort = SortList(Keys=python.li_points, ValuesA=python.curves)  # -> Keys, ValuesA
python_2 = GhPythonScript(curves=simplify(graft(sort.ValuesA)), segment=vertical_spacing)  # -> points; inputs curves: list of Curve
# ---------- python_2: Python ----------
__author__ = "Brooks Scarpa"
__version__ = "2020.06.22"

import rhinoscriptsyntax as rs
import ghpythonlib as gh


li_points = []
segment = segment
for curve in curves:
    
    points = rs.DivideCurveLength(curve,segment,create_points = True)
    
    print(points)
# ---------- end python_2 ----------
xy = XYPlane(Origin=Point(0, 0, 0))
mesh = Mesh(panel_surface_or_polysurface)
panel = Panel(python_2)
python_3 = GhPythonScript(mesh=mesh, x=xy)  # -> center; inputs mesh: Mesh, x: Plane
# ---------- python_3: Python ----------
__author__ = "Brooks Scarpa"
__version__ = "2020.06.22"

import rhinoscriptsyntax as rs
import ghpythonlib as gh

bbox = gh.components.BoundingBox(mesh,x)
bbox = bbox[0]

center = gh.components.Volume(bbox)
center = center[1]
# ---------- end python_3 ----------
xy_2 = XYPlane(Origin=python_3)
xy_3 = XYPlane(Origin=panel)
orient = Orient(Geometry=mesh, Source=xy_2, Target=xy_3)  # -> Geometry, Transform

surface_points_where_bricks_rotate = Point(simplify(python_2))
input_surface_2 = Surface(loft)
srf_cp = SurfaceClosestPoint(Point=surface_points_where_bricks_rotate, Surface=reparameterize(input_surface_2))  # -> Point, UVPoint, Distance

# ----
image = ImageSampler(srf_cp.UVPoint, Filter="Colour", Interpolate=False, Umax=1, Umin=0, Vmax=1, Vmin=0, Wrap=0)

# ---- group: mul (continued)
panel_2 = Panel(image)
python_4 = GhPythonScript(x=panel_2, mul=rotation_coefficient)  # -> simplify(x)
# ---------- python_4: Python ----------
__author__ = "Brooks Scarpa"
__version__ = "2020.06.22"

import rhinoscriptsyntax as rs
import math
import ghpythonlib as gh
print(type(x))

str = x 

x = str.split(',')
x = [int(x) for x in x]
x = gh.components.Average(x)

x = gh.components.RemapNumbers(x,[0,255],[0,45])

x = math.floor(x[1])

x = x*mul
# ---------- end python_4 ----------
panel_3 = Panel(python_4)
rotate = Rotate(Geometry=orient.Geometry, Angle=degrees(panel_3), Plane=xy_3)  # -> Geometry, Transform

# ---- group: Output - Bricks
bricks_mesh = Mesh(flatten(rotate.Geometry))

# ---- group: Rotation Angles
tag = TextTag(Location=panel, Text=python_4)

# ----
group = Group(Objects=bricks_mesh)
bake = ObjectBake(
    BakeToggle=bake_true_false,
    GeometryObjects=group,
    Layer="03_ARCH_FACADE*03_SCREEN ELEMENT",
    ObjectName="GH_Obj",
    ObjectColor=RGB(255, 255, 255),
    LayerColor=RGB(255, 255, 255))
preview = CustomPreview(
    Geometry=group,
    Material={diffuse=RGB(221, 160, 221), emission=RGB(66, 48, 66), shine=0.5, specular=RGB(255, 255, 255), transparency=0})

# ==== cluster GetSrfLowerUpperEdges
B = ClusterInput()
edges = BrepEdges(Brep=B)  # -> Naked, Interior, NonManifold
crv = Curve(edges.Naked)
midpt = CurveMiddle(Curve=crv)
pdecon = Deconstruct(Point=midpt)  # -> XComponent, YComponent, ZComponent
sort = SortList(Keys=pdecon.ZComponent, ValuesA=crv)  # -> Keys, ValuesA
item = ListItem(List=sort.ValuesA, Index=0, Wrap=True)  # -> Item, Item1, Item2, Item3
i = ClusterOutput(item.Item)
item_3 = ClusterOutput(item.Item3)
