# Grasshopper definition Facade_RepeartingProfile (Angle Lake).gh (Grasshopper 1.0.7)
# plug-ins: ShapeDiverForGrasshopper

# ---- group: Choosing a Profile
profile_selector = Slider(0, range=0..10)
angle_lake = Curve(<curve referenced from the Rhino model>)
profile_0 = Curve(<curve referenced from the Rhino model>)
profile_1 = Curve(<curve referenced from the Rhino model>)
profile_2 = Curve([<curve referenced from the Rhino model> x2])
stream_filter = StreamFilter(Gate=profile_selector, Stream0=profile_0, Stream1=profile_1, Stream2=profile_2, Stream3=angle_lake)

# ---- group: Bottom Crv
bottom_curve = Curve(<curve referenced from the Rhino model>)

# ----
distance_on_center = Slider(20, range=1..300)
sddp = ShapeDiverDocumentPayload({AbsoluteTolerance=0, AngleTolerance=0, DistanceDisplayPrecision=0, GltfVersion="Gltf2", InputGroups="{}", OutputGroups="{}", RelativeTolerance=0, UnitSystem=0, VersionCreated="1.14.0.0", VersionSaved="1.13.1.0"})

# ---- group: Top Crv
top_curve = Curve(<curve referenced from the Rhino model>)

# ----
divlength = DivideLength(Curve=top_curve, Length=distance_on_center)  # -> Points, Tangents, Parameters
lng = ListLength(List=divlength.Points)

# ---- group: Creating Crv's from Points
divide_curve = DivideCurve(Curve=top_curve, Count=lng, Kinks=False)  # -> Points, Tangents, Parameters
divide_curve_2 = DivideCurve(Curve=bottom_curve, Count=lng, Kinks=False)  # -> Points, Tangents, Parameters
line = Line(StartPoint=divide_curve.Points, EndPoint=divide_curve_2.Points)

# ---- group: Defining Endpoints
end_points = EndPoints(Curve=line)  # -> Start, End
curve_closest_point = CurveClosestPoint(Point=end_points.End, Curve=bottom_curve)  # -> Point, Parameter, Distance

# ---- group: Matching Frame Direction
horizontal_frame = HorizontalFrame(Curve=bottom_curve, Parameter=curve_closest_point.Parameter)  # -> simplify(graft(Frame))
perp_frames = PerpFrames(Curve=line, Count=1, Align=True)  # -> simplify(Frames), Parameters
align_planes = AlignPlanes(Planes=perp_frames.Frames, Master=horizontal_frame)

# ---- group: Orienting Profile Along Crv
curve = Curve(stream_filter)
bounding_box = BoundingBox(Content=curve, Plane=PlaneXY(0, 0, 0))  # -> Box, Box_2
volume = Volume(Geometry=bounding_box.Box)  # -> Volume, Centroid
xy_plane = XYPlane(Origin=volume.Centroid)
orient = Orient(Geometry=curve, Source=xy_plane, Target=align_planes)  # -> Geometry, Transform

# ---- group: Lofting Profile Between Crv's
loft = Loft(Curves=orient.Geometry, Options={Adjust=False, Closed=False, LoftEnds=0, LoftSimp=0, LoftType=0, Rebuild=10, Refit=0.01})

# ---- group: Output
custom_preview = CustomPreview(Geometry=loft, Material=ColourSwatch(SwatchColor=RGB(94, 56, 255)))
