# Grasshopper definition Facade_Roseland Concept.gh (Grasshopper 1.0.7)
# plug-ins: ShapeDiverForGrasshopper

massing = Brep(<brep referenced from the Rhino model>)
number_slider = Slider(1.2, range=0..10)
extrusion = Slider(0.1, range=0..1)
brick_subdivision = Slider(20, range=0..100)
number_slider_2 = Slider(4, range=0..100)
distributefaces = GhPythonScript(Massing=simplify(massing))  # -> floor, walls, roof, massing_height; inputs Massing: list
# ---------- distributefaces: Python ----------
__author__ = "ilouh"
__version__ = "2023.01.08"

import rhinoscriptsyntax as rs
import ghpythonlib.components as comps
import Rhino.Geometry as geom

def getSrfElevation(surface):
    
    centerPoint = comps.EvaluateSurface(surface,comps.ConstructPoint(0.5,0.5,0))['point']
    elevation = centerPoint[2]
    
    return elevation

roof = []
floor = []
walls = [] 

roof_elevations = []
floor_elevations = []

#find the normal of each face

faces = comps.DeconstructBrep(Massing)['faces']
evaluation_point = comps.ConstructPoint(x_coordinate = 0.5, y_coordinate = 0.5, z_coordinate = 0)

for face in faces: 
    
    vector = comps.EvaluateSurface(face,evaluation_point)['normal']
    
    
    vector_a = comps.VectorXYZ(x_component = vector[0], y_component = vector[1], z_component = vector[2])['vector']
    vector_b = comps.UnitZ(1)

    cross_product = comps.CrossProduct(vector_a,vector_b,True)['vector']
    dot_product = round(comps.DotProduct(vector_a,vector_b,True),4)
    
    print(dot_product)
    
    if abs(dot_product) == 0: 
        walls.append(face)
    
    if dot_product > 0: 
        roof.append(face)
        roof_elevations.append(getSrfElevation(face))
        
        
    if dot_product == -1: 
        floor.append(face)
        floor_elevations.append(getSrfElevation(face))

#sort surface elevations

lowest_floor_elevation = floor_elevations.sort()
lowest_roof_elevation = roof_elevations.sort()

#select lowest floor and heights roof elevations

lowest_floor_elevation = floor_elevations[0]
lowest_roof_elevation = roof_elevations[-1]

#calculates massing height

massing_height = round(lowest_roof_elevation - lowest_floor_elevation,2)
# ---------- end distributefaces ----------
sddp = ShapeDiverDocumentPayload()
expression = Expression(n=number_slider_2, Expression="1/n")
srf = Surface(reparameterize(graft(distributefaces.walls)))
series = Series(Start=0, Step=expression, Count=number_slider_2)
python = GhPythonScript(brep=srf)  # -> edge_1, edge_2; inputs brep: Brep
# ---------- python: Python ----------
__author__ = "Iliya Muzychuk"
__version__ = "2023.02.03"

import rhinoscriptsyntax as rs
import Grasshopper as gh
import Rhino.Geometry as rg
import ghpythonlib.components as comps


def findLowestEdge(brep):
    
    upperChords = [] 
    lowerChords = [] 
    verticalEdges = []
    
    chords = []
    
    edges = comps.DeconstructBrep(brep)['edges']

    for edge in edges: 
        
        vector = comps.Vector2Pt(comps.EndPoints(edge)['start'],comps.EndPoints(edge)['end'],True)['vector']
        dot_product_z = comps.DotProduct(vector,comps.UnitZ(1),True)
        
        if dot_product_z != 0 and abs(round(dot_product_z,2)) != 1: 
            
            upperChords.append(edge)
        
        elif dot_product_z == 0:
            
            lowerChords.append(edge)
        
        else:
            verticalEdges.append(edge)

    return verticalEdges


if __name__ == "__main__":
    
    
    verticalEdges = findLowestEdge(brep)
    
    edge_1 = verticalEdges[0]
    edge_2 = verticalEdges[1]
# ---------- end python ----------
graph = GraphMapper(
    series,
    x0=0,
    x1=1,
    y0=0,
    y1=1,
    container_name="Bezier",
    cpx=[0, 0.7484427094, 0.4028992653, 1],
    cpy=[0, 0.4564487338, 0.6449270844, 1])
ins = InsertItems(List=graph, Item=1, Indices=-1, Wrap=True)

dom = ConstructDomain(DomainStart=0, DomainEnd=distributefaces.massing_height)
remap = RemapNumbers(Value=ins, Source=Domain(0, 1), Target=dom)  # -> Mapped, Clipped
pt = ConstructPoint(XCoordinate=0, YCoordinate=0, ZCoordinate=remap.Clipped)
crv_cp = CurveClosestPoint(Point=pt, Curve=python.edge_2)  # -> Point, Parameter, Distance
crv_cp_2 = CurveClosestPoint(Point=pt, Curve=python.edge_1)  # -> Point, Parameter, Distance
ln = Line(StartPoint=crv_cp_2.Point, EndPoint=crv_cp.Point)

python_2 = GhPythonScript(lines=simplify(ln))  # -> bottom_edge, upper_edge; inputs lines: list
# ---------- python_2: Python ----------
__author__ = "ilouh"
__version__ = "2023.02.21"

import rhinoscriptsyntax as rs
import Grasshopper as gh
import Rhino.Geometry as rg
import ghpythonlib.components as comps
from ghpythonlib import treehelpers as th
import math

line_groups = [] 
bottom_edge = [] 
upper_edge = []

consecutive_pairs = []

# Iterate through the list with a step of 1
for i in range(len(lines) - 1):
    pair = [lines[i], lines[i + 1]]  # Get the current and next elements
    consecutive_pairs.append(pair)  # Add the pair to the list
    
    bottom_edge.append(lines[i])
    upper_edge.append(lines[i+1])

print(consecutive_pairs)
groups = th.list_to_tree(consecutive_pairs)
# ---------- end python_2 ----------

merge = Merge(Data1=graft(python_2.bottom_edge), Data2=graft(python_2.upper_edge))  # -> simplify(Result)
tstat = TreeStatistics(Tree=merge)  # -> Paths, Length, Count
series_2 = Series(Start=Slider(4, range=0..10), Step=1, Count=tstat.Count)
random = Random(Range=Domain(0, 1), Number=Slider(5, range=0..10), Seed=series_2)
ins_2 = InsertItems(List=random, Item=0, Indices=0, Wrap=True)
ins_3 = InsertItems(List=ins_2, Item=1, Indices=-1, Wrap=True)
sort = SortList(Keys=ins_3)  # -> expr("round(x,2)", simplify(Keys)), ValuesA
eval = EvaluateCurve(Curve=reparameterize(graft(python_2.bottom_edge)), Parameter=sort.Keys)  # -> simplify(Point), Tangent, Angle
eval_2 = EvaluateCurve(Curve=reparameterize(graft(python_2.upper_edge)), Parameter=sort.Keys)  # -> simplify(Point), Tangent, Angle

ln_2 = Line(StartPoint=eval.Point, EndPoint=eval_2.Point)
python_3 = GhPythonScript(lines=simplify(ln_2))  # -> graft(bottom_edge), graft(upper_edge); inputs lines: list; same code as python_2
merge_2 = Merge(Data1=python_3.bottom_edge, Data2=python_3.upper_edge)
loft = Loft(Curves=merge_2, Options={Adjust=False, Closed=False, LoftEnds=0, LoftSimp=0, LoftType=0, Rebuild=10, Refit=0.01})  # -> simplify(Loft)
srf_2 = Surface(reparameterize(graft(distributefaces.walls)))
path_mapper = PathMapper(loft, source="{A;B;C}", target="{A}")
evalsrf = EvaluateSurface(Surface=srf_2, Point="0.5,0.5,0")  # -> Point, Normal, UDirection, VDirection, Frame
amp = Amplitude(Vector=evalsrf.Normal, Amplitude=Slider(2, range=0..10))
extr = Extrude(Base=path_mapper, Direction=amp)
bbox = BoundingBox(Content=extr, Plane=evalsrf.Frame)  # -> Box, Box_2
boxmap = BoxMapping(Target=bbox.Box)  # -> Geometry, Transform
