# Grasshopper definition Facade_Sidings.gh (Grasshopper 1.0.8)
# plug-ins: CORE.Toolbox.Grasshopper

pipeline = GeometryPipeline(
    GroupByLayer=False,
    GroupByType=False,
    IncludeHidden=True,
    IncludeLocked=True,
    LayerFilter="03_ARCH*03_SIDING",
    NameFilter="*",
    SublayerFiltering=True,
    TypeFilter=1073741848)

list = ValueList({"Running Bond": 0, "Stacking Bond": 1}, selected="Stacking Bond")
checkboard_mirroring = BooleanToggle(False)
flip_surface_inboard_outboard = BooleanToggle(True)
facade_panel_u_size = Slider(50, range=0..50)
facade_panel_v_size = Slider(6, range=0..50)
# REGULATED SPACING
facade_depth = Slider(1, range=0..10)

# ---- group: Input Surface
srf = Surface(graft(<surface referenced from the Rhino model>))

# ----
units = ConvertUnits(Value=facade_depth, Source=3, Target=4, Exponent=1)  # -> Result, Factor
units_2 = ConvertUnits(Value=facade_panel_v_size, Source=3, Target=4, Exponent=1)  # -> Result, Factor
flatten = FlattenTree(Tree=srf, Path="{0}")  # -> graft(Tree)
evalsrf = EvaluateSurface(Surface=reparameterize(flatten), Point="{0.5,0.5,0}")  # -> Point, Normal, UDirection, VDirection, Frame

srf_2 = Surface(reparameterize(flatten))
python = PythonScript(s=srf_2, swapUV=Toggle(True), reverseU=Toggle(True), reverseV=Toggle(True))  # -> out, anchor, uVec, vVec, revSrf; inputs s: Surface, swapUV: Int32, reverseU: Int32, reverseV: Int32
# ---------- python: Python ----------
import Rhino

if reverseU:
    uS,uE = s.Domain(0)
    inter0 = Rhino.Geometry.Interval(-uE, -uS)
    s.SetDomain(0,inter0)
    s = s.Reverse(0)

if reverseV:
    vS,vE = s.Domain(1)
    inter1 = Rhino.Geometry.Interval(-vE, -vS)
    s.SetDomain(1,inter1)
    s = s.Reverse(1)

if swapUV:
    s = s.Transpose()

anchor = s.PointAt(0,0)
uend = s.PointAt(0.5,0)
vend = s.PointAt(0,0.5)
uVec = uend - anchor
vVec = vend - anchor

revSrf = s
# ---------- end python ----------

box_morphing_facade = BoxMorphingFacade(
    checkboard_mirroring=checkboard_mirroring,
    flip_surface_inboard_outboard=flip_surface_inboard_outboard,
    input_surface=python.revSrf,
    panel_v_size=units_2.Result,
    facade_depth=units.Result)
output_group = Group(Objects=box_morphing_facade)

# ==== cluster BoxMorphingFacade
flip_surface_inboard_outboard = ClusterInput()
checkboard_mirroring = ClusterInput()
input_surface = ClusterInput()
panel_v_size = ClusterInput()
facade_depth = ClusterInput()
flip_surface_inboard_outboard_2 = Boolean(flip_surface_inboard_outboard)
checkboard_mirroring_2 = Boolean(checkboard_mirroring)
input_surface_2 = Surface(reparameterize(input_surface))
panel_v_size_2 = Number(panel_v_size)
facade_depth_2 = Number(facade_depth)

dim = Dimensions(Surface=input_surface_2)  # -> UDimension, VDimension
expression = Expression(x=dim.VDimension, y=panel_v_size_2, Expression="round(x/y)")

md_slider = MDSlider(SliderMode=0, slider_value=Point(0.5, 0.5, 0.5), x_domain=Domain(0, 1), y_domain=Domain(0, 1), z_domain=Domain(0, 1))
divide = DivideDomain²(Domain=input_surface_2, UCount=1, VCount=expression)
subsrf = Isotrim(Surface=input_surface_2, Domain=divide)
evalsrf = EvaluateSurface(Surface=reparameterize(subsrf), Point=md_slider)  # -> Point, Normal, UDirection, VDirection, Frame
scale_nu = ScaleNU(Geometry=subsrf, Plane=evalsrf.Frame, ScaleX=1, ScaleY=Slider(0.8, range=0..1), ScaleZ=1)  # -> Geometry, Transform
amp = Amplitude(Vector=evalsrf.Normal, Amplitude=facade_depth_2)
extr = Extrude(Base=scale_nu.Geometry, Direction=amp)
E = ClusterOutput(extr)
