# Grasshopper definition Facade_Storefront & Mullions 0.1.0.gh (Grasshopper 1.0.7)

# ---- group: Base Surface
# REGULATED SPACING
base_surface = Geometry(graft([<brep referenced from the Rhino model> x47]))

# ---- group: Distance Between Verticals
spacing = Slider(4, range=0..60)

# ---- group: Vertical Width
mullion_depth = Slider(6, range=0..36)

# ---- group: Vertical Depth
mullion_width = Slider(2, range=0..36)

# ----
expression = Expression(x=mullion_depth, Expression="(X/12)/2")
expression_2 = Expression(x=mullion_width, Expression="(X/12)/2")

edges = BrepEdges(Brep=base_surface)  # -> Naked, Interior, NonManifold
curvepoint = PointOnCurve(edges.Naked, parameter=0.5)
pdecon = Deconstruct(Point=curvepoint)  # -> XComponent, YComponent, ZComponent
sort = SortList(Keys=pdecon.ZComponent, ValuesA=edges.Naked)  # -> Keys, ValuesA
item = ListItem(List=reverse(sort.ValuesA), Index=0, Wrap=True)  # -> Item, Item1, Item2, Item3

flip = FlipCurve(Curve=item.Item3, Guide=item.Item)  # -> Curve, Flag
crv = Curve(item.Item)
crv_2 = Curve(flip.Curve)

divlength = DivideLength(Curve=item.Item, Length=spacing)  # -> Points, Tangents, Parameters
lng = ListLength(List=divlength.Points)  # -> simplify(Length)

divide = DivideCurve(Curve=reparameterize(simplify(crv)), Count=lng, Kinks=False)  # -> Points, Tangents, Parameters
divide_2 = DivideCurve(Curve=reparameterize(simplify(crv_2)), Count=lng, Kinks=False)  # -> Points, Tangents, Parameters

dom = ConstructDomain(DomainStart=expression_2, DomainEnd=expr("-x", expression_2))  # disabled
dom_2 = ConstructDomain(DomainStart=expression, DomainEnd=expr("-x", expression))  # disabled

ln = Line(StartPoint=divide.Points, EndPoint=divide_2.Points)
mullions = Curve(ln)  # disabled

# ---- group: Creates the Mullions
curvepoint_2 = PointOnCurve(mullions, parameter=0)  # disabled
srf = Surface(reparameterize(base_surface))  # disabled
srf_cp = SurfaceClosestPoint(Point=curvepoint_2, Surface=srf)  # -> Point, UVPoint, Distance; disabled
evalsrf = EvaluateSurface(Surface=reparameterize(srf), Point=srf_cp.UVPoint)  # -> Point, Normal, UDirection, VDirection, Frame; disabled
pl = ConstructPlane(Origin=evalsrf.Point, XAxis=evalsrf.Normal, YAxis=evalsrf.UDirection)  # disabled
rectangle = Rectangle(Plane=pl, XSize=dom_2, YSize=dom, Radius=0)  # -> simplify(graft(Rectangle)), Length; disabled
swp1 = Sweep1(Rail=simplify(graft(mullions)), Sections=rectangle.Rectangle, Miter=1)  # disabled

# ----
srf_2 = Surface(base_surface)  # disabled
swatch = ColourSwatch(SwatchColor=RGBA(68, 86, 255, 72))  # disabled
preview = CustomPreview(Geometry=srf_2, Material=swatch)  # disabled
cap = CapHoles(Brep=swp1)  # disabled

# ---- group: Output - Mullions
mullions_2 = Brep(cap)  # disabled

# ----
output = DataOutput(
    DataInput=srf_2,
    Destination="C:\Users\Brooks Scarpa\Google Drive Streaming\My Drive\Scripting Repository\Exchange Data\Facade_comm_glass.ghdata",
    RelativePath="C:\Users\Brooks Scarpa\Google Drive Streaming\My Drive\Scripting Repository\Exchange Data\Facade_comm_glass.ghdata|..\..\Exchange Data\Facade_comm_glass.ghdata")  # disabled
output_2 = DataOutput(
    DataInput=mullions_2,
    Destination="C:\Users\Brooks Scarpa\Google Drive Streaming\My Drive\Scripting Repository\Exchange Data\Facade_comm_mullions.ghdata",
    RelativePath="C:\Users\Brooks Scarpa\Google Drive Streaming\My Drive\Scripting Repository\Exchange Data\Facade_comm_mullions.ghdata|..\..\Exchange Data\Facade_comm_mullions.ghdata")  # disabled
