# Grasshopper definition Facade_TriangulatedScreen.gh (Grasshopper 1.0.7)
# plug-ins: ShapeDiverForGrasshopper, LunchBox

# ---- group: Create Covering
surface = Surface(graft([<surface referenced from the Rhino model> x12]))
extrusion_distance = Slider(0.35, range=0.35..50)

# ---- group: Create Covering / Grid
v_count = Slider(30, range=1..100)
u_count = Slider(30, range=1..100)

# ----
geometry_pipeline = GeometryPipeline(
    GroupByLayer=False,
    GroupByType=False,
    IncludeHidden=True,
    IncludeLocked=True,
    LayerFilter="01_ARCH*01_SCREENS",
    NameFilter="*",
    SublayerFiltering=True,
    TypeFilter=1073741848)
dim = Dimensions(Surface=surface)  # -> UDimension, VDimension
number_slider = Slider(0.55, range=0..5)
expression = Expression(x=dim.UDimension, y=number_slider, Expression="round(x/y)")
expression_2 = Expression(x=dim.VDimension, y=number_slider, Expression="round(x/y)")
sddp = ShapeDiverDocumentPayload({AbsoluteTolerance=0, AngleTolerance=0, DistanceDisplayPrecision=0, GltfVersion="Gltf2", InputGroups="{}", OutputGroups="{}", RelativeTolerance=0, UnitSystem=0, VersionCreated="1.13.1.0", VersionSaved="1.13.1.0"})
trib = TrianglePanelsB(Surface=surface, UDivisions=expression, VDivisions=expression_2)  # -> simplify(Panels)
number_slider_2 = Slider(0.1, range=0..0.1)
srf = Surface(trib)
tstat = TreeStatistics(Tree=srf)  # -> Paths, Length, Count
series = Series(Start=Slider(1, range=1..10), Step=1, Count=tstat.Count)  # -> graft(Series)
lng = ListLength(List=srf)
expression_3 = Expression(x=lng, Expression="ROUND(X*0.3)")
reduce = RandomReduce(List=simplify(srf), Reduction=simplify(expression_3), Seed=series)
evaluate_surface = EvaluateSurface(Surface=reparameterize(srf), Point="{0.5,0.5,0}")  # -> Point, Normal, UDirection, VDirection, Frame

pdecon = Deconstruct(Point=evaluate_surface.Point)  # -> XComponent, YComponent, ZComponent
dom = ConstructDomain(DomainStart=Slider(0.04, range=0..1), DomainEnd=expr("x/8", number_slider))
bnd = Bounds(Numbers=pdecon.ZComponent)
remap = RemapNumbers(Value=reverse(pdecon.ZComponent), Source=bnd, Target=dom)  # -> expr("round(x,2)", Mapped), Clipped

wires = BrepWireframe(Brep=reduce, Density=-1)
join = JoinCurves(Curves=wires, Preserve=False)
trim = TrimTree(Tree=join, Depth=1)  # -> simplify(Tree)
area = Area(Geometry=trim)  # -> Area, Centroid
scale = Scale(Geometry=trim, Center=area.Centroid, Factor=Slider(0.65, range=0..1))  # -> Geometry, Transform
wires_2 = BrepWireframe(Brep=scale.Geometry, Density=-1)
join_2 = JoinCurves(Curves=wires_2, Preserve=False)  # -> simplify(Curves)
srfsplit = SurfaceSplit()
trim_2 = TrimTree(Tree=join_2, Depth=1)  # -> simplify(Tree)
srfsplit_2 = SurfaceSplit(Surface=simplify(surface), Curves=trim_2)
area_2 = Area(Geometry=srfsplit_2)  # -> Area, Centroid
sort = SortList(Keys=area_2.Area, ValuesA=srfsplit_2)  # -> Keys, reverse(ValuesA)
item = ListItem(List=sort.ValuesA, Index=0, Wrap=True)
preview = CustomPreview(Geometry=item, Material=ColourSwatch(SwatchColor=RGB(191, 117, 14)))
