# Grasshopper definition Facade_VaryingBrickPattern&Rotating by Photo.gh (Grasshopper 1.0.8)

bar_thickness = Slider(0.3, range=0..2)
bar_width = Slider(2, range=0..3)

extrusion = Slider(1, range=0..1)
brick_subdivision = Slider(27, range=0..100)
number_of_horizontal_lines = Slider(30, range=0..100)

srf = Surface(graft(<surface referenced from the Rhino model>))
colour_swatch = ColourSwatch(SwatchColor=RGB(111, 197, 255))  # disabled

# ---- group: Create Iso Curves across the surfaces
expression = Expression(n=number_of_horizontal_lines, Expression="1/n")
series = Series(Start=0, Step=expression, Count=number_of_horizontal_lines)
pt = ConstructPoint(XCoordinate=0, YCoordinate=series, ZCoordinate=0)

# ---- group: Horizontal Subdivision Control
graph = GraphMapper(
    series,
    x0=0,
    x1=1,
    y0=0,
    y1=1,
    container_name="Bezier",
    cpx=[0, 0.2066518813, 0.6549342275, 1],
    cpy=[0, 0.408095181, 0.3450131416, 1])

# ---- group: Create Iso Curves across the surfaces (continued)
ins = InsertItems(List=graph, Item=1, Indices=-1, Wrap=True)

# ---- group: Create the initial subdivided panels
iso = IsoCurve(Surface=reparameterize(srf), UVPoint=pt)  # -> UIsocurve, VIsocurve
trim = TrimTree(Tree=iso.UIsocurve, Depth=1)
createpanels = CreatePanels(crv=trim, n=brick_subdivision, X=Slider(2, range=0..10), A=extrusion)  # -> G, V
extr = Extrude(Base=createpanels.G, Direction=createpanels.V)

# ---- group: Creates the horizontal bar extrusions
evaluate_surface = EvaluateSurface(Surface=srf, Point="{0.5,0.5,0}")  # -> Point, Normal, UDirection, VDirection, Frame
amplitude = Amplitude(Vector=evaluate_surface.Normal, Amplitude=bar_width)
move = Move(Geometry=trim, Motion=expr("-x/2", amplitude))  # -> Geometry, Transform
extrude = Extrude(Base=move.Geometry, Direction=amplitude)
unit_z = UnitZ(Factor=bar_thickness)
extrude_2 = Extrude(Base=extrude, Direction=unit_z)

# ----
input_surface = Surface(srf)
volume = Volume(Geometry=extr)  # -> Volume, Centroid
srf_cp = SurfaceClosestPoint(Point=volume.Centroid, Surface=reparameterize(input_surface))  # -> Point, UVPoint, Distance

# ---- group: Image to sample pattern from
image = ImageSampler(srf_cp.UVPoint, Filter="Colour", Interpolate=False, Umax=1, Umin=0, Vmax=1, Vmin=0, Wrap=0)

# ----
panel = Panel(image)
python = GhPythonScript(x=panel, mul=Slider(1, range=0..1))  # -> simplify(x)
# ---------- python: Python ----------
__author__ = "Brooks Scarpa"
__version__ = "2020.06.22"

import rhinoscriptsyntax as rs
import math
import ghpythonlib as gh

print(type(x))

str = x 

x = str.split(',')
print(x)
x = [int(x) for x in x]
x = gh.components.Average(x)

x = gh.components.RemapNumbers(x,[0,255],[0,50])


x = math.floor(x[1])
print(x)
x = x*mul
print(x)
# ---------- end python ----------
panel_2 = Panel(python)
rotate = Rotate(Geometry=extr, Angle=degrees(panel_2), Plane=volume.Centroid)  # -> Geometry, Transform; disabled

merge = Merge(Data1=extrude_2, Data2=rotate.Geometry)  # -> flatten(Result); disabled
group = Group(Objects=merge)  # disabled
custom_preview = CustomPreview(Geometry=group, Material=colour_swatch)  # disabled

# ==== cluster CreatePanels
crv = ClusterInput()
crv_2 = Curve(crv)
n = ClusterInput()
python = GhPythonScript(curves=crv_2, n=n)  # -> panel_list; inputs curves: list of Curve
# ---------- python: Python ----------
__author__ = "Iliya Muzychuk"
__version__ = "2023.02.03"

import rhinoscriptsyntax as rs
import Grasshopper as gh
import Rhino.Geometry as rg
import ghpythonlib.components as comps
import ghpythonlib.treehelpers as th 

panel_list = []

for i in range(0,len(curves)-1):
    
    sill = curves[i]
    head = curves[i+1]
    
    points_sill = comps.DivideCurve(sill,n,kinks = False)
    points_sill = points_sill['points']
    
    points_head = comps.DivideCurve(head,n,kinks = False)
    points_head = points_head['points']
    
    panel_temp_list = []
    
    for j in range(0,len(points_sill)-1):
        
        
        pt1 = points_sill[j]
        pt2 = points_sill[j+1]
        pt3 = points_head[j]
        pt4 = points_head[j+1]
        
        bndy = comps.PolyLine((pt1,pt2,pt4,pt3),closed = True)
        
        panel_temp_list.append(bndy)
        
    panel_list.append(panel_temp_list)

panel_list = th.list_to_tree(panel_list)
# ---------- end python ----------

split = SplitTree(Data=python, Masks=flatten("{0;(1,3,...)}"))  # -> Positive, Negative
split_2 = SplitTree(Data=python, Masks=flatten("{0;(0,2,...)}"))  # -> Positive, Negative
cull = CullPattern(List=split.Positive, CullPattern=[False, True])
cull_2 = CullPattern(List=split_2.Positive, CullPattern=[True, False])
boundary = BoundarySurfaces(Edges=cull)
boundary_2 = BoundarySurfaces(Edges=cull_2)
merge = Merge(Data1=boundary, Data2=boundary_2)

evalsrf = EvaluateSurface(Surface=reparameterize(merge), Point="{0.5,0.5,0}")  # -> Point, Normal, UDirection, VDirection, Frame
X = ClusterInput()
scale_nu = ScaleNU(Geometry=merge, Plane=evalsrf.Frame, ScaleX=X, ScaleY=1, ScaleZ=1)  # -> Geometry, Transform
A = ClusterInput()
G = ClusterOutput(scale_nu.Geometry)
amp = Amplitude(Vector=evalsrf.Normal, Amplitude=A)
V = ClusterOutput(amp)
