# Grasshopper definition LandscapeElements_Planters By Point.gh (Grasshopper 1.0.7)
# plug-ins: eleFront, ShapeDiverForGrasshopper

insert_point = Point(graft(<point referenced from the Rhino model>))
sddp = ShapeDiverDocumentPayload({AbsoluteTolerance=0, AngleTolerance=0, DistanceDisplayPrecision=0, GltfVersion="Gltf2", InputGroups="{}", OutputGroups="{}", RelativeTolerance=0, UnitSystem=0, VersionCreated="1.13.1.0", VersionSaved="1.13.1.0"})

planter_radius = Slider(8, range=0..100)
planter_depth = Slider(5, range=0..10)
wall_thickness = Slider(1, range=0..1)
soil_depth = Slider(1, range=0..4)

xy = XYPlane(Origin=insert_point)
insert = InsertBlock(BlockName="Tree", Plane=xy)
block_info = GetBlockInfo(Block=insert)  # -> Name, Plane, Transform, BlockType, FilePath, Active
expression = Expression(x=planter_radius, y=wall_thickness, Expression="x-y")
cir = Circle(Plane=block_info.Plane, Radius=[planter_radius, expression])

item = ListItem(List=cir, Index=0, Wrap=True)  # -> Item1, Item
boundary = BoundarySurfaces(Edges=cir)
boundary_2 = BoundarySurfaces(Edges=item.Item1)
Z = UnitZ(Factor=expr("-x", planter_depth))
extr = Extrude(Base=boundary_2, Direction=Z)

python = GhPythonScript(srf=boundary, soil_depth=soil_depth, planter_depth=planter_depth)  # -> planter; inputs srf: Brep
# ---------- python: Python ----------
__author__ = "Iliya Muzychuk"
__version__ = "2023.02.03"

import rhinoscriptsyntax as rs
import Grasshopper as gh
import Rhino.Geometry as rg
import ghpythonlib.components as comps



vector_move = comps.UnitZ(soil_depth)
upper_lip = comps.Move(srf,vector_move)
upper_lip = upper_lip['geometry']

vector_extrude = comps.UnitZ(-1*(planter_depth + soil_depth))
planter = comps.Extrude(upper_lip,vector_extrude)

print(planter)
# ---------- end python ----------
soil = Brep(extr)
planter = Brep(python)
preview = CustomPreview(Geometry=soil, Material=ColourSwatch(SwatchColor=RGB(134, 164, 99)))
preview_2 = CustomPreview(Geometry=planter, Material=ColourSwatch(SwatchColor=RGB(192, 192, 192)))
