# Grasshopper definition LandscapeElements_RisingMounds.gh (Grasshopper 1.0.7)
# plug-ins: ShapeDiverForGrasshopper

sddp = ShapeDiverDocumentPayload({AbsoluteTolerance=0, AngleTolerance=0, DistanceDisplayPrecision=0, GltfVersion="Gltf2", InputGroups="{}", OutputGroups="{}", RelativeTolerance=0, UnitSystem=0, VersionCreated="1.13.1.0", VersionSaved="1.13.1.0"})

height_coefficient = Slider(10, range=0..10)

guid_curves = Curve([<curve referenced from the Rhino model> x11])

end = EndPoints(Curve=guid_curves)  # -> Start, End
merge = Merge(Data1=end.Start, Data2=end.End)

# ---- group: Orgnanize points clockwise
python = GhPythonScript(points=merge)  # -> points_out; inputs points: list of Point3d
# ---------- python: Python ----------
__author__ = "Iliya Muzychuk"
__version__ = "2023.02.03"

import rhinoscriptsyntax as rs
import Grasshopper as gh
import Rhino.Geometry as rg
import ghpythonlib.components as comps

import math

def calculate_angle_3d(point, centroid):
    # Calculate the angle of the point with respect to the centroid in 3D
    dx = point[0] - centroid[0]
    dy = point[1] - centroid[1]
    dz = point[2] - centroid[2]
    return math.atan2(dy, dx)

def organize_points_clockwise_3d(points):
    # Find the centroid of the points in 3D
    centroid = [sum(coord) / len(points) for coord in zip(*points)]

    # Sort the points based on their angles with respect to the centroid
    points.sort(key=lambda p: calculate_angle_3d(p, centroid))

    return points

li_points = []

for point in points: 
    
    
    x = point[0]
    y = point[1]
    z = point[2]
    
    point_tuple = (x,y,z)
    li_points.append(point_tuple)

print(li_points)

organized_points_3d = organize_points_clockwise_3d(li_points)

points_out = [] 

for point in organized_points_3d: 
    
    point_gh = comps.ConstructPoint(point[0],point[1],point[2])
    points_out.append(point_gh)
# ---------- end python ----------

# ----
pline = PolyLine(Vertices=python, Closed=True)
bounding_curve = Curve(pline)

disc = Discontinuity(Curve=bounding_curve, Level=1)  # -> Points, Parameters
boundary = BoundarySurfaces(Edges=bounding_curve)
srfsplit = SurfaceSplit(Surface=boundary, Curves=guid_curves)  # -> reparameterize(Fragments)

dom = ConstructDomain(DomainStart=Slider(2, range=0..3), DomainEnd=Slider(9, range=0..15))
lng = ListLength(List=srfsplit)

random = Random(Range=dom, Number=lng, Seed=Slider(3, range=0..10), Integers=True)
expression = Expression(x=random, y=height_coefficient, Expression="x*y")  # -> graft(R)

item = ListItem(List=disc.Points, Index=0, Wrap=True)  # -> Item, Item1, Item2, Item3
pl_3pt = Plane3Pt(PointA=item.Item, PointB=item.Item1, PointC=item.Item3)

bbox = BoundingBox(Content=srfsplit, Plane=pl_3pt)  # -> Box, Box_2
debrep = DeconstructBrep(Brep=bbox.Box)  # -> Faces, Edges, Vertices
item_2 = ListItem(List=debrep.Edges, Index=0, Wrap=True)

midpt = CurveMiddle(Curve=item_2)
end_2 = EndPoints(Curve=item_2)  # -> Start, End
Z = UnitZ(Factor=expression)
move = Move(Geometry=midpt, Motion=Z)  # -> Geometry, Transform
arc = Arc3Pt(PointA=end_2.Start, PointB=move.Geometry, PointC=end_2.End)  # -> Arc, Plane, Radius

graft = GraftTree(Tree=srfsplit, IncludeEmptyLists=True, IncludeNullItems=True)
flow = Flow(Geometry=graft, Base=item_2, Target=arc.Arc, ReverseBase=False, ReverseTarget=False, Stretch=True, Rigid=False)
python_2 = GhPythonScript(surface=flow)  # -> curves
# ---------- python_2: Python ----------
__author__ = "Iliya Muzychuk"
__version__ = "2023.02.03"

import rhinoscriptsyntax as rs
import Grasshopper as gh
import Rhino.Geometry as rg
import ghpythonlib.components as comps

curves = rs.DuplicateEdgeCurves(surface)
# ---------- end python_2 ----------

xy = XYPlane(Origin=Point(0, 0, 0))
project = Project(Geometry=python_2, Plane=xy)  # -> Geometry, Transform
merge_2 = Merge(Data1=graft(python_2), Data2=graft(project.Geometry))

loft = Loft(Curves=merge_2, Options={Adjust=False, Closed=False, LoftEnds=0, LoftSimp=0, LoftType=0, Rebuild=10, Refit=0.01})
preview = CustomPreview(Geometry=flow, Material=ColourSwatch(SwatchColor=RGB(101, 144, 64)))
preview_2 = CustomPreview(Geometry=loft, Material=ColourSwatch(SwatchColor=RGB(224, 216, 235)))
