# Grasshopper definition Site Creation Script 0.1.0.gh (Grasshopper 1.0.7)
# plug-ins: Caribou, Human

# Go to: https://www.openstreetmap.org/export#map=19/33.90567/-118.34229
# 
# Download an map.osm file for you environment and load it in the path input
path = FilePath("C:\Users\ilouh\Downloads\map")
osm_specify = SpecifyFeatures(selectionHidesObscure=True, selectionSerialised="boundary=*,building=*")
osm_specify_2 = SpecifyFeatures(selectionHidesObscure=True, selectionSerialised="highway=*,railway=*,waterway=*")
osm_specify_3 = SpecifyFeatures(
    selectionHidesObscure=True,
    selectionSerialised="aerialway=*,aeroway=*,amenity=*,barrier=*,boundary=*,building=*,craft=*,emergency=*,geological=*,healthcare=*,highway=*,historic=*,landuse=*,leisure=*,man_made=*,military=*,natural=*,office=*,place=*,power=*,public_transport=*,railway=*,route=*,shop=*,sport=*,telecom=*,tourism=*,water=*,waterway=*")

# ---- group: Preset Street Width
residential_offset = Slider(10, range=0..100)
tertiary_offset = Slider(20, range=0..100)
service_offset = Slider(5, range=0..100)
footway_offset = Slider(3, range=0..100)

# ----
buildings = ExtractBuildings(OSMFilePath=path, OSMFeatures=osm_specify, OutputHeighted=True)  # -> Buildings, Tags, Report, Bounds
nodes = ExtractNodes(OSMFilePath=path, OSMFeatures=osm_specify_3)  # -> Nodes, Tags, Report, Bounds
ways = ExtractWays(OSMFilePath=path, OSMFeatures=osm_specify_2)  # -> Ways, Tags, Report, Bounds
item = ListItem(List=ways.Tags, Index=0, Wrap=True)
panel = Panel(nodes.Tags)
python = GhPythonScript(
    x=item,
    residential_offset=residential_offset,
    tertiary_offset=tertiary_offset,
    service_offset=service_offset,
    footway_offset=footway_offset)  # -> offset_value
# ---------- python: Python ----------
__author__ = "ilouh"
__version__ = "2023.02.21"

import rhinoscriptsyntax as rs
import Grasshopper as gh
import Rhino.Geometry as rg
import ghpythonlib.components as comps
import math

lib = {

    'highway=residential': residential_offset,
    'highway=tertiary': tertiary_offset,
    'highway=service': service_offset,
    'footway=sidewalk' : footway_offset

}

offset_value = lib[x]
# ---------- end python ----------
expression = Expression(x=python, Expression="(x*12)/2")
neg = Negative(Value=expression)
offset = OffsetCurve(Curve=ways.Ways, Distance=[expression, neg], Corners=1)
previewmat = CustomPreviewMaterials(Geometry=buildings.Buildings, DiffuseColor=ColourSwatch(SwatchColor=RGB(192, 192, 192)))
