# Grasshopper definition Site Creation Script 0.1.1.gh (Grasshopper 1.0.8)
# plug-ins: Human, Caribou

# Go to: https://www.openstreetmap.org/export#map=19/33.90567/-118.34229
# 
# Download an map.osm file for you environment and load it in the path input
path = FilePath("D:\00_Projects\24 07 - Adaptive Reuse Proposal\10_Project Info\map.osm")
osm_specify = SpecifyFeatures(selectionHidesObscure=True, selectionSerialised="boundary=*,building=*")
osm_specify_2 = SpecifyFeatures(selectionHidesObscure=True, selectionSerialised="highway=*,railway=*,waterway=*")

# ---- group: Preset Street Width
secondary_offset = Slider(10, range=0..100)
access_offset = Slider(20, range=0..100)
footway_offst = Slider(3, range=0..100)
access_private_offset = Slider(3, range=0..100)
private_offst = Slider(5, range=0..100)
residential_offset = Slider(10, range=0..100)
tertiary_offset = Slider(20, range=0..100)
service_offset = Slider(5, range=0..100)
footway_offset = Slider(3, range=0..100)

# ----
osm_specify_3 = SpecifyFeatures(
    selectionHidesObscure=True,
    selectionSerialised="aerialway=*,aeroway=*,amenity=*,barrier=*,boundary=*,building=*,craft=*,emergency=*,geological=*,healthcare=*,highway=*,historic=*,landuse=*,leisure=*,man_made=*,military=*,natural=*,office=*,place=*,power=*,public_transport=*,railway=*,route=*,shop=*,sport=*,telecom=*,tourism=*,water=*,waterway=*")
buildings = ExtractBuildings(OSMFilePath=path, OSMFeatures=osm_specify, OutputHeighted=True)  # -> Buildings, Tags, Report, Bounds
nodes = ExtractNodes(OSMFilePath=path, OSMFeatures=osm_specify_3)  # -> Nodes, Tags, Report, Bounds
ways = ExtractWays(OSMFilePath=path, OSMFeatures=osm_specify_2)  # -> Ways, Tags, Report, Bounds
item = ListItem(List=ways.Tags, Index=0, Wrap=True)
python = GhPythonScript(
    x=item,
    residential_offset=residential_offset,
    tertiary_offset=tertiary_offset,
    service_offset=service_offset,
    footway_offset=footway_offset,
    secondary_offset=secondary_offset,
    access_offset=access_offset,
    private_offst=private_offst,
    footway_offst=footway_offst,
    access_private_offset=access_private_offset)  # -> offset_value
# ---------- python: Python ----------
__author__ = "ilouh"
__version__ = "2023.02.21"

import rhinoscriptsyntax as rs
import Grasshopper as gh
import Rhino.Geometry as rg
import ghpythonlib.components as comps
import math

lib = {

    'highway=residential': residential_offset,
    'highway=tertiary': tertiary_offset,
    'highway=service': service_offset,
    'footway=sidewalk' : footway_offset,
    'highway=secondary' : secondary_offset,
    'access=customers' : access_offset,
    'highway=private' : private_offst,
    'highway=footway' : footway_offst,
    'access=private' : access_private_offset

}

try:
    offset_value = lib[x]
    
except (RuntimeError, TypeError, NameError,KeyError):
    offset_value = 1
    pass
# ---------- end python ----------
item_2 = ListItem(List=ways.Tags, Index=0, Wrap=True)
expression = Expression(x=python, Expression="(x*12)/2")
panel = Panel(python)
neg = Negative(Value=expression)
flatten = FlattenTree(Tree=item_2, Path="{0}")
offset = OffsetCurve(Curve=ways.Ways, Distance=[expression, neg], Corners=1)
previewmat = CustomPreviewMaterials(Geometry=buildings.Buildings, DiffuseColor=ColourSwatch(SwatchColor=RGB(192, 192, 192)))
cset = CreateSet(List=flatten)  # -> Set, Map

# ---- group: Output - Buildings
buildings_2 = Brep(buildings.Buildings)

# ---- group: Output - Roads
roads = Curve(offset)
