# Grasshopper definition Site_Convert Mesh Topography to Surface 0.1.0.gh (Grasshopper 1.0.7)
# plug-ins: Kangaroo2 Components

mesh = Mesh(<mesh referenced from the Rhino model>)
triremesh = TriRemesh(Geometry=mesh, Iterations=25)  # -> Triangulation, Dual, Creases
medges = MeshEdges(Mesh=mesh)  # -> NakedEdges, InteriorEdges, NonManifoldEdges
crv = Curve(medges.NakedEdges)
demesh = DeconstructMesh(Mesh=triremesh.Triangulation)  # -> Vertices, Faces, Colours, Normals
join = JoinCurves(Curves=crv, Preserve=False)
patch = Patch(Curves=join, Points=demesh.Vertices, Spans=20, Flexibility=1, Trim=True)
bbox = BoundingBox(Content=patch, Plane=PlaneXY(0, 0, 0))  # -> Box, Box_2
distributefaces = GhPythonScript(Massing=simplify(bbox.Box))  # -> floor, walls, roof; inputs Massing: list
# ---------- distributefaces: Python ----------
__author__ = "ilouh"
__version__ = "2023.01.08"

import rhinoscriptsyntax as rs
import ghpythonlib.components as comps
import Rhino.Geometry as geom


roof = []
floor = []
walls = [] 

#find the normal of each face

faces = comps.DeconstructBrep(Massing)['faces']
evaluation_point = comps.ConstructPoint(x_coordinate = 0.5, y_coordinate = 0.5, z_coordinate = 0)

for face in faces: 
    
    vector = comps.EvaluateSurface(face,evaluation_point)['normal']
    
    
    vector_a = comps.VectorXYZ(x_component = vector[0], y_component = vector[1], z_component = vector[2])['vector']
    vector_b = comps.UnitZ(1)

    cross_product = comps.CrossProduct(vector_a,vector_b,True)['vector']
    dot_product = round(comps.DotProduct(vector_a,vector_b,True),4)
    
    print(dot_product)
    
    if abs(dot_product) == 0: 
        walls.append(face)
    
    if dot_product > 0: 
        roof.append(face)
    
    if dot_product == -1: 
        floor.append(face)
# ---------- end distributefaces ----------
area = Area(Geometry=distributefaces.floor)  # -> Area, Centroid
contour = Contour(Shape=patch, Point=area.Centroid, Direction=Vector(0, 0, 1), Distance=Slider(1, range=0..1))
