# Grasshopper definition Site_Create Roads 0.1.0.gh (Grasshopper 1.0.7)

crv = Curve(<curve referenced from the Rhino model>)
lane = Slider(10, range=0..10)
sidewalk = Slider(3.4, range=0..10)
addition = Addition(A=lane, B=sidewalk)
neg = Negative(Value=[lane, addition])
merge = Merge(Data1=lane, Data3=neg, Data4=addition)
offset = OffsetCurve(Curve=crv, Distance=merge, Corners=1)
