# Grasshopper definition Site_Topography 0.1.0.gh (Grasshopper 1.0.7)
# plug-ins: Human

false_controur_curves_true_grade_elevati = BooleanToggle(True)  # "False : Controur Curves | True : Grade Elevations"

# ---- group: Input - FG Points
grade_elevations = Point([<point referenced from the Rhino model> x10])

# ---- group: Input - Contour Line Distance
contour_lines_distances = Slider(0.6, range=0.1..10)

# ----
contour_curves = Curve([<curve referenced from the Rhino model> x2])
disc = Discontinuity(Curve=contour_curves, Level=1)  # -> flatten(Points), Parameters
filter = StreamFilter(Gate=false_controur_curves_true_grade_elevati, Stream0=disc.Points, Stream1=grade_elevations)
del = DelaunayMesh(Points=filter, Plane=PlaneXY(0, 0, 0))
medges = MeshEdges(Mesh=del)  # -> NakedEdges, InteriorEdges, NonManifoldEdges

# ---- group: Gets the lowest point of the Tyopography
bbox = BoundingBox(Content=del, Plane=PlaneXY(0, 0, 0))  # -> Box, Box_2
getbottomface = GetBottomFace(B=bbox.Box)
area = Area(Geometry=getbottomface)  # -> Area, Centroid

# ----
# Create Topography By Points
crv = Curve(medges.NakedEdges)

# ---- group: Creates a Solid Mesh Boundary
xy = XYPlane(Origin=area.Centroid)
project = Project(Geometry=crv, Plane=xy)  # -> Geometry, Transform
merge = Merge(Data1=simplify(graft(crv)), Data2=simplify(graft(project.Geometry)))
join = JoinCurves(Curves=project.Geometry, Preserve=False)
loft = Loft(Curves=merge, Options={Adjust=False, Closed=False, LoftEnds=0, LoftSimp=0, LoftType=0, Rebuild=10, Refit=0.01})  # -> flatten(Loft)
boundary = BoundarySurfaces(Edges=join)
join_2 = BrepJoin(Breps=[boundary, loft])  # -> Breps, Closed
mesh = MeshBrep(
    Brep=join_2.Breps,
    Settings={GridMaxCount=0, GridMinCount=16, JaggedSeams=False, MaxEdgeLength=0, MinEdgeLength=0.0001, MinTolerance=0, Refine=True, RefineAngle=0, RelativeTolerance=0.65, SimplePlanes=True, Tolerance=0})  # -> flatten(Mesh)

# ----
contour = Contour(Shape=del, Point=area.Centroid, Direction=Vector(0, 0, 1), Distance=contour_lines_distances)  # -> reparameterize(simplify(Contours))

# ---- group: Calculates Z Value of the Curve
eval = EvaluateCurve(Curve=contour, Parameter="0.5")  # -> Point, Tangent, Angle
pdecon = Deconstruct(Point=eval.Point)  # -> XComponent, YComponent, ZComponent
expression = Expression(x=pdecon.ZComponent, Expression="round(x,2)")

# ---- group: Calucate Z Value
pdecon_2 = Deconstruct(Point=filter)  # -> XComponent, YComponent, ZComponent
expression_2 = Expression(x=pdecon_2.ZComponent, Expression="round(x,2)")

# ----
mjoin = MeshJoin(Meshes=[del, mesh])

# ---- group: Output - Curves
topograhpy_curves = Curve(contour)

# ----
previewmat = CustomPreviewMaterials(Geometry=mjoin, DiffuseColor=ColourSwatch(SwatchColor=RGB(255, 255, 255)))

# ---- group: Output - Topography
mesh_2 = Mesh(mjoin)

# ---- group: Curve Elevations
tag = TextTag(Location=eval.Point, Text=expression)

# ---- group: Point Elevataions
tag_2 = TextTag(Location=filter, Text=expression_2)

# ==== cluster GetBottomFace
B = ClusterInput()
debrep = DeconstructBrep(Brep=B)  # -> Faces, Edges, Vertices
md_slider = MDSlider(SliderMode=0, slider_value=Point(0.5, 0.5, 0.5), x_domain=Domain(0, 1), y_domain=Domain(0, 1), z_domain=Domain(0, 1))
evalsrf = EvaluateSurface(Surface=reparameterize(debrep.Faces), Point=md_slider)  # -> Point, Normal, UDirection, VDirection, Frame
devec = DeconstructVector(Vector=evalsrf.Normal)  # -> XComponent, YComponent, simplify(ZComponent)
equals = Equality(FirstNumber=expr("round(x)", devec.ZComponent), SecondNumber=-1)  # -> Equality, Inequality
cull = CullPattern(List=debrep.Faces, CullPattern=equals.Equality)
L = ClusterOutput(cull)
