# Grasshopper definition Building Typology - Gabeled Roofs 0.1.0.gh (Grasshopper 1.0.7)
# plug-ins: RhinoCodePluginGH

series = Series(Start=0, Step=100, Count=Slider(4, range=0..10))
series_2 = Series(Start=0, Step=50, Count=Slider(6, range=0..10))
number_slider = Slider(13, range=0..25)
number_slider_2 = Slider(13, range=0..25)
crv = Curve(<curve referenced from the Rhino model>)
pt = ConstructPoint(XCoordinate=graft(series_2), YCoordinate=series, ZCoordinate=0)
divide = DivideCurve(Curve=crv, Count=10, Kinks=False)  # -> Points, Tangents, Parameters
rectangle = Rectangle(Plane=pt, XSize=Domain(-25, 25), YSize=Domain(-50, 50), Radius=0)  # -> Rectangle, Length
md_slider = MDSlider(
    SliderMode=0,
    slider_value=Point(0.2105531693, 0.3348846436, 0.5),
    x_domain=Domain(0, 1),
    y_domain=Domain(0, 1),
    z_domain=Domain(0, 1))
rectangle_2 = Rectangle(Plane=divide.Points, XSize=Domain(-25, 25), YSize=Domain(-50, 50), Radius=0)  # -> Rectangle, Length
md_slider_2 = MDSlider(
    SliderMode=0,
    slider_value=Point(0.2105531693, 0.3348846436, 0.5),
    x_domain=Domain(0, 1),
    y_domain=Domain(0, 1),
    z_domain=Domain(0, 1))
evalsrf = EvaluateSurface(Surface=reparameterize(rectangle.Rectangle), Point=md_slider)  # -> Point, Normal, UDirection, VDirection, Frame
evalsrf_2 = EvaluateSurface(Surface=reparameterize(rectangle_2.Rectangle), Point=md_slider_2)  # -> Point, Normal, UDirection, VDirection, Frame
pt_2 = Point(simplify(flatten(evalsrf.Point)))
dom = ConstructDomain(DomainStart=Slider(25, range=0..100), DomainEnd=Slider(45, range=0..100))
dom_2 = ConstructDomain(DomainStart=Slider(25, range=0..100), DomainEnd=Slider(35, range=0..100))
pt_3 = Point(simplify(flatten(evalsrf_2.Point)))
lng = ListLength(List=pt_2)
lng_2 = ListLength(List=pt_2)
dom_3 = ConstructDomain(DomainStart=Slider(4, range=0..100), DomainEnd=Slider(8, range=0..100))
lng_3 = ListLength(List=pt_2)
dom_4 = ConstructDomain(DomainStart=Slider(25, range=0..100), DomainEnd=Slider(45, range=0..100))
dom_5 = ConstructDomain(DomainStart=Slider(25, range=0..100), DomainEnd=Slider(35, range=0..100))
lng_4 = ListLength(List=pt_3)
lng_5 = ListLength(List=pt_3)
dom_6 = ConstructDomain(DomainStart=Slider(4, range=0..100), DomainEnd=Slider(12, range=0..100))
lng_6 = ListLength(List=pt_3)
dom_7 = ConstructDomain(DomainStart=Slider(4, range=0..100), DomainEnd=Slider(12, range=0..100))
lng_7 = ListLength(List=pt_3)
random = Random(Range=dom, Number=lng, Seed=number_slider, Integers=True)
random_2 = Random(Range=dom_2, Number=lng_2, Seed=number_slider, Integers=True)
random_3 = Random(Range=dom_3, Number=lng_3, Seed=number_slider, Integers=True)
random_4 = Random(Range=dom_4, Number=lng_4, Seed=number_slider_2, Integers=True)
random_5 = Random(Range=dom_5, Number=lng_5, Seed=number_slider_2, Integers=True)
random_6 = Random(Range=dom_6, Number=lng_6, Seed=number_slider_2, Integers=True)
random_7 = Random(Range=dom_7, Number=lng_7, Seed=number_slider_2, Integers=True)

cookiecutter_01 = Script(startPoint=graft(pt_2), width=graft(random_2), length=graft(random), height=graft(random_3))  # -> polysurface, boundaryPoints
# ---------- cookiecutter_01: Python ----------
import System
import Rhino
import Rhino.Geometry as rg
import Grasshopper
import ghpythonlib.components as comps
from ghpythonlib import treehelpers as th

import rhinoscriptsyntax as rs

def constructGHPoints(points):

    gh_points = []

    for point in points:

        gh_point = comps.ConstructPoint(point[0],point[1],point[2])
        gh_points.append(gh_point)
    
    return gh_points

def roof(point,w,l,h):

    x = point[0]
    y = point[1]
    z = point[2]

    #first horizontal row, left to right
    pt1 = (x,y,z)
    pt2 = (x + 1/4*w,y,z+h)
    pt3 = (x + 1/2*w,y,z)

    #second horizontal row, left to right
    pt4 = (x+1/2*w,y+1/2*l,z)
    pt5 = (x+3/4*w,y+1/2*l,z+h)
    pt6 = (x+w,y+1/2*l,z)

    #third horizontal row, left to right
    pt7 = (x +1/4*w,y+3/4*l,z+h)
    pt8 = (x + 3/4*w,y+3/4*l,z+h)
    pt9 = (x+w, y+3/4*l,z+h)

    #fourth horizontal row, left to right
    pt10 = (x,y+l,z)
    pt11 = (x + 1/4*w, y+l,z+h)
    pt12 = (x+ 1/2*w, y+l,z)
    pt13 = (x+w,y+l,z)

    faces = [

        [pt1,pt2,pt11,pt10],
        [pt2,pt7,pt4,pt3],
        [pt7,pt9,pt6,pt4],
        [pt7,pt9,pt13,pt12],
        [pt12,pt11,pt7],
        [pt1,pt2,pt3],
        [pt10,pt11,pt12],
        [pt6,pt9,pt13],
        [pt4,pt8,pt5],
        [pt5,pt8,pt6],
        [pt4,pt5,pt6]
    ]

    boundary = [

        pt1,
        pt3,
        pt4,
        pt6,
        pt13,
        pt10


    ]
    return faces, boundary

if __name__ == '__main__':

    startPoint = startPoint
    width = width
    length  = length
    height = height

    faces,boundary = roof(startPoint,width,length,height)

    vertices = [] 

    polysurface = []

    for face in faces: 

        points = constructGHPoints(face)
        vertices.append(points)

        surface = rg.NurbsSurface.CreateFromCorners(*points)
        polysurface.append(surface)

    boundaryPoints = constructGHPoints(boundary)
    print(boundaryPoints)
    #boudaryPolyline = rg.PolyCurve(boundaryPoints)
# ---------- end cookiecutter_01 ----------
pline = PolyLine(Vertices=cookiecutter_01.boundaryPoints, Closed=True)
offset = OffsetCurve(Curve=pline, Distance=expr("-0.5", 1), Corners=1)

cookiecutter_01_2 = Script(startPoint=graft(pt_3), width=graft(random_5), length=graft(random_4), height=graft(random_6))  # -> polysurface, boundaryPoints; same code as cookiecutter_01
pline_2 = PolyLine(Vertices=cookiecutter_01_2.boundaryPoints, Closed=True)
offset_2 = OffsetCurve(Curve=pline_2, Distance=expr("-0.5", 1), Corners=1)

number_slider_3 = Slider(8, range=0..100)

Z = UnitZ(Factor=Slider(8, range=0..100))
move = Move(Geometry=cookiecutter_01.polysurface, Motion=Z)  # -> Geometry, Transform
extr = Extrude(Base=offset, Direction=Z)

Z_2 = UnitZ(Factor=random_7)  # -> graft(UnitVector)
move_2 = Move(Geometry=cookiecutter_01_2.polysurface, Motion=Z_2)  # -> Geometry, Transform
extr_2 = Extrude(Base=offset_2, Direction=Z_2)

materials = QueryModelMaterials(Name="*", AutoUpdateState=True)
merge = Merge(Data1=simplify(move.Geometry), Data2=simplify(extr))
materials_2 = QueryModelMaterials(Name="*", AutoUpdateState=True)
merge_2 = Merge(Data1=simplify(move_2.Geometry), Data2=simplify(extr_2))
item = ListItem(List=materials, Index=Slider(5, range=0..1000), Wrap=True)
swatch = ColourSwatch(SwatchColor=RGB(255, 255, 255))
item_2 = ListItem(List=materials_2, Index=Slider(5, range=0..1000), Wrap=True)
swatch_2 = ColourSwatch(SwatchColor=RGB(255, 255, 255))
preview = CustomPreview(Geometry=merge, Material=item)
preview_2 = CustomPreview(Geometry=merge_2, Material=item_2)
