# Grasshopper definition Building Typology - Gabeled Roofs 0.1.1.gh (Grasshopper 1.0.8)
# plug-ins: CORE.Toolbox.Grasshopper

value_list = ValueList({"One": 0, "Two": 1, "Three": 2}, selected="Two")
rhino_units = RhinoUnits(Refresh=True)  # -> UnitName, UnitIndex
width = Slider(30, range=0..50)
depth = Slider(30, range=0..50)
pitch = Slider(8, range=0..25)
height = Slider(8, range=0..25)
point = Point(simplify(graft([<point referenced from the Rhino model> x2])))

lng = ListLength(List=flatten(point))
dup = DuplicateData(Data=depth, Number=lng, Order=True)  # -> simplify(graft(Data))
dup_2 = DuplicateData(Data=height, Number=lng, Order=True)  # -> simplify(graft(Data))
dup_3 = DuplicateData(Data=rhino_units.UnitName, Number=lng, Order=True)  # -> simplify(graft(Data))
dup_4 = DuplicateData(Data=width, Number=lng, Order=True)  # -> simplify(graft(Data))
dup_5 = DuplicateData(Data=pitch, Number=lng, Order=True)  # -> simplify(graft(Data))

merge = Merge(Data1=point, Data2=dup_4, Data3=dup, Data4=dup_5, Data5=dup_2, Data6=dup_3)
stream_gate = StreamGate(Stream=merge, Gate=value_list)  # -> Target0, Target1, Target2
list_item = ListItem(List=stream_gate.Target2, Index=0, Wrap=True)  # -> Item, Item1, Item2, Item3, Item4, Item5
list_item_2 = ListItem(List=stream_gate.Target1, Index=0, Wrap=True)  # -> Item, Item1, Item2, Item3, Item4, Item5
list_item_3 = ListItem(List=stream_gate.Target0, Index=0, Wrap=True)  # -> Item, Item1, Item2, Item3, Item4, Item5
l_shape_pitched_w_gable = LShapePitchedWGable(
    startpoint=list_item_3.Item,
    width=list_item_3.Item1,
    length=list_item_3.Item2,
    pitch_height=list_item_3.Item3,
    floor_floor_height=list_item_3.Item4,
    unitsystem=list_item_3.Item5)
l_shape_pitched = LShapePitched(
    startpoint=list_item_2.Item,
    width=list_item_2.Item1,
    length=list_item_2.Item2,
    pitch_height=list_item_2.Item3,
    floor_floor_height=list_item_2.Item4,
    unitsystem=list_item_2.Item5)
simple_shotgun = SimpleShotgun(
    startpoint=list_item.Item,
    width=list_item.Item1,
    length=list_item.Item2,
    pitch_height=list_item.Item3,
    floor_floor_height=list_item.Item4,
    unitsystem=list_item.Item5)
filter = StreamFilter(Gate=value_list, Stream0=l_shape_pitched_w_gable, Stream1=l_shape_pitched, Stream2=simple_shotgun)
panel = Panel(filter)

# ==== cluster LShapePitchedWGable
startpoint = ClusterInput()
width = ClusterInput()
length = ClusterInput()
pitch_height = ClusterInput()
floor_floor_height = ClusterInput()
unitsystem = ClusterInput()
cookiecutter_01 = Script(
    startPoint=graft(startpoint),
    width=graft(width),
    length=graft(length),
    pitch_height=graft(pitch_height),
    floor_floor_height=floor_floor_height,
    unitSystem=unitsystem)  # -> polysurface, boudaryPolyline, floor_floor_height; inputs startPoint: Point3d, unitSystem: String
# ---------- cookiecutter_01: Python ----------
import System
import Rhino
import Rhino.Geometry as rg
import Grasshopper
import ghpythonlib.components as comps
from ghpythonlib import treehelpers as th

import rhinoscriptsyntax as rs

def constructGHPoints(points):

    gh_points = []

    for point in points:

        gh_point = comps.ConstructPoint(point[0],point[1],point[2])
        gh_points.append(gh_point)
    
    return gh_points

def roof(point,w,l,h):

    x = point[0]
    y = point[1]
    z = point[2]

    #first horizontal row, left to right
    pt1 = (x,y,z)
    pt2 = (x + 1/4*w,y,z+h)
    pt3 = (x + 1/2*w,y,z)

    #second horizontal row, left to right
    pt4 = (x+1/2*w,y+1/2*l,z)
    pt5 = (x+3/4*w,y+1/2*l,z+h)
    pt6 = (x+w,y+1/2*l,z)

    #third horizontal row, left to right
    pt7 = (x +1/4*w,y+3/4*l,z+h)
    pt8 = (x + 3/4*w,y+3/4*l,z+h)
    pt9 = (x+w, y+3/4*l,z+h)

    #fourth horizontal row, left to right
    pt10 = (x,y+l,z)
    pt11 = (x + 1/4*w, y+l,z+h)
    pt12 = (x+ 1/2*w, y+l,z)
    pt13 = (x+w,y+l,z)

    faces = [

        [pt1,pt2,pt11,pt10],
        [pt2,pt7,pt4,pt3],
        [pt7,pt9,pt6,pt4],
        [pt7,pt9,pt13,pt12],
        [pt12,pt11,pt7],
        [pt1,pt2,pt3],
        [pt10,pt11,pt12],
        [pt6,pt9,pt13],
        [pt4,pt8,pt5],
        [pt5,pt8,pt6],
        [pt4,pt5,pt6]
    ]

    boundary = [

        pt1,
        pt3,
        pt4,
        pt6,
        pt13,
        pt10


    ]
    return faces, boundary

def unitCoverter(unitSystem):
    if unitSystem == 'inches':
        return 12
    if unitSystem == 'feet':
        return 1

if __name__ == '__main__':

    startPoint = startPoint

    coef = unitCoverter(unitSystem)

    width = width *coef
    length  = length *coef
    pitch_height = pitch_height * coef
    floor_floor_height = floor_floor_height * coef
    

    faces,boundary = roof(startPoint,width,length,pitch_height)

    vertices = [] 

    polysurface = []

    for face in faces: 

        points = constructGHPoints(face)
        vertices.append(points)

        surface = rg.NurbsSurface.CreateFromCorners(*points)
        
        polysurface.append(surface)


    boundaryPoints = constructGHPoints(boundary)
    boudaryPolyline = comps.PolyLine(boundaryPoints,True)
# ---------- end cookiecutter_01 ----------

Z = UnitZ(Factor=cookiecutter_01.floor_floor_height)
join = BrepJoin(Breps=cookiecutter_01.polysurface)  # -> Breps, Closed
extr = Extrude(Base=cookiecutter_01.boudaryPolyline, Direction=Z)
move = Move(Geometry=join.Breps, Motion=Z)  # -> Geometry, Transform
cap = CapHoles(Brep=extr)
merge = Merge(Data1=move.Geometry, Data2=cap)  # -> flatten(Result)

R = ClusterOutput(merge)

# ==== cluster LShapePitched
startpoint = ClusterInput()
width = ClusterInput()
length = ClusterInput()
pitch_height = ClusterInput()
floor_floor_height = ClusterInput()
unitsystem = ClusterInput()
cookiecutter_02 = Script(
    startPoint=graft(startpoint),
    width=graft(width),
    length=graft(length),
    pitch_height=graft(pitch_height),
    floor_floor_height=floor_floor_height,
    unitSystem=unitsystem)  # -> polysurface, boudaryPolyline, floor_floor_height; inputs startPoint: Point3d, unitSystem: String
# ---------- cookiecutter_02: Python ----------
import System
import Rhino
import Rhino.Geometry as rg
import Grasshopper
import ghpythonlib.components as comps
from ghpythonlib import treehelpers as th

import rhinoscriptsyntax as rs

def constructGHPoints(points):

    gh_points = []

    for point in points:

        gh_point = comps.ConstructPoint(point[0],point[1],point[2])
        gh_points.append(gh_point)
    
    return gh_points

def roof(point,w,l,h):

    x = point[0]
    y = point[1]
    z = point[2]

    #first horizontal row, left to right
    pt1 = (x,y,z)
    pt2 = (x + 1/4*w,y,z+h)
    pt3 = (x + 1/2*w,y,z)

    #second horizontal row, left to right
    pt4 = (x+1/2*w,y+1/2*l,z)
    #pt5 = (x+3/4*w,y+1/2*l,z+h)
    pt6 = (x+w,y+1/2*l,z)

    #third horizontal row, left to right
    pt7 = (x +1/4*w,y+3/4*l,z+h)
    pt8 = (x + 3/4*w,y+3/4*l,z+h)
    pt9 = (x+w, y+3/4*l,z+h)

    #fourth horizontal row, left to right
    pt10 = (x,y+l,z)
    pt11 = (x + 1/4*w, y+l,z+h)
    pt12 = (x+ 1/2*w, y+l,z)
    pt13 = (x+w,y+l,z)

    faces = [

        [pt1,pt2,pt11,pt10],
        [pt2,pt7,pt4,pt3],
        [pt7,pt9,pt6,pt4],
        [pt7,pt9,pt13,pt12],
        [pt12,pt11,pt7],
        [pt1,pt2,pt3],
        [pt10,pt11,pt12],
        [pt6,pt9,pt13],

    ]

    boundary = [

        pt1,
        pt3,
        pt4,
        pt6,
        pt13,
        pt10


    ]
    return faces, boundary

def unitCoverter(unitSystem):
    if unitSystem == 'inches':
        return 12
    if unitSystem == 'feet':
        return 1

if __name__ == '__main__':

    startPoint = startPoint

    coef = unitCoverter(unitSystem)

    width = width *coef
    length  = length *coef
    pitch_height = pitch_height * coef
    floor_floor_height = floor_floor_height * coef
    

    faces,boundary = roof(startPoint,width,length,pitch_height)

    vertices = [] 

    polysurface = []

    for face in faces: 

        points = constructGHPoints(face)
        vertices.append(points)
        surface = rg.NurbsSurface.CreateFromCorners(*points)
        polysurface.append(surface)


    boundaryPoints = constructGHPoints(boundary)
    boudaryPolyline = comps.PolyLine(boundaryPoints,True)
# ---------- end cookiecutter_02 ----------

Z = UnitZ(Factor=cookiecutter_02.floor_floor_height)
join = BrepJoin(Breps=cookiecutter_02.polysurface)  # -> Breps, Closed
extr = Extrude(Base=cookiecutter_02.boudaryPolyline, Direction=Z)
move = Move(Geometry=join.Breps, Motion=Z)  # -> Geometry, Transform
cap = CapHoles(Brep=extr)
merge = Merge(Data1=flatten(move.Geometry), Data2=flatten(cap))

R = ClusterOutput(merge)

# ==== cluster SimpleShotgun
startpoint = ClusterInput()
width = ClusterInput()
length = ClusterInput()
pitch_height = ClusterInput()
floor_floor_height = ClusterInput()
unitsystem = ClusterInput()
cookiecutter_03 = Script(
    startPoint=graft(startpoint),
    width=graft(width),
    length=graft(length),
    pitch_height=graft(pitch_height),
    floor_floor_height=floor_floor_height,
    unitSystem=unitsystem)  # -> polysurface, boudaryPolyline, floor_floor_height; inputs startPoint: Point3d, unitSystem: String
# ---------- cookiecutter_03: Python ----------
import System
import Rhino
import Rhino.Geometry as rg
import Grasshopper
import ghpythonlib.components as comps
from ghpythonlib import treehelpers as th

import rhinoscriptsyntax as rs

def constructGHPoints(points):

    gh_points = []

    for point in points:

        gh_point = comps.ConstructPoint(point[0],point[1],point[2])
        gh_points.append(gh_point)
    
    return gh_points

def roof(point,w,l,h):

    x = point[0]
    y = point[1]
    z = point[2]

    #first horizontal row, left to right
    pt1 = (x,y,z)
    pt2 = (x + 1/4*w,y,z+h)
    pt3 = (x + 1/2*w,y,z)


    #fourth horizontal row, left to right
    pt10 = (x,y+l,z)
    pt11 = (x + 1/4*w, y+l,z+h)
    pt12 = (x+ 1/2*w, y+l,z)


    faces = [

        [pt1,pt2,pt11,pt10],
        [pt12,pt11,pt2,pt3],
        [pt1,pt2,pt3],
        [pt10,pt11,pt12],

    ]

    boundary = [

        pt1,
        pt3,
        pt12,
        pt10

    ]
    return faces, boundary

def unitCoverter(unitSystem):
    if unitSystem == 'inches':
        return 12
    if unitSystem == 'feet':
        return 1

if __name__ == '__main__':

    startPoint = startPoint

    coef = unitCoverter(unitSystem)

    width = width *coef
    length  = length *coef
    pitch_height = pitch_height * coef
    floor_floor_height = floor_floor_height * coef
    

    faces,boundary = roof(startPoint,width,length,pitch_height)

    vertices = [] 

    polysurface = []

    for face in faces: 

        points = constructGHPoints(face)
        vertices.append(points)

        surface = rg.NurbsSurface.CreateFromCorners(*points)
        
        polysurface.append(surface)


    boundaryPoints = constructGHPoints(boundary)
    boudaryPolyline = comps.PolyLine(boundaryPoints,True)
# ---------- end cookiecutter_03 ----------

Z = UnitZ(Factor=cookiecutter_03.floor_floor_height)
join = BrepJoin(Breps=cookiecutter_03.polysurface)  # -> Breps, Closed
extr = Extrude(Base=cookiecutter_03.boudaryPolyline, Direction=Z)
move = Move(Geometry=join.Breps, Motion=Z)  # -> Geometry, Transform
cap = CapHoles(Brep=extr)
merge = Merge(Data1=move.Geometry, Data2=cap)  # -> flatten(Result)

R = ClusterOutput(merge)
