# Grasshopper definition Building Typology - Linear Building 0.1.0.gh (Grasshopper 1.0.7)
# plug-ins: ShapeDiverForGrasshopper

sddp = ShapeDiverDocumentPayload()
bldg_outline = Curve(graft([<curve referenced from the Rhino model> x3]))

no_of_floors = DigitScroller(Scroller_Digits=12, Scroller_Prefix="No. Of Floors", Scroller_Radix=11, Scroller_Value=0)
no_of_floors_2 = DigitScroller(Scroller_Digits=12, Scroller_Prefix="No. Of Floors", Scroller_Radix=11, Scroller_Value=1)
typical_floor_height = DigitScroller(Scroller_Digits=12, Scroller_Prefix="Typical Floor Height", Scroller_Radix=11, Scroller_Value=10)
_1st_stack_floor_height = DigitScroller(Scroller_Digits=12, Scroller_Prefix="1st Stack Floor Height", Scroller_Radix=11, Scroller_Value=10)
_2nd_stack_floor_height = DigitScroller(Scroller_Digits=12, Scroller_Prefix="2nd Stack Floor Height", Scroller_Radix=11, Scroller_Value=14)
omit_last_floor_slab = BooleanToggle(False)

bldgfromline = GhPythonScript(bldgOutline=bldg_outline, thickness=Slider(20, range=0..100), height=Slider(50, range=0..100))  # -> extrusion; inputs bldgOutline: Curve
# ---------- bldgfromline: Python ----------
__author__ = "Iliya Muzychuk"
__version__ = "2023.02.03"

import rhinoscriptsyntax as rs
import Grasshopper as gh
import Rhino.Geometry as rg
import ghpythonlib.components as comps

curve = bldgOutline

#creates Offset

outline_1 = comps.OffsetCurve(curve,thickness/2,corners = 1)
outline_2 = comps.OffsetCurve(curve,-thickness/2,corners = 1)

#end points 

start_a,end_a = comps.EndPoints(outline_1)
start_b,end_b = comps.EndPoints(outline_2)

#creates lines 

line_a = comps.Line(start_a,start_b)
line_b = comps.Line(end_a,end_b)

#create files polyline
print([outline_1,line_a,outline_2,line_b])
polyline = comps.JoinCurves([outline_1,line_a,outline_2,line_b],False)

#extrudes the footprint 
extrusion = comps.Extrude(polyline,comps.UnitZ(height))
extrusion = comps.CapHoles(extrusion)
# ---------- end bldgfromline ----------
brep = Brep(bldgfromline)
massing_calcs = MassingCalcs(
    massing=brep,
    first_stack_floor_height=_1st_stack_floor_height,
    first_stack_no_floors=no_of_floors_2,
    second_stack_floor_height=_2nd_stack_floor_height,
    second_stack_no_floors=no_of_floors,
    typical_floor_height=typical_floor_height,
    bool=omit_last_floor_slab)  # -> massing_3, massing_height, simplify(graft(roof)), walls, floor_surfaces, floor_plates, floor_as_curves
preview = CustomPreview(Geometry=massing_calcs.roof, Material=ColourSwatch(SwatchColor=RGB(255, 255, 255)))
preview_2 = CustomPreview(Geometry=massing_calcs.walls, Material=ColourSwatch(SwatchColor=RGBA(0, 0, 255, 10)))
preview_3 = CustomPreview(Geometry=massing_calcs.floor_plates, Material=ColourSwatch(SwatchColor=RGB(192, 192, 192)))

# ==== cluster MassingCalcs
first_stack_floor_height = ClusterInput()
first_stack_no_floors = ClusterInput()
second_stack_no_floors = ClusterInput()
typical_floor_height = ClusterInput()
second_stack_floor_height = ClusterInput()
massing = ClusterInput()
massing_2 = Brep(graft(massing))
distributefaces = GhPythonScript(Massing=simplify(massing_2))  # -> floor, walls, roof, massing_height; inputs Massing: list
# ---------- distributefaces: Python ----------
__author__ = "ilouh"
__version__ = "2023.01.08"

import rhinoscriptsyntax as rs
import ghpythonlib.components as comps
import Rhino.Geometry as geom

def getSrfElevation(surface):
    
    centerPoint = comps.EvaluateSurface(surface,comps.ConstructPoint(0.5,0.5,0))['point']
    elevation = centerPoint[2]
    
    return elevation

roof = []
floor = []
walls = [] 

roof_elevations = []
floor_elevations = []

#find the normal of each face

faces = comps.DeconstructBrep(Massing)['faces']
evaluation_point = comps.ConstructPoint(x_coordinate = 0.5, y_coordinate = 0.5, z_coordinate = 0)

for face in faces: 
    
    vector = comps.EvaluateSurface(face,evaluation_point)['normal']
    
    
    vector_a = comps.VectorXYZ(x_component = vector[0], y_component = vector[1], z_component = vector[2])['vector']
    vector_b = comps.UnitZ(1)

    cross_product = comps.CrossProduct(vector_a,vector_b,True)['vector']
    dot_product = round(comps.DotProduct(vector_a,vector_b,True),4)
    
    print(dot_product)
    
    if abs(dot_product) == 0: 
        walls.append(face)
    
    if dot_product > 0: 
        roof.append(face)
        roof_elevations.append(getSrfElevation(face))
        
        
    if dot_product == -1: 
        floor.append(face)
        floor_elevations.append(getSrfElevation(face))

#sort surface elevations

lowest_floor_elevation = floor_elevations.sort()
lowest_roof_elevation = roof_elevations.sort()

#select lowest floor and heights roof elevations

lowest_floor_elevation = floor_elevations[0]
lowest_roof_elevation = roof_elevations[-1]

#calculates massing height

massing_height = round(lowest_roof_elevation - lowest_floor_elevation,2)
# ---------- end distributefaces ----------

# ---- group: This Python Component Create the Contour Lines
python = GhPythonScript(
    massing=massing_2,
    First_Stack_Floor_Height=first_stack_floor_height,
    First_Stack_No_Floors=first_stack_no_floors,
    Second_Stack_Floor_Height=second_stack_floor_height,
    Second_Stack_No_Floors=second_stack_no_floors,
    Typical_Floor_Height=typical_floor_height)  # -> simplify(Distances), floor_as_curves; inputs massing: GeometryBase
# ---------- python: Python ----------
__author__ = "Iliya Muzychuk"
__version__ = "2023.02.03"

import rhinoscriptsyntax as rs
import Grasshopper as gh
import Rhino.Geometry as rg
import ghpythonlib.components as comps
import math

def bboxHeight(massing):
    
    box_corners_list = comps.BoxCorners(comps.BoundingBox(massing,comps.XYPlane(comps.ConstructPoint(0,0,0)))[0])
    boxHeight = comps.Distance(box_corners_list[0],box_corners_list[4])
    
    return boxHeight,box_corners_list[0]
#Variable Declaration

First_Stack_Floor_Height = First_Stack_Floor_Height
First_Stack_No_Floors = First_Stack_No_Floors
Second_Stack_Floor_Height = Second_Stack_Floor_Height
Second_Stack_No_Floors = Second_Stack_No_Floors
Typical_Floor_Height = Typical_Floor_Height
Overall_Building_Height = bboxHeight(massing)[0]
start_value_z = bboxHeight(massing)[1]

#Creates a list of distances for contouring. 

Distances = [0]

#Creates the list of first stack floors 

for i in range(0, int(First_Stack_No_Floors)):
    
    temp_height = (i + 1) * First_Stack_Floor_Height
    Distances.append(temp_height)

#Appends the list the second stack floors 
for i in range(0, int(Second_Stack_No_Floors)):
    
    temp_height = Distances[-1] + Second_Stack_Floor_Height
    Distances.append(temp_height)

remaining_floors = math.floor((round(Overall_Building_Height) - Distances[-1])/Typical_Floor_Height)

for i in range(0, int(remaining_floors)):
    
    temp_height = Distances[-1] + Typical_Floor_Height
    Distances.append(temp_height)
    
#print(remaining_floors)

intersection_Planes = []

print(Distances)
Distances = [d + 0.1 for d in Distances]
points = [] 

for d in Distances: 

    point = comps.Move(start_value_z,comps.UnitZ(d))['geometry']
    plane = comps.XYPlane(point)
    intersection_Planes.append(plane)

floor_as_curves = comps.MeshXPlane(massing,intersection_Planes)
# ---------- end python ----------

# ----
floor_thickness = Slider(0.5, range=0..1)
neg = Negative(Value=floor_thickness)
Z = UnitZ(Factor=neg)

srf = Surface(flatten(distributefaces.roof))
cls = Closed(Curve=python.floor_as_curves)  # -> Closed, Periodic
crv = Curve(python.floor_as_curves)
cull = CullPattern(List=python.floor_as_curves, CullPattern=cls.Closed)
bool = ClusterInput()
python_2 = GhPythonScript(thickness="0.1", floor_as_curves=cull, bool=bool)  # -> floor_surfaces, floor_plates, floor_as_curves; inputs floor_as_curves: list of Curve, bool: Boolean
# ---------- python_2: Python ----------
__author__ = "Iliya Muzychuk"
__version__ = "2023.02.03"

import rhinoscriptsyntax as rs
import Grasshopper as gh
import Rhino.Geometry as rg
import ghpythonlib.components as comps

def extrudeCurve(curves,thickenss):
    
    floor_plates = []
    
    for curve in curves:
        extrusion = comps.Extrude(curve,comps.UnitZ(-thickenss))
        extrusion = comps.CapHoles(extrusion)
        floor_plates.append(extrusion)
        
        print(floor_plates)
    
    return floor_plates

def sortByHeight(floors): 

    for floor in floors:
        
        z_value = comps.Area(floor)['centroid'][2]
        z_values.append(z_value)
    
    zipped_data = list(zip(floors,z_values))
    
    sorted_data = sorted(zipped_data, key=lambda x: x[1])
    
    floors,values = zip(*sorted_data)
    
    return floors

floors = floor_as_curves
z_values = []

for floor in floors:
    
    z_value = comps.Area(floor)['centroid'][2]
    z_values.append(z_value)

zipped_data = list(zip(floors,z_values))

print(bool)

if bool is True:
    
    zipped_data.pop()
    floor_as_curves = zip(*zipped_data)[0]

else: 
    pass
    
sorted_data = sorted(zipped_data, key=lambda x: x[1])

#create a dictionary to store grouped data
grouped_data = {}

#iterate through the values and curves

for curve,value in sorted_data:
    if value not in grouped_data:
        grouped_data[value] = [] #create a new list for the value
    grouped_data[value].append(curve)


#convert the dictionary to a list of sublists
grouped_curves_by_floor = list(grouped_data.values())

floor_surfaces = []
floor_plates = [] 

#Extrude the surfaces

for sublist in grouped_curves_by_floor:

    srf = comps.BoundarySurfaces(sublist)
    extrusion = comps.Extrude(srf,comps.UnitZ(thickness))
    floor_surfaces.append(srf)
    floor_plates.append(extrusion)
# ---------- end python_2 ----------

extr = Extrude(Base=srf, Direction=Z)
cap = CapHoles(Brep=extr)

floor_plates = ClusterOutput(python_2.floor_plates)
massing_3 = ClusterOutput(massing_2)
massing_height = ClusterOutput(distributefaces.massing_height)
roof = ClusterOutput(cap)
walls = ClusterOutput(distributefaces.walls)
floor_as_curves = ClusterOutput(python_2.floor_as_curves)
floor_surfaces = ClusterOutput(python_2.floor_surfaces)
