# Grasshopper definition Building Typology - RotatingTower 0.1.0.gh (Grasshopper 1.0.7)
# plug-ins: ShapeDiverForGrasshopper, Human

by_control_point_by_center_point = BooleanToggle(False)
rotation_degree = Slider(13, range=0..100)
sddp = ShapeDiverDocumentPayload()
buidling_footprint = Curve(graft(<curve referenced from the Rhino model>))
no_of_blocks = Slider(4, range=0..15)
range = Range(Domain=Domain(0, 1), Steps=no_of_blocks)
graph = GraphMapper(
    range,
    x0=0,
    x1=1,
    y0=0,
    y1=1,
    container_name="Bezier",
    cpx=[0, 0.5586337447, 0.3699992299, 1],
    cpy=[0, 0.2747219205, 0.6101834774, 1])
no_of_stories = Slider(80, range=0..100)
story_height = Slider(4, range=0..100)
cp = ControlPoints(Curve=buidling_footprint)  # -> Points, Weights, Knots

expression = Expression(x=graph, Expression="round(x,2)")
dom = ConstructDomain(DomainStart=Slider(0, range=0..100), DomainEnd=no_of_stories)
remap = RemapNumbers(Value=expression, Source=Domain(0, 1), Target=dom)  # -> Mapped, Clipped
expression_2 = Expression(x=remap.Mapped, height=story_height, Expression="round(x)*height")
item = ListItem(List=cp.Points, Index=Slider(3, range=0..4), Wrap=True)

area = Area(Geometry=buidling_footprint)  # -> Area, Centroid
filter = StreamFilter(Gate=by_control_point_by_center_point, Stream0=area.Centroid, Stream1=item)
bldgfromline = GhPythonScript(bldgFootprint=simplify(buidling_footprint), heights=expression_2, basePoint=simplify(filter), degree=rotation_degree)  # -> massing; inputs bldgFootprint: Curve, heights: list, basePoint: Point3d
# ---------- bldgfromline: Python ----------
__author__ = "Iliya Muzychuk"
__version__ = "2023.02.03"

import rhinoscriptsyntax as rs
import Grasshopper as gh
import Rhino.Geometry as rg
import ghpythonlib.components as comps
import math
#create rotation function

curve = bldgFootprint

massing = [] 

for i in range(0,len(heights)-1):
    
    extrusion_height = heights[i+1] - heights[i]
    print(extrusion_height)
    curve_moved = comps.Move(curve,comps.UnitZ(heights[i]))['geometry']
    extrusion = comps.Extrude(curve_moved,comps.UnitZ(extrusion_height))
    extrusion = comps.CapHoles(extrusion)
    
    #set rotation point 
    if i%2 == 0:
        
        angle = math.radians(degree*i*0.5)
        
    else:
        
        angle = math.radians(degree*i*0.5)
        
    extrusion = comps.Rotate3D(extrusion,angle,basePoint,comps.UnitZ(1))['geometry']

    massing.append(extrusion)
# ---------- end bldgfromline ----------

no_of_floors = DigitScroller(Scroller_Digits=12, Scroller_Prefix="No. Of Floors", Scroller_Radix=11, Scroller_Value=0)
no_of_floors_2 = DigitScroller(Scroller_Digits=12, Scroller_Prefix="No. Of Floors", Scroller_Radix=11, Scroller_Value=1)
_2nd_stack_floor_height = DigitScroller(Scroller_Digits=12, Scroller_Prefix="2nd Stack Floor Height", Scroller_Radix=11, Scroller_Value=0)
typical_floor_height = DigitScroller(Scroller_Digits=12, Scroller_Prefix="Typical Floor Height", Scroller_Radix=11, Scroller_Value=12)
_1st_stack_floor_height = DigitScroller(Scroller_Digits=12, Scroller_Prefix="1st Stack Floor Height", Scroller_Radix=11, Scroller_Value=12)
omit_last_floor_slab = BooleanToggle(True)

brep = Brep(bldgfromline)
massing_calcs = MassingCalcs(
    massing=brep,
    first_stack_floor_height=_1st_stack_floor_height,
    first_stack_no_floors=no_of_floors_2,
    second_stack_floor_height=_2nd_stack_floor_height,
    second_stack_no_floors=no_of_floors,
    typical_floor_height=typical_floor_height,
    bool=omit_last_floor_slab)  # -> massing_3, massing_height, simplify(graft(roof)), walls, simplify(floors_as_curves), floors_as_plates
preview = CustomPreview(Geometry=massing_calcs.roof, Material=ColourSwatch(SwatchColor=RGB(255, 255, 255)))
preview_2 = CustomPreview(Geometry=massing_calcs.walls, Material=ColourSwatch(SwatchColor=RGBA(0, 0, 255, 10)))
preview_3 = CustomPreview(Geometry=massing_calcs.floors_as_plates, Material=ColourSwatch(SwatchColor=RGB(192, 192, 192)))
previewlw = CustomPreviewLineweights(Geometry=brep, Shader=ColourSwatch(SwatchColor=RGBA(0, 0, 0, 0)), Absolute=False)

# ==== cluster MassingCalcs
first_stack_floor_height = ClusterInput()
first_stack_no_floors = ClusterInput()
second_stack_no_floors = ClusterInput()
typical_floor_height = ClusterInput()
second_stack_floor_height = ClusterInput()
massing = ClusterInput()
massing_2 = Brep(graft(massing))

# ---- group: This Python Component Create the Contour Lines
python = GhPythonScript(
    massing=massing_2,
    First_Stack_Floor_Height=first_stack_floor_height,
    First_Stack_No_Floors=first_stack_no_floors,
    Second_Stack_Floor_Height=second_stack_floor_height,
    Second_Stack_No_Floors=second_stack_no_floors,
    Typical_Floor_Height=typical_floor_height)  # -> simplify(Distances), floor_as_curves; inputs massing: GeometryBase
# ---------- python: Python ----------
__author__ = "Iliya Muzychuk"
__version__ = "2023.02.03"

import rhinoscriptsyntax as rs
import Grasshopper as gh
import Rhino.Geometry as rg
import ghpythonlib.components as comps
import math

def bboxHeight(massing):
    
    box_corners_list = comps.BoxCorners(comps.BoundingBox(massing,comps.XYPlane(comps.ConstructPoint(0,0,0)))[0])
    boxHeight = comps.Distance(box_corners_list[0],box_corners_list[4])
    
    return boxHeight,box_corners_list[0]
#Variable Declaration

First_Stack_Floor_Height = First_Stack_Floor_Height
First_Stack_No_Floors = First_Stack_No_Floors
Second_Stack_Floor_Height = Second_Stack_Floor_Height
Second_Stack_No_Floors = Second_Stack_No_Floors
Typical_Floor_Height = Typical_Floor_Height
Overall_Building_Height = bboxHeight(massing)[0]
start_value_z = bboxHeight(massing)[1]

#Creates a list of distances for contouring. 

Distances = [0]

#Creates the list of first stack floors 

for i in range(0, int(First_Stack_No_Floors)):
    
    temp_height = (i + 1) * First_Stack_Floor_Height
    print(temp_height)
    Distances.append(temp_height)

#Appends the list the second stack floors 
for i in range(0, int(Second_Stack_No_Floors)):
    
    temp_height = Distances[-1] + Second_Stack_Floor_Height
    Distances.append(temp_height)

remaining_floors = math.floor((round(Overall_Building_Height) - Distances[-1])/Typical_Floor_Height)

for i in range(0, int(remaining_floors)):
    
    temp_height = Distances[-1] + Typical_Floor_Height
    Distances.append(temp_height)
    
#print(remaining_floors)
#print(Distances)

intersection_Planes = []

intersection_Planes = []

for i in range(0,len(Distances)): 
    
    Distances[i] = Distances[i] + start_value_z[2]
    
for z in Distances: 
    
    point = comps.ConstructPoint(0,0,z)
    print(point)
    plane = comps.XYPlane(point)
    intersection_Planes.append(plane)
 

floor_as_curves = comps.MeshXPlane(massing,intersection_Planes)
# ---------- end python ----------

# ----
distributefaces = GhPythonScript(Massing=simplify(massing_2))  # -> floor, walls, roof, massing_height; inputs Massing: list
# ---------- distributefaces: Python ----------
__author__ = "ilouh"
__version__ = "2023.01.08"

import rhinoscriptsyntax as rs
import ghpythonlib.components as comps
import Rhino.Geometry as geom

def getSrfElevation(surface):
    
    centerPoint = comps.EvaluateSurface(surface,comps.ConstructPoint(0.5,0.5,0))['point']
    elevation = centerPoint[2]
    
    return elevation

roof = []
floor = []
walls = [] 

roof_elevations = []
floor_elevations = []

#find the normal of each face

faces = comps.DeconstructBrep(Massing)['faces']
evaluation_point = comps.ConstructPoint(x_coordinate = 0.5, y_coordinate = 0.5, z_coordinate = 0)

for face in faces: 
    
    vector = comps.EvaluateSurface(face,evaluation_point)['normal']
    
    
    vector_a = comps.VectorXYZ(x_component = vector[0], y_component = vector[1], z_component = vector[2])['vector']
    vector_b = comps.UnitZ(1)

    cross_product = comps.CrossProduct(vector_a,vector_b,True)['vector']
    dot_product = round(comps.DotProduct(vector_a,vector_b,True),4)
    
    print(dot_product)
    
    if abs(dot_product) == 0: 
        walls.append(face)
    
    if dot_product > 0: 
        roof.append(face)
        roof_elevations.append(getSrfElevation(face))
        
        
    if dot_product == -1: 
        floor.append(face)
        floor_elevations.append(getSrfElevation(face))

#sort surface elevations

lowest_floor_elevation = floor_elevations.sort()
lowest_roof_elevation = roof_elevations.sort()

#select lowest floor and heights roof elevations

lowest_floor_elevation = floor_elevations[0]
lowest_roof_elevation = roof_elevations[-1]

#calculates massing height

massing_height = round(lowest_roof_elevation - lowest_floor_elevation,2)
# ---------- end distributefaces ----------

floor_thickness = Slider(0.5, range=0..1)
neg = Negative(Value=floor_thickness)
Z = UnitZ(Factor=neg)

srf = Surface(flatten(distributefaces.roof))
panel = Panel(python.floor_as_curves)
bool = ClusterInput()

extr = Extrude(Base=srf, Direction=Z)
cap = CapHoles(Brep=extr)

python_2 = GhPythonScript(floor_as_curves=python.floor_as_curves, bool=bool, thickenss="0.5")  # -> simplify(floors_as_curves), floors_as_plates; inputs floor_as_curves: list of Curve
# ---------- python_2: Python ----------
__author__ = "ilouh"
__version__ = "2023.02.21"

import rhinoscriptsyntax as rs
import Grasshopper as gh
import Rhino.Geometry as rg
import ghpythonlib.components as comps
import math

def extrudeCurve(curves,thickenss):
    
    floor_plates = []
    
    for curve in curves:
        extrusion = comps.Extrude(curve,comps.UnitZ(-thickenss))
        extrusion = comps.CapHoles(extrusion)
        floor_plates.append(extrusion)
        
        print(floor_plates)
    
    return floor_plates

if bool is True:
    
    floors_as_curves = floor_as_curves[0:-1]
    floors_as_plates = extrudeCurve(floors_as_curves,thickenss)
    
else:
    floors_as_curves = floor_as_curves
    floors_as_plates = extrudeCurve(floors_as_curves,thickenss)
# ---------- end python_2 ----------
massing_3 = ClusterOutput(massing_2)
massing_height = ClusterOutput(distributefaces.massing_height)
roof = ClusterOutput(cap)
walls = ClusterOutput(distributefaces.walls)
floors_as_curves = ClusterOutput(python_2.floors_as_curves)
floors_as_plates = ClusterOutput(python_2.floors_as_plates)
