# Grasshopper definition Building_FacadeGenerator 0.1.2.gh (Grasshopper 1.0.7)
# plug-ins: Swiftlet

crv = Curve([<curve referenced from the Rhino model> x4])
input = DataInput(
    Destination="D:\10_Software Development\GH Scripts\Interchange\Massing.ghdata",
    RelativePath="D:\10_Software Development\GH Scripts\Interchange\Massing.ghdata|Interchange\Massing.ghdata",
    UpdateDelay=50000)
input_2 = DataInput(
    Destination="D:\10_Software Development\GH Scripts\Interchange\Height.ghdata",
    RelativePath="D:\10_Software Development\GH Scripts\Interchange\Height.ghdata|Interchange\Height.ghdata",
    UpdateDelay=50000)
brep = Brep([<brep referenced from the Rhino model> x3])
contour = Contour(Shape=brep, Point=Point(0, 0, 0), Direction=Vector(0, 0, 1), Distance=input_2)  # -> simplify(Contours)
building_outline = Curve(simplify(flatten(input)))
flip_curves = BooleanToggle(True)
list = ValueList({"Option One": 0, "Option Two": 1}, selected="Option One")
pipeline = GeometryPipeline(
    GroupByLayer=False,
    GroupByType=False,
    IncludeHidden=True,
    IncludeLocked=True,
    LayerFilter="FacadeElements*PanelA",
    NameFilter="*",
    SublayerFiltering=True,
    TypeFilter=1073741848)
pipeline_2 = GeometryPipeline(
    GroupByLayer=False,
    GroupByType=False,
    IncludeHidden=True,
    IncludeLocked=True,
    LayerFilter="FacadeElements*PanelB",
    NameFilter="*",
    SublayerFiltering=True,
    TypeFilter=1073741848)
boundary = BoundarySurfaces(Edges=input)
panel = Panel(pipeline_2)
matchcrvdir = MatchCrvDir(G=flip_curves, T=building_outline)
filter = StreamFilter(Gate=list, Stream0=pipeline, Stream1=pipeline_2)

lng = ListLength(List=matchcrvdir)
python = GhPythonScript(noStories=Slider(1, range=0..10), TotalStories=lng)  # -> mask; inputs noStories: Int32
# ---------- python: Python ----------
__author__ = "ilouh"
__version__ = "2022.12.14"

import rhinoscriptsyntax as rs


mask = []

for i in range(0,noStories):
    
    mask.append(True)

for i in range(noStories, TotalStories):
    
    mask.append(False)
# ---------- end python ----------
dispatch = Dispatch(List=matchcrvdir, DispatchPattern=python)  # -> ListA, ListB
residential_floors = Curve(graft(dispatch.ListB))
commercial_floors = Curve(graft(dispatch.ListA))

Z = UnitZ(Factor=1)
extr = Extrude(Base=boundary, Direction=Z)
python_2 = GhPythonScript(x=filter)  # -> glass, solid; inputs x: list
# ---------- python_2: Python ----------
__author__ = "ilouh"
__version__ = "2022.12.14"

import rhinoscriptsyntax as rs
import Rhino.Geometry as geom

glass = []
soild = [] 
areas = [] 

for item in x: 
    temp = rs.Area(item)
    areas.append(temp)
    
sorted_list = sorted(areas)

zipped_lists = zip(sorted_list,x)

print(zipped_lists[1][1])

glass = zipped_lists[0][1]
solid = zipped_lists[1][1]
# ---------- end python_2 ----------
item = ListItem(List=flatten(extr), Index=-1, Wrap=True)
glass = Surface(python_2.glass)
solid = Brep(python_2.solid)
move = Move(Geometry=item, Motion=Vector(0, 0, 10))  # -> Geometry, Transform
explode = Explode(Curve=residential_floors, Recursive=True)  # -> Segments, Vertices
get = GETRequest()  # -> Status, Content, Response
explode_2 = Explode(Curve=commercial_floors, Recursive=True)  # -> Segments, Vertices
python_3 = GhPythonScript(crv=explode.Segments, facade_length=Slider(12, range=0..100), height=input_2)  # -> simplify(points), simplify(panels); inputs crv: Curve
# ---------- python_3: Python ----------
__author__ = "ilouh"
__version__ = "2022.12.10"

import rhinoscriptsyntax as rs
import ghpythonlib.components as comps
import Rhino.Geometry as geom


#Sometimes the curve is too small to be divided. 

length = comps.Length(crv)
points = rs.DivideCurve(crv, round(length/facade_length,0))

z_transition = comps.UnitZ(height)

panels = [] 

for i in range(0, len(points)-1):
    
    pt_1 = points[i]
    pt_2 = points[i+1]
    pt_3 = comps.Move(pt_1,z_transition)
    pt_3 = pt_3['geometry']
    pt_4 = comps.Move(pt_2,z_transition)
    pt_4 = pt_4['geometry']
    
    print(pt_1)
    
    polyline = comps.PolyLine([pt_1,pt_2,pt_4,pt_3],True)
    surface = comps.BoundarySurfaces(polyline)
    panels.append(surface)
# ---------- end python_3 ----------
python_4 = GhPythonScript(crv=explode_2.Segments, facade_length=Slider(3, range=0..100), height=input_2)  # -> simplify(points), simplify(panels); inputs crv: Curve
# ---------- python_4: Python ----------
__author__ = "ilouh"
__version__ = "2022.12.10"

import rhinoscriptsyntax as rs
import ghpythonlib.components as comps
import Rhino.Geometry as geom


#Sometimes the curve is too small to be divided. 
length = comps.Length(crv)
points = rs.DivideCurve(crv, round(length/facade_length,0))

z_transition = comps.UnitZ(height)

panels = [] 

for i in range(0, len(points)-1):
    
    pt_1 = points[i]
    pt_2 = points[i+1]
    pt_3 = comps.Move(pt_1,z_transition)
    pt_3 = pt_3['geometry']
    pt_4 = comps.Move(pt_2,z_transition)
    pt_4 = pt_4['geometry']
    
    print(pt_1)
    
    polyline = comps.PolyLine([pt_1,pt_2,pt_4,pt_3],True)
    surface = comps.BoundarySurfaces(polyline)
    panels.append(surface)
# ---------- end python_4 ----------
flip = FlipMatrix(Data=explode.Segments)
srf = Surface(python_4.panels)
srf_2 = Surface(python_3.panels)
loft = Loft(Curves=flip, Options={Adjust=False, Closed=False, LoftEnds=0, LoftSimp=0, LoftType=0, Rebuild=10, Refit=0.01})
bbox_of_panel = BBOXOfPanel(S=srf_2, B=srf_2, A=Slider(10, range=0..10))  # -> simplify(B_2)
trim = TrimTree(Tree=bbox_of_panel, Depth=1)
# Flips from Edge; Floor to Floor; Edge.
# 
# Basically the 1st number indicates the facade it related to.
path_mapper = PathMapper(trim, source="{A;B}", target="{B;A}")
item_2 = ListItem(List=path_mapper, Index=0, Wrap=True)
# This scipt needs rework to get to checker board pattern
python_5 = GhPythonScript(x=path_mapper)  # -> typeA, typeB; inputs x: tree
# ---------- python_5: Python ----------
__author__ = "ilouh"
__version__ = "2022.12.14"

import rhinoscriptsyntax as rs
import ghpythonlib.treehelpers as th


a = th.tree_to_list(x)
print(len(a))

typeA = []
typeB = [] 

for i in range(0,len(a)): 

    if i%2 == 0: 
    
        print('true')
        
        for j in range(0,len(a[i])):
            
            if j%2 ==0:
                typeA.append(a[i][j])
            else:
                typeB.append(a[i][j])
    else: 
        
        for j in range(0,len(a[i])):
            
            if j%2 == 0:
                typeB.append(a[i][j])
            else:
                typeB.append(a[i][j])
        
    print('end of branch')
# ---------- end python_5 ----------
panel_2 = Panel(path_mapper)
panel_3 = Panel(python_5.typeB)
panel_4 = Panel(python_5.typeA)

solid_2 = Brep(solid)
bbox = BoundingBox(Content=solid_2, Plane=PlaneXY(0, 0, 0))  # -> Box, Box_2
boxmap = BoxMapping(Geometry=solid_2, Source=bbox.Box, Target=bbox_of_panel)  # -> Geometry, Transform

glass_2 = Brep(glass)
boxmap_2 = BoxMapping(Geometry=glass_2, Source=bbox.Box, Target=bbox_of_panel)  # -> Geometry, Transform

cull = CullPattern(List=path_mapper, CullPattern=[False, True])  # disabled
cull_2 = CullPattern(List=path_mapper, CullPattern=[True, False])  # disabled
swatch = ColourSwatch(SwatchColor=RGB(106, 112, 74))  # disabled
swatch_2 = ColourSwatch(SwatchColor=RGB(203, 242, 5))  # disabled
preview = CustomPreview(Geometry=python_5.typeA, Material=swatch_2)  # disabled
preview_2 = CustomPreview(Geometry=python_5.typeB, Material=swatch)  # disabled
material = CreateMaterial(
    Diffuse=ColourSwatch(SwatchColor=RGB(255, 255, 255)),
    Specular=RGB(255, 255, 255),
    Emission=RGB(0, 0, 0),
    Transparency=0,
    Shine=0)
material_2 = CreateMaterial(
    Diffuse=ColourSwatch(SwatchColor=RGB(44, 161, 219)),
    Specular=RGB(255, 255, 255),
    Emission=RGB(0, 0, 0),
    Transparency=ColourSwatch(SwatchColor=RGB(168, 162, 162)),
    Shine=0)
preview_3 = CustomPreview(Geometry=boxmap.Geometry, Material=material)
preview_4 = CustomPreview(Geometry=boxmap_2.Geometry, Material=material_2)

# ==== cluster BBOXOfPanel
md_slider = MDSlider(SliderMode=0, slider_value=Point(0.5, 0.5, 0.5), x_domain=Domain(0, 1), y_domain=Domain(0, 1), z_domain=Domain(0, 1))
S = ClusterInput()
evalsrf = EvaluateSurface(Surface=reparameterize(S), Point=md_slider)  # -> Point, Normal, UDirection, VDirection, Frame
A = ClusterInput()
amp = Amplitude(Vector=evalsrf.Normal, Amplitude=expr("x/12", A))
B = ClusterInput()

extr = Extrude(Base=B, Direction=amp)
pln = Plane(evalsrf.Frame)
graft = GraftTree(Tree=simplify(pln), IncludeEmptyLists=True, IncludeNullItems=True)
graft_2 = GraftTree(Tree=simplify(extr), IncludeEmptyLists=True, IncludeNullItems=True)
bbox = BoundingBox(Content=graft_2, Plane=graft)  # -> simplify(Box), Box_2

B_2 = ClusterOutput(bbox.Box)

# ==== cluster MatchCrvDir
T = ClusterInput()
flatten = FlattenTree(Tree=T, Path="{0}")
item = ListItem(List=flatten, Index=0, Wrap=True)
flip = FlipCurve(Curve=flatten, Guide=item)  # -> Curve, Flag
G = ClusterInput()
flip_2 = FlipCurve(Curve=flip.Curve)  # -> Curve, Flag
filter = StreamFilter(Gate=G, Stream0=flip.Curve, Stream1=flip_2.Curve)
s_1 = ClusterOutput(filter)
