# Grasshopper definition Building_Program Units Outlines 0.3.1.gh (Grasshopper 1.0.7)

input = DataInput(
    Destination="G:\My Drive\Scripting Repository\Exchange Data\FloorPlates.ghdata",
    RelativePath="G:\My Drive\Scripting Repository\Exchange Data\FloorPlates.ghdata|..\..\Exchange Data\FloorPlates.ghdata",
    UpdateDelay=50000)  # disabled
input_2 = DataInput(
    Destination="G:\My Drive\Scripting Repository\Exchange Data\FloorBreps.ghdata",
    RelativePath="G:\My Drive\Scripting Repository\Exchange Data\FloorBreps.ghdata|..\..\Exchange Data\FloorBreps.ghdata",
    UpdateDelay=50000)  # disabled
input_3 = DataInput(
    Destination="G:\My Drive\Scripting Repository\Exchange Data\RoofBreps.ghdata",
    RelativePath="G:\My Drive\Scripting Repository\Exchange Data\RoofBreps.ghdata|..\..\Exchange Data\RoofBreps.ghdata",
    UpdateDelay=50000)  # disabled
input_4 = DataInput(
    Destination="G:\My Drive\Scripting Repository\Exchange Data\CommercialFloors.ghdata",
    RelativePath="G:\My Drive\Scripting Repository\Exchange Data\CommercialFloors.ghdata|..\..\Exchange Data\CommercialFloors.ghdata",
    UpdateDelay=50000)  # disabled
swatch = ColourSwatch(SwatchColor=RGB(255, 255, 255))  # disabled
swatch_2 = ColourSwatch(SwatchColor=RGB(255, 255, 255))  # disabled
swatch_3 = ColourSwatch(SwatchColor=RGB(255, 255, 255))  # disabled
path_curve = Curve(reparameterize(graft([<curve referenced from the Rhino model> x2])))
unit_area = DigitScroller(Scroller_Digits=12, Scroller_Prefix="Unit Area", Scroller_Radix=9, Scroller_Value=900)
unit_width = DigitScroller(Scroller_Digits=12, Scroller_Prefix="Unit Width", Scroller_Radix=9, Scroller_Value=30)
unit_length = DigitScroller(Scroller_Digits=12, Scroller_Prefix="Unit Length", Scroller_Radix=9, Scroller_Value=30)
unit_height = DigitScroller(Scroller_Digits=12, Scroller_Prefix="Unit Height", Scroller_Radix=9, Scroller_Value=9.25)
true_by_unit_length_false_by_unit_area = BooleanToggle(False)
true_inboard_false_outboard = BooleanToggle(False)
preview = CustomPreview(Geometry=input_2, Material=swatch)  # disabled
preview_2 = CustomPreview(Geometry=input_3, Material=swatch_3)  # disabled
preview_3 = CustomPreview(Geometry=input_4, Material=swatch_2)  # disabled
python = GhPythonScript()  # -> out; inputs list_floors: list
# ---------- python: Python ----------
__author__ = "Iliya Muzychuk"
__version__ = "2023.02.03"

import rhinoscriptsyntax as rs
import Grasshopper as gh
import Rhino.Geometry as rg
import ghpythonlib.components as comps

#list_floors = [1,1,1]
#list_units = [1,1,1]
#list_commerical_floors = [1,1,1]
#list_typical_units = [1,1,10]
#list_non_typical_units = [1,1,1,1,1]
#Gross_typical_unit_area = 1000
#Gross_non_typical_unit_area = 1000

def floor_breakdown(list_floors):

    dic = {}
    for i in range(0,len(list_floors)):
        dic["Floor " + str(i+1)] = str(list_floors[i]) + "sf"
    return dic



building_name = "building Name"
gross_floor_area = sum(list_floors)
number_of_floors = len(list_floors)
floor_breakdown_var = floor_breakdown(list_floors)




json_scheme = {

    "building Name": building_name,
    "Gross Floor Area": gross_floor_area,
    "Number of Floors": number_of_floors,
    "Floor breakdown" : floor_breakdown_var,

    "program area" :   
        {
            "Residential":
                {
                "Number of units": len(list_units),
                "Number of typical units": len(list_typical_units),
                "Number of non-typical units": list_non_typical_units,
                "Commerical area": sum(list_commerical_floors),
                "typical unit size": Gross_typical_unit_area/len(list_typical_units),
                "non-typical unit size": Gross_non_typical_unit_area/len(list_non_typical_units)
                },
                
            "Commerical":{

                "Number of Floors": len(list_commerical_floors),
                "Gross Area": sum(list_commerical_floors)

                }

        }
    }

out = json_scheme
# ---------- end python ----------

python_2 = GhPythonScript(bool=true_inboard_false_outboard)  # -> coef
# ---------- python_2: Python ----------
__author__ = "ilouh"
__version__ = "2023.02.21"

import rhinoscriptsyntax as rs
import Grasshopper as gh
import Rhino.Geometry as rg
import ghpythonlib.components as comps
import math

if bool == True: 
    
    coef = 1

else:
    
    coef = -1
# ---------- end python_2 ----------
expression = Expression(Unit_Length=unit_length, coef=python_2, Expression="coef * Unit_Length")
expression_2 = Expression(Unit_Area=unit_area, Unit_Width=unit_width, coef=python_2, Expression="coef * Ceiling(Unit_Area/Unit_Width)")

explode = Explode(Curve=path_curve, Recursive=True)  # -> simplify(Segments), Vertices

# ---- group: Creates a script to subdivide a curve into units
python_3 = GhPythonScript(crv=explode.Segments, facade_length=unit_width)  # -> simplify(points); inputs crv: Curve
# ---------- python_3: Python ----------
__author__ = "ilouh"
__version__ = "2022.12.10"

import rhinoscriptsyntax as rs
import ghpythonlib.components as comps

def subdivide_curve(curve, num_subdivisions):

    # Use the DivideCurve function to perform the subdivision
    points = rs.DivideCurve(curve, num_subdivisions)
    
    curve_segments = []
    shatter_parameters = []
    
    for i in range(len(points) - 1):
        
        #curve_segments.append(rs.AddLine(points[i], points[i + 1]))
        
        t = rs.CurveClosestPoint(curve, points[i])
        shatter_parameters.append(t)
        
    curve_segments = comps.Shatter(curve,shatter_parameters)

    return curve_segments


length = rs.CurveLength(crv)

num = round(length / facade_length,0)
a = subdivide_curve(crv,num)
points = rs.DivideCurve(crv, num)
# ---------- end python_3 ----------

# ----
filter = StreamFilter(Gate=true_by_unit_length_false_by_unit_area, Stream0=expression_2, Stream1=expression)
Z = UnitZ(Factor=expr("x-2", unit_height))
crv = Curve([<curve referenced from the Rhino model> x71])
brep = Brep([<brep referenced from the Rhino model> x5])
group = Group(Objects=crv)
bbox = BoundingBox(Content=crv, Plane=PlaneXY(0, 0, 0), UnionBox=True)  # -> Box, Box_2

# ---- group: Offset the curves and joins the points for the demising lines
offset = OffsetCurve(Curve=path_curve, Distance=filter, Corners=Slider(1, range=0..4))
crv_cp = CurveClosestPoint(Point=python_3, Curve=reparameterize(graft(explode.Segments)))  # -> Point, Parameter, Distance

# ----
explode_2 = Explode(Curve=offset, Recursive=True)  # -> simplify(Segments), Vertices

# ---- group: Offset the curves and joins the points for the demising lines (continued)
crv_cp_2 = CurveClosestPoint(Point=python_3, Curve=simplify(graft(explode_2.Segments)))  # -> Point, Parameter, Distance
ln = Line(StartPoint=crv_cp.Point, EndPoint=crv_cp_2.Point)

# ---- group: Checks Vector Degree
end = EndPoints(Curve=ln)  # -> Start, End
crv_cp_3 = CurveClosestPoint(Point=end.Start, Curve=graft(explode.Segments))  # -> Point, Parameter, Distance
vec2pt = Vector2Pt(PointA=end.Start, PointB=end.End, Unitize=False)  # -> Vector, Length
eval = EvaluateCurve(Curve=graft(explode.Segments), Parameter=crv_cp_3.Parameter)  # -> Point, Tangent, Angle
dprod = DotProduct(VectorA=eval.Tangent, VectorB=vec2pt.Vector, Unitize=False)

# ----
panel = Panel(dprod)

# ---- group: Removes non perpendicular lines
similar = Similarity(FirstNumber=panel, SecondNumber=Slider(0, range=0..100), Threshold="5")  # -> Similarity, AbsoluteDifference
cull = CullPattern(List=ln, CullPattern=similar.Similarity)  # -> simplify(List)

# ----
end_2 = EndPoints(Curve=cull)  # -> Start, End
trim = TrimTree(Tree=end_2.Start, Depth=1)
pt = Point(trim)
crv_2 = Curve(reparameterize(path_curve))
crv_cp_4 = CurveClosestPoint(Point=pt, Curve=crv_2)  # -> Point, Parameter, Distance
shatter = Shatter(Curve=crv_2, Parameters=crv_cp_4.Parameter)

offset_2 = OffsetCurve(Curve=crv_2, Distance=filter, Corners=Slider(1, range=0..4))

crv_cp_5 = CurveClosestPoint(Point=pt, Curve=offset_2)  # -> Point, Parameter, Distance
shatter_2 = Shatter(Curve=offset_2, Parameters=crv_cp_5.Parameter)

merge = Merge(Data1=simplify(graft(shatter)), Data2=simplify(graft(shatter_2)))
loft = Loft(Curves=merge, Options={Adjust=False, Closed=False, LoftEnds=0, LoftSimp=0, LoftType=0, Rebuild=10, Refit=0.01})  # -> simplify(flatten(Loft))

midpt = CurveMiddle(Curve=merge)
python_4 = GhPythonScript(surfaces=loft)  # -> Typical_Units, Corner_Units, dic, areas, center_points; inputs surfaces: list of Brep
# ---------- python_4: Python ----------
__author__ = "ilouh"
__version__ = "2023.02.21"

import rhinoscriptsyntax as rs
import Grasshopper as gh
import Rhino.Geometry as rg
import ghpythonlib.components as comps
import math

Typical_Units = [] 
Corner_Units = []
areas = []
center_points = []

areas_Corner_units = []
areas_Typical_units = []

dic = {}

i = 0 

for surface in surfaces:
    
    
    temp = comps.DeconstructBrep(surface)
    points = temp['vertices']
    
    
    unit_area = comps.Area(surface)
    
    unit_center = unit_area['centroid']
    
    
    unit_area = round(unit_area['area'],2)
    unit_number = 'Unit Number {}'.format(i)
    
    
    if len(points) > 4: 
        
        unit_name = 'Corner Unit',
        unit_type = 'Two Bedroom',
        Corner_Units.append(surface)

        
    else:
        
        unit_name = 'Typical Unit',
        unit_type = 'One Bedroom',
        Typical_Units.append(surface)

    


    dic_temp = {

        'Unit Name':  unit_name,
        'Unit Area': unit_area,
        'Unit Number' : unit_number,
        'Unit Type' : unit_type


    }
    
    dic[unit_number] = dic_temp
    str = '{} \n {} sf'.format(unit_type,unit_area)
    areas.append(str)
    center_points.append(unit_center)
    
    i= i+1
# ---------- end python_4 ----------

# ---- group: Builds a tree to run extrusion once
flatten = FlattenTree(Tree=python_4.Typical_Units, Path="{0}")
flatten_2 = FlattenTree(Tree=python_4.Corner_Units, Path="{1}")
merge_2 = Merge(Data1=flatten, Data2=flatten_2)

# ----
points = PointList(Points=midpt, Size=Slider(5, range=0..10))

Z_2 = UnitZ(Factor=unit_height)
extr = Extrude(Base=merge_2, Direction=Z_2)  # -> simplify(Extrusion)

# ---- group: Display Project Wireframe
wires = BrepWireframe(Brep=[extr, input_2, input_4], Density=-1)

# ----
bang = ExplodeTree(Data=extr)  # -> Branch0, Branch1
brep_2 = Brep(flatten(bang.Branch0))
brep_3 = Brep(flatten(bang.Branch1))
python_5 = GhPythonScript(x=python_4.areas)  # -> flatten(out)
# ---------- python_5: Python ----------
__author__ = "ilouh"
__version__ = "2023.02.21"

import rhinoscriptsyntax as rs
import Grasshopper as gh
import Rhino.Geometry as rg
import ghpythonlib.components as comps
import math

def remove_chars(string):
    """
    Remove characters ( ) ' , from a string.

    Args:
        string (str): The input string.

    Returns:
        str: The input string with ( ) ' , characters removed.
    """
    chars_to_remove = ["(", ")", "'", ","]
    for char in chars_to_remove:
        string = string.replace(char, "")
    return string

out = remove_chars(x)
print(out)
# ---------- end python_5 ----------
move = Move(Geometry=python_4.center_points, Motion=Z)  # -> Geometry, Transform
preview_4 = CustomPreview(Geometry=brep_2, Material=ColourSwatch(SwatchColor=RGBA(190, 219, 184, 145)))
preview_5 = CustomPreview(Geometry=brep_3, Material=ColourSwatch(SwatchColor=RGBA(70, 79, 73, 158)))
tag = TextTag(Location=move.Geometry, Text=python_5)

# ---- group: Isolate Faces of Mass
panel_2 = Panel("{0.5,0.5,0}")
debrep = DeconstructBrep(Brep=brep_2)  # -> Faces, Edges, Vertices
evalsrf = EvaluateSurface(Surface=reparameterize(debrep.Faces), Point=panel_2)  # -> Point, Normal, UDirection, VDirection, Frame
distributefaces = GhPythonScript(faces=debrep.Faces, brep=brep_2)  # -> floors, facadeWalls, roof; inputs faces: list, brep: Brep
# ---------- distributefaces: Python ----------
__author__ = "ilouh"
__version__ = "2023.01.08"

import rhinoscriptsyntax as rs
import ghpythonlib.components as comps
import Rhino.Geometry as geom

#elements = comps.DeconstructBrep(mass)
#faces = elements['faces']

#find the normal of each face


roof = []
floors = []
solidWalls = []
facadeWalls = [] 

faces = comps.DeconstructBrep(brep)
faces = faces['faces']

for face in faces: 
    
    #evaluate the normal of the sruface
    evaluate_surface = comps.EvaluateSurface(face,(0.5,0.5,0))
    normal = evaluate_surface['normal']
    
    values = comps.DeconstructVector(normal) 

    print(values)
    
    x_value = values['x_component']
    y_value = values['y_component']
    z_value = values['z_component']
    

    if z_value == -1:
        
        floors.append(faces[i])
# ---------- end distributefaces ----------

# ----
flip = Flip(Surface=distributefaces.floors)  # -> Surface, Result
evalsrf_2 = EvaluateSurface(Surface=reparameterize(flip.Surface), Point=panel_2)  # -> Point, Normal, UDirection, VDirection, Frame
panel_3 = Panel(distributefaces.floors)
deplane = DeconstructPlane(Plane=evalsrf_2.Frame)  # -> Origin, XAxis, YAxis, ZAxis
bbox_2 = BoundingBox(Content=graft(brep_2), Plane=evalsrf_2.Frame)  # -> flatten(Box), Box_2
boxmap = BoxMapping(Geometry=group, Source=bbox.Box, Target=bbox_2.Box)  # -> Geometry, Transform
