# Grasshopper definition Building_Program Units Outlines 0.3.2.gh (Grasshopper 1.0.7)

path_curve = Curve(reparameterize(graft(<curve referenced from the Rhino model>)))
unit_area = DigitScroller(Scroller_Digits=12, Scroller_Prefix="Unit Area", Scroller_Radix=9, Scroller_Value=600)
unit_width = DigitScroller(Scroller_Digits=12, Scroller_Prefix="Unit Width", Scroller_Radix=9, Scroller_Value=15)
unit_length = DigitScroller(Scroller_Digits=12, Scroller_Prefix="Unit Length", Scroller_Radix=9, Scroller_Value=30)
unit_height = DigitScroller(Scroller_Digits=12, Scroller_Prefix="Unit Height", Scroller_Radix=9, Scroller_Value=9.25)
true_by_unit_length_false_by_unit_area = BooleanToggle(True)
true_inboard_false_outboard = BooleanToggle(True)
if_only_one_curve_true_if_more_than_1_cu = BooleanToggle(False)  # "If only one curve = True | If more than 1 curve = False"
unit_layout = Curve([<curve referenced from the Rhino model> x57])
viewer = ParamViewer(path_curve)

python = GhPythonScript(bool=true_inboard_false_outboard)  # -> coef
# ---------- python: Python ----------
__author__ = "ilouh"
__version__ = "2023.02.21"

import rhinoscriptsyntax as rs
import Grasshopper as gh
import Rhino.Geometry as rg
import ghpythonlib.components as comps
import math

if bool == True: 
    
    coef = 1

else:
    
    coef = -1
# ---------- end python ----------
expression = Expression(Unit_Length=unit_length, coef=python, Expression="coef * Unit_Length")
expression_2 = Expression(Unit_Area=unit_area, Unit_Width=unit_width, coef=python, Expression="coef * Ceiling(Unit_Area/Unit_Width)")

explode = Explode(Curve=path_curve, Recursive=True)  # -> simplify(Segments), Vertices

# ---- group: Creates a script to subdivide a curve into units
python_2 = GhPythonScript(crv=explode.Segments, facade_length=unit_width)  # -> simplify(points); inputs crv: Curve
# ---------- python_2: Python ----------
__author__ = "ilouh"
__version__ = "2022.12.10"

import rhinoscriptsyntax as rs
import ghpythonlib.components as comps

def subdivide_curve(curve, num_subdivisions):

    # Use the DivideCurve function to perform the subdivision
    points = rs.DivideCurve(curve, num_subdivisions)
    
    curve_segments = []
    shatter_parameters = []
    
    for i in range(len(points) - 1):
        
        #curve_segments.append(rs.AddLine(points[i], points[i + 1]))
        
        t = rs.CurveClosestPoint(curve, points[i])
        shatter_parameters.append(t)
        
    curve_segments = comps.Shatter(curve,shatter_parameters)

    return curve_segments


length = rs.CurveLength(crv)

num = round(length / facade_length,0)
a = subdivide_curve(crv,num)
points = rs.DivideCurve(crv, num)
# ---------- end python_2 ----------

# ----
filter = StreamFilter(Gate=true_by_unit_length_false_by_unit_area, Stream0=expression_2, Stream1=expression)
Z = UnitZ(Factor=expr("x-2", unit_height))
group = Group(Objects=unit_layout)
bbox = BoundingBox(Content=group, Plane=PlaneXY(0, 0, 0), UnionBox=True)  # -> Box, Box_2
debrep = DeconstructBrep(Brep=bbox.Box)  # -> Faces, Edges, Vertices

# ---- group: Offset the curves and joins the points for the demising lines
offset = OffsetCurve(Curve=path_curve, Distance=filter, Corners=Slider(1, range=0..4))
crv_cp = CurveClosestPoint(Point=python_2, Curve=reparameterize(graft(explode.Segments)))  # -> Point, Parameter, Distance

# ----
explode_2 = Explode(Curve=offset, Recursive=True)  # -> simplify(Segments), Vertices

# ---- group: Offset the curves and joins the points for the demising lines (continued)
crv_cp_2 = CurveClosestPoint(Point=python_2, Curve=simplify(graft(explode_2.Segments)))  # -> Point, Parameter, Distance
# Offesting outboard creates a different count of points which creates conflicts
ln = Line(StartPoint=crv_cp.Point, EndPoint=crv_cp_2.Point)

# ---- group: Checks Vector Degree
end = EndPoints(Curve=ln)  # -> Start, End
crv_cp_3 = CurveClosestPoint(Point=end.Start, Curve=graft(explode.Segments))  # -> Point, Parameter, Distance
vec2pt = Vector2Pt(PointA=end.Start, PointB=end.End, Unitize=False)  # -> Vector, Length
eval = EvaluateCurve(Curve=graft(explode.Segments), Parameter=crv_cp_3.Parameter)  # -> Point, Tangent, Angle
dprod = DotProduct(VectorA=eval.Tangent, VectorB=vec2pt.Vector, Unitize=False)

# ----
panel = Panel(dprod)

# ---- group: Removes non perpendicular lines
similar = Similarity(FirstNumber=panel, SecondNumber=Slider(0, range=0..100), Threshold="5")  # -> Similarity, AbsoluteDifference
cull = CullPattern(List=ln, CullPattern=similar.Similarity)  # -> simplify(List)

# ----
end_2 = EndPoints(Curve=cull)  # -> Start, End
trim = TrimTree(Tree=end_2.Start, Depth=1)
filter_2 = StreamFilter(Gate=if_only_one_curve_true_if_more_than_1_cu, Stream0=end_2.Start, Stream1=trim)
crv = Curve(reparameterize(path_curve))
pt = Point(filter_2)
crv_cp_4 = CurveClosestPoint(Point=pt, Curve=crv)  # -> Point, Parameter, Distance
shatter = Shatter(Curve=crv, Parameters=crv_cp_4.Parameter)

offset_2 = OffsetCurve(Curve=crv, Distance=filter, Corners=Slider(1, range=0..4))

crv_cp_5 = CurveClosestPoint(Point=pt, Curve=offset_2)  # -> Point, Parameter, Distance
shatter_2 = Shatter(Curve=offset_2, Parameters=crv_cp_5.Parameter)

merge = Merge(Data1=simplify(graft(shatter)), Data2=simplify(graft(shatter_2)))
loft = Loft(Curves=merge, Options={Adjust=False, Closed=False, LoftEnds=0, LoftSimp=0, LoftType=0, Rebuild=10, Refit=0.01})  # -> simplify(flatten(Loft))

midpt = CurveMiddle(Curve=merge)
python_3 = GhPythonScript(surfaces=loft)  # -> Typical_Units, Corner_Units, dic, areas, center_points, amount_of_units; inputs surfaces: list of Brep
# ---------- python_3: Python ----------
__author__ = "ilouh"
__version__ = "2023.02.21"

import rhinoscriptsyntax as rs
import Grasshopper as gh
import Rhino.Geometry as rg
import ghpythonlib.components as comps
import math

Typical_Units = [] 
Corner_Units = []
areas = []
center_points = []

areas_Corner_units = []
areas_Typical_units = []

dic = {}

i = 0 

for surface in surfaces:
    
    
    temp = comps.DeconstructBrep(surface)
    points = temp['vertices']
    
    
    unit_area = comps.Area(surface)
    
    unit_center = unit_area['centroid']
    
    
    unit_area = round(unit_area['area'],2)
    unit_number = 'Unit Number {}'.format(i)
    
    
    if len(points) > 4: 
        
        unit_name = 'Corner Unit',
        unit_type = 'Two Bedroom',
        Corner_Units.append(surface)

        
    else:
        
        unit_name = 'Typical Unit',
        unit_type = 'One Bedroom',
        Typical_Units.append(surface)

    


    dic_temp = {

        'Unit Name':  unit_name,
        'Unit Area': unit_area,
        'Unit Number' : unit_number,
        'Unit Type' : unit_type


    }
    
    dic[unit_number] = dic_temp
    str = '{} \n {} sf'.format(unit_type,unit_area)
    areas.append(str)
    center_points.append(unit_center)
    
    i= i+1


amount_of_units = len(surfaces)
# ---------- end python_3 ----------
panel_2 = Panel(python_3.amount_of_units)

# ---- group: Builds a tree to run extrusion once
flatten = FlattenTree(Tree=python_3.Typical_Units, Path="{0}")
flatten_2 = FlattenTree(Tree=python_3.Corner_Units, Path="{1}")
merge_2 = Merge(Data1=flatten, Data2=flatten_2)

# ----
points = PointList(Points=midpt, Size=Slider(5, range=0..10))

Z_2 = UnitZ(Factor=unit_height)
extr = Extrude(Base=merge_2, Direction=Z_2)  # -> simplify(Extrusion)

bang = ExplodeTree(Data=extr)  # -> Branch0, Branch1
brep = Brep(flatten(bang.Branch0))
brep_2 = Brep(flatten(bang.Branch1))
python_4 = GhPythonScript(x=python_3.areas)  # -> flatten(out)
# ---------- python_4: Python ----------
__author__ = "ilouh"
__version__ = "2023.02.21"

import rhinoscriptsyntax as rs
import Grasshopper as gh
import Rhino.Geometry as rg
import ghpythonlib.components as comps
import math

def remove_chars(string):
    """
    Remove characters ( ) ' , from a string.

    Args:
        string (str): The input string.

    Returns:
        str: The input string with ( ) ' , characters removed.
    """
    chars_to_remove = ["(", ")", "'", ","]
    for char in chars_to_remove:
        string = string.replace(char, "")
    return string

out = remove_chars(x)
print(out)
# ---------- end python_4 ----------
move = Move(Geometry=python_3.center_points, Motion=Z)  # -> Geometry, Transform
preview = CustomPreview(Geometry=brep, Material=ColourSwatch(SwatchColor=RGBA(190, 219, 184, 145)))
preview_2 = CustomPreview(Geometry=brep_2, Material=ColourSwatch(SwatchColor=RGBA(70, 79, 73, 158)))
tag = TextTag(Location=move.Geometry, Text=python_4)

# ---- group: Get the lower face of a Brep
distributefaces = GhPythonScript(brep=brep)  # -> lower_face; inputs brep: Brep
# ---------- distributefaces: Python ----------
__author__ = "ilouh"
__version__ = "2023.01.08"

import rhinoscriptsyntax as rs
import ghpythonlib.components as comps
import Rhino.Geometry as geom

#elements = comps.DeconstructBrep(mass)
#faces = elements['faces']

#find the normal of each face


roof = []
floors = []
solidWalls = []
facadeWalls = [] 

faces = comps.DeconstructBrep(brep)
faces = faces['faces']

for face in faces: 
    
    #evaluate the normal of the sruface
    point = comps.ConstructPoint(0.5,0.5,0)
    evaluate_surface = comps.EvaluateSurface(face,point)
    normal = evaluate_surface['normal']
    
    values = comps.DeconstructVector(normal) 

    print(values)
    
    x_value = values['x_component']
    y_value = values['y_component']
    z_value = values['z_component']
    

    if z_value == -1:
        
        lower_face = face
# ---------- end distributefaces ----------

# ----
lower_surface = Surface(distributefaces)
area = Area(Geometry=lower_surface)  # -> Area, Centroid
lower_surface_2 = Surface(distributefaces)
evalsrf = EvaluateSurface(Surface=lower_surface, Point="{0.0,0.0,0}")  # -> Point, Normal, UDirection, VDirection, Frame
evalsrf_2 = EvaluateSurface(Surface=lower_surface_2, Point="{0.0,0.0,0}")  # -> Point, Normal, UDirection, VDirection, Frame
recmap = RectangleMapping(Geometry=group, Source=debrep.Faces, Target=lower_surface)  # -> Geometry, Transform
panel_3 = Panel(area.Area)
