# Grasshopper definition Building_Program Units Outlines 0.3.4.gh (Grasshopper 1.0.7)

true_by_unit_length_false_by_unit_area = BooleanToggle(True)
true_inboard_false_outboard = BooleanToggle(True)
if_only_one_curve_true_if_more_than_1_cu = BooleanToggle(False)  # "If only one curve = True | If more than 1 curve = False"
unit_area = DigitScroller(Scroller_Digits=12, Scroller_Prefix="Unit Area", Scroller_Radix=9, Scroller_Value=250)
unit_width = DigitScroller(Scroller_Digits=12, Scroller_Prefix="Unit Width", Scroller_Radix=9, Scroller_Value=10)
unit_length = DigitScroller(Scroller_Digits=12, Scroller_Prefix="Unit Length", Scroller_Radix=9, Scroller_Value=10)
unit_height = DigitScroller(Scroller_Digits=12, Scroller_Prefix="Unit Height", Scroller_Radix=9, Scroller_Value=9.25)
unit_layout = Curve([<curve referenced from the Rhino model> x16])
input = DataInput(
    Destination="G:\My Drive\Scripting Repository\Exchange Data\FloorCurves.ghdata",
    RelativePath="G:\My Drive\Scripting Repository\Exchange Data\FloorCurves.ghdata|..\..\Exchange Data\FloorCurves.ghdata",
    UpdateDelay=5)

python = GhPythonScript(bool=true_inboard_false_outboard)  # -> coef
# ---------- python: Python ----------
__author__ = "ilouh"
__version__ = "2023.02.21"

import rhinoscriptsyntax as rs
import Grasshopper as gh
import Rhino.Geometry as rg
import ghpythonlib.components as comps
import math

if bool == True: 
    
    coef = 1

else:
    
    coef = -1
# ---------- end python ----------
expression = Expression(Unit_Length=unit_length, coef=python, Expression="coef * Unit_Length")
expression_2 = Expression(Unit_Area=unit_area, Unit_Width=unit_width, coef=python, Expression="coef * Ceiling(Unit_Area/Unit_Width)")

path_curve = Curve(reparameterize(graft(input)))
filter = StreamFilter(Gate=true_by_unit_length_false_by_unit_area, Stream0=expression_2, Stream1=expression)

# ---- group: WIP
python_2 = GhPythonScript(Origial_Curve=simplify(path_curve), Offset_Distance=filter, Bool_Single_Edge=Toggle(False))  # -> simplify(Original_Curve_Segments), simplify(Offest_Curve_Segments); inputs Origial_Curve: Curve; disabled
# ---------- python_2: Python ----------
__author__ = "ilouh"
__version__ = "2023.02.21"

import rhinoscriptsyntax as rs
import Grasshopper as gh
import Rhino.Geometry as rg
import ghpythonlib.components as comps
import math

Original_Curve_Segments_Out = []
Offset_Curve_Segments_Out = [] 

Offset_Curve = comps.OffsetCurve(Origial_Curve,Offset_Distance,corners=1)

Original_Curve_Segments = comps.Explode(Origial_Curve,True)
Original_Curve_Segments = Original_Curve_Segments['segments']

Offset_Curve_Segments = comps.Explode(Offset_Curve,True)
Offset_Curve_Segments = Offset_Curve_Segments['segments']
# ---------- end python_2 ----------

# ----
offset = OffsetCurve(Curve=path_curve, Distance=expr("-x", filter), Corners=1)
origitnal_floor_curves = Curve(path_curve)
offset_floor_curves = Curve(offset)

trim = TrimTree(Tree=origitnal_floor_curves, Depth=1)
len = Length(Curve=trim)
sort = SortList(Keys=len, ValuesA=trim)  # -> Keys, reverse(ValuesA)
item = ListItem(List=sort.ValuesA, Index=0, Wrap=True)
offset_2 = OffsetCurve(Curve=item, Distance=expr("-x", filter), Corners=1)

merge = Merge(Data1=simplify(origitnal_floor_curves), Data2=simplify(offset_floor_curves))
offset_edge_curve = Curve(offset_2)
edge_curve = Curve(item)
merge_2 = Merge(Data1=simplify(edge_curve), Data2=simplify(offset_edge_curve))
filter_2 = StreamFilter(Gate=Toggle(False), Stream0=merge, Stream1=merge_2)
item_2 = ListItem(List=filter_2, Index=0, Wrap=True)  # -> Item, Item1
origial_curve = Curve(item_2.Item)
offset_curve = Curve(item_2.Item1)
explode = Explode(Curve=offset_curve, Recursive=True)  # -> reparameterize(simplify(graft(Segments))), Vertices
explode_2 = Explode(Curve=origial_curve, Recursive=True)  # -> reparameterize(simplify(graft(Segments))), Vertices
panel = Panel(explode.Segments)
panel_2 = Panel(explode_2.Segments)

# ---- group: Creates a script to subdivide a curve into units
python_3 = GhPythonScript(crv1=explode_2.Segments, facade_length=unit_width, crv2=explode.Segments, bool=Toggle(True))  # -> simplify(points); inputs crv1: Curve, crv2: Curve
# ---------- python_3: Python ----------
__author__ = "ilouh"
__version__ = "2022.12.10"

import rhinoscriptsyntax as rs
import ghpythonlib.components as comps

def subdivide_curve(curve, num_subdivisions):

    # Use the DivideCurve function to perform the subdivision
    points = rs.DivideCurve(curve, num_subdivisions)
    
    curve_segments = []
    shatter_parameters = []
    
    for i in range(len(points) - 1):
        
        #curve_segments.append(rs.AddLine(points[i], points[i + 1]))
        
        t = rs.CurveClosestPoint(curve, points[i])
        shatter_parameters.append(t)
    
    #Adjust t parameter domain to ensure nothing is segmented on the start and end of lines
    base_domain = comps.Bounds(shatter_parameters)
    target_domain = comps.ConstructDomain(0.05,0.95)

    #Remaps the domain
    
    remapped_shatter_parameters = comps.RemapNumbers(shatter_parameters,base_domain,target_domain)
    remapped_shatter_parameters = remapped_shatter_parameters['mapped']
    
    curve_segments = comps.Shatter(curve,remapped_shatter_parameters)
    curve_segments = curve_segments[1:-1]
    
    return curve_segments

def pick_shortest_crv(crv1,crv2):
    
    len_crv_1 = comps.Length(crv1)
    len_crv_2 = comps.Length(crv2)
    
    if len_crv_1 > len_crv_2:
        
        return crv2
    
    else:
        return crv1
    

#crv = pick_shortest_crv(crv1,crv2)

if bool == True:
    crv = crv1
else:
    crv = crv2
length = rs.CurveLength(crv)


#Averages the curve to units. 
num = round(length / facade_length,0)
points = rs.DivideCurve(crv, num)
# ---------- end python_3 ----------

# ----
panel_3 = Panel(python_3)
crv_cp = CurveClosestPoint(Point=python_3, Curve=origitnal_floor_curves)  # -> Point, Parameter, Distance
pt = Point(python_3)
python_4 = GhPythonScript(points=pt, cls_points=crv_cp.Point, crvs=origitnal_floor_curves)  # -> vector2; inputs points: list of Point3d, cls_points: list of Point3d, crvs: Curve
# ---------- python_4: Python ----------
__author__ = "ilouh"
__version__ = "2023.02.21"

import rhinoscriptsyntax as rs
import Grasshopper as gh
import Rhino.Geometry as rg
import ghpythonlib.components as comps
import math

def rad2deg(rad):
    return rad*180/math.pi

P = []

pts = comps.EndPoints(crvs)
pt_start = pts['start']
pt_end = pts['end']

vector2 = comps.Vector2Pt(pt_start,pt_end,False)

for i in range(0,len(points)):
    
    
    vector1 = comps.Vector2Pt(points[i],cls_points[i],False)

    
    dot_product = comps.Angle(vector1['vector'],vector2['vector'])

    dot_product_angle = rad2deg(dot_product['angle'])

    print(dot_product_angle)

    if dot_product_angle != 90:
        pass
    else:
        P.append(points[i])

print(len(P))

vector1 = vector1['vector']
vector2 = vector2['vector']
# ---------- end python_4 ----------
python_5 = GhPythonScript(points=pt, cls_points=crv_cp.Point, vector2=python_4)  # -> cull_points, cull_cls_points, unit_outlines; inputs points: list, cls_points: list
# ---------- python_5: Python ----------
__author__ = "ilouh"
__version__ = "2023.02.21"

import rhinoscriptsyntax as rs
import Grasshopper as gh
import Rhino.Geometry as rg
import ghpythonlib.components as comps
import math
cull_points = []
cull_cls_points = []
vectors = []

for i in range(0,len(points)):
    vector1 = comps.Vector2Pt(points[i],cls_points[i],False)
    
    dot_product = comps.Angle(vector1['vector'],vector2)

    dot_product_angle = dot_product['angle']
    dot_product_angle = round(dot_product_angle *180 / math.pi,0)
    
    print(dot_product_angle)
    vectors.append(vector1)
    
    


    if int(dot_product_angle) == int(90):
         
        cull_points.append(points[i])
        cull_cls_points.append(cls_points[i])
    else:
        pass
        
        

unit_outlines = []

for i in range(0,len(cull_points)-1):
    
    li_points = [
        
        cull_points[i],
        cull_points[i+1],
        cull_cls_points[i+1],
        cull_cls_points[i]
        
        ]
    
    polyline = comps.PolyLine(li_points,True)
    
    unit_outlines.append(polyline)
# ---------- end python_5 ----------
crv = Curve(flatten(python_5.unit_outlines))
pt_2 = Point(python_5.cull_points)
pt_3 = Point(python_5.cull_cls_points)
boundary = BoundarySurfaces(Edges=crv)
python_6 = GhPythonScript(surfaces=boundary)  # -> Typical_Units, Corner_Units, dic, areas, center_points, amount_of_units; inputs surfaces: list of Brep
# ---------- python_6: Python ----------
__author__ = "ilouh"
__version__ = "2023.02.21"

import rhinoscriptsyntax as rs
import Grasshopper as gh
import Rhino.Geometry as rg
import ghpythonlib.components as comps
import math

Typical_Units = [] 
Corner_Units = []
areas = []
center_points = []

areas_Corner_units = []
areas_Typical_units = []

dic = {}

i = 0 

for surface in surfaces:
    
    
    temp = comps.DeconstructBrep(surface)
    points = temp['vertices']
    
    
    unit_area = comps.Area(surface)
    
    unit_center = unit_area['centroid']
    
    
    unit_area = round(unit_area['area'],2)
    unit_number = 'Unit Number {}'.format(i)
    
    
    if len(points) > 4: 
        
        unit_name = 'Corner Unit',
        unit_type = 'Two Bedroom',
        Corner_Units.append(surface)

        
    else:
        
        unit_name = 'Typical Unit',
        unit_type = 'One Bedroom',
        Typical_Units.append(surface)

    


    dic_temp = {

        'Unit Name':  unit_name,
        'Unit Area': unit_area,
        'Unit Number' : unit_number,
        'Unit Type' : unit_type


    }
    
    dic[unit_number] = dic_temp
    str = '{} \n {} sf'.format(unit_type,unit_area)
    areas.append(str)
    center_points.append(unit_center)
    
    i= i+1


amount_of_units = len(surfaces)
# ---------- end python_6 ----------
panel_4 = Panel(python_6.amount_of_units)

# ---- group: Builds a tree to run extrusion once
flatten = FlattenTree(Tree=python_6.Typical_Units, Path="{0}")
flatten_2 = FlattenTree(Tree=python_6.Corner_Units, Path="{1}")
merge_3 = Merge(Data1=flatten, Data2=flatten_2)

# ----
Z = UnitZ(Factor=unit_height)
extr = Extrude(Base=merge_3, Direction=Z)  # -> simplify(Extrusion)

bang = ExplodeTree(Data=extr)  # -> Branch0, Branch1
brep = Brep(flatten(bang.Branch1))
brep_2 = Brep(flatten(bang.Branch0))
preview = CustomPreview(Geometry=brep_2, Material=ColourSwatch(SwatchColor=RGBA(190, 219, 184, 145)))

# ---- group: Get the lower face of a Brep
distributefaces = GhPythonScript(brep=brep_2)  # -> lower_face; inputs brep: Brep
# ---------- distributefaces: Python ----------
__author__ = "ilouh"
__version__ = "2023.01.08"

import rhinoscriptsyntax as rs
import ghpythonlib.components as comps
import Rhino.Geometry as geom

#elements = comps.DeconstructBrep(mass)
#faces = elements['faces']

#find the normal of each face


roof = []
floors = []
solidWalls = []
facadeWalls = [] 

faces = comps.DeconstructBrep(brep)
faces = faces['faces']

for face in faces: 
    
    #evaluate the normal of the sruface
    point = comps.ConstructPoint(0.5,0.5,0)
    evaluate_surface = comps.EvaluateSurface(face,point)
    normal = evaluate_surface['normal']
    
    values = comps.DeconstructVector(normal) 

    print(values)
    
    x_value = values['x_component']
    y_value = values['y_component']
    z_value = values['z_component']
    

    if z_value == -1:
        
        lower_face = face
# ---------- end distributefaces ----------

# ----
preview_2 = CustomPreview(Geometry=brep, Material=ColourSwatch(SwatchColor=RGBA(70, 79, 73, 158)))
Z_2 = UnitZ(Factor=expr("x-2", unit_height))
python_7 = GhPythonScript(x=python_6.areas)  # -> flatten(out)
# ---------- python_7: Python ----------
__author__ = "ilouh"
__version__ = "2023.02.21"

import rhinoscriptsyntax as rs
import Grasshopper as gh
import Rhino.Geometry as rg
import ghpythonlib.components as comps
import math

def remove_chars(string):
    """
    Remove characters ( ) ' , from a string.

    Args:
        string (str): The input string.

    Returns:
        str: The input string with ( ) ' , characters removed.
    """
    chars_to_remove = ["(", ")", "'", ","]
    for char in chars_to_remove:
        string = string.replace(char, "")
    return string

out = remove_chars(x)
print(out)
# ---------- end python_7 ----------
move = Move(Geometry=python_6.center_points, Motion=Z_2)  # -> Geometry, Transform
tag = TextTag(Location=move.Geometry, Text=python_7)
group = Group(Objects=unit_layout)  # disabled
bbox = BoundingBox(Content=group, Plane=PlaneXY(0, 0, 0), UnionBox=False)  # -> Box, Box_2; disabled
panel_5 = Panel("{0.0,0.0,0}")  # disabled
lower_surface = Surface(distributefaces)  # disabled
area = Area(Geometry=lower_surface)  # -> Area, Centroid; disabled
panel_6 = Panel("{0.0,0.0,0}")  # disabled
lower_surface_2 = Surface(distributefaces)  # disabled
debrep = DeconstructBrep(Brep=bbox.Box)  # -> Faces, Edges, Vertices; disabled
evalsrf = EvaluateSurface(Surface=lower_surface, Point=panel_5)  # -> Point, Normal, UDirection, VDirection, Frame; disabled
evalsrf_2 = EvaluateSurface(Surface=lower_surface_2, Point=panel_6)  # -> Point, Normal, UDirection, VDirection, Frame; disabled
recmap = RectangleMapping(Geometry=group, Source=debrep.Faces, Target=lower_surface)  # -> Geometry, Transform; disabled
panel_7 = Panel(area.Area)  # disabled
int = Integer(unit_height)  # disabled
Z_3 = UnitZ(Factor=int)  # disabled
ungroup = Ungroup(Group=recmap.Geometry)  # disabled
extr_2 = Extrude(Base=ungroup, Direction=Z_3)  # disabled
join = BrepJoin(Breps=extr_2)  # -> Breps, Closed; disabled
cap = CapHoles(Brep=join.Breps)  # disabled
