# Grasshopper definition Facade_Box Morphing Panels 0.1.0.gh (Grasshopper 1.0.7)
# plug-ins: LunchBox

input = DataInput(
    Destination="G:\My Drive\MTA - Venice Bus Yard\03 Data Exchange Files\walls_MR.ghdata",
    RelativePath="G:\My Drive\MTA - Venice Bus Yard\03 Data Exchange Files\walls_MR.ghdata|..\03 Data Exchange Files\walls_MR.ghdata",
    UpdateDelay=50000)

# ---- group: Input Surface
srf = Surface(graft(input))

# ----
flatten = FlattenTree(Tree=srf, Path="{0}")  # -> graft(Tree)
evalsrf = EvaluateSurface(Surface=reparameterize(flatten), Point="{0.5,0.5,0}")  # -> Point, Normal, UDirection, VDirection, Frame
input_2 = DataInput(
    Destination="G:\My Drive\Scripting Repository\Exchange Data\UndergroundParking.ghdata",
    RelativePath="G:\My Drive\Scripting Repository\Exchange Data\UndergroundParking.ghdata|..\..\Scripting Repository\Exchange Data\UndergroundParking.ghdata",
    UpdateDelay=50000)
input_3 = DataInput(
    Destination="G:\My Drive\Scripting Repository\Exchange Data\OpenSpace_Lot.ghdata",
    RelativePath="G:\My Drive\Scripting Repository\Exchange Data\OpenSpace_Lot.ghdata|..\..\Scripting Repository\Exchange Data\OpenSpace_Lot.ghdata",
    UpdateDelay=50000)

# ---- group: Facade Option
list = ValueList({"One": 0, "Two": 1, "Three": 2, "Four": 3}, selected="One")

# ---- group: Orientation Option
list_2 = ValueList({"One": 0, "Two": 1, "Three": 2}, selected="One")

# ----
list_3 = ValueList({"Running Bond": 0, "Stacking Bond": 1}, selected="Running Bond")
checkboard_mirroring = BooleanToggle(False)
flip_surface_inboard_outboard = BooleanToggle(True)
facade_panel_u_size = Slider(10, range=0..50)
facade_panel_v_size = Slider(10, range=0..50)

# ---- group: Facade Panel Depth
number_slider = Slider(2, range=0..10)

# ----
srf_2 = Surface(reparameterize(flatten))
python = PythonScript(s=srf_2, swapUV=Toggle(False), reverseU=Toggle(False), reverseV=Toggle(True))  # -> out, anchor, uVec, vVec, revSrf; inputs s: Surface, swapUV: Int32, reverseU: Int32, reverseV: Int32
# ---------- python: Python ----------
import Rhino

if reverseU:
    uS,uE = s.Domain(0)
    inter0 = Rhino.Geometry.Interval(-uE, -uS)
    s.SetDomain(0,inter0)
    s = s.Reverse(0)

if reverseV:
    vS,vE = s.Domain(1)
    inter1 = Rhino.Geometry.Interval(-vE, -vS)
    s.SetDomain(1,inter1)
    s = s.Reverse(1)

if swapUV:
    s = s.Transpose()

anchor = s.PointAt(0,0)
uend = s.PointAt(0.5,0)
vend = s.PointAt(0,0.5)
uVec = uend - anchor
vVec = vend - anchor

revSrf = s
# ---------- end python ----------
xy = XYPlane(Origin=Point(0, 0, 0))
xz = XZPlane(Origin=Point(0, 0, 0))
yz = YZPlane(Origin=Point(0, 0, 0))
option_a = Brep(<brep referenced from the Rhino model>)
option_b = Brep([<brep referenced from the Rhino model> x5])
option_c = Brep([<brep referenced from the Rhino model> x6])
option_d = Brep([<brep referenced from the Rhino model> x5])
preview = CustomPreview(Geometry=input_2, Material=ColourSwatch(SwatchColor=RGB(192, 192, 192)))
preview_2 = CustomPreview(Geometry=input_3, Material=ColourSwatch(SwatchColor=RGB(19, 232, 119)))
filter = StreamFilter(Gate=list, Stream0=option_a, Stream1=option_b, Stream2=option_c, Stream3=option_d)
filter_2 = StreamFilter(Gate=list_2, Stream0=xy, Stream1=xz, Stream2=yz)
group = Group(Objects=filter)
bbox = BoundingBox(Content=group, Plane=filter_2)  # -> Box, Box_2

volume = Volume(Geometry=bbox.Box)  # -> Volume, Centroid
xz_2 = XZPlane(Origin=volume.Centroid)
mirror = Mirror(Geometry=bbox.Box, Plane=xz_2)  # -> Geometry, Transform

yz_2 = YZPlane(Origin=volume.Centroid)
xy_2 = XYPlane(Origin=volume.Centroid)

dim = Dimensions(Surface=python.revSrf)  # -> UDimension, VDimension
expression = Expression(x=dim.UDimension, y=facade_panel_u_size, Expression="round(x/y)")
expression_2 = Expression(x=dim.VDimension, y=facade_panel_v_size, Expression="round(x/y)")

divide = DivideDomain²(Domain=python.revSrf, UCount=expression, VCount=expression_2)
quadstag = StaggeredQuadPanels(Surface=python.revSrf, UDivisions=expression, VDivisions=expression_2)
subsrf = Isotrim(Surface=python.revSrf, Domain=divide)

filter_3 = StreamFilter(Gate=list_3, Stream0=quadstag, Stream1=subsrf)
partition = PartitionList(List=filter_3, Size=expression_2)

md_slider = MDSlider(SliderMode=0, slider_value=Point(0.5, 0.5, 0.5), x_domain=Domain(0, 1), y_domain=Domain(0, 1), z_domain=Domain(0, 1))

debrep = DeconstructBrep(Brep=partition)  # -> Faces, Edges, Vertices
item = ListItem(List=debrep.Vertices, Index=0, Wrap=True)  # -> Item, Item1, Item2, Item3
srf4pt = _4PointSurface(CornerA=item.Item, CornerB=item.Item1, CornerC=item.Item2, CornerD=item.Item3)  # -> simplify(Surface)
evalsrf_2 = EvaluateSurface(Surface=reparameterize(srf4pt), Point=md_slider)  # -> Point, Normal, UDirection, VDirection, simplify(Frame)

pln = Plane(evalsrf_2.Frame)
neg = Negative(Value=evalsrf_2.Normal)
filter_4 = StreamFilter(Gate=flip_surface_inboard_outboard, Stream0=evalsrf_2.Normal, Stream1=neg)
amp = Amplitude(Vector=filter_4, Amplitude=number_slider)

extr = Extrude(Base=srf4pt, Direction=amp)  # -> simplify(Extrusion)

pl = ConstructPlane(Origin=evalsrf_2.Point, XAxis=evalsrf_2.Normal, YAxis=evalsrf_2.UDirection)
bbox_2 = BoundingBox(Content=extr, Plane=pl)  # -> simplify(Box), Box_2
trim = TrimTree(Tree=bbox_2.Box, Depth=1)

gate = StreamGate(Stream=trim, Gate=checkboard_mirroring)  # -> Target0, Target1

# ----
# Check Board Pattern
brep_t1 = SplitTree(Data=gate.Target0, Masks=flatten("{?;(0,2,....)}"))  # -> Positive, Negative

plane_t1 = SplitTree(Data=gate.Target0, Masks=flatten("{?;(1,3,....)}"))  # -> Positive, Negative

panel = Panel(gate.Target0)

cull = CullPattern(List=brep_t1.Positive, CullPattern=[False, True])
cull_2 = CullPattern(List=brep_t1.Positive, CullPattern=[True, False])
cull_3 = CullPattern(List=plane_t1.Positive, CullPattern=[False, True])
cull_4 = CullPattern(List=plane_t1.Positive, CullPattern=[True, False])

merge = Merge(Data1=cull, Data2=cull_4)
merge_2 = Merge(Data1=cull_2, Data2=cull_3)

boxmap = BoxMapping(Geometry=group, Source=bbox.Box, Target=merge)  # -> Geometry, Transform
boxmap_2 = BoxMapping(Geometry=group, Source=mirror.Geometry, Target=merge_2)  # -> Geometry, Transform
boxmap_3 = BoxMapping(Geometry=group, Source=bbox.Box, Target=gate.Target1)  # -> Geometry, Transform
filter_5 = StreamFilter(Gate=checkboard_mirroring, Stream0=[boxmap_2.Geometry, boxmap.Geometry], Stream1=boxmap_3.Geometry)
output_group = Group(Objects=filter_5)
preview_3 = CustomPreview(Geometry=filter_5, Material=ColourSwatch(SwatchColor=RGB(255, 255, 255)))
output = DataOutput(
    DataInput=output_group,
    Destination="G:\My Drive\Scripting Repository\Exchange Data\Facade_Resi_Detailed.ghdata",
    RelativePath="G:\My Drive\Scripting Repository\Exchange Data\Facade_Resi_Detailed.ghdata|..\..\Scripting Repository\Exchange Data\Facade_Resi_Detailed.ghdata")
