# Grasshopper definition Facade_Storefront & Mullions 0.1.0.gh (Grasshopper 1.0.7)

pipeline = GeometryPipeline(
    GroupByLayer=False,
    GroupByType=False,
    IncludeHidden=True,
    IncludeLocked=True,
    LayerFilter="03_ARCH*03_03_GLAZING_GLASS",
    NameFilter="*",
    SublayerFiltering=True,
    TypeFilter=1073741848)
input = DataInput(
    Destination="G:\My Drive\Scripting Repository\Exchange Data\FacadeWalls_comm.ghdata",
    RelativePath="G:\My Drive\Scripting Repository\Exchange Data\FacadeWalls_comm.ghdata|..\..\Scripting Repository\Exchange Data\FacadeWalls_comm.ghdata",
    UpdateDelay=50000)

# ---- group: Base Surface
# REGULATED SPACING
base_surface = Geometry(graft([<brep referenced from the Rhino model> x7]))

# ---- group: Distance Between Verticals
spacing = Slider(4, range=0..60)

# ---- group: Vertical Width
mullion_depth = Slider(6, range=0..36)

# ---- group: Vertical Depth
mullion_width = Slider(2, range=0..36)

# ----
expression = Expression(x=mullion_depth, Expression="(X/12)/2")
expression_2 = Expression(x=mullion_width, Expression="(X/12)/2")

edges = BrepEdges(Brep=base_surface)  # -> Naked, Interior, NonManifold
curvepoint = PointOnCurve(edges.Naked, parameter=0.5)
pdecon = Deconstruct(Point=curvepoint)  # -> XComponent, YComponent, ZComponent
sort = SortList(Keys=pdecon.ZComponent, ValuesA=edges.Naked)  # -> Keys, ValuesA
item = ListItem(List=reverse(sort.ValuesA), Index=0, Wrap=True)  # -> Item, Item1, Item2, Item3

flip = FlipCurve(Curve=item.Item3)  # -> Curve, Flag
crv = Curve(item.Item)
crv_2 = Curve(item.Item3)

divlength = DivideLength(Curve=item.Item, Length=spacing)  # -> Points, Tangents, Parameters
lng = ListLength(List=divlength.Points)  # -> simplify(Length)

divide = DivideCurve(Curve=reparameterize(simplify(crv)), Count=lng, Kinks=False)  # -> Points, Tangents, Parameters
divide_2 = DivideCurve(Curve=reparameterize(simplify(crv_2)), Count=lng, Kinks=False)  # -> Points, Tangents, Parameters

dom = ConstructDomain(DomainStart=expression_2, DomainEnd=expr("-x", expression_2))
dom_2 = ConstructDomain(DomainStart=expression, DomainEnd=expr("-x", expression))

ln = Line(StartPoint=divide.Points, EndPoint=divide_2.Points)
mullions = Curve(ln)

# ---- group: Creates the Mullions
curvepoint_2 = PointOnCurve(mullions, parameter=0)
srf = Surface(reparameterize(base_surface))
srf_cp = SurfaceClosestPoint(Point=curvepoint_2, Surface=srf)  # -> Point, UVPoint, Distance
evalsrf = EvaluateSurface(Surface=reparameterize(srf), Point=srf_cp.UVPoint)  # -> Point, Normal, UDirection, VDirection, Frame
pl = ConstructPlane(Origin=evalsrf.Point, XAxis=evalsrf.Normal, YAxis=evalsrf.UDirection)
rectangle = Rectangle(Plane=pl, XSize=dom_2, YSize=dom, Radius=0)  # -> simplify(graft(Rectangle)), Length
swp1 = Sweep1(Rail=simplify(graft(mullions)), Sections=rectangle.Rectangle, Miter=1)

# ----
srf_2 = Surface(base_surface)
cap = CapHoles(Brep=swp1)

# ---- group: Output - Mullions
mullions_2 = Brep(cap)

# ----
preview = CustomPreview(Geometry=srf_2, Material=ColourSwatch(SwatchColor=RGBA(68, 86, 255, 72)))
output = DataOutput(
    DataInput=srf_2,
    Destination="G:\My Drive\Scripting Repository\Exchange Data\Facade_comm_glass.ghdata",
    RelativePath="G:\My Drive\Scripting Repository\Exchange Data\Facade_comm_glass.ghdata|..\..\Scripting Repository\Exchange Data\Facade_comm_glass.ghdata")
output_2 = DataOutput(
    DataInput=mullions_2,
    Destination="G:\My Drive\Scripting Repository\Exchange Data\Facade_comm_mullions.ghdata",
    RelativePath="G:\My Drive\Scripting Repository\Exchange Data\Facade_comm_mullions.ghdata|..\..\Scripting Repository\Exchange Data\Facade_comm_mullions.ghdata")
