# Grasshopper definition Massing Design Calculator 0.6.3 (MTA).gh (Grasshopper 1.0.7)
# plug-ins: TT Toolbox, Human

pipeline = GeometryPipeline(
    GroupByLayer=False,
    GroupByType=False,
    IncludeHidden=True,
    IncludeLocked=True,
    LayerFilter="02_MASSING*Extreme Low Income",
    NameFilter="*",
    SublayerFiltering=True,
    TypeFilter=1073741848)
pipeline_2 = GeometryPipeline(
    GroupByLayer=False,
    GroupByType=False,
    IncludeHidden=True,
    IncludeLocked=True,
    LayerFilter="02_MASSING*Very Low Income",
    NameFilter="*",
    SublayerFiltering=True,
    TypeFilter=1073741848)
pipeline_3 = GeometryPipeline(
    GroupByLayer=False,
    GroupByType=False,
    IncludeHidden=True,
    IncludeLocked=True,
    LayerFilter="02_MASSING*Moderate Income",
    NameFilter="*",
    SublayerFiltering=True,
    TypeFilter=1073741848)
pipeline_4 = GeometryPipeline(
    GroupByLayer=False,
    GroupByType=False,
    IncludeHidden=True,
    IncludeLocked=True,
    LayerFilter="02_MASSING*Market Rate",
    NameFilter="*",
    SublayerFiltering=True,
    TypeFilter=1073741848)
pipeline_5 = GeometryPipeline(
    GroupByLayer=False,
    GroupByType=False,
    IncludeHidden=True,
    IncludeLocked=True,
    LayerFilter="02_MASSING*Retail",
    NameFilter="*",
    SublayerFiltering=True,
    TypeFilter=1073741848)
pipeline_6 = GeometryPipeline(
    GroupByLayer=False,
    GroupByType=False,
    IncludeHidden=True,
    IncludeLocked=True,
    LayerFilter="02_MASSING*Community Spaces",
    NameFilter="*",
    SublayerFiltering=True,
    TypeFilter=1073741848)
pipeline_7 = GeometryPipeline(
    GroupByLayer=False,
    GroupByType=False,
    IncludeHidden=True,
    IncludeLocked=True,
    LayerFilter="02_MASSING*Code Required Parking",
    NameFilter="*",
    SublayerFiltering=True,
    TypeFilter=1073741848)
pipeline_8 = GeometryPipeline(
    GroupByLayer=False,
    GroupByType=False,
    IncludeHidden=True,
    IncludeLocked=True,
    LayerFilter="02_MASSING*Visitor Parking",
    NameFilter="*",
    SublayerFiltering=True,
    TypeFilter=1073741848)
program_name = Panel("Moderate Income")
program_name_2 = Panel("Very Low Income")
program_name_3 = Panel("Market Rate")
input_mass = Brep(graft(pipeline))
program_name_4 = Panel("Extreme Low Income")
input_mass_2 = Brep(graft(pipeline_2))

land_value = DigitScroller(Scroller_Digits=12, Scroller_Prefix="Land Value", Scroller_Radix=11, Scroller_Value=1300000)
hard_vs_soft_coef = DigitScroller(Scroller_Digits=12, Scroller_Prefix="Hard vs Soft Coef", Scroller_Radix=11, Scroller_Value=70)
net_coefficient = DigitScroller(Scroller_Digits=12, Scroller_Prefix="Net Coefficient", Scroller_Radix=11, Scroller_Value=70)
cap_rate = DigitScroller(Scroller_Digits=12, Scroller_Prefix="Cap Rate", Scroller_Radix=11, Scroller_Value=5)

input_mass_3 = Brep(graft(pipeline_3))
program_name_5 = Panel("Retail")
input_mass_4 = Brep(graft(pipeline_4))
program_name_6 = Panel("Code Required Parking")
program_name_7 = Panel("Visitor Parking")
program_name_8 = Panel("Community Spaces")
input_mass_5 = Brep(graft(pipeline_5))
input_mass_6 = Brep(graft(pipeline_8))
input_mass_7 = Brep(graft(pipeline_6))
input_mass_8 = Brep(graft(pipeline_7))

unit_density = DigitScroller(Scroller_Digits=12, Scroller_Prefix="Unit Density", Scroller_Radix=11, Scroller_Value=400)
construction_cost_per_sf = DigitScroller(Scroller_Digits=12, Scroller_Prefix="Construction Cost Per SF", Scroller_Radix=11, Scroller_Value=375)
sale_price_per_sf = DigitScroller(Scroller_Digits=12, Scroller_Prefix="Sale Price Per SF", Scroller_Radix=11, Scroller_Value=950)
rent_per_sf = DigitScroller(Scroller_Digits=12, Scroller_Prefix="Rent Per SF", Scroller_Radix=10, Scroller_Value=5)

percentage_of_one_bedrooms = DigitScroller(Scroller_Digits=12, Scroller_Prefix="Percentage of One Bedrooms", Scroller_Radix=11, Scroller_Value=25)
percentage_of_two_bedrooms = DigitScroller(Scroller_Digits=12, Scroller_Prefix="Percentage of Two Bedrooms", Scroller_Radix=11, Scroller_Value=25)

target_area_one_bedroom = DigitScroller(Scroller_Digits=12, Scroller_Prefix="Target Area - One Bedroom", Scroller_Radix=11, Scroller_Value=350)
target_area_two_bedroom = DigitScroller(Scroller_Digits=12, Scroller_Prefix="Target Area - Two Bedroom", Scroller_Radix=11, Scroller_Value=750)
target_area_three_bedroom = DigitScroller(Scroller_Digits=12, Scroller_Prefix="Target Area - Three Bedroom", Scroller_Radix=11, Scroller_Value=1150)

construction_cost_per_sf_2 = DigitScroller(Scroller_Digits=12, Scroller_Prefix="Construction Cost Per SF", Scroller_Radix=11, Scroller_Value=375)
unit_density_2 = DigitScroller(Scroller_Digits=12, Scroller_Prefix="Unit Density", Scroller_Radix=11, Scroller_Value=400)
sale_price_per_sf_2 = DigitScroller(Scroller_Digits=12, Scroller_Prefix="Sale Price Per SF", Scroller_Radix=11, Scroller_Value=950)
rent_per_sf_2 = DigitScroller(Scroller_Digits=12, Scroller_Prefix="Rent Per SF", Scroller_Radix=10, Scroller_Value=3.5)

unit_density_3 = DigitScroller(Scroller_Digits=12, Scroller_Prefix="Unit Density", Scroller_Radix=11, Scroller_Value=400)
construction_cost_per_sf_3 = DigitScroller(Scroller_Digits=12, Scroller_Prefix="Construction Cost Per SF", Scroller_Radix=11, Scroller_Value=375)
sale_price_per_sf_3 = DigitScroller(Scroller_Digits=12, Scroller_Prefix="Sale Price Per SF", Scroller_Radix=11, Scroller_Value=950)
rent_per_sf_3 = DigitScroller(Scroller_Digits=12, Scroller_Prefix="Rent Per SF", Scroller_Radix=10, Scroller_Value=4.25)

percentage_of_one_bedrooms_2 = DigitScroller(Scroller_Digits=12, Scroller_Prefix="Percentage of One Bedrooms", Scroller_Radix=11, Scroller_Value=25)
percentage_of_two_bedrooms_2 = DigitScroller(Scroller_Digits=12, Scroller_Prefix="Percentage of Two Bedrooms", Scroller_Radix=11, Scroller_Value=25)

target_area_one_bedroom_2 = DigitScroller(Scroller_Digits=12, Scroller_Prefix="Target Area - One Bedroom", Scroller_Radix=11, Scroller_Value=350)
target_area_two_bedroom_2 = DigitScroller(Scroller_Digits=12, Scroller_Prefix="Target Area - Two Bedroom", Scroller_Radix=11, Scroller_Value=750)
target_area_three_bedroom_2 = DigitScroller(Scroller_Digits=12, Scroller_Prefix="Target Area - Three Bedroom", Scroller_Radix=11, Scroller_Value=1150)

typical_floor_height = DigitScroller(Scroller_Digits=12, Scroller_Prefix="Typical Floor Height", Scroller_Radix=11, Scroller_Value=10)
omit_last_floor_slab = BooleanToggle(True)
typical_floor_height_2 = DigitScroller(Scroller_Digits=12, Scroller_Prefix="Typical Floor Height", Scroller_Radix=11, Scroller_Value=10)
omit_last_floor_slab_2 = BooleanToggle(True)

percentage_of_one_bedrooms_3 = DigitScroller(Scroller_Digits=12, Scroller_Prefix="Percentage of One Bedrooms", Scroller_Radix=11, Scroller_Value=25)
percentage_of_two_bedrooms_3 = DigitScroller(Scroller_Digits=12, Scroller_Prefix="Percentage of Two Bedrooms", Scroller_Radix=11, Scroller_Value=25)

target_area_one_bedroom_3 = DigitScroller(Scroller_Digits=12, Scroller_Prefix="Target Area - One Bedroom", Scroller_Radix=11, Scroller_Value=350)
target_area_two_bedroom_3 = DigitScroller(Scroller_Digits=12, Scroller_Prefix="Target Area - Two Bedroom", Scroller_Radix=11, Scroller_Value=750)
target_area_three_bedroom_3 = DigitScroller(Scroller_Digits=12, Scroller_Prefix="Target Area - Three Bedroom", Scroller_Radix=11, Scroller_Value=1150)

typical_floor_height_3 = DigitScroller(Scroller_Digits=12, Scroller_Prefix="Typical Floor Height", Scroller_Radix=11, Scroller_Value=10)
omit_last_floor_slab_3 = BooleanToggle(True)
typical_floor_height_4 = DigitScroller(Scroller_Digits=12, Scroller_Prefix="Typical Floor Height", Scroller_Radix=11, Scroller_Value=10)
omit_last_floor_slab_4 = BooleanToggle(True)

unit_density_4 = DigitScroller(Scroller_Digits=12, Scroller_Prefix="Unit Density", Scroller_Radix=11, Scroller_Value=400)
construction_cost_per_sf_4 = DigitScroller(Scroller_Digits=12, Scroller_Prefix="Construction Cost Per SF", Scroller_Radix=11, Scroller_Value=375)
sale_price_per_sf_4 = DigitScroller(Scroller_Digits=12, Scroller_Prefix="Sale Price Per SF", Scroller_Radix=11, Scroller_Value=950)
rent_per_sf_4 = DigitScroller(Scroller_Digits=12, Scroller_Prefix="Rent Per SF", Scroller_Radix=10, Scroller_Value=3.25)

percentage_of_one_bedrooms_4 = DigitScroller(Scroller_Digits=12, Scroller_Prefix="Percentage of One Bedrooms", Scroller_Radix=11, Scroller_Value=25)
percentage_of_two_bedrooms_4 = DigitScroller(Scroller_Digits=12, Scroller_Prefix="Percentage of Two Bedrooms", Scroller_Radix=11, Scroller_Value=25)

target_area_one_bedroom_4 = DigitScroller(Scroller_Digits=12, Scroller_Prefix="Target Area - One Bedroom", Scroller_Radix=11, Scroller_Value=350)
target_area_two_bedroom_4 = DigitScroller(Scroller_Digits=12, Scroller_Prefix="Target Area - Two Bedroom", Scroller_Radix=11, Scroller_Value=750)
target_area_three_bedroom_4 = DigitScroller(Scroller_Digits=12, Scroller_Prefix="Target Area - Three Bedroom", Scroller_Radix=11, Scroller_Value=1150)

unit_density_5 = DigitScroller(Scroller_Digits=12, Scroller_Prefix="Unit Density", Scroller_Radix=11, Scroller_Value=200)
construction_cost_per_sf_5 = DigitScroller(Scroller_Digits=12, Scroller_Prefix="Construction Cost Per SF", Scroller_Radix=11, Scroller_Value=375)
sale_price_per_sf_5 = DigitScroller(Scroller_Digits=12, Scroller_Prefix="Sale Price Per SF", Scroller_Radix=11, Scroller_Value=550)
rent_per_sf_5 = DigitScroller(Scroller_Digits=12, Scroller_Prefix="Rent Per SF", Scroller_Radix=10, Scroller_Value=5)

percentage_of_one_bedrooms_5 = DigitScroller(Scroller_Digits=12, Scroller_Prefix="Percentage of One Bedrooms", Scroller_Radix=11, Scroller_Value=25)
percentage_of_two_bedrooms_5 = DigitScroller(Scroller_Digits=12, Scroller_Prefix="Percentage of Two Bedrooms", Scroller_Radix=11, Scroller_Value=25)

target_area_one_bedroom_5 = DigitScroller(Scroller_Digits=12, Scroller_Prefix="Target Area - One Bedroom", Scroller_Radix=11, Scroller_Value=350)
target_area_two_bedroom_5 = DigitScroller(Scroller_Digits=12, Scroller_Prefix="Target Area - Two Bedroom", Scroller_Radix=11, Scroller_Value=750)
target_area_three_bedroom_5 = DigitScroller(Scroller_Digits=12, Scroller_Prefix="Target Area - Three Bedroom", Scroller_Radix=11, Scroller_Value=1150)

typical_floor_height_5 = DigitScroller(Scroller_Digits=12, Scroller_Prefix="Typical Floor Height", Scroller_Radix=11, Scroller_Value=10)
omit_last_floor_slab_5 = BooleanToggle(True)
typical_floor_height_6 = DigitScroller(Scroller_Digits=12, Scroller_Prefix="Typical Floor Height", Scroller_Radix=11, Scroller_Value=10)
omit_last_floor_slab_6 = BooleanToggle(True)
omit_last_floor_slab_7 = BooleanToggle(True)
omit_last_floor_slab_8 = BooleanToggle(True)

unit_density_6 = DigitScroller(Scroller_Digits=12, Scroller_Prefix="Unit Density", Scroller_Radix=11, Scroller_Value=300)
construction_cost_per_sf_6 = DigitScroller(Scroller_Digits=12, Scroller_Prefix="Construction Cost Per SF", Scroller_Radix=11, Scroller_Value=175)
sale_price_per_sf_6 = DigitScroller(Scroller_Digits=12, Scroller_Prefix="Sale Price Per SF", Scroller_Radix=11, Scroller_Value=0)
rent_per_sf_6 = DigitScroller(Scroller_Digits=12, Scroller_Prefix="Rent Per SF", Scroller_Radix=10, Scroller_Value=0)

percentage_of_one_bedrooms_6 = DigitScroller(Scroller_Digits=12, Scroller_Prefix="Percentage of One Bedrooms", Scroller_Radix=11, Scroller_Value=25)
percentage_of_two_bedrooms_6 = DigitScroller(Scroller_Digits=12, Scroller_Prefix="Percentage of Two Bedrooms", Scroller_Radix=11, Scroller_Value=25)

target_area_two_bedroom_6 = DigitScroller(Scroller_Digits=12, Scroller_Prefix="Target Area - Two Bedroom", Scroller_Radix=11, Scroller_Value=750)
target_area_one_bedroom_6 = DigitScroller(Scroller_Digits=12, Scroller_Prefix="Target Area - One Bedroom", Scroller_Radix=11, Scroller_Value=350)
target_area_three_bedroom_6 = DigitScroller(Scroller_Digits=12, Scroller_Prefix="Target Area - Three Bedroom", Scroller_Radix=11, Scroller_Value=1150)

unit_density_7 = DigitScroller(Scroller_Digits=12, Scroller_Prefix="Unit Density", Scroller_Radix=11, Scroller_Value=400)
construction_cost_per_sf_7 = DigitScroller(Scroller_Digits=12, Scroller_Prefix="Construction Cost Per SF", Scroller_Radix=11, Scroller_Value=225)
sale_price_per_sf_7 = DigitScroller(Scroller_Digits=12, Scroller_Prefix="Sale Price Per SF", Scroller_Radix=11, Scroller_Value=0)
rent_per_sf_7 = DigitScroller(Scroller_Digits=12, Scroller_Prefix="Rent Per SF", Scroller_Radix=10, Scroller_Value=0)

percentage_of_one_bedrooms_7 = DigitScroller(Scroller_Digits=12, Scroller_Prefix="Percentage of One Bedrooms", Scroller_Radix=11, Scroller_Value=25)
percentage_of_two_bedrooms_7 = DigitScroller(Scroller_Digits=12, Scroller_Prefix="Percentage of Two Bedrooms", Scroller_Radix=11, Scroller_Value=25)

target_area_one_bedroom_7 = DigitScroller(Scroller_Digits=12, Scroller_Prefix="Target Area - One Bedroom", Scroller_Radix=11, Scroller_Value=350)
target_area_two_bedroom_7 = DigitScroller(Scroller_Digits=12, Scroller_Prefix="Target Area - Two Bedroom", Scroller_Radix=11, Scroller_Value=750)
target_area_three_bedroom_7 = DigitScroller(Scroller_Digits=12, Scroller_Prefix="Target Area - Three Bedroom", Scroller_Radix=11, Scroller_Value=1150)

unit_density_8 = DigitScroller(Scroller_Digits=12, Scroller_Prefix="Unit Density", Scroller_Radix=11, Scroller_Value=300)
construction_cost_per_sf_8 = DigitScroller(Scroller_Digits=12, Scroller_Prefix="Construction Cost Per SF", Scroller_Radix=11, Scroller_Value=175)
sale_price_per_sf_8 = DigitScroller(Scroller_Digits=12, Scroller_Prefix="Sale Price Per SF", Scroller_Radix=11, Scroller_Value=0)
rent_per_sf_8 = DigitScroller(Scroller_Digits=12, Scroller_Prefix="Rent Per SF", Scroller_Radix=10, Scroller_Value=0)

percentage_of_one_bedrooms_8 = DigitScroller(Scroller_Digits=12, Scroller_Prefix="Percentage of One Bedrooms", Scroller_Radix=11, Scroller_Value=25)
percentage_of_two_bedrooms_8 = DigitScroller(Scroller_Digits=12, Scroller_Prefix="Percentage of Two Bedrooms", Scroller_Radix=11, Scroller_Value=25)

target_area_one_bedroom_8 = DigitScroller(Scroller_Digits=12, Scroller_Prefix="Target Area - One Bedroom", Scroller_Radix=11, Scroller_Value=350)
target_area_two_bedroom_8 = DigitScroller(Scroller_Digits=12, Scroller_Prefix="Target Area - Two Bedroom", Scroller_Radix=11, Scroller_Value=750)
target_area_three_bedroom_8 = DigitScroller(Scroller_Digits=12, Scroller_Prefix="Target Area - Three Bedroom", Scroller_Radix=11, Scroller_Value=1150)

typical_floor_height_7 = DigitScroller(Scroller_Digits=12, Scroller_Prefix="Typical Floor Height", Scroller_Radix=11, Scroller_Value=10)
typical_floor_height_8 = DigitScroller(Scroller_Digits=12, Scroller_Prefix="Typical Floor Height", Scroller_Radix=11, Scroller_Value=10)

pro_forma_calculator = ProFormaCalculator(
    program_name=program_name_3,
    massing=input_mass_4,
    unit_density=unit_density,
    cpsf=construction_cost_per_sf,
    typical_floor_height=typical_floor_height,
    ppsf=sale_price_per_sf,
    rpsf=rent_per_sf,
    cap_rate=cap_rate,
    bool=omit_last_floor_slab,
    net_coef=net_coefficient,
    land_value=land_value,
    hard_soft_coef=hard_vs_soft_coef,
    percentage_one_bedrooms=percentage_of_one_bedrooms,
    percentage_two_bedrooms=percentage_of_two_bedrooms,
    desired_area_one_bedroom=target_area_one_bedroom,
    desired_area_two_bedroom=target_area_two_bedroom,
    desired_area_three_bedroom=target_area_three_bedroom)  # -> walls, roof, floors, R, R_2

pro_forma_calculator_2 = ProFormaCalculator(
    program_name=program_name,
    massing=input_mass_3,
    unit_density=unit_density_3,
    cpsf=construction_cost_per_sf_3,
    typical_floor_height=typical_floor_height_3,
    ppsf=sale_price_per_sf_3,
    rpsf=rent_per_sf_3,
    cap_rate=cap_rate,
    bool=omit_last_floor_slab_3,
    net_coef=net_coefficient,
    land_value=land_value,
    hard_soft_coef=hard_vs_soft_coef,
    percentage_one_bedrooms=percentage_of_one_bedrooms_2,
    percentage_two_bedrooms=percentage_of_two_bedrooms_2,
    desired_area_one_bedroom=target_area_one_bedroom_2,
    desired_area_two_bedroom=target_area_two_bedroom_2,
    desired_area_three_bedroom=target_area_three_bedroom_2)  # -> walls, roof, floors, R, R_2

pro_forma_calculator_3 = ProFormaCalculator(
    program_name=program_name_2,
    massing=input_mass_2,
    unit_density=unit_density_2,
    cpsf=construction_cost_per_sf_2,
    typical_floor_height=typical_floor_height_2,
    ppsf=sale_price_per_sf_2,
    rpsf=rent_per_sf_2,
    cap_rate=cap_rate,
    bool=omit_last_floor_slab_2,
    net_coef=net_coefficient,
    land_value=land_value,
    hard_soft_coef=hard_vs_soft_coef,
    percentage_one_bedrooms=percentage_of_one_bedrooms_3,
    percentage_two_bedrooms=percentage_of_two_bedrooms_3,
    desired_area_one_bedroom=target_area_one_bedroom_3,
    desired_area_two_bedroom=target_area_two_bedroom_3,
    desired_area_three_bedroom=target_area_three_bedroom_3)  # -> walls, roof, floors, R, R_2

pro_forma_calculator_4 = ProFormaCalculator(
    program_name=program_name_4,
    massing=input_mass,
    unit_density=unit_density_4,
    cpsf=construction_cost_per_sf_4,
    typical_floor_height=typical_floor_height_4,
    ppsf=sale_price_per_sf_4,
    rpsf=rent_per_sf_4,
    cap_rate=cap_rate,
    bool=omit_last_floor_slab_4,
    net_coef=net_coefficient,
    land_value=land_value,
    hard_soft_coef=hard_vs_soft_coef,
    percentage_one_bedrooms=percentage_of_one_bedrooms_4,
    percentage_two_bedrooms=percentage_of_two_bedrooms_4,
    desired_area_one_bedroom=target_area_one_bedroom_4,
    desired_area_two_bedroom=target_area_two_bedroom_4,
    desired_area_three_bedroom=target_area_three_bedroom_4)  # -> walls, roof, floors, R, R_2

pro_forma_calculator_5 = ProFormaCalculator(
    program_name=program_name_5,
    massing=input_mass_5,
    unit_density=unit_density_5,
    cpsf=construction_cost_per_sf_5,
    typical_floor_height=typical_floor_height_5,
    ppsf=sale_price_per_sf_5,
    rpsf=rent_per_sf_5,
    cap_rate=cap_rate,
    bool=omit_last_floor_slab_5,
    net_coef=net_coefficient,
    land_value=land_value,
    hard_soft_coef=hard_vs_soft_coef,
    percentage_one_bedrooms=percentage_of_one_bedrooms_5,
    percentage_two_bedrooms=percentage_of_two_bedrooms_5,
    desired_area_one_bedroom=target_area_one_bedroom_5,
    desired_area_two_bedroom=target_area_two_bedroom_5,
    desired_area_three_bedroom=target_area_three_bedroom_5)  # -> walls, roof, floors, R, R_2

pro_forma_calculator_6 = ProFormaCalculator(
    program_name=program_name_7,
    massing=input_mass_6,
    unit_density=unit_density_6,
    cpsf=construction_cost_per_sf_6,
    typical_floor_height=typical_floor_height_6,
    ppsf=sale_price_per_sf_6,
    rpsf=rent_per_sf_6,
    cap_rate=cap_rate,
    bool=omit_last_floor_slab_6,
    net_coef=net_coefficient,
    land_value=land_value,
    hard_soft_coef=hard_vs_soft_coef,
    percentage_one_bedrooms=percentage_of_one_bedrooms_6,
    percentage_two_bedrooms=percentage_of_two_bedrooms_6,
    desired_area_one_bedroom=target_area_one_bedroom_6,
    desired_area_two_bedroom=target_area_two_bedroom_6,
    desired_area_three_bedroom=target_area_three_bedroom_6)  # -> walls, roof, floors, R, R_2

pro_forma_calculator_7 = ProFormaCalculator(
    program_name=program_name_8,
    massing=input_mass_7,
    unit_density=unit_density_7,
    cpsf=construction_cost_per_sf_7,
    typical_floor_height=typical_floor_height_7,
    ppsf=sale_price_per_sf_7,
    rpsf=rent_per_sf_7,
    cap_rate=cap_rate,
    bool=omit_last_floor_slab_7,
    net_coef=net_coefficient,
    land_value=land_value,
    hard_soft_coef=hard_vs_soft_coef,
    percentage_one_bedrooms=percentage_of_one_bedrooms_7,
    percentage_two_bedrooms=percentage_of_two_bedrooms_7,
    desired_area_one_bedroom=target_area_one_bedroom_7,
    desired_area_two_bedroom=target_area_two_bedroom_7,
    desired_area_three_bedroom=target_area_three_bedroom_7)  # -> walls, roof, floors, R, R_2

pro_forma_calculator_8 = ProFormaCalculator(
    program_name=program_name_6,
    massing=input_mass_8,
    unit_density=unit_density_8,
    cpsf=construction_cost_per_sf_8,
    typical_floor_height=typical_floor_height_8,
    ppsf=sale_price_per_sf_8,
    rpsf=rent_per_sf_8,
    cap_rate=cap_rate,
    bool=omit_last_floor_slab_8,
    net_coef=net_coefficient,
    land_value=land_value,
    hard_soft_coef=hard_vs_soft_coef,
    percentage_one_bedrooms=percentage_of_one_bedrooms_8,
    percentage_two_bedrooms=percentage_of_two_bedrooms_8,
    desired_area_one_bedroom=target_area_one_bedroom_8,
    desired_area_two_bedroom=target_area_two_bedroom_8,
    desired_area_three_bedroom=target_area_three_bedroom_8)  # -> walls, roof, floors, R, R_2

list_values = Data(pro_forma_calculator_4.R_2)
list_values_2 = Data(pro_forma_calculator_3.R_2)
list_values_3 = Data(pro_forma_calculator_2.R_2)
list_values_4 = Data(pro_forma_calculator.R_2)
list_values_5 = Data(pro_forma_calculator_5.R_2)
list_values_6 = Data(pro_forma_calculator_7.R_2)
list_values_7 = Data(pro_forma_calculator_8.R_2)
list_values_8 = Data(pro_forma_calculator_6.R_2)
list_keys = Data(pro_forma_calculator_4.R)
list_keys_2 = Data(pro_forma_calculator_3.R)
list_keys_3 = Data(pro_forma_calculator_2.R)
list_keys_4 = Data(pro_forma_calculator.R)
list_keys_5 = Data(pro_forma_calculator_5.R)
list_keys_6 = Data(pro_forma_calculator_7.R)
list_keys_7 = Data(pro_forma_calculator_8.R)
list_keys_8 = Data(pro_forma_calculator_6.R)
brep = Brep(pro_forma_calculator_4.floors)
brep_2 = Brep(pro_forma_calculator_3.floors)
brep_3 = Brep(pro_forma_calculator_2.floors)
brep_4 = Brep(pro_forma_calculator.floors)
brep_5 = Brep(pro_forma_calculator_5.floors)
brep_6 = Brep(pro_forma_calculator_7.floors)
brep_7 = Brep(pro_forma_calculator_8.floors)
brep_8 = Brep(pro_forma_calculator_6.floors)
walls = Merge(
    Data1=simplify(pro_forma_calculator_4.walls),
    Data2=simplify(pro_forma_calculator_3.walls),
    Data3=simplify(pro_forma_calculator_2.walls),
    Data4=simplify(pro_forma_calculator.walls))
roofs = Merge(
    Data1=simplify(pro_forma_calculator_4.roof),
    Data2=simplify(pro_forma_calculator_3.roof),
    Data3=simplify(pro_forma_calculator_2.roof),
    Data4=simplify(pro_forma_calculator.roof))
floors = Merge(
    Data1=simplify(pro_forma_calculator_4.floors),
    Data2=graft(pro_forma_calculator_3.floors),
    Data3=simplify(pro_forma_calculator_2.floors),
    Data4=simplify(pro_forma_calculator.floors))
swatch = ColourSwatch(SwatchColor=RGBA(191, 191, 191, 59))  # disabled
swatch_2 = ColourSwatch(SwatchColor=RGB(125, 125, 125))  # disabled
swatch_3 = ColourSwatch(SwatchColor=RGB(58, 160, 0))  # disabled
output_floors = Brep(floors)  # disabled

# ---- group: Output - Walls
walls_2 = Surface(simplify(walls))  # disabled

# ----
output_roof = Brep(roofs)  # disabled
preview = CustomPreview(Geometry=output_floors, Material=swatch_3)  # disabled
preview_2 = CustomPreview(Geometry=walls_2, Material=swatch)  # disabled
preview_3 = CustomPreview(Geometry=output_roof, Material=swatch_2)  # disabled
output = DataOutput(
    DataInput=output_roof,
    Destination="C:\Users\Brooks Scarpa\Google Drive Streaming\My Drive\MTA - Venice Bus Yard\03 Data Exchange Files\roofs_general.ghdata",
    RelativePath="C:\Users\Brooks Scarpa\Google Drive Streaming\My Drive\MTA - Venice Bus Yard\03 Data Exchange Files\roofs_general.ghdata|..\03 Data Exchange Files\roofs_general.ghdata")  # disabled
output_2 = DataOutput(
    DataInput=walls_2,
    Destination="C:\Users\Brooks Scarpa\Google Drive Streaming\My Drive\MTA - Venice Bus Yard\03 Data Exchange Files\walls_general.ghdata",
    RelativePath="C:\Users\Brooks Scarpa\Google Drive Streaming\My Drive\MTA - Venice Bus Yard\03 Data Exchange Files\walls_general.ghdata|..\03 Data Exchange Files\walls_general.ghdata")  # disabled
output_3 = DataOutput(
    DataInput=output_floors,
    Destination="C:\Users\Brooks Scarpa\Google Drive Streaming\My Drive\MTA - Venice Bus Yard\03 Data Exchange Files\floors_general.ghdata",
    RelativePath="C:\Users\Brooks Scarpa\Google Drive Streaming\My Drive\MTA - Venice Bus Yard\03 Data Exchange Files\floors_general.ghdata|..\03 Data Exchange Files\floors_general.ghdata")  # disabled

# ---- group: Write to Excel
pro_forma = Panel(list_keys)
toggle = BooleanToggle(True)
values = Merge(
    Data1=graft(list_values),
    Data2=graft(list_values_2),
    Data3=graft(list_values_3),
    Data4=graft(list_values_4),
    Data5=graft(list_values_5),
    Data6=graft(list_values_6),
    Data7=graft(list_values_7),
    Data8=graft(list_values_8))

# ---- group: Calcs Total number of Units
flip = FlipMatrix(Data=values)
split = SplitTree(Data=flip, Masks=flatten("{0;(0 to 3)}[3]"))  # -> Positive, Negative
clean = CleanTree(RemoveNulls=True, RemoveInvalid=True, RemoveEmpty=False, Tree=split.Positive)  # -> flatten(Tree)

# ---- group: Calcs Total Parking
flip_2 = FlipMatrix(Data=values)
split_2 = SplitTree(Data=flip_2, Masks=flatten("{0;(6,7)}[3]"))  # -> Positive, Negative
clean_2 = CleanTree(RemoveNulls=True, RemoveInvalid=True, RemoveEmpty=False, Tree=split_2.Positive)  # -> flatten(Tree)

# ---- group: Tree Selection Tools
split_3 = SplitTree(Data=values, Masks=flatten("{0;(17 to 24)}[5 to 7]"))  # -> Positive, Negative

# ----
panel = Panel(clean)
panel_2 = Panel(values)

# ---- group: Write to Excel (continued)
writexl = WriteToExcel(
    Run=toggle,
    ExcelWorksheet="2",
    RowNames=pro_forma,
    WriteOptions="None",
    ColumnnsOrRows=True,
    DataToWriteIntoColumns=split_3.Negative)

# ---- group: Count Totls
panel_3 = Panel("""1
2
3
7
8
9
11
12
17
19
21""")
flip_3 = FlipMatrix(Data=split_3.Negative)
item = ListItem(List=pro_forma, Index=panel_3, Wrap=True)
item_2 = ListItem(List=flip_3, Index=panel_3, Wrap=True)
flip_4 = FlipMatrix(Data=item_2)
panel_4 = Panel(item)

# ----
clean_3 = CleanTree(RemoveNulls=True, RemoveInvalid=True, RemoveEmpty=False, Tree=flip_4)

# ---- group: Count Totls (continued)
ma = MassAddition(Input=clean_3)  # -> flatten(Result), PartialResults
panel_5 = Panel(ma.Result)

# ----
python = GhPythonScript(keys=panel_4, values=ma.Result, parking=clean_2, units=clean)  # -> out, keys_xlsx, values_xlsx, values; inputs keys: list, values: list, parking: list, units: list
# ---------- python: Python ----------
__author__ = "Iliya Muzychuk"
__version__ = "2023.02.03"

import rhinoscriptsyntax as rs
import Grasshopper as gh
import Rhino.Geometry as rg
import ghpythonlib.components as comps

def format_to_dollar_price(value):
    if isinstance(value, (int, float)):
        formatted_value = "${:,.2f}".format(value)
    elif isinstance(value, str):
        # Remove any non-numeric characters
        value = ''.join(filter(str.isdigit, value))
        if value:
            formatted_value = "${:,.2f}".format(float(value)/100)
        else:
            formatted_value = "$0.00"
    else:
        raise TypeError("Unsupported value type. Only int, float, and str are supported.")
    
    return formatted_value

def float_to_percentage(number):
    percentage = number * 100
    formatted_percentage = "{:.2f}%".format(percentage)
    return formatted_percentage

def format_to_sf_area(value):
    if isinstance(value, (int, float)):
        formatted_value = "{:,.2f} SF".format(value)
    else:
        raise TypeError("Unsupported value type. Only int and float are supported.")
    
    return formatted_value
    
def create_dictionary(keys, values):
    # Check if the number of keys and values are equal
    if len(keys) != len(values):
        raise ValueError("The number of keys and values must be equal.")

    # Create a dictionary using the zip function
    dictionary = dict(zip(keys, values))
    return dictionary

dic = create_dictionary(keys,values)

#Calculations

dic['cap_rate'] = dic['net_income']/dic['construction_cost']
dic['total_code_required_parking_spaces'] = parking[0] 
dic['total_visitor_parking_spaces'] = parking[1]
dic['total_potential_units'] = sum(units)
dic['total_achievable_units'] = dic['no_one_bedroom'] + dic['no_two_bedroom'] + dic['no_three_bedroom']

dic_gh_temp = dic
keys_xlsx = dic_gh_temp.keys()
values_xlsx = dic_gh_temp.values()
#Additional formatting

dic['cap_rate'] = float_to_percentage(dic['cap_rate'])
dic['total_gross_area'] = format_to_sf_area(dic['total_gross_area'])
dic['total_net_area'] = format_to_sf_area(dic['total_net_area'])
dic['construction_cost'] = format_to_dollar_price(dic['construction_cost'])
dic['soft_costs'] = format_to_dollar_price(dic['soft_costs'])
dic['total_cost'] = format_to_dollar_price(dic['total_cost'])
dic['gross_income'] = format_to_dollar_price(dic['gross_income'])
dic['net_income'] = format_to_dollar_price(dic['net_income'])





list_keys = [

    'total_gross_area',
    'total_net_area',
    'total_potential_units',
    'total_achievable_units',
    'construction_cost',
    'soft_costs',
    'total_cost',
    'gross_income',
    'net_income',
    'cap_rate',
    'total_code_required_parking_spaces',
    'total_visitor_parking_spaces',
    'no_one_bedroom',
    'no_two_bedroom',
    'no_three_bedroom'
]


values = [] 

for item in list_keys:
    values.append(item + ': ' + str(dic[item]))
# ---------- end python ----------
writexl_2 = WriteToExcel(
    Run=toggle,
    ExcelWorksheet="3",
    RowNames=python.keys_xlsx,
    WriteOptions="None",
    ColumnnsOrRows=True,
    DataToWriteIntoColumns=graft(python.values_xlsx))  # disabled

number_slider = Slider(10, range=0..10)
pt = Point(<point referenced from the Rhino model>)
lng = ListLength(List=python.values)
series = Series(Start=0, Step=expr("x+5", number_slider), Count=lng)
Z = UnitZ(Factor=series)
move = Move(Geometry=pt, Motion=Z)  # -> Geometry, Transform

screentext = ScreenOrientedText(Text=reverse(python.values), Justification=7, Location=move.Geometry, SizeFactor=number_slider, Depth=0, Absolute=False)

# ==== cluster ProFormaCalculator
G = ClusterInput()
massing = ClusterInput()
typical_floor_height = ClusterInput()
bool = ClusterInput()
program_name = ClusterInput()
unit_density = ClusterInput()
cpsf = ClusterInput()
ppsf = ClusterInput()
rpsf = ClusterInput()
cap_rate = ClusterInput()
net_coef = ClusterInput()
land_value = ClusterInput()
hard_soft_coef = ClusterInput()
percentage_one_bedrooms = ClusterInput()
percentage_two_bedrooms = ClusterInput()
desired_area_one_bedroom = ClusterInput()
desired_area_two_bedroom = ClusterInput()
desired_area_three_bedroom = ClusterInput()

cluster = Cluster(massing=massing, typical_floor_height=typical_floor_height, bool=bool)  # -> facade_attributes_2, points_facade_attributes, walls_2, roof, floors_2, floors_as_curves_2, areas, length_tree
pro_forma = GhPythonScript(
    program_name=program_name,
    areas=cluster.areas,
    unit_density=unit_density,
    cpsf=cpsf,
    ppsf=ppsf,
    rpsf=rpsf,
    cap_rate=cap_rate,
    net_coef=net_coef,
    land_value=land_value,
    hard_soft_coef=hard_soft_coef)  # -> values, dic_keys, dic_values, total_net_area; inputs areas: list
# ---------- pro_forma: Python ----------
__author__ = "ilouh"
__version__ = "2023.02.21"

import rhinoscriptsyntax as rs
import Grasshopper as gh
import Rhino.Geometry as rg
import ghpythonlib.components as comps
import math

#sum a list of numbers
def sum(numbers):
    total = 0
    for n in numbers:
        total += n
    return total


#Functions
def format_to_dollar_price(value):
    if isinstance(value, (int, float)):
        formatted_value = "${:,.2f}".format(value)
    elif isinstance(value, str):
        # Remove any non-numeric characters
        value = ''.join(filter(str.isdigit, value))
        if value:
            formatted_value = "${:,.2f}".format(float(value)/100)
        else:
            formatted_value = "$0.00"
    else:
        raise TypeError("Unsupported value type. Only int, float, and str are supported.")
    
    return formatted_value

def float_to_percentage(number):
    percentage = number * 100
    formatted_percentage = "{:.2f}%".format(percentage)
    return formatted_percentage

def format_to_sf_area(value):
    if isinstance(value, (int, float)):
        formatted_value = "{:,.2f} SF".format(value)
    else:
        raise TypeError("Unsupported value type. Only int and float are supported.")
    
    return formatted_value

#_______________________________________________________________________________________
# Calculations


total_area = sum(areas)
total_net_area = total_area * (net_coef /100)
units = math.floor(total_net_area/unit_density)

average_unit_size = total_net_area / units  # Average size of each unit in square feet
average_rent = float(rpsf) * total_net_area / units  # Average monthly rent per unit
unit_sale_value = average_unit_size * ppsf  # Sale value of each unit

project_valuation = (average_rent * units * (net_coef / 100) * 12) / (cap_rate / 100)  # Valuation of the project based on net operating income
construction_costs = total_area * cpsf  # Total construction costs for the project
soft_costs = construction_costs * ((100 - hard_soft_coef) / 100)  # Soft costs for the project
total_project_costs = land_value + construction_costs + soft_costs  # Total costs for the project

net_income = total_net_area * rpsf * (net_coef/100) * 12 

# Create a dictionary to store the calculated values
data_dict = {
    'program_name' : program_name,
    'total_gross_area': format_to_sf_area(total_area),
    'total_net_area': format_to_sf_area(total_net_area),
    'total_Potential_units': units,
    'average_unit_size': format_to_sf_area(average_unit_size),
    'average_unit_rent': format_to_dollar_price(average_rent),
    'average_unit_sale_value': format_to_dollar_price(unit_sale_value),
    'construction_cost': format_to_dollar_price(total_area * cpsf),
    'soft_costs': format_to_dollar_price(soft_costs),
    'total_cost': format_to_dollar_price(total_project_costs),
    'sale_value': format_to_dollar_price(total_area * ppsf),
    'gross_income' : format_to_dollar_price(total_area * rpsf * 12) ,
    'net_income' : format_to_dollar_price(net_income),
    'costruction_costs_per_sf': format_to_dollar_price(cpsf),
    'sale_price_per_sf': format_to_dollar_price(ppsf),
    'rent_price_per_sf': format_to_dollar_price(rpsf)
    
}


# Create a list of keys to iterate through
keys_list = [
    'program_name',
    'total_gross_area',
    'total_net_area',
    'total_Potential_units',
    'average_unit_size',
    'average_unit_rent',
    'average_unit_sale_value',
    'construction_cost',
    'soft_costs',
    'total_cost',
    'sale_value',
    'gross_income',
    'net_income',
    'costruction_costs_per_sf',
    'sale_price_per_sf',
    'rent_price_per_sf'
    
]

# Iterate through the keys_list and retrieve corresponding values from the data_dict
values = []
for item in keys_list:
    values.append(item + ': ' + str(data_dict[item]))

# Print the values
print(values)

dic_keys = keys_list
dic_values = []

for key in keys_list: 
    
    dic_values.append(data_dict[key])
# ---------- end pro_forma ----------
unit_breakdown = GhPythonScript(
    total_program_area=pro_forma.total_net_area,
    percentage_one_bedrooms=percentage_one_bedrooms,
    percentage_two_bedrooms=percentage_two_bedrooms,
    desired_area_one_bedroom=desired_area_one_bedroom,
    desired_area_two_bedroom=desired_area_two_bedroom,
    desired_area_three_bedroom=desired_area_three_bedroom)  # -> info, key_list, values
# ---------- unit_breakdown: Python ----------
__author__ = "ilouh"
__version__ = "2023.02.21"

import rhinoscriptsyntax as rs
import Grasshopper as gh
import Rhino.Geometry as rg
import ghpythonlib.components as comps
import math


#Declaration of variables
total_area = total_program_area

#percentage_one_bedrooms = 25
#percentage_two_bedrooms = 35 

#desired_area_one_bedroom = 400
#desired_area_two_bedroom = 600
#desired_area_three_bedroom = 800

def format_to_sf_area(value):
    if isinstance(value, (int, float)):
        formatted_value = "{:,.2f} SF".format(value)
    else:
        raise TypeError("Unsupported value type. Only int and float are supported.")
    
    return formatted_value
    

def unit_program(total_area,
                 program_percentage,
                 proposed_unit_area):

    total_program_area_for_unit_type = total_area * (program_percentage/100)
    total_units_of_type = math.floor(total_program_area_for_unit_type / proposed_unit_area)
    unit_of_type_average_area = round(total_program_area_for_unit_type / total_units_of_type,2)

    total_program_area = total_units_of_type * unit_of_type_average_area
    

    return total_units_of_type, unit_of_type_average_area,total_program_area

def unit_calcs(total_area,
               percentage_one_bedrooms,
               percentage_two_bedrooms,
               desired_area_one_bedroom,
               desired_area_two_bedroom,
               desired_area_three_bedroom):

    percentage_three_bedrooms = 100 - (percentage_one_bedrooms + percentage_two_bedrooms)

    one_bedroom = unit_program(total_area,percentage_one_bedrooms,desired_area_one_bedroom)
    two_bedroom = unit_program(total_area,percentage_two_bedrooms,desired_area_two_bedroom)
    three_bedroom = unit_program(total_area,percentage_three_bedrooms,desired_area_three_bedroom)

    
    dic = {
        "unit_breakdown" : "----",
        "no_one_bedroom": one_bedroom[0],
        "avg_one_bedroom_area": format_to_sf_area(one_bedroom[1]),
        "no_two_bedroom": two_bedroom[0],
        "avg_two_bedroom_area": format_to_sf_area(two_bedroom[1]),
        "no_three_bedroom": three_bedroom[0],
        "avg_three_bedroom_area": format_to_sf_area(three_bedroom[1]),
        "total_net_area": one_bedroom[2] + two_bedroom[2] + three_bedroom[2],
        "total_units": one_bedroom[0] + two_bedroom[0] + three_bedroom[0]

    }

    return dic


dic = unit_calcs(total_area,percentage_one_bedrooms,percentage_two_bedrooms,desired_area_one_bedroom,desired_area_two_bedroom,desired_area_three_bedroom)

key_list = [
    
    "unit_breakdown",
    "no_one_bedroom",
    "avg_one_bedroom_area",
    "no_two_bedroom",
    "avg_two_bedroom_area",
    "no_three_bedroom",
    "avg_three_bedroom_area",
    "total_units",
    "total_net_area"

]

info  = []
for item in key_list:
    info.append(item + ': ' + str(dic[item]))
    
values  = []

for key in key_list:
    values.append(dic[key])
# ---------- end unit_breakdown ----------
python = GhPythonScript(li=pro_forma.dic_values)  # -> flatten(values_as_floats); inputs li: list
# ---------- python: Python ----------
__author__ = "Iliya Muzychuk"
__version__ = "2023.02.03"

import rhinoscriptsyntax as rs
import Grasshopper as gh
import Rhino.Geometry as rg
import ghpythonlib.components as comps

import re

def extract_numbers(string):
    numbers = re.findall(r'\d+(?:,\d+)*(?:\.\d+)?', string)
    return [float(num.replace(',', '')) for num in numbers]

values_as_floats = []

for item in li: 
    
    extracted_number = extract_numbers(str(item))
    print(len(extracted_number))
    
    
    #check if extracted_number is a number or not
    if len(extracted_number) > 0:
        
        values_as_floats.append(extracted_number[0])
        
    else:
        empty_string = str(item)
        values_as_floats.append(empty_string)


print(values_as_floats)
# ---------- end python ----------
python_2 = GhPythonScript(li=unit_breakdown.values)  # -> flatten(values_as_floats); inputs li: list; same code as python
merge = Merge(Data1=pro_forma.dic_keys, Data2=unit_breakdown.key_list)
merge_2 = Merge(Data1=python, Data2=python_2)

walls = ClusterOutput(cluster.walls_2)
roof = ClusterOutput(cluster.roof)
floors = ClusterOutput(cluster.floors_2)
python_3 = GhPythonScript(
    pro_forma_keys=pro_forma.dic_keys,
    pro_forma_values=pro_forma.dic_values,
    unit_breakdown_keys=unit_breakdown.key_list,
    unit_breakdown_values=unit_breakdown.values)  # -> dic, keys, values; inputs pro_forma_keys: list, pro_forma_values: list, unit_breakdown_keys: list, unit_breakdown_values: list
# ---------- python_3: Python ----------
__author__ = "Iliya Muzychuk"
__version__ = "2023.02.03"

import rhinoscriptsyntax as rs
import Grasshopper as gh
import Rhino.Geometry as rg
import ghpythonlib.components as comps
import re 

def extract_numbers(string):
    numbers = re.findall(r'\d+(?:,\d+)*(?:\.\d+)?', string)
    return [float(num.replace(',', '')) for num in numbers]
    
keys = pro_forma_keys+unit_breakdown_keys
values = pro_forma_values + unit_breakdown_values


dic = {}

for i in range(0,len(keys)):
    
    value = extract_numbers(str(values[i]))
    
    if len(value) > 0:
        
        dic[keys[i]] = round(value[0],2)
        
    else:
        dic[keys[i]] = str(values[i])
        

print dic
# ---------- end python_3 ----------
panel = Panel(python_3.keys)
R = ClusterOutput(merge)
R_2 = ClusterOutput(merge_2)

# ==== cluster Cluster
massing = ClusterInput()
typical_floor_height = ClusterInput()
typical_floor_height_2 = Integer(typical_floor_height)
massing_2 = Brep(massing)

# ---- group: Calculates Building Height
bbox = BoundingBox(Content=massing_2, Plane=PlaneXY(0, 0, 0), UnionBox=True)  # -> Box, Box_2
box_corners = BoxCorners(Box=bbox.Box)  # -> CornerA, CornerB, CornerC, CornerD, CornerE, CornerF, CornerG, CornerH

# ----
Z = UnitZ(Factor=1)
contour = Contour(Shape=massing_2, Point=box_corners.CornerA, Direction=Z, Distance=typical_floor_height_2)  # -> simplify(Contours)
tstat = TreeStatistics(Tree=contour)  # -> Paths, Length, Count
trim = TrimTree(Tree=contour, Depth=1)
panel = Panel(trim)
floors_as_curves = Curve(simplify(contour))

# ---- group: Isolate Faces of Mass
debrep = DeconstructBrep(Brep=massing_2)  # -> Faces, Edges, Vertices
evalsrf = EvaluateSurface(Surface=reparameterize(debrep.Faces), Point="{0.5,0.5,0}")  # -> Point, Normal, UDirection, VDirection, Frame
distributefaces = GhPythonScript(v=evalsrf.Normal, faces=debrep.Faces)  # -> floors, facadeWalls, roof; inputs v: list, faces: list
# ---------- distributefaces: Python ----------
__author__ = "ilouh"
__version__ = "2023.01.08"

import rhinoscriptsyntax as rs
import ghpythonlib.components as comps
import Rhino.Geometry as geom

#elements = comps.DeconstructBrep(mass)
#faces = elements['faces']

#find the normal of each face


roof = []
floors = []
solidWalls = []
facadeWalls = [] 

for i in range(0,len(v)):
    
    
    values = comps.DeconstructVector(v[i])
    print(values)
    
    x_value = values['x_component']
    y_value = values['y_component']
    z_value = values['z_component']
    
    

    if z_value >= 0.4:
        
        print(i)
        roof.append(faces[i])
    
    if z_value == -1:
        
        floors.append(faces[i])
   
    if abs(z_value) != 1:
    
        facadeWalls.append(faces[i])
# ---------- end distributefaces ----------

# ----
srf = Surface(graft(distributefaces.facadeWalls))
srf_2 = Surface(flatten(distributefaces.roof))
srf_3 = Surface(distributefaces.floors)
flatten = FlattenTree(Tree=srf_3, Path="{0}")
trim_2 = TrimTree(Tree=srf, Depth=1)
area = Area(Geometry=flatten)  # -> Area, Centroid
bool = ClusterInput()
ma = MassAddition(Input=area.Area)  # -> Result, PartialResults
walls = Surface(simplify(trim_2))

# ---- group: Pass if Tree or List
python = GhPythonScript(x=floors_as_curves, tree=floors_as_curves)  # -> simplify(flatten(a)); inputs x: list, tree: tree
# ---------- python: Python ----------
__author__ = "ilouh"
__version__ = "2023.02.21"

import rhinoscriptsyntax as rs
import Grasshopper as gh
import Rhino.Geometry as rg
import ghpythonlib.components as comps
from ghpythonlib import treehelpers as th
import math

def remove_brackets(input_str):
    # Remove the brackets
    content = input_str.strip('{}')
    # Split the string by commas and convert to integers
    numbers = [int(num) for num in content.split(';')]

    return numbers
    
test_li = th.tree_to_list(tree)
test_value = len(test_li)

tree_stats = comps.TreeStatistics(tree)
tree_paths = tree_stats['paths']
tree_paths = tree_paths[0]
tree_path_structure = remove_brackets(str(tree_paths))
tree_path_structure_length = len(tree_path_structure)
print(tree_path_structure_length)


if tree_path_structure_length > 1:
    a = True
else:
    a = False
# ---------- end python ----------
trim_3 = TrimTree(Tree=floors_as_curves, Depth=1)
flatten_2 = FlattenTree(Tree=floors_as_curves, Path="{0}")

# ----
item = ListItem(List=python, Index=0, Wrap=True)

# ---- group: Pass if Tree or List (continued)
filter = StreamFilter(Gate=item, Stream0=flatten_2, Stream1=trim_3)

# ----
cls = Closed(Curve=filter)  # -> Closed, Periodic
panel_2 = Panel(cls.Closed)
cull = CullPattern(List=filter, CullPattern=cls.Closed)

# ---- group: Calculates Gross Building Area
python_2 = GhPythonScript(Floor_Plate_Curves=cull, bool=bool)  # -> keys, simplify(values), TotalBuildingArea, Floor_Plate_Curves; inputs Floor_Plate_Curves: list of Curve, floorList: list of Int32
# ---------- python_2: Python ----------
__author__ = "Iliya Muzychuk"
__version__ = "2023.02.03"

import rhinoscriptsyntax as rs
import Grasshopper as gh
import Rhino.Geometry as rg
import ghpythonlib.components as comps

FloorNames = []
FloorAreas = []

#Funcition to find the key of a dictionary by value 

def findKey(value_to_find,dic):
    for key, value in dic.items():
        if abs(value - value_to_find) < 2:
            return key
dic = {}
#Create a name and claculates the area of each floor
for i in range(0,len(floorList)):
    floor_number = 1 + i
    dic_name = 'Floor {}'.format(floor_number)
    dic[dic_name] = floorList[i]

print(dic)

if bool == True: 

    Floor_Plate_Curves.pop(-1)

else:
    
    pass

for  floor in Floor_Plate_Curves: 
    
    
    Floor_Area = comps.Area(floor)
    FloorAreas.append(round(Floor_Area['area'],2))

    
    z_value = int(Floor_Area['centroid'][2])
    print(z_value)
    Floor_Name = findKey(z_value,dic)
    
    print(Floor_Name)

    FloorNames.append(Floor_Name)

keys = FloorNames
values = FloorAreas

TotalBuildingArea = sum(values)
# ---------- end python_2 ----------

# ---- group: creates the extrusion distance
floor_thickness = Slider(0.5, range=0..1)
neg = Negative(Value=floor_thickness)
Z_2 = UnitZ(Factor=neg)
extr = Extrude(Base=python_2.Floor_Plate_Curves, Direction=Z_2)
cap = CapHoles(Brep=extr)

# ----
panel_3 = Panel(python_2.TotalBuildingArea)

extr_2 = Extrude(Base=srf_2, Direction=Z_2)
cap_2 = CapHoles(Brep=extr_2)

panel_4 = Panel(python_2.Floor_Plate_Curves)
floors = Brep(simplify(cap))
flatten_3 = FlattenTree(Tree=python_2.values, Path="{0}")
tstat_2 = TreeStatistics(Tree=python_2.values)  # -> Length_tree, Length, Count

# ---- group: Outputs
floors_as_curves_2 = ClusterOutput(python_2.Floor_Plate_Curves)
floors_2 = ClusterOutput(floors)
walls_2 = ClusterOutput(walls)
roof = ClusterOutput(cap_2)

# ----
areas = ClusterOutput(flatten_3)
length_tree = ClusterOutput(tstat_2.Length_tree)
flatten_4 = FlattenTree(Tree=python_2.TotalBuildingArea, Path="{0}")
graft = GraftTree(Tree=flatten_4, IncludeEmptyLists=True, IncludeNullItems=True)

# ---- group: Calculates Wall Area Ratio
python_3 = GhPythonScript(walls=walls, totalBuildingArea=graft)  # -> keys, values, result; inputs walls: list
# ---------- python_3: Python ----------
__author__ = "Iliya Muzychuk"
__version__ = "2023.02.03"

import rhinoscriptsyntax as rs
import Grasshopper as gh
import Rhino.Geometry as rg
import ghpythonlib.components as comps

#A function to convert a float to percentage

def float_to_percentage(number):
    return '{:.2%}'.format(number)
    
wall_areas = []

for wall in walls:
    
    area = rs.Area(wall)
    wall_areas.append(area)

total_wall_area = round(sum(wall_areas),2)
wall_area_ratio = total_wall_area / totalBuildingArea

#Dictionary constructions allows future json file control 

dic = {

    'Total Facade Area' : total_wall_area,
    'Wall area/Floor area Ratio' : float_to_percentage(wall_area_ratio)

}

keys = dic.keys()
values = dic.values() 

result = []

for key, value in dic.items():
    
    string = str(key) + ": " + str(value)
    result.append(string)
# ---------- end python_3 ----------

# ----
facade_attributes = Data(python_3.result)

lng = ListLength(List=simplify(facade_attributes))
series = Series(Start=0, Step=typical_floor_height_2, Count=lng)

Z_3 = UnitZ(Factor=series)
move = Move(Motion=Z_3)  # -> Points_Facade_Attributes, Transform

points_facade_attributes = ClusterOutput(move.Points_Facade_Attributes)
facade_attributes_2 = ClusterOutput(facade_attributes)
