# Grasshopper definition Massing Design Calculator 0.7.0 (MTA)_Option G.gh (Grasshopper 1.0.7)
# plug-ins: TT Toolbox, Human, CORE.Toolbox.Grasshopper, eleFront

crv = Curve(reparameterize(<curve referenced from the Rhino model>))
divdist = DivideDistance(Curve=crv, Distance=Slider(45, range=0..100))  # -> Points, Tangents, Parameters
hframe = HorizontalFrame(Curve=crv, Parameter=0.5)
deplane = DeconstructPlane(Plane=hframe)  # -> Origin, XAxis, YAxis, ZAxis
Y = UnitY(Factor=1)
line = LineSDL(Start=divdist.Points, Direction=expr("-x", deplane.YAxis), Length=Slider(60, range=0..100))
toggle = BooleanToggle(False)
shift = ShiftList(List=line, Shift=-1, Wrap=toggle)
shift_2 = ShiftList(List=line, Shift=1, Wrap=toggle)
midpt = CurveMiddle(Curve=shift_2)
crv_cp = CurveClosestPoint(Point=midpt, Curve=shift)  # -> Point, Parameter, Distance
amp = Amplitude(Vector=deplane.XAxis, Amplitude=crv_cp.Distance)
extr = Extrude(Base=shift, Direction=amp)
lng = ListLength(List=extr)
random = Random(Range=Domain(5, 6), Number=lng, Seed=2, Integers=True)
expression = Expression(x=random, Expression="x*11.1")
Z = UnitZ(Factor=expression)
extr_2 = Extrude(Base=extr, Direction=Z)

select_option = Slider(2, range=0..6)

pipeline = GeometryPipeline(
    GroupByLayer=False,
    GroupByType=False,
    IncludeHidden=True,
    IncludeLocked=True,
    LayerFilter="02_MASSING - Opt7*Market Rate",
    NameFilter="*",
    SublayerFiltering=True,
    TypeFilter=1073741848)
pipeline_2 = GeometryPipeline(
    GroupByLayer=False,
    GroupByType=False,
    IncludeHidden=True,
    IncludeLocked=True,
    LayerFilter="02_MASSING - Opt7*Retail",
    NameFilter="*",
    SublayerFiltering=True,
    TypeFilter=1073741848)
pipeline_3 = GeometryPipeline(
    GroupByLayer=False,
    GroupByType=False,
    IncludeHidden=True,
    IncludeLocked=True,
    LayerFilter="02_MASSING - Opt7*Community Spaces",
    NameFilter="*",
    SublayerFiltering=True,
    TypeFilter=1073741848)
pipeline_4 = GeometryPipeline(
    GroupByLayer=False,
    GroupByType=False,
    IncludeHidden=True,
    IncludeLocked=True,
    LayerFilter="02_MASSING - Opt7*Code Required Parking",
    NameFilter="*",
    SublayerFiltering=True,
    TypeFilter=1073741848)
pipeline_5 = GeometryPipeline(
    GroupByLayer=False,
    GroupByType=False,
    IncludeHidden=True,
    IncludeLocked=True,
    LayerFilter="02_MASSING - Opt7*Visitor Parking",
    NameFilter="*",
    SublayerFiltering=True,
    TypeFilter=1073741848)

pipeline_6 = GeometryPipeline(
    GroupByLayer=False,
    GroupByType=False,
    IncludeHidden=True,
    IncludeLocked=True,
    LayerFilter="02_MASSING - Opt6*Market Rate",
    NameFilter="*",
    SublayerFiltering=True,
    TypeFilter=1073741848)
pipeline_7 = GeometryPipeline(
    GroupByLayer=False,
    GroupByType=False,
    IncludeHidden=True,
    IncludeLocked=True,
    LayerFilter="02_MASSING - Opt6*Retail",
    NameFilter="*",
    SublayerFiltering=True,
    TypeFilter=1073741848)
pipeline_8 = GeometryPipeline(
    GroupByLayer=False,
    GroupByType=False,
    IncludeHidden=True,
    IncludeLocked=True,
    LayerFilter="02_MASSING - Opt6*Community Spaces",
    NameFilter="*",
    SublayerFiltering=True,
    TypeFilter=1073741848)
pipeline_9 = GeometryPipeline(
    GroupByLayer=False,
    GroupByType=False,
    IncludeHidden=True,
    IncludeLocked=True,
    LayerFilter="02_MASSING - Opt6*Code Required Parking",
    NameFilter="*",
    SublayerFiltering=True,
    TypeFilter=1073741848)
pipeline_10 = GeometryPipeline(
    GroupByLayer=False,
    GroupByType=False,
    IncludeHidden=True,
    IncludeLocked=True,
    LayerFilter="02_MASSING - Opt6*Visitor Parking",
    NameFilter="*",
    SublayerFiltering=True,
    TypeFilter=1073741848)

pipeline_11 = GeometryPipeline(
    GroupByLayer=False,
    GroupByType=False,
    IncludeHidden=True,
    IncludeLocked=True,
    LayerFilter="02_MASSING - Opt5*Market Rate",
    NameFilter="*",
    SublayerFiltering=True,
    TypeFilter=1073741848)
pipeline_12 = GeometryPipeline(
    GroupByLayer=False,
    GroupByType=False,
    IncludeHidden=True,
    IncludeLocked=True,
    LayerFilter="02_MASSING - Opt5*Retail",
    NameFilter="*",
    SublayerFiltering=True,
    TypeFilter=1073741848)
pipeline_13 = GeometryPipeline(
    GroupByLayer=False,
    GroupByType=False,
    IncludeHidden=True,
    IncludeLocked=True,
    LayerFilter="02_MASSING - Opt5*Community Spaces",
    NameFilter="*",
    SublayerFiltering=True,
    TypeFilter=1073741848)
pipeline_14 = GeometryPipeline(
    GroupByLayer=False,
    GroupByType=False,
    IncludeHidden=True,
    IncludeLocked=True,
    LayerFilter="02_MASSING - Opt5*Code Required Parking",
    NameFilter="*",
    SublayerFiltering=True,
    TypeFilter=1073741848)
pipeline_15 = GeometryPipeline(
    GroupByLayer=False,
    GroupByType=False,
    IncludeHidden=True,
    IncludeLocked=True,
    LayerFilter="02_MASSING - Opt5*Visitor Parking",
    NameFilter="*",
    SublayerFiltering=True,
    TypeFilter=1073741848)

pipeline_16 = GeometryPipeline(
    GroupByLayer=False,
    GroupByType=False,
    IncludeHidden=True,
    IncludeLocked=True,
    LayerFilter="02_MASSING - Opt4*Market Rate",
    NameFilter="*",
    SublayerFiltering=True,
    TypeFilter=1073741848)
pipeline_17 = GeometryPipeline(
    GroupByLayer=False,
    GroupByType=False,
    IncludeHidden=True,
    IncludeLocked=True,
    LayerFilter="02_MASSING - Opt4*Retail",
    NameFilter="*",
    SublayerFiltering=True,
    TypeFilter=1073741848)
pipeline_18 = GeometryPipeline(
    GroupByLayer=False,
    GroupByType=False,
    IncludeHidden=True,
    IncludeLocked=True,
    LayerFilter="02_MASSING - Opt4*Community Spaces",
    NameFilter="*",
    SublayerFiltering=True,
    TypeFilter=1073741848)
pipeline_19 = GeometryPipeline(
    GroupByLayer=False,
    GroupByType=False,
    IncludeHidden=True,
    IncludeLocked=True,
    LayerFilter="02_MASSING - Opt4*Code Required Parking",
    NameFilter="*",
    SublayerFiltering=True,
    TypeFilter=1073741848)
pipeline_20 = GeometryPipeline(
    GroupByLayer=False,
    GroupByType=False,
    IncludeHidden=True,
    IncludeLocked=True,
    LayerFilter="02_MASSING - Opt4*Visitor Parking",
    NameFilter="*",
    SublayerFiltering=True,
    TypeFilter=1073741848)

pipeline_21 = GeometryPipeline(
    GroupByLayer=False,
    GroupByType=False,
    IncludeHidden=True,
    IncludeLocked=True,
    LayerFilter="02_MASSING - Opt3*Market Rate",
    NameFilter="*",
    SublayerFiltering=True,
    TypeFilter=1073741848)
pipeline_22 = GeometryPipeline(
    GroupByLayer=False,
    GroupByType=False,
    IncludeHidden=True,
    IncludeLocked=True,
    LayerFilter="02_MASSING - Opt3*Retail",
    NameFilter="*",
    SublayerFiltering=True,
    TypeFilter=1073741848)
pipeline_23 = GeometryPipeline(
    GroupByLayer=False,
    GroupByType=False,
    IncludeHidden=True,
    IncludeLocked=True,
    LayerFilter="02_MASSING - Opt3*Community Spaces",
    NameFilter="*",
    SublayerFiltering=True,
    TypeFilter=1073741848)
pipeline_24 = GeometryPipeline(
    GroupByLayer=False,
    GroupByType=False,
    IncludeHidden=True,
    IncludeLocked=True,
    LayerFilter="02_MASSING - Opt3*Code Required Parking",
    NameFilter="*",
    SublayerFiltering=True,
    TypeFilter=1073741848)
pipeline_25 = GeometryPipeline(
    GroupByLayer=False,
    GroupByType=False,
    IncludeHidden=True,
    IncludeLocked=True,
    LayerFilter="02_MASSING - Opt3*Visitor Parking",
    NameFilter="*",
    SublayerFiltering=True,
    TypeFilter=1073741848)

pipeline_26 = GeometryPipeline(
    GroupByLayer=False,
    GroupByType=False,
    IncludeHidden=True,
    IncludeLocked=True,
    LayerFilter="02_MASSING - Opt2*Market Rate",
    NameFilter="*",
    SublayerFiltering=True,
    TypeFilter=1073741848)
pipeline_27 = GeometryPipeline(
    GroupByLayer=False,
    GroupByType=False,
    IncludeHidden=True,
    IncludeLocked=True,
    LayerFilter="02_MASSING - Opt2*Retail",
    NameFilter="*",
    SublayerFiltering=True,
    TypeFilter=1073741848)
pipeline_28 = GeometryPipeline(
    GroupByLayer=False,
    GroupByType=False,
    IncludeHidden=True,
    IncludeLocked=True,
    LayerFilter="02_MASSING - Opt2*Community Spaces",
    NameFilter="*",
    SublayerFiltering=True,
    TypeFilter=1073741848)
pipeline_29 = GeometryPipeline(
    GroupByLayer=False,
    GroupByType=False,
    IncludeHidden=True,
    IncludeLocked=True,
    LayerFilter="02_MASSING - Opt2*Code Required Parking",
    NameFilter="*",
    SublayerFiltering=True,
    TypeFilter=1073741848)
pipeline_30 = GeometryPipeline(
    GroupByLayer=False,
    GroupByType=False,
    IncludeHidden=True,
    IncludeLocked=True,
    LayerFilter="02_MASSING - Opt2*Visitor Parking",
    NameFilter="*",
    SublayerFiltering=True,
    TypeFilter=1073741848)

pipeline_31 = GeometryPipeline(
    GroupByLayer=False,
    GroupByType=False,
    IncludeHidden=True,
    IncludeLocked=True,
    LayerFilter="02_MASSING - Opt1*Market Rate",
    NameFilter="*",
    SublayerFiltering=True,
    TypeFilter=1073741848)
pipeline_32 = GeometryPipeline(
    GroupByLayer=False,
    GroupByType=False,
    IncludeHidden=True,
    IncludeLocked=True,
    LayerFilter="02_MASSING - Opt1*Retail",
    NameFilter="*",
    SublayerFiltering=True,
    TypeFilter=1073741848)
pipeline_33 = GeometryPipeline(
    GroupByLayer=False,
    GroupByType=False,
    IncludeHidden=True,
    IncludeLocked=True,
    LayerFilter="02_MASSING - Opt1*Community Spaces",
    NameFilter="*",
    SublayerFiltering=True,
    TypeFilter=1073741848)
pipeline_34 = GeometryPipeline(
    GroupByLayer=False,
    GroupByType=False,
    IncludeHidden=True,
    IncludeLocked=True,
    LayerFilter="02_MASSING - Opt1*Code Required Parking",
    NameFilter="*",
    SublayerFiltering=True,
    TypeFilter=1073741848)
pipeline_35 = GeometryPipeline(
    GroupByLayer=False,
    GroupByType=False,
    IncludeHidden=True,
    IncludeLocked=True,
    LayerFilter="02_MASSING - Opt1*Visitor Parking",
    NameFilter="*",
    SublayerFiltering=True,
    TypeFilter=1073741848)

create_tree = CreateTree_2(T=pipeline_16, T_4=pipeline_17, T_5=pipeline_18, T_3=pipeline_19, T_2=pipeline_20)
create_tree_2 = CreateTree_2(T=pipeline_21, T_4=pipeline_22, T_5=pipeline_23, T_3=pipeline_24, T_2=pipeline_25)
create_tree_3 = CreateTree(T=pipeline, T_2=pipeline_2, T_5=pipeline_3, T_4=pipeline_4, T_3=pipeline_5)
create_tree_4 = CreateTree_2(T=pipeline_6, T_4=pipeline_7, T_5=pipeline_8, T_3=pipeline_9, T_2=pipeline_10)
create_tree_5 = CreateTree_2(T=pipeline_11, T_4=pipeline_12, T_5=pipeline_13, T_3=pipeline_14, T_2=pipeline_15)
create_tree_6 = CreateTree_2(T=pipeline_26, T_4=pipeline_27, T_5=pipeline_28, T_3=pipeline_29, T_2=pipeline_30)
create_tree_7 = CreateTree_2(T=pipeline_31, T_4=pipeline_32, T_5=pipeline_33, T_3=pipeline_34, T_2=pipeline_35)
massing = Brep(create_tree)
massing_2 = Brep(create_tree_2)
massing_3 = Brep(create_tree_3)
massing_4 = Brep(create_tree_4)
massing_5 = Brep(create_tree_5)
massing_6 = Brep(create_tree_6)
massing_7 = Brep(create_tree_7)
entwine = Entwine(
    Branch0X=massing_3,
    Branch1X=massing_4,
    Branch2X=massing_5,
    Branch3X=massing,
    Branch4X=massing_2,
    Branch5X=massing_6,
    Branch6X=massing_7,
    FlattenInputs=False)
python = GhPythonScript(y=select_option)  # -> out, a
# ---------- python: Python ----------
__author__ = "ilouh"
__version__ = "2023.02.21"

import rhinoscriptsyntax as rs
import Grasshopper as gh
import Rhino.Geometry as rg
import ghpythonlib.components as comps
import math


a = '{' + str(int(y))+ ';?}'
# ---------- end python ----------
split = SplitTree(Data=entwine, Masks=flatten(python.a))  # -> Positive, Negative
bang = ExplodeTree(Data=split.Positive)  # -> Branch0, Branch1, Branch2, Branch3, Branch4
preview = CustomPreview(
    Geometry=bang.Branch0,
    Material={diffuse=RGB(221, 160, 221), emission=RGB(66, 48, 66), shine=0.5, specular=RGB(255, 255, 255), transparency=0})
preview_2 = CustomPreview(
    Geometry=bang.Branch1,
    Material={diffuse=RGB(221, 160, 221), emission=RGB(66, 48, 66), shine=0.5, specular=RGB(255, 255, 255), transparency=0})
preview_3 = CustomPreview(
    Geometry=bang.Branch2,
    Material={diffuse=RGB(221, 160, 221), emission=RGB(66, 48, 66), shine=0.5, specular=RGB(255, 255, 255), transparency=0})
preview_4 = CustomPreview(
    Geometry=bang.Branch3,
    Material={diffuse=RGB(221, 160, 221), emission=RGB(66, 48, 66), shine=0.5, specular=RGB(255, 255, 255), transparency=0})
preview_5 = CustomPreview(
    Geometry=bang.Branch4,
    Material={diffuse=RGB(221, 160, 221), emission=RGB(66, 48, 66), shine=0.5, specular=RGB(255, 255, 255), transparency=0})

land_value = DigitScroller(Scroller_Digits=12, Scroller_Prefix="Land Value", Scroller_Radix=11, Scroller_Value=1300000)
net_coefficient = DigitScroller(Scroller_Digits=12, Scroller_Prefix="Net Coefficient", Scroller_Radix=11, Scroller_Value=75)
hard_vs_soft_coef = DigitScroller(Scroller_Digits=12, Scroller_Prefix="Hard vs Soft Coef", Scroller_Radix=11, Scroller_Value=70)
cap_rate = DigitScroller(Scroller_Digits=12, Scroller_Prefix="Cap Rate", Scroller_Radix=11, Scroller_Value=5)

pipeline_36 = GeometryPipeline(
    GroupByLayer=False,
    GroupByType=False,
    IncludeHidden=True,
    IncludeLocked=True,
    LayerFilter="02_MASSING*Very Low Income",
    NameFilter="*",
    SublayerFiltering=True,
    TypeFilter=1073741848)  # disabled
pipeline_37 = GeometryPipeline(
    GroupByLayer=False,
    GroupByType=False,
    IncludeHidden=True,
    IncludeLocked=True,
    LayerFilter="02_MASSING*Moderate Income",
    NameFilter="*",
    SublayerFiltering=True,
    TypeFilter=1073741848)  # disabled
pipeline_38 = GeometryPipeline(
    GroupByLayer=False,
    GroupByType=False,
    IncludeHidden=True,
    IncludeLocked=True,
    LayerFilter="02_MASSING*Market Rate",
    NameFilter="*",
    SublayerFiltering=True,
    TypeFilter=1073741848)  # disabled
input_mass = Brep(graft(bang.Branch0))
program_name = Panel("Market Rate")
input_mass_2 = Brep(graft(bang.Branch1))
program_name_2 = Panel("Retail")
input_mass_3 = Brep(graft(bang.Branch2))
program_name_3 = Panel("Community Spaces")
input_mass_4 = Brep(graft(bang.Branch3))
program_name_4 = Panel("Code Required Parking")
input_mass_5 = Brep(graft(bang.Branch4))
program_name_5 = Panel("Visitor Parking")
program_name_6 = Panel("Moderate Income")  # disabled
program_name_7 = Panel("Very Low Income")  # disabled
program_name_8 = Panel("Market Rate")  # disabled
input_mass_6 = Brep(graft(pipeline_36))  # disabled
input_mass_7 = Brep(graft(pipeline_37))  # disabled
input_mass_8 = Brep(graft(pipeline_38))  # disabled
omit_last_floor_slab = BooleanToggle(True)
typical_floor_height = DigitScroller(Scroller_Digits=12, Scroller_Prefix="Typical Floor Height", Scroller_Radix=11, Scroller_Value=11)
percentage_studios = DigitScroller(Scroller_Digits=12, Scroller_Prefix="Percentage Studios", Scroller_Radix=11, Scroller_Value=25)  # disabled
target_area_studios = DigitScroller(Scroller_Digits=12, Scroller_Prefix="Target Area - Studios", Scroller_Radix=11, Scroller_Value=250)  # disabled
omit_last_floor_slab_2 = BooleanToggle(True)
typical_floor_height_2 = DigitScroller(Scroller_Digits=12, Scroller_Prefix="Typical Floor Height", Scroller_Radix=11, Scroller_Value=14)

sale_price_per_sf = DigitScroller(Scroller_Digits=12, Scroller_Prefix="Sale Price Per SF", Scroller_Radix=11, Scroller_Value=550)
unit_density = DigitScroller(Scroller_Digits=12, Scroller_Prefix="Unit Density", Scroller_Radix=11, Scroller_Value=1000)
construction_cost_per_sf = DigitScroller(Scroller_Digits=12, Scroller_Prefix="Construction Cost Per SF", Scroller_Radix=11, Scroller_Value=375)
rent_per_sf = DigitScroller(Scroller_Digits=12, Scroller_Prefix="Rent Per SF", Scroller_Radix=10, Scroller_Value=5)
pro_forma_calculator = ProFormaCalculator(
    program_name=program_name_2,
    massing=input_mass_2,
    unit_density=unit_density,
    cpsf=construction_cost_per_sf,
    typical_floor_height=typical_floor_height_2,
    ppsf=sale_price_per_sf,
    rpsf=rent_per_sf,
    cap_rate=cap_rate,
    bool=omit_last_floor_slab_2,
    net_coef=net_coefficient,
    land_value=land_value,
    hard_soft_coef=hard_vs_soft_coef)  # -> walls, roof, floors, floors_as_curves, values, T, R

typical_floor_height_3 = DigitScroller(Scroller_Digits=12, Scroller_Prefix="Typical Floor Height", Scroller_Radix=11, Scroller_Value=8)
typical_floor_height_4 = DigitScroller(Scroller_Digits=12, Scroller_Prefix="Typical Floor Height", Scroller_Radix=11, Scroller_Value=15)
omit_last_floor_slab_3 = BooleanToggle(True)
omit_last_floor_slab_4 = BooleanToggle(False)
omit_last_floor_slab_5 = BooleanToggle(True)

unit_density_2 = DigitScroller(Scroller_Digits=12, Scroller_Prefix="Unit Density", Scroller_Radix=11, Scroller_Value=400)
construction_cost_per_sf_2 = DigitScroller(Scroller_Digits=12, Scroller_Prefix="Construction Cost Per SF", Scroller_Radix=11, Scroller_Value=175)
sale_price_per_sf_2 = DigitScroller(Scroller_Digits=12, Scroller_Prefix="Sale Price Per SF", Scroller_Radix=11, Scroller_Value=0)
rent_per_sf_2 = DigitScroller(Scroller_Digits=12, Scroller_Prefix="Rent Per SF", Scroller_Radix=10, Scroller_Value=0)
pro_forma_calculator_2 = ProFormaCalculator(
    program_name=program_name_5,
    massing=input_mass_5,
    unit_density=unit_density_2,
    cpsf=construction_cost_per_sf_2,
    typical_floor_height=typical_floor_height_4,
    ppsf=sale_price_per_sf_2,
    rpsf=rent_per_sf_2,
    cap_rate=cap_rate,
    bool=omit_last_floor_slab_3,
    net_coef=net_coefficient,
    land_value=land_value,
    hard_soft_coef=hard_vs_soft_coef)  # -> walls, roof, floors, floors_as_curves, values, T, R

unit_density_3 = DigitScroller(Scroller_Digits=12, Scroller_Prefix="Unit Density", Scroller_Radix=11, Scroller_Value=400)
construction_cost_per_sf_3 = DigitScroller(Scroller_Digits=12, Scroller_Prefix="Construction Cost Per SF", Scroller_Radix=11, Scroller_Value=175)
sale_price_per_sf_3 = DigitScroller(Scroller_Digits=12, Scroller_Prefix="Sale Price Per SF", Scroller_Radix=11, Scroller_Value=0)
rent_per_sf_3 = DigitScroller(Scroller_Digits=12, Scroller_Prefix="Rent Per SF", Scroller_Radix=10, Scroller_Value=0)
pro_forma_calculator_3 = ProFormaCalculator(
    program_name=program_name_4,
    massing=input_mass_4,
    unit_density=unit_density_3,
    cpsf=construction_cost_per_sf_3,
    typical_floor_height=typical_floor_height_3,
    ppsf=sale_price_per_sf_3,
    rpsf=rent_per_sf_3,
    cap_rate=cap_rate,
    bool=omit_last_floor_slab_5,
    net_coef=net_coefficient,
    land_value=land_value,
    hard_soft_coef=hard_vs_soft_coef)  # -> walls, roof, floors, floors_as_curves, values, T, R

typical_floor_height_5 = DigitScroller(Scroller_Digits=12, Scroller_Prefix="Typical Floor Height", Scroller_Radix=11, Scroller_Value=10)

unit_density_4 = DigitScroller(Scroller_Digits=12, Scroller_Prefix="Unit Density", Scroller_Radix=11, Scroller_Value=400)
construction_cost_per_sf_4 = DigitScroller(Scroller_Digits=12, Scroller_Prefix="Construction Cost Per SF", Scroller_Radix=11, Scroller_Value=225)
sale_price_per_sf_4 = DigitScroller(Scroller_Digits=12, Scroller_Prefix="Sale Price Per SF", Scroller_Radix=11, Scroller_Value=0)
rent_per_sf_4 = DigitScroller(Scroller_Digits=12, Scroller_Prefix="Rent Per SF", Scroller_Radix=10, Scroller_Value=0)
pro_forma_calculator_4 = ProFormaCalculator(
    program_name=program_name_3,
    massing=input_mass_3,
    unit_density=unit_density_4,
    cpsf=construction_cost_per_sf_4,
    typical_floor_height=typical_floor_height_5,
    ppsf=sale_price_per_sf_4,
    rpsf=rent_per_sf_4,
    cap_rate=cap_rate,
    bool=omit_last_floor_slab_4,
    net_coef=net_coefficient,
    land_value=land_value,
    hard_soft_coef=hard_vs_soft_coef)  # -> walls, roof, floors, floors_as_curves, values, T, R

percentage_studios_2 = DigitScroller(Scroller_Digits=12, Scroller_Prefix="Percentage Studios", Scroller_Radix=11, Scroller_Value=25)  # disabled
target_area_studios_2 = DigitScroller(Scroller_Digits=12, Scroller_Prefix="Target Area - Studios", Scroller_Radix=11, Scroller_Value=350)  # disabled
target_area_studios_3 = DigitScroller(Scroller_Digits=12, Scroller_Prefix="Target Area - Studios", Scroller_Radix=11, Scroller_Value=350)  # disabled
omit_last_floor_slab_6 = BooleanToggle(True)  # disabled
omit_last_floor_slab_7 = BooleanToggle(True)  # disabled
omit_last_floor_slab_8 = BooleanToggle(False)  # disabled
target_area_studios_4 = DigitScroller(Scroller_Digits=12, Scroller_Prefix="Target Area - Studios", Scroller_Radix=11, Scroller_Value=350)  # disabled
typical_floor_height_6 = DigitScroller(Scroller_Digits=12, Scroller_Prefix="Typical Floor Height", Scroller_Radix=11, Scroller_Value=10)  # disabled

unit_density_5 = DigitScroller(Scroller_Digits=12, Scroller_Prefix="Unit Density", Scroller_Radix=11, Scroller_Value=400)  # disabled
construction_cost_per_sf_5 = DigitScroller(Scroller_Digits=12, Scroller_Prefix="Construction Cost Per SF", Scroller_Radix=11, Scroller_Value=375)  # disabled
percentage_of_one_bedrooms = DigitScroller(Scroller_Digits=12, Scroller_Prefix="Percentage of One Bedrooms", Scroller_Radix=11, Scroller_Value=25)  # disabled
target_area_two_bedroom = DigitScroller(Scroller_Digits=12, Scroller_Prefix="Target Area - Two Bedroom", Scroller_Radix=11, Scroller_Value=700)  # disabled
sale_price_per_sf_5 = DigitScroller(Scroller_Digits=12, Scroller_Prefix="Sale Price Per SF", Scroller_Radix=11, Scroller_Value=950)  # disabled
rent_per_sf_5 = DigitScroller(Scroller_Digits=12, Scroller_Prefix="Rent Per SF", Scroller_Radix=10, Scroller_Value=5)  # disabled
percentage_of_two_bedrooms = DigitScroller(Scroller_Digits=12, Scroller_Prefix="Percentage of Two Bedrooms", Scroller_Radix=11, Scroller_Value=25)  # disabled
target_area_one_bedroom = DigitScroller(Scroller_Digits=12, Scroller_Prefix="Target Area - One Bedroom", Scroller_Radix=11, Scroller_Value=350)  # disabled
target_area_three_bedroom = DigitScroller(Scroller_Digits=12, Scroller_Prefix="Target Area - Three Bedroom", Scroller_Radix=11, Scroller_Value=900)  # disabled
pro_forma_calculator_5 = ProFormaCalculator(
    program_name=program_name_8,
    massing=input_mass_8,
    unit_density=unit_density_5,
    cpsf=construction_cost_per_sf_5,
    typical_floor_height=typical_floor_height_6,
    ppsf=sale_price_per_sf_5,
    rpsf=rent_per_sf_5,
    cap_rate=cap_rate,
    bool=omit_last_floor_slab_6,
    net_coef=net_coefficient,
    land_value=land_value,
    hard_soft_coef=hard_vs_soft_coef,
    percentage_studios=percentage_studios_2,
    percentage_one_bedrooms=percentage_of_one_bedrooms,
    percentage_two_bedrooms=percentage_of_two_bedrooms,
    desired_area_studios=target_area_studios_2,
    desired_area_one_bedroom=target_area_one_bedroom,
    desired_area_two_bedroom=target_area_two_bedroom,
    desired_area_three_bedroom=target_area_three_bedroom)  # -> walls, roof, floors, floors_as_curves, values, T, R; disabled

percentage_studios_3 = DigitScroller(Scroller_Digits=12, Scroller_Prefix="Percentage Studios", Scroller_Radix=11, Scroller_Value=25)  # disabled
typical_floor_height_7 = DigitScroller(Scroller_Digits=12, Scroller_Prefix="Typical Floor Height", Scroller_Radix=11, Scroller_Value=10)  # disabled
percentage_studios_4 = DigitScroller(Scroller_Digits=12, Scroller_Prefix="Percentage Studios", Scroller_Radix=11, Scroller_Value=25)  # disabled

unit_density_6 = DigitScroller(Scroller_Digits=12, Scroller_Prefix="Unit Density", Scroller_Radix=11, Scroller_Value=400)  # disabled
construction_cost_per_sf_6 = DigitScroller(Scroller_Digits=12, Scroller_Prefix="Construction Cost Per SF", Scroller_Radix=11, Scroller_Value=375)  # disabled
percentage_of_one_bedrooms_2 = DigitScroller(Scroller_Digits=12, Scroller_Prefix="Percentage of One Bedrooms", Scroller_Radix=11, Scroller_Value=25)  # disabled
target_area_two_bedroom_2 = DigitScroller(Scroller_Digits=12, Scroller_Prefix="Target Area - Two Bedroom", Scroller_Radix=11, Scroller_Value=700)  # disabled
sale_price_per_sf_6 = DigitScroller(Scroller_Digits=12, Scroller_Prefix="Sale Price Per SF", Scroller_Radix=11, Scroller_Value=950)  # disabled
rent_per_sf_6 = DigitScroller(Scroller_Digits=12, Scroller_Prefix="Rent Per SF", Scroller_Radix=10, Scroller_Value=4.25)  # disabled
percentage_of_two_bedrooms_2 = DigitScroller(Scroller_Digits=12, Scroller_Prefix="Percentage of Two Bedrooms", Scroller_Radix=11, Scroller_Value=25)  # disabled
target_area_one_bedroom_2 = DigitScroller(Scroller_Digits=12, Scroller_Prefix="Target Area - One Bedroom", Scroller_Radix=11, Scroller_Value=350)  # disabled
target_area_three_bedroom_2 = DigitScroller(Scroller_Digits=12, Scroller_Prefix="Target Area - Three Bedroom", Scroller_Radix=11, Scroller_Value=900)  # disabled
pro_forma_calculator_6 = ProFormaCalculator(
    program_name=program_name_6,
    massing=input_mass_7,
    unit_density=unit_density_6,
    cpsf=construction_cost_per_sf_6,
    typical_floor_height=typical_floor_height_7,
    ppsf=sale_price_per_sf_6,
    rpsf=rent_per_sf_6,
    cap_rate=cap_rate,
    bool=omit_last_floor_slab_8,
    net_coef=net_coefficient,
    land_value=land_value,
    hard_soft_coef=hard_vs_soft_coef,
    percentage_studios=percentage_studios_4,
    percentage_one_bedrooms=percentage_of_one_bedrooms_2,
    percentage_two_bedrooms=percentage_of_two_bedrooms_2,
    desired_area_studios=target_area_studios_4,
    desired_area_one_bedroom=target_area_one_bedroom_2,
    desired_area_two_bedroom=target_area_two_bedroom_2,
    desired_area_three_bedroom=target_area_three_bedroom_2)  # -> walls, roof, floors, floors_as_curves, values, T, R; disabled

typical_floor_height_8 = DigitScroller(Scroller_Digits=12, Scroller_Prefix="Typical Floor Height", Scroller_Radix=11, Scroller_Value=10)  # disabled

target_area_one_bedroom_3 = DigitScroller(Scroller_Digits=12, Scroller_Prefix="Target Area - One Bedroom", Scroller_Radix=11, Scroller_Value=350)  # disabled
target_area_two_bedroom_3 = DigitScroller(Scroller_Digits=12, Scroller_Prefix="Target Area - Two Bedroom", Scroller_Radix=11, Scroller_Value=700)  # disabled
target_area_three_bedroom_3 = DigitScroller(Scroller_Digits=12, Scroller_Prefix="Target Area - Three Bedroom", Scroller_Radix=11, Scroller_Value=900)  # disabled
unit_density_7 = DigitScroller(Scroller_Digits=12, Scroller_Prefix="Unit Density", Scroller_Radix=11, Scroller_Value=400)  # disabled
construction_cost_per_sf_7 = DigitScroller(Scroller_Digits=12, Scroller_Prefix="Construction Cost Per SF", Scroller_Radix=11, Scroller_Value=375)  # disabled
sale_price_per_sf_7 = DigitScroller(Scroller_Digits=12, Scroller_Prefix="Sale Price Per SF", Scroller_Radix=11, Scroller_Value=950)  # disabled
percentage_of_one_bedrooms_3 = DigitScroller(Scroller_Digits=12, Scroller_Prefix="Percentage of One Bedrooms", Scroller_Radix=11, Scroller_Value=25)  # disabled
rent_per_sf_7 = DigitScroller(Scroller_Digits=12, Scroller_Prefix="Rent Per SF", Scroller_Radix=10, Scroller_Value=3.5)  # disabled
percentage_of_two_bedrooms_3 = DigitScroller(Scroller_Digits=12, Scroller_Prefix="Percentage of Two Bedrooms", Scroller_Radix=11, Scroller_Value=25)  # disabled
pro_forma_calculator_7 = ProFormaCalculator(
    program_name=program_name_7,
    massing=input_mass_6,
    unit_density=unit_density_7,
    cpsf=construction_cost_per_sf_7,
    typical_floor_height=typical_floor_height_8,
    ppsf=sale_price_per_sf_7,
    rpsf=rent_per_sf_7,
    cap_rate=cap_rate,
    bool=omit_last_floor_slab_7,
    net_coef=net_coefficient,
    land_value=land_value,
    hard_soft_coef=hard_vs_soft_coef,
    percentage_studios=percentage_studios_3,
    percentage_one_bedrooms=percentage_of_one_bedrooms_3,
    percentage_two_bedrooms=percentage_of_two_bedrooms_3,
    desired_area_studios=target_area_studios_3,
    desired_area_one_bedroom=target_area_one_bedroom_3,
    desired_area_two_bedroom=target_area_two_bedroom_3,
    desired_area_three_bedroom=target_area_three_bedroom_3)  # -> walls, roof, floors, floors_as_curves, values, T, R; disabled

target_area_one_bedroom_4 = DigitScroller(Scroller_Digits=12, Scroller_Prefix="Target Area - One Bedroom", Scroller_Radix=11, Scroller_Value=350)  # disabled
unit_density_8 = DigitScroller(Scroller_Digits=12, Scroller_Prefix="Unit Density", Scroller_Radix=11, Scroller_Value=850)
construction_cost_per_sf_8 = DigitScroller(Scroller_Digits=12, Scroller_Prefix="Construction Cost Per SF", Scroller_Radix=11, Scroller_Value=375)
sale_price_per_sf_8 = DigitScroller(Scroller_Digits=12, Scroller_Prefix="Sale Price Per SF", Scroller_Radix=11, Scroller_Value=1260)
percentage_of_one_bedrooms_4 = DigitScroller(Scroller_Digits=12, Scroller_Prefix="Percentage of One Bedrooms", Scroller_Radix=11, Scroller_Value=25)  # disabled
percentage_of_two_bedrooms_4 = DigitScroller(Scroller_Digits=12, Scroller_Prefix="Percentage of Two Bedrooms", Scroller_Radix=11, Scroller_Value=25)  # disabled
target_area_two_bedroom_4 = DigitScroller(Scroller_Digits=12, Scroller_Prefix="Target Area - Two Bedroom", Scroller_Radix=11, Scroller_Value=700)  # disabled
target_area_three_bedroom_4 = DigitScroller(Scroller_Digits=12, Scroller_Prefix="Target Area - Three Bedroom", Scroller_Radix=11, Scroller_Value=900)  # disabled
rent_per_sf_8 = DigitScroller(Scroller_Digits=12, Scroller_Prefix="Rent Per SF", Scroller_Radix=10, Scroller_Value=6.82)
pro_forma_calculator_8 = ProFormaCalculator(
    program_name=program_name,
    massing=input_mass,
    unit_density=unit_density_8,
    cpsf=construction_cost_per_sf_8,
    typical_floor_height=typical_floor_height,
    ppsf=sale_price_per_sf_8,
    rpsf=rent_per_sf_8,
    cap_rate=cap_rate,
    bool=omit_last_floor_slab,
    net_coef=net_coefficient,
    land_value=land_value,
    hard_soft_coef=hard_vs_soft_coef,
    residential=Toggle(False),
    percentage_studios=percentage_studios,
    percentage_one_bedrooms=percentage_of_one_bedrooms_4,
    percentage_two_bedrooms=percentage_of_two_bedrooms_4,
    desired_area_studios=target_area_studios,
    desired_area_one_bedroom=target_area_one_bedroom_4,
    desired_area_two_bedroom=target_area_two_bedroom_4,
    desired_area_three_bedroom=target_area_three_bedroom_4)  # -> walls, roof, floors, floors_as_curves, values, T, R

list_values = Data(pro_forma_calculator.R)
list_values_2 = Data(pro_forma_calculator_2.R)
list_values_3 = Data(pro_forma_calculator_4.R)
list_values_4 = Data(pro_forma_calculator_3.R)
list_values_5 = Data(pro_forma_calculator_8.R)
list_keys = Data(pro_forma_calculator.T)
list_keys_2 = Data(pro_forma_calculator_2.T)
output = DataOutput(
    DataInput=pro_forma_calculator.walls,
    Destination="G:\My Drive\MTA - Venice Bus Yard\03 Data Exchange Files\walls_retail.ghdata",
    RelativePath="G:\My Drive\MTA - Venice Bus Yard\03 Data Exchange Files\walls_retail.ghdata|..\03 Data Exchange Files\walls_retail.ghdata")
output_2 = DataOutput(
    DataInput=pro_forma_calculator.roof,
    Destination="G:\My Drive\MTA - Venice Bus Yard\03 Data Exchange Files\roofs_retail.ghdata",
    RelativePath="G:\My Drive\MTA - Venice Bus Yard\03 Data Exchange Files\roofs_retail.ghdata|..\03 Data Exchange Files\roofs_retail.ghdata")
output_3 = DataOutput(
    DataInput=pro_forma_calculator.floors,
    Destination="G:\My Drive\MTA - Venice Bus Yard\03 Data Exchange Files\floors_retail.ghdata",
    RelativePath="G:\My Drive\MTA - Venice Bus Yard\03 Data Exchange Files\floors_retail.ghdata|..\03 Data Exchange Files\floors_retail.ghdata")
list_keys_3 = Data(pro_forma_calculator_3.T)
brep = Brep(pro_forma_calculator.floors)
brep_2 = Brep(pro_forma_calculator_4.floors)
brep_3 = Brep(pro_forma_calculator_2.floors)
list_keys_4 = Data(pro_forma_calculator_4.T)
brep_4 = Brep(pro_forma_calculator_3.floors)
list_keys_5 = Data(pro_forma_calculator_8.T)
output_4 = DataOutput(
    DataInput=pro_forma_calculator_2.walls,
    Destination="G:\My Drive\MTA - Venice Bus Yard\03 Data Exchange Files\walls_parking_visitor.ghdata",
    RelativePath="G:\My Drive\MTA - Venice Bus Yard\03 Data Exchange Files\walls_parking_visitor.ghdata|..\03 Data Exchange Files\walls_parking_visitor.ghdata")
output_5 = DataOutput(
    DataInput=pro_forma_calculator_2.roof,
    Destination="G:\My Drive\MTA - Venice Bus Yard\03 Data Exchange Files\roofs_parking_visitor.ghdata",
    RelativePath="G:\My Drive\MTA - Venice Bus Yard\03 Data Exchange Files\roofs_parking_visitor.ghdata|..\03 Data Exchange Files\roofs_parking_visitor.ghdata")
output_6 = DataOutput(
    DataInput=pro_forma_calculator_2.floors,
    Destination="G:\My Drive\MTA - Venice Bus Yard\03 Data Exchange Files\floors_parking_visitor.ghdata",
    RelativePath="G:\My Drive\MTA - Venice Bus Yard\03 Data Exchange Files\floors_parking_visitor.ghdata|..\03 Data Exchange Files\floors_parking_visitor.ghdata")
output_7 = DataOutput(
    DataInput=pro_forma_calculator_4.walls,
    Destination="G:\My Drive\MTA - Venice Bus Yard\03 Data Exchange Files\walls_community.ghdata",
    RelativePath="G:\My Drive\MTA - Venice Bus Yard\03 Data Exchange Files\walls_community.ghdata|..\03 Data Exchange Files\walls_community.ghdata")
output_8 = DataOutput(
    DataInput=pro_forma_calculator_4.roof,
    Destination="G:\My Drive\MTA - Venice Bus Yard\03 Data Exchange Files\roofs_community.ghdata",
    RelativePath="G:\My Drive\MTA - Venice Bus Yard\03 Data Exchange Files\roofs_community.ghdata|..\03 Data Exchange Files\roofs_community.ghdata")
output_9 = DataOutput(
    DataInput=pro_forma_calculator_4.floors,
    Destination="G:\My Drive\MTA - Venice Bus Yard\03 Data Exchange Files\floors_community.ghdata",
    RelativePath="G:\My Drive\MTA - Venice Bus Yard\03 Data Exchange Files\floors_community.ghdata|..\03 Data Exchange Files\floors_community.ghdata")
output_10 = DataOutput(
    DataInput=pro_forma_calculator_3.walls,
    Destination="G:\My Drive\MTA - Venice Bus Yard\03 Data Exchange Files\walls_parking_code.ghdata",
    RelativePath="G:\My Drive\MTA - Venice Bus Yard\03 Data Exchange Files\walls_parking_code.ghdata|..\03 Data Exchange Files\walls_parking_code.ghdata")
output_11 = DataOutput(
    DataInput=pro_forma_calculator_3.roof,
    Destination="G:\My Drive\MTA - Venice Bus Yard\03 Data Exchange Files\roofs_parking_code.ghdata",
    RelativePath="G:\My Drive\MTA - Venice Bus Yard\03 Data Exchange Files\roofs_parking_code.ghdata|..\03 Data Exchange Files\roofs_parking_code.ghdata")
output_12 = DataOutput(
    DataInput=pro_forma_calculator_3.floors,
    Destination="G:\My Drive\MTA - Venice Bus Yard\03 Data Exchange Files\floors_parking_code.ghdata",
    RelativePath="G:\My Drive\MTA - Venice Bus Yard\03 Data Exchange Files\floors_parking_code.ghdata|..\03 Data Exchange Files\floors_parking_code.ghdata")
brep_5 = Brep(pro_forma_calculator_8.floors)
output_13 = DataOutput(
    DataInput=pro_forma_calculator_8.walls,
    Destination="G:\My Drive\MTA - Venice Bus Yard\03 Data Exchange Files\walls_ELI.ghdata",
    RelativePath="G:\My Drive\MTA - Venice Bus Yard\03 Data Exchange Files\walls_ELI.ghdata|..\03 Data Exchange Files\walls_ELI.ghdata")
output_14 = DataOutput(
    DataInput=pro_forma_calculator_8.roof,
    Destination="G:\My Drive\MTA - Venice Bus Yard\03 Data Exchange Files\roofs_ELI.ghdata",
    RelativePath="G:\My Drive\MTA - Venice Bus Yard\03 Data Exchange Files\roofs_ELI.ghdata|..\03 Data Exchange Files\roofs_ELI.ghdata")
output_15 = DataOutput(
    DataInput=pro_forma_calculator_8.floors,
    Destination="G:\My Drive\MTA - Venice Bus Yard\03 Data Exchange Files\floors_ELI.ghdata",
    RelativePath="G:\My Drive\MTA - Venice Bus Yard\03 Data Exchange Files\floors_ELI.ghdata|..\03 Data Exchange Files\floors_ELI.ghdata")
output_16 = DataOutput(
    DataInput=pro_forma_calculator_8.floors_as_curves,
    Destination="G:\My Drive\MTA - Venice Bus Yard\03 Data Exchange Files\floors_market_curves.ghdata",
    RelativePath="G:\My Drive\MTA - Venice Bus Yard\03 Data Exchange Files\floors_market_curves.ghdata|..\03 Data Exchange Files\floors_market_curves.ghdata")
crv_2 = Curve(pro_forma_calculator_8.floors_as_curves)
list_values_6 = Data(pro_forma_calculator_5.R)  # disabled
list_values_7 = Data(pro_forma_calculator_7.R)  # disabled
list_keys_6 = Data(pro_forma_calculator_5.T)  # disabled
list_values_8 = Data(pro_forma_calculator_6.R)  # disabled
brep_6 = Brep(pro_forma_calculator_5.floors)  # disabled
list_keys_7 = Data(pro_forma_calculator_7.T)  # disabled
list_keys_8 = Data(pro_forma_calculator_6.T)  # disabled
output_17 = DataOutput(
    DataInput=pro_forma_calculator_5.walls,
    Destination="G:\My Drive\MTA - Venice Bus Yard\03 Data Exchange Files\walls_MR.ghdata",
    RelativePath="G:\My Drive\MTA - Venice Bus Yard\03 Data Exchange Files\walls_MR.ghdata|..\03 Data Exchange Files\walls_MR.ghdata")  # disabled
output_18 = DataOutput(
    DataInput=pro_forma_calculator_5.roof,
    Destination="G:\My Drive\MTA - Venice Bus Yard\03 Data Exchange Files\roofs_MR.ghdata",
    RelativePath="G:\My Drive\MTA - Venice Bus Yard\03 Data Exchange Files\roofs_MR.ghdata|..\03 Data Exchange Files\roofs_MR.ghdata")  # disabled
output_19 = DataOutput(
    DataInput=pro_forma_calculator_5.floors,
    Destination="G:\My Drive\MTA - Venice Bus Yard\03 Data Exchange Files\floors_MR.ghdata",
    RelativePath="G:\My Drive\MTA - Venice Bus Yard\03 Data Exchange Files\floors_MR.ghdata|..\03 Data Exchange Files\floors_MR.ghdata")  # disabled
brep_7 = Brep(pro_forma_calculator_7.floors)  # disabled
brep_8 = Brep(pro_forma_calculator_6.floors)  # disabled
output_20 = DataOutput(
    DataInput=pro_forma_calculator_6.walls,
    Destination="G:\My Drive\MTA - Venice Bus Yard\03 Data Exchange Files\walls_MI.ghdata",
    RelativePath="G:\My Drive\MTA - Venice Bus Yard\03 Data Exchange Files\walls_MI.ghdata|..\03 Data Exchange Files\walls_MI.ghdata")  # disabled
output_21 = DataOutput(
    DataInput=pro_forma_calculator_6.roof,
    Destination="G:\My Drive\MTA - Venice Bus Yard\03 Data Exchange Files\roofs_MI.ghdata",
    RelativePath="G:\My Drive\MTA - Venice Bus Yard\03 Data Exchange Files\roofs_MI.ghdata|..\03 Data Exchange Files\roofs_MI.ghdata")  # disabled
output_22 = DataOutput(
    DataInput=pro_forma_calculator_6.floors,
    Destination="G:\My Drive\MTA - Venice Bus Yard\03 Data Exchange Files\floors_MI.ghdata",
    RelativePath="G:\My Drive\MTA - Venice Bus Yard\03 Data Exchange Files\floors_MI.ghdata|..\03 Data Exchange Files\floors_MI.ghdata")  # disabled
output_23 = DataOutput(
    DataInput=pro_forma_calculator_7.walls,
    Destination="G:\My Drive\MTA - Venice Bus Yard\03 Data Exchange Files\walls_VLI.ghdata",
    RelativePath="G:\My Drive\MTA - Venice Bus Yard\03 Data Exchange Files\walls_VLI.ghdata|..\03 Data Exchange Files\walls_VLI.ghdata")  # disabled
output_24 = DataOutput(
    DataInput=pro_forma_calculator_7.roof,
    Destination="G:\My Drive\MTA - Venice Bus Yard\03 Data Exchange Files\roofs_VLI.ghdata",
    RelativePath="G:\My Drive\MTA - Venice Bus Yard\03 Data Exchange Files\roofs_VLI.ghdata|..\03 Data Exchange Files\roofs_VLI.ghdata")  # disabled
output_25 = DataOutput(
    DataInput=pro_forma_calculator_7.floors,
    Destination="G:\My Drive\MTA - Venice Bus Yard\03 Data Exchange Files\floors_VLI.ghdata",
    RelativePath="G:\My Drive\MTA - Venice Bus Yard\03 Data Exchange Files\floors_VLI.ghdata|..\03 Data Exchange Files\floors_VLI.ghdata")  # disabled
panel = Panel(pro_forma_calculator_8.values)
panel_2 = Panel(pro_forma_calculator.values)
panel_3 = Panel(pro_forma_calculator_4.values)
brep_9 = Brep([brep_5, pro_forma_calculator_8.roof])
bbox = BoundingBox(Content=flatten(brep_9), Plane=PlaneXY(0, 0, 0), UnionBox=True)  # -> Box, Box_2
box_corners = BoxCorners(Box=bbox.Box)  # -> CornerA, CornerB, CornerC, CornerD, CornerE, CornerF, CornerG, CornerH
keys = Merge(
    Data1=graft(list_keys_5),
    Data2=graft(list_keys_7),
    Data3=graft(list_keys_8),
    Data4=graft(list_keys_6),
    Data5=graft(list_keys),
    Data6=graft(list_keys_4),
    Data7=graft(list_keys_3),
    Data8=graft(list_keys_2))  # -> simplify(Result)
values = Merge(
    Data1=graft(list_values_5),
    Data2=graft(list_values_7),
    Data3=graft(list_values_8),
    Data4=graft(list_values_6),
    Data5=graft(list_values),
    Data6=graft(list_values_3),
    Data7=graft(list_values_4),
    Data8=graft(list_values_2))
Z_2 = UnitZ(Factor=1)
contour = Contour(Shape=bbox.Box, Point=box_corners.CornerA, Direction=Z_2, Distance=typical_floor_height)
flip = FlipMatrix(Data=keys)
flip_2 = FlipMatrix(Data=values)
disc = Discontinuity(Curve=contour, Level=1)  # -> Points, Parameters
wires = BrepWireframe(Brep=bbox.Box, Density=-1)

# ---- group: Preview Height Dimensions
item = ListItem(List=disc.Points, Index=2, Wrap=True)  # -> simplify(flatten(Item))
item_2 = ListItem(List=item, Index=0, Wrap=True)  # -> Item1, Item
ln = Line(StartPoint=item_2.Item1, EndPoint=item_2.Item)
len = Length(Curve=ln)
linedim = LineDimension(Line=ln, Text=len, Size=Slider(6, range=0..100))

# ---- group: Preview Floor Names
item_3 = ListItem(List=disc.Points, Index=3, Wrap=True)  # -> simplify(flatten(Item))
python_2 = GhPythonScript(floor_point=flatten(item_3))  # -> floor_names; inputs floor_point: list of Point3d
# ---------- python_2: Python ----------
__author__ = "ilouh"
__version__ = "2023.02.21"

import rhinoscriptsyntax as rs
import Grasshopper as gh
import Rhino.Geometry as rg
import ghpythonlib.components as comps
import math

floor_names = []

for point in floor_point:
    
    floor_name = 'Floor {}'.format(floor_point.index(point)+1)
    floor_names.append(floor_name)

floor_names[0] = 'Residential Ground Floor'
floor_names[-1] = 'Roof Floor'
print(floor_names)
# ---------- end python_2 ----------
textdot = DefineTextDot(Text=python_2, Location=item_3, Font="Arial", Size=10)

# ---- group: Preview Lines
lt_table = LinetypeTable(Update=True)  # -> flatten(Linetypes), LinetypePattern
panel_4 = Panel(lt_table.Linetypes)
item_4 = ListItem(List=panel_4, Index=0, Wrap=True)
previewlw = CustomPreviewLineweights(Geometry=wires, Shader=item_4, Thickness=Slider(0, range=0..10), Absolute=False)

# ---- group: Write to Excel
path = FilePath("G:\My Drive\MTA - Venice Bus Yard\04 Excel Files\MTA - Data & Proforma.xlsx")
xl_out = WriteToExcelClassic(WorkbookFilepath=path, WorksheetName="Pro-Forma", Data=values, LocationAddress="E1", Stream=Toggle(True))

# ----
python_3 = GhPythonScript(keys=list_keys_5, values=flip_2)  # -> keys, values; inputs keys: list, values: tree
# ---------- python_3: Python ----------
__author__ = "Iliya Muzychuk"
__version__ = "2023.02.03"

import rhinoscriptsyntax as rs
import Grasshopper as gh
import Rhino.Geometry as rg
import ghpythonlib.components as comps
from ghpythonlib import treehelpers as th

def format_to_dollar_price(value):
    if isinstance(value, (int, float)):
        formatted_value = "${:,.2f}".format(value)
    elif isinstance(value, str):
        # Remove any non-numeric characters
        value = ''.join(filter(str.isdigit, value))
        if value:
            formatted_value = "${:,.2f}".format(float(value)/100)
        else:
            formatted_value = "$0.00"
    else:
        raise TypeError("Unsupported value type. Only int, float, and str are supported.")
    
    return formatted_value

def float_to_percentage(number):
    percentage = number * 100
    formatted_percentage = "{:.2f}%".format(percentage)
    return formatted_percentage

def format_to_sf_area(value):
    if isinstance(value, (int, float)):
        if value != 0:
            formatted_value = "{:,.2f} SF".format(value)
        else:
            formatted_value = value
    else:
        raise TypeError("Unsupported value type. Only int and float are supported.")
    
    return formatted_value
    

keys = keys

values = th.tree_to_list(values)
values = values

dic = {}


#print(values)
for dic_value in values:
    
    temp_dic = {key: value for key, value in zip(keys, dic_value)}
    #print(dic_value[0])
    dic[str(dic_value[0])] = temp_dic
    

#remember that if a program name is changing than these lists needs to be revised, to work on. 
resi_list = [
    
    'Extreme Low Income',
    'Very Low Income',
    'Moderate Income',
    'Market Rate'
]

parking_list = [

    'Code Required Parking',
    'Visitor Parking'
    
]

total_gross_area = [] 
total_net_area = [] 
total_potential_units = [] 
total_achievable_units = []
construction_costs = [] 
soft_costs = [] 
total_costs = [] 
gross_income = []
net_income = []

studio_units = []
one_bedroom_units = [] 
two_bedroom_units = [] 
three_bedroom_units = [] 

total_code_required_parking_spaces = []
total_visitor_parking_spaces = []
total_residential_area = []
total_parking_area = []
total_retail_area = []
#calculate total areas

print(dic)

for item in dic: 
    
    if item not in parking_list:
         
        total_gross_area.append(dic[item]['total_gross_area'])
        total_net_area.append(dic[item]['total_net_area'])
        
    construction_costs.append(dic[item]['construction_cost'])
    soft_costs.append(dic[item]['soft_costs'])
    total_costs.append(dic[item]['total_cost'])
    gross_income.append(dic[item]['gross_income'])
    net_income.append(dic[item]['net_income'])
    
    if item in resi_list: 
        
        total_potential_units.append(dic[item]['total_Potential_units'])
        #total_units = dic[item]['no_studios'] +  dic[item]['no_one_bedroom'] + dic[item]['no_two_bedroom'] + dic[item]['no_three_bedroom']
        #total_achievable_units.append(total_units)
        #studio_units.append(dic[item]['no_studios'])
        #one_bedroom_units.append(dic[item]['no_one_bedroom'])
        #two_bedroom_units.append(dic[item]['no_two_bedroom'])
        #three_bedroom_units.append(dic[item]['no_three_bedroom'])
        
        total_residential_area.append(dic[item]['total_net_area'])
    
    if item in parking_list:
        
        total_parking_area.append(dic[item]['total_net_area'])
        
        if item == 'Code Required Parking':
            
            total_code_required_parking_spaces.append(dic[item]['total_Potential_units'])
            
        if item == 'Visitor Parking':
            
            total_visitor_parking_spaces.append(dic[item]['total_Potential_units'])
        
    if str(item) == 'Retail':
     
        total_retail_area.append(dic[item]['total_net_area'])
        total_retail_units = dic[item]['total_Potential_units']
        avg_retail_unit_size = dic[item]['average_unit_size']

    if str(item) == 'Community Spaces':
        total_community_area = dic[item]['total_net_area']

temp_dic = {

      "G.total_gross_area":  format_to_sf_area(sum(total_gross_area)),
      "G.total_net_area": format_to_sf_area(sum(total_net_area)),
      "G.total_Potential_units": sum(total_potential_units),
      "G.construction_cost":  format_to_dollar_price(sum(construction_costs)),
      "G.soft_costs": format_to_dollar_price(sum(soft_costs)),
      "G.total_cost":  format_to_dollar_price(sum(total_costs)),
      "G.gross_income":  format_to_dollar_price(sum(gross_income)),
      "G.net_income":  format_to_dollar_price(sum(net_income)),
      "G.cap_rate": float_to_percentage(sum(net_income) / sum(total_costs)),
      "U.no_studios": sum(studio_units),
      "U.no_one_bedroom": sum(one_bedroom_units),
      "U.no_two_bedroom": sum(two_bedroom_units),
      "U.no_three_bedroom": sum(three_bedroom_units),
      "U.total_units":sum(total_achievable_units),
      "U.total_residential_net_area": sum(total_residential_area),
      "P.total_parking_area": format_to_sf_area(sum(total_parking_area)),
      "P.total_parking_stalls": sum(total_code_required_parking_spaces) + sum(total_visitor_parking_spaces),
      "R.total_retail_net_area": format_to_sf_area(sum(total_retail_area)),
      "R.total_retail_units": total_retail_units,
      "R.avg_retail_unit_size": format_to_sf_area(avg_retail_unit_size),
      "C.total_community_space_net_area": format_to_sf_area(total_community_area)
    }
    



key_names = [

    "G.total_gross_area",
    "G.total_net_area",
    "G.total_Potential_units",
    "G.construction_cost",
    "G.soft_costs",
    "G.total_cost",
    "G.gross_income",
    "G.net_income",
    "G.cap_rate",
    "U.no_studios",
    "U.no_one_bedroom",
    "U.no_two_bedroom",
    "U.no_three_bedroom",
    "U.total_units",
    "U.total_residential_net_area",
    "P.total_parking_area",
    "P.total_parking_stalls",
    "R.total_retail_net_area",
    "R.total_retail_units",
    "R.avg_retail_unit_size",
    "C.total_community_space_net_area"
]


values = [] 

for item in key_names:
    values.append(item + ': ' + str(temp_dic[item]))
# ---------- end python_3 ----------
panel_5 = Panel("""9
15
17
20""")
ins = InsertItems(List=python_3.values, Indices=panel_5, Wrap=True)

number_slider = Slider(8, range=0..10)
lng_2 = ListLength(List=ins)
series = Series(Start=0, Step=expr("x+7", number_slider), Count=lng_2)
Z_3 = UnitZ(Factor=series)
pt = Point(<point referenced from the Rhino model>)
move = Move(Geometry=pt, Motion=Z_3)  # -> Geometry, Transform

screentext = ScreenOrientedText(Text=reverse(ins), Justification=7, Location=move.Geometry, SizeFactor=number_slider, Depth=0, Absolute=Toggle(True))
writexl = WriteToExcel(Run=False, ExcelWorksheet="2", WriteOptions="None", ColumnnsOrRows=True)

# ==== cluster ProFormaCalculator
massing = ClusterInput()
typical_floor_height = ClusterInput()
bool = ClusterInput()
percentage_studios = ClusterInput()
percentage_one_bedrooms = ClusterInput()
percentage_two_bedrooms = ClusterInput()
desired_area_studios = ClusterInput()
desired_area_one_bedroom = ClusterInput()
desired_area_two_bedroom = ClusterInput()
desired_area_three_bedroom = ClusterInput()
program_name = ClusterInput()
unit_density = ClusterInput()
cpsf = ClusterInput()
ppsf = ClusterInput()
rpsf = ClusterInput()
cap_rate = ClusterInput()
net_coef = ClusterInput()
land_value = ClusterInput()
hard_soft_coef = ClusterInput()
residential = ClusterInput()

cluster = Cluster(massing=massing, typical_floor_height=typical_floor_height, bool=bool)  # -> facade_attributes_2, points_facade_attributes, walls_2, roof, floors_2, floors_as_curves_2, areas, length_tree
pro_forma = GhPythonScript(
    program_name=program_name,
    areas=cluster.areas,
    unit_density=unit_density,
    cpsf=cpsf,
    ppsf=ppsf,
    rpsf=rpsf,
    cap_rate=cap_rate,
    net_coef=net_coef,
    land_value=land_value,
    hard_soft_coef=hard_soft_coef)  # -> values, dic_keys, dic_values, total_net_area; inputs areas: list
# ---------- pro_forma: Python ----------
__author__ = "ilouh"
__version__ = "2023.02.21"

import rhinoscriptsyntax as rs
import Grasshopper as gh
import Rhino.Geometry as rg
import ghpythonlib.components as comps
import math

#sum a list of numbers
def sum(numbers):
    total = 0
    for n in numbers:
        total += n
    return total


#Functions
def format_to_dollar_price(value):
    if isinstance(value, (int, float)):
        formatted_value = "${:,.2f}".format(value)
    elif isinstance(value, str):
        # Remove any non-numeric characters
        value = ''.join(filter(str.isdigit, value))
        if value:
            formatted_value = "${:,.2f}".format(float(value)/100)
        else:
            formatted_value = "$0.00"
    else:
        raise TypeError("Unsupported value type. Only int, float, and str are supported.")
    
    return formatted_value

def float_to_percentage(number):
    percentage = number * 100
    formatted_percentage = "{:.2f}%".format(percentage)
    return formatted_percentage

def format_to_sf_area(value):
    if isinstance(value, (int, float)):
        formatted_value = "{:,.2f} SF".format(value)
    else:
        raise TypeError("Unsupported value type. Only int and float are supported.")
    
    return formatted_value

#_______________________________________________________________________________________
# Calculations


total_area = sum(areas)
total_net_area = total_area * (net_coef /100)
units = math.floor(total_net_area/unit_density)
average_unit_size = total_net_area / units  # Average size of each unit in square feet
average_rent = float(rpsf) * total_net_area / units  # Average monthly rent per unit
unit_sale_value = average_unit_size * ppsf  # Sale value of each unit

project_valuation = (average_rent * units * (net_coef / 100) * 12) / (cap_rate / 100)  # Valuation of the project based on net operating income
construction_costs = total_area * cpsf  # Total construction costs for the project
soft_costs = construction_costs * ((100 - hard_soft_coef) / 100)  # Soft costs for the project
total_project_costs = land_value + construction_costs + soft_costs  # Total costs for the project

net_income = total_net_area * rpsf * (net_coef/100) * 12 

# Create a dictionary to store the calculated values
data_dict = {
    'program_name' : program_name,
    'total_gross_area': format_to_sf_area(total_area),
    'total_net_area': format_to_sf_area(total_net_area),
    'total_Potential_units': units,
    'average_unit_size': format_to_sf_area(average_unit_size),
    'average_unit_rent': format_to_dollar_price(average_rent),
    'average_unit_sale_value': format_to_dollar_price(unit_sale_value),
    'construction_cost': format_to_dollar_price(total_area * cpsf),
    'soft_costs': format_to_dollar_price(soft_costs),
    'total_cost': format_to_dollar_price(total_project_costs),
    'sale_value': format_to_dollar_price(total_area * ppsf),
    'gross_income' : format_to_dollar_price(total_area * rpsf * 12) ,
    'net_income' : format_to_dollar_price(net_income),
    'costruction_costs_per_sf': format_to_dollar_price(cpsf),
    'sale_price_per_sf': format_to_dollar_price(ppsf),
    'rent_price_per_sf': format_to_dollar_price(rpsf)
    
}


# Create a list of keys to iterate through
keys_list = [
    'program_name',
    'total_gross_area',
    'total_net_area',
    'total_Potential_units',
    'average_unit_size',
    'average_unit_rent',
    'average_unit_sale_value',
    'construction_cost',
    'soft_costs',
    'total_cost',
    'sale_value',
    'gross_income',
    'net_income',
    'costruction_costs_per_sf',
    'sale_price_per_sf',
    'rent_price_per_sf'
    
]

# Iterate through the keys_list and retrieve corresponding values from the data_dict
values = []
for item in keys_list:
    values.append(item + ': ' + str(data_dict[item]))

# Print the values
print(values)

dic_keys = keys_list
dic_values = []

for key in keys_list: 
    
    dic_values.append(data_dict[key])
# ---------- end pro_forma ----------
unit_breakdown = GhPythonScript(
    residential=residential,
    total_program_area=pro_forma.total_net_area,
    percentage_studios=percentage_studios,
    percentage_one_bedrooms=percentage_one_bedrooms,
    percentage_two_bedrooms=percentage_two_bedrooms,
    desired_area_studios=desired_area_studios,
    desired_area_one_bedroom=desired_area_one_bedroom,
    desired_area_two_bedroom=desired_area_two_bedroom,
    desired_area_three_bedroom=desired_area_three_bedroom)  # -> info, key_list, values
# ---------- unit_breakdown: Python ----------
__author__ = "ilouh"
__version__ = "2023.02.21"

import rhinoscriptsyntax as rs
import Grasshopper as gh
import Rhino.Geometry as rg
import ghpythonlib.components as comps
import math


#Declaration of variables
total_area = total_program_area

#percentage_one_bedrooms = 25
#percentage_two_bedrooms = 35 

#desired_area_one_bedroom = 400
#desired_area_two_bedroom = 600
#desired_area_three_bedroom = 800

def format_to_sf_area(value):
    if isinstance(value, (int, float)):
        formatted_value = "{:,.2f} SF".format(value)
    else:
        raise TypeError("Unsupported value type. Only int and float are supported.")
    
    return formatted_value
    

def unit_program(total_area,
                 program_percentage,
                 proposed_unit_area):

    total_program_area_for_unit_type = total_area * (program_percentage/100)
    total_units_of_type = round(total_program_area_for_unit_type / proposed_unit_area)
    unit_of_type_average_area = round(total_program_area_for_unit_type / total_units_of_type,2)

    total_program_area = total_units_of_type * unit_of_type_average_area
    

    return total_units_of_type, unit_of_type_average_area,total_program_area

def unit_calcs(total_area,
               percentage_studios,
               percentage_one_bedrooms,
               percentage_two_bedrooms,
               desired_area_studios,
               desired_area_one_bedroom,
               desired_area_two_bedroom,
               desired_area_three_bedroom):

    percentage_three_bedrooms = 100 - (percentage_studios + percentage_one_bedrooms + percentage_two_bedrooms)
    
    studios = unit_program(total_area,percentage_studios,desired_area_studios)
    one_bedroom = unit_program(total_area,percentage_one_bedrooms,desired_area_one_bedroom)
    two_bedroom = unit_program(total_area,percentage_two_bedrooms,desired_area_two_bedroom)
    three_bedroom = unit_program(total_area,percentage_three_bedrooms,desired_area_three_bedroom)

    
    dic = {
        "unit_breakdown" : "----",
        "no_studios": studios[0],
        "avg_studio_area" : format_to_sf_area(studios[1]),
        "no_one_bedroom": one_bedroom[0],
        "avg_one_bedroom_area": format_to_sf_area(one_bedroom[1]),
        "no_two_bedroom": two_bedroom[0],
        "avg_two_bedroom_area": format_to_sf_area(two_bedroom[1]),
        "no_three_bedroom": three_bedroom[0],
        "avg_three_bedroom_area": format_to_sf_area(three_bedroom[1]),
        "total_net_area": studios[2] + one_bedroom[2] + two_bedroom[2] + three_bedroom[2],
        "total_units": studios[0] + one_bedroom[0] + two_bedroom[0] + three_bedroom[0]

    }

    return dic

if residential is True: 

    dic = unit_calcs(total_area,percentage_studios,percentage_one_bedrooms,percentage_two_bedrooms,desired_area_studios,desired_area_one_bedroom,desired_area_two_bedroom,desired_area_three_bedroom)
    
    key_list = [
        
        "unit_breakdown",
        "no_studios",
        "avg_studio_area",
        "no_one_bedroom",
        "avg_one_bedroom_area",
        "no_two_bedroom",
        "avg_two_bedroom_area",
        "no_three_bedroom",
        "avg_three_bedroom_area",
        "total_units",
        "total_net_area"
    
    ]
    
    info  = []
    for item in key_list:
        info.append(item + ': ' + str(dic[item]))
        
    values  = []
    
    for key in key_list:
        values.append(dic[key])
# ---------- end unit_breakdown ----------
python = GhPythonScript(li=unit_breakdown.values)  # -> flatten(values_as_floats); inputs li: list
# ---------- python: Python ----------
__author__ = "Iliya Muzychuk"
__version__ = "2023.02.03"

import rhinoscriptsyntax as rs
import Grasshopper as gh
import Rhino.Geometry as rg
import ghpythonlib.components as comps

import re

def extract_numbers(string):
    numbers = re.findall(r'\d+(?:,\d+)*(?:\.\d+)?', string)
    return [float(num.replace(',', '')) for num in numbers]

values_as_floats = []

for item in li: 
    
    extracted_number = extract_numbers(str(item))
    print(len(extracted_number))
    
    
    #check if extracted_number is a number or not
    if len(extracted_number) > 0:
        
        values_as_floats.append(extracted_number[0])
        
    else:
        empty_string = str(item)
        values_as_floats.append(empty_string)


print(values_as_floats)
# ---------- end python ----------
python_2 = GhPythonScript(li=pro_forma.dic_values)  # -> flatten(values_as_floats); inputs li: list; same code as python
merge = Merge(Data1=simplify(pro_forma.dic_keys), Data2=simplify(unit_breakdown.key_list))
merge_2 = Merge(Data1=python_2, Data2=python)

panel = Panel(cluster.areas)
walls = ClusterOutput(cluster.walls_2)
roof = ClusterOutput(cluster.roof)
floors_as_curves = ClusterOutput(cluster.floors_as_curves_2)
floors = ClusterOutput(cluster.floors_2)
python_3 = GhPythonScript(
    pro_forma_keys=pro_forma.dic_keys,
    pro_forma_values=pro_forma.dic_values,
    unit_breakdown_keys=unit_breakdown.key_list,
    unit_breakdown_values=unit_breakdown.values)  # -> dic, keys, values; inputs pro_forma_keys: list, pro_forma_values: list, unit_breakdown_keys: list, unit_breakdown_values: list
# ---------- python_3: Python ----------
__author__ = "Iliya Muzychuk"
__version__ = "2023.02.03"

import rhinoscriptsyntax as rs
import Grasshopper as gh
import Rhino.Geometry as rg
import ghpythonlib.components as comps
import re 
import json

def extract_numbers(string):
    numbers = re.findall(r'\d+(?:,\d+)*(?:\.\d+)?', string)
    return [float(num.replace(',', '')) for num in numbers]
    
keys = pro_forma_keys+unit_breakdown_keys
values = pro_forma_values + unit_breakdown_values


dic = {}

for i in range(0,len(keys)):
    
    value = extract_numbers(str(values[i]))
    
    if len(value) > 0:
        
        dic[keys[i]] = round(value[0],2)
        
    else:
        dic[keys[i]] = str(values[i])
        

print dic
# ---------- end python_3 ----------
clean = CleanTree(RemoveNulls=True, RemoveInvalid=True, RemoveEmpty=False, Tree=merge)  # -> flatten(Tree)
values = ClusterOutput(pro_forma.values)
T = ClusterOutput(clean)
R = ClusterOutput(merge_2)

# ==== cluster CreateTree
T = ClusterInput()
flatten = FlattenTree(Tree=T, Path="{0}")
T_2 = ClusterInput()
flatten_2 = FlattenTree(Tree=T_2, Path="{1}")
T_3 = ClusterInput()
flatten_3 = FlattenTree(Tree=T_3, Path="{4}")
T_4 = ClusterInput()
flatten_4 = FlattenTree(Tree=T_4, Path="{3}")
T_5 = ClusterInput()
flatten_5 = FlattenTree(Tree=T_5, Path="{2}")
merge = Merge(Data1=flatten, Data2=flatten_2, Data3=flatten_5, Data4=flatten_4, Data5=flatten_3)
R = ClusterOutput(merge)

# ==== cluster CreateTree_2
T = ClusterInput()
T_2 = ClusterInput()
T_3 = ClusterInput()
T_4 = ClusterInput()
T_5 = ClusterInput()
flatten = FlattenTree(Tree=T, Path="{0}")
flatten_2 = FlattenTree(Tree=T_2, Path="{4}")
flatten_3 = FlattenTree(Tree=T_3, Path="{3}")
flatten_4 = FlattenTree(Tree=T_4, Path="{1}")
flatten_5 = FlattenTree(Tree=T_5, Path="{2}")
merge = Merge(Data1=flatten, Data2=flatten_4, Data3=flatten_5, Data4=flatten_3, Data5=flatten_2)
R = ClusterOutput(merge)

# ==== cluster Cluster
massing = ClusterInput()
typical_floor_height = ClusterInput()
typical_floor_height_2 = Integer(typical_floor_height)
massing_2 = Brep(massing)

# ---- group: Calculates Building Height
bbox = BoundingBox(Content=massing_2, Plane=PlaneXY(0, 0, 0), UnionBox=True)  # -> Box, Box_2
box_corners = BoxCorners(Box=bbox.Box)  # -> CornerA, CornerB, CornerC, CornerD, CornerE, CornerF, CornerG, CornerH

# ----
Z = UnitZ(Factor=1)
contour = Contour(Shape=massing_2, Point=box_corners.CornerA, Direction=Z, Distance=typical_floor_height_2)  # -> simplify(Contours)
tstat = TreeStatistics(Tree=contour)  # -> Paths, Length, Count
trim = TrimTree(Tree=contour, Depth=1)
panel = Panel(trim)
floors_as_curves = Curve(simplify(contour))

# ---- group: Isolate Faces of Mass
debrep = DeconstructBrep(Brep=massing_2)  # -> Faces, Edges, Vertices
evalsrf = EvaluateSurface(Surface=reparameterize(debrep.Faces), Point="{0.5,0.5,0}")  # -> Point, simplify(Normal), UDirection, VDirection, Frame
distributefaces = GhPythonScript(v=simplify(evalsrf.Normal), faces=simplify(debrep.Faces))  # -> floors, facadeWalls, roof; inputs v: list, faces: list
# ---------- distributefaces: Python ----------
__author__ = "ilouh"
__version__ = "2023.01.08"

import rhinoscriptsyntax as rs
import ghpythonlib.components as comps
import Rhino.Geometry as geom

#elements = comps.DeconstructBrep(mass)
#faces = elements['faces']

#find the normal of each face


roof = []
floors = []
solidWalls = []
facadeWalls = [] 

for i in range(0,len(v)):
    
    vector = v[i]
    values = comps.DeconstructVector(vector)
    
    print(vector)
    
    if values['x_component'] is not None:
        
        x_value = values['x_component']
        y_value = values['y_component']
        z_value = values['z_component']
        
    else:
        
        x_value = vector[0]
        y_value = vector[1]
        z_value = vector[2]
    
    print(x_value)
    
    if x_value is not None:
        
        if z_value >= 0.4:
            
            print(i)
            roof.append(faces[i])
        
        if z_value == -1:
            
            floors.append(faces[i])
       
        if abs(z_value) != 1:
        
            facadeWalls.append(faces[i])
# ---------- end distributefaces ----------

# ----
panel_2 = Panel(evalsrf.Normal)
srf = Surface(graft(distributefaces.facadeWalls))
srf_2 = Surface(flatten(distributefaces.roof))
srf_3 = Surface(distributefaces.floors)
flatten = FlattenTree(Tree=srf_3, Path="{0}")
trim_2 = TrimTree(Tree=srf, Depth=1)
bool = ClusterInput()
area = Area(Geometry=flatten)  # -> Area, Centroid
python = GhPythonScript()  # -> Out, A
ma = MassAddition(Input=area.Area)  # -> Result, PartialResults
walls = Surface(simplify(trim_2))

# ---- group: Pass if Tree or List
python_2 = GhPythonScript(x=floors_as_curves, tree=floors_as_curves)  # -> simplify(flatten(a)); inputs x: list, tree: tree
# ---------- python_2: Python ----------
__author__ = "ilouh"
__version__ = "2023.02.21"

import rhinoscriptsyntax as rs
import Grasshopper as gh
import Rhino.Geometry as rg
import ghpythonlib.components as comps
from ghpythonlib import treehelpers as th
import math

def remove_brackets(input_str):
    # Remove the brackets
    content = input_str.strip('{}')
    # Split the string by commas and convert to integers
    numbers = [int(num) for num in content.split(';')]

    return numbers
    
test_li = th.tree_to_list(tree)
test_value = len(test_li)

tree_stats = comps.TreeStatistics(tree)
tree_paths = tree_stats['paths']
tree_paths = tree_paths[0]
tree_path_structure = remove_brackets(str(tree_paths))
tree_path_structure_length = len(tree_path_structure)
print(tree_path_structure_length)


if tree_path_structure_length > 1:
    a = True
else:
    a = False
# ---------- end python_2 ----------
trim_3 = TrimTree(Tree=floors_as_curves, Depth=1)
flatten_2 = FlattenTree(Tree=floors_as_curves, Path="{0}")

# ----
item = ListItem(List=python_2, Index=0, Wrap=True)

# ---- group: Pass if Tree or List (continued)
filter = StreamFilter(Gate=item, Stream0=flatten_2, Stream1=trim_3)

# ----
cls = Closed(Curve=filter)  # -> Closed, Periodic
panel_3 = Panel(cls.Closed)
cull = CullPattern(List=filter, CullPattern=cls.Closed)
area_2 = Area(Geometry=cull)  # -> Area, Centroid

# ---- group: Calculates Gross Building Area
python_3 = GhPythonScript(Floor_Plate_Curves=cull, bool=bool, areas=area_2.Area)  # -> keys, simplify(values), TotalBuildingArea, Floor_Plate_Curves; inputs Floor_Plate_Curves: list of Curve, floorList: list of Int32, areas: list
# ---------- python_3: Python ----------
__author__ = "Iliya Muzychuk"
__version__ = "2023.02.03"

import rhinoscriptsyntax as rs
import Grasshopper as gh
import Rhino.Geometry as rg
import ghpythonlib.components as comps

FloorNames = []
FloorAreas = []

#Funcition to find the key of a dictionary by value 

def findKey(value_to_find,dic):
    for key, value in dic.items():
        if abs(value - value_to_find) < 2:
            return key
dic = {}
#Create a name and claculates the area of each floor
for i in range(0,len(floorList)):
    floor_number = 1 + i
    dic_name = 'Floor {}'.format(floor_number)
    dic[dic_name] = floorList[i]



if bool == True: 

    Floor_Plate_Curves.pop(-1)


else:
    
    pass

for  i in range(0,len(Floor_Plate_Curves)): 
    
    floor = Floor_Plate_Curves[i]
    print(floor)
    #Floor_Area = comps.Area(floor)
    Floor_Area = areas[i]
    print(Floor_Area)
    if Floor_Area is not None:
        
        FloorAreas.append(round(Floor_Area,2))


keys = FloorNames
values = FloorAreas

TotalBuildingArea = sum(values)
# ---------- end python_3 ----------

# ---- group: creates the extrusion distance
floor_thickness = Slider(0.5, range=0..1)
neg = Negative(Value=floor_thickness)
Z_2 = UnitZ(Factor=neg)
extr = Extrude(Base=python_3.Floor_Plate_Curves, Direction=Z_2)
cap = CapHoles(Brep=extr)

# ----
panel_4 = Panel(python_3.TotalBuildingArea)

extr_2 = Extrude(Base=srf_2, Direction=Z_2)
cap_2 = CapHoles(Brep=extr_2)

panel_5 = Panel(python_3.Floor_Plate_Curves)
floors = Brep(simplify(cap))
flatten_3 = FlattenTree(Tree=python_3.values, Path="{0}")
tstat_2 = TreeStatistics(Tree=python_3.values)  # -> Length_tree, Length, Count

# ---- group: Outputs
floors_as_curves_2 = ClusterOutput(python_3.Floor_Plate_Curves)
floors_2 = ClusterOutput(floors)
walls_2 = ClusterOutput(walls)
roof = ClusterOutput(cap_2)

# ----
areas = ClusterOutput(flatten_3)
length_tree = ClusterOutput(tstat_2.Length_tree)
flatten_4 = FlattenTree(Tree=python_3.TotalBuildingArea, Path="{0}")
graft = GraftTree(Tree=flatten_4, IncludeEmptyLists=True, IncludeNullItems=True)

# ---- group: Calculates Wall Area Ratio
python_4 = GhPythonScript(walls=walls, totalBuildingArea=graft)  # -> keys, values, result; inputs walls: list
# ---------- python_4: Python ----------
__author__ = "Iliya Muzychuk"
__version__ = "2023.02.03"

import rhinoscriptsyntax as rs
import Grasshopper as gh
import Rhino.Geometry as rg
import ghpythonlib.components as comps

#A function to convert a float to percentage

def float_to_percentage(number):
    return '{:.2%}'.format(number)
    
wall_areas = []

for wall in walls:
    
    area = rs.Area(wall)
    
    wall_areas.append(area)

if len(wall_areas) > 0:
    
    total_wall_area = round(sum(wall_areas),2)
    wall_area_ratio = total_wall_area / totalBuildingArea
    
    #Dictionary constructions allows future json file control 
    
    dic = {
    
        'Total Facade Area' : total_wall_area,
        'Wall area/Floor area Ratio' : float_to_percentage(wall_area_ratio)
    
    }
    
    keys = dic.keys()
    values = dic.values() 
    
    result = []
    
    for key, value in dic.items():
        
        string = str(key) + ": " + str(value)
        result.append(string)
# ---------- end python_4 ----------

# ----
facade_attributes = Data(python_4.result)

lng = ListLength(List=simplify(facade_attributes))
series = Series(Start=0, Step=typical_floor_height_2, Count=lng)

Z_3 = UnitZ(Factor=series)
move = Move(Motion=Z_3)  # -> Points_Facade_Attributes, Transform

points_facade_attributes = ClusterOutput(move.Points_Facade_Attributes)
facade_attributes_2 = ClusterOutput(facade_attributes)
