# Grasshopper definition Program Units Outlines 0.2.0.gh (Grasshopper 1.0.7)

unit_length = DigitScroller(Scroller_Digits=12, Scroller_Prefix="Unit Length", Scroller_Radix=9, Scroller_Value=30)
unit_height = DigitScroller(Scroller_Digits=12, Scroller_Prefix="Unit Height", Scroller_Radix=9, Scroller_Value=10)
true_inboard_false_outboard = BooleanToggle(False)
select_boundary_curve = Slider(1, range=1..4)
unit_area = DigitScroller(Scroller_Digits=12, Scroller_Prefix="Unit Area", Scroller_Radix=9, Scroller_Value=900)
unit_width = DigitScroller(Scroller_Digits=12, Scroller_Prefix="Unit Width", Scroller_Radix=9, Scroller_Value=15)
true_by_unit_length_false_by_unit_area = BooleanToggle(True)
path_curve = Curve(graft(<curve referenced from the Rhino model>))

python = GhPythonScript(bool=true_inboard_false_outboard)  # -> coef
# ---------- python: Python ----------
__author__ = "ilouh"
__version__ = "2023.02.21"

import rhinoscriptsyntax as rs
import Grasshopper as gh
import Rhino.Geometry as rg
import ghpythonlib.components as comps
import math

if bool == True: 
    
    coef = 1

else:
    
    coef = -1
# ---------- end python ----------
expression = Expression(Unit_Length=unit_length, coef=python, Expression="coef * Unit_Length")
expression_2 = Expression(Unit_Area=unit_area, Unit_Width=unit_width, coef=python, Expression="coef * Ceiling(Unit_Area/Unit_Width)")

explode = Explode(Curve=path_curve, Recursive=True)  # -> Segments, Vertices

# ---- group: Creates a script to subdivide a curve into units
python_2 = GhPythonScript(crv=explode.Segments, facade_length=unit_width)  # -> points; inputs crv: Curve
# ---------- python_2: Python ----------
__author__ = "ilouh"
__version__ = "2022.12.10"

import rhinoscriptsyntax as rs
import ghpythonlib.components as comps

def subdivide_curve(curve, num_subdivisions):

    # Use the DivideCurve function to perform the subdivision
    points = rs.DivideCurve(curve, num_subdivisions)
    
    curve_segments = []
    shatter_parameters = []
    
    for i in range(len(points) - 1):
        
        #curve_segments.append(rs.AddLine(points[i], points[i + 1]))
        
        t = rs.CurveClosestPoint(curve, points[i])
        shatter_parameters.append(t)
        
    curve_segments = comps.Shatter(curve,shatter_parameters)

    return curve_segments


length = rs.CurveLength(crv)

num = round(length / facade_length,0)
a = subdivide_curve(crv,num)
points = rs.DivideCurve(crv, num)
# ---------- end python_2 ----------

# ----
filter = StreamFilter(Gate=true_by_unit_length_false_by_unit_area, Stream0=expression_2, Stream1=expression)
mplane = MeshPlane(Boundary={Plane=PlaneXY(0, 0, 0), Size=Domain2(u=-10..10, v=-10..10)}, WidthCount=10, HeightCount=10)  # -> Mesh, Area
number_slider = Slider(1, range=0..2)  # disabled
swatch = ColourSwatch(SwatchColor=RGBA(162, 209, 153, 145))  # disabled
swatch_2 = ColourSwatch(SwatchColor=RGBA(61, 128, 78, 158))  # disabled

# ---- group: Offset the curves and joins the points for the demising lines
crv_cp = CurveClosestPoint(Point=python_2, Curve=path_curve)  # -> Point, Parameter, Distance
offset = OffsetCurve(Curve=path_curve, Distance=filter, Corners=Slider(1, range=0..4))
crv_cp_2 = CurveClosestPoint(Point=crv_cp.Point, Curve=offset)  # -> Point, Parameter, Distance
ln = Line(StartPoint=crv_cp_2.Point, EndPoint=crv_cp.Point)

# ----
trim = TrimTree(Tree=offset, Depth=1)

# ---- group: Offset the curves and joins the points for the demising lines (continued)
merge = Merge(Data1=path_curve, Data2=trim)
loft = Loft(Curves=merge, Options={Adjust=False, Closed=False, LoftEnds=0, LoftSimp=0, LoftType=0, Rebuild=10, Refit=0.01})

# ---- group: Removes non perpendicular lines
angle = Angle(VectorA=ln, VectorB=graft(explode.Segments))  # -> Angle, Reflex
expression_3 = Expression(x=angle.Angle, Expression="(x*180)/π")
similar = Similarity(FirstNumber=expression_3, SecondNumber="90", Threshold="5")  # -> Similarity, AbsoluteDifference
cull = CullPattern(List=ln, CullPattern=similar.Similarity)  # -> simplify(List)

# ----
demising_lines = Curve(cull)
original_curve = Curve(path_curve)
offset_curve = Curve(offset)

curvepoint = PointOnCurve(demising_lines, parameter=0.5)

# ---- group: Split the Surface with the line
debrep = DeconstructBrep(Brep=loft)  # -> Faces, Edges, Vertices
srfsplit = SurfaceSplit(Surface=debrep.Faces, Curves=flatten(cull))

# ----
alongcrv = SortAlongCurve(Points=curvepoint, Curve=original_curve)  # -> Points, Indices

# ---- group: Extrudes the Units
Z = UnitZ(Factor=unit_height)
extr = Extrude(Base=srfsplit, Direction=Z)  # -> simplify(Extrusion)
cap = CapHoles(Brep=extr)

# ----
python_3 = GhPythonScript(index_map=alongcrv.Indices, Lines=demising_lines, threshold=Slider(2, range=0..2))  # -> Breps_Out, corner_Lines, Dem_Lines; inputs index_map: list, Lines: list, threshold: Int32
# ---------- python_3: Python ----------
__author__ = "ilouh"
__version__ = "2023.02.21"

import rhinoscriptsyntax as rs
import Grasshopper as gh
import Rhino.Geometry as rg
import ghpythonlib.components as comps
import math

temp_list = (range(0, len(Lines)))

Lines_Out = []

#maps the breps to a list according the index_mappings

reordered_list = [Lines[i] for i in index_map]
    
Lines_Out = reordered_list

corner_index = [] 

corner_index.append(Lines_Out[threshold])
corner_index.append(Lines_Out[-(threshold+1)])
    
corner_Lines = corner_index

Dem_Lines = Lines_Out

for i in range(0,threshold):
    Dem_Lines.pop(0)
    Dem_Lines.pop(-1)
# ---------- end python_3 ----------

# ---- group: Organizing the Breps on a curve and merges the corners
volume = Volume(Geometry=extr)  # -> Volume, Centroid; disabled
alongcrv_2 = SortAlongCurve(Points=volume.Centroid, Curve=path_curve)  # -> Points, Indices; disabled
python_4 = GhPythonScript(index_map=alongcrv_2.Indices, Breps=cap, threshold=number_slider)  # -> Breps_Out, corner_breps, Typical_Units; inputs index_map: list, Breps: list, threshold: Int32; disabled
# ---------- python_4: Python ----------
__author__ = "ilouh"
__version__ = "2023.02.21"

import rhinoscriptsyntax as rs
import Grasshopper as gh
import Rhino.Geometry as rg
import ghpythonlib.components as comps
import math

temp_list = (range(0, len(Breps)))

Breps_Out = []

#maps the breps to a list according the index_mappings

reordered_list = [Breps[i] for i in index_map]
    
Breps_Out = reordered_list

corner_index = [] 

for i in range(0,threshold):
    
    corner_index.append(Breps_Out[i])
    corner_index.append(Breps_Out[-(i+1)])
    
corner_breps = corner_index

Typical_Units = Breps_Out

for i in range(0,threshold):
    Typical_Units.pop(0)
    Typical_Units.pop(-1)
# ---------- end python_4 ----------

# ----
crv = Curve(python_3.Dem_Lines)
crv_2 = Curve(python_3.corner_Lines)
python_5 = GhPythonScript(crvs=crv)  # -> units_outlines; inputs crvs: list of Curve
# ---------- python_5: Python ----------
__author__ = "ilouh"
__version__ = "2023.02.21"

import rhinoscriptsyntax as rs
import Grasshopper as gh
import Rhino.Geometry as rg
import ghpythonlib.components as comps
import math

units_outlines = []

for i in range(0,len(crvs) -1):
    
    crv_a = crvs[i]
    crv_b = crvs[i+1]
    
    points_a = comps.EndPoints(crv_a)
    points_b = comps.EndPoints(crv_b)
    
    points_a_start = points_a['start']
    points_a_end = points_a['end']
    
    points_b_start = points_b['start']
    points_b_end = points_b['end']
    
    polyline = comps.PolyLine([points_a_start,points_a_end,points_b_end,points_b_start], True)
    #mesh = comps.MeshQuad(points_a_start,points_a_end,points_b_end,points_b_start)
    units_outlines.append(polyline)


print(polyline)
# ---------- end python_5 ----------
panel = Panel(python_5)

# ---- group: Boolean Corners
brep = Brep(simplify(python_4.corner_breps))  # disabled
sunion = SolidUnion(Breps=flatten(brep))  # disabled

# ----
volume_2 = Volume(Geometry=[python_4.Typical_Units, sunion])  # -> Volume, Centroid; disabled
expression_4 = Expression(volume=volume_2.Volume, height=unit_height, Expression="round(volume/height,0)")  # disabled
panel_2 = Panel(sunion)
volume_3 = Volume(Geometry=sunion)  # -> Volume, Centroid; disabled
brep_2 = Brep(flatten(sunion))  # disabled
brep_3 = Brep(flatten(python_4.Typical_Units))  # disabled
panel_3 = Panel(expression_4)  # disabled
preview = CustomPreview(Geometry=brep_2, Material=swatch)  # disabled
preview_2 = CustomPreview(Geometry=brep_3, Material=swatch_2)  # disabled
tag = TextTag(Location=volume_2.Centroid, Text=expression_4)  # disabled
