# Grasshopper definition Program Units Outlines 0.2.1.gh (Grasshopper 1.0.7)

input = DataInput(
    Destination="G:\My Drive\Scripting Repository\Exchange Data\FloorPlates.ghdata",
    RelativePath="G:\My Drive\Scripting Repository\Exchange Data\FloorPlates.ghdata|..\..\Exchange Data\FloorPlates.ghdata",
    UpdateDelay=5)  # disabled
item = ListItem(List=input, Index=0, Wrap=True)  # disabled
flip = FlipCurve(Curve=input, Guide=item)  # -> Curve, Flag; disabled
path_curve = Curve(graft([<curve referenced from the Rhino model> x4]))
select_boundary_curve = Slider(1, range=1..4)
unit_area = DigitScroller(Scroller_Digits=12, Scroller_Prefix="Unit Area", Scroller_Radix=9, Scroller_Value=500)
unit_width = DigitScroller(Scroller_Digits=12, Scroller_Prefix="Unit Width", Scroller_Radix=9, Scroller_Value=10)
unit_length = DigitScroller(Scroller_Digits=12, Scroller_Prefix="Unit Length", Scroller_Radix=9, Scroller_Value=25)
unit_height = DigitScroller(Scroller_Digits=12, Scroller_Prefix="Unit Height", Scroller_Radix=9, Scroller_Value=10)
true_by_unit_length_false_by_unit_area = BooleanToggle(True)
true_inboard_false_outboard = BooleanToggle(False)

python = GhPythonScript(bool=true_inboard_false_outboard)  # -> coef
# ---------- python: Python ----------
__author__ = "ilouh"
__version__ = "2023.02.21"

import rhinoscriptsyntax as rs
import Grasshopper as gh
import Rhino.Geometry as rg
import ghpythonlib.components as comps
import math

if bool == True: 
    
    coef = 1

else:
    
    coef = -1
# ---------- end python ----------
expression = Expression(Unit_Length=unit_length, coef=python, Expression="coef * Unit_Length")
expression_2 = Expression(Unit_Area=unit_area, Unit_Width=unit_width, coef=python, Expression="coef * Ceiling(Unit_Area/Unit_Width)")

explode = Explode(Curve=path_curve, Recursive=True)  # -> simplify(Segments), Vertices

# ---- group: Creates a script to subdivide a curve into units
python_2 = GhPythonScript(crv=explode.Segments, facade_length=unit_width)  # -> simplify(points); inputs crv: Curve
# ---------- python_2: Python ----------
__author__ = "ilouh"
__version__ = "2022.12.10"

import rhinoscriptsyntax as rs
import ghpythonlib.components as comps

def subdivide_curve(curve, num_subdivisions):

    # Use the DivideCurve function to perform the subdivision
    points = rs.DivideCurve(curve, num_subdivisions)
    
    curve_segments = []
    shatter_parameters = []
    
    for i in range(len(points) - 1):
        
        #curve_segments.append(rs.AddLine(points[i], points[i + 1]))
        
        t = rs.CurveClosestPoint(curve, points[i])
        shatter_parameters.append(t)
        
    curve_segments = comps.Shatter(curve,shatter_parameters)

    return curve_segments


length = rs.CurveLength(crv)

num = round(length / facade_length,0)
a = subdivide_curve(crv,num)
points = rs.DivideCurve(crv, num)
# ---------- end python_2 ----------

# ----
filter = StreamFilter(Gate=true_by_unit_length_false_by_unit_area, Stream0=expression_2, Stream1=expression)
panel = Panel(python_2)

# ---- group: Offset the curves and joins the points for the demising lines
offset = OffsetCurve(Curve=path_curve, Distance=filter, Corners=Slider(1, range=0..4))
crv_cp = CurveClosestPoint(Point=python_2, Curve=reparameterize(graft(explode.Segments)))  # -> Point, Parameter, Distance

# ----
explode_2 = Explode(Curve=offset, Recursive=True)  # -> simplify(Segments), Vertices

# ---- group: Offset the curves and joins the points for the demising lines (continued)
crv_cp_2 = CurveClosestPoint(Point=python_2, Curve=simplify(graft(explode_2.Segments)))  # -> Point, Parameter, Distance
ln = Line(StartPoint=crv_cp_2.Point, EndPoint=crv_cp.Point)

# ---- group: Checks Vector Degree
end = EndPoints(Curve=ln)  # -> Start, End
crv_cp_3 = CurveClosestPoint(Point=end.Start, Curve=graft(explode.Segments))  # -> Point, Parameter, Distance
vec2pt = Vector2Pt(PointA=end.Start, PointB=end.End, Unitize=False)  # -> Vector, Length
eval = EvaluateCurve(Curve=graft(explode.Segments), Parameter=crv_cp_3.Parameter)  # -> Point, Tangent, Angle
dprod = DotProduct(VectorA=eval.Tangent, VectorB=vec2pt.Vector, Unitize=False)

# ----
panel_2 = Panel(dprod)

# ---- group: Removes non perpendicular lines
similar = Similarity(FirstNumber=panel_2, SecondNumber=Slider(0, range=0..100), Threshold="5")  # -> Similarity, AbsoluteDifference
cull = CullPattern(List=ln, CullPattern=similar.Similarity)  # -> simplify(List)

# ----
original_curve = Curve(reparameterize(path_curve))
offset_curve = Curve(reparameterize(offset))
demising_lines = Curve(cull)

curvepoint = PointOnCurve(demising_lines, parameter=0.5)

alongcrv = SortAlongCurve(Points=curvepoint, Curve=original_curve)  # -> Points, Indices
python_3 = GhPythonScript(index_map=alongcrv.Indices, Lines=demising_lines, threshold=Slider(1, range=0..2))  # -> Breps_Out, corner_Lines, Dem_Lines; inputs index_map: list, Lines: list, threshold: Int32
# ---------- python_3: Python ----------
__author__ = "ilouh"
__version__ = "2023.02.21"

import rhinoscriptsyntax as rs
import Grasshopper as gh
import Rhino.Geometry as rg
import ghpythonlib.components as comps
import math

temp_list = (range(0, len(Lines)))

Lines_Out = []

#maps the breps to a list according the index_mappings

reordered_list = [Lines[i] for i in index_map]
    
Lines_Out = reordered_list

corner_index = [] 
try:
    
    corner_index.append(Lines_Out[threshold])
    corner_index.append(Lines_Out[-(threshold+1)])
        
    corner_Lines = corner_index
    
    Dem_Lines = Lines_Out
    
    for i in range(0,threshold):
        Dem_Lines.pop(0)
        Dem_Lines.pop(-1)

except IndexError:
    pass
# ---------- end python_3 ----------
crv = Curve(python_3.Dem_Lines)
python_4 = GhPythonScript(crvs=crv)  # -> units_outlines; inputs crvs: list of Curve
# ---------- python_4: Python ----------
__author__ = "ilouh"
__version__ = "2023.02.21"

import rhinoscriptsyntax as rs
import Grasshopper as gh
import Rhino.Geometry as rg
import ghpythonlib.components as comps
import math

units_outlines = []

for i in range(0,len(crvs) -1):
    
    crv_a = crvs[i]
    crv_b = crvs[i+1]
    
    points_a = comps.EndPoints(crv_a)
    points_b = comps.EndPoints(crv_b)
    
    points_a_start = points_a['start']
    points_a_end = points_a['end']
    
    points_b_start = points_b['start']
    points_b_end = points_b['end']
    
    polyline = comps.PolyLine([points_a_start,points_a_end,points_b_end,points_b_start], True)
    #mesh = comps.MeshQuad(points_a_start,points_a_end,points_b_end,points_b_start)
    units_outlines.append(polyline)
    
    


print(polyline)
# ---------- end python_4 ----------

# ---- group: Create the corner units
crv_2 = Curve(simplify(graft(python_3.corner_Lines)))
curvepoint_2 = PointOnCurve(crv_2, parameter=0.5)
crv_cp_4 = CurveClosestPoint(Point=curvepoint_2, Curve=original_curve)  # -> Point, Parameter, Distance
shatter = Shatter(Curve=graft(original_curve), Parameters=flatten(crv_cp_4.Parameter))
disc = Discontinuity(Curve=shatter, Level=1)  # -> Points, Parameters
python_5 = GhPythonScript(points=simplify(disc.Points))  # -> flatten(corners); inputs points: list of Point3d
# ---------- python_5: Python ----------
__author__ = "ilouh"
__version__ = "2023.02.21"

import rhinoscriptsyntax as rs
import Grasshopper as gh
import Rhino.Geometry as rg
import ghpythonlib.components as comps
import math
corners = []
linears = [] 

if len(points) > 2:
   
    curve = comps.PolyLine(points,False)
    corners.append(curve)
# ---------- end python_5 ----------
offset_2 = OffsetCurve(Curve=python_5, Distance=filter, Corners=Slider(1, range=0..4))
merge = Merge(Data1=simplify(graft(python_5)), Data2=simplify(offset_2))

# ---- group: Extrudes the Units
Z = UnitZ(Factor=unit_height)
extr = Extrude(Base=python_4, Direction=Z)  # -> simplify(Extrusion)
cap = CapHoles(Brep=extr)

# ----
loft = Loft(Curves=merge, Options={Adjust=False, Closed=False, LoftEnds=0, LoftSimp=0, LoftType=0, Rebuild=10, Refit=0.01})
Z_2 = UnitZ(Factor=unit_height)
extr_2 = Extrude(Base=loft, Direction=Z_2)  # -> simplify(Extrusion)

brep = Brep(flatten(cap))
brep_2 = Brep(flatten(extr_2))
preview = CustomPreview(Geometry=brep_2, Material=ColourSwatch(SwatchColor=RGBA(162, 209, 153, 145)))
preview_2 = CustomPreview(Geometry=brep, Material=ColourSwatch(SwatchColor=RGBA(61, 128, 78, 158)))
