# Grasshopper definition Program Units Outlines 0.2.2.gh (Grasshopper 1.0.7)

input = DataInput(
    Destination="G:\My Drive\Scripting Repository\Exchange Data\FloorPlates.ghdata",
    RelativePath="G:\My Drive\Scripting Repository\Exchange Data\FloorPlates.ghdata|..\..\Exchange Data\FloorPlates.ghdata",
    UpdateDelay=50000)
item = ListItem(List=input, Index=0, Wrap=True)
flip = FlipCurve(Curve=input, Guide=item)  # -> Curve, Flag
path_curve = Curve(reparameterize(graft([<curve referenced from the Rhino model> x4])))
select_boundary_curve = Slider(1, range=1..4)
unit_area = DigitScroller(Scroller_Digits=12, Scroller_Prefix="Unit Area", Scroller_Radix=9, Scroller_Value=250)
unit_width = DigitScroller(Scroller_Digits=12, Scroller_Prefix="Unit Width", Scroller_Radix=9, Scroller_Value=12)
unit_length = DigitScroller(Scroller_Digits=12, Scroller_Prefix="Unit Length", Scroller_Radix=9, Scroller_Value=25)
unit_height = DigitScroller(Scroller_Digits=12, Scroller_Prefix="Unit Height", Scroller_Radix=9, Scroller_Value=10)
true_by_unit_length_false_by_unit_area = BooleanToggle(False)
true_inboard_false_outboard = BooleanToggle(False)

python = GhPythonScript(bool=true_inboard_false_outboard)  # -> coef
# ---------- python: Python ----------
__author__ = "ilouh"
__version__ = "2023.02.21"

import rhinoscriptsyntax as rs
import Grasshopper as gh
import Rhino.Geometry as rg
import ghpythonlib.components as comps
import math

if bool == True: 
    
    coef = 1

else:
    
    coef = -1
# ---------- end python ----------
expression = Expression(Unit_Length=unit_length, coef=python, Expression="coef * Unit_Length")
expression_2 = Expression(Unit_Area=unit_area, Unit_Width=unit_width, coef=python, Expression="coef * Ceiling(Unit_Area/Unit_Width)")

explode = Explode(Curve=path_curve, Recursive=True)  # -> simplify(Segments), Vertices

# ---- group: Creates a script to subdivide a curve into units
python_2 = GhPythonScript(crv=explode.Segments, facade_length=unit_width)  # -> simplify(points); inputs crv: Curve
# ---------- python_2: Python ----------
__author__ = "ilouh"
__version__ = "2022.12.10"

import rhinoscriptsyntax as rs
import ghpythonlib.components as comps

def subdivide_curve(curve, num_subdivisions):

    # Use the DivideCurve function to perform the subdivision
    points = rs.DivideCurve(curve, num_subdivisions)
    
    curve_segments = []
    shatter_parameters = []
    
    for i in range(len(points) - 1):
        
        #curve_segments.append(rs.AddLine(points[i], points[i + 1]))
        
        t = rs.CurveClosestPoint(curve, points[i])
        shatter_parameters.append(t)
        
    curve_segments = comps.Shatter(curve,shatter_parameters)

    return curve_segments


length = rs.CurveLength(crv)

num = round(length / facade_length,0)
a = subdivide_curve(crv,num)
points = rs.DivideCurve(crv, num)
# ---------- end python_2 ----------

# ----
filter = StreamFilter(Gate=true_by_unit_length_false_by_unit_area, Stream0=expression_2, Stream1=expression)
panel = Panel(python_2)
swatch = ColourSwatch(SwatchColor=RGBA(162, 209, 153, 145))  # disabled
swatch_2 = ColourSwatch(SwatchColor=RGBA(61, 128, 78, 158))  # disabled
brep = Brep()  # disabled
preview = CustomPreview(Geometry=brep, Material=swatch_2)  # disabled

# ---- group: Offset the curves and joins the points for the demising lines
offset = OffsetCurve(Curve=path_curve, Distance=filter, Corners=Slider(1, range=0..4))
crv_cp = CurveClosestPoint(Point=python_2, Curve=reparameterize(graft(explode.Segments)))  # -> Point, Parameter, Distance

# ----
explode_2 = Explode(Curve=offset, Recursive=True)  # -> simplify(Segments), Vertices

# ---- group: Offset the curves and joins the points for the demising lines (continued)
crv_cp_2 = CurveClosestPoint(Point=python_2, Curve=simplify(graft(explode_2.Segments)))  # -> Point, Parameter, Distance
ln = Line(StartPoint=crv_cp.Point, EndPoint=crv_cp_2.Point)

# ---- group: Checks Vector Degree
end = EndPoints(Curve=ln)  # -> Start, End
crv_cp_3 = CurveClosestPoint(Point=end.Start, Curve=graft(explode.Segments))  # -> Point, Parameter, Distance
vec2pt = Vector2Pt(PointA=end.Start, PointB=end.End, Unitize=False)  # -> Vector, Length
eval = EvaluateCurve(Curve=graft(explode.Segments), Parameter=crv_cp_3.Parameter)  # -> Point, Tangent, Angle
dprod = DotProduct(VectorA=eval.Tangent, VectorB=vec2pt.Vector, Unitize=False)

# ----
panel_2 = Panel(dprod)

# ---- group: Removes non perpendicular lines
similar = Similarity(FirstNumber=panel_2, SecondNumber=Slider(0, range=0..100), Threshold="5")  # -> Similarity, AbsoluteDifference
cull = CullPattern(List=ln, CullPattern=similar.Similarity)  # -> simplify(List)

# ----
end_2 = EndPoints(Curve=cull)  # -> Start, End
trim = TrimTree(Tree=end_2.Start, Depth=1)
pt = Point(trim)
crv = Curve(path_curve)
crv_cp_4 = CurveClosestPoint(Point=pt, Curve=crv)  # -> Point, Parameter, Distance
shatter = Shatter(Curve=crv, Parameters=crv_cp_4.Parameter)

offset_2 = OffsetCurve(Curve=shatter, Distance=filter, Corners=Slider(1, range=0..4))
merge = Merge(Data1=simplify(graft(shatter)), Data2=simplify(offset_2))
loft = Loft(Curves=merge, Options={Adjust=False, Closed=False, LoftEnds=0, LoftSimp=0, LoftType=0, Rebuild=10, Refit=0.01})  # -> simplify(flatten(Loft))

python_3 = GhPythonScript(surfaces=loft)  # -> Typical_Units, Corner_Units; inputs surfaces: list of Brep
# ---------- python_3: Python ----------
__author__ = "ilouh"
__version__ = "2023.02.21"

import rhinoscriptsyntax as rs
import Grasshopper as gh
import Rhino.Geometry as rg
import ghpythonlib.components as comps
import math

Typical_Units = [] 
Corner_Units = []

for surface in surfaces:
    
    temp = comps.DeconstructBrep(surface)
    points = temp['vertices']
    
    if len(points) > 4: 
        
        Corner_Units.append(surface)
    
    else:
        
        Typical_Units.append(surface)
# ---------- end python_3 ----------

Z = UnitZ(Factor=unit_height)  # disabled
extr = Extrude(Base=loft, Direction=Z)  # -> simplify(Extrusion); disabled

brep_2 = Brep(flatten(extr))  # disabled
preview_2 = CustomPreview(Geometry=brep_2, Material=swatch)  # disabled
