# Grasshopper definition Program_Parking 0.1.0.gh (Grasshopper 1.0.7)
# plug-ins: ParkingSolver

number_slider = Slider(9, range=0..10)
number_slider_2 = Slider(28, range=0..100)
number_slider_3 = Slider(18, range=0..100)
roads_settings = RoadsSettings(
    SideOut=Slider(0, range=0..9),
    EdgesCull=Slider(0, range=0..9),
    ReferenceEdge=Slider(5, range=0..9),
    Skirt=0.5,
    AccessWidth=6,
    AxialWidth=6,
    PerimetralSettings=Slider(2, range=0..9),
    SnapAccess=1,
    IslandRadius=1.5)
normal_spot = NormalSpot(
    Angle=90,
    Stack=False,
    Length=number_slider_3,
    Width=number_slider,
    RoadWidth=number_slider_2,
    CountText5baba97a_1282_4edf_b8b2_e9454d95afd9=0,
    lastIndex5baba97a_1282_4edf_b8b2_e9454d95afd9=0)
normal_spot_2 = NormalSpot(
    Length=number_slider_3,
    Width=number_slider,
    RoadWidth=number_slider_2,
    CountText1d2e8e4c_0566_4b95_9df8_6846a18eef92=0,
    lastIndex1d2e8e4c_0566_4b95_9df8_6846a18eef92=0)

curve = Curve(<curve referenced from the Rhino model>)
point = Point(Point(423.5152277, -699.3109418, 0))

point_2 = Point([<point referenced from the Rhino model> x2])
pedestrain_settings = PedestrainSettings(Access=point_2, AccessWidth=1.5, CircWidth=0.8, Style=0)
bike_picker = BikePicker(Pick=Button(), AccessWidth=1.2, Border=0.2, SpotLength=1.8, LateralDistance=0.9, Amount=10, Reset=False)  # -> SpotInstances, Debug
normal_spot_3 = NormalSpot(Amount="5", CountText1886b621_c52e_48d7_9a89_db1ba3845917=0, lastIndex1886b621_c52e_48d7_9a89_db1ba3845917=0)
normal_spot_4 = NormalSpot(Amount="10", CountTextb6dade71_039c_4edd_b0f5_1dcc0756d057=0, lastIndexb6dade71_039c_4edd_b0f5_1dcc0756d057=0)
parking_solver = ParkingSolver(
    Plot=curve,
    Access=point,
    OutterSpot=normal_spot,
    InnerSpot=normal_spot_2,
    SpecialSpots=False,
    RoadsSettings=roads_settings,
    PedestrianSettings=pedestrain_settings,
    Visualize=Toggle(True),
    Form=False)  # -> RoadsNetwork, Spots, Islands, SpotInstances, RoadInstances
special_spots = SpecialSpots(Handicap=normal_spot_3, Elderly=normal_spot_4)
spots_info = SpotsInfo(Spots=parking_solver.SpotInstances)  # -> Type, Curve, Origin, Centroid, Width, Length, Strips, Sign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
roads_info = RoadsInfo(Roads=parking_solver.RoadInstances)  # -> Curve, Width, Type, Stripes, Lanes, Zebras, Sidewalks
optimization_seetings = OptimizationSeetings(Spots=parking_solver.SpotInstances)
