# Grasshopper definition Program_Parking.gh (Grasshopper 1.0.7)
# plug-ins: ParkingSolver

normal_spot = NormalSpot(
    Angle=Slider(90, range=0..100),
    Stack=Toggle(True),
    Length=Slider(18, range=0..100),
    Width=Slider(9, range=0..100),
    RoadWidth=Slider(28, range=0..100),
    CountText496c3a65_62c9_4899_babe_60b02211b8d3=0,
    lastIndex496c3a65_62c9_4899_babe_60b02211b8d3=0)
optimization_setings = OptimizationSetings()
point = Point(Point(223.38, -1014.283089, 0))
curve = Curve(<curve referenced from the Rhino model>)
parking_solver = ParkingSolver(Plot=curve, Access=point, OutterSpot=normal_spot, InnerSpot=normal_spot, SpecialSpots=False, Visualize=False, Form=False)  # -> RoadsNetwork, Spots, Islands, SpotInstances, RoadInstances
curve_2 = Curve(parking_solver.Spots)
