# Grasshopper definition Program_Units 0.4.0.gh (Grasshopper 1.0.7)

input = DataInput(
    Destination="G:\My Drive\MTA - Venice Bus Yard\03 Data Exchange Files\floors_market_curves.ghdata",
    RelativePath="G:\My Drive\MTA - Venice Bus Yard\03 Data Exchange Files\floors_market_curves.ghdata|..\03 Data Exchange Files\floors_market_curves.ghdata",
    UpdateDelay=5)
path_curve = Curve(reparameterize(simplify(graft(input))))
number_slider = Slider(0, range=0..4)
unit_area = DigitScroller(Scroller_Digits=12, Scroller_Prefix="Unit Area", Scroller_Radix=9, Scroller_Value=850)
unit_width = DigitScroller(Scroller_Digits=12, Scroller_Prefix="Unit Width", Scroller_Radix=9, Scroller_Value=40)
unit_length = DigitScroller(Scroller_Digits=12, Scroller_Prefix="Unit Length", Scroller_Radix=9, Scroller_Value=20)
unit_height = DigitScroller(Scroller_Digits=12, Scroller_Prefix="Unit Height", Scroller_Radix=9, Scroller_Value=9)
true_by_unit_length_false_by_unit_area = BooleanToggle(True)
true_inboard_false_outboard = BooleanToggle(True)
list = ValueList({"One": 0, "Two": 1, "Three": 2}, selected="One")
unit_layout_type_a = Curve([<curve referenced from the Rhino model> x2])
unit_layout_type_b = Curve([<curve referenced from the Rhino model> x18])
unit_layout_type_c = Curve([<curve referenced from the Rhino model> x11])
filter = StreamFilter(Gate=list, Stream0=unit_layout_type_a, Stream1=unit_layout_type_b, Stream2=unit_layout_type_c)
explode = Explode(Curve=path_curve, Recursive=True)  # -> Segments, Vertices
item = ListItem(List=explode.Segments, Index=Slider(0, range=0..4), Wrap=True)
cluster = Cluster(
    O=filter,
    C=path_curve,
    facade_length=unit_width,
    G=true_by_unit_length_false_by_unit_area,
    F=unit_height,
    unit_area=unit_area,
    unit_width=unit_width,
    unit_length=unit_length,
    bool=true_inboard_false_outboard)  # -> corner_units, typica_units, unit_layout_plans
brep = Brep(cluster.typica_units)
output_group = Group(Objects=cluster.unit_layout_plans)
preview = CustomPreview(Geometry=brep, Material=ColourSwatch(SwatchColor=RGBA(62, 193, 255, 48)))

brep_t1 = SplitTree(Data=output_group, Masks=flatten("{?;?;0}"))  # -> Positive, Negative

brep_t1_2 = SplitTree(Data=output_group, Masks=flatten("{?;?;1}"))  # -> Positive, Negative

# ==== cluster Cluster
C = ClusterInput()
facade_length = ClusterInput()
G = ClusterInput()
F = ClusterInput()
unit_area = ClusterInput()
unit_width = ClusterInput()
unit_length = ClusterInput()
bool = ClusterInput()

python = GhPythonScript(bool=bool)  # -> coef
# ---------- python: Python ----------
__author__ = "ilouh"
__version__ = "2023.02.21"

import rhinoscriptsyntax as rs
import Grasshopper as gh
import Rhino.Geometry as rg
import ghpythonlib.components as comps
import math

if bool == True: 
    
    coef = 1

else:
    
    coef = -1
# ---------- end python ----------
expression = Expression(Unit_Length=unit_length, coef=python, Expression="coef * Unit_Length")
expression_2 = Expression(Unit_Area=unit_area, Unit_Width=unit_width, coef=python, Expression="coef * Ceiling(Unit_Area/Unit_Width)")

explode = Explode(Curve=C, Recursive=True)  # -> reparameterize(simplify(graft(Segments))), Vertices
filter = StreamFilter(Gate=G, Stream0=expression_2, Stream1=expression)
offset = OffsetCurve(Curve=C, Distance=expr("-x", filter), Corners=1)
explode_2 = Explode(Curve=offset, Recursive=True)  # -> reparameterize(simplify(graft(Segments))), Vertices

# ---- group: Creates a script to subdivide a curve into units
python_2 = GhPythonScript(crv1=explode_2.Segments, facade_length=facade_length, crv2=explode.Segments, bool=Toggle(True))  # -> simplify(points_out), crvs_out
# ---------- python_2: Python ----------
__author__ = "ilouh"
__version__ = "2022.12.10"

import rhinoscriptsyntax as rs
import ghpythonlib.components as comps

def subdivide_curve(curve, num_subdivisions):

    # Use the DivideCurve function to perform the subdivision
    points = rs.DivideCurve(curve, num_subdivisions)
    
    curve_segments = []
    shatter_parameters = []
    
    for i in range(len(points) - 1):
        
        #curve_segments.append(rs.AddLine(points[i], points[i + 1]))
        
        t = rs.CurveClosestPoint(curve, points[i])
        shatter_parameters.append(t)
    
    #Adjust t parameter domain to ensure nothing is segmented on the start and end of lines
    base_domain = comps.Bounds(shatter_parameters)
    target_domain = comps.ConstructDomain(0.05,0.95)

    #Remaps the domain
    
    remapped_shatter_parameters = comps.RemapNumbers(shatter_parameters,base_domain,target_domain)
    remapped_shatter_parameters = remapped_shatter_parameters['mapped']
    
    curve_segments = comps.Shatter(curve,remapped_shatter_parameters)
    curve_segments = curve_segments[1:-1]
    
    return curve_segments

def pick_shortest_crv(crv1,crv2):
    
    len_crv_1 = comps.Length(crv1)
    len_crv_2 = comps.Length(crv2)
    
    if len_crv_1 > len_crv_2:
        
        return crv2
    
    else:
        return crv1
    

print(type(crv1))
print(type(crv2))

#crv = pick_shortest_crv(crv1,crv2)

if bool == True:
    crv = crv1
else:
    crv = crv2
    


length = comps.Length(crv)


crvs_out = []
points_out = []
#length = rs.CurveLength(crv)

if length != None:
#Averages the curve to units. 
    num = round(length / facade_length,0)
    points = rs.DivideCurve(crv, num)
    
    for point in points:
        points_out.append(point)
    crvs_out.append(crv2)
# ---------- end python_2 ----------

# ----
toggle = BooleanToggle(True)
clean = CleanTree(RemoveNulls=True, RemoveInvalid=True, RemoveEmpty=toggle, Tree=python_2.points_out)
clean_2 = CleanTree(RemoveNulls=True, RemoveInvalid=True, RemoveEmpty=toggle, Tree=python_2.crvs_out)
crv = Curve(clean_2)
pt = Point(clean)
crv_cp = CurveClosestPoint(Point=pt, Curve=crv)  # -> Point, Parameter, Distance
pt_2 = Point(pt)
python_3 = GhPythonScript(points=pt_2, cls_points=crv_cp.Point, crvs=crv)  # -> vector2; inputs points: list of Point3d, cls_points: list of Point3d, crvs: Curve
# ---------- python_3: Python ----------
__author__ = "ilouh"
__version__ = "2023.02.21"

import rhinoscriptsyntax as rs
import Grasshopper as gh
import Rhino.Geometry as rg
import ghpythonlib.components as comps
import math

def rad2deg(rad):
    return rad*180/math.pi

P = []

pts = comps.EndPoints(crvs)
pt_start = pts['start']
pt_end = pts['end']

vector2 = comps.Vector2Pt(pt_start,pt_end,False)

print(len(points))
print(len(cls_points))

for i in range(0,len(points)):
    
    
    vector1 = comps.Vector2Pt(points[i],cls_points[i],False)
    print(vector1)
    
    dot_product = comps.Angle(vector1['vector'],vector2['vector'])
    print(dot_product)
    
    if dot_product['angle'] != None:
        dot_product_angle = rad2deg(dot_product['angle'])
    else:
        dot_product_angle = 0
    print(dot_product_angle)

    if dot_product_angle != 90:
        pass
    else:
        P.append(points[i])

print(len(P))

print(vector1)
vector1 = vector1['vector']
vector2 = vector2['vector']
# ---------- end python_3 ----------
flatten = FlattenTree(Tree=offset, Path="{0}")
flatten_2 = FlattenTree(Tree=C, Path="{0}")
python_4 = GhPythonScript(points=pt_2, cls_points=crv_cp.Point, vector2=python_3)  # -> cull_points, cull_cls_points, unit_outlines, demising_walls; inputs points: list, cls_points: list
# ---------- python_4: Python ----------
__author__ = "ilouh"
__version__ = "2023.02.21"

import rhinoscriptsyntax as rs
import Grasshopper as gh
import Rhino.Geometry as rg
import ghpythonlib.components as comps
import math
cull_points = []
cull_cls_points = []
vectors = []

for i in range(0,len(points)):
    vector1 = comps.Vector2Pt(points[i],cls_points[i],False)
    
    dot_product = comps.Angle(vector1['vector'],vector2)

    dot_product_angle = dot_product['angle']
    dot_product_angle = round(dot_product_angle *180 / math.pi,0)
    
    print(dot_product_angle)
    vectors.append(vector1)
    
    


    if int(dot_product_angle) == int(90):
         
        cull_points.append(points[i])
        cull_cls_points.append(cls_points[i])
    else:
        pass
        
        

unit_outlines = []

for i in range(0,len(cull_points)-1):
    
    li_points = [
        
        cull_points[i],
        cull_points[i+1],
        cull_cls_points[i+1],
        cull_cls_points[i]
        
        ]
    
    polyline = comps.PolyLine(li_points,True)
    
    unit_outlines.append(polyline)

demising_walls = []

for i in range(1,len(cull_points)-1):
    
    li_points = [
        
        cull_points[i],
        cull_cls_points[i]
        
        ]
    
    polyline = comps.PolyLine(li_points,True)
    
    demising_walls.append(polyline)
# ---------- end python_4 ----------
graft = GraftParallel(PrimaryData=flatten_2)  # -> PrimaryData, SecondaryData1
graft_2 = GraftParallel(PrimaryData=flatten)  # -> PrimaryData, SecondaryData1
rulesrf = RuledSurface(CurveA=graft.PrimaryData, CurveB=graft_2.PrimaryData)
pt_3 = Point(python_4.cull_cls_points)
pt_4 = Point(python_4.cull_points)
crv_2 = Curve(python_4.unit_outlines)
crv_3 = Curve(python_4.demising_walls)
merge = Merge(Data1=simplify(graft.PrimaryData), Data2=simplify(graft_2.PrimaryData))

flatten_3 = FlattenTree(Tree=C, Path="{0}")
trim = TrimTree(Tree=crv_2, Depth=1)
flatten_4 = FlattenTree(Tree=crv_2, Path="{0}")
python_5 = GhPythonScript(x=flatten_3)  # -> a; inputs x: list
# ---------- python_5: Python ----------
__author__ = "ilouh"
__version__ = "2023.02.21"

import rhinoscriptsyntax as rs
import Grasshopper as gh
import Rhino.Geometry as rg
import ghpythonlib.components as comps
import math

if len(x) > 1:
    a = True
else:
    a = False
# ---------- end python_5 ----------
filter_2 = StreamFilter(Gate=python_5, Stream0=flatten_4, Stream1=trim)

boundary = BoundarySurfaces(Edges=merge)
Z = UnitZ(Factor=F)
extr = Extrude(Base=filter_2, Direction=Z)
extr_2 = Extrude(Base=boundary, Direction=Z)
cap = CapHoles(Brep=extr)
sdiff = SolidDifference(BrepsA=extr_2, BrepsB=cap)
python_6 = GhPythonScript(surfaces=filter_2)  # -> simplify(Typical_Units), Corner_Units, dic, areas, center_points, amount_of_units; inputs surfaces: list of Brep
# ---------- python_6: Python ----------
__author__ = "ilouh"
__version__ = "2023.02.21"

import rhinoscriptsyntax as rs
import Grasshopper as gh
import Rhino.Geometry as rg
import ghpythonlib.components as comps
import math

Typical_Units = [] 
Corner_Units = []
areas = []
center_points = []

areas_Corner_units = []
areas_Typical_units = []

dic = {}

i = 0 

for surface in surfaces:
    
    
    temp = comps.DeconstructBrep(surface)
    points = temp['vertices']
    
    
    unit_area = comps.Area(surface)
    
    unit_center = unit_area['centroid']
    
    
    unit_area = round(unit_area['area'],2)
    unit_number = 'Unit Number {}'.format(i)
    
    print(unit_area)
    
    if len(points) > 4: 
        
        unit_name = 'Corner Unit',
        unit_type = 'Two Bedroom',
        Corner_Units.append(surface)

        
    else:
        
        unit_name = 'Typical Unit',
        unit_type = 'One Bedroom',
        Typical_Units.append(surface)


    dic_temp = {

        'Unit Name':  unit_name,
        'Unit Area': unit_area,
        'Unit Number' : unit_number,
        'Unit Type' : unit_type

    }
    
    dic[unit_number] = dic_temp
    str = '{} \n {} sf'.format(unit_type,unit_area)
    areas.append(str)
    center_points.append(unit_center)
    
    i= i+1


amount_of_units = len(surfaces)
# ---------- end python_6 ----------
corner_units = ClusterOutput(sdiff)
typica_units = ClusterOutput(cap)

# ---- group: Get the lower face of a Brep
distributefaces = GhPythonScript(brep=cap)  # -> lower_face; inputs brep: Brep
# ---------- distributefaces: Python ----------
__author__ = "ilouh"
__version__ = "2023.01.08"

import rhinoscriptsyntax as rs
import ghpythonlib.components as comps
import Rhino.Geometry as geom

#elements = comps.DeconstructBrep(mass)
#faces = elements['faces']

#find the normal of each face


roof = []
floors = []
solidWalls = []
facadeWalls = [] 

faces = comps.DeconstructBrep(brep)
faces = faces['faces']

for face in faces: 
    
    #evaluate the normal of the sruface
    point = comps.ConstructPoint(0.5,0.5,0)
    evaluate_surface = comps.EvaluateSurface(face,point)
    normal = evaluate_surface['normal']
    
    values = comps.DeconstructVector(normal) 

    print(values)
    
    x_value = values['x_component']
    y_value = values['y_component']
    z_value = values['z_component']
    

    if z_value == -1:
        
        lower_face = face
# ---------- end distributefaces ----------

# ----
O = ClusterInput()
group = Group(Objects=O)
bbox = BoundingBox(Content=group, Plane=PlaneXY(0, 0, 0), UnionBox=False)  # -> Box, Box_2
lower_surface = Surface(simplify(distributefaces))
debrep = DeconstructBrep(Brep=bbox.Box)  # -> Faces, Edges, Vertices
Z_2 = UnitZ(Factor=expr("x-2", F))
evalsrf = EvaluateSurface(Surface=lower_surface, Point="{0.0,0.0,0}")  # -> Point, Normal, UDirection, VDirection, Frame
python_7 = GhPythonScript(x=python_6.areas)  # -> flatten(out)
# ---------- python_7: Python ----------
__author__ = "ilouh"
__version__ = "2023.02.21"

import rhinoscriptsyntax as rs
import Grasshopper as gh
import Rhino.Geometry as rg
import ghpythonlib.components as comps
import math

def remove_chars(string):
    """
    Remove characters ( ) ' , from a string.

    Args:
        string (str): The input string.

    Returns:
        str: The input string with ( ) ' , characters removed.
    """
    chars_to_remove = ["(", ")", "'", ","]
    for char in chars_to_remove:
        string = string.replace(char, "")
    return string

out = remove_chars(x)
print(out)
# ---------- end python_7 ----------
recmap = RectangleMapping(Geometry=group, Source=debrep.Faces, Target=lower_surface)  # -> Geometry, Transform
move = Move(Geometry=python_6.center_points, Motion=Z_2)  # -> Geometry, Transform
plane = Plane(evalsrf.Frame)
unflatten = UnflattenTree(Tree=recmap.Geometry, Guide=lower_surface)
unit_layout_plans = ClusterOutput(unflatten)
ungroup = Ungroup(Group=unflatten)
