# Grasshopper definition Program_Units 0.5.0.gh (Grasshopper 1.0.7)
# plug-ins: LunchBox

pipeline = GeometryPipeline(
    GroupByLayer=False,
    GroupByType=False,
    IncludeHidden=True,
    IncludeLocked=True,
    LayerFilter="05_DRAFTING*05_LW04 - Residential",
    NameFilter="*",
    SublayerFiltering=True,
    TypeFilter=4)
list = ValueList({"One": 0, "Two": 1, "Three": 2}, selected="One")
unit_layout_type_a = Curve([<curve referenced from the Rhino model> x2])
unit_layout_type_b = Curve([<curve referenced from the Rhino model> x18])
unit_layout_type_c = Curve([<curve referenced from the Rhino model> x11])
path_curve = Curve(reparameterize(simplify(graft(pipeline))))
filter = StreamFilter(Gate=list, Stream0=unit_layout_type_a, Stream1=unit_layout_type_b, Stream2=unit_layout_type_c)
disc = Discontinuity(Curve=path_curve, Level=1)  # -> Points, Parameters
lng = ListLength(List=disc.Points)
larger = LargerThan(FirstNumber=lng, SecondNumber=3)  # -> LargerThan, OrEqualTo
cull = CullPattern(List=path_curve, CullPattern=larger.LargerThan)  # -> flatten(List)
panel = Panel(larger.LargerThan)
unit_area = DigitScroller(Scroller_Digits=12, Scroller_Prefix="Unit Area", Scroller_Radix=9, Scroller_Value=850)
unit_width = DigitScroller(Scroller_Digits=12, Scroller_Prefix="Unit Width", Scroller_Radix=9, Scroller_Value=30)
unit_length = DigitScroller(Scroller_Digits=12, Scroller_Prefix="Unit Length", Scroller_Radix=9, Scroller_Value=20)
unit_height = DigitScroller(Scroller_Digits=12, Scroller_Prefix="Unit Height", Scroller_Radix=9, Scroller_Value=9)
true_by_unit_length_false_by_unit_area = BooleanToggle(False)
true_inboard_false_outboard = BooleanToggle(True)
explode = Explode(Curve=path_curve, Recursive=True)  # -> Segments, Vertices
item = ListItem(List=explode.Segments, Index=Slider(1, range=0..4), Wrap=True)  # -> Item, Item1, Item2, Item3

python = GhPythonScript(bool=true_inboard_false_outboard)  # -> coef
# ---------- python: Python ----------
__author__ = "ilouh"
__version__ = "2023.02.21"

import rhinoscriptsyntax as rs
import Grasshopper as gh
import Rhino.Geometry as rg
import ghpythonlib.components as comps
import math

if bool == True: 
    
    coef = 1

else:
    
    coef = -1
# ---------- end python ----------
expression = Expression(Unit_Length=unit_length, coef=python, Expression="coef * Unit_Length")
expression_2 = Expression(Unit_Area=unit_area, Unit_Width=unit_width, coef=python, Expression="coef * Ceiling(Unit_Area/Unit_Width)")

filter_2 = StreamFilter(Gate=true_by_unit_length_false_by_unit_area, Stream0=expression_2, Stream1=expression)
offset = OffsetCurve(Curve=explode.Segments, Distance=expr("-x", filter_2), Corners=1)

# ---- group: Creates a script to subdivide a curve into units
python_2 = GhPythonScript(crv1=graft(explode.Segments), facade_length=unit_width, crv2=offset, bool=Toggle(True))  # -> simplify(points_out), crvs_out
# ---------- python_2: Python ----------
__author__ = "ilouh"
__version__ = "2022.12.10"

import rhinoscriptsyntax as rs
import ghpythonlib.components as comps

def subdivide_curve(curve, num_subdivisions):

    # Use the DivideCurve function to perform the subdivision
    points = rs.DivideCurve(curve, num_subdivisions)
    
    curve_segments = []
    shatter_parameters = []
    
    for i in range(len(points) - 1):
        
        #curve_segments.append(rs.AddLine(points[i], points[i + 1]))
        
        t = rs.CurveClosestPoint(curve, points[i])
        shatter_parameters.append(t)
    
    #Adjust t parameter domain to ensure nothing is segmented on the start and end of lines
    base_domain = comps.Bounds(shatter_parameters)
    target_domain = comps.ConstructDomain(0.05,0.95)

    #Remaps the domain
    
    remapped_shatter_parameters = comps.RemapNumbers(shatter_parameters,base_domain,target_domain)
    remapped_shatter_parameters = remapped_shatter_parameters['mapped']
    
    curve_segments = comps.Shatter(curve,remapped_shatter_parameters)
    curve_segments = curve_segments[1:-1]
    
    return curve_segments

def pick_shortest_crv(crv1,crv2):
    
    len_crv_1 = comps.Length(crv1)
    len_crv_2 = comps.Length(crv2)
    
    if len_crv_1 > len_crv_2:
        
        return crv2
    
    else:
        return crv1
    

print(type(crv1))
print(type(crv2))

#crv = pick_shortest_crv(crv1,crv2)

if bool == True:
    crv = crv1
else:
    crv = crv2
    


length = comps.Length(crv)


crvs_out = []
points_out = []
#length = rs.CurveLength(crv)

if length != None:
#Averages the curve to units. 
    num = round(length / facade_length,0)
    points = rs.DivideCurve(crv, num)
    
    for point in points:
        points_out.append(point)
    crvs_out.append(crv2)
# ---------- end python_2 ----------

# ----
toggle = BooleanToggle(False)
clean = CleanTree(RemoveNulls=True, RemoveInvalid=True, RemoveEmpty=toggle, Tree=python_2.points_out)
clean_2 = CleanTree(RemoveNulls=True, RemoveInvalid=True, RemoveEmpty=toggle, Tree=python_2.crvs_out)
crv = Curve(clean_2)
pt = Point(clean)
crv_cp = CurveClosestPoint(Point=pt, Curve=crv)  # -> Point, Parameter, Distance
pt_2 = Point(pt)
python_3 = GhPythonScript(points=pt_2, cls_points=crv_cp.Point, crvs=crv)  # -> vector2; inputs points: list of Point3d, cls_points: list of Point3d, crvs: Curve
# ---------- python_3: Python ----------
__author__ = "ilouh"
__version__ = "2023.02.21"

import rhinoscriptsyntax as rs
import Grasshopper as gh
import Rhino.Geometry as rg
import ghpythonlib.components as comps
import math

def rad2deg(rad):
    return rad*180/math.pi

P = []

pts = comps.EndPoints(crvs)
pt_start = pts['start']
pt_end = pts['end']

vector2 = comps.Vector2Pt(pt_start,pt_end,False)

print(len(points))
print(len(cls_points))

for i in range(0,len(points)):
    
    
    vector1 = comps.Vector2Pt(points[i],cls_points[i],False)
    print(vector1)
    
    dot_product = comps.Angle(vector1['vector'],vector2['vector'])
    print(dot_product)
    
    if dot_product['angle'] != None:
        dot_product_angle = rad2deg(dot_product['angle'])
    else:
        dot_product_angle = 0
    print(dot_product_angle)

    if dot_product_angle != 90:
        pass
    else:
        P.append(points[i])

print(len(P))

print(vector1)
vector1 = vector1['vector']
vector2 = vector2['vector']
# ---------- end python_3 ----------
python_4 = GhPythonScript(points=pt_2, cls_points=crv_cp.Point, vector2=python_3)  # -> cull_points, cull_cls_points, unit_outlines, demising_walls; inputs points: list, cls_points: list
# ---------- python_4: Python ----------
__author__ = "ilouh"
__version__ = "2023.02.21"

import rhinoscriptsyntax as rs
import Grasshopper as gh
import Rhino.Geometry as rg
import ghpythonlib.components as comps
import math
cull_points = []
cull_cls_points = []
vectors = []

for i in range(0,len(points)):
    vector1 = comps.Vector2Pt(points[i],cls_points[i],False)
    
    dot_product = comps.Angle(vector1['vector'],vector2)

    dot_product_angle = dot_product['angle']
    dot_product_angle = round(dot_product_angle *180 / math.pi,0)
    
    print(dot_product_angle)
    vectors.append(vector1)
    
    


    if int(dot_product_angle) == int(90):
         
        cull_points.append(points[i])
        cull_cls_points.append(cls_points[i])
    else:
        pass
        
        

unit_outlines = []

for i in range(0,len(cull_points)-1):
    
    li_points = [
        
        cull_points[i],
        cull_points[i+1],
        cull_cls_points[i+1],
        cull_cls_points[i]
        
        ]
    
    polyline = comps.PolyLine(li_points,True)
    
    unit_outlines.append(polyline)

demising_walls = []

for i in range(1,len(cull_points)-1):
    
    li_points = [
        
        cull_points[i],
        cull_cls_points[i]
        
        ]
    
    polyline = comps.PolyLine(li_points,True)
    
    demising_walls.append(polyline)
# ---------- end python_4 ----------
pt_3 = Point(python_4.cull_points)
crv_2 = Curve(simplify(python_4.unit_outlines))
sort_crv = SortDuplicateCurves(Curves=flatten(crv_2))  # -> UniqueCurves, Indices
item_2 = ListItem(List=crv_2, Index=0, Wrap=True)  # -> flatten(Item)
python_5 = GhPythonScript(surfaces=sort_crv.UniqueCurves)  # -> simplify(Typical_Units), Corner_Units, dic, areas, center_points, amount_of_units; inputs surfaces: list of Brep
# ---------- python_5: Python ----------
__author__ = "ilouh"
__version__ = "2023.02.21"

import rhinoscriptsyntax as rs
import Grasshopper as gh
import Rhino.Geometry as rg
import ghpythonlib.components as comps
import math

Typical_Units = [] 
Corner_Units = []
areas = []
center_points = []

areas_Corner_units = []
areas_Typical_units = []

dic = {}

i = 0 

for surface in surfaces:
    
    
    temp = comps.DeconstructBrep(surface)
    points = temp['vertices']
    
    
    unit_area = comps.Area(surface)
    
    unit_center = unit_area['centroid']
    
    
    unit_area = round(unit_area['area'],2)
    unit_number = 'Unit Number {}'.format(i)
    
    print(unit_area)
    
    if len(points) > 4: 
        
        unit_name = 'Corner Unit',
        unit_type = 'Two Bedroom',
        Corner_Units.append(surface)

        
    else:
        
        unit_name = 'Typical Unit',
        unit_type = 'One Bedroom',
        Typical_Units.append(surface)


    dic_temp = {

        'Unit Name':  unit_name,
        'Unit Area': unit_area,
        'Unit Number' : unit_number,
        'Unit Type' : unit_type

    }
    
    dic[unit_number] = dic_temp
    str = '{} \n {} sf'.format(unit_type,unit_area)
    areas.append(str)
    center_points.append(unit_center)
    
    i= i+1


amount_of_units = len(surfaces)
# ---------- end python_5 ----------
pt_4 = Point(python_4.cull_cls_points)
crv_3 = Curve(crv_2)
evalsrf = EvaluateSurface(Surface=reparameterize(item_2), Point="{0.5,0.5,0}")  # -> Point, Normal, UDirection, VDirection, Frame
debrep = DeconstructBrep(Brep=item_2)  # -> Faces, Edges, Vertices
dim = Dimensions(Surface=item_2)  # -> UDimension, VDimension
area = Area(Geometry=sort_crv.UniqueCurves)  # -> Area, Centroid
number_slider = Slider(4, range=0..100)
dist = Distance()
item_3 = ListItem(List=debrep.Edges, Index=0, Wrap=True)  # -> Item, Item1
linedim = LineDimension(Line=item_3.Item, Text="{0:0.00}", Size=number_slider)
linedim_2 = LineDimension(Line=item_3.Item1, Text="{0:0.00}", Size=number_slider)
Z = UnitZ(Factor=unit_height)
number_slider_2 = Slider(41, range=0..100)

flatten = FlattenTree(Tree=sort_crv.UniqueCurves, Path="{0}")
lng_2 = ListLength(List=flatten)
multiplication = Multiplication(A=lng_2, B=Slider(5, range=0..15))
merge = Merge(Data1=lng_2, Data2=multiplication)

lng_3 = ListLength(List=merge)
series = Series(Start=0, Step=expr("x*1.1", number_slider_2), Count=lng_3)
Y = UnitY(Factor=series)
pt_5 = Point(<point referenced from the Rhino model>)
move = Move(Geometry=pt_5, Motion=Y)  # -> Geometry, Transform

# ---- group: Get the lower face of a Brep
distributefaces = GhPythonScript()  # -> flatten(lower_face); inputs brep: Brep
# ---------- distributefaces: Python ----------
__author__ = "ilouh"
__version__ = "2023.01.08"

import rhinoscriptsyntax as rs
import ghpythonlib.components as comps
import Rhino.Geometry as geom

#elements = comps.DeconstructBrep(mass)
#faces = elements['faces']

#find the normal of each face


roof = []
floors = []
solidWalls = []
facadeWalls = [] 

faces = comps.DeconstructBrep(brep)
faces = faces['faces']

for face in faces: 
    
    #evaluate the normal of the sruface
    point = comps.ConstructPoint(0.5,0.5,0)
    evaluate_surface = comps.EvaluateSurface(face,point)
    normal = evaluate_surface['normal']
    
    values = comps.DeconstructVector(normal) 

    print(values)
    
    x_value = values['x_component']
    y_value = values['y_component']
    z_value = values['z_component']
    

    if z_value == -1:
        
        lower_face = face
# ---------- end distributefaces ----------

# ----
extr = Extrude(Base=flatten, Direction=Z)
tag = TextTag3D(Location=move.Geometry, Text=merge, Size=number_slider_2, Justification=7)
cap = CapHoles(Brep=extr)
brep = Brep()
preview = CustomPreview(Geometry=brep, Material=ColourSwatch(SwatchColor=RGBA(62, 193, 255, 48)))
