# Grasshopper definition Program_Units 0.5.2 WIP.gh (Grasshopper 1.0.7)
# plug-ins: LunchBox

pipeline = GeometryPipeline(
    GroupByLayer=False,
    GroupByType=False,
    IncludeHidden=True,
    IncludeLocked=True,
    LayerFilter="05_DRAFTING*05_LW04 - Residential",
    NameFilter="*",
    SublayerFiltering=True,
    TypeFilter=4)
path_curve = Curve(reparameterize(simplify(graft(pipeline))))
list = ValueList({"One": 0, "Two": 1, "Three": 2}, selected="One")
unit_layout_type_a = Curve([<curve referenced from the Rhino model> x2])
unit_layout_type_b = Curve([<curve referenced from the Rhino model> x18])
unit_layout_type_c = Curve([<curve referenced from the Rhino model> x11])
filter = StreamFilter(Gate=list, Stream0=unit_layout_type_a, Stream1=unit_layout_type_b, Stream2=unit_layout_type_c)
crv = Curve(graft([<curve referenced from the Rhino model> x6]))

offset = OffsetCurve(Curve=crv, Distance=Slider(65, range=0..100), Corners=1)
flip = FlipCurve(Curve=offset)  # -> Curve, Flag
merge = Merge(Data1=flip.Curve, Data2=crv)

unit_area = DigitScroller(Scroller_Digits=12, Scroller_Prefix="Unit Area", Scroller_Radix=9, Scroller_Value=850)
unit_width = DigitScroller(Scroller_Digits=12, Scroller_Prefix="Unit Width", Scroller_Radix=9, Scroller_Value=30)
unit_length = DigitScroller(Scroller_Digits=12, Scroller_Prefix="Unit Length", Scroller_Radix=9, Scroller_Value=20)
unit_height = DigitScroller(Scroller_Digits=12, Scroller_Prefix="Unit Height", Scroller_Radix=9, Scroller_Value=9)
true_by_unit_length_false_by_unit_area = BooleanToggle(False)
true_inboard_false_outboard = BooleanToggle(True)
explode = Explode(Curve=merge, Recursive=True)  # -> Segments, Vertices

python = GhPythonScript(bool=true_inboard_false_outboard)  # -> coef
# ---------- python: Python ----------
__author__ = "ilouh"
__version__ = "2023.02.21"

import rhinoscriptsyntax as rs
import Grasshopper as gh
import Rhino.Geometry as rg
import ghpythonlib.components as comps
import math

if bool == True: 
    
    coef = 1

else:
    
    coef = -1
# ---------- end python ----------
expression = Expression(Unit_Length=unit_length, coef=python, Expression="coef * Unit_Length")
expression_2 = Expression(Unit_Area=unit_area, Unit_Width=unit_width, coef=python, Expression="coef * Ceiling(Unit_Area/Unit_Width)")

filter_2 = StreamFilter(Gate=true_by_unit_length_false_by_unit_area, Stream0=expression_2, Stream1=expression)
offset_2 = OffsetCurve(Curve=merge, Distance=expr("-x", filter_2), Corners=1)
flatten = FlattenTree(Tree=merge, Path="{0}")

# ---- group: Creates a script to subdivide a curve into units
python_2 = GhPythonScript(crv1=simplify(graft(flatten)), facade_length=unit_width, crv2=simplify(graft(offset_2)), bool=Toggle(True))  # -> simplify(points_out), simplify(crvs_out)
# ---------- python_2: Python ----------
__author__ = "ilouh"
__version__ = "2022.12.10"

import rhinoscriptsyntax as rs
import ghpythonlib.components as comps

def subdivide_curve(curve, num_subdivisions):

    # Use the DivideCurve function to perform the subdivision
    points = rs.DivideCurve(curve, num_subdivisions)
    
    curve_segments = []
    shatter_parameters = []
    
    for i in range(len(points) - 1):
        
        #curve_segments.append(rs.AddLine(points[i], points[i + 1]))
        
        t = rs.CurveClosestPoint(curve, points[i])
        shatter_parameters.append(t)
    
    #Adjust t parameter domain to ensure nothing is segmented on the start and end of lines
    base_domain = comps.Bounds(shatter_parameters)
    target_domain = comps.ConstructDomain(0.05,0.95)

    #Remaps the domain
    
    remapped_shatter_parameters = comps.RemapNumbers(shatter_parameters,base_domain,target_domain)
    remapped_shatter_parameters = remapped_shatter_parameters['mapped']
    
    curve_segments = comps.Shatter(curve,remapped_shatter_parameters)
    curve_segments = curve_segments[1:-1]
    
    return curve_segments

def pick_shortest_crv(crv1,crv2):
    
    len_crv_1 = comps.Length(crv1)
    len_crv_2 = comps.Length(crv2)
    
    if len_crv_1 > len_crv_2:
        
        return crv2
    
    else:
        return crv1
    

print(type(crv1))
print(type(crv2))

#crv = pick_shortest_crv(crv1,crv2)

if bool == True:
    crv = crv1
else:
    crv = crv2
    


length = comps.Length(crv)


crvs_out = []
points_out = []
#length = rs.CurveLength(crv)

if length != None:
#Averages the curve to units. 
    num = round(length / facade_length,0)
    points = rs.DivideCurve(crv, num)
    
    for point in points:
        points_out.append(point)
    crvs_out.append(crv2)
# ---------- end python_2 ----------

# ----
pt = Point(python_2.points_out)
crv_cp = CurveClosestPoint(Point=pt, Curve=python_2.crvs_out)  # -> Point, Parameter, Distance
ln = Line(StartPoint=pt, EndPoint=crv_cp.Point)

crv_cp_2 = CurveClosestPoint(Point=pt, Curve=graft(flatten))  # -> Point, Parameter, Distance
hframe = HorizontalFrame(Curve=graft(flatten), Parameter=crv_cp_2.Parameter)
deplane = DeconstructPlane(Plane=hframe)  # -> Origin, XAxis, YAxis, ZAxis

python_3 = GhPythonScript(points=pt, cls_points=crv_cp.Point, crvs=ln, vector1=deplane.XAxis)  # -> vector2, angled_walls, straight_walls; inputs points: list of Point3d, cls_points: list of Point3d, crvs: list of Curve, vector1: list of Vector3d
# ---------- python_3: Python ----------
__author__ = "ilouh"
__version__ = "2023.02.21"

import rhinoscriptsyntax as rs
import Grasshopper as gh
import Rhino.Geometry as rg
import ghpythonlib.components as comps
import math



# Function to convert radians to degrees
def deg2rad(rad):
    return 180 / rad

P = []  # List to store points
straight_walls = [] 
angled_walls = []

# Loop through the points
for i in range(len(points)):
    
    
    pts = comps.EndPoints(crvs[i])  # Get start and end points of curves
    pt_start = pts['start']
    pt_end = pts['end']


    vector2 = comps.Vector2Pt(pt_start, pt_end, False)  # Calculate vector2
    #vector1 = comps.Vector2Pt(points[i], cls_points[i], False)  # Calculate vector1
    #print(vector2)
    
    dot_product = comps.Angle(vector1[i], vector2['vector'])  # Calculate dot product
    print(dot_product)

    
    if dot_product['angle'] is not None:
        dot_product_angle = math.degrees(dot_product['angle']) 
        straight_walls.append(crvs[i])
        print(dot_product_angle)
        # Convert angle to degrees
    else:
        dot_product_angle = 0
        

    # Check if the dot product angle is not 90 degrees
    if round(dot_product_angle) != float(90):
        pass
        angled_walls.append(crvs[i])
    else:
        P.append(points[i])  # Add the point to the list

#print(len(P))

#print(vector1)
vector2 = vector2['vector']
# ---------- end python_3 ----------
number_slider = Slider(4, range=0..100)
dist = Distance()
crv_2 = Curve(python_3.straight_walls)
crv_3 = Curve(python_3.angled_walls)
panel = Panel(python_3.vector2)
python_4 = GhPythonScript(points=pt, cls_points=crv_cp.Point, vector2=python_3.vector2)  # -> cull_points, cull_cls_points, unit_outlines, demising_walls; inputs points: list, cls_points: list
# ---------- python_4: Python ----------
__author__ = "ilouh"
__version__ = "2023.02.21"

import rhinoscriptsyntax as rs
import Grasshopper as gh
import Rhino.Geometry as rg
import ghpythonlib.components as comps
import math

cull_points = []          # List to store points that meet the condition
cull_cls_points = []      # List to store corresponding cls_points
vectors = []              # List to store vectors

# Loop through the points
for i in range(0, len(points)):
    # Calculate vector1 using comps.Vector2Pt function
    vector1 = comps.Vector2Pt(points[i], cls_points[i], False)
    
    # Calculate dot product between vector1 and vector2
    dot_product = comps.Angle(vector1['vector'], vector2)
    
    # Retrieve the angle from the dot_product result
    dot_product_angle = dot_product['angle']
    
    # Convert the angle to degrees and round it
    dot_product_angle = round(dot_product_angle * 180 / math.pi, 0)
    
    print(dot_product_angle)  # Print the angle
    vectors.append(vector1)   # Append vector1 to the list of vectors
    
    # Check if the angle is approximately 90 degrees
    if int(dot_product_angle) == int(90):
        # If the angle is 90 degrees, add the points to the cull lists
        cull_points.append(points[i])
        cull_cls_points.append(cls_points[i])
    else:
        pass

unit_outlines = []  # List to store unit outlines

# Loop through the cull_points (excluding the last one)
for i in range(0, len(cull_points) - 1):
    # Create a list of points for the polyline
    li_points = [
        cull_points[i],
        cull_points[i + 1],
        cull_cls_points[i + 1],
        cull_cls_points[i]
    ]
    
    # Create a polyline using comps.PolyLine function
    polyline = comps.PolyLine(li_points, True)
    
    # Append the polyline to the unit_outlines list
    unit_outlines.append(polyline)

demising_walls = []  # List to store demising walls

# Loop through the cull_points (excluding the first and last ones)
for i in range(1, len(cull_points) - 1):
    # Create a list of points for the polyline
    li_points = [
        cull_points[i],
        cull_cls_points[i]
    ]
    
    # Create a polyline using comps.PolyLine function
    polyline = comps.PolyLine(li_points, True)
    
    # Append the polyline to the demising_walls list
    demising_walls.append(polyline)
# ---------- end python_4 ----------

# ---- group: Get the lower face of a Brep
distributefaces = GhPythonScript()  # -> flatten(lower_face); inputs brep: Brep
# ---------- distributefaces: Python ----------
__author__ = "ilouh"
__version__ = "2023.01.08"

import rhinoscriptsyntax as rs
import ghpythonlib.components as comps
import Rhino.Geometry as geom

#elements = comps.DeconstructBrep(mass)
#faces = elements['faces']

#find the normal of each face


roof = []
floors = []
solidWalls = []
facadeWalls = [] 

faces = comps.DeconstructBrep(brep)
faces = faces['faces']

for face in faces: 
    
    #evaluate the normal of the sruface
    point = comps.ConstructPoint(0.5,0.5,0)
    evaluate_surface = comps.EvaluateSurface(face,point)
    normal = evaluate_surface['normal']
    
    values = comps.DeconstructVector(normal) 

    print(values)
    
    x_value = values['x_component']
    y_value = values['y_component']
    z_value = values['z_component']
    

    if z_value == -1:
        
        lower_face = face
# ---------- end distributefaces ----------

# ----
crv_4 = Curve(simplify(python_4.unit_outlines))
item = ListItem(List=crv_4, Index=0, Wrap=True)  # -> flatten(Item)
evalsrf = EvaluateSurface(Surface=reparameterize(item), Point="{0.5,0.5,0}")  # -> Point, Normal, UDirection, VDirection, Frame
debrep = DeconstructBrep(Brep=item)  # -> Faces, Edges, Vertices
dim = Dimensions(Surface=item)  # -> UDimension, VDimension
item_2 = ListItem(List=debrep.Edges, Index=0, Wrap=True)  # -> Item, Item1
linedim = LineDimension(Line=item_2.Item, Text="{0:0.00}", Size=number_slider)
linedim_2 = LineDimension(Line=item_2.Item1, Text="{0:0.00}", Size=number_slider)
sort_crv = SortDuplicateCurves(Curves=flatten(crv_4))  # -> UniqueCurves, Indices
python_5 = GhPythonScript(surfaces=sort_crv.UniqueCurves)  # -> simplify(Typical_Units), Corner_Units, dic, areas, center_points, amount_of_units; inputs surfaces: list of Brep
# ---------- python_5: Python ----------
__author__ = "ilouh"
__version__ = "2023.02.21"

import rhinoscriptsyntax as rs
import Grasshopper as gh
import Rhino.Geometry as rg
import ghpythonlib.components as comps
import math

Typical_Units = [] 
Corner_Units = []
areas = []
center_points = []

areas_Corner_units = []
areas_Typical_units = []

dic = {}

i = 0 

for surface in surfaces:
    
    
    temp = comps.DeconstructBrep(surface)
    points = temp['vertices']
    
    
    unit_area = comps.Area(surface)
    
    unit_center = unit_area['centroid']
    
    
    unit_area = round(unit_area['area'],2)
    unit_number = 'Unit Number {}'.format(i)
    
    print(unit_area)
    
    if len(points) > 4: 
        
        unit_name = 'Corner Unit',
        unit_type = 'Two Bedroom',
        Corner_Units.append(surface)

        
    else:
        
        unit_name = 'Typical Unit',
        unit_type = 'One Bedroom',
        Typical_Units.append(surface)


    dic_temp = {

        'Unit Name':  unit_name,
        'Unit Area': unit_area,
        'Unit Number' : unit_number,
        'Unit Type' : unit_type

    }
    
    dic[unit_number] = dic_temp
    str = '{} \n {} sf'.format(unit_type,unit_area)
    areas.append(str)
    center_points.append(unit_center)
    
    i= i+1


amount_of_units = len(surfaces)
# ---------- end python_5 ----------
pt_2 = Point(python_4.cull_points)
pt_3 = Point(python_4.cull_cls_points)
crv_5 = Curve(crv_4)
number_slider_2 = Slider(5, range=0..15)
area = Area(Geometry=sort_crv.UniqueCurves)  # -> Area, Centroid
area_2 = Area(Geometry=crv_4)  # -> Area, Centroid
flatten_2 = FlattenTree(Tree=area_2.Area, Path="{0}")
number_slider_3 = Slider(41, range=0..100)
ma = MassAddition(Input=flatten_2)  # -> Result, PartialResults
Z = UnitZ(Factor=unit_height)
multiplication = Multiplication(A=ma.Result, B=number_slider_2)

flatten_3 = FlattenTree(Tree=sort_crv.UniqueCurves, Path="{0}")
lng = ListLength(List=flatten_3)
multiplication_2 = Multiplication(A=lng, B=number_slider_2)
merge_2 = Merge(Data1=lng, Data2=multiplication_2, Data3=multiplication)

extr = Extrude(Base=flatten_3, Direction=Z)

lng_2 = ListLength(List=merge_2)
series = Series(Start=0, Step=expr("x*1.1", number_slider_3), Count=lng_2)
Y = UnitY(Factor=series)
pt_4 = Point(<point referenced from the Rhino model>)
move = Move(Geometry=pt_4, Motion=Y)  # -> Geometry, Transform

cap = CapHoles(Brep=extr)
tag = TextTag3D(Location=move.Geometry, Text=merge_2, Size=number_slider_3, Justification=7)
brep = Brep()
preview = CustomPreview(Geometry=brep, Material=ColourSwatch(SwatchColor=RGBA(62, 193, 255, 48)))
