# Grasshopper definition Program_Units 0.5.3 WIP.gh (Grasshopper 1.0.7)

pipeline = GeometryPipeline(
    GroupByLayer=False,
    GroupByType=False,
    IncludeHidden=True,
    IncludeLocked=True,
    LayerFilter="05_DRAFTING*05_LW04 - Residential",
    NameFilter="*",
    SublayerFiltering=True,
    TypeFilter=4)
list = ValueList({"One": 0, "Two": 1, "Three": 2}, selected="One")
unit_layout_type_a = Curve([<curve referenced from the Rhino model> x2])
unit_layout_type_b = Curve([<curve referenced from the Rhino model> x18])
unit_layout_type_c = Curve([<curve referenced from the Rhino model> x11])
path_curve = Curve(reparameterize(simplify(graft(pipeline))))
filter = StreamFilter(Gate=list, Stream0=unit_layout_type_a, Stream1=unit_layout_type_b, Stream2=unit_layout_type_c)
corridor_depth = Slider(8, range=5..10)
unit_area = DigitScroller(Scroller_Digits=12, Scroller_Prefix="Unit Area", Scroller_Radix=9, Scroller_Value=850)
unit_width = DigitScroller(Scroller_Digits=12, Scroller_Prefix="Unit Width", Scroller_Radix=9, Scroller_Value=25)
unit_length = DigitScroller(Scroller_Digits=12, Scroller_Prefix="Unit Length", Scroller_Radix=9, Scroller_Value=40)
unit_height = DigitScroller(Scroller_Digits=12, Scroller_Prefix="Unit Height", Scroller_Radix=9, Scroller_Value=9)
true_by_unit_length_false_by_unit_area = BooleanToggle(False)
true_inboard_false_outboard = BooleanToggle(False)
crv = Curve(graft(path_curve))

# ---- group: creates the curve offsets for units
python = GhPythonScript(
    guide_crv=crv,
    corridor_depth=corridor_depth,
    unit_area=unit_area,
    unit_width=unit_width,
    unit_length=unit_length,
    bool_calc=true_by_unit_length_false_by_unit_area,
    bool_dir=true_inboard_false_outboard)  # -> outer_curves, inner_curves; inputs guide_crv: Curve
# ---------- python: Python ----------
__author__ = "ilouh"
__version__ = "2023.02.21"

import rhinoscriptsyntax as rs
import Grasshopper as gh
import Rhino.Geometry as rg
import ghpythonlib.components as comps
import math


#Set the directionality of the curves 
#set up if the unit depth is calculated by reuiqred area or by preset depth

if bool_dir is True:
    coef = 1
else:
    coef = -1
    

if bool_calc is False:
    unit_depth = coef * math.ceil(unit_area/unit_width)
else:
    unit_depth = coef * unit_length

#__________________________________________________

offest_lengths = [

    0,
    unit_depth,
    unit_depth+corridor_depth,
    2*unit_depth + corridor_depth

]

curves = comps.OffsetCurve(guide_crv,offest_lengths, corners = 1)

#due to directionality the order of the list changes, therefore the if 
#condition

if bool_dir is False:
    
    outer_curves = [curves[0],curves[2]]
    outer_curves[1] = comps.FlipCurve(outer_curves[1])
    outer_curves[1] = outer_curves[1]['curve']
    
    inner_curves = [curves[1],curves[3]]
    inner_curves[1] = comps.FlipCurve(inner_curves[1])
    inner_curves[1] = inner_curves[1]['curve']

else:
    
    outer_curves = [curves[2],curves[3]]
    outer_curves[1] = comps.FlipCurve(outer_curves[1])
    outer_curves[1] = outer_curves[1]['curve']
    
    inner_curves = [curves[0],curves[1]]
    inner_curves[1] = comps.FlipCurve(inner_curves[1])
    inner_curves[1] = inner_curves[1]['curve']
# ---------- end python ----------

# ----
crv_2 = Curve(simplify(python.outer_curves))
crv_3 = Curve(simplify(python.inner_curves))
item = ListItem(List=crv_2, Index=0, Wrap=True)  # -> Item, Item1

# ---- group: curve subdivision per units dim
python_2 = GhPythonScript(outer_curve=simplify(graft(item.Item)), unit_width=unit_width, inner_curve=simplify(graft(item.Item1)))  # -> simplify(outter_points), simplify(inner_points)
# ---------- python_2: Python ----------
__author__ = "ilouh"
__version__ = "2022.12.10"

import rhinoscriptsyntax as rs
import Grasshopper as gh
import Rhino.Geometry as rg
import ghpythonlib.components as comps
import math

def subdivide_curve(curve,unit_width):

    # Use the DivideCurve function to perform the subdivision
    points = comps.DivideDistance(curve,unit_width)
    points = comps.DivideCurve(curve,len(points['points']),kinks = True)
    
    return points['points']



#goal is to subdivide the curve into points appx per the width of a unit
outter_points = subdivide_curve(outer_curve,unit_width)

#find closest points
inner_points = comps.CurveClosestPoint(outter_points,inner_curve)
inner_points = inner_points['point']
# ---------- end python_2 ----------

# ---- group: Get the X vector at each point
crv_cp = CurveClosestPoint(Point=python_2.outter_points, Curve=item.Item)  # -> Point, Parameter, Distance
hframe = HorizontalFrame(Curve=graft(item.Item), Parameter=crv_cp.Parameter)
deplane = DeconstructPlane(Plane=hframe)  # -> Origin, XAxis, YAxis, ZAxis

# ----
pt = Point(python_2.outter_points)
pt_2 = Point(python_2.inner_points)

# ---- group: creates perpendicular dem walls
python_3 = GhPythonScript(outter_points=pt, inner_points=pt_2, vector1=deplane.XAxis)  # -> angled_walls, simplify(straight_walls); inputs outter_points: list of Point3d, inner_points: list of Point3d, vector1: list of Vector3d
# ---------- python_3: Python ----------
__author__ = "ilouh"
__version__ = "2023.02.21"

import rhinoscriptsyntax as rs
import Grasshopper as gh
import Rhino.Geometry as rg
import ghpythonlib.components as comps
import math



# Function to convert radians to degrees
def deg2rad(rad):
    return 180 / rad



P = []  # List to store points
straight_walls = [] 
angled_walls = []

# Loop through the points
for i in range(len(outter_points)):
    
    
    pt_start = outter_points[i] 
    pt_end = inner_points[i]

    crv = comps.Line(pt_start,pt_end)
    
    vector2 = comps.Vector2Pt(pt_start, pt_end, False)  # Calculate vector2
    
    dot_product = comps.Angle(vector1[i], vector2['vector'])  # Calculate dot product
    print(dot_product)

    
    if dot_product['angle'] is not None:
        dot_product_angle = math.degrees(dot_product['angle']) 
        
        if round(dot_product_angle) == float(90):
            straight_walls.append(crv)
            print(dot_product_angle)
            print('straight wall')
        # Convert angle to degrees
    else:
        dot_product_angle = 0
        

    # Check if the dot product angle is not 90 degrees
    if round(dot_product_angle) != float(90):
        pass
        angled_walls.append(crv)
        print('angled wall')
    else:
        P.append(outter_points[i])  # Add the point to the list

#print(len(P))

#print(vector1)
vector2 = vector2['vector']
# ---------- end python_3 ----------

# ---- group: creates a surface to be divided to units
python_4 = GhPythonScript(outer_curve=item.Item, inner_curve=item.Item1)  # -> srf; inputs outer_curve: Curve, inner_curve: Curve
# ---------- python_4: Python ----------
__author__ = "ilouh"
__version__ = "2023.02.21"

import rhinoscriptsyntax as rs
import Grasshopper as gh
import Rhino.Geometry as rg
import ghpythonlib.components as comps
import math


inner_curve = comps.FlipCurve(inner_curve,outer_curve)
inner_curve = inner_curve['curve']


if comps.Closed(outer_curve) is True: 
    srf = comps.BoundarySurfaces([outer_curve,inner_curve])

else:
    
    pts_outer = comps.EndPoints(outer_curve)
    pts_inner = comps.EndPoints(inner_curve)
    
    pts_outer_start = pts_outer['start']
    pts_outer_end = pts_outer['end']
    
    pts_inner_start = pts_inner['start']
    pts_inner_end = pts_inner['end']
    
    
    start_line = comps.Line(pts_outer_start,pts_inner_start)
    end_line = comps.Line(pts_outer_end,pts_inner_end)

    
    print(start_line)
    
    srf = comps.BoundarySurfaces([
        outer_curve,
        start_line,
        end_line,
        inner_curve])


    
    #srf = comps.BoundarySurfaces([outer_curve,inner_curve])

    #loft_option = comps.LoftOptions(True,True,0,0,0)
    #srf = comps.Loft([outer_curve,inner_curve],loft_option)
# ---------- end python_4 ----------

# ----
crv_4 = Curve(reparameterize(python_3.straight_walls))
srfsplit = SurfaceSplit(Surface=python_4, Curves=crv_4)
python_5 = GhPythonScript(units=simplify(srfsplit))  # inputs units: list; unedited script template
item_2 = ListItem(Index=0, Wrap=True)  # -> flatten(Item)
evalsrf = EvaluateSurface(Surface=reparameterize(item_2), Point="{0.5,0.5,0}")  # -> Point, Normal, UDirection, VDirection, Frame
debrep = DeconstructBrep(Brep=item_2)  # -> Faces, Edges, Vertices
dim = Dimensions(Surface=item_2)  # -> UDimension, VDimension
number_slider = Slider(4, range=0..100)
dist = Distance()
item_3 = ListItem(List=debrep.Edges, Index=0, Wrap=True)  # -> Item, Item1
linedim = LineDimension(Line=item_3.Item, Text="{0:0.00}", Size=number_slider)
linedim_2 = LineDimension(Line=item_3.Item1, Text="{0:0.00}", Size=number_slider)

# ---- group: Get the lower face of a Brep
distributefaces = GhPythonScript()  # -> flatten(lower_face); inputs brep: Brep
# ---------- distributefaces: Python ----------
__author__ = "ilouh"
__version__ = "2023.01.08"

import rhinoscriptsyntax as rs
import ghpythonlib.components as comps
import Rhino.Geometry as geom

#elements = comps.DeconstructBrep(mass)
#faces = elements['faces']

#find the normal of each face


roof = []
floors = []
solidWalls = []
facadeWalls = [] 

faces = comps.DeconstructBrep(brep)
faces = faces['faces']

for face in faces: 
    
    #evaluate the normal of the sruface
    point = comps.ConstructPoint(0.5,0.5,0)
    evaluate_surface = comps.EvaluateSurface(face,point)
    normal = evaluate_surface['normal']
    
    values = comps.DeconstructVector(normal) 

    print(values)
    
    x_value = values['x_component']
    y_value = values['y_component']
    z_value = values['z_component']
    

    if z_value == -1:
        
        lower_face = face
# ---------- end distributefaces ----------

# ----
number_slider_2 = Slider(5, range=0..15)
number_slider_3 = Slider(41, range=0..100)
ma = MassAddition()  # -> Result, PartialResults
Z = UnitZ(Factor=unit_height)
multiplication = Multiplication(A=ma.Result, B=number_slider_2)

flatten = FlattenTree(Path="{0}")
lng = ListLength(List=flatten)
multiplication_2 = Multiplication(A=lng, B=number_slider_2)
merge = Merge(Data1=lng, Data2=multiplication_2, Data3=multiplication)

extr = Extrude(Base=flatten, Direction=Z)

lng_2 = ListLength(List=merge)
series = Series(Start=0, Step=expr("x*1.1", number_slider_3), Count=lng_2)
Y = UnitY(Factor=series)
pt_3 = Point(<point referenced from the Rhino model>)
move = Move(Geometry=pt_3, Motion=Y)  # -> Geometry, Transform

cap = CapHoles(Brep=extr)
tag = TextTag3D(Location=move.Geometry, Text=merge, Size=number_slider_3, Justification=7)
brep = Brep()
preview = CustomPreview(Geometry=brep, Material=ColourSwatch(SwatchColor=RGBA(62, 193, 255, 48)))
