# Grasshopper definition Site_TopographyFromPointsAndLines.gh (Grasshopper 1.0.7)
# plug-ins: TT Toolbox

pt = Point()
crv = Curve([<curve referenced from the Rhino model> x5000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])
disc = Discontinuity(Curve=crv, Level=1)  # -> Points, Parameters
disc_2 = Discontinuity(Curve=crv, Level=1)  # -> flatten(Points), Parameters
lng = ListLength(List=disc.Points)
panel = Panel(lng)
graft = GraftTree(Tree=crv, IncludeEmptyLists=True, IncludeNullItems=True)
expression = Expression(x=lng, y=Slider(0.5, range=0..1), Expression="(x*y)+1")
reb = RebuildCurve(Curve=graft, Degree=Slider(2, range=0..10), Count=expression, Tangents=False)
disc_3 = Discontinuity(Curve=reb, Level=1)  # -> flatten(Points), Parameters
cullduppoints = RemoveDuplicatePoints(InputPoints=disc_3.Points, Tolerance=0.001)  # -> OutputPoints, FirstPointIndexes
patch = Patch(Spans=20, Flexibility=1, Trim=True)
del = DelaunayMesh(Points=cullduppoints.OutputPoints, Plane=PlaneXY(0, 0, 0))
