# Grasshopper definition UnitOutlines 0.1.1.gh (Grasshopper 1.0.7)

building_outline = Curve(<curve referenced from the Rhino model>)
corridor = Curve(<curve referenced from the Rhino model>)
end = EndPoints(Curve=corridor)  # -> Start, End
explode = Explode(Curve=building_outline, Recursive=True)  # -> Segments, Vertices
cluster = Cluster(L=explode.Segments, P=end.Start, P_2=end.End, C=explode.Segments)
bldg_long_walls = Curve(cluster)
item = ListItem(List=bldg_long_walls, Index=0, Wrap=True)  # -> Item, Item1
bldg_crv_1 = Curve(item.Item1)
explode_2 = Explode(Curve=bldg_crv_1, Recursive=True)  # -> Segments, Vertices
python = GhPythonScript(crv=explode_2.Segments, facade_length=Slider(25, range=0..100))  # -> a, points; inputs crv: Curve
# ---------- python: Python ----------
__author__ = "ilouh"
__version__ = "2022.12.10"

import rhinoscriptsyntax as rs
import ghpythonlib.components as comps

def subdivide_curve(curve, num_subdivisions):

    # Use the DivideCurve function to perform the subdivision
    points = rs.DivideCurve(curve, num_subdivisions)
    
    curve_segments = []
    shatter_parameters = []
    
    for i in range(len(points) - 1):
        
        #curve_segments.append(rs.AddLine(points[i], points[i + 1]))
        
        t = rs.CurveClosestPoint(curve, points[i])
        shatter_parameters.append(t)
        
    curve_segments = comps.Shatter(curve,shatter_parameters)

    return curve_segments


length = rs.CurveLength(crv)

num = round(length / facade_length,0)
a = subdivide_curve(crv,num)
points = rs.DivideCurve(crv, num)
# ---------- end python ----------

# ==== cluster Cluster
P = ClusterInput()
C = ClusterInput()
crv_cp = CurveClosestPoint(Point=P, Curve=C)  # -> Point, Parameter, Distance
L = ClusterInput()
larger = LargerThan(FirstNumber=crv_cp.Distance, SecondNumber=0.001)  # -> LargerThan, OrEqualTo
P_2 = ClusterInput()
cull = CullPattern(List=L, CullPattern=larger.OrEqualTo)
crv_cp_2 = CurveClosestPoint(Point=P_2, Curve=cull)  # -> Point, Parameter, Distance
larger_2 = LargerThan(FirstNumber=crv_cp_2.Distance, SecondNumber=0.001)  # -> LargerThan, OrEqualTo
cull_2 = CullPattern(List=cull, CullPattern=larger_2.OrEqualTo)
join = JoinCurves(Curves=cull_2, Preserve=False)
C_2 = ClusterOutput(join)
