# Grasshopper definition Finalized_Design_Script 0.1.0.gh (Grasshopper 1.0.7)
# plug-ins: Speckle 2

# ---- group: comm_glass
input = DataInput(
    Destination="G:\My Drive\Scripting Repository\Exchange Data\Facade_comm_glass.ghdata",
    RelativePath="G:\My Drive\Scripting Repository\Exchange Data\Facade_comm_glass.ghdata|..\..\Exchange Data\Facade_comm_glass.ghdata",
    UpdateDelay=50000)

# ---- group: comm_mullions
input_2 = DataInput(
    Destination="G:\My Drive\Scripting Repository\Exchange Data\Facade_comm_mullions.ghdata",
    RelativePath="G:\My Drive\Scripting Repository\Exchange Data\Facade_comm_mullions.ghdata|..\..\Exchange Data\Facade_comm_mullions.ghdata",
    UpdateDelay=50000)

# ---- group: comm_floors
input_3 = DataInput(
    Destination="G:\My Drive\Scripting Repository\Exchange Data\Floors_comm.ghdata",
    RelativePath="G:\My Drive\Scripting Repository\Exchange Data\Floors_comm.ghdata|..\..\Exchange Data\Floors_comm.ghdata",
    UpdateDelay=50000)

# ---- group: comm_roof
input_4 = DataInput(
    Destination="G:\My Drive\Scripting Repository\Exchange Data\Roof_comm.ghdata",
    RelativePath="G:\My Drive\Scripting Repository\Exchange Data\Roof_comm.ghdata|..\..\Exchange Data\Roof_comm.ghdata",
    UpdateDelay=50000)

# ---- group: resi_floors
input_5 = DataInput(
    Destination="G:\My Drive\Scripting Repository\Exchange Data\Floors_resi.ghdata",
    RelativePath="G:\My Drive\Scripting Repository\Exchange Data\Floors_resi.ghdata|..\..\Exchange Data\Floors_resi.ghdata",
    UpdateDelay=50000)

# ---- group: resi_roof
input_6 = DataInput(
    Destination="G:\My Drive\Scripting Repository\Exchange Data\Roof_resi.ghdata",
    RelativePath="G:\My Drive\Scripting Repository\Exchange Data\Roof_resi.ghdata|..\..\Exchange Data\Roof_resi.ghdata",
    UpdateDelay=50000)

# ---- group: resi_panels
input_7 = DataInput(
    Destination="G:\My Drive\Scripting Repository\Exchange Data\Facade_Resi_Detailed.ghdata",
    RelativePath="G:\My Drive\Scripting Repository\Exchange Data\Facade_Resi_Detailed.ghdata|..\..\Exchange Data\Facade_Resi_Detailed.ghdata",
    UpdateDelay=50000)

# ----
input_8 = DataInput(
    Destination="G:\My Drive\Scripting Repository\Exchange Data\OpenSpace_Lot.ghdata",
    RelativePath="G:\My Drive\Scripting Repository\Exchange Data\OpenSpace_Lot.ghdata|..\..\Exchange Data\OpenSpace_Lot.ghdata",
    UpdateDelay=50000)
input_9 = DataInput(
    Destination="G:\My Drive\Scripting Repository\Exchange Data\Setbacks.ghdata",
    RelativePath="G:\My Drive\Scripting Repository\Exchange Data\Setbacks.ghdata|..\..\Exchange Data\Setbacks.ghdata",
    UpdateDelay=50000)
input_10 = DataInput(
    Destination="G:\My Drive\Scripting Repository\Exchange Data\UndergroundParking.ghdata",
    RelativePath="G:\My Drive\Scripting Repository\Exchange Data\UndergroundParking.ghdata|..\..\Exchange Data\UndergroundParking.ghdata",
    UpdateDelay=50000)
preview = CustomPreview(Geometry=input_5, Material=ColourSwatch(SwatchColor=RGB(255, 255, 255)))
preview_2 = CustomPreview(Geometry=input_6, Material=ColourSwatch(SwatchColor=RGB(132, 140, 119)))
preview_3 = CustomPreview(Geometry=input_7, Material=ColourSwatch(SwatchColor=RGB(25, 123, 93)))
preview_4 = CustomPreview(Geometry=input_8, Material=ColourSwatch(SwatchColor=RGB(19, 232, 119)))
preview_5 = CustomPreview(
    Geometry=input_9,
    Material={diffuse=RGB(221, 160, 221), emission=RGB(66, 48, 66), shine=0.5, specular=RGB(255, 255, 255), transparency=0})  # disabled
preview_6 = CustomPreview(Geometry=input_10, Material=ColourSwatch(SwatchColor=RGB(25, 123, 93)))
preview_7 = CustomPreview(Geometry=input, Material=ColourSwatch(SwatchColor=RGBA(97, 208, 192, 164)))
preview_8 = CustomPreview(Geometry=input_2, Material=ColourSwatch(SwatchColor=RGB(39, 39, 41)))
preview_9 = CustomPreview(Geometry=input_3, Material=ColourSwatch(SwatchColor=RGB(255, 255, 255)))
preview_10 = CustomPreview(Geometry=input_4, Material=ColourSwatch(SwatchColor=RGB(132, 140, 119)))
ungroup = Ungroup(Group=input_7)
ungroup_2 = Ungroup(Group=ungroup)
cso = CreateSpeckleObject(A=simplify(input), selectedKitName="Objects")
cso_2 = CreateSpeckleObject(A=simplify(input_2), selectedKitName="Objects")
cso_3 = CreateSpeckleObject(A=simplify(input_3), selectedKitName="Objects")
cso_4 = CreateSpeckleObject(A=simplify(input_4), selectedKitName="Objects")
cso_5 = CreateSpeckleObject(A=simplify(input_5), selectedKitName="Objects")
cso_6 = CreateSpeckleObject(A=simplify(input_6), selectedKitName="Objects")
cso_7 = CreateSpeckleObject(A=simplify(ungroup_2), selectedKitName="Objects")
cso_8 = CreateSpeckleObject(A=simplify(input_8), selectedKitName="Objects")
cso_9 = CreateSpeckleObject(A=simplify(input_10), selectedKitName="Objects")
panel = Panel(cso_7)
merge = Merge(Data1=cso, Data2=cso_2, Data3=cso_3, Data4=cso_4, Data5=cso_5, Data6=cso_6, Data7=cso_7, Data8=cso_8, Data9=cso_9)
send = Send(
    Stream="https://speckle.xyz/streams/15849209bd",
    Data=merge,
    AutoSend=False,
    BaseId="1e1fe961b8edc8fa6d065c3ba3189d80",
    CurrentComponentState="expired",
    KitName="Objects",
    OutputWrappers="https://speckle.xyz\t15849209bd\te9b3ed00af",
    UseDefaultCache=True,
    selectedKitName="Objects")
