# Grasshopper definition Lot Subdivision Demo 0.2.0.gh (Grasshopper 1.0.8)
# plug-ins: CORE.Toolbox.Grasshopper, Human

road_thickness = Slider(25, range=0..50)
lot_depth = Slider(150, range=50..150)
lot_width = Slider(60, range=50..150)
coverage_area = Slider(0.5, range=0..1)
geometry_pipeline = GeometryPipeline(
    GroupByLayer=False,
    GroupByType=False,
    IncludeHidden=True,
    IncludeLocked=True,
    LayerFilter="01_SITE*01_ROADS",
    NameFilter="*",
    SublayerFiltering=True,
    TypeFilter=4)

street_centerline = Curve(geometry_pipeline)
lot_subdivision = GhPythonScript(curve=street_centerline, distance=road_thickness, lot_depth=lot_depth)  # -> out; inputs curve: Guid
# ---------- lot_subdivision: Python ----------
__author__ = "ilouh"
__version__ = "2023.02.21"

import rhinoscriptsyntax as rs
import Grasshopper as gh
import Rhino.Geometry as rg
import ghpythonlib.components as comps
import math

def create_wall_linear(curve,distance):
    
    
    crv_1 = comps.OffsetCurve(curve,distance/2, corners = 1)
    crv_2 = comps.OffsetCurve(curve,distance/2+lot_depth, corners = 1)
    crv_3 = comps.OffsetCurve(curve,-distance/2,corners = 1)
    crv_4 = comps.OffsetCurve(curve,-distance/2-+lot_depth,corners = 1)
    
    return crv_1,crv_2,crv_3,crv_4


out = create_wall_linear(curve,distance)
# ---------- end lot_subdivision ----------

item = ListItem(List=lot_subdivision, Index=0, Wrap=True)  # -> Item, Item1, Item2, Item3
merge = Merge(Data1=item.Item, Data2=item.Item1)
merge_2 = Merge(Data1=item.Item2, Data2=item.Item3)
cluster = Cluster(curves=merge_2, unit_width=lot_width)
cluster_2 = Cluster(curves=merge, unit_width=lot_width)
merge_3 = Merge(Data1=cluster)
merge_4 = Merge(Data1=cluster_2)
python = GhPythonScript(surfaces=merge_4)  # -> simplify(Typical_Units), Corner_Units, dic, areas, center_points, amount_of_units; inputs surfaces: list of Brep
# ---------- python: Python ----------
__author__ = "ilouh"
__version__ = "2023.02.21"

import rhinoscriptsyntax as rs
import Grasshopper as gh
import Rhino.Geometry as rg
import ghpythonlib.components as comps
import math

def UnitBoundary(srf):
    
    boundary = rs.DuplicateSurfaceBorder(srf)

    return boundary
    
Typical_Units = [] 
Corner_Units = []
areas = []
center_points = []

areas_Corner_units = []
areas_Typical_units = []

dic = {}

i = 0 

for surface in surfaces:
    
    
    temp = comps.DeconstructBrep(surface)
    points = temp['vertices']
    
    
    unit_area = comps.Area(surface)
    
    unit_center = unit_area['centroid']
    
    
    unit_area = round(unit_area['area'],2)
    unit_number = 'Lot Number {}'.format(i)
    
    
    if len(points) > 4: 
        
        unit_name = 'Corner Lot',
        unit_type = 'Corner Lot',
        Corner_Units.append(surface)

        
    else:
        
        unit_name = 'Typical Lot',
        unit_type = 'Typical Lot',
        Typical_Units.append(surface)


    dic_temp = {

        'Lot Name':  unit_name,
        'Lot Area': unit_area,
        'Lot Number' : unit_number,
        'Lot Type' : unit_type

    }
    
    dic[unit_number] = dic_temp
    str = '{} \n {} sf'.format(unit_type,unit_area)
    areas.append(str)
    center_points.append(unit_center)
    
    i= i+1

print(Typical_Units)

amount_of_units = len(surfaces)
# ---------- end python ----------
python_2 = GhPythonScript(surfaces=merge_3)  # -> simplify(Typical_Units), Corner_Units, dic, areas, center_points, amount_of_units; inputs surfaces: list of Brep
# ---------- python_2: Python ----------
__author__ = "ilouh"
__version__ = "2023.02.21"

import rhinoscriptsyntax as rs
import Grasshopper as gh
import Rhino.Geometry as rg
import ghpythonlib.components as comps
import math

def UnitBoundary(srf):
    
    boundary = rs.DuplicateSurfaceBorder(srf)

    return boundary
    
Typical_Units = [] 
Corner_Units = []
areas = []
center_points = []

areas_Corner_units = []
areas_Typical_units = []

dic = {}

i = 0 

for surface in surfaces:
    
    
    temp = comps.DeconstructBrep(surface)
    points = temp['vertices']
    
    
    unit_area = comps.Area(surface)
    
    unit_center = unit_area['centroid']
    
    
    unit_area = round(unit_area['area'],2)
    unit_number = 'Unit Number {}'.format(i)
    
    
    if len(points) > 4: 
        
        unit_name = 'Corner Unit',
        unit_type = '2 BDRM',
        Corner_Units.append(surface)

        
    else:
        
        unit_name = 'Typical Unit',
        unit_type = '1 BDRM',
        Typical_Units.append(surface)


    dic_temp = {

        'Unit Name':  unit_name,
        'Unit Area': unit_area,
        'Unit Number' : unit_number,
        'Unit Type' : unit_type

    }
    
    dic[unit_number] = dic_temp
    str = '{} \n {} sf'.format(unit_type,unit_area)
    areas.append(str)
    center_points.append(unit_center)
    
    i= i+1

print(Typical_Units)

amount_of_units = len(surfaces)
# ---------- end python_2 ----------
merge_5 = Merge(Data1=simplify(python.Typical_Units), Data2=simplify(python.Corner_Units))
merge_6 = Merge(Data1=simplify(python_2.Typical_Units), Data2=simplify(python_2.Corner_Units))
property_boundary = Curve(merge_5)
number_slider = Slider(0.72, range=0..1)
property_boundary_2 = Curve(merge_6)
buildable_area = Buildable_area(G=simplify(property_boundary), d=coverage_area)  # -> simplify(G_2)
buildable_area_2 = Buildable_area(G=simplify(property_boundary_2), d=coverage_area)  # -> simplify(G_2)
Z = UnitZ(Factor=Slider(51, range=0..100))
Z_2 = UnitZ(Factor=Slider(51, range=0..100))
extr = Extrude(Base=buildable_area, Direction=Z)
extr_2 = Extrude(Base=buildable_area_2, Direction=Z_2)
cap = CapHoles(Brep=extr)
cap_2 = CapHoles(Brep=extr_2)
bbox = BoundingBox(Content=cap, Plane=PlaneXY(0, 0, 0))  # -> Box, Box_2
bbox_2 = BoundingBox(Content=cap_2, Plane=PlaneXY(0, 0, 0))  # -> Box, Box_2
material = ModelMaterial(Material=<geometry referenced from the Rhino model>, Shader=ColourSwatch(SwatchColor=RGB(255, 255, 255)))  # -> Material, Shader
material_2 = ModelMaterial(Material=<geometry referenced from the Rhino model>, Shader=ColourSwatch(SwatchColor=RGBA(63, 211, 175, 159)))  # -> Material, Shader
preview = CustomPreview(Geometry=[merge_5, merge_6], Material=material_2.Material)
pt = Point(<point referenced from the Rhino model>)

rhino_units = RhinoUnits(Refresh=True)  # -> UnitName, UnitIndex
pt_2 = ConstructPoint(XCoordinate=0, YCoordinate=0, ZCoordinate=0)
l_shape_pitched_w_gable = LShapePitchedWGable(
    startpoint=pt_2,
    width=Slider(25, range=0..100),
    length=Slider(5, range=0..100),
    pitch_height=Slider(5, range=0..100),
    floor_floor_height=Slider(10, range=0..100),
    unitsystem=rhino_units.UnitName)

bbox_3 = BoundingBox(Content=l_shape_pitched_w_gable, Plane=PlaneXY(0, 0, 0), UnionBox=True)  # -> Box, Box_2
volume = Volume(Geometry=bbox_3.Box)  # -> Volume, Centroid
expression = Expression(x=Slider(2, range=1..4), Expression="x*90")
rotate_3d = Rotate3D(Geometry=l_shape_pitched_w_gable, Angle=degrees(expression), Center=volume.Centroid, Axis=Vector(0, 0, 1))  # -> Geometry, Transform

item_2 = ListItem(List=rotate_3d.Geometry, Index=0, Wrap=True)

bbox_4 = BoundingBox(Content=rotate_3d.Geometry, Plane=PlaneXY(0, 0, 0), UnionBox=True)  # -> Box, Box_2
group = Group(Geometry=item_2)

boxmap = BoxMapping(Geometry=group, Source=bbox_4.Box, Target=bbox.Box)  # -> Geometry, Transform

rhino_units_2 = RhinoUnits(Refresh=True)  # -> UnitName, UnitIndex
pt_3 = ConstructPoint(XCoordinate=0, YCoordinate=0, ZCoordinate=0)
l_shape_pitched_w_gable_2 = LShapePitchedWGable(
    startpoint=pt_3,
    width=Slider(25, range=0..100),
    length=Slider(5, range=0..100),
    pitch_height=Slider(5, range=0..100),
    floor_floor_height=Slider(10, range=0..100),
    unitsystem=rhino_units_2.UnitName)

bbox_5 = BoundingBox(Content=l_shape_pitched_w_gable_2, Plane=PlaneXY(0, 0, 0), UnionBox=True)  # -> Box, Box_2
volume_2 = Volume(Geometry=bbox_5.Box)  # -> Volume, Centroid
expression_2 = Expression(x=Slider(4, range=1..4), Expression="x*90")
rotate_3d_2 = Rotate3D(Geometry=l_shape_pitched_w_gable_2, Angle=degrees(expression_2), Center=volume_2.Centroid, Axis=Vector(0, 0, 1))  # -> Geometry, Transform

item_3 = ListItem(List=rotate_3d_2.Geometry, Index=0, Wrap=True)

bbox_6 = BoundingBox(Content=rotate_3d_2.Geometry, Plane=PlaneXY(0, 0, 0), UnionBox=True)  # -> Box, Box_2

boxmap_2 = BoxMapping(Geometry=item_3, Source=bbox_6.Box, Target=bbox_2.Box)  # -> Geometry, Transform
preview_2 = CustomPreview(Geometry=[boxmap.Geometry, boxmap_2.Geometry], Material=material.Material)
lng = ListLength(List=flatten([boxmap.Geometry, boxmap_2.Geometry]))
concat = Concatenate(FragmentA="Proposed Units: ", FragmentB=lng)
screentext = ScreenOrientedText(Text=concat, Justification=7, Location=pt, SizeFactor=Slider(40, range=0..100), Depth=0, Absolute=False)

# ==== cluster LShapePitchedWGable
startpoint = ClusterInput()
width = ClusterInput()
length = ClusterInput()
pitch_height = ClusterInput()
floor_floor_height = ClusterInput()
unitsystem = ClusterInput()
cookiecutter_01 = Script(
    startPoint=graft(startpoint),
    width=graft(width),
    length=graft(length),
    pitch_height=graft(pitch_height),
    floor_floor_height=floor_floor_height,
    unitSystem=unitsystem)  # -> polysurface, boudaryPolyline, floor_floor_height; inputs startPoint: Point3d, unitSystem: String
# ---------- cookiecutter_01: Python ----------
import System
import Rhino
import Rhino.Geometry as rg
import Grasshopper
import ghpythonlib.components as comps
from ghpythonlib import treehelpers as th

import rhinoscriptsyntax as rs

def constructGHPoints(points):

    gh_points = []

    for point in points:

        gh_point = comps.ConstructPoint(point[0],point[1],point[2])
        gh_points.append(gh_point)
    
    return gh_points

def roof(point,w,l,h):

    x = point[0]
    y = point[1]
    z = point[2]

    #first horizontal row, left to right
    pt1 = (x,y,z)
    pt2 = (x + 1/4*w,y,z+h)
    pt3 = (x + 1/2*w,y,z)

    #second horizontal row, left to right
    pt4 = (x+1/2*w,y+1/2*l,z)
    pt5 = (x+3/4*w,y+1/2*l,z+h)
    pt6 = (x+w,y+1/2*l,z)

    #third horizontal row, left to right
    pt7 = (x +1/4*w,y+3/4*l,z+h)
    pt8 = (x + 3/4*w,y+3/4*l,z+h)
    pt9 = (x+w, y+3/4*l,z+h)

    #fourth horizontal row, left to right
    pt10 = (x,y+l,z)
    pt11 = (x + 1/4*w, y+l,z+h)
    pt12 = (x+ 1/2*w, y+l,z)
    pt13 = (x+w,y+l,z)

    faces = [

        [pt1,pt2,pt11,pt10],
        [pt2,pt7,pt4,pt3],
        [pt7,pt9,pt6,pt4],
        [pt7,pt9,pt13,pt12],
        [pt12,pt11,pt7],
        [pt1,pt2,pt3],
        [pt10,pt11,pt12],
        [pt6,pt9,pt13],
        [pt4,pt8,pt5],
        [pt5,pt8,pt6],
        [pt4,pt5,pt6]
    ]

    boundary = [

        pt1,
        pt3,
        pt4,
        pt6,
        pt13,
        pt10


    ]
    return faces, boundary

def unitCoverter(unitSystem):
    if unitSystem == 'inches':
        return 12
    if unitSystem == 'feet':
        return 1

if __name__ == '__main__':

    startPoint = startPoint

    coef = unitCoverter(unitSystem)

    width = width *coef
    length  = length *coef
    pitch_height = pitch_height * coef
    floor_floor_height = floor_floor_height * coef
    

    faces,boundary = roof(startPoint,width,length,pitch_height)

    vertices = [] 

    polysurface = []

    for face in faces: 

        points = constructGHPoints(face)
        vertices.append(points)

        surface = rg.NurbsSurface.CreateFromCorners(*points)
        
        polysurface.append(surface)


    boundaryPoints = constructGHPoints(boundary)
    boudaryPolyline = comps.PolyLine(boundaryPoints,True)
# ---------- end cookiecutter_01 ----------

Z = UnitZ(Factor=cookiecutter_01.floor_floor_height)
join = BrepJoin(Breps=cookiecutter_01.polysurface)  # -> Breps, Closed
extr = Extrude(Base=cookiecutter_01.boudaryPolyline, Direction=Z)
move = Move(Geometry=join.Breps, Motion=Z)  # -> Geometry, Transform
cap = CapHoles(Brep=extr)
merge = Merge(Data1=move.Geometry, Data2=cap)  # -> flatten(Result)

R = ClusterOutput(merge)

# ==== cluster Cluster
curves = ClusterInput()
unit_width = ClusterInput()

item = ListItem(Curves=curves, Index=0, Wrap=True)  # -> Item, Item1

# ---- group: curve subdivision per units dim
python = GhPythonScript(outer_curve=simplify(item.Item), unit_width=unit_width, inner_curve=simplify(item.Item1))  # -> simplify(outter_points), simplify(inner_points)
# ---------- python: Python ----------
__author__ = "ilouh"
__version__ = "2022.12.10"

import rhinoscriptsyntax as rs
import Grasshopper as gh
import Rhino.Geometry as rg
import ghpythonlib.components as comps
import math

def subdivide_curve(curve,unit_width):

    # Use the DivideCurve function to perform the subdivision
    points = comps.DivideDistance(curve,unit_width)
    points = comps.DivideCurve(curve,len(points['points']),kinks = True)
    
    return points['points']



#goal is to subdivide the curve into points appx per the width of a unit
outter_points = subdivide_curve(outer_curve,unit_width)

#find closest points
inner_points = comps.CurveClosestPoint(outter_points,inner_curve)
inner_points = inner_points['point']
# ---------- end python ----------

# ---- group: Get the X vector at each point
crv_cp = CurveClosestPoint(Point=python.outter_points, Curve=item.Item)  # -> Point, Parameter, Distance
hframe = HorizontalFrame(Curve=item.Item, Parameter=crv_cp.Parameter)
deplane = DeconstructPlane(Plane=hframe)  # -> Origin, XAxis, YAxis, ZAxis

# ----
merge = Merge(Data1=item.Item, Data2=item.Item1)
loft = Loft(Curves=merge, Options={Adjust=False, Closed=False, LoftEnds=0, LoftSimp=0, LoftType=0, Rebuild=10, Refit=0.01})

# ---- group: creates a surface to be divided to units
python_2 = GhPythonScript(outer_curve=item.Item, inner_curve=item.Item1)  # -> srf; inputs outer_curve: Curve, inner_curve: Curve
# ---------- python_2: Python ----------
__author__ = "ilouh"
__version__ = "2023.02.21"

import rhinoscriptsyntax as rs
import Grasshopper as gh
import Rhino.Geometry as rg
import ghpythonlib.components as comps
import math


inner_curve = comps.FlipCurve(inner_curve,outer_curve)
inner_curve = inner_curve['curve']


if comps.Closed(outer_curve) is True: 
    srf = comps.BoundarySurfaces([outer_curve,inner_curve])

else:
    
    pts_outer = comps.EndPoints(outer_curve)
    pts_inner = comps.EndPoints(inner_curve)
    
    pts_outer_start = pts_outer['start']
    pts_outer_end = pts_outer['end']
    
    pts_inner_start = pts_inner['start']
    pts_inner_end = pts_inner['end']
    
    
    start_line = comps.Line(pts_outer_start,pts_inner_start)
    end_line = comps.Line(pts_outer_end,pts_inner_end)

    
    print(start_line)
    
    srf = comps.BoundarySurfaces([
        outer_curve,
        start_line,
        end_line,
        inner_curve])


    
    #srf = comps.BoundarySurfaces([outer_curve,inner_curve])

    #loft_option = comps.LoftOptions(True,True,0,0,0)
    #srf = comps.Loft([outer_curve,inner_curve],loft_option)
# ---------- end python_2 ----------

# ----
pt = Point(python.outter_points)
pt_2 = Point(python.inner_points)

# ---- group: creates perpendicular dem walls
python_3 = GhPythonScript(outter_points=pt, inner_points=pt_2, vector1=deplane.XAxis)  # -> angled_walls, simplify(straight_walls); inputs outter_points: list of Point3d, inner_points: list of Point3d, vector1: list of Vector3d
# ---------- python_3: Python ----------
"""Provides a scripting component.
    Inputs:
        outter_points: A list of points for the outer wall endpoints
        inner_points: A list of points for the inner wall endpoints
        vector1: A list of vectors to compare against
    Output:
        straight_walls: List of lines considered 'straight'
        angled_walls: List of lines considered 'angled'
        P: Some points recorded if needed
"""

__author__ = "ilouh"
__version__ = "2023.02.21"

import rhinoscriptsyntax as rs
import Grasshopper as gh
import Rhino.Geometry as rg
import math

P = []
straight_walls = []
angled_walls = []

# Small angle tolerance in degrees
tol_deg = 1.0

for i in range(len(outter_points)):

    pt_start = outter_points[i]
    pt_end   = inner_points[i]

    # Create a RhinoCommon Line from start to end points
    crv = rg.Line(pt_start, pt_end)

    # Convert the two points into a Vector3d
    v2 = rg.Vector3d(pt_end - pt_start)

    # Make sure vector1[i] is a Rhino.Geometry.Vector3d (if not, cast it):
    v1 = rg.Vector3d(vector1[i])

    # Compute the angle in radians using RhinoCommon
    angle_radians = rg.Vector3d.VectorAngle(v1, v2)
    angle_degrees = math.degrees(angle_radians)

    # Check for near 0° or near 90° => "straight"
    if (abs(angle_degrees - 0) < tol_deg) or (abs(angle_degrees - 90) < tol_deg):
        straight_walls.append(crv)
        P.append(pt_start)
        print("Angle: {:.2f} => Straight wall".format(angle_degrees))
    else:
        angled_walls.append(crv)
        print("Angle: {:.2f} => Angled wall".format(angle_degrees))
# ---------- end python_3 ----------

# ----
crv = Curve(reparameterize(python_3.straight_walls))
srfsplit = SurfaceSplit(Surface=loft, Curves=crv)

F = ClusterOutput(srfsplit)

# ==== cluster Buildable_area
G = ClusterInput()
d = ClusterInput()
area = Area(Geometry=G)  # -> Area, graft(Centroid)
number_slider = Slider(0.85, range=0..1)
scale = Scale(Geometry=graft(G), Center=area.Centroid, Factor=d)  # -> Geometry, Transform
d_2 = Number(d)
G_2 = ClusterOutput(scale.Geometry)
