# Grasshopper definition Slope Analysis 0.1.0.gh (Grasshopper 1.0.8)

srf = Surface(<surface referenced from the Rhino model>)
divide = DivideDomain²(Domain=srf, UCount=Slider(40, range=0..100), VCount=Slider(40, range=0..100))
subsrf = Isotrim(Surface=srf, Domain=divide)
debrep = DeconstructBrep(Brep=subsrf)  # -> Faces, Edges, Vertices
item = ListItem(List=debrep.Vertices, Index=3, Wrap=True)
item_2 = ListItem(List=debrep.Vertices, Index=1, Wrap=True)
ln = Line(StartPoint=item_2, EndPoint=item)
pdecon = Deconstruct(Point=item_2)  # -> XComponent, YComponent, ZComponent
pdecon_2 = Deconstruct(Point=item)  # -> XComponent, YComponent, ZComponent
vec2pt = Vector2Pt(PointA=item, PointB=item_2, Unitize=True)  # -> Vector, Length
expression = Expression(x=pdecon.ZComponent, y=pdecon_2.ZComponent, Expression="abs(x-y)")
vdis = VectorDisplay(Anchor=item_2, Vector=vec2pt.Vector)
flatten = FlattenTree(Tree=expression, Path="{0}")
bnd = Bounds(Numbers=flatten)
remap = RemapNumbers(Value=flatten, Source=bnd, Target=Domain(0, 1))  # -> reverse(Mapped), Clipped
gradient = Gradient(
    LowerLimit=0,
    UpperLimit=1,
    Parameter=remap.Mapped,
    stops=[0: RGB(234, 38, 0), 0.25: RGB(234, 126, 0), 0.5: RGB(254, 244, 84), 0.75: RGB(173, 203, 249), 1: RGB(75, 107, 169)])
srf_2 = Surface(flatten(debrep.Faces))
preview = CustomPreview(Geometry=srf_2, Material=gradient)
panel = Panel(gradient)
