# Grasshopper definition BSA_RevitToRhino 0.0.2.gh (Grasshopper 1.0.7)
# plug-ins: Rhino.Inside for Autodesk Revit

rooms = QueryRooms(Placed=True)
categories = QueryCategories(Type=1, Name="Floors", IsSubcategory=False)
categories_2 = QueryCategories(Type=1, Name="Walls", IsSubcategory=False)
categories_3 = QueryCategories(Type=1, Name="Roofs", IsSubcategory=False)
panel = Panel(rooms)
parameters = QueryElementParameters(Element=rooms)
views = QueryViews(ViewName="{3D}", IsDependent=False, IsTemplate=False)
catfltr = CategoryFilter(Categories=categories, Inverted=False)
catfltr_2 = CategoryFilter(Categories=categories_2, Inverted=False)
catfltr_3 = CategoryFilter(Categories=categories_3, Inverted=False)
mesh = Mesh(<mesh referenced from the Rhino model>)  # disabled
panel_2 = Panel(parameters)
roof = Roof()
floor = Floor()
wall = Wall()
elements = QueryElements(Filter=catfltr, Limit=100)  # -> Elements, Count
elements_2 = QueryElements(Filter=catfltr_2, Limit=100)  # -> Elements, Count
selfltr = SelectableInViewFilter(View=views, Inverted=False)
elements_3 = QueryElements(Filter=catfltr_3, Limit=100)  # -> Elements, Count
elements_4 = QueryElements(Filter=selfltr, Limit=100)  # -> Elements, Count
floor_2 = Floor(elements.Elements)
wall_2 = Wall(elements_2.Elements)
roof_2 = Roof(elements_3.Elements)
panel_3 = Panel(elements_4.Elements)
bbox = BoundingBox(Content=roof_2, Plane=PlaneXY(0, 0, 0))  # -> Box, Box_2
bbox_2 = BoundingBox(Content=floor_2, Plane=PlaneXY(0, 0, 0))  # -> Box, Box_2
bbox_3 = BoundingBox(Content=wall_2, Plane=PlaneXY(0, 0, 0))  # -> Box, Box_2
brep = Brep([bbox_2.Box, bbox_3.Box, bbox.Box])  # disabled
