# Grasshopper definition BSA_RhinoToRevit_AssembliesByCurves 0.2.0.gh (Grasshopper 1.0.7)
# plug-ins: Rhino.Inside for Autodesk Revit, Pufferfish

pipeline = GeometryPipeline(
    GroupByLayer=False,
    GroupByType=False,
    IncludeHidden=True,
    IncludeLocked=True,
    LayerFilter="Make2D*Visible*Curves*03_FLOORS",
    NameFilter="*",
    SublayerFiltering=True,
    TypeFilter=1073741852)
pipeline_2 = GeometryPipeline(
    GroupByLayer=False,
    GroupByType=False,
    IncludeHidden=True,
    IncludeLocked=True,
    LayerFilter="Make2D*Visible*Curves*03_ROOF",
    NameFilter="*",
    SublayerFiltering=True,
    TypeFilter=1073741852)
pipeline_3 = GeometryPipeline(
    GroupByLayer=False,
    GroupByType=False,
    IncludeHidden=True,
    IncludeLocked=True,
    LayerFilter="Make2D*Visible*ClippingPlaneIntersections*03_ARCH*03_EXT WALLS",
    NameFilter="*",
    SublayerFiltering=True,
    TypeFilter=1073741852)
pipeline_4 = GeometryPipeline(
    GroupByLayer=False,
    GroupByType=False,
    IncludeHidden=True,
    IncludeLocked=True,
    LayerFilter="Make2D*Visible*ClippingPlaneIntersections*03_ARCH*03_INT WALLS",
    NameFilter="*",
    SublayerFiltering=True,
    TypeFilter=1073741852)
dam = DataDam(DataA=pipeline, BufferDelay=10000000, BufferMode=0)
dam_2 = DataDam(DataA=pipeline_2, BufferDelay=10000000, BufferMode=0)

# ---- group: Convert Polylines into Lines
dam_3 = DataDam(DataA=pipeline_3, BufferDelay=2500000, BufferMode=2)
crv = Curve(reparameterize(graft(dam_3)))
disc = Discontinuity(Curve=crv, Level=Slider(1, range=0..3))  # -> Points, Parameters
shatter = Shatter(Curve=crv, Parameters=disc.Parameters)

dam_4 = DataDam(DataA=pipeline_4, BufferDelay=2500000, BufferMode=2)
crv_2 = Curve(reparameterize(graft(dam_4)))
disc_2 = Discontinuity(Curve=crv_2, Level=Slider(1, range=0..3))  # -> Points, Parameters
shatter_2 = Shatter(Curve=crv_2, Parameters=disc_2.Parameters)

# ---- group: Select Wall Type
category = Category(<category referenced from the Revit model>)
types = QueryTypes(Kind=3, Category=category)
item = ListItem(Index=Slider(34, range=0..50), Wrap=True)

category_2 = Category(<category referenced from the Revit model>)
types_2 = QueryTypes(Kind=3, Category=category_2)
item_2 = ListItem(Index=Slider(33, range=0..50), Wrap=True)

# ---- group: Checks if curve is closed and ensures they are planer
clscrv = CloseCurve(Curve=dam, CloseType=0, Bulge=0.5, Tolerance=0)  # -> Closed, R; disabled
area = Area(Geometry=dam)  # -> Area, Centroid
xy = XYPlane(Origin=area.Centroid)
project = Project(Geometry=dam, Plane=xy)  # -> Geometry, Transform

# ----
level = Level(<level referenced from the Revit model>)

types_3 = QueryTypes(Kind=3, Category=<missing>)
floor_plate_boundary = Curve(simplify(graft(project.Geometry)))
item_3 = ListItem(Index=Slider(1, range=0..10), Wrap=True)

# ---- group: Removes Small Line portions
len = Length(Curve=shatter)
larger = LargerThan(FirstNumber=len, SecondNumber=Slider(0.5, range=0..5))  # -> LargerThan, OrEqualTo
cull = CullPattern(List=shatter, CullPattern=larger.LargerThan)

len_2 = Length(Curve=shatter_2)
larger_2 = LargerThan(FirstNumber=len_2, SecondNumber=Slider(0.5, range=0..5))  # -> LargerThan, OrEqualTo
cull_2 = CullPattern(List=shatter_2, CullPattern=larger_2.LargerThan)

# ---- group: Checks if curve is closed and ensures they are planer
project_2 = Project(Geometry=dam_2, Plane=level)  # -> Geometry, Transform

# ----
types_4 = QueryTypes(Kind=3, Category=<missing>)
floor_plate_boundary_2 = Curve(simplify(graft(project_2.Geometry)))
item_4 = ListItem(Index=Slider(3, range=0..10), Wrap=True)

floor = AddFloor(Boundary=floor_plate_boundary, Type=item_3, TrackingMode=2)

# ---- group: Rebuilds lines
end = EndPoints(Curve=cull)  # -> Start, End
ln = Line(StartPoint=end.Start, EndPoint=end.End)

end_2 = EndPoints(Curve=cull_2)  # -> Start, End
ln_2 = Line(StartPoint=end_2.Start, EndPoint=end_2.End)

# ----
roof = AddRoof(Boundary=floor_plate_boundary_2, Type=item_4, TrackingMode=2)

# ---- group: Evaluate Location of Line (Which floor is it in)
curvepoint = PointOnCurve(ln, parameter=0.5)
python = GhPythonScript(points=flatten(curvepoint))  # -> FirstFloor, SecondFloor; inputs points: list of Point3d
# ---------- python: Python ----------
import rhinoscriptsyntax as rs
import Grasshopper as gh
import Rhino.Geometry as rg
import ghpythonlib.components as comps

FirstFloor = []
SecondFloor = []

for point in points: 

    values = comps.Deconstruct(point)
    print(values)
    
    z_value = round(values['z_component'],0)
    
    if z_value > 0: 
        
        SecondFloor.append(True)
        FirstFloor.append(False)
    
    else:
        
        SecondFloor.append(False)
        FirstFloor.append(True)

print(FirstFloor)
# ---------- end python ----------

curvepoint_2 = PointOnCurve(ln_2, parameter=0.5)
python_2 = GhPythonScript(points=flatten(curvepoint_2))  # -> FirstFloor, SecondFloor; inputs points: list of Point3d; same code as python

# ----
panel = Panel(python.FirstFloor)
panel_2 = Panel(python_2.FirstFloor)
cull_3 = CullPattern(List=flatten(ln), CullPattern=python.FirstFloor)
cull_4 = CullPattern(List=flatten(ln), CullPattern=python.SecondFloor)
cull_5 = CullPattern(List=flatten(ln_2), CullPattern=python_2.FirstFloor)
cull_6 = CullPattern(List=flatten(ln_2), CullPattern=python_2.SecondFloor)
wll = WallLocationLine({"Wall Centerline": 0, "Core Centerline": 1, "Finish (Exterior Face)": 2, "Finish (Interior Face)": 3, "Core (Exterior Face)": 4, "Core (Interior Face)": 5}, selected="Wall Centerline")
wll_2 = WallLocationLine({"Wall Centerline": 0, "Core Centerline": 1, "Finish (Exterior Face)": 2, "Finish (Interior Face)": 3, "Core (Exterior Face)": 4, "Core (Interior Face)": 5}, selected="Wall Centerline")
wll_3 = WallLocationLine({"Wall Centerline": 0, "Core Centerline": 1, "Finish (Exterior Face)": 2, "Finish (Interior Face)": 3, "Core (Exterior Face)": 4, "Core (Interior Face)": 5}, selected="Wall Centerline")
wll_4 = WallLocationLine({"Wall Centerline": 0, "Core Centerline": 1, "Finish (Exterior Face)": 2, "Finish (Interior Face)": 3, "Core (Exterior Face)": 4, "Core (Interior Face)": 5}, selected="Wall Centerline")
line = Line(cull_3)
level_2 = Level(<level referenced from the Revit model>)
line_2 = Line(cull_4)
level_3 = Level(<level referenced from the Revit model>)
line_3 = Line(cull_5)
level_4 = Level(<level referenced from the Revit model>)
line_4 = Line(cull_6)
level_5 = Level(<level referenced from the Revit model>)
wallcrv = AddWallCurve(
    Curve=line,
    Type=item,
    Level=level_2,
    Height=Slider(15, range=0..100),
    LocationLine=wll,
    AllowJoins=Toggle(True),
    TrackingMode=2)
wallcrv_2 = AddWallCurve(
    Curve=line_2,
    Type=item,
    Level=level_3,
    Height=Slider(15, range=0..100),
    LocationLine=wll_2,
    AllowJoins=Toggle(True),
    TrackingMode=2)
wallcrv_3 = AddWallCurve(
    Curve=line_3,
    Type=item_2,
    Level=level_4,
    Height=Slider(15, range=0..100),
    LocationLine=wll_3,
    AllowJoins=Toggle(True),
    TrackingMode=2)
wallcrv_4 = AddWallCurve(
    Curve=line_4,
    Type=item_2,
    Level=level_5,
    Height=Slider(15, range=0..100),
    LocationLine=wll_4,
    AllowJoins=Toggle(True),
    TrackingMode=2)
pipeline_5 = GeometryPipeline(
    GroupByLayer=False,
    GroupByType=False,
    IncludeHidden=True,
    IncludeLocked=True,
    LayerFilter="Make2D*Visible*ClippingPlaneIntersections*03_ARCH*03_GLAZING_GLASS",
    NameFilter="*",
    SublayerFiltering=True,
    TypeFilter=4)

# ---- group: Convert Polylines into Lines
dam_5 = DataDam(DataA=pipeline_5, BufferDelay=2500000, BufferMode=2)
crv_3 = Curve(reparameterize(graft(dam_5)))
disc_3 = Discontinuity(Curve=crv_3, Level=Slider(1, range=0..3))  # -> Points, Parameters
shatter_3 = Shatter(Curve=crv_3, Parameters=disc_3.Parameters)

# ---- group: Select Wall Type
category_3 = Category(<category referenced from the Revit model>)
types_5 = QueryTypes(Kind=3, Category=category_3)
item_5 = ListItem(Index=Slider(41, range=0..50), Wrap=True)

# ---- group: Removes Small Line portions
len_3 = Length(Curve=shatter_3)
larger_3 = LargerThan(FirstNumber=len_3, SecondNumber=Slider(0.5, range=0..5))  # -> LargerThan, OrEqualTo
cull_7 = CullPattern(List=shatter_3, CullPattern=larger_3.LargerThan)

# ---- group: Rebuilds lines
end_3 = EndPoints(Curve=cull_7)  # -> Start, End
ln_3 = Line(StartPoint=end_3.Start, EndPoint=end_3.End)

# ---- group: Evaluate Location of Line (Which floor is it in)
curvepoint_3 = PointOnCurve(ln_3, parameter=0.5)
python_3 = GhPythonScript(points=flatten(curvepoint_3))  # -> FirstFloor, SecondFloor; inputs points: list of Point3d; same code as python

# ----
panel_3 = Panel(python_3.FirstFloor)
cull_8 = CullPattern(List=flatten(ln_3), CullPattern=python_3.FirstFloor)
cull_9 = CullPattern(List=flatten(ln_3), CullPattern=python_3.SecondFloor)
wll_5 = WallLocationLine({"Wall Centerline": 0, "Core Centerline": 1, "Finish (Exterior Face)": 2, "Finish (Interior Face)": 3, "Core (Exterior Face)": 4, "Core (Interior Face)": 5}, selected="Wall Centerline")
wll_6 = WallLocationLine({"Wall Centerline": 0, "Core Centerline": 1, "Finish (Exterior Face)": 2, "Finish (Interior Face)": 3, "Core (Exterior Face)": 4, "Core (Interior Face)": 5}, selected="Wall Centerline")
line_5 = Line(cull_8)
line_6 = Line(cull_9)
level_6 = Level(<level referenced from the Revit model>)
level_7 = Level(<level referenced from the Revit model>)
wallcrv_5 = AddWallCurve(
    Curve=line_5,
    Type=item_5,
    Level=level_6,
    Height=Slider(15, range=0..100),
    LocationLine=wll_5,
    AllowJoins=Toggle(True),
    TrackingMode=2)
wallcrv_6 = AddWallCurve(
    Curve=line_6,
    Type=item_5,
    Level=level_7,
    Height=Slider(15, range=0..100),
    LocationLine=wll_6,
    AllowJoins=Toggle(True),
    TrackingMode=2)
