# Grasshopper definition BSA_RhinoToRevit_ByModelElements 0.2.1.gh (Grasshopper 1.0.7)
# plug-ins: Rhino.Inside for Autodesk Revit

# CORE ELEMENTS
pipeline = GeometryPipeline(
    GroupByLayer=False,
    GroupByType=False,
    IncludeHidden=True,
    IncludeLocked=True,
    LayerFilter="03_ARCH*03_FLOORS",
    NameFilter="*",
    SublayerFiltering=True,
    TypeFilter=1073741848)  # disabled
pipeline_2 = GeometryPipeline(
    GroupByLayer=False,
    GroupByType=False,
    IncludeHidden=True,
    IncludeLocked=True,
    LayerFilter="03_ARCH*03_ROOF",
    NameFilter="*",
    SublayerFiltering=True,
    TypeFilter=1073741848)  # disabled
# INTERIOR PARTITIONS
pipeline_3 = GeometryPipeline(
    GroupByLayer=False,
    GroupByType=False,
    IncludeHidden=True,
    IncludeLocked=True,
    LayerFilter="03_ARCH*03_INT WALLS",
    NameFilter="*",
    SublayerFiltering=True,
    TypeFilter=1073741848)  # disabled
pipeline_4 = GeometryPipeline(
    GroupByLayer=False,
    GroupByType=False,
    IncludeHidden=True,
    IncludeLocked=True,
    LayerFilter="03_ARCH*03_EXT WALLS",
    NameFilter="*",
    SublayerFiltering=True,
    TypeFilter=1073741848)  # disabled
pipeline_5 = GeometryPipeline(
    GroupByLayer=False,
    GroupByType=False,
    IncludeHidden=True,
    IncludeLocked=True,
    LayerFilter="03_ARCH*03_STRUCTURE",
    NameFilter="*",
    SublayerFiltering=True,
    TypeFilter=1073741848)  # disabled
categories = DirectShapeCategories("autodesk.revit.category.family:structuralFraming-1.0.0", SearchPattern="STRUCTURAL FRAMING")  # disabled
categories_2 = BuiltInCategories("autodesk.revit.category.local:walls-1.0.0", LayoutLevel=2, SearchPattern="WALLS")  # disabled
# STRUCTURE
pipeline_6 = GeometryPipeline(
    GroupByLayer=False,
    GroupByType=False,
    IncludeHidden=True,
    IncludeLocked=True,
    LayerFilter="03_ARCH*03_STRUCTURE",
    NameFilter="*",
    SublayerFiltering=True,
    TypeFilter=1073741848)  # disabled
categories_3 = BuiltInCategories("autodesk.revit.category.local:floors-1.0.0", LayoutLevel=2, SearchPattern="fLOORS")  # disabled
categories_4 = BuiltInCategories("autodesk.revit.category.local:roofs-1.0.0", LayoutLevel=2, SearchPattern="Roof")  # disabled
dam = DataDam(DataA=pipeline_6, BufferDelay=10000000, BufferMode=0)  # disabled
categories_5 = BuiltInCategories("autodesk.revit.category.local:walls-1.0.0", LayoutLevel=2, SearchPattern="WALLS")  # disabled
categories_6 = BuiltInCategories("autodesk.revit.category.local:walls-1.0.0", LayoutLevel=2, SearchPattern="WALLS")  # disabled
dam_2 = DataDam(DataA=pipeline_3, BufferDelay=5000000, BufferMode=2)  # disabled
dam_3 = DataDam(DataA=pipeline_5, BufferDelay=10000000, BufferMode=0)  # disabled
dam_4 = DataDam(DataA=pipeline_2, BufferDelay=10000000, BufferMode=0)  # disabled
dam_5 = DataDam(DataA=pipeline, BufferDelay=10000000, BufferMode=0)  # disabled
dam_6 = DataDam(DataA=pipeline_4, BufferDelay=5000000, BufferMode=2)  # disabled
geodshape = AddGeometryDirectShape(Category=categories, Geometry=dam_3, TrackingMode=2)  # disabled

types = QueryTypes(Kind=3, Category=<geometry referenced from the Revit model>)  # disabled
panel = Panel(types)  # disabled
brep_top_boundary = BrepTopBoundary(B=dam)  # -> C, L; disabled
brep_bottom_boundary = BrepBottomBoundary(B=dam)  # -> N, L, C; disabled
area = Area(Geometry=brep_top_boundary.L)  # -> Area, Centroid; disabled
area_2 = Area(Geometry=brep_bottom_boundary.L)  # -> Area, Centroid; disabled
ln = Line(StartPoint=area_2.Centroid, EndPoint=area.Centroid)  # disabled
number_slider = Slider(4, range=0..10)  # disabled
item = ListItem(List=types, Index=number_slider, Wrap=True)  # disabled

# ---- group: Exterior Wall
exterior_walls = Brep(dam_2)  # disabled
types_2 = QueryTypes(Kind=3, Category=categories_5)  # disabled
panel_2 = Panel(types_2)  # disabled
getwallheight = GetWallHeight(C=exterior_walls)  # -> graft(R); disabled
getbottomface = GetBottomFace(B=exterior_walls)  # disabled
bottom_face = Surface(flatten(getbottomface))  # disabled
number_slider_2 = Slider(8, range=0..50)  # disabled
get_longest_edge_curves = GetLongestEdgeCurves(B=bottom_face)  # -> i, item_1; disabled
item_2 = ListItem(List=types_2, Index=number_slider_2, Wrap=True)  # disabled
python = GhPythonScript(curve_a=get_longest_edge_curves.i, curve_b=get_longest_edge_curves.item_1)  # -> centerline; inputs curve_a: list of Curve, curve_b: list of Curve; disabled
# ---------- python: Python ----------
__author__ = "ilouh"
__version__ = "2022.11.25"

import rhinoscriptsyntax as rs

import rhinoscriptsyntax as rs
import Grasshopper as gh
import Rhino.Geometry as rg
import ghpythonlib.components as comps

def listToTree(nestedList):
    
    """ Convert a nested python iterable to a datatree """
    
    dt = gh.DataTree[object]()
    for i,l in enumerate(nestedList):
        dt.AddRange(l,gh.Kernel.Data.GH_Path(i))
        
    return dt
    

centerline = []

for i in range(0,len(curve_a)):
    
    curve_b[i] = comps.FlipCurve(curve_b[i])
    print(curve_b[i])
    curve_b[i] = curve_b[i]['curve']
    temp = comps.TweenCurve(curve_a[i],curve_b[i],0.5)
    print(temp)
    centerline.append(temp)
# ---------- end python ----------

exterior_walls_2 = Brep(dam_6)  # disabled
types_3 = QueryTypes(Kind=3, Category=categories_6)  # disabled
panel_3 = Panel(types_3)  # disabled
getwallheight_2 = GetWallHeight(C=exterior_walls_2)  # -> graft(R); disabled
getbottomface_2 = GetBottomFace(B=exterior_walls_2)  # disabled
bottom_face_2 = Surface(flatten(getbottomface_2))  # disabled
number_slider_3 = Slider(13, range=0..50)  # disabled
get_longest_edge_curves_2 = GetLongestEdgeCurves(B=bottom_face_2)  # -> i, item_1; disabled
item_3 = ListItem(List=types_3, Index=number_slider_3, Wrap=True)  # disabled

# ----
bbox = BoundingBox(Content=dam_4, Plane=PlaneXY(0, 0, 0))  # -> Box, Box_2; disabled
brep_bottom_boundary_2 = BrepBottomBoundary(B=dam_4)  # -> N, L, C; disabled
brep_top_boundary_2 = BrepTopBoundary(B=bbox.Box)  # -> C, L; disabled
panel_4 = Panel("{0.5,0.5,0}")  # disabled
number_slider_4 = Slider(1, range=0..10)  # disabled

types_4 = QueryTypes(Kind=3, Category=categories_3)  # disabled
panel_5 = Panel(types_4)  # disabled
brep_top_boundary_3 = BrepTopBoundary(B=dam_5)  # -> C, L; disabled
item_4 = ListItem(List=types_4, Index=number_slider_4, Wrap=True)  # disabled
python_2 = GhPythonScript(FloorPlates=dam_5)  # -> HighestFace; inputs FloorPlates: Brep; disabled
# ---------- python_2: Python ----------
__author__ = "ilouh"
__version__ = "2022.11.25"

import rhinoscriptsyntax as rs

import rhinoscriptsyntax as rs
import Grasshopper as gh
import Rhino.Geometry as rg
import ghpythonlib.components as comps

def listToTree(nestedList):
    
    """ Convert a nested python iterable to a datatree """
    
    dt = gh.DataTree[object]()
    for i,l in enumerate(nestedList):
        dt.AddRange(l,gh.Kernel.Data.GH_Path(i))
        
    return dt
    

brep_components = comps.DeconstructBrep(FloorPlates)
brep_components = brep_components['faces']

applicable_faces = []

def returnFaceCenterZValue(face):
    
    evaluation_point = comps.Area(face)
    z_point = evaluation_point['centroid']
    z_point = z_point[2]
    
    return z_point


z_values = []

for face in brep_components: 
    
    temp = returnFaceCenterZValue(face)
    z_values.append(temp)

dic = zip(brep_components,z_values)

HighestFace, HighestPoint = max(dic)
print(HighestPoint)
# ---------- end python_2 ----------
floor_plate_boundary = Curve(simplify(brep_top_boundary_3.C))  # disabled

number_slider_5 = Slider(3, range=0..10)  # disabled

types_5 = QueryTypes(Kind=3, Category=categories_4)  # disabled
panel_6 = Panel(types_5)  # disabled
roof_boundary = Curve(brep_bottom_boundary_2.C)  # disabled
item_5 = ListItem(List=types_5, Index=number_slider_5, Wrap=True)  # disabled

evalsrf = EvaluateSurface(Surface=reparameterize(brep_top_boundary_2.C), Point=panel_4)  # -> Point, Normal, UDirection, VDirection, Frame; disabled
project = Project(Geometry=roof_boundary, Plane=evalsrf.Frame)  # -> Geometry, Transform; disabled
roof_boundary_2 = Curve(project.Geometry)  # disabled
tweencrv = TweenCurve(CurveA=get_longest_edge_curves_2.i, CurveB=get_longest_edge_curves_2.item_1, Factor=0.5, BlendType=0)  # disabled
wll = WallLocationLine({"Wall Centerline": 0, "Core Centerline": 1, "Finish (Exterior Face)": 2, "Finish (Interior Face)": 3, "Core (Exterior Face)": 4, "Core (Interior Face)": 5}, selected="Wall Centerline")  # disabled
wll_2 = WallLocationLine({"Wall Centerline": 0, "Core Centerline": 1, "Finish (Exterior Face)": 2, "Finish (Interior Face)": 3, "Core (Exterior Face)": 4, "Core (Interior Face)": 5}, selected="Wall Centerline")  # disabled
# will need some fixing
# Add curvature - will need to rebuild spline into curve
toggle = BooleanToggle(True)  # disabled
# will need some fixing
# Add curvature - will need to rebuild spline into curve
toggle_2 = BooleanToggle(True)  # disabled
crv = Curve(python)  # disabled
crv_2 = Curve(tweencrv)  # disabled
s_column = AddStructuralColumn(Curve=ln, Type=item, TrackingMode=2)  # disabled
wallcrv = AddWallCurve(Curve=crv, Type=item_2, Height=getwallheight, LocationLine=wll, AllowJoins=toggle, TrackingMode=2)  # disabled
floor = AddFloor(Boundary=floor_plate_boundary, Type=item_4, TrackingMode=2)  # disabled
roof = AddRoof(Boundary=roof_boundary_2, Type=item_5, TrackingMode=2)  # disabled
wallcrv_2 = AddWallCurve(Curve=crv_2, Type=item_3, Height=getwallheight_2, LocationLine=wll_2, AllowJoins=toggle_2, TrackingMode=2)  # disabled
pipeline_7 = GeometryPipeline(
    GroupByLayer=False,
    GroupByType=False,
    IncludeHidden=True,
    IncludeLocked=True,
    LayerFilter="01_SITE*01_ASPHALT",
    NameFilter="*",
    SublayerFiltering=True,
    TypeFilter=1073741848)  # disabled
categories_7 = DirectShapeCategories("autodesk.revit.category.local:floors-1.0.0", SearchPattern="Floors")  # disabled
pipeline_8 = GeometryPipeline(
    GroupByLayer=False,
    GroupByType=False,
    IncludeHidden=True,
    IncludeLocked=True,
    LayerFilter="01_SITE*01_GRASS",
    NameFilter="*",
    SublayerFiltering=True,
    TypeFilter=1073741848)  # disabled
categories_8 = DirectShapeCategories("autodesk.revit.category.local:topography-1.0.0", SearchPattern="TOPOGRAPHY")  # disabled
pipeline_9 = GeometryPipeline(
    GroupByLayer=False,
    GroupByType=False,
    IncludeHidden=True,
    IncludeLocked=True,
    LayerFilter="01_SITE*01_WATER",
    NameFilter="*",
    SublayerFiltering=True,
    TypeFilter=1073741848)  # disabled
categories_9 = DirectShapeCategories("autodesk.revit.category.local:topography-1.0.0", SearchPattern="TOPOGRAPHY")  # disabled

# ---- group: Simple Material Creation
swatch = ColourSwatch(SwatchColor=RGB(255, 252, 252))  # disabled
material = ConvertMaterial(Shader=swatch, TrackingMode=2)  # disabled

# ----
# SITE ELEMENTS
pipeline_10 = GeometryPipeline(
    GroupByLayer=False,
    GroupByType=False,
    IncludeHidden=True,
    IncludeLocked=True,
    LayerFilter="01_SITE*01_PAVEMENT",
    NameFilter="*",
    SublayerFiltering=True,
    TypeFilter=1073741848)  # disabled
categories_10 = DirectShapeCategories("autodesk.revit.category.local:floors-1.0.0", SearchPattern="Floors")  # disabled
pipeline_11 = GeometryPipeline(
    GroupByLayer=False,
    GroupByType=False,
    IncludeHidden=True,
    IncludeLocked=True,
    LayerFilter="03_ARCH*03_EXT FINISH",
    NameFilter="*",
    SublayerFiltering=True,
    TypeFilter=1073741848)
categories_11 = DirectShapeCategories("autodesk.revit.category.family:genericModel-1.0.0", SearchPattern="GENERIC")
pipeline_12 = GeometryPipeline(
    GroupByLayer=False,
    GroupByType=False,
    IncludeHidden=True,
    IncludeLocked=True,
    LayerFilter="03_ARCH*03_MILWORK",
    NameFilter="*",
    SublayerFiltering=True,
    TypeFilter=1073741848)
categories_12 = DirectShapeCategories("autodesk.revit.category.family:casework-1.0.0", SearchPattern="CASEWORK")

# ---- group: Simple Material Creation
swatch_2 = ColourSwatch(SwatchColor=RGB(82, 78, 78))  # disabled
material_2 = ConvertMaterial(Shader=swatch_2, TrackingMode=2)  # disabled

# ----
pipeline_13 = GeometryPipeline(
    GroupByLayer=False,
    GroupByType=False,
    IncludeHidden=True,
    IncludeLocked=True,
    LayerFilter="01_SITE*01_WALLS",
    NameFilter="*",
    SublayerFiltering=True,
    TypeFilter=1073741848)  # disabled
categories_13 = DirectShapeCategories("autodesk.revit.category.local:topography-1.0.0", SearchPattern="TOPOGRAPHY")  # disabled

# ---- group: Simple Material Creation
swatch_3 = ColourSwatch(SwatchColor=RGB(255, 252, 252))  # disabled
material_3 = ConvertMaterial(Shader=swatch_3, TrackingMode=2)  # disabled

swatch_4 = ColourSwatch(SwatchColor=RGB(152, 168, 72))  # disabled
material_4 = ConvertMaterial(Shader=swatch_4, TrackingMode=2)  # disabled

swatch_5 = ColourSwatch(SwatchColor=RGB(181, 181, 181))  # disabled
material_5 = ConvertMaterial(Shader=swatch_5, TrackingMode=2)  # disabled

# ----
pipeline_14 = GeometryPipeline(
    GroupByLayer=False,
    GroupByType=False,
    IncludeHidden=True,
    IncludeLocked=True,
    LayerFilter="01_SITE*01_WALLS",
    NameFilter="*",
    SublayerFiltering=True,
    TypeFilter=1073741848)  # disabled

# ---- group: Simple Material Creation
material_6 = ConvertMaterial(Shader=ColourSwatch(SwatchColor=RGB(70, 171, 82)), TrackingMode=2)

# ----
categories_14 = DirectShapeCategories("autodesk.revit.category.local:topography-1.0.0", SearchPattern="TOPOGRAPHY")  # disabled

# ---- group: Simple Material Creation
swatch_6 = ColourSwatch(SwatchColor=RGB(255, 252, 252))  # disabled
material_7 = ConvertMaterial(Shader=swatch_6, TrackingMode=2)  # disabled

material_8 = ConvertMaterial(Shader=ColourSwatch(SwatchColor=RGB(70, 171, 82)), TrackingMode=2)

# ----
# SHELL ELEMENTS
pipeline_15 = GeometryPipeline(
    GroupByLayer=False,
    GroupByType=False,
    IncludeHidden=True,
    IncludeLocked=True,
    LayerFilter="03_ARCH*03_GLAZING_GLASS",
    NameFilter="*",
    SublayerFiltering=True,
    TypeFilter=1073741848)  # disabled
dam_7 = DataDam(DataA=pipeline_11, BufferDelay=10000000, BufferMode=0)
dam_8 = DataDam(DataA=pipeline_12, BufferDelay=10000000, BufferMode=0)
dam_9 = DataDam(DataA=pipeline_10, BufferDelay=10000000, BufferMode=0)  # disabled
dam_10 = DataDam(DataA=pipeline_7, BufferDelay=10000000, BufferMode=0)  # disabled
dam_11 = DataDam(DataA=pipeline_8, BufferDelay=10000000, BufferMode=0)  # disabled
dam_12 = DataDam(DataA=pipeline_9, BufferDelay=10000000, BufferMode=0)  # disabled
dam_13 = DataDam(DataA=pipeline_13, BufferDelay=10000000, BufferMode=0)  # disabled
dam_14 = DataDam(DataA=pipeline_14, BufferDelay=10000000, BufferMode=0)  # disabled
geodshape_2 = AddGeometryDirectShape(Category=categories_11, Geometry=dam_7, Material=material_6, TrackingMode=2)
geodshape_3 = AddGeometryDirectShape(Category=categories_12, Geometry=dam_8, Material=material_8, TrackingMode=2)
categories_15 = BuiltInCategories("autodesk.revit.category.local:walls-1.0.0", LayoutLevel=2, SearchPattern="WALLS")  # disabled
dam_15 = DataDam(DataA=pipeline_15, BufferDelay=2500000, BufferMode=2)  # disabled
panel_7 = Panel("Pavement")  # disabled
pipeline_16 = GeometryPipeline(
    GroupByLayer=False,
    GroupByType=False,
    IncludeHidden=True,
    IncludeLocked=True,
    LayerFilter="03_ARCH*03_COLUMNS",
    NameFilter="*",
    SublayerFiltering=True,
    TypeFilter=1073741848)
categories_16 = DirectShapeCategories("autodesk.revit.category.family:structuralFraming-1.0.0", SearchPattern="STRUCTURAL")
categories_17 = DirectShapeCategories("autodesk.revit.category.family:planting-1.0.0", SearchPattern="PLANTING")
pipeline_17 = GeometryPipeline(
    GroupByLayer=False,
    GroupByType=False,
    IncludeHidden=True,
    IncludeLocked=True,
    LayerFilter="04_ENTOURAGE*04_PLANTERS",
    NameFilter="*",
    SublayerFiltering=True,
    TypeFilter=1073741848)

# ---- group: Simple Material Creation
material_9 = ConvertMaterial(Shader=ColourSwatch(SwatchColor=RGB(255, 255, 255)), TrackingMode=2)

material_10 = ConvertMaterial(Shader=ColourSwatch(SwatchColor=RGB(70, 171, 82)), TrackingMode=2)

# ----
# This component needs additional work
exterior_walls_3 = Brep(dam_15)  # disabled
types_6 = QueryTypes(Kind=3, Category=categories_15)  # disabled
number_slider_6 = Slider(42, range=0..50)  # disabled
getbrepprofile = GetBrepProfile(B=exterior_walls_3)  # disabled
getwallheight_3 = GetWallHeight(C=exterior_walls_3)  # -> graft(R); disabled
item_6 = ListItem(List=types_6, Index=number_slider_6, Wrap=True)  # disabled

geodshape_4 = AddGeometryDirectShape(Name=panel_7, Category=categories_10, Geometry=dam_9, Material=material_5, TrackingMode=2)  # disabled
geodshape_5 = AddGeometryDirectShape(Category=categories_7, Geometry=dam_10, Material=material_2, TrackingMode=2)  # disabled
geodshape_6 = AddGeometryDirectShape(Category=categories_8, Geometry=dam_11, Material=material_4, TrackingMode=2)  # disabled
geodshape_7 = AddGeometryDirectShape(Category=categories_9, Geometry=dam_12, Material=material, TrackingMode=2)  # disabled
geodshape_8 = AddGeometryDirectShape(Category=categories_13, Geometry=dam_13, Material=material_3, TrackingMode=2)  # disabled
geodshape_9 = AddGeometryDirectShape(Category=categories_14, Geometry=dam_14, Material=material_7, TrackingMode=2)  # disabled
panel_8 = Panel(types_6)  # disabled
dam_16 = DataDam(DataA=pipeline_16, BufferDelay=10000000, BufferMode=0)
dam_17 = DataDam(DataA=pipeline_17, BufferDelay=10000000, BufferMode=0)
geodshape_10 = AddGeometryDirectShape(Category=categories_16, Geometry=dam_16, Material=material_9, TrackingMode=2)
geodshape_11 = AddGeometryDirectShape(Category=categories_17, Geometry=dam_17, Material=material_10, TrackingMode=2)
crv_3 = Curve(getbrepprofile)  # disabled
wll_3 = WallLocationLine({"Wall Centerline": 0, "Core Centerline": 1, "Finish (Exterior Face)": 2, "Finish (Interior Face)": 3, "Core (Exterior Face)": 4, "Core (Interior Face)": 5}, selected="Wall Centerline")  # disabled
toggle_3 = BooleanToggle(False)  # disabled
crv_4 = Curve(crv_3)  # disabled
wallprfl = AddWallProfile(Profile=crv_4, Type=item_6, LocationLine=wll_3, AllowJoins=toggle_3, TrackingMode=2)  # disabled

# ==== cluster BrepTopBoundary
B = ClusterInput()
debrep = DeconstructBrep(Brep=B)  # -> Faces, Edges, Vertices
md_slider = MDSlider(SliderMode=0, slider_value=Point(0.5, 0.5, 0.5), x_domain=Domain(0, 1), y_domain=Domain(0, 1), z_domain=Domain(0, 1))
evalsrf = EvaluateSurface(Surface=reparameterize(debrep.Faces), Point=md_slider)  # -> Point, Normal, UDirection, VDirection, Frame
devec = DeconstructVector(Vector=evalsrf.Normal)  # -> XComponent, YComponent, simplify(ZComponent)
panel = Panel(evalsrf.Normal)
equals = Equality(FirstNumber=expr("round(x)", devec.ZComponent), SecondNumber=1)  # -> Equality, Inequality
cull = CullPattern(List=debrep.Faces, CullPattern=equals.Equality)
edges = BrepEdges(Brep=cull)  # -> Naked, Interior, NonManifold
join = JoinCurves(Curves=edges.Naked, Preserve=False)
C = ClusterOutput(join)
L = ClusterOutput(cull)

# ==== cluster BrepBottomBoundary
B = ClusterInput()
debrep = DeconstructBrep(Brep=B)  # -> Faces, Edges, Vertices
md_slider = MDSlider(SliderMode=0, slider_value=Point(0.5, 0.5, 0.5), x_domain=Domain(0, 1), y_domain=Domain(0, 1), z_domain=Domain(0, 1))
evalsrf = EvaluateSurface(Surface=reparameterize(debrep.Faces), Point=md_slider)  # -> Point, Normal, UDirection, VDirection, Frame
N = ClusterOutput(evalsrf.Normal)
devec = DeconstructVector(Vector=evalsrf.Normal)  # -> XComponent, YComponent, simplify(ZComponent)
equals = Equality(FirstNumber=expr("round(x)", devec.ZComponent), SecondNumber=-1)  # -> Equality, Inequality
cull = CullPattern(List=debrep.Faces, CullPattern=equals.Equality)
edges = BrepEdges(Brep=cull)  # -> Naked, Interior, NonManifold
L = ClusterOutput(cull)
join = JoinCurves(Curves=edges.Naked, Preserve=False)  # -> simplify(Curves)
C = ClusterOutput(join)

# ==== cluster GetBottomFace
B = ClusterInput()
debrep = DeconstructBrep(Brep=B)  # -> Faces, Edges, Vertices
md_slider = MDSlider(SliderMode=0, slider_value=Point(0.5, 0.5, 0.5), x_domain=Domain(0, 1), y_domain=Domain(0, 1), z_domain=Domain(0, 1))
evalsrf = EvaluateSurface(Surface=reparameterize(debrep.Faces), Point=md_slider)  # -> Point, Normal, UDirection, VDirection, Frame
devec = DeconstructVector(Vector=evalsrf.Normal)  # -> XComponent, YComponent, simplify(ZComponent)
equals = Equality(FirstNumber=expr("round(x)", devec.ZComponent), SecondNumber=-1)  # -> Equality, Inequality
cull = CullPattern(List=debrep.Faces, CullPattern=equals.Equality)
L = ClusterOutput(cull)

# ==== cluster GetLongestEdgeCurves
B = ClusterInput()
edges = BrepEdges(Brep=B)  # -> Naked, Interior, NonManifold
len = Length(Curve=edges.Naked)
sort = SortList(Keys=len, ValuesA=edges.Naked)  # -> reverse(Keys), ValuesA
rev = ReverseList(List=sort.ValuesA)
panel = Panel(rev)
panel_2 = Panel(sort.Keys)
item = ListItem(List=rev, Index=0, Wrap=True)  # -> Item, Item1
i = ClusterOutput(item.Item)
item_1 = ClusterOutput(item.Item1)

# ==== cluster GetWallHeight
C = ClusterInput()
bbox = BoundingBox(Content=C, Plane=PlaneXY(0, 0, 0))  # -> Box, Box_2
box_corners = BoxCorners(Box=bbox.Box)  # -> CornerA, CornerB, CornerC, CornerD, CornerE, CornerF, CornerG, CornerH
dist = Distance(PointA=box_corners.CornerA, PointB=box_corners.CornerE)
expression = Expression(x=dist, Expression="Round(x,2)")
R = ClusterOutput(expression)

# ==== cluster GetBrepProfile
B = ClusterInput()
debrep = DeconstructBrep(Brep=B)  # -> Faces, Edges, Vertices

area = Area(Geometry=debrep.Faces)  # -> Area, Centroid
sort = SortList(Keys=area.Area, ValuesA=debrep.Faces)  # -> Keys, reverse(ValuesA)
split = SplitList(List=sort.ValuesA, Index=1)  # -> ListA, ListB
srf = Surface(simplify(split.ListA))

edges = BrepEdges(Brep=srf)  # -> Naked, Interior, NonManifold
join = JoinCurves(Curves=edges.Naked, Preserve=False)
C = ClusterOutput(join)
