# Grasshopper definition BSA_RhinoToRevit_Complete Example 0.2.0.gh (Grasshopper 1.0.7)
# plug-ins: Rhino.Inside for Autodesk Revit, Pufferfish

_1st_floor = Level(<level referenced from the Revit model>)
_2nd_floor = Level(<level referenced from the Revit model>)
categories = BuiltInCategories("autodesk.revit.category.local:walls-1.0.0", LayoutLevel=2, SearchPattern="Walls")
pipeline = GeometryPipeline(
    GroupByLayer=False,
    GroupByType=False,
    IncludeHidden=True,
    IncludeLocked=True,
    LayerFilter="Make2D*Visible*Curves*03_FLOORS",
    NameFilter="*",
    SublayerFiltering=True,
    TypeFilter=1073741852)
pipeline_2 = GeometryPipeline(
    GroupByLayer=False,
    GroupByType=False,
    IncludeHidden=True,
    IncludeLocked=True,
    LayerFilter="Make2D*Visible*Curves*03_ROOF",
    NameFilter="*",
    SublayerFiltering=True,
    TypeFilter=1073741852)
pipeline_3 = GeometryPipeline(
    GroupByLayer=False,
    GroupByType=False,
    IncludeHidden=True,
    IncludeLocked=True,
    LayerFilter="Make2D*Visible*ClippingPlaneIntersections*03_ARCH*03_EXT WALLS",
    NameFilter="*",
    SublayerFiltering=True,
    TypeFilter=1073741852)
pipeline_4 = GeometryPipeline(
    GroupByLayer=False,
    GroupByType=False,
    IncludeHidden=True,
    IncludeLocked=True,
    LayerFilter="Make2D*Visible*ClippingPlaneIntersections*03_ARCH*03_INT WALLS",
    NameFilter="*",
    SublayerFiltering=True,
    TypeFilter=1073741852)
categories_2 = BuiltInCategories("autodesk.revit.category.local:floors-1.0.0", LayoutLevel=2, SearchPattern="fLOORS")
categories_3 = BuiltInCategories("autodesk.revit.category.local:roofs-1.0.0", LayoutLevel=2, SearchPattern="roofs")
dam = DataDam(DataA=pipeline, BufferDelay=10000000, BufferMode=0)
dam_2 = DataDam(DataA=pipeline_2, BufferDelay=10000000, BufferMode=0)

# ---- group: Convert Polylines into Lines
dam_3 = DataDam(DataA=pipeline_3, BufferDelay=2500000, BufferMode=2)
crv = Curve(reparameterize(graft(dam_3)))
disc = Discontinuity(Curve=crv, Level=Slider(1, range=0..3))  # -> Points, Parameters
shatter = Shatter(Curve=crv, Parameters=disc.Parameters)

dam_4 = DataDam(DataA=pipeline_4, BufferDelay=2500000, BufferMode=2)
crv_2 = Curve(reparameterize(graft(dam_4)))
disc_2 = Discontinuity(Curve=crv_2, Level=Slider(1, range=0..3))  # -> Points, Parameters
shatter_2 = Shatter(Curve=crv_2, Parameters=disc_2.Parameters)

# ---- group: Select Wall Type
category = Category(categories)
types = QueryTypes(Kind=3, Category=category)
panel = Panel(types)
item = ListItem(List=types, Index=Slider(34, range=0..50), Wrap=True)

category_2 = Category(categories)
types_2 = QueryTypes(Kind=3, Category=category_2)
panel_2 = Panel(types_2)
item_2 = ListItem(List=types_2, Index=Slider(33, range=0..50), Wrap=True)

# ---- group: Checks if curve is closed and ensures they are planer
clscrv = CloseCurve(Curve=dam, CloseType=0, Bulge=0.5, Tolerance=0)  # -> Closed, R; disabled
area = Area(Geometry=dam)  # -> Area, Centroid
xy = XYPlane(Origin=area.Centroid)
project = Project(Geometry=dam, Plane=xy)  # -> Geometry, Transform

# ----
level = Level(<level referenced from the Revit model>)

# ---- group: Removes Small Line portions
len = Length(Curve=shatter)
larger = LargerThan(FirstNumber=len, SecondNumber=Slider(0.5, range=0..5))  # -> LargerThan, OrEqualTo
cull = CullPattern(List=shatter, CullPattern=larger.LargerThan)

len_2 = Length(Curve=shatter_2)
larger_2 = LargerThan(FirstNumber=len_2, SecondNumber=Slider(0.5, range=0..5))  # -> LargerThan, OrEqualTo
cull_2 = CullPattern(List=shatter_2, CullPattern=larger_2.LargerThan)

# ----
types_3 = QueryTypes(Kind=3, Category=categories_2)
panel_3 = Panel(types_3)
floor_plate_boundary = Curve(simplify(graft(project.Geometry)))
item_3 = ListItem(List=types_3, Index=Slider(1, range=0..10), Wrap=True)

# ---- group: Checks if curve is closed and ensures they are planer
project_2 = Project(Geometry=dam_2, Plane=level)  # -> Geometry, Transform

# ----
types_4 = QueryTypes(Kind=3, Category=categories_3)
panel_4 = Panel(types_4)
floor_plate_boundary_2 = Curve(simplify(graft(project_2.Geometry)))
item_4 = ListItem(List=types_4, Index=Slider(3, range=0..10), Wrap=True)

# ---- group: Rebuilds lines
end = EndPoints(Curve=cull)  # -> Start, End
ln = Line(StartPoint=end.Start, EndPoint=end.End)

end_2 = EndPoints(Curve=cull_2)  # -> Start, End
ln_2 = Line(StartPoint=end_2.Start, EndPoint=end_2.End)

# ----
roof = AddRoof(Boundary=floor_plate_boundary_2, Type=item_4, TrackingMode=2)
floor = AddFloor(Boundary=floor_plate_boundary, Type=item_3, TrackingMode=2)

# ---- group: Evaluate Location of Line (Which floor is it in)
curvepoint = PointOnCurve(ln, parameter=0.5)
python = GhPythonScript(points=flatten(curvepoint))  # -> FirstFloor, SecondFloor; inputs points: list of Point3d
# ---------- python: Python ----------
import rhinoscriptsyntax as rs
import Grasshopper as gh
import Rhino.Geometry as rg
import ghpythonlib.components as comps

FirstFloor = []
SecondFloor = []

for point in points: 

    values = comps.Deconstruct(point)
    print(values)
    
    z_value = round(values['z_component'],0)
    
    if z_value > 0: 
        
        SecondFloor.append(True)
        FirstFloor.append(False)
    
    else:
        
        SecondFloor.append(False)
        FirstFloor.append(True)

print(FirstFloor)
# ---------- end python ----------

curvepoint_2 = PointOnCurve(ln_2, parameter=0.5)
python_2 = GhPythonScript(points=flatten(curvepoint_2))  # -> FirstFloor, SecondFloor; inputs points: list of Point3d; same code as python

# ----
panel_5 = Panel(python.FirstFloor)
panel_6 = Panel(python_2.FirstFloor)
cull_3 = CullPattern(List=flatten(ln), CullPattern=python.FirstFloor)
cull_4 = CullPattern(List=flatten(ln), CullPattern=python.SecondFloor)
cull_5 = CullPattern(List=flatten(ln_2), CullPattern=python_2.FirstFloor)
cull_6 = CullPattern(List=flatten(ln_2), CullPattern=python_2.SecondFloor)
wll = WallLocationLine({"Wall Centerline": 0, "Core Centerline": 1, "Finish (Exterior Face)": 2, "Finish (Interior Face)": 3, "Core (Exterior Face)": 4, "Core (Interior Face)": 5}, selected="Wall Centerline")
wll_2 = WallLocationLine({"Wall Centerline": 0, "Core Centerline": 1, "Finish (Exterior Face)": 2, "Finish (Interior Face)": 3, "Core (Exterior Face)": 4, "Core (Interior Face)": 5}, selected="Wall Centerline")
wll_3 = WallLocationLine({"Wall Centerline": 0, "Core Centerline": 1, "Finish (Exterior Face)": 2, "Finish (Interior Face)": 3, "Core (Exterior Face)": 4, "Core (Interior Face)": 5}, selected="Wall Centerline")
wll_4 = WallLocationLine({"Wall Centerline": 0, "Core Centerline": 1, "Finish (Exterior Face)": 2, "Finish (Interior Face)": 3, "Core (Exterior Face)": 4, "Core (Interior Face)": 5}, selected="Wall Centerline")
line = Line(cull_3)
level_2 = Level(_1st_floor)
line_2 = Line(cull_4)
level_3 = Level(_2nd_floor)
line_3 = Line(cull_5)
level_4 = Level(_1st_floor)
line_4 = Line(cull_6)
level_5 = Level(_2nd_floor)
wallcrv = AddWallCurve(
    Curve=line,
    Type=item,
    Level=level_2,
    Height=Slider(14, range=0..100),
    LocationLine=wll,
    AllowJoins=Toggle(True),
    TrackingMode=2)
wallcrv_2 = AddWallCurve(
    Curve=line_2,
    Type=item,
    Level=level_3,
    Height=Slider(15, range=0..100),
    LocationLine=wll_2,
    AllowJoins=Toggle(True),
    TrackingMode=2)
wallcrv_3 = AddWallCurve(
    Curve=line_3,
    Type=item_2,
    Level=level_4,
    Height=Slider(14, range=0..100),
    LocationLine=wll_3,
    AllowJoins=Toggle(True),
    TrackingMode=2)
wallcrv_4 = AddWallCurve(
    Curve=line_4,
    Type=item_2,
    Level=level_5,
    Height=Slider(14, range=0..100),
    LocationLine=wll_4,
    AllowJoins=Toggle(True),
    TrackingMode=2)
pipeline_5 = GeometryPipeline(
    GroupByLayer=False,
    GroupByType=False,
    IncludeHidden=True,
    IncludeLocked=True,
    LayerFilter="Make2D*Visible*ClippingPlaneIntersections*03_ARCH*03_GLAZING_GLASS",
    NameFilter="*",
    SublayerFiltering=True,
    TypeFilter=4)

# ---- group: Convert Polylines into Lines
dam_5 = DataDam(DataA=pipeline_5, BufferDelay=2500000, BufferMode=2)
crv_3 = Curve(reparameterize(graft(dam_5)))
disc_3 = Discontinuity(Curve=crv_3, Level=Slider(1, range=0..3))  # -> Points, Parameters
shatter_3 = Shatter(Curve=crv_3, Parameters=disc_3.Parameters)

# ---- group: Select Wall Type
category_3 = Category(categories)
types_5 = QueryTypes(Kind=3, Category=category_3)
panel_7 = Panel(types_5)
item_5 = ListItem(List=types_5, Index=Slider(41, range=0..50), Wrap=True)

# ---- group: Removes Small Line portions
len_3 = Length(Curve=shatter_3)
larger_3 = LargerThan(FirstNumber=len_3, SecondNumber=Slider(0.5, range=0..5))  # -> LargerThan, OrEqualTo
cull_7 = CullPattern(List=shatter_3, CullPattern=larger_3.LargerThan)

# ---- group: Rebuilds lines
end_3 = EndPoints(Curve=cull_7)  # -> Start, End
ln_3 = Line(StartPoint=end_3.Start, EndPoint=end_3.End)

# ---- group: Evaluate Location of Line (Which floor is it in)
curvepoint_3 = PointOnCurve(ln_3, parameter=0.5)
python_3 = GhPythonScript(points=flatten(curvepoint_3))  # -> FirstFloor, SecondFloor; inputs points: list of Point3d; same code as python

# ----
panel_8 = Panel(python_3.FirstFloor)
cull_8 = CullPattern(List=flatten(ln_3), CullPattern=python_3.FirstFloor)
cull_9 = CullPattern(List=flatten(ln_3), CullPattern=python_3.SecondFloor)
wll_5 = WallLocationLine({"Wall Centerline": 0, "Core Centerline": 1, "Finish (Exterior Face)": 2, "Finish (Interior Face)": 3, "Core (Exterior Face)": 4, "Core (Interior Face)": 5}, selected="Wall Centerline")
wll_6 = WallLocationLine({"Wall Centerline": 0, "Core Centerline": 1, "Finish (Exterior Face)": 2, "Finish (Interior Face)": 3, "Core (Exterior Face)": 4, "Core (Interior Face)": 5}, selected="Wall Centerline")
line_5 = Line(cull_8)
line_6 = Line(cull_9)
level_6 = Level(_1st_floor)
level_7 = Level(_2nd_floor)
wallcrv_5 = AddWallCurve(
    Curve=line_5,
    Type=item_5,
    Level=level_6,
    Height=Slider(15, range=0..100),
    LocationLine=wll_5,
    AllowJoins=Toggle(True),
    TrackingMode=2)
wallcrv_6 = AddWallCurve(
    Curve=line_6,
    Type=item_5,
    Level=level_7,
    Height=Slider(15, range=0..100),
    LocationLine=wll_6,
    AllowJoins=Toggle(True),
    TrackingMode=2)
pipeline_6 = GeometryPipeline(
    GroupByLayer=False,
    GroupByType=False,
    IncludeHidden=True,
    IncludeLocked=True,
    LayerFilter="01_SITE*Asphalt",
    NameFilter="*",
    SublayerFiltering=True,
    TypeFilter=1073741848)
categories_4 = DirectShapeCategories("autodesk.revit.category.local:floors-1.0.0", SearchPattern="Floors")
pipeline_7 = GeometryPipeline(
    GroupByLayer=False,
    GroupByType=False,
    IncludeHidden=True,
    IncludeLocked=True,
    LayerFilter="01_SITE*Grass",
    NameFilter="*",
    SublayerFiltering=True,
    TypeFilter=1073741848)
categories_5 = DirectShapeCategories("autodesk.revit.category.local:topography-1.0.0", SearchPattern="TOPOGRAPHY")
pipeline_8 = GeometryPipeline(
    GroupByLayer=False,
    GroupByType=False,
    IncludeHidden=True,
    IncludeLocked=True,
    LayerFilter="Courtyard",
    NameFilter="*",
    SublayerFiltering=True,
    TypeFilter=1073741848)
categories_6 = DirectShapeCategories("autodesk.revit.category.local:floors-1.0.0", SearchPattern="Floor")
# SITE ELEMENTS
pipeline_9 = GeometryPipeline(
    GroupByLayer=False,
    GroupByType=False,
    IncludeHidden=True,
    IncludeLocked=True,
    LayerFilter="Pavement",
    NameFilter="*",
    SublayerFiltering=True,
    TypeFilter=1073741848)
categories_7 = DirectShapeCategories("autodesk.revit.category.local:floors-1.0.0", SearchPattern="Floors")

# ---- group: Simple Material Creation
material = ConvertMaterial(Shader=ColourSwatch(SwatchColor=RGB(214, 214, 214)), TrackingMode=2)

material_2 = ConvertMaterial(Shader=ColourSwatch(SwatchColor=RGB(82, 78, 78)), TrackingMode=2)

# ----
pipeline_10 = GeometryPipeline(
    GroupByLayer=False,
    GroupByType=False,
    IncludeHidden=True,
    IncludeLocked=True,
    LayerFilter="01_SITE*02_SITE_WALLS",
    NameFilter="*",
    SublayerFiltering=True,
    TypeFilter=1073741848)
categories_8 = DirectShapeCategories("autodesk.revit.category.local:walls-1.0.0", SearchPattern="WALLS")

# ---- group: Simple Material Creation
material_3 = ConvertMaterial(Shader=ColourSwatch(SwatchColor=RGB(231, 241, 220)), TrackingMode=2)

material_4 = ConvertMaterial(Shader=ColourSwatch(SwatchColor=RGB(255, 252, 252)), TrackingMode=2)

material_5 = ConvertMaterial(Shader=ColourSwatch(SwatchColor=RGB(181, 181, 181)), TrackingMode=2)

# ----
pipeline_11 = GeometryPipeline(
    GroupByLayer=False,
    GroupByType=False,
    IncludeHidden=True,
    IncludeLocked=True,
    LayerFilter="02_MASSING*02_OPTION 1 SOLID",
    NameFilter="*",
    SublayerFiltering=True,
    TypeFilter=1073741848)
categories_9 = DirectShapeCategories("autodesk.revit.category.family:genericModel-1.0.0", SearchPattern="GENERIC")

# ---- group: Simple Material Creation
material_6 = ConvertMaterial(Shader=ColourSwatch(SwatchColor=RGB(255, 252, 252)), TrackingMode=2)

# ----
dam_6 = DataDam(DataA=pipeline_9, BufferDelay=10000000, BufferMode=0)
dam_7 = DataDam(DataA=pipeline_6, BufferDelay=10000000, BufferMode=0)
dam_8 = DataDam(DataA=pipeline_7, BufferDelay=10000000, BufferMode=0)
dam_9 = DataDam(DataA=pipeline_8, BufferDelay=10000000, BufferMode=0)
dam_10 = DataDam(DataA=pipeline_10, BufferDelay=10000000, BufferMode=0)
dam_11 = DataDam(DataA=pipeline_11, BufferDelay=10000000, BufferMode=0)

neg = Negative(Value="1")
Z = UnitZ(Factor=neg)
extr = Extrude(Base=dam_8, Direction=Z)

neg_2 = Negative(Value="1")
Z_2 = UnitZ(Factor=neg_2)
extr_2 = Extrude(Base=dam_7, Direction=Z_2)  # -> graft(Extrusion)

neg_3 = Negative(Value="1")
Z_3 = UnitZ(Factor=neg_3)
extr_3 = Extrude(Base=dam_6, Direction=Z_3)  # -> graft(Extrusion)

geodshape = AddGeometryDirectShape(Category=categories_6, Geometry=dam_9, Material=material, TrackingMode=2)
geodshape_2 = AddGeometryDirectShape(Name="Site Walls", Category=categories_8, Geometry=dam_10, Material=material_4, TrackingMode=2)
geodshape_3 = AddGeometryDirectShape(Name="Site Buildings", Category=categories_9, Geometry=dam_11, Material=material_6, TrackingMode=2)
brep = Brep(extr_2)
geodshape_4 = AddGeometryDirectShape(Name="Pavement", Category=categories_7, Geometry=extr_3, Material=material_5, TrackingMode=2)
geodshape_5 = AddGeometryDirectShape(Name="Asphalt2", Category=categories_4, Geometry=brep, Material=material_2, TrackingMode=2)
geodshape_6 = AddGeometryDirectShape(Name="Grass", Category=categories_5, Geometry=extr, Material=material_3, TrackingMode=2)
categories_10 = DirectShapeCategories("autodesk.revit.category.family:genericModel-1.0.0", SearchPattern="Generic ")
categories_11 = DirectShapeCategories("autodesk.revit.category.family:structuralFraming-1.0.0", SearchPattern="structural framing")

# ---- group: Simple Material Creation
material_7 = ConvertMaterial(Shader=ColourSwatch(SwatchColor=RGB(173, 155, 204)), TrackingMode=2)

# ----
screen_structure = Brep([<brep referenced from the Rhino model> x36])
screen = Brep([<brep referenced from the Rhino model> x5000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])

# ---- group: Simple Material Creation
material_8 = ConvertMaterial(Shader=ColourSwatch(SwatchColor=RGB(181, 181, 181)), TrackingMode=2)

# ----
geodshape_7 = AddGeometryDirectShape(Name="Screen", Category=categories_10, Geometry=screen, Material=material_7, TrackingMode=2)
geodshape_8 = AddGeometryDirectShape(Category=categories_11, Geometry=screen_structure, Material=material_8, TrackingMode=2)
id = Guid([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])
python_4 = PythonScript(id=id)  # -> out, a, pt
# ---------- python_4: Python ----------
import rhinoscriptsyntax as rs
import Rhino as rc
import scriptcontext as sc

import re

def remove_numbers_and_brackets(string):    
    return re.sub(r'\d+|\(|\)', '', string)


# Set the script context to the current Rhino doc
sc.doc = rc.RhinoDoc.ActiveDoc

# Do your Rhino doc business...
if id:
    a = rs.TextObjectText(id)
    a = re.sub(r'\(|\)', '', a)
    a = re.sub(r'sf', '', a)
    a = re.sub(r'\s', '', a)
    a = re.sub(r'@', '', a)
    pt = rs.TextObjectPoint(id)

# Then set the script context back to the Grasshopper doc
sc.doc = ghdoc
# ---------- end python_4 ----------
panel_9 = Panel(python_4.a)
panel_10 = Panel(python_4.pt)
python_5 = GhPythonScript(points=flatten(python_4.pt), names=panel_9)  # -> FirstFloor, FirstFloorNames, SecondFloor, SecondFloorNames; inputs points: list of Point3d, names: list
# ---------- python_5: Python ----------
import rhinoscriptsyntax as rs
import Grasshopper as gh
import Rhino.Geometry as rg
import ghpythonlib.components as comps

FirstFloor = []
SecondFloor = []

FirstFloorNames = []
SecondFloorNames = []

for i in range(0,len(points)): 
    
    point = points[i]
    name = names[i]
    
    values = comps.Deconstruct(point)
    print(values)
    
    z_value = round(values['z_component'],0)
    
    if z_value > 0: 
        
        SecondFloor.append(point)
        #FirstFloor.append(False)
        SecondFloorNames.append(name)
    
    else:
        
        #SecondFloor.append(False)
        FirstFloor.append(point)
        FirstFloorNames.append(name)

print(FirstFloor)
# ---------- end python_5 ----------

# ---- group: Transfer the points to a CSV File
python_6 = GhPythonScript(
    names=flatten(panel_9),
    points=flatten(python_4.pt),
    fileAddress="C:\Users\ilouh\Desktop\Covenant House\RoomLocation.csv")  # inputs names: list, points: list of Point3d
# ---------- python_6: Python ----------
import rhinoscriptsyntax as rs
import Grasshopper as gh
import Rhino.Geometry as rg
import ghpythonlib.components as comps


fileName = open(fileAddress, 'w')

for i in range(0,len(points)):
    pt = points[i]
    name = names[i]
    
    print(name)
    
    fileName.write(`name` + ',' + `pt.X` + ',' + `pt.Y` + ',' + `pt.Z` + '\n')

fileName.close()
# ---------- end python_6 ----------

# ----
floor_plan = FloorPlan(<floor plan referenced from the Revit model>)
floor_plan_2 = FloorPlan(<floor plan referenced from the Revit model>)
room = AddRoom(View=floor_plan_2, Location=python_5.SecondFloor, TrackingMode=2)
room_2 = AddRoom(View=floor_plan, Location=python_5.FirstFloor, TrackingMode=2)
param = ElementParameter(Element=room, Value=python_5.SecondFloorNames)  # -> Element, Value
param_2 = ElementParameter(Element=room_2, Value=python_5.FirstFloorNames)  # -> Element, Value
