# Grasshopper definition BSA_RhinoToRevit_WallsByBreps 0.2.0.gh (Grasshopper 1.0.7)
# plug-ins: Rhino.Inside for Autodesk Revit

pipeline = GeometryPipeline(
    GroupByLayer=False,
    GroupByType=False,
    IncludeHidden=True,
    IncludeLocked=True,
    LayerFilter="03_ARCH*03_PARAPET",
    NameFilter="*",
    SublayerFiltering=True,
    TypeFilter=1073741848)
categories = BuiltInCategories("autodesk.revit.category.local:walls-1.0.0", LayoutLevel=2, SearchPattern="WALLS")
dam = DataDam(DataA=pipeline, BufferDelay=5000000, BufferMode=2)

# ---- group: Exterior Wall
exterior_walls = Brep(dam)
types = QueryTypes(Kind=3, Category=categories)
panel = Panel(types)
getwallheight = GetWallHeight(C=exterior_walls)  # -> graft(R)
getbottomface = GetBottomFace(B=exterior_walls)
bottom_face = Surface(flatten(getbottomface))
get_longest_edge_curves = GetLongestEdgeCurves(B=bottom_face)  # -> i, item_1
item = ListItem(List=types, Index=Slider(34, range=0..50), Wrap=True)

# ----
edges = BrepEdges(Brep=bottom_face)  # -> Naked, Interior, NonManifold
len = Length(Curve=edges.Naked)
sort = SortList(Keys=len, ValuesA=edges.Naked)  # -> reverse(Keys), ValuesA
split = SplitList(List=sort.ValuesA, Index=2)  # -> ListA, ListB
panel_2 = Panel(sort.Keys)
join = JoinCurves(Curves=split.ListB, Preserve=False)
item_2 = ListItem(List=join, Index=0, Wrap=True)  # -> Item, Item1
panel_3 = Panel(join)
tweencrv = TweenCurve(CurveA=item_2.Item, CurveB=item_2.Item1, Factor=0.5, BlendType=0)
panel_4 = Panel(get_longest_edge_curves.i)
explode = Explode(Curve=tweencrv, Recursive=True)  # -> Segments, Vertices
wll = WallLocationLine({"Wall Centerline": 0, "Core Centerline": 1, "Finish (Exterior Face)": 2, "Finish (Interior Face)": 3, "Core (Exterior Face)": 4, "Core (Interior Face)": 5}, selected="Wall Centerline")
crv = Curve(explode.Segments)
lng = ListLength(List=crv)
# will need some fixing
# Add curvature - will need to rebuild spline into curve
toggle = BooleanToggle(True)
larger = LargerThan(FirstNumber=lng, SecondNumber=Slider(0.5, range=0..1))  # -> LargerThan, OrEqualTo
cull = CullPattern(List=crv, CullPattern=larger.OrEqualTo)
wallcrv = AddWallCurve(Curve=cull, Type=item, Height=Slider(3, range=0..10), LocationLine=wll, AllowJoins=toggle, TrackingMode=2)

# ==== cluster GetBottomFace
B = ClusterInput()
debrep = DeconstructBrep(Brep=B)  # -> Faces, Edges, Vertices
md_slider = MDSlider(SliderMode=0, slider_value=Point(0.5, 0.5, 0.5), x_domain=Domain(0, 1), y_domain=Domain(0, 1), z_domain=Domain(0, 1))
evalsrf = EvaluateSurface(Surface=reparameterize(debrep.Faces), Point=md_slider)  # -> Point, Normal, UDirection, VDirection, Frame
devec = DeconstructVector(Vector=evalsrf.Normal)  # -> XComponent, YComponent, simplify(ZComponent)
equals = Equality(FirstNumber=expr("round(x)", devec.ZComponent), SecondNumber=-1)  # -> Equality, Inequality
cull = CullPattern(List=debrep.Faces, CullPattern=equals.Equality)
L = ClusterOutput(cull)

# ==== cluster GetLongestEdgeCurves
B = ClusterInput()
edges = BrepEdges(Brep=B)  # -> Naked, Interior, NonManifold
len = Length(Curve=edges.Naked)
sort = SortList(Keys=len, ValuesA=edges.Naked)  # -> reverse(Keys), ValuesA
rev = ReverseList(List=sort.ValuesA)
panel = Panel(sort.Keys)
item = ListItem(List=rev, Index=0, Wrap=True)  # -> Item, Item1
panel_2 = Panel(rev)
i = ClusterOutput(item.Item)
item_1 = ClusterOutput(item.Item1)

# ==== cluster GetWallHeight
C = ClusterInput()
bbox = BoundingBox(Content=C, Plane=PlaneXY(0, 0, 0))  # -> Box, Box_2
box_corners = BoxCorners(Box=bbox.Box)  # -> CornerA, CornerB, CornerC, CornerD, CornerE, CornerF, CornerG, CornerH
dist = Distance(PointA=box_corners.CornerA, PointB=box_corners.CornerE)
expression = Expression(x=dist, Expression="Round(x,2)")
R = ClusterOutput(expression)
