# Grasshopper definition BSA_RhinoToRevit_WallsByCurves 0.3.0.gh (Grasshopper 1.0.7)
# plug-ins: Rhino.Inside for Autodesk Revit, Pufferfish

pipeline = GeometryPipeline(
    GroupByLayer=False,
    GroupByType=False,
    IncludeHidden=True,
    IncludeLocked=True,
    LayerFilter="04_RhRe*walls",
    NameFilter="*",
    SublayerFiltering=True,
    TypeFilter=4)
number_slider = Slider(12, range=0..100)
category = Category(<category referenced from the Revit model>)
types = QueryTypes(Kind=3, Category=category)
panel = Panel(types)

# ---- group: Convert Polylines into Lines
dam = DataDam(DataA=pipeline, BufferDelay=2500000, BufferMode=2)
crv = Curve(reparameterize(graft(dam)))
disc = Discontinuity(Curve=crv, Level=Slider(1, range=0..3))  # -> Points, Parameters
shatter = Shatter(Curve=crv, Parameters=disc.Parameters)

# ----
clscrv = CloseCurve(Curve=<missing>, CloseType=0, Bulge=0.5, Tolerance=0)  # -> Closed, R; disabled

# ---- group: Removes Small Line portions
len = Length(Curve=shatter)
larger = LargerThan(FirstNumber=len, SecondNumber=Slider(0.5, range=0..5))  # -> LargerThan, OrEqualTo
cull = CullPattern(List=shatter, CullPattern=larger.LargerThan)

# ----
item = ListItem(List=types, Index=Slider(0, range=0..50), Wrap=True)

# ---- group: Evaluate Location of Line (Which floor is it in)
curvepoint = PointOnCurve(cull, parameter=0.5)
python = GhPythonScript(points=flatten(curvepoint))  # -> FirstFloor, SecondFloor; inputs points: list of Point3d
# ---------- python: Python ----------
import rhinoscriptsyntax as rs
import Grasshopper as gh
import Rhino.Geometry as rg
import ghpythonlib.components as comps

FirstFloor = []
SecondFloor = []

for point in points: 

    values = comps.Deconstruct(point)
    print(values)
    
    z_value = round(values['z_component'],0)
    
    if z_value > 0: 
        
        SecondFloor.append(True)
        FirstFloor.append(False)
    
    else:
        
        SecondFloor.append(False)
        FirstFloor.append(True)

print(FirstFloor)
# ---------- end python ----------

# ----
panel_2 = Panel(python.FirstFloor)
cull_2 = CullPattern(List=flatten(cull), CullPattern=python.FirstFloor)
cull_3 = CullPattern(List=flatten(cull), CullPattern=python.SecondFloor)
wll = WallLocationLine({"Wall Centerline": 0, "Core Centerline": 1, "Finish (Exterior Face)": 2, "Finish (Interior Face)": 3, "Core (Exterior Face)": 4, "Core (Interior Face)": 5}, selected="Wall Centerline")
wll_2 = WallLocationLine({"Wall Centerline": 0, "Core Centerline": 1, "Finish (Exterior Face)": 2, "Finish (Interior Face)": 3, "Core (Exterior Face)": 4, "Core (Interior Face)": 5}, selected="Wall Centerline")
wallcrv = AddWallCurve(Curve=cull_2, Type=item, Height=number_slider, LocationLine=wll, AllowJoins=Toggle(True), TrackingMode=2)
wallcrv_2 = AddWallCurve(Curve=cull_3, Type=item, Height=number_slider, LocationLine=wll_2, AllowJoins=Toggle(True), TrackingMode=2)
