# Grasshopper definition BSA_AddRoomInRevitByPointsInRhino.gh (Grasshopper 1.0.7)
# plug-ins: Rhino.Inside for Autodesk Revit

id = Guid([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])
python = PythonScript(id=id)  # -> out, a, pt
# ---------- python: Python ----------
import rhinoscriptsyntax as rs
import Rhino as rc
import scriptcontext as sc

import re

def remove_numbers_and_brackets(string):    
    return re.sub(r'\d+|\(|\)', '', string)


# Set the script context to the current Rhino doc
sc.doc = rc.RhinoDoc.ActiveDoc

# Do your Rhino doc business...
if id:
    a = rs.TextObjectText(id)
    a = re.sub(r'\(|\)', '', a)
    a = re.sub(r'sf', '', a)
    a = re.sub(r'\s', '', a)
    a = re.sub(r'@', '', a)
    pt = rs.TextObjectPoint(id)

# Then set the script context back to the Grasshopper doc
sc.doc = ghdoc
# ---------- end python ----------
panel = Panel(python.a)
panel_2 = Panel(python.pt)
python_2 = GhPythonScript(points=flatten(python.pt), names=panel)  # -> FirstFloor, FirstFloorNames, SecondFloor, SecondFloorNames; inputs points: list of Point3d, names: list
# ---------- python_2: Python ----------
import rhinoscriptsyntax as rs
import Grasshopper as gh
import Rhino.Geometry as rg
import ghpythonlib.components as comps

FirstFloor = []
SecondFloor = []

FirstFloorNames = []
SecondFloorNames = []

for i in range(0,len(points)): 
    
    point = points[i]
    name = names[i]
    
    values = comps.Deconstruct(point)
    print(values)
    
    z_value = round(values['z_component'],0)
    
    if z_value > 0: 
        
        SecondFloor.append(point)
        #FirstFloor.append(False)
        SecondFloorNames.append(name)
    
    else:
        
        #SecondFloor.append(False)
        FirstFloor.append(point)
        FirstFloorNames.append(name)

print(FirstFloor)
# ---------- end python_2 ----------

# ---- group: Transfer the points to a CSV File
python_3 = GhPythonScript(names=flatten(panel), points=flatten(python.pt), fileAddress="C:\Users\ilouh\Desktop\Covenant House\RoomLocation.csv")  # inputs names: list, points: list of Point3d
# ---------- python_3: Python ----------
import rhinoscriptsyntax as rs
import Grasshopper as gh
import Rhino.Geometry as rg
import ghpythonlib.components as comps


fileName = open(fileAddress, 'w')

for i in range(0,len(points)):
    pt = points[i]
    name = names[i]
    
    print(name)
    
    fileName.write(`name` + ',' + `pt.X` + ',' + `pt.Y` + ',' + `pt.Z` + '\n')

fileName.close()
# ---------- end python_3 ----------

# ----
floor_plan = FloorPlan(<floor plan referenced from the Revit model>)
floor_plan_2 = FloorPlan(<floor plan referenced from the Revit model>)
room = AddRoom(View=floor_plan_2, Location=python_2.SecondFloor, TrackingMode=2)
room_2 = AddRoom(View=floor_plan, Location=python_2.FirstFloor, TrackingMode=2)
param = ElementParameter(Element=room, Value=python_2.SecondFloorNames)  # -> Element, Value
param_2 = ElementParameter(Element=room_2, Value=python_2.FirstFloorNames)  # -> Element, Value
