# Grasshopper definition BSA_AssignFamiliesToModel.gh (Grasshopper 1.0.7)
# plug-ins: Rhino.Inside for Autodesk Revit

pt = Point([<point referenced from the Rhino model> x181])

# ---- group: Transfer the points to a CSV File
python = GhPythonScript(points=flatten(pt), fileAddress="C:\Users\ilouh\Desktop\Covenant House\DoorLocation.csv")  # inputs points: list of Point3d
# ---------- python: Python ----------
import rhinoscriptsyntax as rs
import Grasshopper as gh
import Rhino.Geometry as rg
import ghpythonlib.components as comps

fileName = open(fileAddress, 'w')

for pt in points:
    
    fileName.write(`pt.X` + ',' + `pt.Y` + ',' + `pt.Z` + '\n')

fileName.close()
# ---------- end python ----------

# ----
python_2 = GhPythonScript(points=flatten(pt))  # -> FirstFloor, SecondFloor; inputs points: list of Point3d
# ---------- python_2: Python ----------
import rhinoscriptsyntax as rs
import Grasshopper as gh
import Rhino.Geometry as rg
import ghpythonlib.components as comps

FirstFloor = []
SecondFloor = []

for point in points: 

    values = comps.Deconstruct(point)
    print(values)
    
    z_value = round(values['z_component'],0)
    
    if z_value > 0: 
        
        SecondFloor.append(point)
        #FirstFloor.append(False)
    
    else:
        
        #SecondFloor.append(False)
        FirstFloor.append(point)

print(FirstFloor)
# ---------- end python_2 ----------
number_slider = Slider(3, range=0..10)  # disabled

# ---- group: Queries All walls within a model
walls = QueryWalls(WallSystemFamily=0)  # disabled

# ----
neg = Negative(Value=number_slider)  # disabled
brep = Brep(walls)  # disabled
Z = UnitZ(Factor=neg)  # disabled
move = Move(Geometry=brep, Motion=Z)  # -> Geometry, Transform; disabled
brepinc = PointInBrep(Brep=graft(move.Geometry), Point=simplify(pt), Strict=False)  # disabled
