# Grasshopper definition BSA_RevitToRhinoCategories 0.2.0.gh (Grasshopper 1.0.7)
# plug-ins: Rhino.Inside for Autodesk Revit

# Right click on category to select the proper category you would like to import back to Rhino
category = Category(<category referenced from the Revit model>)
category_filter = CategoryFilter(Categories=category, Inverted=False)
elements = QueryElements(Filter=category_filter, Limit=300)  # -> Elements, Count
e_name = ElementName(Element=elements.Elements)  # -> Element, Name
panel = Panel(e_name.Name)
geometry = ElementGeometry(Elements=elements.Elements)
preview = CustomPreview(
    Geometry=geometry,
    Material={diffuse=RGB(221, 160, 221), emission=RGB(66, 48, 66), shine=0.5, specular=RGB(255, 255, 255), transparency=0})
volume = Volume(Geometry=flatten(geometry))  # -> Volume, Centroid
tag = TextTag(Location=volume.Centroid, Text=panel)
