# Grasshopper definition BSA_RhinoToRevit_AssembliesByCurves 0.3.0.gh (Grasshopper 1.0.7)
# plug-ins: Rhino.Inside for Autodesk Revit, Pufferfish

pipeline = GeometryPipeline(
    GroupByLayer=False,
    GroupByType=False,
    IncludeHidden=True,
    IncludeLocked=True,
    LayerFilter="Make2D*Visible*Curves*03_FLOORS",
    NameFilter="*",
    SublayerFiltering=True,
    TypeFilter=1073741852)
pipeline_2 = GeometryPipeline(
    GroupByLayer=False,
    GroupByType=False,
    IncludeHidden=True,
    IncludeLocked=True,
    LayerFilter="Make2D*Visible*Curves*03_ROOF",
    NameFilter="*",
    SublayerFiltering=True,
    TypeFilter=1073741852)
pipeline_3 = GeometryPipeline(
    GroupByLayer=False,
    GroupByType=False,
    IncludeHidden=True,
    IncludeLocked=True,
    LayerFilter="Make2D*Visible*ClippingPlaneIntersections*03_ARCH*03_EXT WALLS",
    NameFilter="*",
    SublayerFiltering=True,
    TypeFilter=1073741852)
dam = DataDam(DataA=pipeline, BufferDelay=10000000, BufferMode=0)
dam_2 = DataDam(DataA=pipeline_2, BufferDelay=10000000, BufferMode=0)

# ---- group: Convert Polylines into Lines
dam_3 = DataDam(DataA=pipeline_3, BufferDelay=2500000, BufferMode=2)
crv = Curve(reparameterize(graft(dam_3)))
disc = Discontinuity(Curve=crv, Level=Slider(1, range=0..3))  # -> Points, Parameters
shatter = Shatter(Curve=crv, Parameters=disc.Parameters)

# ---- group: Select Wall Type
category = Category(<category referenced from the Revit model>)
types = QueryTypes(Kind=3, Category=category)
item = ListItem(Index=Slider(34, range=0..50), Wrap=True)

# ---- group: Checks if curve is closed and ensures they are planer
clscrv = CloseCurve(Curve=dam, CloseType=0, Bulge=0.5, Tolerance=0)  # -> Closed, R; disabled
area = Area(Geometry=dam)  # -> Area, Centroid
xy = XYPlane(Origin=area.Centroid)
project = Project(Geometry=dam, Plane=xy)  # -> Geometry, Transform

# ----
level = Level(<level referenced from the Revit model>)

types_2 = QueryTypes(Kind=3, Category=<geometry referenced from the Revit model>)
floor_plate_boundary = Curve(simplify(graft(project.Geometry)))
item_2 = ListItem(Index=Slider(1, range=0..10), Wrap=True)

# ---- group: Removes Small Line portions
len = Length(Curve=shatter)
larger = LargerThan(FirstNumber=len, SecondNumber=Slider(0.5, range=0..5))  # -> LargerThan, OrEqualTo
cull = CullPattern(List=shatter, CullPattern=larger.LargerThan)

# ---- group: Checks if curve is closed and ensures they are planer
project_2 = Project(Geometry=dam_2, Plane=level)  # -> Geometry, Transform

# ----
types_3 = QueryTypes(Kind=3, Category=<geometry referenced from the Revit model>)
floor_plate_boundary_2 = Curve(simplify(graft(project_2.Geometry)))
item_3 = ListItem(Index=Slider(3, range=0..10), Wrap=True)

floor = AddFloor(Boundary=floor_plate_boundary, Type=item_2, TrackingMode=2)

# ---- group: Rebuilds lines
end = EndPoints(Curve=cull)  # -> Start, End
ln = Line(StartPoint=end.Start, EndPoint=end.End)

# ----
roof = AddRoof(Boundary=floor_plate_boundary_2, Type=item_3, TrackingMode=2)

# ---- group: Evaluate Location of Line (Which floor is it in)
curvepoint = PointOnCurve(ln, parameter=0.5)
python = GhPythonScript(points=flatten(curvepoint))  # -> FirstFloor, SecondFloor; inputs points: list of Point3d
# ---------- python: Python ----------
import rhinoscriptsyntax as rs
import Grasshopper as gh
import Rhino.Geometry as rg
import ghpythonlib.components as comps

FirstFloor = []
SecondFloor = []

for point in points: 

    values = comps.Deconstruct(point)
    print(values)
    
    z_value = round(values['z_component'],0)
    
    if z_value > 0: 
        
        SecondFloor.append(True)
        FirstFloor.append(False)
    
    else:
        
        SecondFloor.append(False)
        FirstFloor.append(True)

print(FirstFloor)
# ---------- end python ----------

# ----
panel = Panel(python.FirstFloor)
cull_2 = CullPattern(List=flatten(ln), CullPattern=python.FirstFloor)
cull_3 = CullPattern(List=flatten(ln), CullPattern=python.SecondFloor)
wll = WallLocationLine({"Wall Centerline": 0, "Core Centerline": 1, "Finish (Exterior Face)": 2, "Finish (Interior Face)": 3, "Core (Exterior Face)": 4, "Core (Interior Face)": 5}, selected="Wall Centerline")
wll_2 = WallLocationLine({"Wall Centerline": 0, "Core Centerline": 1, "Finish (Exterior Face)": 2, "Finish (Interior Face)": 3, "Core (Exterior Face)": 4, "Core (Interior Face)": 5}, selected="Wall Centerline")
line = Line(cull_2)
level_2 = Level(<level referenced from the Revit model>)
line_2 = Line(cull_3)
level_3 = Level(<level referenced from the Revit model>)
wallcrv = AddWallCurve(
    Curve=line,
    Type=item,
    Level=level_2,
    Height=Slider(15, range=0..100),
    LocationLine=wll,
    AllowJoins=Toggle(True),
    TrackingMode=2)
wallcrv_2 = AddWallCurve(
    Curve=line_2,
    Type=item,
    Level=level_3,
    Height=Slider(15, range=0..100),
    LocationLine=wll_2,
    AllowJoins=Toggle(True),
    TrackingMode=2)
