# Grasshopper definition BSA_RhinoToRevit_DirectShape 0.3.0.gh (Grasshopper 1.0.8)
# plug-ins: Rhino.Inside for Autodesk Revit

brep = Brep(graft([<brep referenced from the Rhino model> x14]))
brep_2 = Brep(graft([<brep referenced from the Rhino model> x2]))
categories = DirectShapeCategories("autodesk.revit.category.family:casework-1.0.0", SearchPattern="casework")
brep_3 = Brep(graft([<brep referenced from the Rhino model> x4]))

# ---- group: Material Color Selection
swatch = ColourSwatch(SwatchColor=RGB(192, 180, 146))

# ----
categories_2 = DirectShapeCategories("autodesk.revit.category.family:casework-1.0.0", SearchPattern="casework")
brep_4 = Brep(graft([<brep referenced from the Rhino model> x25]))

# ---- group: Material Color Selection
swatch_2 = ColourSwatch(SwatchColor=RGB(255, 255, 255))

# ----
categories_3 = DirectShapeCategories("autodesk.revit.category.family:windows-1.0.0", SearchPattern="windows")

# ---- group: Material Color Selection
swatch_3 = ColourSwatch(SwatchColor=RGB(255, 72, 255))

# ----
categories_4 = DirectShapeCategories("autodesk.revit.category.family:windows-1.0.0", SearchPattern="windows")

# ---- group: Material Color Selection
swatch_4 = ColourSwatch(SwatchColor=RGB(47, 42, 0))

# ----
dam = DataDam(DataA=brep, BufferDelay=10000000, BufferMode=0)
material = AddMaterial(Name="Office Seating Cabinets", TrackingMode=2)
dam_2 = DataDam(DataA=brep_2, BufferDelay=10000000, BufferMode=0)
material_2 = AddMaterial(Name="Office Counters Cabinets", TrackingMode=2)
dam_3 = DataDam(DataA=brep_3, BufferDelay=10000000, BufferMode=0)
material_3 = AddMaterial(Name="Glass Window Door", TrackingMode=2)
dam_4 = DataDam(DataA=brep_4, BufferDelay=10000000, BufferMode=0)
material_4 = AddMaterial(Name="Glass Window Door Frame", TrackingMode=2)
graphics = MaterialGraphics(Material=material, Color=swatch)  # -> Material, UseRenderAppearance, Color, Transparency, SurfacePatternsForegroundPattern, SurfacePatternsForegroundColor, CutPatternsForegroundPattern, CutPatternsForegroundColor
graphics_2 = MaterialGraphics(Material=material_2, Color=swatch_2)  # -> Material, UseRenderAppearance, Color, Transparency, SurfacePatternsForegroundPattern, SurfacePatternsForegroundColor, CutPatternsForegroundPattern, CutPatternsForegroundColor
graphics_3 = MaterialGraphics(Material=material_3, Color=swatch_3)  # -> Material, UseRenderAppearance, Color, Transparency, SurfacePatternsForegroundPattern, SurfacePatternsForegroundColor, CutPatternsForegroundPattern, CutPatternsForegroundColor
graphics_4 = MaterialGraphics(Material=material_4, Color=swatch_4)  # -> Material, UseRenderAppearance, Color, Transparency, SurfacePatternsForegroundPattern, SurfacePatternsForegroundColor, CutPatternsForegroundPattern, CutPatternsForegroundColor
g_shape = AddDirectShapeGeometry(Category=categories, Geometry=dam, Material=graphics.Material, TrackingMode=2)
g_shape_2 = AddDirectShapeGeometry(Category=categories_2, Geometry=dam_2, Material=graphics_2.Material, TrackingMode=2)
g_shape_3 = AddDirectShapeGeometry(Category=categories_3, Geometry=dam_3, Material=graphics_3.Material, TrackingMode=2)
g_shape_4 = AddDirectShapeGeometry(Category=categories_4, Geometry=dam_4, Material=graphics_4.Material, TrackingMode=2)
b_shape = AddDirectShapeBrep(Brep=g_shape, TrackingMode=2)  # disabled
g_shape_5 = AddDirectShapeGeometry(TrackingMode=2)  # disabled
