# Grasshopper definition BSA_RhinoToRevit_DirectShapeElements 0.2.1.gh (Grasshopper 1.0.7)
# plug-ins: Rhino.Inside for Autodesk Revit

categories = DirectShapeCategories("autodesk.revit.category.local:walls-1.0.0", SearchPattern="walls")
pipeline = GeometryPipeline(
    GroupByLayer=False,
    GroupByType=False,
    IncludeHidden=True,
    IncludeLocked=True,
    LayerFilter="04_ENTOURAGE*04_PLANTERS",
    NameFilter="*",
    SublayerFiltering=True,
    TypeFilter=1073741848)  # disabled
categories_2 = DirectShapeCategories("autodesk.revit.category.local:floors-1.0.0", SearchPattern="Floor")  # disabled
# SITE ELEMENTS
# CORE ELEMENTS
categories_3 = DirectShapeCategories("autodesk.revit.category.local:walls-1.0.0", SearchPattern="walls")

# ---- group: Simple Material Creation
material = ConvertMaterial(Shader=ColourSwatch(SwatchColor=RGB(192, 180, 146)), TrackingMode=2)

material_2 = ConvertMaterial(Shader=ColourSwatch(SwatchColor=RGBA(157, 187, 235, 128)), TrackingMode=2)

swatch = ColourSwatch(SwatchColor=RGB(152, 168, 72))  # disabled
material_3 = ConvertMaterial(Shader=swatch, TrackingMode=2)  # disabled

# ----
brep = Brep([<brep referenced from the Rhino model> x2617])
brep_2 = Brep([<brep referenced from the Rhino model> x928])
dam = DataDam(DataA=brep, BufferDelay=10000000, BufferMode=0)
dam_2 = DataDam(DataA=brep_2, BufferDelay=10000000, BufferMode=0)
dam_3 = DataDam(DataA=pipeline, BufferDelay=10000000, BufferMode=0)  # disabled
panel = Panel("Planters")  # disabled
# SHELL ELEMENTS
geodshape = AddGeometryDirectShape(Category=categories_3, Geometry=dam, Material=material, TrackingMode=2)
geodshape_2 = AddGeometryDirectShape(Category=categories, Geometry=dam_2, Material=material_2, TrackingMode=2)
# will need some fixing
# Add curvature - will need to rebuild spline into curve
geodshape_3 = AddGeometryDirectShape(Name=panel, Category=categories_2, Geometry=dam_3, Material=material_3, TrackingMode=2)  # disabled
