# Grasshopper definition BSA_RhinoToRevit_FloorsByCurves 0.3.0.gh (Grasshopper 1.0.7)
# plug-ins: Rhino.Inside for Autodesk Revit

category = Category(<category referenced from the Revit model>)
pipeline = GeometryPipeline(
    GroupByLayer=False,
    GroupByType=False,
    IncludeHidden=True,
    IncludeLocked=True,
    LayerFilter="04_RhRe*floors",
    NameFilter="*",
    SublayerFiltering=True,
    TypeFilter=1073741852)
select_floor_type = Slider(1, range=0..10)
dam = DataDam(DataA=pipeline, BufferDelay=10000000, BufferMode=0)
area = Area(Geometry=dam)  # -> Area, Centroid
xy = XYPlane(Origin=area.Centroid)
project = Project(Geometry=dam, Plane=xy)  # -> Geometry, Transform
types = QueryTypes(Kind=3, Category=category)
panel = Panel(types)
floor_plate_boundary = Curve(simplify(graft(project.Geometry)))
item = ListItem(List=types, Index=select_floor_type, Wrap=True)
floor = AddFloor(Boundary=floor_plate_boundary, Type=item, TrackingMode=2)
