# Grasshopper definition BSA_RhinoToRevit_RoofByCurves 0.3.0.gh (Grasshopper 1.0.7)
# plug-ins: Rhino.Inside for Autodesk Revit

pipeline = GeometryPipeline(
    GroupByLayer=False,
    GroupByType=False,
    IncludeHidden=True,
    IncludeLocked=True,
    LayerFilter="04_RhRe*roofs",
    NameFilter="*",
    SublayerFiltering=True,
    TypeFilter=1073741852)
level = Level(<level referenced from the Revit model>)
category = Category(<category referenced from the Revit model>)
select_roof_type = Slider(3, range=0..10)
dam = DataDam(DataA=pipeline, BufferDelay=10000000, BufferMode=0)
types = QueryTypes(Kind=3, Category=category)

# ---- group: Checks if curve is closed and ensures they are planer
project = Project(Geometry=dam, Plane=level)  # -> Geometry, Transform

# ----
panel = Panel(types)
roof_plate_boundary = Curve(simplify(graft(project.Geometry)))
item = ListItem(List=types, Index=select_roof_type, Wrap=True)
roof = AddRoof(Boundary=roof_plate_boundary, Type=item, TrackingMode=2)
