# Grasshopper definition BSA_RhinoToRevit_SiteElements.gh (Grasshopper 1.0.7)
# plug-ins: Rhino.Inside for Autodesk Revit

pipeline = GeometryPipeline(
    GroupByLayer=False,
    GroupByType=False,
    IncludeHidden=True,
    IncludeLocked=True,
    LayerFilter="01_SITE*Asphalt",
    NameFilter="*",
    SublayerFiltering=True,
    TypeFilter=1073741848)
categories = DirectShapeCategories("autodesk.revit.category.local:floors-1.0.0", SearchPattern="Floors")
pipeline_2 = GeometryPipeline(
    GroupByLayer=False,
    GroupByType=False,
    IncludeHidden=True,
    IncludeLocked=True,
    LayerFilter="01_SITE*Grass",
    NameFilter="*",
    SublayerFiltering=True,
    TypeFilter=1073741848)
categories_2 = DirectShapeCategories("autodesk.revit.category.local:topography-1.0.0", SearchPattern="TOPOGRAPHY")
pipeline_3 = GeometryPipeline(
    GroupByLayer=False,
    GroupByType=False,
    IncludeHidden=True,
    IncludeLocked=True,
    LayerFilter="Courtyard",
    NameFilter="*",
    SublayerFiltering=True,
    TypeFilter=1073741848)
categories_3 = DirectShapeCategories("autodesk.revit.category.local:floors-1.0.0", SearchPattern="Floor")
# SITE ELEMENTS
pipeline_4 = GeometryPipeline(
    GroupByLayer=False,
    GroupByType=False,
    IncludeHidden=True,
    IncludeLocked=True,
    LayerFilter="Pavement",
    NameFilter="*",
    SublayerFiltering=True,
    TypeFilter=1073741848)
categories_4 = DirectShapeCategories("autodesk.revit.category.local:floors-1.0.0", SearchPattern="Floors")

# ---- group: Simple Material Creation
material = ConvertMaterial(Shader=ColourSwatch(SwatchColor=RGB(214, 214, 214)), TrackingMode=2)

material_2 = ConvertMaterial(Shader=ColourSwatch(SwatchColor=RGB(82, 78, 78)), TrackingMode=2)

# ----
pipeline_5 = GeometryPipeline(
    GroupByLayer=False,
    GroupByType=False,
    IncludeHidden=True,
    IncludeLocked=True,
    LayerFilter="01_SITE*02_SITE_WALLS",
    NameFilter="*",
    SublayerFiltering=True,
    TypeFilter=1073741848)
categories_5 = DirectShapeCategories("autodesk.revit.category.local:walls-1.0.0", SearchPattern="WALLS")

# ---- group: Simple Material Creation
material_3 = ConvertMaterial(Shader=ColourSwatch(SwatchColor=RGB(231, 241, 220)), TrackingMode=2)

material_4 = ConvertMaterial(Shader=ColourSwatch(SwatchColor=RGB(255, 252, 252)), TrackingMode=2)

material_5 = ConvertMaterial(Shader=ColourSwatch(SwatchColor=RGB(181, 181, 181)), TrackingMode=2)

# ----
pipeline_6 = GeometryPipeline(
    GroupByLayer=False,
    GroupByType=False,
    IncludeHidden=True,
    IncludeLocked=True,
    LayerFilter="02_MASSING*02_OPTION 1 SOLID",
    NameFilter="*",
    SublayerFiltering=True,
    TypeFilter=1073741848)
categories_6 = DirectShapeCategories("autodesk.revit.category.family:genericModel-1.0.0", SearchPattern="GENERIC")

# ---- group: Simple Material Creation
material_6 = ConvertMaterial(Shader=ColourSwatch(SwatchColor=RGB(255, 252, 252)), TrackingMode=2)

# ----
dam = DataDam(DataA=pipeline_4, BufferDelay=10000000, BufferMode=0)
dam_2 = DataDam(DataA=pipeline, BufferDelay=10000000, BufferMode=0)
dam_3 = DataDam(DataA=pipeline_2, BufferDelay=10000000, BufferMode=0)
dam_4 = DataDam(DataA=pipeline_3, BufferDelay=10000000, BufferMode=0)
dam_5 = DataDam(DataA=pipeline_5, BufferDelay=10000000, BufferMode=0)
dam_6 = DataDam(DataA=pipeline_6, BufferDelay=10000000, BufferMode=0)

neg = Negative(Value="1")
Z = UnitZ(Factor=neg)
extr = Extrude(Base=dam_3, Direction=Z)

neg_2 = Negative(Value="1")
Z_2 = UnitZ(Factor=neg_2)
extr_2 = Extrude(Base=dam_2, Direction=Z_2)  # -> graft(Extrusion)

neg_3 = Negative(Value="1")
Z_3 = UnitZ(Factor=neg_3)
extr_3 = Extrude(Base=dam, Direction=Z_3)  # -> graft(Extrusion)

geodshape = AddGeometryDirectShape(Category=categories_3, Geometry=dam_4, Material=material, TrackingMode=2)
geodshape_2 = AddGeometryDirectShape(Name="Site Walls", Category=categories_5, Geometry=dam_5, Material=material_4, TrackingMode=2)
# will need some fixing
# Add curvature - will need to rebuild spline into curve
geodshape_3 = AddGeometryDirectShape(Name="Site Buildings", Category=categories_6, Geometry=dam_6, Material=material_6, TrackingMode=2)
brep = Brep(extr_2)
geodshape_4 = AddGeometryDirectShape(Name="Pavement", Category=categories_4, Geometry=extr_3, Material=material_5, TrackingMode=2)
geodshape_5 = AddGeometryDirectShape(Name="Asphalt2", Category=categories, Geometry=brep, Material=material_2, TrackingMode=2)
geodshape_6 = AddGeometryDirectShape(Name="Grass", Category=categories_2, Geometry=extr, Material=material_3, TrackingMode=2)
categories_7 = DirectShapeCategories("autodesk.revit.category.family:genericModel-1.0.0", SearchPattern="Generic ")
categories_8 = DirectShapeCategories("autodesk.revit.category.family:structuralFraming-1.0.0", SearchPattern="structural framing")

# ---- group: Simple Material Creation
material_7 = ConvertMaterial(Shader=ColourSwatch(SwatchColor=RGB(173, 155, 204)), TrackingMode=2)

# ----
screen_structure = Brep([<brep referenced from the Rhino model> x36])
screen = Brep([<brep referenced from the Rhino model> x5000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])

# ---- group: Simple Material Creation
material_8 = ConvertMaterial(Shader=ColourSwatch(SwatchColor=RGB(181, 181, 181)), TrackingMode=2)

# ----
geodshape_7 = AddGeometryDirectShape(Name="Screen", Category=categories_7, Geometry=screen, Material=material_7, TrackingMode=2)
geodshape_8 = AddGeometryDirectShape(Category=categories_8, Geometry=screen_structure, Material=material_8, TrackingMode=2)
