# Grasshopper definition BSA_RhinoToRevit_StructuralElements.gh (Grasshopper 1.0.7)
# plug-ins: Rhino.Inside for Autodesk Revit, EleFront

category = Category(<category referenced from the Revit model>)  # disabled
category_2 = Category(<category referenced from the Revit model>)  # disabled
pipeline = GeometryPipeline(
    GroupByLayer=False,
    GroupByType=False,
    IncludeHidden=True,
    IncludeLocked=True,
    LayerFilter="03_STRUCTURE_CONNECTIONS",
    NameFilter="*",
    SublayerFiltering=True,
    TypeFilter=1073741848)  # disabled
category_3 = Category(<category referenced from the Revit model>)  # disabled
pipeline_2 = GeometryPipeline(
    GroupByLayer=False,
    GroupByType=False,
    IncludeHidden=True,
    IncludeLocked=True,
    LayerFilter="03_STRUCTURE_SCREEN_HORIZONTALCRVS",
    NameFilter="*",
    SublayerFiltering=True,
    TypeFilter=1073741852)  # disabled
types = QueryTypes(Kind=3, Category=category)  # disabled
pipeline_3 = GeometryPipeline(
    GroupByLayer=False,
    GroupByType=False,
    IncludeHidden=True,
    IncludeLocked=True,
    LayerFilter="03_STRUCTURE_SCREEN_VERTICALS_SIZE-03",
    NameFilter="*",
    SublayerFiltering=True,
    TypeFilter=1073741848)  # disabled
pipeline_4 = GeometryPipeline(
    GroupByLayer=False,
    GroupByType=False,
    IncludeHidden=True,
    IncludeLocked=True,
    LayerFilter="03_STRUCTURE_SCREEN_VERTICALS_SIZE-02",
    NameFilter="*",
    SublayerFiltering=True,
    TypeFilter=1073741848)  # disabled
pipeline_5 = GeometryPipeline(
    GroupByLayer=False,
    GroupByType=False,
    IncludeHidden=True,
    IncludeLocked=True,
    LayerFilter="03_STRUCTURE_SCREEN_VERTICALS_SIZE-01",
    NameFilter="*",
    SublayerFiltering=True,
    TypeFilter=1073741848)  # disabled
types_2 = QueryTypes(Kind=3, Category=category_2)  # disabled
types_3 = QueryTypes(Kind=3, Category=category_3)  # disabled
panel = Panel(types)  # disabled
dam = DataDam(DataA=pipeline, BufferDelay=10000000, BufferMode=0)  # disabled
panel_2 = Panel(types_2)  # disabled
dam_2 = DataDam(DataA=pipeline_2, BufferDelay=10000000, BufferMode=0)  # disabled
panel_3 = Panel(types_3)  # disabled
dam_3 = DataDam(DataA=pipeline_4, BufferDelay=10000000, BufferMode=0)  # disabled
dam_4 = DataDam(DataA=[pipeline_5, pipeline_3], BufferDelay=10000000, BufferMode=0)  # disabled
categories = DirectShapeCategories("autodesk.revit.category.family:structConnections-1.0.0", SearchPattern="structural")  # disabled
num = Number(3.5)  # disabled
num_2 = Number(-3.5)  # disabled
merge = Merge(Data1=num, Data2=num_2)  # disabled
graft = GraftTree(Tree=dam_3, IncludeEmptyLists=True, IncludeNullItems=True)  # disabled
graft_2 = GraftParallel(PrimaryData=dam)  # -> PrimaryData, SecondaryData1; disabled
graft_3 = GraftTree(Tree=dam_4, IncludeEmptyLists=True, IncludeNullItems=True)  # disabled
explode = Explode(Curve=dam_2, Recursive=True)  # -> reparameterize(Segments), Vertices; disabled
brep = Brep(graft)  # disabled
xy = XYPlane(Origin=Point(0, 0, 0))  # disabled
number_slider = Slider(1, range=0..2)  # disabled
brep_2 = Brep(graft_3)  # disabled
panel_4 = Panel("Custom Connections")  # disabled
offset = OffsetCurve(Curve=graft(dam_2), Distance=expr("x/12", merge), Plane=xy, Corners=1)  # disabled
number_slider_2 = Slider(0, range=0..2)  # disabled
number_slider_3 = Slider(1, range=0..2)  # disabled
graft_4 = GraftParallel(PrimaryData=explode.Segments)  # -> PrimaryData, SecondaryData1; disabled
bbox = BoundingBox(Content=brep, Plane=PlaneXY(0, 0, 0))  # -> Box, Box_2; disabled
bbox_2 = BoundingBox(Content=brep_2, Plane=PlaneXY(0, 0, 0))  # -> Box, Box_2; disabled
item = ListItem(List=types, Index=number_slider, Wrap=True)  # disabled
geodshape = AddGeometryDirectShape(Name=panel_4, Category=categories, Geometry=graft_2.PrimaryData, TrackingMode=2)  # disabled

brep_top_boundary = BrepTopBoundary(B=bbox.Box)  # -> C, L; disabled
brep_bottom_boundary = BrepBottomBoundary(B=bbox.Box)  # -> N, L, C; disabled
srf = Surface(brep_bottom_boundary.C)  # disabled
srf_2 = Surface(brep_top_boundary.C)  # disabled
area = Area(Geometry=srf_2)  # -> Area, Centroid; disabled
area_2 = Area(Geometry=srf)  # -> Area, Centroid; disabled

brep_top_boundary_2 = BrepTopBoundary(B=bbox_2.Box)  # -> C, L; disabled
brep_bottom_boundary_2 = BrepBottomBoundary(B=bbox_2.Box)  # -> N, L, C; disabled
srf_3 = Surface(brep_bottom_boundary_2.C)  # disabled
srf_4 = Surface(brep_top_boundary_2.C)  # disabled
area_3 = Area(Geometry=srf_4)  # -> Area, Centroid; disabled
area_4 = Area(Geometry=srf_3)  # -> Area, Centroid; disabled

item_2 = ListItem(List=types_2, Index=number_slider_2, Wrap=True)  # disabled
item_3 = ListItem(List=types_3, Index=number_slider_3, Wrap=True)  # disabled
s_beam = AddStructuralBeam(Curve=graft_4.PrimaryData, Type=item_3, TrackingMode=2)  # disabled
ln = Line(StartPoint=area_2.Centroid, EndPoint=area.Centroid)  # disabled
ln_2 = Line(StartPoint=area_4.Centroid, EndPoint=area_3.Centroid)  # disabled
crv = Curve()  # disabled
s_column = AddStructuralColumn(Curve=ln, Type=item_2, TrackingMode=2)  # disabled
s_column_2 = AddStructuralColumn(Curve=ln_2, Type=item, TrackingMode=2)  # disabled

# ==== cluster BrepBottomBoundary
B = ClusterInput()
debrep = DeconstructBrep(Brep=B)  # -> Faces, Edges, Vertices
md_slider = MDSlider(SliderMode=0, slider_value=Point(0.5, 0.5, 0.5), x_domain=Domain(0, 1), y_domain=Domain(0, 1), z_domain=Domain(0, 1))
evalsrf = EvaluateSurface(Surface=reparameterize(debrep.Faces), Point=md_slider)  # -> Point, Normal, UDirection, VDirection, Frame
N = ClusterOutput(evalsrf.Normal)
devec = DeconstructVector(Vector=evalsrf.Normal)  # -> XComponent, YComponent, simplify(ZComponent)
equals = Equality(FirstNumber=expr("round(x)", devec.ZComponent), SecondNumber=-1)  # -> Equality, Inequality
cull = CullPattern(List=debrep.Faces, CullPattern=equals.Equality)
edges = BrepEdges(Brep=cull)  # -> Naked, Interior, NonManifold
L = ClusterOutput(cull)
join = JoinCurves(Curves=edges.Naked, Preserve=False)  # -> simplify(Curves)
C = ClusterOutput(join)

# ==== cluster BrepTopBoundary
B = ClusterInput()
debrep = DeconstructBrep(Brep=B)  # -> Faces, Edges, Vertices
md_slider = MDSlider(SliderMode=0, slider_value=Point(0.5, 0.5, 0.5), x_domain=Domain(0, 1), y_domain=Domain(0, 1), z_domain=Domain(0, 1))
evalsrf = EvaluateSurface(Surface=reparameterize(debrep.Faces), Point=md_slider)  # -> Point, Normal, UDirection, VDirection, Frame
devec = DeconstructVector(Vector=evalsrf.Normal)  # -> XComponent, YComponent, simplify(ZComponent)
panel = Panel(evalsrf.Normal)
equals = Equality(FirstNumber=expr("round(x)", devec.ZComponent), SecondNumber=1)  # -> Equality, Inequality
cull = CullPattern(List=debrep.Faces, CullPattern=equals.Equality)
edges = BrepEdges(Brep=cull)  # -> Naked, Interior, NonManifold
join = JoinCurves(Curves=edges.Naked, Preserve=False)
C = ClusterOutput(join)
L = ClusterOutput(cull)
