# Grasshopper definition Revit To Rhino - Datums 0.1.0.gh (Grasshopper 1.0.7)
# plug-ins: Rhino.Inside for Autodesk Revit

# ---- group: Import Grids As Curves
grids = QueryGrids()
grid_lines = Curve(grids)

# ---- group: Import Levels
levels = QueryLevels(BuildingStory=True)
pln = Plane(levels)
deplane = DeconstructPlane(Plane=pln)  # -> Origin, XAxis, YAxis, ZAxis
pdecon = Deconstruct(Point=deplane.Origin)  # -> XComponent, YComponent, ZComponent
e_name = ElementName(Element=levels)  # -> Element, Name
concat = Concatenate(FragmentA=e_name.Name, FragmentB="(ELEVATION ", FragmentC=pdecon.ZComponent, FragmentD=")")
tag = TextTag(Location=deplane.Origin, Text=concat)
