# Grasshopper definition Revit To Rhino - Rooms 0.1.0.gh (Grasshopper 1.0.7)
# plug-ins: Rhino.Inside for Autodesk Revit

categories = QueryCategories(Type=1, Name="Rooms", IsSubcategory=False)
catfltr = CategoryFilter(Categories=categories, Inverted=False)
elements = QueryElements(Filter=catfltr, Limit=100)  # -> Elements, Count
room = Brep(elements.Elements)
inspect = InspectElement(Element=elements.Elements)  # -> IdentityDataName, IdentityDataNumber
panel = Panel(inspect.IdentityDataName)
panel_2 = Panel(inspect.IdentityDataNumber)
volume = Volume(Geometry=room)  # -> Volume, Centroid
concat = Concatenate(FragmentA=panel, FragmentB=" (", FragmentC=panel_2, FragmentD=")")
tag = TextTag(Location=volume.Centroid, Text=concat)
