# Grasshopper definition Structure_Members from Breps.gh (Grasshopper 1.0.7)
# plug-ins: Rhino.Inside for Autodesk Revit

girder_beams = Brep(graft([<brep referenced from the Rhino model> x5]))
joists = Brep(graft([<brep referenced from the Rhino model> x41]))
crv = Curve([<curve referenced from the Rhino model> x2277])
rim = Brep(graft([<brep referenced from the Rhino model> x18]))
pipe = Pipe(Curve=crv, Radius=Slider(0.02, range=0..1), Caps=0)  # -> flatten(Pipe)
distributefaces = GhPythonScript(Massing=simplify(joists))  # -> floor, walls, roof; inputs Massing: list
# ---------- distributefaces: Python ----------
__author__ = "ilouh"
__version__ = "2023.01.08"

import rhinoscriptsyntax as rs
import ghpythonlib.components as comps
import Rhino.Geometry as geom


roof = []
floor = []
walls = [] 

#find the normal of each face

faces = comps.DeconstructBrep(Massing)['faces']
evaluation_point = comps.ConstructPoint(x_coordinate = 0.5, y_coordinate = 0.5, z_coordinate = 0)

for face in faces: 
    
    vector = comps.EvaluateSurface(face,evaluation_point)['normal']
    
    
    vector_a = comps.VectorXYZ(x_component = vector[0], y_component = vector[1], z_component = vector[2])['vector']
    vector_b = comps.UnitZ(1)

    cross_product = comps.CrossProduct(vector_a,vector_b,True)['vector']
    dot_product = round(comps.DotProduct(vector_a,vector_b,True),4)
    
    print(dot_product)
    
    if abs(dot_product) == 0: 
        walls.append(face)
    
    if dot_product > 0: 
        roof.append(face)
    
    if dot_product == -1: 
        floor.append(face)
# ---------- end distributefaces ----------
distributefaces_2 = GhPythonScript(Massing=simplify(girder_beams))  # -> floor, walls, roof; inputs Massing: list; same code as distributefaces
distributefaces_3 = GhPythonScript(Massing=simplify(rim))  # -> floor, walls, roof; inputs Massing: list; same code as distributefaces
cap = CapHoles(Brep=pipe)
material = AddMaterial(Name="Palo De Arco", TrackingMode=2)
g_shape = AddGeometryDirectShape(Geometry=cap, Material=material, TrackingMode=2)

area = Area(Geometry=distributefaces.walls)  # -> Area, Centroid
sort = SortList(Keys=area.Area, ValuesA=distributefaces.walls)  # -> Keys, ValuesA
item = ListItem(List=sort.ValuesA, Index=0, Wrap=True)  # -> Item, Item1
area_2 = Area(Geometry=item.Item)  # -> Area, Centroid
area_3 = Area(Geometry=item.Item1)  # -> Area, Centroid

area_4 = Area(Geometry=distributefaces_2.walls)  # -> Area, Centroid
sort_2 = SortList(Keys=area_4.Area, ValuesA=distributefaces_2.walls)  # -> Keys, ValuesA
item_2 = ListItem(List=sort_2.ValuesA, Index=0, Wrap=True)  # -> Item, Item1
area_5 = Area(Geometry=item_2.Item)  # -> Area, Centroid
area_6 = Area(Geometry=item_2.Item1)  # -> Area, Centroid

area_7 = Area(Geometry=distributefaces_3.walls)  # -> Area, Centroid
sort_3 = SortList(Keys=area_7.Area, ValuesA=distributefaces_3.walls)  # -> Keys, ValuesA
item_3 = ListItem(List=sort_3.ValuesA, Index=0, Wrap=True)  # -> Item, Item1
area_8 = Area(Geometry=item_3.Item)  # -> Area, Centroid
area_9 = Area(Geometry=item_3.Item1)  # -> Area, Centroid

ln = Line(StartPoint=area_2.Centroid, EndPoint=area_3.Centroid)
ln_2 = Line(StartPoint=area_5.Centroid, EndPoint=area_6.Centroid)
type = Type(
    <familysymbol referenced from the Revit model>,
    SelectedBuiltInCategory="autodesk.revit.category.family:structuralFraming")
ln_3 = Line(StartPoint=area_8.Centroid, EndPoint=area_9.Centroid)
type_2 = Type(
    <familysymbol referenced from the Revit model>,
    SelectedBuiltInCategory="autodesk.revit.category.family:structuralFraming")
type_3 = Type(
    <familysymbol referenced from the Revit model>,
    SelectedBuiltInCategory="autodesk.revit.category.family:structuralFraming")
s_beam = AddStructuralBeam(Curve=ln_2, Type=type, ReferenceLevel=null, TrackingMode=2)
s_beam_2 = AddStructuralBeam(Curve=ln, Type=type_2, ReferenceLevel=null, TrackingMode=2)
s_beam_3 = AddStructuralBeam(Curve=ln_3, Type=type_3, ReferenceLevel=null, TrackingMode=2)
