# Grasshopper definition WallBySillCurveAndHeight.gh (Grasshopper 1.0.7)
# plug-ins: Rhino.Inside for Autodesk Revit

pipeline = GeometryPipeline(
    GroupByLayer=False,
    GroupByType=False,
    IncludeHidden=True,
    IncludeLocked=True,
    LayerFilter="03_ARCH*03_EXT WALLS",
    NameFilter="*",
    SublayerFiltering=True,
    TypeFilter=1073741848)
pipeline_2 = GeometryPipeline(
    GroupByLayer=False,
    GroupByType=False,
    IncludeHidden=True,
    IncludeLocked=True,
    LayerFilter="03_ARCH*03_INT WALLS",
    NameFilter="*",
    SublayerFiltering=True,
    TypeFilter=1073741848)
dam = DataDam(DataA=pipeline, BufferDelay=2500000, BufferMode=2)
exterior_walls = Brep(dam)
dam_2 = DataDam(DataA=pipeline_2, BufferDelay=2500000, BufferMode=2)
exterior_walls_2 = Brep(dam_2)
area = Area(Geometry=exterior_walls)  # -> Area, Centroid
larger = LargerThan(FirstNumber=area.Area, SecondNumber=Slider(5, range=0..5))  # -> LargerThan, OrEqualTo
area_2 = Area(Geometry=exterior_walls_2)  # -> Area, Centroid
larger_2 = LargerThan(FirstNumber=area_2.Area, SecondNumber=Slider(5, range=0..5))  # -> LargerThan, OrEqualTo
cull = CullPattern(List=exterior_walls, CullPattern=larger.LargerThan)
cull_2 = CullPattern(List=exterior_walls_2, CullPattern=larger_2.LargerThan)
pipeline_3 = GeometryPipeline(
    GroupByLayer=False,
    GroupByType=False,
    IncludeHidden=True,
    IncludeLocked=True,
    LayerFilter="Make2D*Visible*ClippingPlaneIntersections*03_ARCH*03_EXT WALLS",
    NameFilter="*",
    SublayerFiltering=True,
    TypeFilter=1073741852)
pipeline_4 = GeometryPipeline(
    GroupByLayer=False,
    GroupByType=False,
    IncludeHidden=True,
    IncludeLocked=True,
    LayerFilter="Make2D*Visible*ClippingPlaneIntersections*03_ARCH*03_INT WALLS",
    NameFilter="*",
    SublayerFiltering=True,
    TypeFilter=1073741852)
category = Category(<category referenced from the Revit model>)
category_2 = Category(<category referenced from the Revit model>)
types = QueryTypes(Kind=3, Category=category)
types_2 = QueryTypes(Kind=3, Category=category_2)
panel = Panel(types)
panel_2 = Panel(types_2)
dam_3 = DataDam(DataA=pipeline_3, BufferDelay=2500000, BufferMode=2)
dam_4 = DataDam(DataA=pipeline_4, BufferDelay=2500000, BufferMode=2)
crv = Curve(reparameterize(graft(dam_4)))
category_3 = Category(<category referenced from the Revit model>)  # disabled
category_4 = Category(<category referenced from the Revit model>)  # disabled
crv_2 = Curve(dam_3)
types_3 = QueryTypes(Kind=3, Category=category_3)  # disabled
types_4 = QueryTypes(Kind=3, Category=category_4)  # disabled
disc = Discontinuity(Curve=crv_2, Level=1)  # -> Points, Parameters
disc_2 = Discontinuity(Curve=crv, Level=Slider(1, range=0..3))  # -> Points, Parameters
panel_3 = Panel(types_3)  # disabled
panel_4 = Panel(types_4)  # disabled
number_slider = Slider(22, range=0..50)  # disabled
number_slider_2 = Slider(33, range=0..50)  # disabled
shatter = Shatter(Curve=crv, Parameters=disc_2.Parameters)
crv_3 = Curve(graft([<curve referenced from the Rhino model> x55]))

# ---- group: Removes Small Line portions
len = Length(Curve=shatter)
larger_3 = LargerThan(FirstNumber=len, SecondNumber=Slider(0.5, range=0..5))  # -> LargerThan, OrEqualTo
cull_3 = CullPattern(List=shatter, CullPattern=larger_3.LargerThan)

# ----
item = ListItem(List=types, Index=Slider(34, range=0..50), Wrap=True)
item_2 = ListItem(List=types_2, Index=Slider(33, range=0..50), Wrap=True)
reconstruct_surface = ReconstructSurface(B=cull)  # -> wall_profile_2, wall_centerline_2, height_2; disabled
reconstruct_surface_2 = ReconstructSurface(B=cull_2)  # -> wall_profile_2, wall_centerline_2, height_2; disabled

# ---- group: Removes Small Line portions
len_2 = Length(Curve=crv_3)
larger_4 = LargerThan(FirstNumber=len_2, SecondNumber=Slider(0.5, range=0..5))  # -> LargerThan, OrEqualTo
cull_4 = CullPattern(List=crv_3, CullPattern=larger_4.LargerThan)

# ----
end = EndPoints(Curve=cull_3)  # -> Start, End
wll = WallLocationLine({"Wall Centerline": 0, "Core Centerline": 1, "Finish (Exterior Face)": 2, "Finish (Interior Face)": 3, "Core (Exterior Face)": 4, "Core (Interior Face)": 5}, selected="Wall Centerline")
end_2 = EndPoints(Curve=cull_4)  # -> Start, End
ln = Line(StartPoint=end.Start, EndPoint=end.End)
wll_2 = WallLocationLine({"Wall Centerline": 0, "Core Centerline": 1, "Finish (Exterior Face)": 2, "Finish (Interior Face)": 3, "Core (Exterior Face)": 4, "Core (Interior Face)": 5}, selected="Wall Centerline")
ln_2 = Line(StartPoint=end_2.Start, EndPoint=end_2.End)
crv_4 = Curve(ln)
panel_5 = Panel(ln_2)
wallcrv = AddWallCurve(Curve=ln_2, Type=item, Height=Slider(15, range=0..100), LocationLine=wll, AllowJoins=Toggle(True), TrackingMode=2)
wallcrv_2 = AddWallCurve(Curve=crv_4, Type=item_2, LocationLine=wll_2, AllowJoins=Toggle(True), TrackingMode=2)
item_3 = ListItem(List=types_3, Index=number_slider, Wrap=True)  # disabled
item_4 = ListItem(List=types_4, Index=number_slider_2, Wrap=True)  # disabled
wll_3 = WallLocationLine({"Wall Centerline": 0, "Core Centerline": 1, "Finish (Exterior Face)": 2, "Finish (Interior Face)": 3, "Core (Exterior Face)": 4, "Core (Interior Face)": 5}, selected="Wall Centerline")  # disabled
wll_4 = WallLocationLine({"Wall Centerline": 0, "Core Centerline": 1, "Finish (Exterior Face)": 2, "Finish (Interior Face)": 3, "Core (Exterior Face)": 4, "Core (Interior Face)": 5}, selected="Wall Centerline")  # disabled
wll_5 = WallLocationLine({"Wall Centerline": 0, "Core Centerline": 1, "Finish (Exterior Face)": 2, "Finish (Interior Face)": 3, "Core (Exterior Face)": 4, "Core (Interior Face)": 5}, selected="Wall Centerline")  # disabled
wll_6 = WallLocationLine({"Wall Centerline": 0, "Core Centerline": 1, "Finish (Exterior Face)": 2, "Finish (Interior Face)": 3, "Core (Exterior Face)": 4, "Core (Interior Face)": 5}, selected="Wall Centerline")  # disabled
toggle = BooleanToggle(True)  # disabled
toggle_2 = BooleanToggle(True)  # disabled
toggle_3 = BooleanToggle(True)  # disabled
toggle_4 = BooleanToggle(True)  # disabled
crv_5 = Curve(reconstruct_surface.wall_centerline_2)  # disabled
crv_6 = Curve(reconstruct_surface_2.wall_centerline_2)  # disabled
wallprfl = AddWallProfile(Profile=reconstruct_surface.wall_profile_2, Type=item_3, LocationLine=wll_5, AllowJoins=toggle_3, TrackingMode=2)  # disabled
wallcrv_3 = AddWallCurve(Curve=crv_5, Height=reconstruct_surface.height_2, LocationLine=wll_3, AllowJoins=toggle, TrackingMode=2)  # disabled
wallprfl_2 = AddWallProfile(Profile=reconstruct_surface_2.wall_profile_2, Type=item_4, LocationLine=wll_6, AllowJoins=toggle_4, TrackingMode=2)  # disabled
wallcrv_4 = AddWallCurve(Curve=crv_6, Height=reconstruct_surface_2.height_2, LocationLine=wll_4, AllowJoins=toggle_2, TrackingMode=2)  # disabled

# ==== cluster ReconstructSurface
B = ClusterInput()

# ---- group: Recontruct surface to be planer
debrep = DeconstructBrep(Brep=B)  # -> Faces, Edges, Vertices
evalsrf = EvaluateSurface(Surface=reparameterize(debrep.Faces), Point="{0.5,0.5,0}")  # -> Point, Normal, UDirection, VDirection, Frame
X = UnitX(Factor=1)
devec = DeconstructVector(Vector=evalsrf.Normal)  # -> XComponent, YComponent, ZComponent
vec = VectorXYZ(XComponent=devec.XComponent, YComponent=devec.YComponent, ZComponent=Slider(0, range=0..100))  # -> Vector, Length
pl = PlaneNormal(Origin=evalsrf.Point, ZAxis=vec.Vector)
project = Project(Geometry=debrep.Faces, Plane=pl)  # -> Geometry, Transform

# ----
srf = Surface(reparameterize(simplify(project.Geometry)))
panel = Panel("""{0,0,0}
{1,0,0}
{0,1,0}
{1,1,0}""")
evalsrf_2 = EvaluateSurface(Surface=reparameterize(srf), Point=panel)  # -> Point, Normal, UDirection, VDirection, Frame
pt = Point(evalsrf_2.Point)
item = ListItem(List=pt, Index=0, Wrap=True)  # -> Item, Item1, Item2, Item3
rec_2pt = Rectangle2Pt(Plane=pl, PointA=item.Item, PointB=item.Item3, Radius=0)  # -> Rectangle, Length

# ---- group: Reconstruct the line to be planer
pdecon = Deconstruct(Point=item.Item)  # -> XComponent, YComponent, ZComponent
pdecon_2 = Deconstruct(Point=item.Item1)  # -> XComponent, YComponent, ZComponent
pt_2 = ConstructPoint(XCoordinate=pdecon.XComponent, YCoordinate=pdecon.YComponent, ZCoordinate=pdecon.ZComponent)
pt_3 = ConstructPoint(XCoordinate=pdecon_2.XComponent, YCoordinate=pdecon_2.YComponent, ZCoordinate=pdecon.ZComponent)

# ----
ln = Line(StartPoint=item.Item, EndPoint=item.Item2)
len = Length(Curve=ln)

ln_2 = Line(StartPoint=pt_2, EndPoint=pt_3)
wall_centerline = Curve(ln_2)
wall_profile = Curve(rec_2pt.Rectangle)
height = Number(len)
wall_profile_2 = ClusterOutput(wall_profile)
wall_centerline_2 = ClusterOutput(wall_centerline)
height_2 = ClusterOutput(height)
