# Grasshopper definition Beams.gh (Grasshopper 0.9.76)

crv = Curve(graft([<curve referenced from the Rhino model> x21]))
beam_height = Slider(12, range=0..12)
beam_width_2 = Slider(2, range=0..10)
crv_2 = Curve([<curve referenced from the Rhino model> x5])
shift = ShiftList(List=crv_2, Shift=1, Wrap=False)
brep = Brep(<brep referenced from the Rhino model>)
X = UnitX(Factor=1)
crv_3 = Curve(shift)
neg = Negative(Value=X)
contour = Contour(Curve=brep, Point=Point(-1.525144345, 51.48171639, 0), Direction=neg, Distance=Slider(16, range=0..100))  # -> Contours, Parameters
divlength = DivideLength(Curve=crv_2, Length=Slider(16, range=0..100))  # -> Points, Tangents, Parameters
divlength_2 = DivideLength(Curve=crv_3, Length=Slider(16, range=0..100))  # -> Points, Tangents, Parameters
lng = ListLength(List=divlength.Points)
avr = Average(Input=flatten(lng))
divide = DivideCurve(Curve=crv_2, Count=avr, Kinks=False)  # -> Points, Tangents, Parameters
divide_2 = DivideCurve(Curve=crv_3, Count=avr, Kinks=False)  # -> Points, Tangents, Parameters
shift_2 = ShiftList(List=divide.Points, Shift=1, Wrap=False)
shift_3 = ShiftList(List=divide_2.Points, Shift=1, Wrap=False)
shift_4 = ShiftList(List=shift_2, Shift=-1, Wrap=False)
shift_5 = ShiftList(List=shift_3, Shift=-1, Wrap=False)
ln = Line(StartPoint=shift_4, EndPoint=shift_5)
beam_height_2 = Slider(12, range=0..12)
beam_width_2_2 = Slider(2, range=0..10)
Z = UnitZ(Factor=beam_height)
Z_2 = UnitZ(Factor=beam_height_2)
neg_2 = Negative(Value=Z)
neg_3 = Negative(Value=Z_2)
extr = Extrude(Base=crv, Direction=neg_2)
neg_4 = Negative(Value=beam_width_2)
extr_2 = Extrude(Base=ln, Direction=neg_3)
offset = Offset(Surface=extr, Distance=beam_width_2, Retrim=True)
offset_2 = Offset(Surface=extr, Distance=neg_4, Retrim=True)
wires = BrepWireframe(Brep=offset, Density=-1)
wires_2 = BrepWireframe(Brep=offset_2, Density=-1)
join = JoinCurves(Curves=wires, Preserve=False)  # -> simplify(Curves)
join_2 = JoinCurves(Curves=wires_2, Preserve=False)  # -> simplify(Curves)
merge = Merge(Data1=join, Data2=join_2)
loft = Loft(Curves=merge, Options={Adjust=False, Closed=False, LoftEnds=0, LoftSimp=0, LoftType=0, Rebuild=10, Refit=0.01})
cap = CapHoles(Brep=loft)
