# Grasshopper definition BuildingElements_Bridge.gh (Grasshopper 1.0.7)
# plug-ins: ShapeDiverForGrasshopper

sddp = ShapeDiverDocumentPayload({AbsoluteTolerance=0, AngleTolerance=0, DistanceDisplayPrecision=0, GltfVersion="Gltf2", InputGroups="{}", OutputGroups="{}", RelativeTolerance=0, UnitSystem=0, VersionCreated="1.13.1.0", VersionSaved="1.13.1.0"})
corner_type = Slider(1, range=1..4)
n = Slider(7, range=0..100)
depth = Slider(10, range=0..10)
rail_height = Slider(42, range=0..100)
rail_spacing = Slider(4, range=0..10)
bridge_path = Curve(graft(<curve referenced from the Rhino model>))
clsplylinefromline = GhPythonScript(bridgePath=bridge_path, thickness=Slider(24, range=0..100), corner_type=corner_type, n=n, depth=depth)  # -> centerLine, edge_1, edge_2, frames; inputs bridgePath: Curve
# ---------- clsplylinefromline: Python ----------
__author__ = "Iliya Muzychuk"
__version__ = "2023.02.03"

import rhinoscriptsyntax as rs
import Grasshopper as gh
import Rhino.Geometry as rg
import ghpythonlib.components as comps

curve = bridgePath

#creates Offset
xy_plane = comps.XYPlane(comps.ConstructPoint(0,0,0))
edge_1 = comps.OffsetCurve(curve,thickness/2,xy_plane,corners = corner_type)
edge_2 = comps.OffsetCurve(curve,-thickness/2,xy_plane,corners = corner_type)

centerLine = comps.Move(bridgePath,comps.UnitZ(-depth))['geometry'] 

centerPoints = comps.DivideCurve(centerLine,n,True)['points']
edge_1_closestPoints = comps.CurveClosestPoint(centerPoints,edge_1)['point']
edge_2_closestPoints = comps.CurveClosestPoint(centerPoints,edge_2)['point']

pointSets = zip(centerPoints,edge_1_closestPoints,edge_2_closestPoints)

frames = [] 

for set in pointSets: 

    frame = comps.PolyLine(set,True)
    frames.append(frame)
# ---------- end clsplylinefromline ----------
crv = Curve(clsplylinefromline.frames)
merge = Merge(Data1=clsplylinefromline.edge_1, Data2=clsplylinefromline.centerLine, Data3=clsplylinefromline.edge_2)
loft = Loft(Curves=merge, Options={Adjust=False, Closed=True, LoftEnds=0, LoftSimp=0, LoftType=3, Rebuild=10, Refit=0.01})
expression = Expression(x=rail_height, Expression="x/12")
expression_2 = Expression(x=rail_spacing, Expression="x/12")
cap = CapHoles(Brep=loft)
preview = CustomPreview(Geometry=cap, Material=ColourSwatch(SwatchColor=RGB(255, 255, 255)))
picketrailing = GhPythonScript(crv=[clsplylinefromline.edge_1, clsplylinefromline.edge_2], height=rail_height, spacing=rail_spacing)  # -> sill_curve, pickets, head_curve; inputs crv: Curve
# ---------- picketrailing: Python ----------
__author__ = "ilouh"
__version__ = "2023.02.21"

import rhinoscriptsyntax as rs
import Grasshopper as gh
import Rhino.Geometry as rg
import ghpythonlib.components as comps
import math

height = height
spacing = spacing

try: 

    crvs = comps.Explode(crv,True)['segments']
    
    pickets = []
    
    sill_curve = crv 
    head_curve = comps.Move(crv,comps.UnitZ(height))['geometry']
    
    for crv in crvs: 
        
        points = len(comps.DivideLength(crv,spacing)['points'])
        points = comps.DivideCurve(crv,points,kinks = False)['points']
        
        for point in points:
            
    
            line = comps.LineSDL(point,comps.UnitZ(1),height)
            pickets.append(line)

except TypeError:
    
    sill_curve = crv 
    head_curve = comps.Move(sill_curve,comps.UnitZ(height))['geometry']
    
    points = len(comps.DivideLength(sill_curve,spacing)['points'])
    points = comps.DivideCurve(sill_curve,points,kinks = False)['points']
    
    for point in points:
        

        line = comps.LineSDL(point,comps.UnitZ(1),height)
        pickets.append(line)
# ---------- end picketrailing ----------
railing = Curve([picketrailing.pickets, picketrailing.head_curve, picketrailing.sill_curve])
