# Grasshopper definition BuildingElements_ColumnFromPoints.gh (Grasshopper 1.0.7)

# ---- group: By curve
crv = Curve(<curve referenced from the Rhino model>)
divdist = DivideDistance(Curve=crv, Distance=Slider(5, range=1..16))  # -> Points, Tangents, Parameters
hframe = HorizontalFrame(Curve=crv, Parameter=divdist.Parameters)

# ---- group: By point
pt = Point(<point referenced from the Rhino model>)

# ---- group: By point grid
column_grid_extension_b = Slider(6, range=1..20)
column_grid_extension_a = Slider(6, range=1..20)
column_spacing_a = Slider(12, range=1..20)
column_spacing_b = Slider(12, range=1..20)
recgrid = Rectangular(
    Plane=PlaneXY(0, 0, 0),
    SizeX=column_spacing_a,
    SizeY=column_spacing_b,
    ExtentX=column_grid_extension_a,
    ExtentY=column_grid_extension_b)  # -> Cells, Points

# ----
width = Slider(0.3, range=0..100)
length = Slider(0.5, range=0..100)
height = Slider(-8, range=-144..144)
createcolumn = GhPythonScript(point=divdist.Points, plane=hframe, width=width, length=length, height=height)  # -> column; inputs point: Point3d, plane: Plane
# ---------- createcolumn: Python ----------
__author__ = "Iliya Muzychuk"
__version__ = "2023.02.03"

import rhinoscriptsyntax as rs
import Grasshopper as gh
import Rhino.Geometry as rg
import ghpythonlib.components as comps

#create profile function

def createSquare(point,width,length,plane):
    
    plane_rec = comps.PlaneOrigin(plane,point)

    width_domain = comps.ConstructDomain(-width/2,width/2)
    length_domain = comps.ConstructDomain(-length/2,length/2)
    
    rec = comps.Rectangle(plane_rec,width_domain,length_domain,0)
    rec = rec['rectangle']
    
    print(plane_rec)
    
    return rec

#extrusion function 

def createColumn(rec,height):
    
    vector = comps.UnitZ(height)
    brep = comps.Extrude(rec,vector)
    brep = comps.CapHoles(brep)
    
    return brep

print(comps.XYPlane(point))
column_profile = createSquare(point,width,length,plane)
column = createColumn(column_profile,height)
# ---------- end createcolumn ----------
brep = Brep(createcolumn)
