# Grasshopper definition BuildingElements_ColumnFromSurface.gh (Grasshopper 1.0.7)
# plug-ins: Kangaroo2 Components

roof_surface = Surface(<surface referenced from the Rhino model>)
number_slider = Slider(1, range=0..1)
wires = BrepWireframe(Brep=roof_surface, Density=-1)
join = JoinCurves(Curves=wires, Preserve=False)
neg = Negative(Value=number_slider)
offset = OffsetCurve(Curve=join, Distance=[number_slider, neg], Corners=1)  # -> flatten(Curve)
area = Area(Geometry=offset)  # -> Area, Centroid
sort = SortList(Keys=area.Area, ValuesA=offset)  # -> Keys, ValuesA
item = ListItem(List=sort.ValuesA, Index=0, Wrap=True)
boundary = BoundarySurfaces(Edges=item)
roof_surface_2 = Surface(boundary)
dim = Dimensions(Surface=roof_surface_2)  # -> UDimension, VDimension
expression = Expression(V=dim.VDimension, Span_B=Slider(20, range=0..20), Expression="Round(V/Span_B,0)")
expression_2 = Expression(U=dim.UDimension, Span_A=Slider(10, range=0..20), Expression="Round(U/Span_A,0)")
divide = DivideDomain²(Domain=roof_surface_2, UCount=expression_2, VCount=expression)
wires_2 = BrepWireframe(Brep=roof_surface_2, Density=-1)
subsrf = Isotrim(Surface=roof_surface_2, Domain=divide)
debrep = DeconstructBrep(Brep=subsrf)  # -> Faces, flatten(Edges), flatten(Vertices)
join_2 = JoinCurves(Curves=wires_2, Preserve=False)
panel = Panel("CLOSED RECTANGULAR CURVE")
xy = XYPlane(Origin=Point(0, 0, 0))
duppt = RemoveDuplicatePts(Points=debrep.Vertices, Tolerance=0.01)
project = Project(Geometry=duppt, Plane=xy)  # -> Geometry, Transform
crv = Curve(<curve referenced from the Rhino model>)
width = Slider(2, range=0..100)
height = Slider(6, range=0..100)
height_2 = Slider(34, range=0..1000)
ln = Line(StartPoint=project.Geometry, EndPoint=duppt)
area_2 = Area(Geometry=crv)  # -> Area, Centroid
neg_2 = Negative(Value=width)
neg_3 = Negative(Value=height)
pframes = PerpFrames(Curve=ln, Count=2, Align=True)  # -> Frames, Parameters
dom = ConstructDomain(DomainStart=width, DomainEnd=neg_2)
dom_2 = ConstructDomain(DomainStart=height, DomainEnd=neg_3)
cir = Circle(Plane=pframes.Frames, Radius=Slider(0.5, range=0..10))
loft = Loft(Curves=cir, Options={Adjust=False, Closed=False, LoftEnds=0, LoftSimp=0, LoftType=0, Rebuild=10, Refit=0.01})
line = LineSDL(Start=area_2.Centroid, Direction=Vector(0, 0, 1), Length=height_2)
rectangle = Rectangle(Plane=area_2.Centroid, XSize=dom, YSize=dom_2, Radius=0)  # -> Rectangle, Length
cap = CapHoles(Brep=loft)
extr = Extrude(Base=rectangle.Rectangle, Direction=line)
