# Grasshopper definition BuildingElements_CustomStairs.gh (Grasshopper 1.0.8)
# plug-ins: CORE.Toolbox.Grasshopper

profile = Curve(<curve referenced from the Rhino model>)
stringer = Curve(<curve referenced from the Rhino model>)
area = Area(Geometry=profile)  # -> Area, Centroid
number_slider = Slider(0, range=0..1)
stringer_2 = Curve(<curve referenced from the Rhino model>)
profile_selector = ProfileSelector(System=0, ShapeType=10)
evaluate_curve = EvaluateCurve(Curve=stringer, Parameter=number_slider)  # -> Point, Tangent, Angle
curve = Curve(<curve referenced from the Rhino model>)
curve_2 = Curve(<curve referenced from the Rhino model>)
perp_frame = PerpFrame(Curve=stringer, Parameter=number_slider)
panel = Panel(profile_selector)
divide_length = DivideLength(Curve=curve_2, Length=Slider(4, range=0..10))  # -> Points, Tangents, Parameters
orient = Orient(Geometry=profile, Source=area.Centroid, Target=perp_frame)  # -> Geometry, Transform
list_item = ListItem(List=panel, Index=Slider(114, range=0..500), Wrap=True)
project_point = ProjectPoint(Point=divide_length.Points, Direction=Vector(0, 0, -1), Geometry=curve)  # -> Point, Index
sweep_profile = SweepProfile(
    OutputMesh=False,
    BeamRail=stringer_2,
    SectionNameOrCurve=list_item,
    Justification=1,
    Rotation=0,
    JustificationIndex=4,
    SectionNameIndex=191,
    ShapeTypeIndex=0,
    UnitTypeIndex=0)  # -> BrepsOrMeshes, SectionProfiles
line = Line(StartPoint=divide_length.Points, EndPoint=project_point.Point)
