# Grasshopper definition BuildingElements_FacadePanelsByCurve.gh (Grasshopper 1.0.7)

geometry_pipeline = GeometryPipeline(
    GroupByLayer=False,
    GroupByType=False,
    IncludeHidden=True,
    IncludeLocked=True,
    LayerFilter="01_ARCH*01_PANELS",
    NameFilter="*",
    SublayerFiltering=True,
    TypeFilter=4)

number_slider = Slider(0.05, range=0..0.1)
negative = Negative(Value=number_slider)
offset_curve = OffsetCurve(Curve=graft(geometry_pipeline), Distance=[number_slider, negative], Corners=1)
trim_tree = TrimTree(Tree=offset_curve, Depth=1)
length = Length(Curve=trim_tree)
sort_list = SortList(Keys=length, ValuesValuesA=trim_tree)  # -> Keys, ValuesValuesA
list_item = ListItem(List=sort_list.ValuesValuesA, Index=0, Wrap=True)

boundary_surfaces = BoundarySurfaces(Edges=geometry_pipeline)

evaluate_surface = EvaluateSurface(Surface=reparameterize(boundary_surfaces), Point="{0.0,0.5,0}")  # -> Point, Normal, UDirection, VDirection, Frame

amplitude = Amplitude(Vector=evaluate_surface.Normal, Amplitude=expr("-x", Slider(1, range=0..1)))
extrude = Extrude(Base=boundary_surfaces, Direction=amplitude)

amplitude_2 = Amplitude(Vector=evaluate_surface.Normal, Amplitude=Slider(0.1, range=0..1))
extrude_2 = Extrude(Base=list_item, Direction=graft(amplitude_2))
cap_holes = CapHoles(Brep=extrude_2)

custom_preview = CustomPreview(Geometry=[cap_holes, extrude], Material=ColourSwatch(SwatchColor=RGB(72, 160, 113)))

# ---- group: Bake This Result
merge = Merge(Data1=extrude, Data2=cap_holes)
