# Grasshopper definition BuildingElements_HSS Profile Modeling by Curve.gh (Grasshopper 1.0.7)

panel = Panel("CURVE")
width = Slider(3, range=0..10)
height = Slider(7, range=0..10)
crv = Curve(reparameterize([<curve referenced from the Rhino model> x5]))
xy = XYPlane(Origin=Point(0, 0, 0))
dom = ConstructDomain(DomainStart=expr("x/2", width), DomainEnd=expr("-x/2", width))
offset = OffsetCurve(Curve=crv, Distance=expr("x/2", height), Plane=xy, Corners=1)
dom_2 = ConstructDomain(DomainStart=expr("x/2", height), DomainEnd=expr("-x/2", height))
pframes = PerpFrames(Curve=crv, Count=Slider(5, range=0..10), Align=True)  # -> Frames, Parameters
rectangle = Rectangle(Plane=pframes.Frames, XSize=dom, YSize=dom_2, Radius=0)  # -> Rectangle, Length
fillet = Fillet(Curve=rectangle.Rectangle, Radius=Slider(0.3, range=0..1))
loft = Loft(Curves=fillet, Options={Adjust=False, Closed=False, LoftEnds=0, LoftSimp=0, LoftType=0, Rebuild=10, Refit=0.01})
Z = UnitZ(Factor=expr("-x/2", height))
cap = CapHoles(Brep=loft)
move = Move(Geometry=cap, Motion=Z)  # -> Geometry, Transform
