# Grasshopper definition BuildingElements_PathFromCurve.gh (Grasshopper 1.0.7)

crv = Curve(graft([<curve referenced from the Rhino model> x2]))
offset = OffsetCurve(Curve=crv, Distance=Slider(5, range=0..10), Corners=1)
end = EndPoints(Curve=offset)  # -> Start, End
end_2 = EndPoints(Curve=crv)  # -> Start, End
ln = Line(StartPoint=end.End, EndPoint=end_2.End)
ln_2 = Line(StartPoint=end.Start, EndPoint=end_2.Start)
join = JoinCurves(Curves=flatten([crv, offset, ln_2, ln]), Preserve=False)
Z = UnitZ(Factor=1)
boundary = BoundarySurfaces(Edges=join)
extr = Extrude(Base=boundary, Direction=Z)
