# Grasshopper definition BuildingElements_PopulateBlockAlongCurve.gh (Grasshopper 1.0.7)
# plug-ins: eleFront

guide_curve = Curve([<curve referenced from the Rhino model> x3])

# ---- group: Block Name
insert = InsertBlock(BlockName="Tree_Plan", Plane=PlaneXY(0, 0, 0))

# ----
bbox = BoundingBox(Content=insert, Plane=PlaneXY(0, 0, 0))  # -> Box, Box_2

divlength = DivideLength(Curve=guide_curve, Length=Slider(50, range=0..100))  # -> Points, Tangents, Parameters
shift = ShiftList(List=divlength.Points, Shift=-1, Wrap=False)
shift_2 = ShiftList(List=divlength.Points, Shift=1, Wrap=False)
dist = Distance(PointA=shift, PointB=shift_2)
vec2pt = Vector2Pt(PointA=shift, PointB=shift_2, Unitize=False)  # -> Vector, Length

box_corners = BoxCorners(Box=bbox.Box)  # -> CornerA, CornerB, CornerC, CornerD, CornerE, CornerF, CornerG, CornerH
ln = Line(StartPoint=box_corners.CornerG, EndPoint=box_corners.CornerH)
ln_2 = Line(StartPoint=box_corners.CornerE, EndPoint=box_corners.CornerF)
midpt = CurveMiddle(Curve=ln)
midpt_2 = CurveMiddle(Curve=ln_2)
vec2pt_2 = Vector2Pt(PointA=midpt_2, PointB=midpt, Unitize=False)  # -> Vector, Length

orient = OrientDirection(Geometry=insert, PointA=midpt_2, DirectionA=vec2pt_2.Vector, PointB=shift, DirectionB=vec2pt.Vector)  # -> Geometry, Transform
