# Grasshopper definition BuildingElements_ProfileAlongSurface.gh (Grasshopper 1.0.7)

# POPULATING A SURFACE WITH VERTICAL PROFILE FROM A CURVE
panel = Panel("CURVE PROFILE")
panel_2 = Panel("VERTICAL SURFACE")

# ---- group: Profile Rotation Angle
number_slider = Slider(90, range=0..360)

# ---- group: Profile curve - Can be replaced
input_profile = Curve(<curve referenced from the Rhino model>)

# ---- group: Input Surface
srf = Surface(<surface referenced from the Rhino model>)

# ----
srf_2 = Surface(srf)

# ---- group: Get Surface Edges
getsrflowerupperedges = GetSrfLowerUpperEdges(B=srf_2)  # -> i, item_3
loweredge = Curve(getsrflowerupperedges.i)
upperedge = Curve(getsrflowerupperedges.item_3)

# ----
number_slider_2 = Slider(12, range=0..100)

# ---- group: Get Rail Curve
divlength = DivideLength(Curve=loweredge, Length=number_slider_2)  # -> Points, Tangents, Parameters
divlength_2 = DivideLength(Curve=upperedge, Length=number_slider_2)  # -> reverse(Points), Tangents, Parameters
short = ShortestList(ListA=divlength.Points, ListB=divlength_2.Points, TrimMode=2)  # -> ListA, ListB
ln = Line(StartPoint=short.ListA, EndPoint=short.ListB)
pframe = PerpFrame(Curve=reparameterize(ln), Parameter=0)

# ---- group: Find Place to Orient
area = Area(Geometry=input_profile)  # -> Area, Centroid
xy = XYPlane(Origin=area.Centroid)

# ---- group: Rotate Profile
orient = Orient(Geometry=input_profile, Source=xy, Target=pframe)  # -> Geometry, Transform
rotax = RotateAxis(Geometry=orient.Geometry, Angle=degrees(number_slider), Axis=ln)  # -> Geometry, Transform

# ---- group: Sweep
swp1 = Sweep1(Rail=graft(ln), Sections=graft(rotax.Geometry), Miter=1)  # -> simplify(Brep)

# ---- group: Outputs - Profile
extrusion = Brep(swp1)

# ==== cluster GetSrfLowerUpperEdges
B = ClusterInput()
edges = BrepEdges(Brep=B)  # -> Naked, Interior, NonManifold
crv = Curve(edges.Naked)
midpt = CurveMiddle(Curve=crv)
pdecon = Deconstruct(Point=midpt)  # -> XComponent, YComponent, ZComponent
sort = SortList(Keys=pdecon.ZComponent, ValuesA=crv)  # -> Keys, ValuesA
item = ListItem(List=sort.ValuesA, Index=0, Wrap=True)  # -> Item, Item1, Item2, Item3
i = ClusterOutput(item.Item)
item_3 = ClusterOutput(item.Item3)
