# Grasshopper definition BuildingElements_Railings 0.1.0.gh (Grasshopper 1.0.8)
# plug-ins: CORE.Toolbox.Grasshopper

picket_distance = Slider(20, range=0..48)
sill_curve = Curve(<curve referenced from the Rhino model>)
head_curve = Curve(<curve referenced from the Rhino model>)
units = ConvertUnits(Value=picket_distance, Source=3, Target=4, Exponent=1)  # -> Result, Factor
picketrailing = GhPythonScript(sill_curve=sill_curve, head_curve=head_curve, distance=units.Result)  # -> sill_curve, pickets_output, head_curve; inputs sill_curve: Curve, head_curve: Curve
# ---------- picketrailing: Python ----------
__author__ = "ilouh"
__version__ = "2024.10.13"

import ghpythonlib.components as ghcomp

# Divide the sill curve by a distance of 4 inches
division_result = ghcomp.DivideLength(sill_curve, distance)
points_on_sill = division_result['points']  # These are the division points from Grasshopper

pickets = []  # List to store picket lines

# Iterate over the points on the sill curve
for point in points_on_sill:
    # Find the closest point on the head curve
    projected_point = ghcomp.CurveClosestPoint(point, head_curve)['point']
    
    # Create a line connecting the point on the sill to the projected point on the head curve
    line = ghcomp.Line(point, projected_point)
    pickets.append(line)

# Handle the last picket, connecting the endpoints of the two curves
sill_endpoint = ghcomp.EndPoints(sill_curve)['end']  # Endpoint of the sill curve
head_endpoint =projected_point = ghcomp.CurveClosestPoint(sill_endpoint, head_curve)['point']  # Endpoint of the head curve

# Create the last picket connecting the two endpoints
last_picket = ghcomp.Line(sill_endpoint, head_endpoint)
pickets.append(last_picket)

# Output the picket lines
pickets_output = pickets
# ---------- end picketrailing ----------
railing = Curve([picketrailing.pickets_output, picketrailing.head_curve, picketrailing.sill_curve])
