# Grasshopper definition BuildingElements_Roads By Curves.gh (Grasshopper 1.0.8)
# plug-ins: RhinoCodePluginGH, CORE.Toolbox.Grasshopper

wall_thickness = Slider(20, range=0..20)
bake = BooleanToggle(False)
geometry_pipeline = GeometryPipeline(
    GroupByLayer=False,
    GroupByType=False,
    IncludeHidden=True,
    IncludeLocked=True,
    LayerFilter="01_SITE*01_ROADS",
    NameFilter="*",
    SublayerFiltering=True,
    TypeFilter=4)

curve = Curve(geometry_pipeline)
curve_type = CurveType(Curve=curve)  # -> Type, Degree, Closed, Planar

wall_thickness_2 = GhPythonScript(curve=curve, distance=wall_thickness, type=curve_type.Type)  # -> out; inputs curve: Guid
# ---------- wall_thickness_2: Python ----------
__author__ = "ilouh"
__version__ = "2023.02.21"

import rhinoscriptsyntax as rs
import Grasshopper as gh
import Rhino.Geometry as rg
import ghpythonlib.components as comps
import math

def create_wall_linear(curve,distance):
    
    
    crv_1 = comps.OffsetCurve(curve,distance/2, corners = 1)
    crv_2 = comps.OffsetCurve(curve,-distance/2,corners = 1)
    
    
    end_points_1 = comps.EndPoints(crv_1)
    end_points_2 = comps.EndPoints(crv_2)
    
    pt1 = end_points_1[0]
    pt2 = end_points_1[1]
    pt3 = end_points_2[1]
    pt4 = end_points_2[0]
    
    cap_1 = comps.Line(pt2,pt3)
    cap_2 = comps.Line(pt1,pt4)
    
    crv_list = [crv_1,crv_2,cap_1,cap_2]
    joined_curve = comps.JoinCurves([crv_1,cap_1,cap_2,crv_2], False)

    return joined_curve

def create_wall_arc(curve,distance):
    
    crv_1 = comps.OffsetCurve(curve,distance/2, corners = 1)
    crv_2 = comps.OffsetCurve(curve,-distance/2,corners = 1)
    
    print(crv_1,crv_2)
    
    
if type != 'Arc':
    out = create_wall_linear(curve,distance)
# ---------- end wall_thickness_2 ----------
offset_distance = Slider(28, range=0..50)
region_union = RegionUnion(Curves=wall_thickness_2)
py3 = Python3Script(curve=region_union, x=wall_thickness, y=offset_distance)  # -> b; inputs curve: Curve
# ---------- py3: Python ----------
import Rhino.Geometry as rg

def explode_filter_offset(curve, x, y):
    if not curve:
        return None, None
    
    # Explode the curve into segments
    exploded_segments = curve.DuplicateSegments()
    
    # Filter segments based on length
    filtered_segments = [seg for seg in exploded_segments if seg.GetLength() > x]
    
    # Offset the filtered segments
    offset_curves = []
    for seg in filtered_segments:
        # Find the curve's direction and normal for offset
        offset_curve = seg.Offset(rg.Plane.WorldXY, y, 0.01, rg.CurveOffsetCornerStyle.Sharp)
        if offset_curve:
            offset_curves.extend(offset_curve)
    
    return filtered_segments, offset_curves

# Inputs
# Curve to explode (must be provided as 'curve' input)
# Threshold length (float 'x')
# Offset distance (float 'y')
filtered, offsetted = explode_filter_offset(curve, x+1, y)

# Outputs
# A list of filtered segments
# A list of offset curves
a = filtered  # Plug into Grasshopper output for filtered curves
b = offsetted  # Plug into Grasshopper output for offset curves
# ---------- end py3 ----------
crv = Curve(py3)
divlength = DivideLength(Curve=crv, Length=Slider(74, range=0..100))  # -> Points, Tangents, Parameters
