# Grasshopper definition BuildingElements_Roof.gh (Grasshopper 1.0.7)
# plug-ins: eleFront

massing = Brep(<brep referenced from the Rhino model>)
panel = Panel("""0
1
2
3""")
cluster = Cluster(massing=massing)  # -> floors, walls_2, roof_2
massing_2 = Brep(<brep referenced from the Rhino model>)
list_item = ListItem(List=flatten(cluster.walls_2), Index=panel, Wrap=True)
cluster_2 = Cluster(massing=massing_2)  # -> floors, walls_2, roof_2
surface = Surface(reparameterize(cluster_2.walls_2))
surface_2 = Surface(reparameterize(cluster_2.roof_2))
surface_3 = Surface(reparameterize(list_item))
surface_4 = Surface(reparameterize(cluster.roof_2))
pattern_hatch = PatternHatch(Boundaries=surface, Pattern=1, Scale=Slider(12, range=0..20), Angle=degrees(90))
pattern_hatch_2 = PatternHatch(Boundaries=surface_2, Pattern=1, Scale=4, Angle=degrees(90))
get_horizontal_isocurve = GhPythonScript(surface=surface, sill=Slider(1, range=0..10))  # -> out; inputs surface: Surface
# ---------- get_horizontal_isocurve: Python ----------
__author__ = "ilouh"
__version__ = "2023.02.21"

import rhinoscriptsyntax as rs
import Grasshopper as gh
import Rhino.Geometry as rg
import ghpythonlib.components as comps
import math

#declare 
srf = surface

#get surface isocurves
pt_01 = comps.ConstructPoint(0.0,0.0,0)
pt_02 = comps.ConstructPoint(0.0,1.0,0)
pt_03 = comps.ConstructPoint(1.0,0.0,0)
pt_04 = comps.ConstructPoint(1.0,1.0,0)

points_test = [pt_01,pt_02,pt_03,pt_04] 

def horizontal_isocurve(srf,pt):
    
    curves = comps.IsoCurve(srf,pt)
    
    for curve in curves: 
        
        end_points = comps.EndPoints(curve)
        vector = comps.Vector2Pt(end_points['start'],end_points['end'],True)
        
        vector = vector['vector']
        
        values = comps.DeconstructVector(vector)
        z_value = values['z_component']
        
        if abs(round(z_value,0)) == 0: 
            
            horionztal_curve = curve
            
    return horionztal_curve

def mid_z(curve):
    
    middle = comps.EvaluateCurve(curve,0.5)
    middle = middle['point']
    
    z_value = comps.Deconstruct(middle)
    z_value = z_value['z_component']
    
    return z_value

horizontal_curves = [] 
z_values = []

for point in points_test: 
    
    crv = horizontal_isocurve(srf,point)
    mid = mid_z(crv)
    
    horizontal_curves.append(crv)
    z_values.append(mid)

    

temp_list = zip(z_values,horizontal_curves)
temp_list.sort()

print(temp_list[0][1])

horizontal_sill_curve = temp_list[0][1]

vector = comps.UnitZ(sill)
window_curve = comps.Move(horizontal_sill_curve,vector)
print(window_curve)
out = window_curve['geometry']
# ---------- end get_horizontal_isocurve ----------
get_horizontal_isocurve_2 = GhPythonScript(surface=surface_3)  # -> out; inputs surface: Surface
# ---------- get_horizontal_isocurve_2: Python ----------
__author__ = "ilouh"
__version__ = "2023.02.21"

import rhinoscriptsyntax as rs
import Grasshopper as gh
import Rhino.Geometry as rg
import ghpythonlib.components as comps
import math

#declare 
srf = surface

#get surface isocurves
pt_01 = comps.ConstructPoint(0.0,0.0,0)
pt_02 = comps.ConstructPoint(0.0,1.0,0)
pt_03 = comps.ConstructPoint(1.0,0.0,0)
pt_04 = comps.ConstructPoint(1.0,1.0,0)

points_test = [pt_01,pt_02,pt_03,pt_04] 

def horizontal_isocurve(srf,pt):
    
    curves = comps.IsoCurve(srf,pt)
    
    for curve in curves: 
        
        end_points = comps.EndPoints(curve)
        vector = comps.Vector2Pt(end_points['start'],end_points['end'],True)
        
        vector = vector['vector']
        
        values = comps.DeconstructVector(vector)
        z_value = values['z_component']
        
        if abs(round(z_value,0)) == 0: 
            
            horionztal_curve = curve
            
    return horionztal_curve

def mid_z(curve):
    
    middle = comps.EvaluateCurve(curve,0.5)
    middle = middle['point']
    
    z_value = comps.Deconstruct(middle)
    z_value = z_value['z_component']
    
    return z_value

horizontal_curves = [] 
z_values = []

for point in points_test: 
    
    crv = horizontal_isocurve(srf,point)
    mid = mid_z(crv)
    
    horizontal_curves.append(crv)
    z_values.append(mid)

    

temp_list = zip(z_values,horizontal_curves)
temp_list.sort()

print(temp_list[0][1])

horizontal_sill_curve = temp_list[0][1]

vector = comps.UnitZ(3)
window_curve = comps.Move(horizontal_sill_curve,vector)
print(window_curve)
out = window_curve['geometry']
# ---------- end get_horizontal_isocurve_2 ----------
pattern_hatch_3 = PatternHatch(Boundaries=surface_3, Pattern=1, Scale=Slider(12, range=0..20), Angle=degrees(90))
pattern_hatch_4 = PatternHatch(Boundaries=surface_4, Pattern=1, Scale=4, Angle=degrees(90))
curve = Curve(get_horizontal_isocurve)
curve_2 = Curve(get_horizontal_isocurve_2)
number_slider = Slider(5, range=0..10)
number_slider_2 = Slider(2, range=0..10)
number_slider_3 = Slider(8, range=0..10)
number_slider_4 = Slider(2, range=0..10)
window_from_sill_point = GhPythonScript(sill_curve=curve_2, height=number_slider, width=number_slider_2, num_windows=Slider(4, range=0..10))  # -> windows, window_planes; inputs sill_curve: Curve
# ---------- window_from_sill_point: Python ----------
__author__ = "ilouh"
__version__ = "2023.02.21"

import rhinoscriptsyntax as rs
import Grasshopper as gh
import Rhino.Geometry as rg
import ghpythonlib.components as comps
import math

sill_curve = sill_curve
sill_points = comps.DivideCurve(sill_curve,num_windows,kinks = False)['points']
sill_tangents = comps.DivideCurve(sill_curve,num_windows,kinks = False)['tangents']

evaluate_curve_planes = comps.CurveFrame(sill_curve,sill_tangents)
window_planes = evaluate_curve_planes[1:-1]

window_height = height
window_width = width

#declare 
windows = []

for i in range(1,len(sill_points)-1):
    
    sill_point = sill_points[i]
    sill_frame = evaluate_curve_planes[i]
    
    plane_vectors = comps.DeconstructPlane(sill_frame)
    
    x_axis = plane_vectors['x-axis']
    y_axis = plane_vectors['y-axis']

    
    
    pt_01 = comps.Move(sill_point,comps.Amplitude(x_axis,width/2))['geometry']
    pt_02 = comps.Move(sill_point,comps.Amplitude(x_axis,-width/2))['geometry']
    
    pt_03 = comps.Move(pt_01,comps.UnitZ(height))['geometry']
    pt_04 = comps.Move(pt_02,comps.UnitZ(height))['geometry']

    
    
    pt_list = [pt_01,pt_02,pt_04,pt_03]
    
    for pt in pt_list:
        print(pt)
        
    window_outline = comps.PolyLine(pt_list,True)

    windows.append(window_outline)
# ---------- end window_from_sill_point ----------
window_from_sill_point_2 = GhPythonScript(sill_curve=curve, height=number_slider_3, width=number_slider_4, num_windows=Slider(4, range=0..10))  # -> windows, window_planes; inputs sill_curve: Curve; same code as window_from_sill_point
curve_3 = Curve(window_from_sill_point.windows)
curve_4 = Curve(window_from_sill_point_2.windows)
evaluate_surface = EvaluateSurface(Surface=reparameterize(curve_3), Point="{0.5,0.0,0}")  # -> Point, Normal, UDirection, VDirection, Frame
evaluate_surface_2 = EvaluateSurface(Surface=reparameterize(curve_4), Point="{0.5,0.0,0}")  # -> Point, Normal, UDirection, VDirection, Frame
expression = Expression(height=number_slider, Expression="height / 8")
expression_2 = Expression(width=number_slider_2, Expression="width / 3")
insert_block = InsertBlock(BlockName="Casement Window", Plane=evaluate_surface.Frame)
expression_3 = Expression(height=number_slider_3, Expression="height / 8")
expression_4 = Expression(width=number_slider_4, Expression="width / 3")
insert_block_2 = InsertBlock(BlockName="Casement Window", Plane=evaluate_surface_2.Frame)
scale_nu = ScaleNU(Geometry=insert_block, Plane=evaluate_surface.Frame, ScaleX=expression_2, ScaleY=expression, ScaleZ=1)  # -> Geometry, Transform
scale_nu_2 = ScaleNU(Geometry=insert_block_2, Plane=evaluate_surface_2.Frame, ScaleX=expression_4, ScaleY=expression_3, ScaleZ=1)  # -> Geometry, Transform

# ==== cluster Cluster
massing = ClusterInput()
massing_2 = Brep(massing)

# ---- group: Isolate Faces of Mass
debrep = DeconstructBrep(Brep=massing_2)  # -> Faces, Edges, Vertices
evalsrf = EvaluateSurface(Surface=reparameterize(debrep.Faces), Point="{0.5,0.5,0}")  # -> Point, simplify(Normal), UDirection, VDirection, Frame
distributefaces = GhPythonScript(v=simplify(evalsrf.Normal), faces=simplify(debrep.Faces))  # -> floors, facadeWalls, roof; inputs v: list, faces: list
# ---------- distributefaces: Python ----------
__author__ = "ilouh"
__version__ = "2023.01.08"

import rhinoscriptsyntax as rs
import ghpythonlib.components as comps
import Rhino.Geometry as geom

#elements = comps.DeconstructBrep(mass)
#faces = elements['faces']

#find the normal of each face


roof = []
floors = []
solidWalls = []
facadeWalls = [] 

for i in range(0,len(v)):
    
    vector = v[i]
    values = comps.DeconstructVector(vector)
    
    print(vector)
    
    if values['x_component'] is not None:
        
        x_value = values['x_component']
        y_value = values['y_component']
        z_value = values['z_component']
        
    else:
        
        x_value = vector[0]
        y_value = vector[1]
        z_value = vector[2]
    
    print(x_value)
    
    if x_value is not None:
        
        if z_value > 0:
            
            print(i)
            roof.append(faces[i])
        
        if z_value == -1:
            
            floors.append(faces[i])
       
        if abs(z_value) == 0:
            
            facadeWalls.append(faces[i])
# ---------- end distributefaces ----------

# ----
panel = Panel(evalsrf.Normal)
roof = Surface(flatten(distributefaces.roof))
walls = Surface(graft(distributefaces.facadeWalls))
srf = Surface(distributefaces.floors)
floors = ClusterOutput(distributefaces.floors)
walls_2 = ClusterOutput(walls)
roof_2 = ClusterOutput(roof)
