# Grasshopper definition BuildingElements_Sidings.gh (Grasshopper 1.0.8)
# plug-ins: RhinoCodePluginGH, CORE.Toolbox.Grasshopper

# ---- group: Input Surface
srf = Surface(reparameterize(graft(<surface referenced from the Rhino model>)))

# ----
spacing = Slider(4.431, range=0..100)
height = Slider(3, range=-20..20)
width = Slider(1, range=-10..10)
flip = BooleanToggle(True)
direction = BooleanToggle(False)
py3 = Python3Script(x=height, flip=flip)  # -> out, x
# ---------- py3: Python ----------
"""Grasshopper Script"""
a = "Hello Python 3 in Grasshopper!"

if flip: 
    x = x
else:
    x = -x
# ---------- end py3 ----------
units = ConvertUnits(Value=spacing, Source=3, Target=4, Exponent=1)  # -> Result, Factor
units_2 = ConvertUnits(Value=py3.x, Source=3, Target=4, Exponent=1)  # -> Result, Factor
units_3 = ConvertUnits(Value=width, Source=3, Target=4, Exponent=1)  # -> Result, Factor
createframinglines = GhPythonScript(srf=srf, direction=direction, distance=units.Result)  # -> framing_lines; inputs srf: Surface
# ---------- createframinglines: Python ----------
"""
This script generates framing lines between two curves, which are the edges of an untrimmed surface.
The script selects either the shortest or longest set of edges based on the specified direction and 
creates framing members with a specified spacing distance between points along these edges.

Inputs:
    srf: The surface from which edges are extracted to generate framing lines.
    distance: The spacing distance between points along each curve, determining the number of framing members.
    direction: Boolean variable to choose framing along the shortest or longest set of edges.
Outputs:
    framing_lines: The generated lines representing framing members between points on the selected edge curves.

Author: ilouh
Version: 2023.02.21
"""

import rhinoscriptsyntax as rs
import Grasshopper as gh
import Rhino.Geometry as rg
import ghpythonlib.components as comps
import math

# Untrim the surface input to get the entire, unmodified boundary.
untrim_surface = comps.Untrim(srf)  # Extracts the untrimmed boundary of the surface 'srf'.

# Function to create framing lines between two curves with a specified distance between points
def framing(crvs, distance):
    """
    Generates framing lines between two input curves (crv_01 and crv_02).
    
    Parameters:
        crvs (list): A list of two curves to use for framing.
        distance (float): The distance between points along each curve.
        
    Returns:
        list: A list of lines representing framing members between the points on the curves.
    """
    crv_01 = crvs[0]
    crv_02 = comps.FlipCurve(crvs[1])['curve']  # Flips the second curve's direction to match crv_01.

    # Calculate the spacing by dividing the length of the curve by the specified distance.
    spacing = comps.Length(crv_01) / distance

    # Divide both curves into points using the calculated spacing.
    points_01 = comps.DivideCurve(crv_01, spacing, False)['points']
    points_02 = comps.DivideCurve(crv_02, spacing, False)['points']

    # Pair each point from points_01 with the corresponding point in points_02.
    zipped_points = list(zip(points_01, points_02))
    
    framing_members = []
    for pair in zipped_points:
        line = comps.Line(pair[0], pair[1])  # Create a line between each pair of points.
        framing_members.append(line)  # Append each line to the framing_members list.
    
    return framing_members

# Deconstruct the untrimmed surface to extract edges.
edges = comps.DeconstructBrep(untrim_surface)['edges']
edge_lengths = comps.Length(edges)

# Sort edges by length to identify the shortest and longest curves.
sorted_list = list(zip(edges, edge_lengths))
sorted_list = sorted(sorted_list, key=lambda x: x[1])

# Separate sorted edges into curves and lengths.
crvs, lengths = zip(*sorted_list)

# Identify the two shortest and two longest edges.
shortest_crvs = [crvs[0], crvs[1]]
longest_crvs = [crvs[2], crvs[3]]

# Choose the set of curves (shortest or longest) based on the direction parameter.
if direction:
    framing_lines = framing(shortest_crvs, distance)
else: 
    framing_lines = framing(longest_crvs, distance)
# ---------- end createframinglines ----------
md_slider = MDSlider(SliderMode=0, slider_value=Point(0.5, 0.5, 0.5), x_domain=Domain(0, 1), y_domain=Domain(0, 1), z_domain=Domain(0, 1))
evalsrf = EvaluateSurface(Surface=reparameterize(srf), Point=md_slider)  # -> Point, Normal, UDirection, VDirection, Frame

scx = SurfaceCurve(Surface=srf, Curve=createframinglines)  # -> Curves, Points, UVPoints, Normals, Parameters, Tangents

amp = Amplitude(Vector=evalsrf.Normal, Amplitude=units_2.Result)
extr = Extrude(Base=scx.Curves, Direction=amp)
md_slider_2 = MDSlider(SliderMode=0, slider_value=Point(0.5, 0.5, 0.5), x_domain=Domain(0, 1), y_domain=Domain(0, 1), z_domain=Domain(0, 1))
evalsrf_2 = EvaluateSurface(Surface=reparameterize(extr), Point=md_slider_2)  # -> Point, Normal, UDirection, VDirection, Frame
amp_2 = Amplitude(Vector=evalsrf_2.Normal, Amplitude=units_3.Result)
extr_2 = Extrude(Base=extr, Direction=amp_2)  # -> flatten(Extrusion)
group = Group(Objects=extr_2)
