# Grasshopper definition BuildingElements_SlidingDoor.gh (Grasshopper 1.0.8)

number_of_sliders = Slider(2, range=0..10)
frame_thickeness = Slider(2, range=0..10)
frame_depth = Slider(0, range=0..10)
framedepth = Slider(3, range=0..10)
framewidth = Slider(2, range=0..6)
surface = Surface(<surface referenced from the Rhino model>)
creates_panels = CreatesPanels(surface=surface, U=number_of_sliders, V=frame_depth)  # -> V_2, S
move = Move(Geometry=creates_panels.S, Motion=creates_panels.V_2)  # -> graft(Geometry), Transform
create_panel = CreatePanel(curves=move.Geometry, V=framewidth, V_2=framedepth, x_2=Slider(2.4, range=0..20), x=Slider(4, range=0..20))  # -> R, P
group = Group(Objects=create_panel.R)

# ==== cluster CreatesPanels
surface = ClusterInput()
surface_2 = Surface(reparameterize(surface))
debrep = DeconstructBrep(Brep=surface_2)  # -> Faces, Edges, Vertices
item = ListItem(List=debrep.Vertices, Index=0, Wrap=True)  # -> Item, Item1, Item2, Item3
srf4pt = _4PointSurface(CornerA=item.Item, CornerB=item.Item1, CornerC=item.Item2, CornerD=item.Item3)
V = ClusterInput()
U = ClusterInput()
units = ConvertUnits(Value=V, Source=3, Target=4, Exponent=1)  # -> Result, Factor

md_slider = MDSlider(SliderMode=0, slider_value=Point(0.5, 0.5, 0.5), x_domain=Domain(0, 1), y_domain=Domain(0, 1), z_domain=Domain(0, 1))
divide = DivideDomain²(Domain=srf4pt, UCount=U, VCount=1)
evalsrf = EvaluateSurface(Surface=reparameterize(srf4pt), Point=md_slider)  # -> Point, Normal, UDirection, VDirection, Frame
subsrf = Isotrim(Surface=srf4pt, Domain=divide)
lng = ListLength(List=subsrf)
series = Series(Start=0, Step=units.Result, Count=lng)
amp = Amplitude(Vector=evalsrf.Normal, Amplitude=series)

S = ClusterOutput(subsrf)
V_2 = ClusterOutput(amp)

# ==== cluster CreatePanel
V = ClusterInput()
V_2 = ClusterInput()
x = ClusterInput()
x_2 = ClusterInput()
curves = ClusterInput()
join_curves = JoinCurves(Curves=curves, Preserve=False)
boundary_curve = Curve(reparameterize(graft(join_curves)))
units = ConvertUnits(Value=V, Source=3, Target=4, Exponent=1)  # -> Result, Factor
units_2 = ConvertUnits(Value=V_2, Source=3, Target=4, Exponent=1)  # -> Result, Factor
surfaceboundary = GhPythonScript(curve=boundary_curve, distance=units.Result, frameDepth=units_2.Result)  # -> windowFrame, windowGlazing; inputs curve: Curve
# ---------- surfaceboundary: Python ----------
__author__ = "ilouh"
__version__ = "2023.02.21"

import rhinoscriptsyntax as rs
import Grasshopper as gh
import Rhino.Geometry as rg
import ghpythonlib.components as comps
import math


def createFrame(crv,distance,frameDepth):
    
    offset_1 = comps.OffsetCurve(crv,distance,corners = 1)
    offset_2 = comps.OffsetCurve(crv,-distance,corners = 1)
    
    if comps.Length(offset_1) > comps.Length(offset_2): 
        srf = comps.BoundarySurfaces([crv,offset_2])
        point = comps.ConstructPoint(0.5,0.5,0)
        normal = comps.EvaluateSurface(srf,point)['normal']
        brep = comps.Extrude(srf,comps.Amplitude(normal,frameDepth))
        brep = comps.Move(brep,comps.Amplitude(normal,-frameDepth/2))['geometry']
        return brep,comps.BoundarySurfaces(offset_2)

    
    else:
        srf =  comps.BoundarySurfaces([crv,offset_1])
        point = comps.ConstructPoint(0.5,0.5,0)
        normal = comps.EvaluateSurface(srf,point)['normal']
        brep = comps.Extrude(srf,comps.Amplitude(normal,frameDepth))
        brep = comps.Move(brep,comps.Amplitude(normal,-frameDepth/2))['geometry']
        return brep,comps.BoundarySurfaces(offset_1)



windowFrame = createFrame(curve,distance,frameDepth)[0]
windowGlazing = createFrame(curve,distance,frameDepth)[1]
# ---------- end surfaceboundary ----------
glazing = Surface(reparameterize(surfaceboundary.windowGlazing))
dim = Dimensions(Surface=glazing)  # -> UDimension, VDimension
expression = Expression(v=dim.VDimension, x=x, Expression="round(v/x)")
expression_2 = Expression(u=dim.UDimension, x=x_2, Expression="round(u/x)")
frame = Brep(surfaceboundary.windowFrame)
mountins = Mountins(S=reparameterize(graft(glazing)), x=expression, x_2=expression_2)  # -> U, V
preview = CustomPreview(Geometry=frame, Material=ColourSwatch(SwatchColor=RGB(70, 19, 17)))
preview_2 = CustomPreview(Geometry=glazing, Material=ColourSwatch(SwatchColor=RGBA(255, 0, 255, 59)))
crv = Curve(mountins.U)
crv_2 = Curve(mountins.V)
merge = Merge(Data1=crv, Data2=crv_2)
units_3 = ConvertUnits(Value=Slider(0.5, range=0..1), Source=3, Target=4, Exponent=1)  # -> Result, Factor
pipe = Pipe(Curve=simplify(merge), Radius=units_3.Result, Caps=0)  # -> simplify(Pipe)
P = ClusterOutput(pipe)
trim = TrimTree(Tree=pipe, Depth=1)
merge_2 = Merge(Data1=simplify(frame), Data2=simplify(trim))  # -> flatten(Result)
R = ClusterOutput(merge_2)

# ==== cluster Mountins
x = ClusterInput()
x_2 = ClusterInput()
py3 = Python3Script(x=x)  # -> out
# ---------- py3: Python ----------
def create_range(step_size):
    if step_size <= 0:
        return "Step size must be greater than 0."
    else:
        range_list = []
        current_value = 0
        while current_value <= 1:
            range_list.append(round(current_value, 5))
            current_value += step_size
        return range_list[1:-1]


step_size = 1/x
out = create_range(step_size)
# ---------- end py3 ----------
py3_2 = Python3Script(x=x_2)  # -> out; same code as py3
concat = Concatenate(FragmentA="{0.0,", FragmentB=py3, FragmentC=",0.0}")
concat_2 = Concatenate(FragmentA=py3_2, FragmentB=",0.0,", FragmentC=",0.0}")
S = ClusterInput()
iso = IsoCurve(Surface=reparameterize(S), UVPoint=concat)  # -> UIsocurve, VIsocurve
iso_2 = IsoCurve(Surface=reparameterize(S), UVPoint=concat_2)  # -> UIsocurve, VIsocurve
U = ClusterOutput(iso.UIsocurve)
V = ClusterOutput(iso_2.VIsocurve)
