# Grasshopper definition BuildingElements_StairsByCurve.gh (Grasshopper 1.0.8)

tread_depth = Slider(10, range=0..24)
stair_width = Slider(24, range=0..48)
# Make sure your documents in units before running the script, or change the parameters above to match the units the document is using
tread_height = Slider(10, range=0..48)
input_curve = Curve(reparameterize(<curve referenced from the Rhino model>))

divide_length = DivideLength(Curve=input_curve, Length=expr("x", tread_depth))  # -> Points, Tangents, Parameters
list_length = ListLength(List=divide_length.Points)
divide_curve = DivideCurve(Curve=input_curve, Count=list_length, Kinks=False)  # -> Points, Tangents, Parameters

xy = XYPlane(Origin=Point(0, 0, 0))

shatter = Shatter(Curve=input_curve, Parameters=divide_curve.Parameters)
offset_curve = OffsetCurve(Curve=shatter, Distance=expr("x", stair_width), Plane=xy, Corners=1)  # -> simplify(flatten(Curve))

merge = Merge(Data1=simplify(graft(shatter)), Data2=simplify(graft(offset_curve)))
loft = Loft(Curves=merge, Options={Adjust=False, Closed=False, LoftEnds=0, LoftSimp=0, LoftType=0, Rebuild=10, Refit=0.01})  # -> flatten(Loft)

expression = Expression(x=tread_height, Expression="x/12")
createstairs = GhPythonScript(treads=loft, treadHeight=tread_height)  # -> steps; inputs treads: list of Surface
# ---------- createstairs: Python ----------
__author__ = "ilouh"
__version__ = "2023.02.21"

import rhinoscriptsyntax as rs
import Grasshopper as gh
import Rhino.Geometry as rg
import ghpythonlib.components as comps
import math

steps = [] 

for index,tread in enumerate(treads):
    
    
    treadHeight_temp = (index) * treadHeight
    print(treadHeight)
    srf = comps.Move(tread,comps.UnitZ(treadHeight_temp))
    
    step = comps.Extrude(srf['geometry'],comps.UnitZ(treadHeight)) 
    steps.append(step)
# ---------- end createstairs ----------
colour_swatch = ColourSwatch(SwatchColor=RGB(62, 200, 255))
steps = Brep(createstairs)
