# Grasshopper definition BuildingElements_StandingMetalSeamBySurface 0.1.0.gh (Grasshopper 1.0.8)
# plug-ins: CORE.Toolbox.Grasshopper

# ---- group: Input Surface
srf = Surface(graft([<surface referenced from the Rhino model> x10]))

# ----
direction = BooleanToggle(False)
spacing = Slider(1, range=0..100)
width = Slider(1, range=0..20)
height = Slider(1, range=0..10)
rhunits = RhinoUnits(Refresh=True)  # -> UnitName, UnitIndex
python = GhPythonScript(units=rhunits.UnitName)  # -> out
# ---------- python: Python ----------
__author__ = "ilouh"
__version__ = "2023.02.21"

import rhinoscriptsyntax as rs
import Grasshopper as gh
import Rhino.Geometry as rg
import ghpythonlib.components as comps
import math

print(units)

if units == 'inches':
    out = 1

if units == 'feet':
    out = 12

if units == 'meters':
    out = 10
# ---------- end python ----------
createframinglines = GhPythonScript(srf=srf, direction=direction, distance=spacing)  # -> framing_lines; inputs srf: Surface
# ---------- createframinglines: Python ----------
__author__ = "ilouh"
__version__ = "2023.02.21"

import rhinoscriptsyntax as rs
import Grasshopper as gh
import Rhino.Geometry as rg
import ghpythonlib.components as comps
import math


untrim_sruface = comps.Untrim(srf)



def framing (crvs,distance):
    
    crv_01 = crvs[0]
    crv_02 = comps.FlipCurve(crvs[1])['curve']
    
    spacing = comps.Length(crv_01)/distance
    
    points_01 = comps.DivideCurve(crv_01,spacing,False)['points']
    points_02 = comps.DivideCurve(crv_02,spacing,False)['points']

    zipped_points = list(zip(points_01,points_02))
    
    framing_members = []
    
    for pair in zipped_points:
        
        line = comps.Line(pair[0],pair[1])
        framing_members.append(line)
        
    
    return framing_members


edges = comps.DeconstructBrep(untrim_sruface)['edges']
edge_lengths = comps.Length(edges)

sorted_list = list(zip(edges,edge_lengths))
sorted_list = sorted(sorted_list, key = lambda x: x[1])

crvs, lengths = zip(*sorted_list)

shortest_crvs = [crvs[0],crvs[1]]
longest_crvs = [crvs[2],crvs[3]]


if direction:
    
    framing_lines = framing(shortest_crvs,distance)

else: 
    
    framing_lines = framing(longest_crvs,distance)
# ---------- end createframinglines ----------

scx = SurfaceCurve(Surface=srf, Curve=createframinglines)  # -> Curves, Points, UVPoints, Normals, Parameters, Tangents
pframe = PerpFrame(Curve=reparameterize(scx.Curves), Parameter=0)

expression = Expression(x=width, d=python, Expression="x/d")
expression_2 = Expression(x=height, d=python, Expression="x/d")
createframe = GhPythonScript(framing_lines=scx.Curves, height=expression, width=expression_2, plane=pframe)  # -> simplify(framing_members); inputs framing_lines: Curve
# ---------- createframe: Python ----------
__author__ = "ilouh"
__version__ = "2023.02.21"

import rhinoscriptsyntax as rs
import Grasshopper as gh
import Rhino.Geometry as rg
import ghpythonlib.components as comps
import math

x = width
y = height

def profie(x,y,plane):
    
    x_domain = comps.ConstructDomain(-x/2,x/2)
    y_domain = comps.ConstructDomain(-y/2,y/2)
    
    
    rec = comps.Rectangle(plane,x_domain,y_domain,radius = 0)
    
    print(rec)
    return rec['rectangle']

rec = profie(height,width,plane)

framing_members = comps.Sweep1(framing_lines,rec,0)

#vector = comps.DeconstructPlane(plane)['y-axis']
#vector = comps.Amplitude(vector,x/2)
#framing_members = comps.Move(framing_members,vector)['geometry']

print(rec)
# ---------- end createframe ----------
cap = CapHoles(Brep=createframe)
relay = Relay()

rim = Brep()
merge = Merge(Data2=relay)

group = Group()
group_2 = Group(Objects=merge)
merge_2 = Merge(Data1=group_2, Data2=group)
