# Grasshopper definition BuildingElements_StructuralFootings.gh (Grasshopper 1.0.7)
# plug-ins: EleFront, Rhino.Inside for Autodesk Revit

grade_beams = Curve(reparameterize([<curve referenced from the Rhino model> x7]))
crv = Curve(reparameterize([<curve referenced from the Rhino model> x10]))
crv_2 = Curve(reparameterize([<curve referenced from the Rhino model> x28]))
pframe = PerpFrame(Curve=grade_beams, Parameter=Slider(0, range=0..1))
neg = Negative(Value=Slider(18, range=0..100))
Z = UnitZ(Factor=expr("x/12", neg))
merge = Merge(Data1=Slider(-15, range=-24..24), Data2=Slider(15, range=-24..24))
dom = ConstructDomain(DomainStart=expr("x/12", Slider(-18, range=-24..24)), DomainEnd=expr("x/12", Slider(0, range=-24..24)))
dom_2 = ConstructDomain(DomainStart=expr("x/12", Slider(-7.5, range=-24..24)), DomainEnd=expr("x/12", Slider(7.5, range=-24..24)))
extr = Extrude(Base=crv_2, Direction=Z)
offset = OffsetCurve(Curve=graft(crv), Distance=expr("x/12", merge), Corners=1)
cap = CapHoles(Brep=extr)  # -> graft(Brep)
rectangle = Rectangle(Plane=pframe, XSize=dom, YSize=dom_2, Radius=0)  # -> Rectangle, Length
trim = TrimTree(Tree=offset, Depth=1)
graft = GraftParallel(PrimaryData=grade_beams)  # -> simplify(PrimaryData), SecondaryData1
graft_2 = GraftParallel(PrimaryData=rectangle.Rectangle)  # -> simplify(PrimaryData), SecondaryData1
len = Length(Curve=trim)
sort = SortList(Keys=len, ValuesA=trim)  # -> Keys, ValuesA
item = ListItem(List=sort.ValuesA, Index=0, Wrap=True)
crv_3 = Curve(flatten(item))
merge_2 = Merge(Data1=graft(crv), Data2=graft(crv_3))
boundary = BoundarySurfaces(Edges=merge_2)
neg_2 = Negative(Value=Slider(18, range=0..100))
swp1 = Sweep1(Rail=graft.PrimaryData, Sections=graft_2.PrimaryData, Miter=1)
Z_2 = UnitZ(Factor=expr("x/12", neg_2))
extr_2 = Extrude(Base=boundary, Direction=Z_2)
brep = Brep(flatten([swp1, cap, extr_2]))
materials = QueryMaterials()
graft_3 = GraftParallel(PrimaryData=brep)  # -> simplify(PrimaryData), SecondaryData1
item_2 = ListItem(List=materials, Index=78, Wrap=True)
geodshape = AddGeometryDirectShape(
    Name="Structural Footing Per LFA",
    Category=<geometry referenced from the Revit model>,
    Geometry=graft_3.PrimaryData,
    Material=item_2,
    TrackingMode=2)
