# Grasshopper definition BuildingElements_StructuralFramingBetweenTwoCurves.gh (Grasshopper 1.0.8)
# plug-ins: eleFront

pipeline = GeometryPipeline(
    GroupByLayer=False,
    GroupByType=False,
    IncludeHidden=True,
    IncludeLocked=True,
    LayerFilter="03_ARCH*03_FACADE",
    NameFilter="*",
    SublayerFiltering=True,
    TypeFilter=1073741848)
srf = Surface(graft(pipeline))
debrep = DeconstructBrep(Brep=srf)  # -> Faces, Edges, Vertices
item = ListItem(List=debrep.Edges, Index=0, Wrap=True)  # -> Item, Item1, Item2, Item3
flip = FlipCurve(Curve=item.Item3)  # -> Curve, Flag

# ---- group: Bottom Crv
bottom_curve = Curve(flip.Curve)

# ---- group: Top Crv
top_curve = Curve(item.Item1)

# ----
panel = Panel("TOP RAIL")
panel_2 = Panel("BOTTOM RAIL")
panel_3 = Panel("ORIENTING POINT")
panel_4 = Panel("CURVE PROFILE")
pt = ConstructPoint()
yz = YZPlane(Origin=Point(0, 0, 0))

# ---- group: Input - Curve A
crv = Curve(top_curve)

# ---- group: Input - Curve B
crv_2 = Curve(bottom_curve)

# ---- group: Input O.C spacing
number_slider = Slider(12, range=0..100)

# ---- group: Input - Framing Profile
crv_3 = Curve(<curve referenced from the Rhino model>)

# ---- group: Input - Point to orient from
pt_2 = Point(pt)

# ----
orient = Orient(Geometry=crv_3, Source=PlaneXY(0, 0, 0), Target=yz)  # -> Geometry, Transform
area = Area()  # -> Area, Centroid

end = EndPoints(Curve=crv_2)  # -> Start, End
edgesrf = EdgeSurface(CurveA=crv, CurveB=crv_2)
vec2pt = Vector2Pt(PointA=end.Start, PointB=end.End, Unitize=False)  # -> Vector, Length
vec = Vector(vec2pt.Vector)
pt_3 = Point(end.Start)
srf_2 = Surface(edgesrf)
contour = Contour(Shape=srf_2, Point=pt_3, Direction=vec, Distance=number_slider)
crv_4 = Curve(contour)
end_2 = EndPoints(Curve=crv_4)  # -> Start, End
ln = Line(StartPoint=end_2.Start, EndPoint=end_2.End)

# ---- group: Unclear if this connects to contour or the other Pt
pt_4 = Point(Point(-444, 4.636149242e-10, 158))

# ----
line = Line(ln)
end_3 = EndPoints(Curve=line)  # -> Start, End
pt_5 = Point(end_3.Start)
pcomp = PlaneComponents(Plane=pt_5)  # -> Origin, XAxis, YAxis, ZAxis
pcomp_2 = PlaneComponents(Plane=pt_2)  # -> Origin, XAxis, YAxis, ZAxis
pl = Plane(Origin=pcomp.Origin, XAxis=pcomp.XAxis, YAxis=expr("-x", pcomp.ZAxis))
pl_2 = Plane(Origin=pcomp_2.Origin, XAxis=pcomp_2.XAxis, YAxis=expr("-x", pcomp_2.ZAxis))
orient_2 = Orient(Geometry=orient.Geometry, Source=pl_2, Target=pl)  # -> Geometry, Transform
extrcrv = ExtrudeAlong(Base=orient_2.Geometry, Curve=line)
cap = CapHoles(Brep=extrcrv)

# ---- group: Output - Framing
brep = Brep(cap)

# ----
bake = BakeObjects(Geometry=brep, Bake=False, createGroups=False)  # -> Message, Guids
