# Grasshopper definition BuildingElements_StructuralFramingByCurve.gh (Grasshopper 1.0.8)
# plug-ins: CORE.Toolbox.Grasshopper

profile_selector = ProfileSelector(System=0, ShapeType=0)
profile_selector_2 = ProfileSelector(System=0, ShapeType=0)
panel = Panel(profile_selector)
panel_2 = Panel(profile_selector_2)
list_item = ListItem(List=profile_selector, Index=Slider(245, range=0..500), Wrap=True)
list_item_2 = ListItem(List=profile_selector_2, Index=Slider(266, range=0..500), Wrap=True)
curve = Curve([<curve referenced from the Rhino model> x3])
curve_2 = Curve([<curve referenced from the Rhino model> x3])
width = Slider(4, range=0..100)
length = Slider(4, range=0..100)
height = Slider(-8, range=-144..144)
sweep_profile = SweepProfile(
    OutputMesh=False,
    BeamRail=curve,
    SectionNameOrCurve=list_item,
    Justification=-1,
    Rotation=0,
    JustificationIndex=4,
    SectionNameIndex=191,
    ShapeTypeIndex=0,
    UnitTypeIndex=0)  # -> BrepsOrMeshes, SectionProfiles
sweep_profile_2 = SweepProfile(
    OutputMesh=False,
    BeamRail=curve_2,
    SectionNameOrCurve=list_item_2,
    Justification=-1,
    Rotation=0,
    JustificationIndex=4,
    SectionNameIndex=191,
    ShapeTypeIndex=0,
    UnitTypeIndex=0)  # -> BrepsOrMeshes, SectionProfiles
brep = Brep(sweep_profile.BrepsOrMeshes)
brep_2 = Brep(sweep_profile_2.BrepsOrMeshes)

# ---- group: By curve
crv = Curve(reparameterize(graft([<curve referenced from the Rhino model> x6])))

# ----
end_points = EndPoints(Curve=crv)  # -> Start, End
merge = Merge(Data1=end_points.Start, Data2=end_points.End)
curve_closest_point = CurveClosestPoint(Point=merge, Curve=crv)  # -> Point, Parameter, Distance

# ---- group: By curve (continued)
hframe = HorizontalFrame(Curve=crv, Parameter=curve_closest_point.Parameter)

# ----
createcolumn = GhPythonScript(point=merge, plane=hframe, width=width, length=length, height=height)  # -> column_profile; inputs point: Point3d, plane: Plane
# ---------- createcolumn: Python ----------
__author__ = "Iliya Muzychuk"
__version__ = "2023.02.03"

import rhinoscriptsyntax as rs
import Grasshopper as gh
import Rhino.Geometry as rg
import ghpythonlib.components as comps

#create profile function

def createSquare(point,width,length,plane):
    
    plane_rec = comps.PlaneOrigin(plane,point)

    width_domain = comps.ConstructDomain(-width/2,width/2)
    length_domain = comps.ConstructDomain(-length/2,length/2)
    
    rec = comps.Rectangle(plane_rec,width_domain,length_domain,0)
    rec = rec['rectangle']
    
    print(plane_rec)
    
    return rec

#extrusion function 

def createColumn(rec,height):
    
    vector = comps.UnitZ(height)
    brep = comps.Extrude(rec,vector)
    brep = comps.CapHoles(brep)
    
    return brep

column_profile = createSquare(point,width,length,plane)
# ---------- end createcolumn ----------
loft = Loft(Curves=createcolumn, Options={Adjust=False, Closed=False, LoftEnds=0, LoftSimp=0, LoftType=0, Rebuild=10, Refit=0.01})
cap_holes = CapHoles(Brep=loft)

brep_3 = Brep(cap_holes)
merge_2 = Merge(Data1=brep, Data2=brep_2, Data3=brep_3)
custom_preview = CustomPreview(Geometry=merge_2, Material=ColourSwatch(SwatchColor=RGB(192, 192, 192)))
