# Grasshopper definition BuildingElements_StructuralFramingBySurface 0.2.2.gh (Grasshopper 1.0.8)
# plug-ins: CORE.Toolbox.Grasshopper

beam_heights = Slider(1, range=0..10)
beam_width = Slider(1, range=0..10)

# ---- group: Input Surface
srf = Surface(<surface referenced from the Rhino model>)

# ----
spacing = Slider(53, range=0..100)
u_system = UnitSystem(UnitSystem=4)  # -> UnitSystem, Name, Meters

# ---- group: Unit checker & converter
rhunits = RhinoUnits(Refresh=Toggle(True))  # -> UnitName, UnitIndex
panel = Panel(u_system.UnitSystem)
python = GhPythonScript(units=u_system.UnitSystem)  # -> out
# ---------- python: Python ----------
__author__ = "ilouh"
__version__ = "2023.02.21"

import rhinoscriptsyntax as rs
import Grasshopper as gh
import Rhino.Geometry as rg
import ghpythonlib.components as comps
import math


if units == 'inches':
    out = 1

if units == 'feet':
    out = 12

if units == 'Meters':
    out = 10
# ---------- end python ----------

# ----
expression = Expression(x=beam_heights, d=python, Expression="x/d")
expression_2 = Expression(x=beam_width, d=python, Expression="x/d")
surfaceboundary = GhPythonScript(srf=srf, distance=expression, rimHeight=expression_2)  # -> rimGuide, internalFramingBoundary; inputs srf: Brep
# ---------- surfaceboundary: Python ----------
__author__ = "ilouh"
__version__ = "2023.02.21"

import rhinoscriptsyntax as rs
import Grasshopper as gh
import Rhino.Geometry as rg
import ghpythonlib.components as comps
import math


points = comps.DeconstructBrep(srf)['vertices']

boundary = comps.PolyLine(points,True)

def offsetInwards(crv,distance):
    
    offset_1 = comps.OffsetCurve(crv,distance,corners = 1)
    offset_2 = comps.OffsetCurve(crv,-distance,corners = 1)
    
    if comps.Length(offset_1) > comps.Length(offset_2): 
        return offset_2
    
    else:
        return offset_1
        

def createRimGuide(crv,distance,rimHeight):
    
    offset_1 = comps.OffsetCurve(crv,distance,corners = 1)
    offset_2 = comps.OffsetCurve(crv,-distance,corners = 1)
    
    print(offset_1)
    
    if comps.Length(offset_1) > comps.Length(offset_2): 
        srf = comps.BoundarySurfaces([crv,offset_2])
        point = comps.ConstructPoint(0.5,0.5,0)
        normal = comps.EvaluateSurface(srf,point)['normal']
        brep = comps.Extrude(srf,comps.Amplitude(normal,rimHeight))
        brep = comps.Move(brep,comps.Amplitude(normal,-rimHeight/2))['geometry']
        return brep

    
    else:
        srf =  comps.BoundarySurfaces([crv,offset_1])
        point = comps.ConstructPoint(0.5,0.5,0)
        normal = comps.EvaluateSurface(srf,point)['normal']
        brep = comps.Extrude(srf,comps.Amplitude(normal,rimHeight))
        brep = comps.Move(brep,comps.Amplitude(normal,-rimHeight/2))['geometry']
        return brep


internalFramingBoundary = offsetInwards(boundary,distance)
rimGuide = createRimGuide(boundary,distance,rimHeight)
# ---------- end surfaceboundary ----------
crv = Curve()

boundary = BoundarySurfaces(Edges=surfaceboundary.internalFramingBoundary)
srf_2 = Surface(boundary)

# ---- group: Toggle Directions
direction = BooleanToggle(False)

# ----
createframinglines = GhPythonScript(srf=srf_2, direction=direction, distance=Slider(2, range=0..100))  # -> framing_lines; inputs srf: Surface
# ---------- createframinglines: Python ----------
__author__ = "ilouh"
__version__ = "2023.02.21"

import rhinoscriptsyntax as rs
import Grasshopper as gh
import Rhino.Geometry as rg
import ghpythonlib.components as comps
import math


untrim_sruface = comps.Untrim(srf)



def framing (crvs,distance):
    
    crv_01 = crvs[0]
    crv_02 = comps.FlipCurve(crvs[1])['curve']

    points_01 = comps.DivideDistance(crv_01,distance)['points']
    points_02 = comps.DivideDistance(crv_02,distance)['points']
   
    zipped_points = list(zip(points_01,points_02))
    
    framing_members = []
    
    for pair in zipped_points:
        
        line = comps.Line(pair[0],pair[1])
        framing_members.append(line)
        
    
    return framing_members


edges = comps.DeconstructBrep(untrim_sruface)['edges']
edge_lengths = comps.Length(edges)

sorted_list = list(zip(edges,edge_lengths))
sorted_list = sorted(sorted_list, key = lambda x: x[1])

crvs, lengths = zip(*sorted_list)

shortest_crvs = [crvs[0],crvs[1]]
longest_crvs = [crvs[2],crvs[3]]


if direction:
    
    framing_lines = framing(shortest_crvs,distance)

else: 
    
    framing_lines = framing(longest_crvs,distance)
# ---------- end createframinglines ----------

scx = SurfaceCurve(Surface=srf_2, Curve=createframinglines)  # -> Curves, Points, UVPoints, Normals, Parameters, Tangents
pframe = PerpFrame(Curve=reparameterize(scx.Curves), Parameter=[0, 1])

expression_3 = Expression(x=Slider(7, range=0..20), d=python, Expression="x/d")
expression_4 = Expression(x=Slider(3, range=0..10), d=python, Expression="x/d")
createframe = GhPythonScript(x=expression_3, y=expression_4, plane=pframe)  # -> rec
# ---------- createframe: Python ----------
__author__ = "ilouh"
__version__ = "2023.02.21"

import rhinoscriptsyntax as rs
import Grasshopper as gh
import Rhino.Geometry as rg
import ghpythonlib.components as comps
import math

def profie(x,y,plane):
    
    x_domain = comps.ConstructDomain(-x/2,x/2)
    y_domain = comps.ConstructDomain(-y/2,y/2)
    
    rec = comps.Rectangle(plane,x_domain,y_domain,radius = 0)
    
    return rec['rectangle']

rec = profie(x,y,plane)
print(rec)
# ---------- end createframe ----------
expression_5 = Expression(joist_height=expression_3, Expression="-(joist_height/2) - floor_thickness ")

loft = Loft(Curves=createframe, Options={Adjust=False, Closed=False, LoftEnds=0, LoftSimp=0, LoftType=0, Rebuild=10, Refit=0.01})
cap = CapHoles(Brep=loft)

# ---- group: Output - Framing
joists = Brep(cap)

# ----
Z = UnitZ(Factor=expression_5)
move = Move(Geometry=joists, Motion=Z)  # -> Geometry, Transform

rim = Brep(surfaceboundary.rimGuide)
merge = Merge()
