# Grasshopper definition BuildingElements_StructuralFramingBySurface 0.2.3.gh (Grasshopper 1.0.8)

curve = Curve(graft(<curve referenced from the Rhino model>))
direction = BooleanToggle(False)
spacing = Slider(1, range=0..100)
height = Slider(4, range=0..20)
width = Slider(0.75, range=0..10)
direction_2 = BooleanToggle(True)
spacing_2 = Slider(1.5, range=0..100)
height_2 = Slider(8, range=0..20)
width_2 = Slider(1.25, range=0..10)
boundary_surfaces = BoundarySurfaces(Edges=curve)

# ---- group: Input Surface
srf = Surface(boundary_surfaces)

# ----
number_slider = Slider(0.094, range=0..0.1)
Z = UnitZ(Factor=expr("-x", number_slider))
extr = Extrude(Base=curve, Direction=Z)
cap = CapHoles(Brep=extr)

edge_trim_width = Slider(2, range=0..10)
edge_trim_height = Slider(1.5, range=0..10)

edge_trim_height_2 = Slider(1, range=0..10)
edge_trim_width_2 = Slider(1, range=0..10)

u_system = UnitSystem(UnitSystem=4)  # -> UnitSystem, Name, Meters
python = GhPythonScript(units=u_system.UnitSystem)  # -> out
# ---------- python: Python ----------
__author__ = "ilouh"
__version__ = "2023.02.21"

import rhinoscriptsyntax as rs
import Grasshopper as gh
import Rhino.Geometry as rg
import ghpythonlib.components as comps
import math


if units == 'inches':
    out = 1

if units == 'feet':
    out = 12

if units == 'Meters':
    out = 10
# ---------- end python ----------
expression = Expression(x=height, d=python, Expression="x/d")
expression_2 = Expression(x=width, d=python, Expression="x/d")

expression_3 = Expression(x=edge_trim_height, d=python, Expression="x/d")
expression_4 = Expression(x=edge_trim_width, d=python, Expression="x/d")

expression_5 = Expression(joist_height=expression, floor_thickness=number_slider, Expression="-(joist_height/2) - floor_thickness ")
expression_6 = Expression(joist_height=expression, floor_thickness=number_slider, Expression="-(joist_height + floor_thickness)")
Z_2 = UnitZ(Factor=expression_5)
Z_3 = UnitZ(Factor=expression_6)
move = Move(Geometry=curve, Motion=Z_3)  # -> Geometry, Transform
curve_2 = Curve(graft(move.Geometry))
boundary_surfaces_2 = BoundarySurfaces(Edges=curve_2)

# ---- group: Input Surface
srf_2 = Surface(boundary_surfaces_2)

# ----
surfaceboundary = GhPythonScript(srf=srf, distance=expression_3, rimHeight=expression_4)  # -> rimGuide, internalFramingBoundary; inputs srf: Brep
# ---------- surfaceboundary: Python ----------
__author__ = "ilouh"
__version__ = "2023.02.21"

import rhinoscriptsyntax as rs
import Grasshopper as gh
import Rhino.Geometry as rg
import ghpythonlib.components as comps
import math


points = comps.DeconstructBrep(srf)['vertices']

boundary = comps.PolyLine(points,True)

def offsetInwards(crv,distance):
    
    offset_1 = comps.OffsetCurve(crv,distance,corners = 1)
    offset_2 = comps.OffsetCurve(crv,-distance,corners = 1)
    
    if comps.Length(offset_1) > comps.Length(offset_2): 
        return offset_2
    
    else:
        return offset_1
        

def createRimGuide(crv,distance,rimHeight):
    
    offset_1 = comps.OffsetCurve(crv,distance,corners = 1)
    offset_2 = comps.OffsetCurve(crv,-distance,corners = 1)
    
    if comps.Length(offset_1) > comps.Length(offset_2): 
        srf = comps.BoundarySurfaces([crv,offset_2])
        point = comps.ConstructPoint(0.5,0.5,0)
        normal = comps.EvaluateSurface(srf,point)['normal']
        brep = comps.Extrude(srf,comps.Amplitude(normal,rimHeight))
        brep = comps.Move(brep,comps.Amplitude(normal,-rimHeight/2))['geometry']
        return brep

    
    else:
        srf =  comps.BoundarySurfaces([crv,offset_1])
        point = comps.ConstructPoint(0.5,0.5,0)
        normal = comps.EvaluateSurface(srf,point)['normal']
        brep = comps.Extrude(srf,comps.Amplitude(normal,rimHeight))
        brep = comps.Move(brep,comps.Amplitude(normal,-rimHeight/2))['geometry']
        return brep

internalFramingBoundary = offsetInwards(boundary,distance)
if rimHeight > 0:
    
    rimGuide = createRimGuide(boundary,distance,rimHeight)
# ---------- end surfaceboundary ----------

boundary = BoundarySurfaces(Edges=surfaceboundary.internalFramingBoundary)
srf_3 = Surface(boundary)

u_system_2 = UnitSystem(UnitSystem=4)  # -> UnitSystem, Name, Meters
srf_4 = Surface(srf_2)
python_2 = GhPythonScript(units=u_system_2.UnitSystem)  # -> out; same code as python
createframinglines = GhPythonScript(srf=srf_4, direction=direction_2, distance=spacing_2)  # -> framing_lines; inputs srf: Surface
# ---------- createframinglines: Python ----------
__author__ = "ilouh"
__version__ = "2023.02.21"

import rhinoscriptsyntax as rs
import Grasshopper as gh
import Rhino.Geometry as rg
import ghpythonlib.components as comps
import math


untrim_sruface = comps.Untrim(srf)



def framing (crvs,distance):
    
    crv_01 = crvs[0]
    crv_02 = comps.FlipCurve(crvs[1])['curve']
    
    spacing = comps.Length(crv_01)/distance
    
    points_01 = comps.DivideCurve(crv_01,spacing,False)['points']
    points_02 = comps.DivideCurve(crv_02,spacing,False)['points']

    zipped_points = list(zip(points_01,points_02))
    
    framing_members = []
    
    for pair in zipped_points:
        
        line = comps.Line(pair[0],pair[1])
        framing_members.append(line)
        
    
    return framing_members


edges = comps.DeconstructBrep(untrim_sruface)['edges']
edge_lengths = comps.Length(edges)

sorted_list = list(zip(edges,edge_lengths))
sorted_list = sorted(sorted_list, key = lambda x: x[1])

crvs, lengths = zip(*sorted_list)

shortest_crvs = [crvs[0],crvs[1]]
longest_crvs = [crvs[2],crvs[3]]


if direction:
    
    framing_lines = framing(shortest_crvs,distance)

else: 
    
    framing_lines = framing(longest_crvs,distance)
# ---------- end createframinglines ----------
expression_7 = Expression(x=height_2, d=python_2, Expression="x/d")
expression_8 = Expression(x=width_2, d=python_2, Expression="x/d")

expression_9 = Expression(x=edge_trim_height_2, d=python_2, Expression="x/d")
expression_10 = Expression(x=edge_trim_width_2, d=python_2, Expression="x/d")

scx = SurfaceCurve(Surface=srf_4, Curve=createframinglines)  # -> Curves, Points, UVPoints, Normals, Parameters, Tangents
pframe = PerpFrame(Curve=reparameterize(scx.Curves), Parameter=[0, 1])

createframe = GhPythonScript(x=expression_7, y=expression_8, plane=pframe)  # -> rec
# ---------- createframe: Python ----------
__author__ = "ilouh"
__version__ = "2023.02.21"

import rhinoscriptsyntax as rs
import Grasshopper as gh
import Rhino.Geometry as rg
import ghpythonlib.components as comps
import math

def profie(x,y,plane):
    
    x_domain = comps.ConstructDomain(-x/2,x/2)
    y_domain = comps.ConstructDomain(-y/2,y/2)
    
    rec = comps.Rectangle(plane,x_domain,y_domain,radius = 0)
    
    return rec['rectangle']

rec = profie(x,y,plane)
print(rec)
# ---------- end createframe ----------

expression_11 = Expression(joist_height=expression_7, Expression="-(joist_height/2)")

loft = Loft(Curves=createframe, Options={Adjust=False, Closed=False, LoftEnds=0, LoftSimp=0, LoftType=0, Rebuild=10, Refit=0.01})
cap_2 = CapHoles(Brep=loft)

# ---- group: Output - Framing
joists = Brep(cap_2)

# ----
Z_4 = UnitZ(Factor=expression_11)
move_2 = Move(Geometry=joists, Motion=Z_4)  # -> Geometry, Transform
item = ListItem(List=flatten(move_2.Geometry), Index=0, Wrap=True)  # -> Item2, Item1, Item, Item1_2
merge = Merge(Data1=item.Item2, Data2=item.Item1_2)
merge_2 = Merge(Data1=merge)
group = Group(Objects=merge_2)

createframinglines_2 = GhPythonScript(srf=srf_3, direction=direction, distance=spacing)  # -> framing_lines; inputs srf: Surface; same code as createframinglines

scx_2 = SurfaceCurve(Surface=srf_3, Curve=createframinglines_2)  # -> Curves, Points, UVPoints, Normals, Parameters, Tangents
pframe_2 = PerpFrame(Curve=reparameterize(scx_2.Curves), Parameter=[0, 1])

createframe_2 = GhPythonScript(x=expression, y=expression_2, plane=pframe_2)  # -> rec; same code as createframe

loft_2 = Loft(Curves=createframe_2, Options={Adjust=False, Closed=False, LoftEnds=0, LoftSimp=0, LoftType=0, Rebuild=10, Refit=0.01})
cap_3 = CapHoles(Brep=loft_2)

# ---- group: Output - Framing
joists_2 = Brep(cap_3)

# ----
move_3 = Move(Geometry=joists_2, Motion=Z_2)  # -> Geometry, Transform

rim = Brep(surfaceboundary.rimGuide)
merge_3 = Merge(Data1=move_3.Geometry, Data2=cap)

group_2 = Group(Objects=merge_3)
merge_4 = Merge(Data1=group_2, Data2=group)
