# Grasshopper definition BuildingElements_StructuralFramingBySurface 0.2.4.gh (Grasshopper 1.0.8)

direction = BooleanToggle(False)  # disabled
spacing = Slider(1.5, range=0..100)  # disabled
height = Slider(8, range=0..20)  # disabled
width = Slider(1.5, range=0..10)  # disabled
direction_2 = BooleanToggle(True)  # disabled
spacing_2 = Slider(1.5, range=0..100)  # disabled
height_2 = Slider(8, range=0..20)  # disabled
width_2 = Slider(1.25, range=0..10)  # disabled
direction_3 = BooleanToggle(False)
spacing_3 = Slider(1.5, range=0..100)
height_3 = Slider(8, range=0..20)
width_3 = Slider(1.5, range=0..10)

# ---- group: Input Surface
srf = Surface(graft(<surface referenced from the Rhino model>))  # disabled

srf_2 = Surface(graft(<surface referenced from the Rhino model>))

# ----
u_system = UnitSystem(UnitSystem=4)  # -> UnitSystem, Name, Meters
python = GhPythonScript(units=u_system.UnitSystem)  # -> out
# ---------- python: Python ----------
__author__ = "ilouh"
__version__ = "2023.02.21"

import rhinoscriptsyntax as rs
import Grasshopper as gh
import Rhino.Geometry as rg
import ghpythonlib.components as comps
import math


if units == 'inches':
    out = 1

if units == 'feet':
    out = 12

if units == 'Meters':
    out = 10
# ---------- end python ----------

edge_trim_width = Slider(2, range=0..10)
edge_trim_height = Slider(1.5, range=0..10)
expression = Expression(x=edge_trim_height, d=python, Expression="x/d")
expression_2 = Expression(x=edge_trim_width, d=python, Expression="x/d")

u_system_2 = UnitSystem(UnitSystem=4)  # -> UnitSystem, Name, Meters; disabled
python_2 = GhPythonScript(units=u_system_2.UnitSystem)  # -> out; disabled; same code as python

edge_trim_width_2 = Slider(2, range=0..10)  # disabled
edge_trim_height_2 = Slider(1.5, range=0..10)  # disabled
expression_3 = Expression(x=edge_trim_height_2, d=python_2, Expression="x/d")  # disabled
expression_4 = Expression(x=edge_trim_width_2, d=python_2, Expression="x/d")  # disabled

createframinglines = GhPythonScript(srf=srf, direction=direction, distance=spacing)  # -> framing_lines; inputs srf: Surface; disabled
# ---------- createframinglines: Python ----------
__author__ = "ilouh"
__version__ = "2023.02.21"

import rhinoscriptsyntax as rs
import Grasshopper as gh
import Rhino.Geometry as rg
import ghpythonlib.components as comps
import math


untrim_sruface = comps.Untrim(srf)



def framing (crvs,distance):
    
    crv_01 = crvs[0]
    crv_02 = comps.FlipCurve(crvs[1])['curve']
    
    spacing = comps.Length(crv_01)/distance
    
    points_01 = comps.DivideCurve(crv_01,spacing,False)['points']
    points_02 = comps.DivideCurve(crv_02,spacing,False)['points']

    zipped_points = list(zip(points_01,points_02))
    
    framing_members = []
    
    for pair in zipped_points:
        
        line = comps.Line(pair[0],pair[1])
        framing_members.append(line)
        
    
    return framing_members


edges = comps.DeconstructBrep(untrim_sruface)['edges']
edge_lengths = comps.Length(edges)

sorted_list = list(zip(edges,edge_lengths))
sorted_list = sorted(sorted_list, key = lambda x: x[1])

crvs, lengths = zip(*sorted_list)

shortest_crvs = [crvs[0],crvs[1]]
longest_crvs = [crvs[2],crvs[3]]


if direction:
    
    framing_lines = framing(shortest_crvs,distance)

else: 
    
    framing_lines = framing(longest_crvs,distance)
# ---------- end createframinglines ----------
createframinglines_2 = GhPythonScript(srf=srf_2, direction=direction_3, distance=spacing_3)  # -> framing_lines; inputs srf: Surface; same code as createframinglines
pipeline = GeometryPipeline(
    GroupByLayer=False,
    GroupByType=False,
    IncludeHidden=True,
    IncludeLocked=True,
    LayerFilter="*beams",
    NameFilter="*",
    SublayerFiltering=True,
    TypeFilter=4)
crv = Curve(graft(<curve referenced from the Rhino model>))
height_4 = Slider(8, range=0..20)

scx = SurfaceCurve(Surface=srf_2, Curve=createframinglines_2)  # -> Curves, Points, UVPoints, Normals, Parameters, Tangents
expression_5 = Expression(x=height_3, d=python, Expression="-x/d")
Z = UnitZ(Factor=expression_5)
move = Move(Geometry=scx.Curves, Motion=Z)  # -> Geometry, Transform
end = EndPoints(Curve=move.Geometry)  # -> Start, End
end_2 = EndPoints(Curve=scx.Curves)  # -> Start, End
expression_6 = Expression(x=width_3, d=python, Expression="(x/d)/2")
expression_7 = Expression(x=width_3, d=python, Expression="-(x/d)/2")
srf4pt = _4PointSurface(CornerA=end_2.Start, CornerB=end_2.End, CornerC=end.End, CornerD=end.Start)
offset = OffsetSurface(Surface=srf4pt, Distance=expression_6, Retrim=True)
offset_2 = OffsetSurface(Surface=srf4pt, Distance=expression_7, Retrim=True)
merge = Merge(Data1=offset, Data2=offset_2)
loft = Loft(Curves=merge, Options={Adjust=False, Closed=False, LoftEnds=0, LoftSimp=0, LoftType=0, Rebuild=10, Refit=0.01})

scx_2 = SurfaceCurve(Surface=srf, Curve=createframinglines)  # -> Curves, Points, UVPoints, Normals, Parameters, Tangents; disabled
pframe = PerpFrame(Curve=reparameterize(scx_2.Curves), Parameter=[0, 1])  # disabled

height_5 = Slider(4, range=0..20)
expression_8 = Expression(x=height, d=python_2, Expression="x/d")  # disabled
expression_9 = Expression(x=width, d=python_2, Expression="x/d")  # disabled
expression_10 = Expression(x=height_4, d=python, Expression="-x/d")
Z_2 = UnitZ(Factor=expression_10)

number_slider = Slider(0.094, range=0..0.1)  # disabled
Z_3 = UnitZ(Factor=expr("-x", number_slider))  # disabled
extr = Extrude(Direction=Z_3)  # disabled
cap = CapHoles(Brep=extr)  # disabled

number_slider_2 = Slider(0.094, range=0..0.1)
createframe = GhPythonScript(x=expression_8, y=expression_9, plane=pframe)  # -> rec; disabled
# ---------- createframe: Python ----------
__author__ = "ilouh"
__version__ = "2023.02.21"

import rhinoscriptsyntax as rs
import Grasshopper as gh
import Rhino.Geometry as rg
import ghpythonlib.components as comps
import math

def profie(x,y,plane):
    
    x_domain = comps.ConstructDomain(-x/2,x/2)
    y_domain = comps.ConstructDomain(-y/2,y/2)
    
    rec = comps.Rectangle(plane,x_domain,y_domain,radius = 0)
    
    return rec['rectangle']

rec = profie(x,y,plane)
print(rec)
# ---------- end createframe ----------
move_2 = Move(Geometry=crv, Motion=Z_2)  # -> Geometry, Transform
end_3 = EndPoints(Curve=move_2.Geometry)  # -> Start, End
end_4 = EndPoints(Curve=crv)  # -> Start, End
expression_11 = Expression(x=height_5, d=python, Expression="(x/d)/2")
expression_12 = Expression(x=height_5, d=python, Expression="-(x/d)/2")
expression_13 = Expression(joist_height=expression_8, floor_thickness=number_slider, Expression="-(joist_height/2) - floor_thickness ")  # disabled
expression_14 = Expression(joist_height=expression_8, floor_thickness=number_slider, Expression="-(joist_height + floor_thickness)")  # disabled
srf4pt_2 = _4PointSurface(CornerA=end_4.Start, CornerB=end_4.End, CornerC=end_3.End, CornerD=end_3.Start)
offset_3 = OffsetSurface(Surface=srf4pt_2, Distance=expression_11, Retrim=True)
offset_4 = OffsetSurface(Surface=srf4pt_2, Distance=expression_12, Retrim=True)
merge_2 = Merge(Data1=offset_3, Data2=offset_4)
loft_2 = Loft(Curves=merge_2, Options={Adjust=False, Closed=False, LoftEnds=0, LoftSimp=0, LoftType=0, Rebuild=10, Refit=0.01})
cap_2 = CapHoles(Brep=loft)
cap_3 = CapHoles(Brep=loft_2)

loft_3 = Loft(Curves=createframe, Options={Adjust=False, Closed=False, LoftEnds=0, LoftSimp=0, LoftType=0, Rebuild=10, Refit=0.01})  # disabled
cap_4 = CapHoles(Brep=loft_3)  # disabled

# ---- group: Output - Framing
joists = Brep(cap_4)  # disabled

# ----
Z_4 = UnitZ(Factor=expression_13)  # disabled
Z_5 = UnitZ(Factor=expression_14)  # disabled
move_3 = Move(Geometry=joists, Motion=Z_4)  # -> Geometry, Transform; disabled

rim = Brep()  # disabled
merge_3 = Merge(Data1=move_3.Geometry, Data2=cap)  # disabled

move_4 = Move(Motion=Z_5)  # -> Geometry, Transform; disabled
curve = Curve(graft(move_4.Geometry))  # disabled
boundary_surfaces = BoundarySurfaces(Edges=curve)  # disabled

# ---- group: Input Surface
srf_3 = Surface(boundary_surfaces)  # disabled

# ----
group = Group(Objects=merge_3)  # disabled

edge_trim_height_3 = Slider(1, range=0..10)  # disabled
edge_trim_width_3 = Slider(1, range=0..10)  # disabled

u_system_3 = UnitSystem(UnitSystem=4)  # -> UnitSystem, Name, Meters; disabled
srf_4 = Surface(srf_3)  # disabled
python_3 = GhPythonScript(units=u_system_3.UnitSystem)  # -> out; disabled; same code as python
createframinglines_3 = GhPythonScript(srf=srf_4, direction=direction_2, distance=spacing_2)  # -> framing_lines; inputs srf: Surface; disabled; same code as createframinglines
expression_15 = Expression(x=height_2, d=python_3, Expression="x/d")  # disabled
expression_16 = Expression(x=width_2, d=python_3, Expression="x/d")  # disabled

expression_17 = Expression(x=edge_trim_height_3, d=python_3, Expression="x/d")  # disabled
expression_18 = Expression(x=edge_trim_width_3, d=python_3, Expression="x/d")  # disabled

scx_3 = SurfaceCurve(Surface=srf_4, Curve=createframinglines_3)  # -> Curves, Points, UVPoints, Normals, Parameters, Tangents; disabled
pframe_2 = PerpFrame(Curve=reparameterize(scx_3.Curves), Parameter=[0, 1])  # disabled

createframe_2 = GhPythonScript(x=expression_15, y=expression_16, plane=pframe_2)  # -> rec; disabled; same code as createframe

expression_19 = Expression(joist_height=expression_15, Expression="-(joist_height/2)")  # disabled

loft_4 = Loft(Curves=createframe_2, Options={Adjust=False, Closed=False, LoftEnds=0, LoftSimp=0, LoftType=0, Rebuild=10, Refit=0.01})  # disabled
cap_5 = CapHoles(Brep=loft_4)  # disabled

# ---- group: Output - Framing
joists_2 = Brep(cap_5)  # disabled

# ----
Z_6 = UnitZ(Factor=expression_19)  # disabled
move_5 = Move(Geometry=joists_2, Motion=Z_6)  # -> Geometry, Transform; disabled
item = ListItem(List=flatten(move_5.Geometry), Index=0, Wrap=True)  # -> Item2, Item1, Item, Item1_2; disabled
merge_4 = Merge(Data1=item.Item2, Data2=item.Item1_2)  # disabled
merge_5 = Merge(Data1=merge_4)  # disabled
group_2 = Group(Objects=merge_5)  # disabled
merge_6 = Merge(Data1=group, Data2=group_2)  # disabled
