# Grasshopper definition BuildingElements_StructuralFramingBySurface 0.2.5.gh (Grasshopper 1.0.8)

curve = Curve(<curve referenced from the Rhino model>)
boundary_surfaces = BoundarySurfaces(Edges=curve)

# ---- group: Input Surface
srf = Surface(reparameterize(graft(boundary_surfaces)))

# ----
direction = BooleanToggle(False)
spacing = Slider(14, range=0..100)
height = Slider(13, range=-20..20)
width = Slider(2.5, range=-10..10)
md_slider = MDSlider(SliderMode=0, slider_value=Point(0.5, 0.5, 0.5), x_domain=Domain(0, 1), y_domain=Domain(0, 1), z_domain=Domain(0, 1))
createframinglines = GhPythonScript(srf=srf, direction=direction, distance=spacing)  # -> framing_lines; inputs srf: Surface
# ---------- createframinglines: Python ----------
__author__ = "ilouh"
__version__ = "2023.02.21"

import rhinoscriptsyntax as rs
import Grasshopper as gh
import Rhino.Geometry as rg
import ghpythonlib.components as comps
import math


untrim_sruface = comps.Untrim(srf)



def framing (crvs,distance):
    
    crv_01 = crvs[0]
    crv_02 = comps.FlipCurve(crvs[1])['curve']
    
    spacing = comps.Length(crv_01)/distance
    
    points_01 = comps.DivideCurve(crv_01,spacing,False)['points']
    points_02 = comps.DivideCurve(crv_02,spacing,False)['points']

    zipped_points = list(zip(points_01,points_02))
    
    framing_members = []
    
    for pair in zipped_points:
        
        line = comps.Line(pair[0],pair[1])
        framing_members.append(line)
        
    
    return framing_members


edges = comps.DeconstructBrep(untrim_sruface)['edges']
edge_lengths = comps.Length(edges)

sorted_list = list(zip(edges,edge_lengths))
sorted_list = sorted(sorted_list, key = lambda x: x[1])

crvs, lengths = zip(*sorted_list)

shortest_crvs = [crvs[0],crvs[1]]
longest_crvs = [crvs[2],crvs[3]]


if direction:
    
    framing_lines = framing(shortest_crvs,distance)

else: 
    
    framing_lines = framing(longest_crvs,distance)
# ---------- end createframinglines ----------
evalsrf = EvaluateSurface(Surface=reparameterize(srf), Point=md_slider)  # -> Point, Normal, UDirection, VDirection, Frame

scx = SurfaceCurve(Surface=srf, Curve=createframinglines)  # -> Curves, Points, UVPoints, Normals, Parameters, Tangents

amp = Amplitude(Vector=evalsrf.Normal, Amplitude=height)
amp_2 = Amplitude(Vector=evalsrf.UDirection, Amplitude=width)
extr = Extrude(Base=scx.Curves, Direction=amp)
extr_2 = Extrude(Base=extr, Direction=amp_2)  # -> flatten(Extrusion)
group = Group(Objects=extr_2)
