# Grasshopper definition BuildingElements_TrussFromLowerUpperChords.gh (Grasshopper 1.0.7)

top_chord = Curve(reverse(graft(<curve referenced from the Rhino model>)))
bottom_chord = Curve(reverse(graft(<curve referenced from the Rhino model>)))
no_diagnals = Slider(8, range=0..100)
flip = FlipCurve(Curve=top_chord)  # -> Curve, Flag
flip_2 = FlipCurve(Curve=bottom_chord)  # -> Curve, Flag

number_slider = Slider(1, range=0..1)
divide = DivideCurve(Curve=flip.Curve, Count=no_diagnals, Kinks=False)  # -> Points, Tangents, Parameters
divide_2 = DivideCurve(Curve=flip_2.Curve, Count=no_diagnals, Kinks=False)  # -> Points, Tangents, Parameters
shift = ShiftList(List=divide.Points, Shift=number_slider, Wrap=False)
shift_2 = ShiftList(List=divide_2.Points, Shift=number_slider, Wrap=False)
srf4pt = _4PointSurface(CornerA=divide.Points, CornerB=shift, CornerC=shift_2, CornerD=divide_2.Points)

python = GhPythonScript(srfs=srf4pt)  # -> srf_a, srf_b; inputs srfs: list
# ---------- python: Python ----------
__author__ = "ilouh"
__version__ = "2022.06.14"

import rhinoscriptsyntax as rs

Truss_strings = []

li_length = len(srfs)
half_point = int(round(li_length/2,0))-1

srf_a = srfs[:half_point]
srf_b = srfs[half_point:]


#Truss_strings.append(crvs_a)
#Truss_strings.append(crvs_b)
# ---------- end python ----------

srf = Surface(python.srf_b)
srf_2 = Surface(python.srf_a)
debrep = DeconstructBrep(Brep=srf)  # -> Faces, Edges, Vertices
debrep_2 = DeconstructBrep(Brep=srf_2)  # -> Faces, Edges, Vertices
item = ListItem(List=debrep_2.Vertices, Index=0, Wrap=True)  # -> Item, Item1, Item2, Item3
item_2 = ListItem(List=debrep.Vertices, Index=0, Wrap=True)  # -> Item, Item1, Item2, Item3

ln = Line(StartPoint=item_2.Item, EndPoint=item_2.Item2)
ln_2 = Line(StartPoint=item.Item1, EndPoint=item.Item3)
ln_3 = Line(StartPoint=divide.Points, EndPoint=divide_2.Points)
merge = Merge(Data1=flatten(ln_2), Data2=ln_3, Data3=flatten(ln))
crv = Curve(merge)
