# Grasshopper definition BuildingElements_VerticalTrussStructure.gh (Grasshopper 1.0.7)
# plug-ins: MetaHopper, Human

division_of_truss = Slider(4, range=0..100)
bake_edges = BooleanToggle(True)
bake_diagonals = BooleanToggle(True)
left_chord = Curve(graft(<curve referenced from the Rhino model>))
right_chord = Curve(graft(<curve referenced from the Rhino model>))
createatts = CreateAttributes(LayerName="VERTICAL TRUSSES", GroupIndices="1", enableFullPath=False)
createatts_2 = CreateAttributes(LayerName="VERTICAL TRUSSES", GroupIndices="1", enableFullPath=False)
bake = BakeObject(ObjectAttributes=createatts, Bake=bake_edges, AllObjects_Object=pipeedges)
bake_2 = BakeObject(ObjectAttributes=createatts_2, Bake=bake_diagonals, AllObjects_Object=pipediagonals_top_bottom)
divide = DivideCurve(Curve=left_chord, Count=division_of_truss, Kinks=False)  # -> Points, Tangents, Parameters
divide_2 = DivideCurve(Curve=right_chord, Count=division_of_truss, Kinks=False)  # -> Points, Tangents, Parameters
end = EndPoints(Curve=right_chord)  # -> Start, End
end_2 = EndPoints(Curve=left_chord)  # -> Start, End
cull = CullPattern(List=divide_2.Points, CullPattern=[True, False])
cull_2 = CullPattern(List=divide.Points, CullPattern=[False, True])
starttostart = Line(StartPoint=end_2.Start, EndPoint=end.Start)
endtoend = Line(StartPoint=end_2.End, EndPoint=end.End)
weave = Weave(Pattern=[0, 1], Stream0=cull, Stream1=cull_2, NullGaps=False)
pline = PolyLine(Vertices=weave, Closed=False)
number_slider = Slider(0.15, range=0..1)
pipediagonals_top_bottom = Pipe(Curve=[endtoend, starttostart, pline], Radius=number_slider, Caps="1")
pipeedges = Pipe(Curve=[left_chord, right_chord], Radius=number_slider, Caps="1")
