# Grasshopper definition BuildingElements_WallPanelsByCurves.gh (Grasshopper 1.0.7)

input_curve = Curve([<curve referenced from the Rhino model> x5])
panel_seam_dimension = Slider(0.1, range=0..0.1)
panel_depth = Slider(0.2, range=0..1)
wall_depth = Slider(3.1, range=0..6)
wallpanel = GhPythonScript(curve=input_curve, seamDimension=panel_seam_dimension, panelDepth=panel_depth, wallDepth=wall_depth)  # -> wallPanel, wallBacking; inputs curve: Curve
# ---------- wallpanel: Python ----------
__author__ = "ilouh"
__version__ = "2023.02.21"

import rhinoscriptsyntax as rs
import Grasshopper as gh
import Rhino.Geometry as rg
import ghpythonlib.components as comps
import math

def createWallBacking(crv,depth):
    
    srf = comps.BoundarySurfaces(crv)
    point = comps.ConstructPoint(0.5,0.5,0)
    normal = comps.EvaluateSurface(srf,point)['normal']
    brep = comps.Extrude(srf,comps.Amplitude(normal,-depth))
    return brep

def createFrame(crv,distance,frameDepth):
    
    offset_1 = comps.OffsetCurve(crv,distance,corners = 1)
    offset_2 = comps.OffsetCurve(crv,-distance,corners = 1)
    
    if comps.Length(offset_1) > comps.Length(offset_2): 
        srf = comps.BoundarySurfaces(offset_2)
        point = comps.ConstructPoint(0.5,0.5,0)
        normal = comps.EvaluateSurface(srf,point)['normal']
        brep = comps.Extrude(srf,comps.Amplitude(normal,frameDepth))
        return brep

    
    else:
        srf = comps.BoundarySurfaces(offset_2)
        point = comps.ConstructPoint(0.5,0.5,0)
        normal = comps.EvaluateSurface(srf,point)['normal']
        brep = comps.Extrude(srf,comps.Amplitude(normal,frameDepth))
        return brep


wallPanel = createFrame(curve,seamDimension,panelDepth)
wallBacking = createWallBacking(curve,wallDepth)
# ---------- end wallpanel ----------
brep = Brep(wallpanel.wallPanel)
brep_2 = Brep(wallpanel.wallBacking)
preview = CustomPreview(Geometry=brep, Material=ColourSwatch(SwatchColor=RGB(156, 158, 41)))
preview_2 = CustomPreview(Geometry=brep_2, Material=ColourSwatch(SwatchColor=RGB(68, 216, 255)))
