# Grasshopper definition BuildingElements_Walls By Curves.gh (Grasshopper 1.0.7)
# plug-ins: CORE.Toolbox.Grasshopper, LunchBox, Human

wall_thickness = Slider(1, range=0..10)
bake = BooleanToggle(False)
geometry_pipeline = GeometryPipeline(
    GroupByLayer=False,
    GroupByType=False,
    IncludeHidden=True,
    IncludeLocked=True,
    LayerFilter="05_DRAFTING",
    NameFilter="*",
    SublayerFiltering=True,
    TypeFilter=4)
select_layer = Slider(5, range=0..50)

layer_table = LayerTable(Update=True, AutoUpdate=Toggle(True))  # -> Layers, FullLayerPaths, LayerColors, Linetypes, MaterialNames, Visible, PrintWidth, PrintColor
panel = Panel(layer_table.FullLayerPaths)
list_item = ListItem(List=panel, Index=select_layer, Wrap=True)

curve = Curve(geometry_pipeline)
curve_type = CurveType(Curve=curve)  # -> Type, Degree, Closed, Planar

wall_thickness_2 = GhPythonScript(curve=curve, distance=wall_thickness, type=curve_type.Type)  # -> out; inputs curve: Guid
# ---------- wall_thickness_2: Python ----------
__author__ = "ilouh"
__version__ = "2023.02.21"

import rhinoscriptsyntax as rs
import Grasshopper as gh
import Rhino.Geometry as rg
import ghpythonlib.components as comps
import math

def create_wall_linear(curve,distance):
    
    
    crv_1 = comps.OffsetCurve(curve,distance/2, corners = 1)
    crv_2 = comps.OffsetCurve(curve,-distance/2,corners = 1)
    
    
    end_points_1 = comps.EndPoints(crv_1)
    end_points_2 = comps.EndPoints(crv_2)
    
    pt1 = end_points_1[0]
    pt2 = end_points_1[1]
    pt3 = end_points_2[1]
    pt4 = end_points_2[0]
    
    cap_1 = comps.Line(pt2,pt3)
    cap_2 = comps.Line(pt1,pt4)
    
    crv_list = [crv_1,crv_2,cap_1,cap_2]
    joined_curve = comps.JoinCurves([crv_1,cap_1,cap_2,crv_2], False)

    return joined_curve

def create_wall_arc(curve,distance):
    
    crv_1 = comps.OffsetCurve(curve,distance/2, corners = 1)
    crv_2 = comps.OffsetCurve(curve,-distance/2,corners = 1)
    
    print(crv_1,crv_2)
    
    
if type != 'Arc':
    out = create_wall_linear(curve,distance)
# ---------- end wall_thickness_2 ----------
region_union = RegionUnion(Curves=wall_thickness_2)
custom_preview = CustomPreview(Geometry=region_union, Material=ColourSwatch(SwatchColor=RGB(68, 76, 255)))
object_bake = ObjectBake(
    BakeToggle=bake,
    GeometryObjects=region_union,
    Layer=list_item,
    ObjectName="GH_Obj",
    ObjectColor=RGB(255, 255, 255),
    LayerColor=RGB(255, 255, 255))
