# Grasshopper definition BuildingElements_WindowsFromCurves.gh (Grasshopper 1.0.8)
# plug-ins: CORE.Toolbox.Grasshopper

pipeline = GeometryPipeline(
    GroupByLayer=False,
    GroupByType=False,
    IncludeHidden=True,
    IncludeLocked=True,
    LayerFilter="03_ARCH*03_WINDOW_FRAME",
    NameFilter="*",
    SublayerFiltering=True,
    TypeFilter=4)
framewidth = Slider(1, range=0..2)
framedepth = Slider(8, range=0..10)
boundary_curve = Curve(graft(pipeline))
units = ConvertUnits(Value=framewidth, Source=3, Target=4, Exponent=1)  # -> Result, Factor
units_2 = ConvertUnits(Value=framedepth, Source=3, Target=4, Exponent=1)  # -> Result, Factor
surfaceboundary = GhPythonScript(curve=boundary_curve, distance=units.Result, frameDepth=units_2.Result)  # -> windowFrame, windowGlazing; inputs curve: Curve
# ---------- surfaceboundary: Python ----------
__author__ = "ilouh"
__version__ = "2023.02.21"

import rhinoscriptsyntax as rs
import Grasshopper as gh
import Rhino.Geometry as rg
import ghpythonlib.components as comps
import math


def createFrame(crv,distance,frameDepth):
    
    offset_1 = comps.OffsetCurve(crv,distance,corners = 1)
    offset_2 = comps.OffsetCurve(crv,-distance,corners = 1)
    
    if comps.Length(offset_1) > comps.Length(offset_2): 
        srf = comps.BoundarySurfaces([crv,offset_2])
        point = comps.ConstructPoint(0.5,0.5,0)
        normal = comps.EvaluateSurface(srf,point)['normal']
        brep = comps.Extrude(srf,comps.Amplitude(normal,frameDepth))
        brep = comps.Move(brep,comps.Amplitude(normal,-frameDepth/2))['geometry']
        return brep,comps.BoundarySurfaces(offset_2)

    
    else:
        srf =  comps.BoundarySurfaces([crv,offset_1])
        point = comps.ConstructPoint(0.5,0.5,0)
        normal = comps.EvaluateSurface(srf,point)['normal']
        brep = comps.Extrude(srf,comps.Amplitude(normal,frameDepth))
        brep = comps.Move(brep,comps.Amplitude(normal,-frameDepth/2))['geometry']
        return brep,comps.BoundarySurfaces(offset_1)



windowFrame = createFrame(curve,distance,frameDepth)[0]
windowGlazing = createFrame(curve,distance,frameDepth)[1]
# ---------- end surfaceboundary ----------
frame = Brep(surfaceboundary.windowFrame)
glazing = Surface(surfaceboundary.windowGlazing)
divide = DivideDomain²(Domain=glazing, UCount=Slider(2, range=0..10), VCount=Slider(2, range=0..10))
iso = IsoCurve(Surface=reparameterize(glazing))  # -> UIsocurve, VIsocurve
subsrf = Isotrim(Surface=glazing, Domain=divide)
preview = CustomPreview(Geometry=frame, Material=ColourSwatch(SwatchColor=RGB(70, 19, 17)))
preview_2 = CustomPreview(Geometry=glazing, Material=ColourSwatch(SwatchColor=RGBA(255, 0, 255, 59)))
