# Grasshopper definition Annotations_DimsByEdges.gh (Grasshopper 1.0.7)

crv = Curve(<curve referenced from the Rhino model>)
brep = Brep(<brep referenced from the Rhino model>)
brepdims = GhPythonScript(brep=brep)  # -> dims, locations; inputs brep: Brep
# ---------- brepdims: Python ----------
__author__ = "ilouh"
__version__ = "2023.02.21"

import rhinoscriptsyntax as rs
import Grasshopper as gh
import Rhino.Geometry as rg
import ghpythonlib.components as comps
import math


def decimal_to_feet_and_inches(decimal_length):
    # Calculate the total inches
    total_inches = decimal_length * 12

    # Extract the feet
    feet = int(total_inches // 12)

    # Calculate the remaining inches (including fractional inches)
    remaining_inches = round(total_inches % 12,2)
    inches = remaining_inches // 1
    # Calculate the fractional part
    fractional_part = round(remaining_inches % 1, 2)

    # Calculate the nearest fraction in 1/16 inch increments
    fractions = [1/16, 1/8, 3/16, 1/4, 5/16, 3/8, 7/16, 1/2, 9/16, 5/8, 11/16, 3/4, 13/16, 7/8, 15/16]
    nearest_fraction = min(fractions, key=lambda x: abs(fractional_part - x))
    
    
    string = str(feet) + '-' + str(int(inches)).lstrip('0') + str(nearest_fraction).lstrip('0')
    
    return string
    
def createDim(line): 
    
    startPoint = comps.EndPoints(line)['start']
    endPoint = comps.EndPoints(line)['end']
    
    midPoint = comps.CurveMiddle(line)
    distance = comps.Distance(startPoint,endPoint)
    
    return distance,midPoint

edges = comps.DeconstructBrep(brep)['edges']

dims = [] 
locations = [] 

for edge in edges: 
    
    dim,location = createDim(edge) 
    
    dims.append(decimal_to_feet_and_inches(dim))
    locations.append(location)
# ---------- end brepdims ----------
crvdims = GhPythonScript(curve=crv)  # -> dims, locations; inputs curve: Curve
# ---------- crvdims: Python ----------
__author__ = "ilouh"
__version__ = "2023.02.21"

import rhinoscriptsyntax as rs
import Grasshopper as gh
import Rhino.Geometry as rg
import ghpythonlib.components as comps
import math


def decimal_to_feet_and_inches(decimal_length):
    # Calculate the total inches
    total_inches = decimal_length * 12

    # Extract the feet
    feet = int(total_inches // 12)

    # Calculate the remaining inches (including fractional inches)
    remaining_inches = round(total_inches % 12,2)
    inches = remaining_inches // 1
    # Calculate the fractional part
    fractional_part = round(remaining_inches % 1, 2)

    # Calculate the nearest fraction in 1/16 inch increments
    fractions = [1/16, 1/8, 3/16, 1/4, 5/16, 3/8, 7/16, 1/2, 9/16, 5/8, 11/16, 3/4, 13/16, 7/8, 15/16]
    nearest_fraction = min(fractions, key=lambda x: abs(fractional_part - x))
    
    
    string = str(feet) + '-' + str(int(inches)).lstrip('0') + str(nearest_fraction).lstrip('0')
    
    return string
    
def createDim(line): 
    
    startPoint = comps.EndPoints(line)['start']
    endPoint = comps.EndPoints(line)['end']
    
    midPoint = comps.CurveMiddle(line)
    distance = comps.Distance(startPoint,endPoint)
    
    return distance,midPoint

crvs = comps.Explode(curve,recursive = True)['segments']
print(crvs)

dims = [] 
locations = [] 

for crv in crvs: 
    
    dim,location = createDim(crv) 
    
    dims.append(dim)
    locations.append(location)
# ---------- end crvdims ----------
tag = TextTag(Location=brepdims.locations, Text=brepdims.dims)
tag_2 = TextTag(Location=crvdims.locations, Text=crvdims.dims)
