# Grasshopper definition BSA_CurvatureMillingValidation.gh (Grasshopper 1.0.7)

minimum_curve_radius = Slider(0.06, range=0..0.1)
crv = Curve([<curve referenced from the Rhino model> x774])
explode = Explode(Curve=crv, Recursive=True)  # -> Segments, Vertices
panel = Panel(explode.Segments)

darc = DeconstructArc(Arc=explode.Segments)  # -> BasePlane, Radius, Angle
bnd = Bounds(Numbers=darc.Radius)

larger = LargerThan(FirstNumber=darc.Radius, SecondNumber=minimum_curve_radius)  # -> LargerThan, OrEqualTo
not = GateNot(A=larger.LargerThan)
cull = CullPattern(List=explode.Segments, CullPattern=not)
end = EndPoints(Curve=cull)  # -> Start, End
pt = Point(flatten([end.Start, end.End]))

panel_2 = Panel(bnd)
cull_2 = CullPattern(List=explode.Segments, CullPattern=larger.LargerThan)  # -> simplify(List)
arcs_with_proper_radius = Curve(cull_2)
