# Grasshopper definition BSA_GeometryShopVerification.gh (Grasshopper 1.0.7)

number_slider = Slider(0.28, range=0..1)
expression = Expression(x=number_slider, Expression="1/x")
beams = Brep(<brep referenced from the Rhino model>)
columns = Brep([<brep referenced from the Rhino model> x9])
series = Series(Start=0, Step=number_slider, Count=expression)
debrep = DeconstructBrep(Brep=beams)  # -> graft(Faces), Edges, Vertices
bbox = BoundingBox(Content=columns, Plane=PlaneXY(0, 0, 0))  # -> Box, Box_2
ins = InsertItems(List=series, Item="1", Indices=-1, Wrap=True)
debrep_2 = DeconstructBrep(Brep=bbox.Box)  # -> Faces, Edges, Vertices; disabled
brep = Brep([<brep referenced from the Rhino model> x171])
panel = Panel(ins)
area = Area(Geometry=debrep_2.Faces)  # -> Area, Centroid; disabled
pt = ConstructPoint(XCoordinate=ins, YCoordinate=ins, ZCoordinate=ins)
sort = SortList(Keys=area.Area, ValuesA=debrep_2.Faces)  # -> Keys, ValuesA; disabled
debrep_3 = DeconstructBrep(Brep=brep)  # -> Faces, Edges, Vertices
box_corners = BoxCorners(Box=bbox.Box)  # -> CornerA, CornerB, CornerC, CornerD, CornerE, CornerF, CornerG, CornerH
iso = IsoCurve(Surface=reparameterize(debrep.Faces), UVPoint=pt)  # -> UIsocurve, VIsocurve
len = Length(Curve=debrep_3.Edges)
item = ListItem(List=sort.ValuesA, Index=0, Wrap=True)  # -> Item, Item1; disabled
crv = Curve([iso.UIsocurve, iso.VIsocurve])
ln = Line(StartPoint=box_corners.CornerA, EndPoint=box_corners.CornerE)
area_2 = Area(Geometry=item.Item)  # -> Area, Centroid; disabled
area_3 = Area(Geometry=item.Item1)  # -> Area, Centroid; disabled
trim = TrimTree(Tree=crv, Depth=1)
larger = LargerThan(FirstNumber=len, SecondNumber=3)  # -> LargerThan, OrEqualTo
ln_2 = Line(StartPoint=area_2.Centroid, EndPoint=area_3.Centroid)  # disabled
crv_2 = Curve(trim)
crv_3 = Curve([<curve referenced from the Rhino model> x4])
len_2 = Length(Curve=crv_3)  # -> expr("round(x,2)", Length)
cull = CullPattern(List=debrep_3.Edges, CullPattern=larger.LargerThan)
python = GhPythonScript(x=len_2)  # -> d
# ---------- python: Python ----------
__author__ = "ilouh"
__version__ = "2023.02.02"

import rhinoscriptsyntax as rs

def convert_inches_to_feet_inches(inches):
    feet = int(inches / 12) + 2
    remaining_inches = float(inches % 12)

    dimension = '{}-{}'.format(feet,remaining_inches)
    return dimension

d = convert_inches_to_feet_inches(x)
# ---------- end python ----------
cls = Closed(Curve=crv_2)  # -> Closed, Periodic
curvepoint = PointOnCurve(cull, parameter=0.5)
cull_2 = CullPattern(List=crv_2, CullPattern=cls.Closed)
pdecon = Deconstruct(Point=curvepoint)  # -> XComponent, YComponent, ZComponent
linedim = LineDimension(Line=crv_3, Text=python, Size=Slider(17, range=0..100))
crv_4 = Curve(cull_2)
trim_2 = TrimTree(Tree=crv_4, Depth=1)
panel_2 = Panel(cull_2)
area_4 = Area(Geometry=trim_2)  # -> Area, Centroid
sort_2 = SortList(Keys=pdecon.ZComponent, ValuesA=cull)  # -> Keys, reverse(ValuesA)
sort_pt = SortPoints(Points=area_4.Centroid)  # -> Points, Indices
item_2 = ListItem(List=sort_2.ValuesA, Index=1, Wrap=True)
crv_5 = Curve(item_2)
pline = PolyLine(Vertices=sort_pt.Points, Closed=False)
intcrv = Interpolate(Vertices=sort_pt.Points, Degree=3, Periodic=False, KnotStyle=1)  # -> Curve, Length, Domain
divide = DivideCurve(Curve=crv_5, Count=2, Kinks=False)  # -> Points, Tangents, Parameters
pdecon_2 = Deconstruct(Point=divide.Points)  # -> XComponent, YComponent, ZComponent
python_2 = GhPythonScript(x=pdecon_2.ZComponent)  # -> d
# ---------- python_2: Python ----------
__author__ = "ilouh"
__version__ = "2023.02.02"

import rhinoscriptsyntax as rs

def convert_inches_to_feet_inches(inches):
    feet = int(inches / 12)
    remaining_inches = round(float(inches % 12),2)

    dimension = '{}-{}'.format(feet,remaining_inches)
    return dimension

d = convert_inches_to_feet_inches(x)
# ---------- end python_2 ----------
tag = TextTag(Location=divide.Points, Text=python_2)
