# Grasshopper definition BSA_ReviewDimensions.gh (Grasshopper 1.0.7)

crv = Curve([<curve referenced from the Rhino model> x13])
len = Length(Curve=crv)
expression = Expression(x=len, Expression="round(x,2)")
panel = Panel(expression)
split = TextSplit(Text=panel, Separators=".")
item = ListItem(List=split, Index=1, Wrap=True)  # -> Item1, Item
remap = RemapNumbers(Value=item.Item, Source=Domain(0, 100), Target=Domain(0, 12))  # -> Mapped, Clipped
split_2 = TextSplit(Text=remap.Mapped, Separators=".")
item_2 = ListItem(List=split_2, Index=0, Wrap=True)  # -> Item, Item1
remap_2 = RemapNumbers(Value=item_2.Item1, Source=Domain(0, 100), Target=Domain(0, 16))  # -> expr("round(x)", Mapped), Clipped
panel_2 = Panel(item_2.Item)
panel_3 = Panel(item.Item1)
panel_4 = Panel(remap_2.Mapped)
python = GhPythonScript(feet=panel_3, inches=panel_2, fractions=panel_4)  # -> dim
# ---------- python: Python ----------
__author__ = "Iliya Muzychuk"
__version__ = "2023.02.03"

import rhinoscriptsyntax as rs
import Grasshopper as gh
import Rhino.Geometry as rg
import ghpythonlib.components as comps


dim = feet + '-' + inches + ' ' + fractions +'/16'
# ---------- end python ----------
midpt = CurveMiddle(Curve=crv)  # -> graft(Midpoint)
tag = TextTag(Location=midpt, Text=python)
