# Grasshopper definition BSA_ReviewSlopes.gh (Grasshopper 1.0.7)

line = Line(Line((70.44382992, 159.378271, 14.27853632), (68.39449484, 161.9386644, 14.61160976)))
end = EndPoints(Curve=line)  # -> Start, End
len = Length(Curve=line)
pdecon = Deconstruct(Point=end.End)  # -> XComponent, YComponent, ZComponent
pdecon_2 = Deconstruct(Point=end.Start)  # -> XComponent, YComponent, ZComponent
subtraction = Subtraction(A=pdecon_2.ZComponent, B=pdecon.ZComponent)
abs = Absolute(Value=subtraction)
division = Division(A=abs, B=len)
