# Grasshopper definition Microclimate_Map_-_Simple.gh (Grasshopper 1.0.7)

ladybug = Ladybug_Ladybug()  # -> Vviiiiiiiiiizzz; plug-in component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
honeybee = Honeybee_Honeybee()  # -> Vviiiiiiiiiizzz; plug-in component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

brep = Brep(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)
mass2zone = Honeybee_Masses2Zones(zoneMasses=flatten(brep), isConditioned=True, maxRoofAngle=30, createHBZones=Toggle(True))  # -> readMe, HBZones; plug-in component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
panel = Panel("""0.4
0
0.4
0""")
glazingcreator = Honeybee_GlazingBasedOnRatio(HBObjects=mass2zone.HBZones, glzRatio=panel, breakUpWindow=Toggle(False), runIt=Toggle(True))  # -> readMe, HBObjWGLZ; plug-in component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

# ----
# DEFINE ZONES
# Set Surfaces On Which
# To Observe Temperatures
brep_2 = Brep([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])

# ----
# SET ENERGY SIM
# PARAMETERS
panel_2 = Panel("http://climate.onebuilding.org/WMO_Region_4_North_and_Central_America/California_Climate_Zones/California_CTZ_2010/USA_CA_Los.Angeles.Intl.AP.722950_CTZ2010.zip")
toggle = BooleanToggle(True)
epoutput = Honeybee_GenerateEPOutput(zoneGainsAndLosses="False", zoneComfortMetrics=toggle, comfortMapVariables=toggle, surfaceTempAnalysis=toggle)  # -> report, flatten(simulationOutputs); plug-in component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
epw_stat = Ladybug_OpenEPWAndSTATWeatherFiles(weatherFileURL=panel_2)  # -> epwFile, statFile; plug-in component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

# ----
# 2
toggle_2 = BooleanToggle(False)
# 1
toggle_3 = BooleanToggle(True)

# ----
# CALCULATE
# VIEW FACTORS
toggle_4 = BooleanToggle(True)
indoorviewfactor = Honeybee_IndoorViewFactorCalculator(
    HBZones=flatten(glazingcreator.HBObjWGLZ),
    gridSize="0.5",
    distFromFloorOrSrf=flatten(brep_2),
    includeOutdoor=Toggle(True),
    parallel=toggle_4,
    buildMesh=toggle_2,
    runIt=toggle_2)  # -> readMe, port, viewFactorMesh, viewFactorInfo, port_2, testPts, viewMeshFaces, zoneWireFrame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; plug-in component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

# ----
# RUN ENERGY SIM
exporttoopenstudio = Honeybee_ExportToOpenStudio(
    epwWeatherFile=epw_stat.epwFile,
    HBZones=flatten(glazingcreator.HBObjWGLZ),
    simulationOutputs=flatten(epoutput.simulationOutputs),
    writeOSM=toggle_3,
    runSimulation=toggle_3)  # -> readMe, osmFileAddress, idfFileAddress, resultFileAddress, eioFileAddress, rddFileAddress, htmlReport, studyFolder, model; plug-in component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
readepsrfresult = Honeybee_ReadEPSurfaceResult(resultFileAddress=exporttoopenstudio.resultFileAddress)  # -> surfaceIndoorTemp, surfaceOutdoorTemp, surfaceEnergyFlow, opaqueEnergyFlow, glazEnergyFlow, windowTotalSolarEnergy, windowBeamEnergy, windowDiffEnergy, windowTransmissivity; plug-in component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
readepresult = Honeybee_ReadEPResult(resultFileAddress=exporttoopenstudio.resultFileAddress)  # -> totalThermalLoad, thermalLoadBalance, cooling, heating, electricLight, electricEquip, fanElectric, pumpElectric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; plug-in component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

preview = CustomPreview(Geometry=indoorviewfactor.zoneWireFrame, Shader=ColourSwatch(SwatchColor=RGB(0, 0, 0)))
# 3
toggle_5 = BooleanToggle(False)

adaptcomfrecipe = Honeybee_AdaptiveComfortAnalysisRecipe(
    viewFactorMesh=indoorviewfactor.viewFactorMesh,
    viewFactorInfo=indoorviewfactor.viewFactorInfo,
    epwFile=epw_stat.epwFile,
    srfIndoorTemp=readepsrfresult.surfaceIndoorTemp,
    srfOutdoorTemp=readepsrfresult.surfaceOutdoorTemp,
    zoneAirTemp=readepresult.airTemperature,
    zoneAirFlowVol=readepresult.airFlowVolume,
    zoneAirHeatGain=readepresult.airHeatGainRate)  # -> comfRecipe; plug-in component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
# RUN MICROCLIMATE MAP
importstat = Ladybug_ImportStat(statFile=epw_stat.statFile)  # -> readMe, ashraeClimateZone, koppenClimateZone, heatingDesignTemps, coolingDesignTemps, heatingDesignDay, coolingDesignDay, monthlyTauBeam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; plug-in component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
microclimatemap = Honeybee_MicroclimateMapAnalysis(
    comfAnalysisRecipe=adaptcomfrecipe,
    analysisPeriodOrHOY=importstat.extremeHotWeek,
    writeResultFile=Toggle(False),
    parallel=toggle_5,
    runIt=toggle_5)  # -> readMe, port, radTempMtx, airTempMtx, operativeTempMtx, adaptComfMtx, degFromTargetMtx, port_2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; plug-in component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

# ----
# Scroll Through the Hours of the Simulation
number_slider = Slider(18, range=1..24)
# VISUALIZE MICROCLIMATE MAP
panel_3 = Panel("38")
legendpar = Ladybug_LegendParameters(lowBound="18", highBound=panel_3)  # -> legendPar; plug-in component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
visualizemicroclimate = Honeybee_VisualizeMicroclimateMap(
    comfResultsMtx=microclimatemap.operativeTempMtx,
    viewFactorMesh=flatten(indoorviewfactor.viewFactorMesh),
    stepOfSimulation=number_slider,
    legendPar=legendpar)  # -> readMe, port, resultMesh, legend, legendBasePt, port_2, resultValues, resultColors; plug-in component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
