# Grasshopper definition Peak Solar Radiation Massing Study.gh (Grasshopper 1.0.8)

ladybug = Ladybug_Ladybug()  # -> Vviiiiiiiiiizzz; plug-in component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

# ----
# Weather File
# Go to ladybug.tools/epwmap/ to select location. Copy link to clipboard and past it in the text box above.
# 1. Create a window
# 2. Create an element
# Slider
# Checkbox
# Label
# Button
weather_file = Panel("https://climate.onebuilding.org/WMO_Region_4_North_and_Central_America/USA_United_States_of_America/CA_California/USA_CA_Marina.Del.Rey-Hughes.Heli.722913_TMYx.zip")
weather_file_2 = Data(weather_file)

# ----
# Import Cooling Design Day Parameters
epw_stat = Ladybug_OpenEPWAndSTATWeatherFiles(weatherFileURL=weather_file_2)  # -> epwFile, statFile; plug-in component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
importstat = Ladybug_ImportStat(statFile=epw_stat.statFile)  # -> readMe, ashraeClimateZone, koppenClimateZone, heatingDesignTemps, coolingDesignTemps, heatingDesignDay, coolingDesignDay, monthlyTauBeam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; plug-in component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
importlocation = Ladybug_ImportLocation(epwFile=epw_stat.epwFile)  # -> location; plug-in component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

# ----
# 1
toggle = BooleanToggle(True)

# ----
# Generate a Clear Sky for the Entire Cooling Design Day
designdaysky = Ladybug_DesignDaySkyModel(
    location=importlocation,
    tauBeam=importstat.monthlyTauBeam,
    tauDiffuse=importstat.monthlyTauDiffuse,
    useOldRes=True,
    genCumSky=toggle)  # -> readMe, directNormRad, diffuseHorizRad, globalHorizRad, cumulativeSkyMtx; plug-in component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
selectskymtx = Ladybug_selectSkyMtx(
    cumulativeSkyMtx=designdaysky.cumulativeSkyMtx,
    analysisPeriod=importstat.coolingDesignDay,
    removeDiffuse=False,
    removeDirect=False)  # -> readMe, selectedSkyMtx; plug-in component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
data = Data(flatten(selectskymtx.selectedSkyMtx))

# ----
# Generate Clear Ses for Each Hour of the Cooling Design Day
item = ListItem(List=importstat.coolingDesignDay, Index=0, Wrap=True)
split = TextSplit(Text=item, Separators=",")
panel = Panel("""(
)""")
rep = ReplaceText(Text=split, Find=panel, RecursiveReplace=False)
int = Integer(simplify(graft(rep)))
bang = ExplodeTree(Data=int)  # -> flatten(Branch0), flatten(Branch1), flatten(Branch2)
doy_hoy = Ladybug_DOY_HOY(days=bang.Branch1, months=bang.Branch0, hours=bang.Branch2)  # -> HOY, DOY, date; plug-in component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
series = Series(Start=doy_hoy.HOY, Step=1, Count="24")  # -> simplify(graft(Series))
selectskymtx_2 = Ladybug_selectSkyMtx(cumulativeSkyMtx=designdaysky.cumulativeSkyMtx, HOY=series, removeDiffuse=False, removeDirect=False)  # -> readMe, simplify(selectedSkyMtx); plug-in component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

# ----
# Geometry Inputs
windowgeometry = Brep([<brep referenced from the Rhino model> x50])
contextgeometry = Brep([<brep referenced from the Rhino model> x3])
shades_balconies = Brep([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])

grid_size = Panel("2")
# 3
toggle_2 = BooleanToggle(True)

# ----
# Run Radiation Study
toggle_3 = BooleanToggle(True)
radiationanalysis = Ladybug_RadiationAnalysis(
    geometry=flatten(windowgeometry),
    context=flatten(contextgeometry),
    gridSize=grid_size,
    disFromBase="0.01",
    selectedSkyMtx=flatten(data),
    parallel=toggle_3,
    runIt=toggle_2)  # -> readMe, contextMesh, analysisMesh, testPts, testVec, port, radiationResult, radiationMesh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; plug-in component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

# ----
# 2
toggle_4 = BooleanToggle(True)

# ----
# Visualize Peak Solar Sky Dome
panel_2 = Panel("2")
skydome = Ladybug_SkyDome(selectedSkyMtx=data, scale=panel_2, showTotalOnly=toggle_4, runIt=toggle_4)  # -> readMe, skyPatchesMesh, baseCrvs, altitudeCrvs, legend, legendBasePts, skyPatchesCenPts, skyPatchesAreas, skyPatchesAsBrep, values; plug-in component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

# ----
# Find Max Radiation Values for Each Hour of the Design Day
rtradiationanalysis = Ladybug_RealTimeRadiationAnalysis(selectedSkyMatrix=selectskymtx_2.selectedSkyMtx, intersectionMatrix=radiationanalysis.intersectionMtx)  # -> radiationResult; plug-in component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
flip = FlipMatrix(Data=rtradiationanalysis)
sort = SortList(Keys=flip)  # -> Keys, ValuesA
item_2 = ListItem(List=sort.Keys, Index="-1", Wrap=True)  # -> flatten(Item)
multiplication = Multiplication(A=item_2, B="1000")

# ----
# Visualize Peak Solar on Massing
panel_3 = Panel("W/m2")
recolormesh = Ladybug_RecolorMesh(
    analysisResult=multiplication,
    inputMesh=radiationanalysis.radiationMesh,
    analysisTitle="Peak Solar Radiation on Design Day",
    legendTitle=panel_3)  # -> readMe, newMesh, newLegend, legendBasePt, meshColors, legendColors; plug-in component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

ma = MassAddition(Input=multiplication)  # -> Result, PartialResults
int_2 = Integer(ma.Result)

# ----
# IMPORT CLIMATE DATA + BUILD THE SKY
# INPUTS
# RADIATION BENEFIT ANALYSIS
# DISPLAY
# PANEL CONDITIONAL ACTIONS
total_building_peak_solar_w_bldg_cooling = Panel(int_2)  # "Total Building Peak Solar (W) - Bldg Cooling System Size"
