# Grasshopper definition Radiation Study 0.1.0.gh (Grasshopper 1.0.8)

panel = Panel("https://climate.onebuilding.org/WMO_Region_4_North_and_Central_America/USA_United_States_of_America/CA_California/USA_CA_Marina.Del.Rey-Hughes.Heli.722913_TMYx.zip")

# ---- group: North Degree
panel_2 = Panel("20")

# ----
geometry_to_analyze = Geometry([<brep referenced from the Rhino model>, <extrusion referenced from the Rhino model>, <surface referenced from the Rhino model>, <brep referenced from the Rhino model>])
context_geometry = Geometry(<surface referenced from the Rhino model>)

# ----
# Import Weather Data
downloadepw = LBDownloadWeather(weather_URL=panel)  # -> epw_file, stat_file, ddy_file; plug-in component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
importepw = LBImportEPW(epw_file=downloadepw.epw_file)  # -> location, dry_bulb_temperature, dew_point_temperature, relative_humidity, wind_speed, wind_direction, direct_normal_rad, diffuse_horizontal_rad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; plug-in component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
importstat = LBImportSTAT(stat_file=downloadepw.stat_file)  # -> location, ashrae_zone, koppen_zone, clear_dir_norm_rad, clear_diff_horiz_rad, ann_heat_dday_996, ann_heat_dday_990, ann_cool_dday_004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; plug-in component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

start = Point(Point(-67.36735877, -59.09568387, 0))
end = Point(Point(-18.22637091, -47.62045318, 0))

# ---- group: North Arrow
vec2pt = Vector2Pt(PointA=start, PointB=end, Unitize=False)  # -> Vector, Length

# ----
# Summer Design Day
# Radiation
panel_3 = Panel("21")
analysisperiod = LBAnalysisPeriod(start_month="7", start_day=panel_3, start_hour=0, end_month="7", end_day=panel_3)  # -> period, hoys, dates; plug-in component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
skymatrix = LBCumulativeSkyMatrix(
    north=vec2pt.Vector,
    location=importstat.location,
    direct_rad=importstat.clear_dir_norm_rad,
    diffuse_rad=importstat.clear_diff_horiz_rad,
    hoys=analysisperiod.hoys)  # -> report, sky_mtx; plug-in component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

# ----
# Annual Radiation
# Benefit/Harm
benefitmatrix = LBBenefitSkyMatrix(
    north=vec2pt.Vector,
    location=importepw.location,
    temperature=importepw.dry_bulb_temperature,
    direct_rad=importepw.direct_normal_rad,
    diffuse_rad=importepw.diffuse_horizontal_rad)  # -> report, sky_mtx; plug-in component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

# ----
# Annual Radiation
skymatrix_2 = LBCumulativeSkyMatrix(
    north=vec2pt.Vector,
    location=importepw.location,
    direct_rad=importepw.direct_normal_rad,
    diffuse_rad=importepw.diffuse_horizontal_rad)  # -> report, sky_mtx; plug-in component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

# ---- group: Run Me!
toggle = BooleanToggle(True)

# ----
# Visualize Sky Matrix
skydome = LBSkyDome(sky_mtx=skymatrix_2.sky_mtx)  # -> report, mesh, compass, legend, title, patch_vecs, patch_values, mesh_values, vis_set; plug-in component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

# ----
# Run Radiation Study
incidentradiation = LBIncidentRadiation(
    sky_mtx=skymatrix_2.sky_mtx,
    geometry=flatten(geometry_to_analyze),
    context=flatten(context_geometry),
    grid_size="1",
    offset_dist="0.1",
    run=toggle)  # -> report, points, results, total, mesh, legend, title, int_mtx; plug-in component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
xmatrix = LBDeconstructMatrix(matrix=flatten(skymatrix_2.sky_mtx))  # -> values; plug-in component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
meshselector = LBMeshThresholdSelector(values=incidentradiation.results, mesh=incidentradiation.mesh, pct_threshold=Slider(55, range=0..100))  # -> report, total_value, total_area, sub_mesh, outline; plug-in component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
panel_4 = Panel(xmatrix)
radiation_in_threshold_kwh = Panel(meshselector.total_value)
