# Grasshopper definition Shadow Range [Nov-09 '23, 1527].gh (Grasshopper 1.0.7)

# Go to ladybug.tools/epwmap/ to select location. Copy link to clipboard and past it in the text box above.
panel = Panel("https://climate.onebuilding.org/WMO_Region_2_Asia/SAU_Saudi_Arabia/RI_Riyadh/SAU_RI_Riyadh.AB.404380_TMYx.zip")
ladybug = Ladybug_Ladybug()  # -> Vviiiiiiiiiizzz; plug-in component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

# ---- group: Input Geometry
brep = Brep([<brep referenced from the Rhino model> x136])

# ---- group: Set your Base Plane
geo = Geometry(<brep referenced from the Rhino model>)

# ----
epw_stat = Ladybug_OpenEPWAndSTATWeatherFiles(weatherFileURL=panel)  # -> epwFile, statFile; plug-in component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
start = Point(<point referenced from the Rhino model>)
end = Point(<point referenced from the Rhino model>)

# ---- group: Create Geometry Center Point
bbox = BoundingBox(Content=brep, Plane=PlaneXY(0, 0, 0), UnionBox=True)  # -> Box, Box_2
volume = Volume(Geometry=bbox.Box)  # -> Volume, Centroid
pdecon = Deconstruct(Point=volume.Centroid)  # -> XComponent, YComponent, ZComponent
pt = ConstructPoint(XCoordinate=pdecon.XComponent, YCoordinate=pdecon.YComponent, ZCoordinate=0)

# ---- group: North Arrow
vec2pt = Vector2Pt(PointA=start, PointB=end, Unitize=False)  # -> Vector, Length

# ----
importlocation = Ladybug_ImportLocation(epwFile=epw_stat.epwFile)  # -> location; plug-in component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
series = Series(Start="8", Step=1, Count="11")
panel_2 = Panel("0.35")
sunpath = Ladybug_SunPath(
    north=vec2pt.Vector,
    location=importlocation,
    hour=series,
    day=21,
    month="12",
    timeStep=1,
    centerPt=pt,
    sunPathScale=Slider(1, range=0..10),
    sunScale=Slider(2, range=0..10),
    dailyOrAnnualSunPath=True)  # -> readMe, sunVectors, sunAltitudes, sunAzimuths, port, sunSpheresMesh, sunPathCrvs, compassCrvs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; plug-in component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

colrange = LBColorRange(index=Slider(3, range=0..25))  # -> colors; plug-in component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
legendpar = LBLegendParameters(colors=colrange)  # -> leg_par; plug-in component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

panel_3 = Panel(sunpath.readMe)
mesh = Mesh(sunpath.sunSpheresMesh)
preview = CustomPreview(Geometry=[sunpath.sunPathCrvs, sunpath.compassCrvs], Shader=ColourSwatch(SwatchColor=RGB(192, 192, 192)))
directsunhours = LBDirectSunHours(
    vectors=flatten(sunpath.sunVectors),
    timestep=Slider(1, range=0..100),
    geometry=flatten(brep),
    context=flatten(geo),
    grid_size=Slider(3, range=0..100),
    offset_dist=Slider(0.1, range=0..10),
    legend_par=legendpar,
    run=Toggle(True))  # -> report, points, results, mesh, legend, title, int_mtx; plug-in component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
