# Grasshopper definition Shadow Range_Ladybug.gh (Grasshopper 1.0.7)

# Base surface to project shadows onto
panel = Panel("Geometry to analyze")
# Go to ladybug.tools/epwmap/ to select location. Copy link to clipboard and past it in the text box above.
panel_2 = Panel("http://climate.onebuilding.org/WMO_Region_4_North_and_Central_America/USA_United_States_of_America/FL_Florida/USA_FL_Gainesville.Rgnl.AP.747560_TMY3.zip")

# ---- group: Setup North Arrow
north_arrow_head = Point(<point referenced from the Rhino model>)
north_arrow_tail = Point(<point referenced from the Rhino model>)
vec2pt = Vector2Pt(PointA=north_arrow_tail, PointB=north_arrow_head, Unitize=False)  # -> Vector, Length

# ---- group: Set your Base Plane
plane_to_project_onto = Geometry(<brep referenced from the Rhino model>)

# ----
input_geometry = Brep([<brep referenced from the Rhino model> x8])
ladybug = Ladybug_Ladybug()  # -> Vviiiiiiiiiizzz; plug-in component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
epw_stat = Ladybug_OpenEPWAndSTATWeatherFiles(weatherFileURL=panel_2)  # -> epwFile, statFile; plug-in component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

# ---- group: Create Geometry Center Point
bbox = BoundingBox(Content=input_geometry, Plane=PlaneXY(0, 0, 0), UnionBox=True)  # -> Box, Box_2
volume = Volume(Geometry=bbox.Box)  # -> Volume, Centroid
pdecon = Deconstruct(Point=volume.Centroid)  # -> XComponent, YComponent, ZComponent
pt = ConstructPoint(XCoordinate=pdecon.XComponent, YCoordinate=pdecon.YComponent, ZCoordinate=0)

# ----
importlocation = Ladybug_ImportLocation(epwFile=epw_stat.epwFile)  # -> location; plug-in component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
series = Series(Start="1", Step=1, Count="24")
sunpath = Ladybug_SunPath(
    north=vec2pt.Vector,
    location=importlocation,
    hour=series,
    day=21,
    month="9",
    timeStep=1,
    centerPt=pt,
    sunPathScale="0.35",
    dailyOrAnnualSunPath=True)  # -> readMe, sunVectors, sunAltitudes, sunAzimuths, port, sunSpheresMesh, sunPathCrvs, compassCrvs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; plug-in component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
panel_3 = Panel(sunpath.readMe)
mesh = Mesh(sunpath.sunSpheresMesh)
gradientlibrary = Ladybug_GradientLibrary(gradIndex="5")  # -> customColors; plug-in component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
toggle = BooleanToggle(True)
toggle_2 = BooleanToggle(True)
path = FilePath("C:\Users\Brooks Scarpa\Desktop\Junk\")
legendpar = Ladybug_LegendParameters(customColors=flatten(gradientlibrary))  # -> legendPar; plug-in component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
sunlighthoursanalysis = Ladybug_SunlightHoursAnalysis(
    geometry=flatten(plane_to_project_onto),
    context=flatten(input_geometry),
    gridSize="1",
    disFromBase="0.2",
    sunVectors=flatten(sunpath.sunVectors),
    timeStep=Toggle(True),
    legendPar=flatten(legendpar),
    parallel=toggle_2,
    runIt=toggle_2,
    bakeIt=Toggle(False),
    workingDir=path,
    projectName="Stereographic")  # -> readMe, contextMesh, analysisMesh, testPts, testVec, port, sunlightHoursResult, sunlightHoursMesh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; plug-in component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
preview = CustomPreview(Geometry=[sunpath.sunPathCrvs, sunpath.compassCrvs], Shader=ColourSwatch(SwatchColor=RGB(192, 192, 192)))
mesh_2 = Mesh(sunlighthoursanalysis.sunlightHoursMesh)
panel_4 = Panel(mesh_2)
panel_5 = Panel(sunlighthoursanalysis.readMe)
captureview = Ladybug_CaptureView()  # -> imagePath; disabled; plug-in component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
