# Grasshopper definition Wind Rose 0.1.0.gh (Grasshopper 1.0.8)

# Go to ladybug.tools/epwmap/ to select location. Copy link to clipboard and past it in the text box above.
panel = Panel("https://climate.onebuilding.org/WMO_Region_4_North_and_Central_America/USA_United_States_of_America/CA_California/USA_CA_Marina.Del.Rey-Hughes.Heli.722913_TMYx.zip")
# http://climate.onebuilding.org/WMO_Region_4_North_and_Central_America/California_Climate_Zones/California_CTZ_2010/USA_CA_Los.Angeles.Intl.AP.722950_CTZ2010.zip
ladybug = Ladybug_Ladybug()  # -> Vviiiiiiiiiizzz; plug-in component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
wind_rose_center_point = Point(<point referenced from the Rhino model>)

# ---- group: Setup North Arrow
north_arrow_head = Point(Point(584.2959065, -356.8483409, 0))
north_arrow_tail = Point(Point(535.1549186, -368.3235716, 0))
vec2pt = Vector2Pt(PointA=north_arrow_tail, PointB=north_arrow_head, Unitize=False)  # -> Vector, Length

# ----
panel_2 = Panel(ladybug)
epw_stat = Ladybug_OpenEPWAndSTATWeatherFiles(weatherFileURL=panel)  # -> epwFile, statFile; plug-in component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
importepw = Ladybug_ImportEpw(epwFile=epw_stat.epwFile)  # -> readMe, latitude, location, dryBulbTemperature, dewPointTemperature, relativeHumidity, windSpeed, windDirection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; plug-in component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
gradientlibrary = Ladybug_GradientLibrary(gradIndex="8")  # -> customColors; plug-in component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
legendpar = Ladybug_LegendParameters(highBound="20", customColors=flatten(gradientlibrary))  # -> legendPar; plug-in component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
toggle = BooleanToggle(True)
windrose = Ladybug_WindRose(
    north=vec2pt.Vector,
    hourlyWindDirection=importepw.windDirection,
    hourlyWindSpeed=importepw.windSpeed,
    centerPoint=wind_rose_center_point,
    showFrequency=toggle,
    showAverageVelocity=toggle,
    scale=Slider(0.25, range=0..1),
    legendPar=legendpar,
    runIt=Toggle(True))  # -> readMe, calmRoseMesh, windRoseMesh, windRoseCrvs, windRoseCenPts, legend, legendBasePts, title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; plug-in component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
