# Grasshopper definition IM_DotBimExport.gh (Grasshopper 1.0.7)
# plug-ins: dotbimGH, jSwan, LunchBox

panel = Panel("Studio Area")
mesh = Mesh(<mesh referenced from the Rhino model>)
mesh_2 = Mesh(<mesh referenced from the Rhino model>)
lng = ListLength(List=mesh)
path = FilePath("D:\10_Software Development\data.json")
mesh_3 = Mesh([<mesh referenced from the Rhino model> x21])
lng_2 = ListLength(List=mesh_2)
dejson = DeserializeJson(JSON=path, OutputsLocked=False)
dup = DuplicateData(Data="1200 sf", Number=lng, Order=True)
path_2 = FilePath("D:\10_Software Development\data.csv")
create_guid = CreateGuid(Count=lng_2)  # -> flatten(Guid)
lng_3 = ListLength(List=mesh_3)
xy = XYPlane(Origin=Point(0, 0, 0))
series = Series(Start=0, Step=1, Count=lng)
dejsonkv = DeserializeKeysAndValues(JSON=dejson)  # -> Key, Value
create_guid_2 = CreateGuid(Count=lng)
csv = ReadCSV(CSVString=path_2, Delimiter=",")  # -> Headers, Values
python = GhPythonScript(list_length=lng_3)  # -> graft(names)
# ---------- python: Python ----------
__author__ = "ilouh"
__version__ = "2023.02.06"

names = []
for i in range(1,list_length+1):
    
    temp = 'Studio No. {}'.format(i)
    names.append(temp)
# ---------- end python ----------
panel_2 = Panel(dejsonkv.Value)
create_info = CreateInfo(Keys=series, Values=dup)
create_info_2 = CreateInfo(Keys=dejsonkv.Key, Values=dejsonkv.Value)  # -> simplify(Info)
create_info_3 = CreateInfo(Keys="4611 Studios", Values="Website URL")  # -> simplify(Info)
dup_2 = DuplicateData(Data=xy, Number=lng, Order=True)
create_guid_3 = CreateGuid(Count=lng_3)  # -> flatten(Guid)
panel_3 = Panel(create_guid)
panel_4 = Panel(csv.Values)
panel_5 = Panel(csv.Headers)
dup_3 = DuplicateData(Data=series, Number=lng, Order=True)
dup_4 = DuplicateData(Data=ColourSwatch(SwatchColor=RGB(98, 225, 245)), Number=lng, Order=True)
create_elements_set = CreateElementsSet(Mesh=mesh, InsertPlanes=dup_2, Guids=create_guid_2, Types=dup_3, Colors=dup_4, Info=create_info)  # -> ElementsSet, Preview
panel_6 = Panel(dup_3)
xy_2 = XYPlane(Origin=Point(0, 0, 0))
panel_7 = Panel(create_info_2)
panel_8 = Panel(create_guid_3)
panel_9 = Panel(python)
create_elements_set_2 = CreateElementsSet(
    Mesh=graft(mesh_3),
    InsertPlanes=xy_2,
    Guids=graft(create_guid_3),
    Types=python,
    Colors=ColourSwatch(SwatchColor=RGB(146, 187, 209)),
    Info=flatten(create_info_2))  # -> ElementsSet, Preview
xy_3 = XYPlane(Origin=Point(0, 0, 0))
panel_10 = Panel(create_elements_set_2.Preview)
create_elements_set_3 = CreateElementsSet(
    Mesh=mesh_2,
    InsertPlanes=xy_3,
    Guids=create_guid,
    Types="Artist Studios",
    Colors=ColourSwatch(SwatchColor=RGBA(217, 247, 255, 0)),
    Info=create_info_3)  # -> ElementsSet, Preview
create_info_4 = CreateInfo(Keys="Author", Values="Iliya Muzychuk")
path_3 = FilePath("C:\Users\ilouh\Documents\GitHub\Dotbim\ApartmentBldg.bim")
flatten = FlattenTree(Tree=create_elements_set_2.ElementsSet, Path="{0}")
merge = Merge(Data1=simplify(create_elements_set_2.ElementsSet), Data2=simplify(create_elements_set_3.ElementsSet))  # -> simplify(flatten(Result))
create_file = CreateFile(ElementsSetsOrElements=merge, Info=create_info_4, Path=path_3)
