# Grasshopper definition IM_SpeckleExport.gh (Grasshopper 1.0.7)
# plug-ins: Speckle 2, jSwan

receive = Receive(
    Stream="https://speckle.xyz/streams/bf9b724b71/commits/ac55694755",
    AutoReceive=False,
    CurrentComponentState="expired",
    ExpandOutput=True,
    LastInfoMessage="Iliya Muzychuk  @ 2023-03-22T14:27:33.392Z: Sent 129 elements from Rhino. (id:ac55694755)",
    ReceiveOnOpen=False,
    ReceivedCommitId="ac55694755",
    StreamWrapper="https://speckle.xyz/streams/bf9b724b71/commits/ac55694755",
    selectedKitName="Objects")  # -> Info, _100, Data, Default, NamedViews, StandardViews, Белый, Красный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
panel = Panel(receive.Белый)
mesh_rooms_studios = Mesh([<mesh referenced from the Rhino model> x12])
mesh_rooms_bathrooms = Mesh([<mesh referenced from the Rhino model> x2])
mesh_rooms_circulation = Mesh([<mesh referenced from the Rhino model> x2])
mesh_topography = Mesh(<mesh referenced from the Rhino model>)
crv = Curve([<curve referenced from the Rhino model> x5000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])
swatch = ColourSwatch(SwatchColor=RGB(255, 255, 255))
mcol = MeshColours(Mesh=mesh_rooms_studios, Colours=ColourSwatch(SwatchColor=RGB(0, 255, 128)))
mcol_2 = MeshColours(Mesh=mesh_rooms_circulation, Colours=ColourSwatch(SwatchColor=RGB(255, 103, 128)))
mcol_3 = MeshColours(Mesh=mesh_rooms_bathrooms, Colours=ColourSwatch(SwatchColor=RGB(255, 136, 206)))
swatch_2 = ColourSwatch(SwatchColor=RGB(255, 255, 255))
swatch_3 = ColourSwatch(SwatchColor=RGB(255, 255, 255))
mcol_4 = MeshColours(Mesh=mesh_topography, Colours=ColourSwatch(SwatchColor=RGB(255, 255, 255)))
mcol_5 = MeshColours(Mesh=[receive.Белый, receive._100], Colours=swatch_3)
mcol_6 = MeshColours(Mesh=receive.Красный, Colours=swatch_3)
mcol_7 = MeshColours(Mesh=receive.Металл, Colours=swatch_2)
mcol_8 = MeshColours(Mesh=receive.Серебристый, Colours=swatch_2)
mcol_9 = MeshColours(Mesh=receive.Чёрный, Colours=ColourSwatch(SwatchColor=RGB(0, 0, 0)))
merge = Merge(Data1=mcol, Data2=mcol_2, Data3=mcol_3)
merge_2 = Merge(Data1=mcol_5, Data2=mcol_6, Data3=mcol_7, Data4=mcol_8, Data5=mcol_9)
mesh = Mesh(merge_2)
mesh_2 = Mesh(merge)
to_speckle = ToSpeckle(Data=[mcol_4, crv], selectedKitName="Objects")
path = FilePath("G:\My Drive\Scripting Repository\Python\SpeckleAttributes.json")
path_2 = FilePath("G:\My Drive\Scripting Repository\Python\SpeckleAttributes.json")
lng = ListLength(List=mesh)
mesh_3 = Mesh(graft(mesh))
file = ReadFile(File=path, PerLineParse=True)
lng_2 = ListLength(List=mesh_2)
mesh_4 = Mesh(graft(mesh_2))
file_2 = ReadFile(File=path_2, PerLineParse=True)
python = GhPythonScript(iterations=lng)  # -> keys, tree
# ---------- python: Python ----------
__author__ = "ilouh"
__version__ = "2023.02.21"

import rhinoscriptsyntax as rs
import Grasshopper as gh
import Rhino.Geometry as rg
import ghpythonlib.components as comps
import math
import random
from ghpythonlib import treehelpers as th




dic = {


    "Data_PartNumber":  random.randint(100000, 999999),
    "Data_Description": random.randint(100000, 999999),
    "Data_Cost": random.randint(100000, 999999),
    "Data_Specifications": random.randint(100000, 999999),
    "Data_Manufacturer": random.randint(100000, 999999),
    "Data_ManufacturerPartNumber": random.randint(100000, 999999),
    "Data_Warranty": random.randint(100000, 999999),
    "Data_WarrantyPeriod": random.randint(100000, 999999),

}

#create a loop to iterate through the dictionary and assign random value for each key at each iteration

tree = []

for i in range(iterations):
    
    for key in dic:

        dic[key] = random.randint(100000, 999999)

    tree.append(dic.values())

keys = dic.keys()
tree = th.list_to_tree(tree)
# ---------- end python ----------
dejsonkv = DeserializeKeysAndValues(JSON=file)  # -> Key, Value
python_2 = GhPythonScript(iterations=lng_2)  # -> keys, tree
# ---------- python_2: Python ----------
__author__ = "ilouh"
__version__ = "2023.02.21"

import rhinoscriptsyntax as rs
import Grasshopper as gh
import Rhino.Geometry as rg
import ghpythonlib.components as comps
import math
import random
from ghpythonlib import treehelpers as th




dic = {


    "Data_RoomNumber":  random.randint(100000, 999999),
    "Data_Description": random.randint(100000, 999999),
    "Data_Function": random.randint(100000, 999999),
    "Data_Specifications": random.randint(100000, 999999),
    "Data_Occupancy": random.randint(100000, 999999),
    "Data_Program": random.randint(100000, 999999),


}

#create a loop to iterate through the dictionary and assign random value for each key at each iteration

tree = []

for i in range(iterations):
    
    for key in dic:

        dic[key] = random.randint(100000, 999999)

    tree.append(dic.values())

keys = dic.keys()
tree = th.list_to_tree(tree)
# ---------- end python_2 ----------
dejsonkv_2 = DeserializeKeysAndValues(JSON=file_2)  # -> Key, Value
panel_2 = Panel(python.tree)
panel_3 = Panel(python.keys)
panel_4 = Panel(python_2.tree)
panel_5 = Panel(python_2.keys)
panel_6 = Panel(dejsonkv.Value)
panel_7 = Panel(dejsonkv_2.Value)
esokv = ExtendSpeckleObjectByKeyValue(SpeckleObject=flatten(mesh_3), Keys=panel_3, Values=flatten(python.tree), selectedKitName="Objects")
esokv_2 = ExtendSpeckleObjectByKeyValue(SpeckleObject=flatten(mesh_4), Keys=panel_5, Values=flatten(python_2.tree), selectedKitName="Objects")
dso = DeconstructSpeckleObject(SpeckleObject=esokv, selectedKitName="Objects")
dso_2 = DeconstructSpeckleObject(SpeckleObject=esokv_2, selectedKitName="Objects")  # -> Area, Bbox, Colors, Data_Description, Data_Function, Data_Occupancy, Data_Program, Data_RoomNumber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
send = Send(
    Stream="https://speckle.xyz/streams/91c60ff761/branches/main",
    Data=[esokv_2, to_speckle],
    AutoSend=False,
    BaseId="3cac963e413b5343af8f2c77482c3b05",
    CurrentComponentState="up_to_date",
    KitName="Objects",
    OutputWrappers="https://speckle.xyz\t91c60ff761\taf6fa4013f",
    UseDefaultCache=True,
    selectedKitName="Objects")
send_2 = Send(
    Stream="https://speckle.xyz/streams/bf9b724b71",
    Data=esokv,
    AutoSend=False,
    BaseId="7dbe6dc37d9545500aeb9ef8ee38473f",
    CurrentComponentState="up_to_date",
    KitName="Objects",
    OutputWrappers="https://speckle.xyz\tbf9b724b71\t6990ac883e",
    UseDefaultCache=True,
    selectedKitName="Objects")
