# Grasshopper definition 20230502_21015.0_wrapcircles.gh (Grasshopper 1.0.7)
# plug-ins: Kangaroo2 Components

input_curve = Curve(<curve referenced from the Rhino model>)
number_slider = Slider(200, range=0..1000)
construct_domain = ConstructDomain(DomainStart="1", DomainEnd="4")
number_slider_2 = Slider(300, range=0..500)
rectangle = Rectangle(Plane=PlaneXY(0, 0, 0), XSize=Slider(12, range=0..100), YSize=Slider(12, range=0..100), Radius=0)  # -> Rectangle, Length
area = Area(Geometry=rectangle.Rectangle)  # -> Area, Centroid
pop2d = Populate2D(Region=input_curve, Count=number_slider_2, Seed=1)
random = Random(Range=construct_domain, Number=number_slider_2, Seed=Slider(60, range=0..100))
divide = DivideCurve(Curve=input_curve, Count=number_slider, Kinks=False)  # -> Points, Tangents, Parameters
pline = PolyLine(Vertices=divide.Points, Closed=True)
dup = DuplicateData(Data=0, Number=number_slider, Order=True)
area_2 = Area(Geometry=pline)  # -> Area, Centroid
multiplication = Multiplication(A=area_2.Area, B=Slider(0.5, range=0..1))
explode = Explode(Curve=pline, Recursive=True)  # -> Segments, Vertices
polygonarea = PolygonArea(Polyline=pline, Area=multiplication, Strength=0.01)
len = Length(Curve=explode.Segments)
end = EndPoints(Curve=explode.Segments)  # -> Start, End
line = Line(explode.Segments)
multiplication_2 = Multiplication(A=len, B=Slider(0.03, range=0..1))
collider = Collider(Objects=flatten([pop2d, line]), Radii=flatten([random, dup]), Strength=100)
length_line = LengthLine(Line=explode.Segments, Length=multiplication_2, Strength=0.1)
onplane = OnPlane(Points=[pop2d, end.Start], Plane=PlaneXY(0, 0, 0), Strength=10000)
show = Show(G=pop2d)
entwine = Entwine(Branch00=show, Branch01=length_line, Branch02=[onplane, collider, polygonarea], FlattenInputs=True)
panel = Panel(entwine)
solver = Solver(GoalObjects=entwine, Reset=Button(), Threshold=1e-15, Tolerance=0.01, On=Toggle(True))  # -> I, V, O
bang = ExplodeTree(Data=solver.O)  # -> Branch0, Branch1, Branch2
cir = Circle(Plane=bang.Branch0, Radius=random)
crv = Curve(bang.Branch1)
