# Grasshopper definition 23 1016 Circle Packing Algorithm_Daniel Picker.gh (Grasshopper 1.0.7)
# plug-ins: Kangaroo2 Components

expression = Expression(x="12", Expression="X/12")
expression_2 = Expression(x="6", Expression="X/12")
dom = ConstructDomain(DomainStart=expression_2, DomainEnd=expression)
srf = Surface(<surface referenced from the Rhino model>)
bbox = BoundingBox(Content=srf, Plane=PlaneXY(0, 0, 0))  # -> Box, Box_2
debrep = DeconstructBrep(Brep=bbox.Box)  # -> Faces, Edges, Vertices

bbox_2 = BoundingBox(Content=debrep.Faces, Plane=PlaneXY(0, 0, 0))  # -> Box, Box_2
wires = BrepWireframe(Brep=bbox_2.Box, Density=-1)
join = JoinCurves(Curves=wires, Preserve=False)

wires_2 = BrepWireframe(Brep=debrep.Faces, Density=-1)
join_2 = JoinCurves(Curves=wires_2, Preserve=False)

input_curve = Curve(join)
popgeo = PopulateGeometry(Geometry=debrep.Faces, Count=Slider(50, range=0..200), Seed=1)
lng = ListLength(List=popgeo)
random = Random(Range=dom, Number=lng, Seed=2, Integers=False)

lng_2 = ListLength(List=popgeo)
divide = DivideCurve(Curve=input_curve, Count=lng_2, Kinks=False)  # -> Points, Tangents, Parameters
pline = PolyLine(Vertices=divide.Points, Closed=True)
dup = DuplicateData(Data=0, Number=lng_2, Order=True)
explode = Explode(Curve=pline, Recursive=True)  # -> Segments, Vertices
len = Length(Curve=explode.Segments)
end = EndPoints(Curve=explode.Segments)  # -> Start, End
multiplication = Multiplication(A=len, B=Slider(0.625, range=0..1))
line = Line(explode.Segments)
collider = Collider(Objects=flatten([popgeo, line]), Radii=flatten([random, dup]), Strength=1)
length_line = LengthLine(Line=explode.Segments, Length=multiplication, Strength=0.01)
onplane = OnPlane(Points=[popgeo, end.Start], Plane=PlaneXY(0, 0, 0), Strength=100)
show = Show(G=popgeo)

entwine = Entwine(Branch00=show, Branch01=length_line, Branch02=[onplane, collider], FlattenInputs=True)
solver = Solver(GoalObjects=entwine, Reset=Button(), Threshold=1e-15, Tolerance=0.01, On=Toggle(True))  # -> I, V, O
bang = ExplodeTree(Data=solver.O)  # -> Branch0, Branch1, Branch2
cir = Circle(Plane=bang.Branch0, Radius=random)

input_curve_2 = Curve(join_2)

incurve = PointInCurve(Point=bang.Branch0, Curve=input_curve_2)  # -> Relationship, Point
larger = LargerThan(FirstNumber=incurve.Relationship, SecondNumber=1)  # -> LargerThan, OrEqualTo
cull = CullPattern(List=cir, CullPattern=larger.OrEqualTo)

circles = Curve(cull)
darc = DeconstructArc(Arc=circles)  # -> BasePlane, Radius, Angle
expression_3 = Expression(x=darc.Radius, Expression="round(X*12)")
python = GhPythonScript(radii=expression_3)  # -> labels, tag, count, reverse(text); inputs radii: list of Int32
# ---------- python: Python ----------
__author__ = "Iliya Muzychuk"
__version__ = "2023.02.03"

import rhinoscriptsyntax as rs
import Grasshopper as gh
import Rhino.Geometry as rg
import ghpythonlib.components as comps

def createTagList(li):
    
    # Create a list of unique values
    unique_list = list(set(li))
    
    # Sort the unique list by numerical values
    unique_list.sort()
    
    # Determine the starting letter based on the minimum value
    start_letter = 'A'
    
    # Create a list of letters starting from 'A'
    letter_list = [chr(ord(start_letter) + value - unique_list[0]) for value in unique_list]
    
    my_dict = dict(zip(unique_list,letter_list))
    
    print(my_dict)
    return my_dict

def countItems(li):

    # Convert the list to a set to get unique items
    unique_set = set(li)
    
    # Create a dictionary to store item counts
    my_dict = {}
    
    # Iterate through the unique items in the set and count their occurrences
    for item in unique_set:
        count = li.count(item)
        my_dict[item] = count
    
    print(my_dict)
    return my_dict
        
if __name__ == "__main__":
    
    # Run the functions to count all offsets. 
    
    my_dict = createTagList(radii)
    count_dict = countItems(radii)
    
    # Create labels for each Circle 
    labels = [] 
    
    for item in radii:
        labels.append(my_dict[item])
    
    # Create a dictionary to count the values of all types 
    new_dic = {}
    text = []
    
    for key,value in my_dict.items():
        
        new_dic[value] = count_dict[key]
        
        string = '{} ({}" radius)'.format(value,key) + ': '+'{} of this type'.format(count_dict[key])
        text.append(string)
    
    tag = new_dic.keys()
    count = new_dic.values()
# ---------- end python ----------
pt = Point(Point(147.389498, 108.1882147, 0))

lng_3 = ListLength(List=python.tag)
series = Series(Start=0, Step="3", Count=lng_3)
Y = UnitY(Factor=series)
move = Move(Geometry=pt, Motion=Y)  # -> Geometry, Transform

tag = TextTag(Location=darc.BasePlane, Text=python.labels)
tag_2 = TextTag(Location=move.Geometry, Text=python.text)
