# Grasshopper definition 23 1016 Circle Packing Algorithm_IM.gh (Grasshopper 1.0.7)
# plug-ins: Kangaroo2 Components

srf = Surface(reparameterize(<surface referenced from the Rhino model>))

dom = ConstructDomain(DomainStart=Slider(12, range=0..100), DomainEnd=Slider(12, range=0..100))

wires = BrepWireframe(Brep=srf, Density=-1)
join = JoinCurves(Curves=wires, Preserve=False)
divide = DivideCurve(Curve=wires, Count=Slider(15, range=0..100), Kinks=False)  # -> flatten(Points), Tangents, Parameters
remeshbycolour = RemeshByColour(
    Mesh=srf,
    LengthInterval=dom,
    FixCurves=join,
    FixVertices=divide.Points,
    Flip=1,
    Iterations=Slider(30, range=0..50),
    Reset=Toggle(False))
tangentincircles = TangentIncircles(Mesh=remeshbycolour, Boundary=join, Strength=Slider(100, range=0..100))
demesh = DeconstructMesh(Mesh=remeshbycolour)  # -> Vertices, Faces, Colours, Normals
show = Show(G=remeshbycolour)
onmesh = OnMesh(Points=demesh.Vertices, Mesh=remeshbycolour, Strength=1)
entwine = Entwine(Branch00=show, Branch01=[tangentincircles, onmesh], FlattenInputs=True)
number_slider = Slider(1, range=1..12)
solver = Solver(GoalObjects=entwine, Reset=Button(), Threshold=1e-15, Tolerance=0.0001, On=Toggle(True))  # -> I, V, O
bang = ExplodeTree(Data=solver.O)  # -> Branch0, Branch1
tc = TangentCircles(Mesh=bang.Branch0)  # -> Incircles, CirclePacking, Dual
crv = Curve(tc.CirclePacking)
number_slider_2 = Slider(2, range=0..100)
circles = Curve(crv)

neg = Negative(Value=Slider(1, range=0..1))
offset = OffsetCurve(Curve=circles, Distance=neg, Corners=1)
merge = Merge(Data1=simplify(graft(circles)), Data2=simplify(graft(offset)))

crv_2 = Curve(offset)
panel = Panel("""0.15
0.33
0.5
0.66
0.75
0.88
0.95""")
darc = DeconstructArc(Arc=crv_2)  # -> graft(BasePlane), Radius, Angle
eval = EvaluateCurve(Curve=reparameterize(graft(crv_2)), Parameter=panel)  # -> Point, Tangent, Angle
darc_2 = DeconstructArc(Arc=circles)  # -> BasePlane, Radius, Angle
srf_cp = SurfaceClosestPoint(Point=darc_2.BasePlane, Surface=srf)  # -> Point, graft(UVPoint), Distance

loft = Loft(Curves=merge, Options={Adjust=False, Closed=False, LoftEnds=0, LoftSimp=0, LoftType=0, Rebuild=10, Refit=0.01})
panel_2 = Panel("0.5,0.5,0")
evalsrf = EvaluateSurface(Surface=srf, Point=srf_cp.UVPoint)  # -> Point, Normal, UDirection, VDirection, Frame
neg_2 = Negative(Value=evalsrf.Normal)
amp = Amplitude(Vector=neg_2, Amplitude=number_slider_2)
move = Move(Geometry=loft, Motion=amp)  # -> Geometry, Transform
amp_2 = Amplitude(Vector=evalsrf.Normal, Amplitude=number_slider_2)

srf_cp_2 = SurfaceClosestPoint(Point=darc_2.BasePlane, Surface=srf)  # -> Point, graft(UVPoint), Distance; disabled
python = GhPythonScript(radii=darc_2.Radius)  # -> labels, tag, count, reverse(text); inputs radii: list of Int32
# ---------- python: Python ----------
__author__ = "Iliya Muzychuk"
__version__ = "2023.02.03"

import rhinoscriptsyntax as rs
import Grasshopper as gh
import Rhino.Geometry as rg
import ghpythonlib.components as comps

def createTagList(li):
    
    # Create a list of unique values
    unique_list = list(set(li))
    
    # Sort the unique list by numerical values
    unique_list.sort()
    
    # Determine the starting letter based on the minimum value
    start_letter = 'A'
    
    # Create a list of letters starting from 'A'
    letter_list = [chr(ord(start_letter) + value - unique_list[0]) for value in unique_list]
    
    my_dict = dict(zip(unique_list,letter_list))
    
    print(my_dict)
    return my_dict

def countItems(li):

    # Convert the list to a set to get unique items
    unique_set = set(li)
    
    # Create a dictionary to store item counts
    my_dict = {}
    
    # Iterate through the unique items in the set and count their occurrences
    for item in unique_set:
        count = li.count(item)
        my_dict[item] = count
    
    print(my_dict)
    return my_dict
        
if __name__ == "__main__":
    
    # Run the functions to count all offsets. 
    
    my_dict = createTagList(radii)
    count_dict = countItems(radii)
    
    # Create labels for each Circle 
    labels = [] 
    
    for item in radii:
        labels.append(my_dict[item])
    
    # Create a dictionary to count the values of all types 
    new_dic = {}
    text = []
    
    for key,value in my_dict.items():
        
        new_dic[value] = count_dict[key]
        
        string = '{} ({}" radius)'.format(value,key) + ': '+'{} of this type'.format(count_dict[key])
        text.append(string)
    
    tag = new_dic.keys()
    count = new_dic.values()
# ---------- end python ----------
ln = Line(StartPoint=darc.BasePlane, EndPoint=eval.Point)
tag = TextTag(Location=darc_2.BasePlane, Text=python.labels)
leaf = GhPythonScript(line=ln, d=Slider(1, range=0..10), plane=darc.BasePlane)  # -> curve; inputs line: Line, plane: Plane
# ---------- leaf: Python ----------
__author__ = "ilouh"
__version__ = "2023.02.21"

import rhinoscriptsyntax as rs
import Grasshopper as gh
import Rhino.Geometry as rg
import ghpythonlib.components as comps
import math

start_pt = comps.EndPoints(line)['start']
end_pt = comps.EndPoints(line)['end']

vector = comps.Vector2Pt(start_pt,end_pt,True)['vector']

offset_line_1 = comps.OffsetCurve(line,-d,plane,corners = 0)
offset_line_2 = comps.OffsetCurve(line,d,plane,corners = 0)

mid_1 = comps.CurveMiddle(offset_line_1)
mid_2 = comps.CurveMiddle(offset_line_2)

arc_1 = comps.Arc3Pt(start_pt,mid_1,end_pt)['arc']
arc_2 = comps.Arc3Pt(start_pt,mid_2,end_pt)['arc']

curve = comps.JoinCurves([arc_1,arc_2],True)
# ---------- end leaf ----------
pt = Point(Point(147.389498, 108.1882147, 0))

lng = ListLength(List=python.tag)
series = Series(Start=0, Step="3", Count=lng)
Y = UnitY(Factor=series)
move_2 = Move(Geometry=pt, Motion=Y)  # -> Geometry, Transform

boundary = BoundarySurfaces(Edges=leaf)
extr = Extrude(Base=move.Geometry, Direction=amp_2)
tag_2 = TextTag(Location=move_2.Geometry, Text=python.text)
preview = CustomPreview(
    Geometry=[extr, boundary],
    Material={diffuse=RGB(221, 160, 221), emission=RGB(66, 48, 66), shine=0.5, specular=RGB(255, 255, 255), transparency=0})
