# Grasshopper definition 23 1017 Circle Packing Algorithm_IM.gh (Grasshopper 1.0.7)
# plug-ins: Kangaroo2 Components

subd = SubD(<subd referenced from the Rhino model>)
mesh = Mesh(subd)
medges = MeshEdges(Mesh=mesh)  # -> NakedEdges, InteriorEdges, NonManifoldEdges
demesh = DeconstructMesh(Mesh=mesh)  # -> Vertices, Faces, Colours, Normals
join = JoinCurves(Curves=medges.NakedEdges, Preserve=False)

dom = ConstructDomain(DomainStart=Slider(8, range=0..100), DomainEnd=Slider(35, range=0..100))

# ---- group: Relexes and triangulates the mesh
remeshbycolour = RemeshByColour(Mesh=mesh, LengthInterval=dom, FixCurves=join, Flip=1, Iterations=Slider(25, range=0..50), Reset=Toggle(False))

# ----
tangentincircles = TangentIncircles(Mesh=remeshbycolour, Boundary=join, Strength=Slider(5, range=0..100))
demesh_2 = DeconstructMesh(Mesh=remeshbycolour)  # -> Vertices, Faces, Colours, Normals
show = Show(G=remeshbycolour)
onmesh = OnMesh(Points=demesh_2.Vertices, Mesh=remeshbycolour, Strength=1)
entwine = Entwine(Branch00=show, Branch01=[tangentincircles, onmesh], FlattenInputs=True)
number_slider = Slider(1, range=1..12)
dam = DataDam(DataA=entwine, BufferDelay=10000000, BufferMode=0)
solver = Solver(GoalObjects=dam, Reset=Button(), Threshold=1e-15, Tolerance=0.0001, On=Toggle(False))  # -> I, V, O
bang = ExplodeTree(Data=solver.O)  # -> Branch0, Branch1
number_slider_2 = Slider(1, range=0..1)
tc = TangentCircles(Mesh=bang.Branch0)  # -> Incircles, CirclePacking, Dual
crv = Curve(tc.CirclePacking)
curvepoint = PointOnCurve(crv, parameter=0.552)
curvepoint_2 = PointOnCurve(crv, parameter=0.694)
curvepoint_3 = PointOnCurve(crv, parameter=0.358)
curvepoint_4 = PointOnCurve(crv, parameter=0.142)
number_slider_3 = Slider(2, range=0..100)
merge = Merge(Data1=graft(curvepoint_4), Data2=graft(curvepoint_3), Data3=graft(curvepoint), Data4=graft(curvepoint_2))  # -> simplify(Result)
circles = Curve(crv)

neg = Negative(Value=Slider(0.15, range=0..1))
offset = OffsetCurve(Curve=circles, Distance=neg, Corners=1)
merge_2 = Merge(Data1=simplify(graft(circles)), Data2=simplify(graft(offset)))

number_slider_4 = Slider(0.15, range=0..1)
pline = PolyLine(Vertices=merge, Closed=Toggle(True))
darc = DeconstructArc(Arc=circles)  # -> BasePlane, Radius, Angle
expression = Expression(x=darc.Radius, Expression="round(x)")

loft = Loft(Curves=merge_2, Options={Adjust=False, Closed=False, LoftEnds=0, LoftSimp=0, LoftType=0, Rebuild=10, Refit=0.01})
evalsrf = EvaluateSurface(Surface=loft, Point="0.5,0.5,0")  # -> Point, Normal, UDirection, VDirection, Frame
neg_2 = Negative(Value=evalsrf.Normal)
amp = Amplitude(Vector=neg_2, Amplitude=number_slider_4)
move = Move(Geometry=loft, Motion=amp)  # -> Geometry, Transform
amp_2 = Amplitude(Vector=evalsrf.Normal, Amplitude=number_slider_4)

reb = RebuildCurve(Curve=pline, Degree=Slider(2, range=0..10), Count=4, Tangents=False)  # -> flatten(Curve)
python = GhPythonScript(radii=expression)  # -> labels, tag, count, reverse(text); inputs radii: list
# ---------- python: Python ----------
__author__ = "Iliya Muzychuk"
__version__ = "2023.02.03"

import rhinoscriptsyntax as rs
import Grasshopper as gh
import Rhino.Geometry as rg
import ghpythonlib.components as comps

def createTagList(li):
    
    # Create a list of unique values
    unique_list = list(set(li))
    # Sort the unique list by numerical values
    unique_list.sort()
    print(unique_list)
    # Determine the starting letter based on the minimum value
    start_letter = 'A'
    
    # Create a list of letters starting from 'A'
    letter_list = [chr(ord(start_letter) + value - unique_list[0]) for value in unique_list]
    
    my_dict = dict(zip(unique_list,letter_list))
    
    print(my_dict)
    return my_dict

def countItems(li):

    # Convert the list to a set to get unique items
    unique_set = set(li)
    
    # Create a dictionary to store item counts
    my_dict = {}
    
    # Iterate through the unique items in the set and count their occurrences
    for item in unique_set:
        count = li.count(item)
        my_dict[item] = count
    
    print(my_dict)
    return my_dict
        
if __name__ == "__main__":
    
    #rounded_radii = [round(x) for x in radii]

    # Run the functions to count all offsets. 
    
    my_dict = createTagList(radii)
    count_dict = countItems(radii)
    
    # Create labels for each Circle 
    labels = [] 
    
    for item in radii:
        labels.append(my_dict[item])
    
    # Create a dictionary to count the values of all types 
    new_dic = {}
    text = []
    
    for key,value in my_dict.items():
        
        new_dic[value] = count_dict[key]
        
        string = '{} ({}" radius)'.format(value,key) + ': '+'{} of this type'.format(count_dict[key])
        text.append(string)
    
    tag = new_dic.keys()
    count = new_dic.values()
# ---------- end python ----------
lng = ListLength(List=reb)
random = Random(Range=Domain(10, 20), Number=lng, Seed=2)
tag = TextTag(Location=darc.BasePlane, Text=python.labels)
Z = UnitZ(Factor=random)
pt = Point(Point(147.389498, 108.1882147, 0))

lng_2 = ListLength(List=python.tag)
series = Series(Start=0, Step="3", Count=lng_2)
Y = UnitY(Factor=series)
move_2 = Move(Geometry=pt, Motion=Y)  # -> Geometry, Transform

extr = Extrude(Base=reb, Direction=Z)
cap = CapHoles(Brep=extr)
extr_2 = Extrude(Base=move.Geometry, Direction=amp_2)
tag_2 = TextTag(Location=move_2.Geometry, Text=python.text)
preview = CustomPreview(
    Geometry=extr_2,
    Material={diffuse=RGB(221, 160, 221), emission=RGB(66, 48, 66), shine=0.5, specular=RGB(255, 255, 255), transparency=0})
