# Grasshopper definition 23 1018 Circle Packing Algorithm_IM.gh (Grasshopper 1.0.7)
# plug-ins: Kangaroo2 Components

srf = Surface(graft(<surface referenced from the Rhino model>))
expression = Expression(x=Slider(36, range=1..100), Expression="x/12")
mesh = Mesh(<mesh referenced from the Rhino model>)
triremesh = TriRemesh(Geometry=srf, Length=expression, Iterations=25)  # -> Triangulation, Dual, Creases
mesh_2 = Mesh(triremesh.Triangulation)
medges = MeshEdges(Mesh=mesh_2)  # -> NakedEdges, InteriorEdges, NonManifoldEdges
join = JoinCurves(Curves=medges.NakedEdges, Preserve=False)
tangentincircles = TangentIncircles(Mesh=mesh_2, Boundary=join, Strength=Slider(35, range=0..100))
demesh = DeconstructMesh(Mesh=mesh_2)  # -> Vertices, Faces, Colours, Normals
show = Show(G=mesh_2)
onmesh = OnMesh(Points=demesh.Vertices, Mesh=mesh_2, Strength=1)
entwine = Entwine(Branch00=show, Branch01=[tangentincircles, onmesh], FlattenInputs=True)
solver = Solver(
    GoalObjects=entwine,
    Reset=Button(),
    Threshold=Slider(0.5, range=0..1),
    Tolerance=Slider(0.56, range=0..1),
    On=Toggle(True))  # -> I, V, O
bang = ExplodeTree(Data=solver.O)  # -> Branch0, Branch1
number_slider = Slider(1, range=0..1)
tc = TangentCircles(Mesh=bang.Branch0)  # -> Incircles, CirclePacking, Dual
crv = Curve(tc.CirclePacking)
boundaries = Curve(join)
circles = Curve(crv)
trim = TrimWithRegion(Curve=crv, Region=boundaries)  # -> Inside, Outside
darc = DeconstructArc(Arc=circles)  # -> BasePlane, Radius, Angle
inner_curves = Curve(flatten(trim.Outside))
expression_2 = Expression(x=darc.Radius, Expression="round(x)")
srf_cp = SurfaceClosestPoint(Point=darc.BasePlane, Surface=srf)  # -> Point, UVPoint, Distance
srf_2 = Surface(<surface referenced from the Rhino model>)
expression_3 = Expression(x=darc.Radius, Expression="round(X*12)")
python = GhPythonScript(radii=expression_3)  # -> labels, tag, count, reverse(text); inputs radii: list
# ---------- python: Python ----------
__author__ = "Iliya Muzychuk"
__version__ = "2023.02.03"

import rhinoscriptsyntax as rs
import Grasshopper as gh
import Rhino.Geometry as rg
import ghpythonlib.components as comps

def createTagList(li):
    
    # Create a list of unique values
    unique_list = list(set(li))
    # Sort the unique list by numerical values
    unique_list.sort()
    print(unique_list)
    # Determine the starting letter based on the minimum value
    start_letter = 'A'
    
    # Create a list of letters starting from 'A'
    letter_list = [chr(ord(start_letter) + value - unique_list[0]) for value in unique_list]
    
    my_dict = dict(zip(unique_list,letter_list))
    
    print(my_dict)
    return my_dict

def countItems(li):

    # Convert the list to a set to get unique items
    unique_set = set(li)
    
    # Create a dictionary to store item counts
    my_dict = {}
    
    # Iterate through the unique items in the set and count their occurrences
    for item in unique_set:
        count = li.count(item)
        my_dict[item] = count
    
    print(my_dict)
    return my_dict
        
if __name__ == "__main__":
    
    #rounded_radii = [round(x) for x in radii]

    # Run the functions to count all offsets. 
    
    my_dict = createTagList(radii)
    count_dict = countItems(radii)
    
    # Create labels for each Circle 
    labels = [] 
    
    for item in radii:
        labels.append(my_dict[item])
    
    # Create a dictionary to count the values of all types 
    new_dic = {}
    text = []
    
    for key,value in my_dict.items():
        
        new_dic[value] = count_dict[key]
        
        string = '{} ({}" radius)'.format(value,key) + ': '+'{} of this type'.format(count_dict[key])
        text.append(string)
    
    tag = new_dic.keys()
    count = new_dic.values()
# ---------- end python ----------
expression_4 = Expression(x=expression_3, Expression="(x-(1/8))/12")
evalsrf = EvaluateSurface(Surface=srf_2, Point=srf_cp.UVPoint)  # -> Point, Normal, UDirection, VDirection, Frame
tag = TextTag(Location=darc.BasePlane, Text=python.labels)
expression_5 = Expression(x=expression_4, Expression="x*12")
number_slider_2 = Slider(1, range=0..1)
cir = Circle(Plane=evalsrf.Point, Radius=expression_4)
cset = CreateSet(List=expression_3)  # -> Set, Map
cir_2 = Circle(Plane=darc.BasePlane, Radius=expression_4)

neg = Negative(Value=Slider(0.1, range=0..1))
offset = OffsetCurve(Curve=cir_2, Distance=neg, Corners=1)
merge = Merge(Data1=simplify(graft(cir_2)), Data2=simplify(graft(offset)))

neg_2 = Negative(Value=Slider(0.1, range=0..1))
offset_2 = OffsetCurve(Curve=cir, Distance=neg_2, Corners=1)
merge_2 = Merge(Data1=simplify(graft(cir)), Data2=simplify(graft(offset_2)))

python_2 = GhPythonScript(radii=expression_3)  # -> labels, tag, count, reverse(text); inputs radii: list
# ---------- python_2: Python ----------
__author__ = "Iliya Muzychuk"
__version__ = "2023.02.03"

import rhinoscriptsyntax as rs
import Grasshopper as gh
import Rhino.Geometry as rg
import ghpythonlib.components as comps

def createTagList(li):
    
    # Create a list of unique values
    unique_list = list(set(li))
    # Sort the unique list by numerical values
    unique_list.sort()
    print(unique_list)
    # Determine the starting letter based on the minimum value
    start_letter = 'A'
    
    # Create a list of letters starting from 'A'
    letter_list = [chr(ord(start_letter) + value - unique_list[0]) for value in unique_list]
    
    my_dict = dict(zip(unique_list,letter_list))
    
    print(my_dict)
    return my_dict

def countItems(li):

    # Convert the list to a set to get unique items
    unique_set = set(li)
    
    # Create a dictionary to store item counts
    my_dict = {}
    
    # Iterate through the unique items in the set and count their occurrences
    for item in unique_set:
        count = li.count(item)
        my_dict[item] = count
    
    print(my_dict)
    return my_dict
        
if __name__ == "__main__":
    
    #rounded_radii = [round(x) for x in radii]

    # Run the functions to count all offsets. 
    
    my_dict = createTagList(radii)
    count_dict = countItems(radii)
    
    # Create labels for each Circle 
    labels = [] 
    
    for item in radii:
        labels.append(my_dict[item])
    
    # Create a dictionary to count the values of all types 
    new_dic = {}
    text = []
    
    for key,value in my_dict.items():
        
        new_dic[value] = count_dict[key]
        
        string = '{}'.format(value) + ': '+'{} of this type'.format(count_dict[key])
        text.append(string)
    
    tag = new_dic.keys()
    count = new_dic.values()
# ---------- end python_2 ----------
tag_2 = TextTag(Location=evalsrf.Point, Text=python_2.labels)
pt = Point(Point(-132.8338078, -78.58814896, 0))

lng = ListLength(List=python.tag)
series = Series(Start=0, Step="3", Count=lng)
Y = UnitY(Factor=series)
move = Move(Geometry=pt, Motion=Y)  # -> Geometry, Transform

tag_3 = TextTag(Location=move.Geometry, Text=python_2.text)
