# Grasshopper definition 23 1208 MultipipeBlock.gh (Grasshopper 1.0.7)
# plug-ins: Kangaroo2 Components

pipeline = GeometryPipeline(
    GroupByLayer=False,
    GroupByType=False,
    IncludeHidden=True,
    IncludeLocked=True,
    LayerFilter="Facade*Base_Penthouse_Curves",
    NameFilter="*",
    SublayerFiltering=True,
    TypeFilter=4)
crv = Curve(pipeline)
Y = UnitY(Factor=Slider(0, range=0..1000))
move = Move(Geometry=crv, Motion=Y)  # -> Geometry, Transform
number_slider = Slider(1.89, range=0..10)

number_slider_2 = Slider(1, range=0..10)
number_slider_3 = Slider(1, range=0..1)

lng = ListLength(List=move.Geometry)
dom = ConstructDomain(DomainStart=Slider(0.45, range=0..1), DomainEnd=Slider(0.85, range=0..2))
random = Random(Range=dom, Number=lng, Seed=2)
midpt = CurveMiddle(Curve=move.Geometry)
mp = MultiPipe(NodeSize=0.5, EndOffset=1, StrutSize=1, Segment=0, KinkAngle=0.6, CubeFit=0, Caps=0)
mp_2 = MultiPipe(
    Curves=move.Geometry,
    NodeSize=random,
    SizePoints=midpt,
    EndOffset=Slider(0, range=0..1),
    StrutSize=Slider(0.9, range=0..3),
    Segment=0,
    KinkAngle=Slider(0, range=0..1),
    CubeFit=0,
    Caps=Slider(2, range=0..2))
filter = StreamFilter(
    Gate=Toggle(True),
    Stream0=ColourSwatch(SwatchColor=RGBA(112, 63, 255, 51)),
    Stream1=ColourSwatch(SwatchColor=RGB(160, 217, 255)))  # disabled
preview = CustomPreview(Geometry=mp_2, Material=filter)
