# Grasshopper definition 24 0121 Circle Packing Ring_IM.gh (Grasshopper 1.0.7)
# plug-ins: Kangaroo2 Components, RhinoCodePluginGH, Human

crv = Curve(<curve referenced from the Rhino model>)

start_radius = Slider(1, range=1..100)

number_slider = Slider(0, range=0..1)  # disabled
number_slider_2 = Slider(0.1, range=0..1)  # disabled
number_slider_3 = Slider(0.3, range=0..1)  # disabled
crv_2 = Curve(<curve referenced from the Rhino model>)
expression = Expression(x=start_radius, Expression="x/12")
boundary = BoundarySurfaces(Edges=crv)

# ---- group: gradually increase this until circles are packed
number_slider_4 = Slider(2, range=0..2)

# ----
neg = Negative(Value=number_slider)  # disabled
neg_2 = Negative(Value=number_slider_2)  # disabled
neg_3 = Negative(Value=number_slider_3)  # disabled
img = ImportImage(
    File="C:\Users\ilouh\Downloads\Slide 4_3 - 1.jpg",
    Rectangle=crv_2,
    XSamples=Slider(150, range=0..1000),
    YSamples=Slider(150, range=0..1000))
srf = Surface(graft(boundary))
merge = Merge(Data1=neg, Data2=neg_2, Data3=neg_3)  # disabled
N = Count(Slider(2000, range=0..2000))
mesh = Mesh(img)
triremesh = TriRemesh(Geometry=srf, Length=start_radius, Iterations=25)  # -> Triangulation, Dual, Creases
crv_3 = Curve(crv_2)
pop2d = Populate2D(Region=crv_2, Count=N, Seed=1)
multiplication = Multiplication(A=Slider(0.02, range=0..1), B=number_slider_4)
multiplication_2 = Multiplication(A=Slider(0.045, range=0..1), B=number_slider_4)
toggle = BooleanToggle(False)  # disabled
imgcircles = ImageCircles(Points=pop2d, Mesh=mesh, Min=multiplication, Max=multiplication_2, Curves=crv_3, Strength=1)

mesh_2 = Mesh(triremesh.Triangulation)
medges = MeshEdges(Mesh=mesh_2)  # -> NakedEdges, InteriorEdges, NonManifoldEdges
join = JoinCurves(Curves=medges.NakedEdges, Preserve=False)
tangentincircles = TangentIncircles(Mesh=mesh_2, Boundary=join, Strength=Slider(35, range=0..100))
show = Show(G=mesh_2)
demesh = DeconstructMesh(Mesh=mesh_2)  # -> Vertices, Faces, Colours, Normals
onmesh = OnMesh(Points=demesh.Vertices, Mesh=mesh_2, Strength=1)
entwine = Entwine(Branch00=show, Branch01=[tangentincircles, onmesh], FlattenInputs=True)
solver = Solver(
    GoalObjects=entwine,
    Reset=Button(),
    Threshold=Slider(0.46, range=0..1),
    Tolerance=Slider(0.56, range=0..1),
    On=Toggle(True))  # -> I, V, O
bang = ExplodeTree(Data=solver.O)  # -> Branch0, Branch1
tc = TangentCircles(Mesh=bang.Branch0)  # -> Incircles, CirclePacking, Dual

solver_2 = Solver(GoalObjects=imgcircles, Reset=Button(), Threshold=1e-15, Tolerance=0.01, On=Toggle(False))  # -> I, V, O
cir = Circle(Plane=solver_2.V, Radius=solver_2.O)
srf_2 = Surface(<surface referenced from the Rhino model>)
group = Group(Objects=srf_2)
crv_4 = Curve(simplify(graft([<curve referenced from the Rhino model> x20])))
bbox = BoundingBox(Content=group, Plane=PlaneXY(0, 0, 0))  # -> Box, Box_2
distributefaces = GhPythonScript(Massing=simplify(bbox.Box))  # -> floor, walls, roof; inputs Massing: list
# ---------- distributefaces: Python ----------
__author__ = "ilouh"
__version__ = "2023.01.08"

import rhinoscriptsyntax as rs
import ghpythonlib.components as comps
import Rhino.Geometry as geom


roof = []
floor = []
walls = [] 

#find the normal of each face

faces = comps.DeconstructBrep(Massing)['faces']
evaluation_point = comps.ConstructPoint(x_coordinate = 0.5, y_coordinate = 0.5, z_coordinate = 0)

for face in faces: 
    
    vector = comps.EvaluateSurface(face,evaluation_point)['normal']
    
    
    vector_a = comps.VectorXYZ(x_component = vector[0], y_component = vector[1], z_component = vector[2])['vector']
    vector_b = comps.UnitZ(1)

    cross_product = comps.CrossProduct(vector_a,vector_b,True)['vector']
    dot_product = round(comps.DotProduct(vector_a,vector_b,True),4)
    
    print(dot_product)
    
    if abs(dot_product) == 0: 
        walls.append(face)
    
    if dot_product > 0: 
        roof.append(face)
    
    if dot_product == -1: 
        floor.append(face)
# ---------- end distributefaces ----------
darc = DeconstructArc(Arc=crv_4)  # -> BasePlane, Radius, Angle
panel = Panel(darc.Radius)
area = Area(Geometry=distributefaces.floor)  # -> Area, Centroid
number_slider_5 = Slider(3, range=0..10)  # disabled
number_slider_6 = Slider(3, range=0..10)  # disabled
pt = Point(area.Centroid)

deplane = DeconstructPlane(Plane=darc.BasePlane)  # -> Origin, XAxis, YAxis, ZAxis
pl = ConstructPlane(Origin=deplane.Origin, XAxis=deplane.YAxis, YAxis=deplane.ZAxis)
deplane_2 = DeconstructPlane(Plane=pl)  # -> Origin, XAxis, YAxis, ZAxis

bnd = Bounds(Numbers=flatten(panel))
dom = ConstructDomain(DomainStart=Slider(0.01, range=0..1), DomainEnd=Slider(0.05, range=0..1))
series = Series(Start=0, Step=1, Count=number_slider_6)  # disabled
series_2 = Series(Start=0, Step=0.5, Count=number_slider_5)  # disabled
remap = RemapNumbers(Value=panel, Source=bnd, Target=dom)  # -> Mapped, Clipped

Z = UnitZ(Factor=remap.Mapped)
move = Move(Geometry=darc.BasePlane, Motion=Z)  # -> Geometry, Transform

ln = Line(StartPoint=darc.BasePlane, EndPoint=move.Geometry)
curvepoint = PointOnCurve(ln, parameter=0.75)
Z_2 = UnitZ(Factor=series)  # disabled
orient = Orient(Geometry=group, Source=pt, Target=darc.BasePlane)  # -> Geometry, Transform
amp = Amplitude(Vector=expr("-x", deplane_2.ZAxis), Amplitude=darc.Radius)
centerpoint = Point(deplane_2.Origin)

pdecon = Deconstruct(Point=curvepoint)  # -> XComponent, YComponent, ZComponent
move_2 = Move(Geometry=deplane_2.Origin, Motion=amp)  # -> Geometry, Transform
Z_3 = UnitZ(Factor=pdecon.ZComponent)

scale = Scale(Geometry=orient.Geometry, Center=centerpoint, Factor=remap.Mapped)  # -> Geometry, Transform
move_3 = Move(Geometry=move_2.Geometry, Motion=Z_3)  # -> Geometry, Transform
Z_4 = UnitZ(Factor=1)
pt_2 = Point(move_3.Geometry)
pt_3 = Point(curvepoint)
pt_4 = Point(deplane_2.Origin)
crv_5 = Curve(tc.CirclePacking)
crv_6 = Curve(simplify(graft(crv_5)))  # disabled
offset = OffsetCurve(Curve=crv_6, Distance=merge, Corners=1)  # disabled
lng = ListLength(List=flatten(offset))  # disabled
py3 = Python3Script(button=toggle, iterations=lng)  # -> domainStart, domainEnd; inputs iterations: Int32; disabled
# ---------- py3: Python ----------
"""Grasshopper Script Instance"""
import System
import Rhino
import Grasshopper

import rhinoscriptsyntax as rs

import random


def randomDomain(s):

    random.seed(s)

    x = random.randint(0,50)
    y = random.randint(x,100)

    a = x/100
    b = y/100

    return [a,b]

domainStart = [] 
domainEnd = []

if button == True:

    for i in range(0,iterations):

        domain = randomDomain(i)

        domainStart.append(domain[0])
        domainEnd.append(domain[1])

        print(domainStart)
        print(domainEnd)
# ---------- end py3 ----------
merge_2 = Merge(Data1=graft(py3.domainStart), Data2=graft(py3.domainEnd))  # disabled
crv_7 = Curve(reparameterize(offset))  # disabled
panel_2 = Panel(merge_2)  # disabled
shatter = Shatter(Curve=simplify(crv_7), Parameters=simplify(merge_2))  # disabled
panel_3 = Panel(shatter)  # disabled
item = ListItem(List=shatter, Index=0, Wrap=True)  # disabled
trim = TrimTree(Tree=item, Depth=1)  # disabled
trim_2 = TrimTree(Tree=trim, Depth=1)  # disabled
lng_2 = ListLength(List=trim_2)  # disabled
range = Range(Domain=Domain(0, 1), Steps=expr("x-1", lng_2))  # disabled
graph = GraphMapper(range, x0=0, x1=1, y0=0, y1=1, Ox=0.5649254918, Oy=0.3315553665, Px=0.75, Py=0.25, container_name="Parabola")  # disabled
panel_4 = Panel(graph)  # disabled
move_4 = Move(Geometry=trim, Motion=Z_2)  # -> Geometry, Transform; disabled
offset_2 = OffsetCurve(Curve=move_4.Geometry, Distance=graph, Corners=1)  # disabled
trim_3 = TrimTree(Tree=offset_2, Depth=1)  # disabled
loft = Loft(Curves=trim_3, Options={Adjust=False, Closed=False, LoftEnds=0, LoftSimp=0, LoftType=0, Rebuild=10, Refit=0.01})  # disabled
arc = ArcSED(Start=pt_4, End=pt_2, Direction=Z_4)  # -> Arc, Plane, Radius
bend = BendDeform(Geometry=scale.Geometry, BendingArc=arc.Arc)
previewmat = CustomPreviewMaterials(Geometry=bend, DiffuseColor=ColourSwatch(SwatchColor=RGB(186, 137, 255)))
