# Grasshopper definition 24 0401 Circle Packing Algorithm_IM.gh (Grasshopper 1.0.8)
# plug-ins: Kangaroo2 Components

srf = Surface(graft(<surface referenced from the Rhino model>))
reset_button = Button()
expression = Expression(x=Slider(12, range=0..250), Expression="x/12")
triremesh = TriRemesh(Geometry=srf, Length=expression, Iterations=25)  # -> Triangulation, Dual, Creases
mesh = Mesh(triremesh.Triangulation)
medges = MeshEdges(Mesh=mesh)  # -> NakedEdges, InteriorEdges, NonManifoldEdges
join = JoinCurves(Curves=medges.NakedEdges, Preserve=False)
tangentincircles = TangentIncircles(Mesh=mesh, Boundary=join, Strength=Slider(35, range=0..100))
demesh = DeconstructMesh(Mesh=mesh)  # -> Vertices, Faces, Colours, Normals
show = Show(G=mesh)
onmesh = OnMesh(Points=demesh.Vertices, Mesh=mesh, Strength=1)
entwine = Entwine(Branch00=show, Branch01=[tangentincircles, onmesh], FlattenInputs=True)
solver = Solver(
    GoalObjects=entwine,
    Reset=reset_button,
    Threshold=Slider(0.05, range=0..1),
    Tolerance=Slider(0.05, range=0..1),
    On=Toggle(True))  # -> I, V, O
bang = ExplodeTree(Data=solver.O)  # -> Branch0, Branch1
tc = TangentCircles(Mesh=bang.Branch0)  # -> Incircles, CirclePacking, Dual
crv = Curve(tc.CirclePacking)
