# Grasshopper definition CIRCLEPACKING_IMAGE.gh (Grasshopper 1.0.7)
# plug-ins: Kangaroo2 Components

curve = Curve(<curve referenced from the Rhino model>)
triremesh = TriRemesh(Geometry=curve, Length=Slider(5, range=0..10), Iterations=25)  # -> Triangulation, Dual, Creases
mesh_edges = MeshEdges(Mesh=triremesh.Triangulation)  # -> NakedEdges, InteriorEdges, NonManifoldEdges
deconstruct_mesh = DeconstructMesh(Mesh=triremesh.Triangulation)  # -> Vertices, Faces, Colours, Normals
image_sampler = ImageSampler(deconstruct_mesh.Vertices, Filter="Colour", Interpolate=False, Umax=1600, Umin=100, Vmax=900, Vmin=100, Wrap=2)

# ---- group: Selects only point within the curve
point_in_curve = PointInCurve(Point=deconstruct_mesh.Vertices, Curve=curve)  # -> Relationship, Point
larger_than = LargerThan(FirstNumber=point_in_curve.Relationship, SecondNumber=2)  # -> LargerThan, OrEqualTo

# ----
mesh_colours = MeshColours(Mesh=triremesh.Triangulation, Colours=image_sampler)
cull_pattern = CullPattern(List=deconstruct_mesh.Vertices, CullPattern=larger_than.OrEqualTo)
imagecircles = ImageCircles(
    Points=cull_pattern,
    Mesh=mesh_colours,
    Min=Slider(1.5, range=0..10),
    Max=Slider(5, range=0..10),
    Curves=curve,
    Strength=1)
solver = Solver(GoalObjects=imagecircles, Reset=Button(), Threshold=1e-15, Tolerance=0.0001, On=Toggle(True))  # -> I, V, O
circle_cnr = CircleCNR(Center=solver.V, Normal=Vector(0, 0, 1), Radius=solver.O)
