# Grasshopper definition Ceramic Printer.gh (Grasshopper 1.0.8)

pipeline = GeometryPipeline(
    GroupByLayer=False,
    GroupByType=False,
    IncludeHidden=True,
    IncludeLocked=True,
    LayerFilter="03_ARCH",
    NameFilter="*",
    SublayerFiltering=True,
    TypeFilter=1073741848)
materials = QueryModelMaterials(AutoUpdateState=True)
materials_2 = QueryModelMaterials(AutoUpdateState=True)
brep = Brep(pipeline)
panel = Panel(materials)
item = ListItem(List=materials, Index=Slider(11, range=0..50), Wrap=True)
item_2 = ListItem(List=materials_2, Index=Slider(0, range=0..50), Wrap=True)
material = ModelMaterial(Material=item)  # -> Material, Name, Shader
material_2 = ModelMaterial(Material=item_2)  # -> Material, Name, Shader
pt = ConstructPoint(XCoordinate=0, YCoordinate=0, ZCoordinate=0)
number_slider = Slider(12, range=0..12)
number_slider_2 = Slider(1, range=0..1)
bbox = BoundingBox(Content=brep, Plane=PlaneXY(0, 0, 0))  # -> Box, Box_2
number_slider_3 = Slider(0.95, range=0..1)
volume = Volume(Geometry=bbox.Box)  # -> Volume, Centroid
contour = Contour(Shape=brep, Point=pt, Direction=Vector(0, 0, 1), Distance=number_slider)
fillet = Fillet(Curve=contour, Radius=number_slider)  # -> flatten(Curve)
scale_nu = ScaleNU(Geometry=brep, Plane=volume.Centroid, ScaleX=number_slider_3, ScaleY=number_slider_3, ScaleZ=Slider(0.8, range=0..1))  # -> Geometry, Transform
pipe = Pipe(Curve=flatten(fillet), Radius=expr("x/1.75", number_slider), Caps=0)
cap = CapHoles(Brep=scale_nu.Geometry)
preview = CustomPreview(Geometry=cap, Material=material_2.Material)
preview_2 = CustomPreview(Geometry=pipe, Material=material.Material)
