# Grasshopper definition IM_SplineToArc.gh (Grasshopper 1.0.7)
# plug-ins: LunchBox

number_slider = Slider(0.1, range=0..1)
crv = Curve(reparameterize(<curve referenced from the Rhino model>))
expression = Expression(x=number_slider, Expression="round(1/x)")
series = Series(Start=0, Step=number_slider, Count=expression)
ins = InsertItems(List=series, Item=1, Indices=-1, Wrap=True)
arcdivide = ArcDivide(Curve=crv, TParameters=ins)  # -> Arcs, Centers
panel = Panel(series)
join = JoinCurves(Curves=arcdivide.Arcs, Preserve=False)
area = Area(Geometry=join)  # -> Area, Centroid
len = Length(Curve=join)
panel_2 = Panel(len)
