# Grasshopper definition compactcircles_multiboundary.gh (Grasshopper 1.0.7)
# plug-ins: Kangaroo2 Components

brep = Brep(<brep referenced from the Rhino model>)
triremesh = TriRemesh(Geometry=brep, Length="3", Iterations=25)  # -> Triangulation, Dual, Creases
wires = BrepWireframe(Brep=brep, Density=-1)
join = JoinCurves(Curves=wires, Preserve=False)
crv = Curve(<curve referenced from the Rhino model>)
offset = OffsetCurve(Curve=crv, Distance=1, Plane=PlaneXY(0, 0, 0), Corners=1)
boundary = BoundarySurfaces(Edges=crv)
boundary_2 = BoundarySurfaces(Edges=flatten(offset))
brep_2 = Brep(brep)
brep_3 = Brep(brep)
mesh = MeshBrep(
    Brep=brep_2,
    Settings={GridMaxCount=0, GridMinCount=16, JaggedSeams=False, MaxEdgeLength=0.5, MinEdgeLength=0.0001, MinTolerance=0, Refine=True, RefineAngle=0, RelativeTolerance=0.65, SimplePlanes=False, Tolerance=0})
triremesh_2 = TriRemesh(Geometry=brep_3, Length="5", Iterations=25)  # -> Triangulation, Dual, Creases
demesh = DeconstructMesh(Mesh=triremesh_2.Triangulation)  # -> Vertices, Faces, Colours, Normals
tangentincircles = TangentIncircles(Mesh=triremesh_2.Triangulation, Strength=10)
onmesh = OnMesh(Points=demesh.Vertices, Mesh=mesh, Strength=1)
c_script = CSharpScript(
    M=triremesh_2.Triangulation,
    C=join,
    k=1000,
    Reference="C:\Program Files\Rhino 7\Plug-ins\Grasshopper\Components\KangarooSolver.dll")  # -> out, A, B; inputs M: Mesh, C: list of Curve, k: Double
# ---------- c_script: C# usings ----------
using System.Linq;
using KangarooSolver;
# ---------- c_script: C# ----------
    // List<KangarooSolver.IGoal> g = new List<KangarooSolver.IGoal>();

    bool[] naked = M.GetNakedEdgePointStatus();
    Point3d[] vertPts = M.Vertices.ToPoint3dArray();

    List<Point3d> P = new List<Point3d>();

    for(int i = 0;i < M.Vertices.Count;i++)
    {
      if(naked[i])
      {
        Point3d[] pts;
        int f = M.Vertices.GetVertexFaces(i)[0];
        for(int j = 0;j < 3;j++)
        {
          if(M.Faces[f][j] == i)
          {
            pts = new Point3d[3]{vertPts[M.Faces[f][j]],vertPts[M.Faces[f][(j + 1) % 3]],vertPts[M.Faces[f][(j + 2) % 3]]};
            P.AddRange(pts);
            // g.Add(new BoundaryTangentCircle(pts, C, k));
            break;
          }
        }
      }
    }

    A = new BoundaryTangentCircle(P.ToArray(), C, k);

    B = P;
# ---------- c_script: C# additional code ----------
  public class BoundaryTangentCircle : GoalObject
  {
    //input a list of 3n points and a curve
    //first pt is the naked mesh point, and the next 2 are consistently ordered
    //verts of a connected face, and so on

    public List<Curve> Crv;
    public BoundaryTangentCircle(Point3d[] P, List<Curve> C, double k)
    {
      PPos = P;
      Crv = C;
      Move = new Vector3d[P.Length];
      Weighting = new double[P.Length];
      for(int i = 0;i < P.Length;i += 3)
      {
        Weighting[i] = k;
        Weighting[i + 1] = 0;
        Weighting[i + 2] = 0;
      }
    }
    public override void Calculate(List<KangarooSolver.Particle> p)
    {
      Point3d[] pts = this.GetCurrentPositions(p);
      for(int i = 0;i < pts.Length;i += 3)
      {
        //use semiperimeter minus this opposite edge to get radius
        //pull towards this distance from the curve
        double[] lengths = new double[3];
        Vector3d v01 = pts[i + 1] - pts[i];
        Vector3d v12 = pts[i + 2] - pts[i + 1];
        lengths[0] = v01.Length;
        lengths[1] = v12.Length;
        //        lengths[0] = pts[i].DistanceTo(pts[i + 1]);
        //        lengths[1] = pts[i + 1].DistanceTo(pts[i + 2]);
        lengths[2] = pts[i + 2].DistanceTo(pts[i]);
        double radius = 0.5 * (lengths[0] + lengths[1] + lengths[2]) - lengths[1];

        Vector3d v = new Vector3d();
        double d = double.MaxValue;
        for(int j = 0;j < Crv.Count;j++)
        {
          double t = 0;
          Crv[j].ClosestPoint(pts[i], out t);
          Point3d closest = Crv[j].PointAt(t);
          double dist = closest.DistanceToSquared(pts[i]);
          if(dist < d)
          {
            v = Crv[j].PointAt(t) - pts[i];
            d = dist;
          }

        }

        //Vector3d tangent = Crv.TangentAt(t);
        //Vector3d normal = Vector3d.CrossProduct(v01, v12);

        double diff;
        // if(normal * (Vector3d.CrossProduct(tangent, v)) < 0)
        {
          diff = v.Length - radius;
        }
        //  else
        {
          //   diff = v.Length + radius;
        }
        v.Unitize();
        Move[i] = v * 0.5 * diff;

      }

    }

    public override object Output(List<KangarooSolver.Particle> p)
    {
      Point3d[] pts = this.GetCurrentPositions(p);

      return pts;
    }

  }
# ---------- end c_script ----------
show = Show(G=triremesh_2.Triangulation)
entwine = Entwine(Branch00=show, Branch01=[tangentincircles, onmesh, c_script.A], FlattenInputs=True)
solver = Solver(GoalObjects=entwine, Reset=Button(), Threshold=1e-15, Tolerance=0.01, On=Toggle(False))  # -> I, V, O
bang = ExplodeTree(Data=solver.O)  # -> Branch0, Branch1
tc = TangentCircles(Mesh=bang.Branch0)  # -> Incircles, CirclePacking, Dual
mesh_2 = Mesh(bang.Branch0)
crv_2 = Curve(tc.CirclePacking)
