# Grasshopper definition Furniture_Bookshelf.gh (Grasshopper 1.0.8)
# plug-ins: RhinoCodePluginGH

shelves = Python3Script(
    width=Slider(49, range=0..84),
    height=Slider(76, range=0..140),
    depth=Slider(18, range=0..36),
    num_shelves=Slider(6, range=0..10),
    side_thickness=Slider(1, range=0..10),
    shelf_thickness=Slider(1, range=0..10),
    back_thickness=Slider(1, range=0..10),
    show_back=Toggle(False),
    show_sides=Toggle(False),
    show_posts=Toggle(True),
    num_posts=Slider(2, range=0..10),
    post_dia=Slider(1, range=0..10))  # -> a
# ---------- shelves: Python ----------
import Rhino.Geometry as rg

def create_box(x0, x1, y0, y1, z0, z1):
    """
    Creates an axis-aligned box (as a Brep) given the specified extents.
    """
    box = rg.Box(rg.Plane.WorldXY, rg.Interval(x0, x1), rg.Interval(y0, y1), rg.Interval(z0, z1))
    return box.ToBrep()

# Convert shelf and post counts to integers (in case sliders output floats)
num_shelves = int(num_shelves)
num_posts   = int(num_posts)

# Determine lateral offsets for panels based on whether side panels are shown.
if show_sides:
    left_offset = side_thickness
    right_offset = side_thickness
else:
    left_offset = 0
    right_offset = 0

# List to hold all bookshelf parts
bookshelf_parts = []

# --- Side Panels ---
if show_sides:
    # Left side panel: from X = 0 to side_thickness
    left_panel = create_box(0, side_thickness, 0, depth, 0, height)
    bookshelf_parts.append(left_panel)
    # Right side panel: from X = (width - side_thickness) to width.
    right_panel = create_box(width - side_thickness, width, 0, depth, 0, height)
    bookshelf_parts.append(right_panel)

# --- Top and Bottom Panels ---
# Bottom panel: spans between side panels (or full width if sides are off)
bottom_panel = create_box(left_offset, width - right_offset, 0, depth, 0, shelf_thickness)
bookshelf_parts.append(bottom_panel)

# Top panel: from (height - shelf_thickness) to height.
top_panel = create_box(left_offset, width - right_offset, 0, depth, height - shelf_thickness, height)
bookshelf_parts.append(top_panel)

# --- Shelves ---
# The vertical cavity between bottom and top panels:
cavity_height = height - 2 * shelf_thickness
for i in range(1, num_shelves + 1):
    center = shelf_thickness + (cavity_height * i) / (num_shelves + 1)
    z0 = center - shelf_thickness / 2.0
    z1 = center + shelf_thickness / 2.0
    shelf = create_box(left_offset, width - right_offset, 0, depth, z0, z1)
    bookshelf_parts.append(shelf)

# --- Back Panel ---
if show_back:
    back_panel = create_box(0, width, depth - back_thickness, depth, 0, height)
    bookshelf_parts.append(back_panel)

# --- Posts ---
if show_posts:
    # Calculate the inset distance as one-sixth of the width.
    inset = width / 6.0
    # Use the larger of the side panel offset or the desired inset.
    if show_sides:
        effective_x_min = max(left_offset, inset)
        effective_x_max = min(width - right_offset, width - inset)
    else:
        effective_x_min = inset
        effective_x_max = width - inset

    effective_width = effective_x_max - effective_x_min

    # Compute X positions: evenly distribute posts along the effective width.
    x_positions = []
    if num_posts <= 1:
        x_positions = [effective_x_min + effective_width / 2.0]
    else:
        for i in range(num_posts):
            x_positions.append(effective_x_min + i * effective_width / (num_posts - 1))
    
    # Define Y positions for the two rows of posts (typically at 25% and 75% of depth)
    y_positions = [depth * 0.25, depth * 0.75]
    
    # Create posts as cylinders (using the user's working approach)
    for x in x_positions:
        for y in y_positions:
            base_point = rg.Point3d(x, y, 0)
            circle = rg.Circle(base_point, post_dia / 2.0)
            cylinder = rg.Cylinder(circle, height)
            # In your working version you simply set the post_brep to the cylinder object.
            post_brep = cylinder  
            bookshelf_parts.append(post_brep)

# --- Output ---
a = bookshelf_parts
# ---------- end shelves ----------
brep = Brep(shelves)
custom_preview = CustomPreview(Geometry=brep, Material=ColourSwatch(SwatchColor=RGB(92, 66, 89)))
